# Grasshopper definition MathDomain028.gh (Grasshopper 1.0.7)
# Copyright: Wickerson Studios
# plug-ins: Bifocals

# 1001 GRASSHOPPER DEFINITIONS
# Wickerson Studio
# 
# created by: Michael Wickerson
# 
# Grasshopper for Rhino 3D Algorithmic Modeling
# 
# www.wickersonstudios.com
# www.michaelwickerson.com
# https://www.youtube.com/channel/UC7J48Ppcsa6oncp6d29R0xw
# https://github.com/mwickerson
# https://www.facebook.com/michael.wickerson
# https://www.linkedin.com/in/michael-wickerson-696a80156/
# https://www.grasshopper3d.com/profile/MichaelWickerson
image_sampler = ImageSampler(
    FilePath="C:\Users\Sculpture\Documents\2020Grasshopper\ScreenShots2019\Screenshots2020\SurfaceEditAlgorithm.PNG",
    Filter="Value",
    Interpolate=False,
    Umax=1,
    Umin=0,
    Vmax=1,
    Vmin=0,
    Wrap=1)  # disabled

# ----
# Wickerson Studio
# created by: Michael Wickerson
# Grasshopper for Rhino 3D Algorithmic Modeling
# www.wickersonstudios.com
# www.michaelwickerson.com
# https://www.youtube.com/channel/UC7J48Ppcsa6oncp6d29R0xw
# https://github.com/mwickerson
# https://www.facebook.com/michael.wickerson
# https://www.linkedin.com/in/michael-wickerson-696a80156/
# https://www.grasshopper3d.com/profile/MichaelWickerson
construct_domain = ConstructDomain(DomainStart=0, DomainEnd=1)
consecutive_domains = ConsecutiveDomains(Numbers=[0, 0.5, 1, 1.5, 2], Additive=True)
bounds = Bounds()
remap_numbers = RemapNumbers(Source=Domain(0, 1), Target=Domain(0, 1))  # -> Mapped, Clipped
remap = Remap(min=0, max=1)
divide_domain = DivideDomain(Domain=Domain(0, 1), Count=10)
deconstruct_domain = DeconstructDomain()  # -> Start, End

find_domain = FindDomain(Strict=False)  # -> Index, Neighbour
includes = Includes(Domain=Domain(0, 1))  # -> Includes, Deviation

# ----
# Math Domain  028/1001
number_slider = Slider(2, range=0..10)
construct_domain_2 = ConstructDomain(DomainStart=number_slider, DomainEnd=Slider(20, range=0..100))
deconstruct_domain_2 = DeconstructDomain(Domain=construct_domain_2)  # -> Start, End
construct_point = ConstructPoint(XCoordinate=deconstruct_domain_2.Start, YCoordinate=0, ZCoordinate=0)
construct_point_2 = ConstructPoint(XCoordinate=deconstruct_domain_2.End, YCoordinate=0, ZCoordinate=0)
number_slider_2 = Slider(2.253, range=0..4)
domain_box = DomainBox(Base=PlaneXY(0, 0, 0), X=construct_domain_2, Y=Domain(-0.5, 0.5), Z=Domain(0, 0.25))
distance = Distance(PointA=construct_point, PointB=construct_point_2)
volume = Volume(Geometry=domain_box)  # -> Volume, Centroid
construct_domain_3 = ConstructDomain(DomainStart=number_slider_2, DomainEnd=Slider(6, range=0..10))
bounds_2 = Bounds(Numbers=distance)
remap_2 = Remap(data=distance, min=number_slider_2, max=Slider(6, range=0..10))
remap_numbers_2 = RemapNumbers(Value=distance, Source=bounds_2, Target=construct_domain_3)  # -> Mapped, Clipped
negative = Negative(Value=remap_numbers_2.Mapped)
construct_point_3 = ConstructPoint(XCoordinate=volume.Centroid, YCoordinate=0, ZCoordinate=remap_2)
construct_point_4 = ConstructPoint(XCoordinate=volume.Centroid, YCoordinate=[remap_numbers_2.Mapped, negative], ZCoordinate=remap_numbers_2.Mapped)
arc_3pt = Arc3Pt(PointA=construct_point, PointB=construct_point_4, PointC=construct_point_2)  # -> graft(Arc), Plane, Radius
arc_3pt_2 = Arc3Pt(PointA=construct_point, PointB=construct_point_3, PointC=construct_point_2)  # -> Arc, Plane, Radius
explode_tree = ExplodeTree(Data=arc_3pt.Arc)  # -> Branch0, Branch1
point_on_curve = PointOnCurve(arc_3pt.Arc, parameter=0.506)
explode_tree_2 = ExplodeTree(Data=point_on_curve)  # -> Branch0, Branch1
arc_3pt_3 = Arc3Pt(PointA=explode_tree_2.Branch0, PointB=construct_point_3, PointC=explode_tree_2.Branch1)  # -> Arc, Plane, Radius
arc_3pt_4 = Arc3Pt(PointA=explode_tree.Branch0, PointB=construct_point_3, PointC=explode_tree.Branch1)  # -> Arc, Plane, Radius
end_points = EndPoints(Curve=arc_3pt_4.Arc)  # -> Start, End
line = Line(StartPoint=end_points.Start, EndPoint=end_points.End)
point_on_curve_2 = PointOnCurve(line, parameter=0.587)
merge = Merge(Data1=line, Data2=arc_3pt_4.Arc, Data3=arc_3pt_3.Arc, Data4=arc_3pt.Arc, Data5=arc_3pt_2.Arc)
gene_pool = GenePool(Decimals=2, Maximum=1, Minimum=0, Value=[0.3073893475, 0.4310230368, 0.5397306916])
line_2 = Line(StartPoint=construct_point_3, EndPoint=construct_point_4)
evaluate_curve = EvaluateCurve(Curve=line_2, Parameter=gene_pool)  # -> Point, Tangent, Angle
list_item = ListItem(List=evaluate_curve.Point, Index=0, Wrap=True)  # -> Item, Item1, Item2
deconstruct = Deconstruct(Point=list_item.Item)  # -> XComponent, YComponent, ZComponent
deconstruct_2 = Deconstruct(Point=list_item.Item1)  # -> XComponent, YComponent, ZComponent
deconstruct_3 = Deconstruct(Point=list_item.Item2)  # -> XComponent, YComponent, ZComponent
number_slider_3 = Slider(2, range=0..2)
consecutive_domains_2 = ConsecutiveDomains(Numbers=[deconstruct.XComponent, deconstruct_2.XComponent, deconstruct_3.XComponent], Additive=True)
consecutive_domains_3 = ConsecutiveDomains(Numbers=[deconstruct.YComponent, deconstruct_2.YComponent, deconstruct_3.YComponent], Additive=True)
consecutive_domains_4 = ConsecutiveDomains(Numbers=[deconstruct.ZComponent, deconstruct_2.ZComponent, deconstruct_3.ZComponent], Additive=True)
domain_box_2 = DomainBox(Base=list_item.Item, X=Domain(-2, 2), Y=consecutive_domains_2, Z=consecutive_domains_2)
domain_box_3 = DomainBox(Base=list_item.Item1, X=consecutive_domains_3, Y=Domain(-0.5, 0.5), Z=consecutive_domains_3)
domain_box_4 = DomainBox(Base=list_item.Item2, X=consecutive_domains_4, Y=consecutive_domains_4, Z=Domain(0, 0.25))
value_list = ValueList({"One": 0, "Two": 1, "Three": 2}, selected="Three")
boolean_toggle = BooleanToggle(True)
merge_2 = Merge(Data1=domain_box_2, Data2=domain_box_3, Data3=domain_box_4)
pi = Pi(Factor=number_slider_3)
scale = Scale(Geometry=merge_2, Center=Point(0, 0, 0), Factor=Slider(0.3, range=-0.6..0.4))  # -> Geometry, Transform
panel = Panel(value_list)
pipe = Pipe(Curve=merge, Radius=number_slider_3, Caps=value_list)
polar_array = PolarArray(Geometry=scale.Geometry, Plane=point_on_curve_2, Count=Slider(7, range=0..10), Angle=pi)  # -> Geometry, Transform
mirror = Mirror(Geometry=[pipe, polar_array.Geometry], Plane=point_on_curve_2)  # -> Geometry, Transform
merge_3 = Merge(Data1=polar_array.Geometry, Data2=pipe, Data3=mirror.Geometry)

number_slider_4 = Slider(2, range=0..10)
divide_domain_2 = DivideDomain(Domain=construct_domain_3, Count=number_slider_4)

divide_domain_3 = DivideDomain(Domain=construct_domain_3, Count=number_slider_4)
panel_2 = Panel(divide_domain_2)
gradient = Gradient(
    LowerLimit=0,
    UpperLimit=1,
    Parameter=Slider(0.51, range=0..1),
    stops=[0: RGB(234, 38, 0), 0.25: RGB(234, 126, 0), 0.5: RGB(254, 244, 84), 0.75: RGB(173, 203, 249), 1: RGB(75, 107, 169)])
gradient_2 = Gradient(LowerLimit=0, UpperLimit=1, Parameter=Slider(0.56, range=0..1), stops=[0.15: RGB(255, 130, 160), 0.85: RGB(220, 0, 40)])
gradient_3 = Gradient(
    LowerLimit=0,
    UpperLimit=1,
    Parameter=Slider(0.54, range=0..1),
    stops=[0: RGB(243, 57, 0), 0.1: RGB(236, 27, 60), 0.2: RGB(210, 0, 118), 0.3: RGB(103, 0, 120), 0.4: RGB(39, 72, 161), 0.6: RGB(18, 178, 90), 0.7: RGB(79, 186, 8), 0.8: RGB(220, 237, 32), 0.9: RGB(247, 159, 20), 1: RGB(243, 57, 0)])
gradient_4 = Gradient(LowerLimit=0, UpperLimit=1, Parameter=Slider(0.97, range=0..1), stops=[0.704: RGB(173, 203, 249), 1: RGB(75, 107, 169)])
custom_preview = CustomPreview(Geometry=mirror.Geometry, Material=gradient)
custom_preview_2 = CustomPreview(Geometry=polar_array.Geometry, Material=gradient_2)
custom_preview_3 = CustomPreview(Geometry=pipe, Material=gradient_3)
custom_preview_4 = CustomPreview(Geometry=scale.Geometry, Material=gradient_4)

# ==== cluster Remap: Remaps numbers
data = ClusterInput()
min = ClusterInput()
max = ClusterInput()
bnd = Bounds(Numbers=data)
dom = ConstructDomain(DomainStart=min, DomainEnd=max)
remap = RemapNumbers(Value=data, Source=bnd, Target=dom)  # -> Mapped, Clipped
R = ClusterOutput(remap.Mapped)
