# Grasshopper definition MathDomain029.gh (Grasshopper 1.0.7)
# Copyright: Wickerson Studios
# plug-ins: Bifocals

image_sampler = ImageSampler(
    FilePath="C:\Users\Sculpture\Documents\2020Grasshopper\ScreenShots2019\Screenshots2020\SurfaceEditAlgorithm.PNG",
    Filter="Value",
    Interpolate=False,
    Umax=1,
    Umin=0,
    Vmax=1,
    Vmin=0,
    Wrap=1)  # disabled

divide_domain = DivideDomain(Domain=Domain(0, 1), Count=10)
# 1001 GRASSHOPPER DEFINITIONS
# Wickerson Studio
# 
# created by: Michael Wickerson
# 
# Grasshopper for Rhino 3D Algorithmic Modeling
# 
# www.wickersonstudios.com
# www.michaelwickerson.com
# https://www.youtube.com/channel/UC7J48Ppcsa6oncp6d29R0xw
# https://github.com/mwickerson
# https://www.facebook.com/michael.wickerson
# https://www.linkedin.com/in/michael-wickerson-696a80156/
# https://www.grasshopper3d.com/profile/MichaelWickerson
find_domain = FindDomain(Strict=False)  # -> Index, Neighbour
# Wickerson Studio
# created by: Michael Wickerson
# Grasshopper for Rhino 3D Algorithmic Modeling
# www.wickersonstudios.com
# www.michaelwickerson.com
# https://www.youtube.com/channel/UC7J48Ppcsa6oncp6d29R0xw
# https://github.com/mwickerson
# https://www.facebook.com/michael.wickerson
# https://www.linkedin.com/in/michael-wickerson-696a80156/
# https://www.grasshopper3d.com/profile/MichaelWickerson
includes = Includes(Domain=Domain(0, 1))  # -> Includes, Deviation

# ----
# Math Domain  029/1001
number_slider = Slider(0, range=0..100)
number_slider_2 = Slider(21, range=21..100)
construct_domain = ConstructDomain(DomainStart=number_slider, DomainEnd=Slider(5, range=0..5))
construct_domain_2 = ConstructDomain(DomainStart=Slider(6, range=6..7), DomainEnd=Slider(20, range=0..100))
construct_domain_3 = ConstructDomain(DomainStart=number_slider, DomainEnd=Slider(64, range=0..200))
merge = Merge(Data1=construct_domain, Data2=construct_domain_2, Data3=construct_domain_3)
number_slider_3 = Slider(100, range=0..100)
find_domain_2 = FindDomain(Domains=merge, Number=Slider(57.357, range=0.1..100), Strict=Toggle(True))  # -> Index, Neighbour
panel = Panel(find_domain_2.Index)
list_item = ListItem(List=merge, Index=find_domain_2.Index, Wrap=True)
divide_domain_2 = DivideDomain(Domain=list_item, Count=Slider(9, range=0..10))
includes_2 = Includes(Value=find_domain_2.Neighbour, Domain=divide_domain_2)  # -> Includes, Deviation
includes_3 = Includes(Value=number_slider_3, Domain=divide_domain_2)  # -> Includes, Deviation
panel_2 = Panel(includes_2.Includes)
panel_3 = Panel(includes_3.Deviation)
panel_4 = Panel(list_item)
panel_5 = Panel(includes_2.Deviation)
panel_6 = Panel(includes_3.Includes)
domain_box = DomainBox(Base=PlaneXY(0, 0, 0), X=construct_domain, Y=panel_4, Z=panel_3)
construct_domain_4 = ConstructDomain(DomainStart=0, DomainEnd=number_slider_3)
list_length = ListLength(List=domain_box)
range = Range(Domain=construct_domain_4, Steps=list_length)
unit_x = UnitX(Factor=range)
move = Move(Geometry=domain_box, Motion=unit_x)  # -> graft(Geometry), Transform

explode_tree = ExplodeTree(Data=move.Geometry)  # -> _0000, _0001, _0002, _0003, _0004, _0005, _0006, _0007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
gradient = Gradient(
    LowerLimit=0,
    UpperLimit=1,
    Parameter=Slider(0.12, range=0..1),
    stops=[0: RGB(234, 38, 0), 0.25: RGB(234, 126, 0), 0.5: RGB(254, 244, 84), 0.75: RGB(173, 203, 249), 1: RGB(75, 107, 169)])
gradient_2 = Gradient(
    LowerLimit=0,
    UpperLimit=1,
    Parameter=Slider(0.66, range=0..1),
    stops=[0: RGB(234, 38, 0), 0.25: RGB(234, 126, 0), 0.5: RGB(254, 244, 84), 0.75: RGB(173, 203, 249), 1: RGB(75, 107, 169)])
gradient_3 = Gradient(
    LowerLimit=0,
    UpperLimit=1,
    Parameter=Slider(0.51, range=0..1),
    stops=[0: RGB(234, 38, 0), 0.25: RGB(234, 126, 0), 0.5: RGB(254, 244, 84), 0.75: RGB(173, 203, 249), 1: RGB(75, 107, 169)])
gradient_4 = Gradient(LowerLimit=0, UpperLimit=1, Parameter=Slider(0.87, range=0..1), stops=[0.15: RGB(255, 130, 160), 0.85: RGB(220, 0, 40)])
gradient_5 = Gradient(LowerLimit=0, UpperLimit=1, Parameter=Slider(0.02, range=0..1), stops=[0.15: RGB(255, 130, 160), 0.85: RGB(220, 0, 40)])
gradient_6 = Gradient(
    LowerLimit=0,
    UpperLimit=1,
    Parameter=Slider(0, range=0..1),
    stops=[0.131: RGB(31, 197, 237), 0.19: RGB(29, 247, 176), 0.47: RGB(128, 180, 50), 0.85: RGB(220, 0, 40)])
gradient_7 = Gradient(
    LowerLimit=0,
    UpperLimit=1,
    Parameter=Slider(0.84, range=0..1),
    stops=[0: RGB(243, 57, 0), 0.1: RGB(236, 27, 60), 0.2: RGB(210, 0, 118), 0.3: RGB(103, 0, 120), 0.4: RGB(39, 72, 161), 0.6: RGB(18, 178, 90), 0.7: RGB(79, 186, 8), 0.8: RGB(220, 237, 32), 0.9: RGB(247, 159, 20), 1: RGB(243, 57, 0)])
gradient_8 = Gradient(
    LowerLimit=0,
    UpperLimit=1,
    Parameter=Slider(0.19, range=0..1),
    stops=[0: RGB(243, 57, 0), 0.1: RGB(236, 27, 60), 0.2: RGB(210, 0, 118), 0.3: RGB(103, 0, 120), 0.4: RGB(39, 72, 161), 0.6: RGB(18, 178, 90), 0.7: RGB(79, 186, 8), 0.8: RGB(220, 237, 32), 0.9: RGB(247, 159, 20), 1: RGB(243, 57, 0)])
gradient_9 = Gradient(
    LowerLimit=0,
    UpperLimit=1,
    Parameter=Slider(0.54, range=0..1),
    stops=[0: RGB(243, 57, 0), 0.1: RGB(236, 27, 60), 0.2: RGB(210, 0, 118), 0.3: RGB(103, 0, 120), 0.4: RGB(39, 72, 161), 0.6: RGB(18, 178, 90), 0.7: RGB(79, 186, 8), 0.8: RGB(220, 237, 32), 0.9: RGB(247, 159, 20), 1: RGB(243, 57, 0)])
gradient_10 = Gradient(LowerLimit=0, UpperLimit=1, Parameter=Slider(0.21, range=0..1), stops=[0.704: RGB(173, 203, 249), 1: RGB(75, 107, 169)])
gradient_11 = Gradient(LowerLimit=0, UpperLimit=1, Parameter=Slider(1, range=0..1), stops=[0.804: RGB(173, 203, 249), 1: RGB(75, 107, 169)])
gradient_12 = Gradient(LowerLimit=0, UpperLimit=1, Parameter=Slider(0.97, range=0..1), stops=[0.704: RGB(173, 203, 249), 1: RGB(75, 107, 169)])
custom_preview = CustomPreview(Geometry=explode_tree._0005, Material=gradient)
custom_preview_2 = CustomPreview(Geometry=explode_tree.Branch10, Material=gradient_2)
custom_preview_3 = CustomPreview(Geometry=explode_tree._0001, Material=gradient_3)
custom_preview_4 = CustomPreview(Geometry=explode_tree._0004, Material=gradient_4)
custom_preview_5 = CustomPreview(Geometry=explode_tree._0008, Material=gradient_5)
custom_preview_6 = CustomPreview(Geometry=explode_tree._0000, Material=gradient_6)
custom_preview_7 = CustomPreview(Geometry=explode_tree._0007, Material=gradient_7)
custom_preview_8 = CustomPreview(Geometry=explode_tree.Branch11, Material=gradient_8)
custom_preview_9 = CustomPreview(Geometry=explode_tree._0003, Material=gradient_9)
custom_preview_10 = CustomPreview(Geometry=explode_tree._0006, Material=gradient_10)
custom_preview_11 = CustomPreview(Geometry=explode_tree._0009, Material=gradient_11)
custom_preview_12 = CustomPreview(Geometry=explode_tree._0002, Material=gradient_12)
