# Grasshopper definition MathDomain030.gh (Grasshopper 1.0.7)
# Copyright: Wickerson Studios
# plug-ins: Bifocals

# 1001 GRASSHOPPER DEFINITIONS
# Wickerson Studio
# 
# created by: Michael Wickerson
# 
# Grasshopper for Rhino 3D Algorithmic Modeling
# 
# www.wickersonstudios.com
# www.michaelwickerson.com
# https://www.youtube.com/channel/UC7J48Ppcsa6oncp6d29R0xw
# https://github.com/mwickerson
# https://www.facebook.com/michael.wickerson
# https://www.linkedin.com/in/michael-wickerson-696a80156/
# https://www.grasshopper3d.com/profile/MichaelWickerson
image_sampler = ImageSampler(
    FilePath="C:\Users\Sculpture\Documents\2020Grasshopper\ScreenShots2019\Screenshots2020\SurfaceEditAlgorithm.PNG",
    Filter="Value",
    Interpolate=False,
    Umax=1,
    Umin=0,
    Vmax=1,
    Vmin=0,
    Wrap=1)  # disabled

# ----
# Wickerson Studio
# created by: Michael Wickerson
# Grasshopper for Rhino 3D Algorithmic Modeling
# www.wickersonstudios.com
# www.michaelwickerson.com
# https://www.youtube.com/channel/UC7J48Ppcsa6oncp6d29R0xw
# https://github.com/mwickerson
# https://www.facebook.com/michael.wickerson
# https://www.linkedin.com/in/michael-wickerson-696a80156/
# https://www.grasshopper3d.com/profile/MichaelWickerson
construct_domain² = ConstructDomain²(DomainU=Domain(0, 1), DomainV=Domain(0, 1))
construct_domain²_2 = ConstructDomain²(UMin=0, UMax=1, VMin=0, VMax=1)
bounds_2d = Bounds2D()
divide_domain² = DivideDomain²(UCount=10, VCount=10)
# Math Domain  030/1001
deconstruct_domain² = DeconstructDomain²()  # -> UMin, UMax, VMin, VMax
deconstruct_domain²_2 = DeconstructDomain²()  # -> UComponent, VComponent

gradient = Gradient(
    LowerLimit=0,
    UpperLimit=1,
    Parameter=Slider(0.12, range=0..1),
    stops=[0: RGB(234, 38, 0), 0.25: RGB(234, 126, 0), 0.5: RGB(254, 244, 84), 0.75: RGB(173, 203, 249), 1: RGB(75, 107, 169)])
gradient_2 = Gradient(
    LowerLimit=0,
    UpperLimit=1,
    Parameter=Slider(0.66, range=0..1),
    stops=[0: RGB(234, 38, 0), 0.25: RGB(234, 126, 0), 0.5: RGB(254, 244, 84), 0.75: RGB(173, 203, 249), 1: RGB(75, 107, 169)])
gradient_3 = Gradient(
    LowerLimit=0,
    UpperLimit=1,
    Parameter=Slider(0.51, range=0..1),
    stops=[0: RGB(234, 38, 0), 0.25: RGB(234, 126, 0), 0.5: RGB(254, 244, 84), 0.75: RGB(173, 203, 249), 1: RGB(75, 107, 169)])
gradient_4 = Gradient(LowerLimit=0, UpperLimit=1, Parameter=Slider(0.87, range=0..1), stops=[0.15: RGB(255, 130, 160), 0.85: RGB(220, 0, 40)])
gradient_5 = Gradient(LowerLimit=0, UpperLimit=1, Parameter=Slider(0.02, range=0..1), stops=[0.15: RGB(255, 130, 160), 0.85: RGB(220, 0, 40)])
gradient_6 = Gradient(
    LowerLimit=0,
    UpperLimit=1,
    Parameter=Slider(0, range=0..1),
    stops=[0.131: RGB(31, 197, 237), 0.19: RGB(29, 247, 176), 0.47: RGB(128, 180, 50), 0.85: RGB(220, 0, 40)])
gradient_7 = Gradient(
    LowerLimit=0,
    UpperLimit=1,
    Parameter=Slider(0.84, range=0..1),
    stops=[0: RGB(243, 57, 0), 0.1: RGB(236, 27, 60), 0.2: RGB(210, 0, 118), 0.3: RGB(103, 0, 120), 0.4: RGB(39, 72, 161), 0.6: RGB(18, 178, 90), 0.7: RGB(79, 186, 8), 0.8: RGB(220, 237, 32), 0.9: RGB(247, 159, 20), 1: RGB(243, 57, 0)])
gradient_8 = Gradient(
    LowerLimit=0,
    UpperLimit=1,
    Parameter=Slider(0.19, range=0..1),
    stops=[0: RGB(243, 57, 0), 0.1: RGB(236, 27, 60), 0.2: RGB(210, 0, 118), 0.3: RGB(103, 0, 120), 0.4: RGB(39, 72, 161), 0.6: RGB(18, 178, 90), 0.7: RGB(79, 186, 8), 0.8: RGB(220, 237, 32), 0.9: RGB(247, 159, 20), 1: RGB(243, 57, 0)])
gradient_9 = Gradient(
    LowerLimit=0,
    UpperLimit=1,
    Parameter=Slider(0.54, range=0..1),
    stops=[0: RGB(243, 57, 0), 0.1: RGB(236, 27, 60), 0.2: RGB(210, 0, 118), 0.3: RGB(103, 0, 120), 0.4: RGB(39, 72, 161), 0.6: RGB(18, 178, 90), 0.7: RGB(79, 186, 8), 0.8: RGB(220, 237, 32), 0.9: RGB(247, 159, 20), 1: RGB(243, 57, 0)])
gradient_10 = Gradient(LowerLimit=0, UpperLimit=1, Parameter=Slider(0.21, range=0..1), stops=[0.704: RGB(173, 203, 249), 1: RGB(75, 107, 169)])
gradient_11 = Gradient(LowerLimit=0, UpperLimit=1, Parameter=Slider(1, range=0..1), stops=[0.804: RGB(173, 203, 249), 1: RGB(75, 107, 169)])
gradient_12 = Gradient(
    LowerLimit=0,
    UpperLimit=1,
    Parameter=Slider(0.86, range=0..1),
    stops=[0: RGB(234, 38, 0), 0.25: RGB(234, 126, 0), 0.5: RGB(254, 244, 84), 0.75: RGB(173, 203, 249), 1: RGB(75, 107, 169)])
gradient_13 = Gradient(LowerLimit=0, UpperLimit=1, Parameter=Slider(0.97, range=0..1), stops=[0.704: RGB(173, 203, 249), 1: RGB(75, 107, 169)])
gradient_14 = Gradient(
    LowerLimit=0,
    UpperLimit=1,
    Parameter=Slider(0, range=0..1),
    stops=[0.131: RGB(31, 197, 237), 0.19: RGB(29, 247, 176), 0.85: RGB(220, 0, 40)])
gradient_15 = Gradient(
    LowerLimit=0,
    UpperLimit=1,
    Parameter=Slider(0.89, range=0..1),
    stops=[0: RGB(243, 57, 0), 0.1: RGB(236, 27, 60), 0.2: RGB(210, 0, 118), 0.3: RGB(103, 0, 120), 0.4: RGB(39, 72, 161), 0.6: RGB(18, 178, 90), 0.7: RGB(79, 186, 8), 0.8: RGB(220, 237, 32), 0.9: RGB(247, 159, 20), 1: RGB(243, 57, 0)])
gradient_16 = Gradient(LowerLimit=0, UpperLimit=1, Parameter=Slider(0.22, range=0..1), stops=[0.704: RGB(173, 203, 249), 1: RGB(75, 107, 169)])

construct_domain²_3 = ConstructDomain²(DomainU=Slider(100, range=0..100), DomainV=Slider(100, range=0..100))
deconstruct_domain²_3 = DeconstructDomain²()  # -> UMin, UMax, VMin, VMax
panel = Panel(construct_domain²_3)
number_slider = Slider(4, range=3..10)
number_slider_2 = Slider(2, range=0..10)
number_slider_3 = Slider(49, range=0..100)
number_slider_4 = Slider(34, range=0..100)
number_slider_5 = Slider(1.4, range=0..2)
construct_domain = ConstructDomain(DomainStart=0, DomainEnd=number_slider_5)
construct_domain_2 = ConstructDomain(DomainStart=0, DomainEnd=number_slider_5)

construct_domain²_4 = ConstructDomain²(UMin=Slider(0.21, range=0..1), UMax=Slider(10, range=0..10), VMin=Slider(0.3, range=0..1), VMax=Slider(10, range=0..10))

panel_2 = Panel(construct_domain²_4)
plane_surface = PlaneSurface(Plane=PlaneXY(0, 0, 0), XSize=construct_domain²_4, YSize=construct_domain²_4)
surface = Surface(plane_surface)
surface_2 = Surface(plane_surface)
divide_domain²_2 = DivideDomain²(Domain=surface_2, UCount=number_slider_2, VCount=number_slider_2)
isotrim = Isotrim(Surface=surface_2, Domain=divide_domain²_2)
populate_2d = Populate2D(Region=isotrim, Count=number_slider_4, Seed=number_slider_3)
list_length = ListLength(List=populate_2d)
bounds_2d_2 = Bounds2D(Coordinates=populate_2d)
range = Range(Domain=construct_domain, Steps=expr("x-1", list_length))
deconstruct_domain²_4 = DeconstructDomain²(Domain=bounds_2d_2)  # -> UMin, UMax, VMin, VMax
pi = Pi(Factor=range)
rectangle = Rectangle(Plane=PlaneXY(0, 0, 0), XSize=deconstruct_domain²_4.UMax, YSize=deconstruct_domain²_4.VMax, Radius=0)  # -> Rectangle, Length
rotate = Rotate(Geometry=rectangle.Rectangle, Angle=pi, Plane=PlaneXY(0, 0, 0))  # -> Geometry, Transform
list_length_2 = ListLength(List=rotate.Geometry)
range_2 = Range(Domain=construct_domain_2, Steps=expr("x-1", list_length_2))
area = Area(Geometry=rotate.Geometry)  # -> Area, Centroid
pi_2 = Pi(Factor=range_2)

divide_domain²_3 = DivideDomain²(Domain=surface, UCount=number_slider, VCount=number_slider)

isotrim_2 = Isotrim(Surface=surface, Domain=divide_domain²_3)
populate_2d_2 = Populate2D(Region=isotrim_2, Count=number_slider_4, Seed=expr("x-1", number_slider_3))

bounds_2d_3 = Bounds2D(Coordinates=populate_2d_2)

deconstruct_domain²_5 = DeconstructDomain²(Domain=bounds_2d_3)  # -> UMin, UMax, VMin, VMax
rectangle_2 = Rectangle(Plane=PlaneXY(0, 0, 0), XSize=deconstruct_domain²_5.UMax, YSize=deconstruct_domain²_5.VMax, Radius=0)  # -> Rectangle, Length
region_difference = RegionDifference(CurvesA=rotate.Geometry, CurvesB=rectangle_2.Rectangle)
rotate_3d = Rotate3D(Geometry=region_difference, Angle=pi_2, Center=area.Centroid, Axis=Vector(1, 0, 0))  # -> Geometry, Transform
boundary_surfaces = BoundarySurfaces(Edges=rotate_3d.Geometry)

explode_tree = ExplodeTree(Data=boundary_surfaces)  # -> _00000, _00100, _00200, _00300, _00310, _00320, _00330, _00340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
custom_preview = CustomPreview(Geometry=explode_tree._00320, Material=gradient)
custom_preview_2 = CustomPreview(Geometry=explode_tree._00370, Material=gradient_2)
custom_preview_3 = CustomPreview(Geometry=explode_tree._00100, Material=gradient_3)
custom_preview_4 = CustomPreview(Geometry=explode_tree._00310, Material=gradient_4)
custom_preview_5 = CustomPreview(Geometry=explode_tree._00350, Material=gradient_5)
custom_preview_6 = CustomPreview(Geometry=explode_tree._00000, Material=gradient_6)
custom_preview_7 = CustomPreview(Geometry=explode_tree._00340, Material=gradient_7)
custom_preview_8 = CustomPreview(Geometry=explode_tree._00380, Material=gradient_8)
custom_preview_9 = CustomPreview(Geometry=explode_tree._00300, Material=gradient_9)
custom_preview_10 = CustomPreview(Geometry=explode_tree._00330, Material=gradient_10)
custom_preview_11 = CustomPreview(Geometry=explode_tree._00360, Material=gradient_11)
custom_preview_12 = CustomPreview(Geometry=explode_tree._00390, Material=gradient_12)
custom_preview_13 = CustomPreview(Geometry=explode_tree._00200, Material=gradient_13)
custom_preview_14 = CustomPreview(Geometry=explode_tree._003120, Material=gradient_4)
custom_preview_15 = CustomPreview(Geometry=explode_tree._00000, Material=gradient_14)
custom_preview_16 = CustomPreview(Geometry=explode_tree._003110, Material=gradient_15)
custom_preview_17 = CustomPreview(Geometry=explode_tree._003100, Material=gradient_16)
