# Grasshopper definition MathDomain031.gh (Grasshopper 1.0.7)
# Copyright: Wickerson Studios
# plug-ins: Bifocals

image_sampler = ImageSampler(
    FilePath="C:\Users\Sculpture\Documents\2020Grasshopper\ScreenShots2019\Screenshots2020\SurfaceEditAlgorithm.PNG",
    Filter="Value",
    Interpolate=False,
    Umax=1,
    Umin=0,
    Vmax=1,
    Vmin=0,
    Wrap=1)  # disabled

display_matrix = DisplayMatrix()
invert_matrix = InvertMatrix(Tolerance=0)  # -> Matrix, Success
swap_columns = SwapColumns()
deconstruct_matrix = DeconstructMatrix()  # -> Rows, Columns, Values
# 1001 GRASSHOPPER DEFINITIONS
# Wickerson Studio
# 
# created by: Michael Wickerson
# 
# Grasshopper for Rhino 3D Algorithmic Modeling
# 
# www.wickersonstudios.com
# www.michaelwickerson.com
# https://www.youtube.com/channel/UC7J48Ppcsa6oncp6d29R0xw
# https://github.com/mwickerson
# https://www.facebook.com/michael.wickerson
# https://www.linkedin.com/in/michael-wickerson-696a80156/
# https://www.grasshopper3d.com/profile/MichaelWickerson
# Math Matrix  031/1001
# Wickerson Studio
# created by: Michael Wickerson
# Grasshopper for Rhino 3D Algorithmic Modeling
# www.wickersonstudios.com
# www.michaelwickerson.com
# https://www.youtube.com/channel/UC7J48Ppcsa6oncp6d29R0xw
# https://github.com/mwickerson
# https://www.facebook.com/michael.wickerson
# https://www.linkedin.com/in/michael-wickerson-696a80156/
# https://www.grasshopper3d.com/profile/MichaelWickerson
construct_matrix = ConstructMatrix(Rows=3, Columns=3)
transpose_matrix = TransposeMatrix()
swap_rows = SwapRows()

# ---- group: ChangeOfBasis
pt = Point(<point referenced from the Rhino model>)
pt_2 = Point(<point referenced from the Rhino model>)
mesh = Mesh(<mesh referenced from the Rhino model>)
pt_3 = Point(<point referenced from the Rhino model>)
pt_4 = Point(<point referenced from the Rhino model>)
mesh_2 = Mesh(<mesh referenced from the Rhino model>)
superman = CSharpScript(x=mesh, v1=pt_2, v2=pt)  # -> out, A, B, C, D, E, F; inputs x: Mesh, v1: Vector3d, v2: Vector3d
# ---------- superman: C# ----------
    //grid of input geometry
    List<Mesh> mg = new List<Mesh>(); //mg is "mesh grid"

    int i = 0;
    int j = 0;
    for (i = 0; i < 10; i++){
      for (j = 0; j < 10; j++){
        mg.Add(x.DuplicateMesh());//copy object
        mg[(mg.Count - 1)].Transform(Transform.Translation(100 * i, 30 * j, 0)); //transform
      }
    }


    //Omni Light Source
    var v3 = v2 - v1;

    //Transform geometry to point at lightsource
    for (i = 0; i < mg.Count; i++){

      //Vector3d FaceNormal = new Vector3d(mg[i].FaceNormals[0]);
      //Point3d FaceCenter = new Point3d(mg[i].Faces.GetFaceCenter(0));
      mg[i].Transform(Transform.Rotation(mg[i].FaceNormals[0], v2 - mg[i].FaceNormals[0], mg[i].Faces.GetFaceCenter(0)));
    }




    A = v3;
    B = mg;
    E = x;
    //C = FaceNormal;
    //D = FaceCenter;
    F = x.Faces.GetFaceCenter(0);
# ---------- end superman ----------
vdis = VectorDisplay(Anchor=pt_2, Vector=superman.A)
orient_to_point_changebasis_rotate = CSharpScript(x=mesh_2, v1=pt_4, v2=pt_3)  # -> out, A, B, C, D, E, F; inputs x: Mesh, v1: Vector3d, v2: Vector3d
# ---------- orient_to_point_changebasis_rotate: C# usings ----------
using System.IO;
using System.Linq;
using System.Data;
using System.Drawing;
using System.Reflection;
using System.Windows.Forms;
using System.Xml;
using System.Xml.Linq;
using System.Runtime.InteropServices;

using Rhino.DocObjects;
using Rhino.Collections;
using GH_IO;
using GH_IO.Serialization;
# ---------- orient_to_point_changebasis_rotate: C# ----------
    //Omni Light Vector
    var v3 = v2 - v1;

    //COMPUTATION: Transform mesh to orient toward OmniLight origin using ChangeOfBasis + Rotate
    Plane mp = new Plane(x.Faces.GetFaceCenter(0), x.FaceNormals[0]); //mp is "meshplane", the plane oriented to meshface

    var nv = v2 - x.FaceNormals[0]; //check if meshplane vector of transformed mesh is pointing to omnilight (v2)

    v2.Transform(Transform.ChangeBasis(Plane.WorldXY, mp)); //make omnipoint coordinate relative to meshplane
    x.Transform(Transform.Rotation(x.FaceNormals[0], v2, x.Faces.GetFaceCenter(0))); //rotate mesh using meshplane normal and relative omnipoint

    v2.Transform(Transform.ChangeBasis(mp, Plane.WorldXY)); //reset omnipoint coordinate to world XYZ

    //checks
    var nv2 = v2 - x.FaceNormals[0]; //check if meshplane vector of transformed mesh is pointing to omnilight (v2)
    Plane mp2 = new Plane(x.Faces.GetFaceCenter(0), x.FaceNormals[0]); //mp is "meshplane", the plane oriented to meshface

    //outputs
    A = nv; //initial normal vector (from meshplane)
    B = nv2;//transformed normal vector (from meshplane, should be oriented toward omnilight)
    C = mp;//initial meshplane
    D = mp2; //transformed meshplane (should be oriented toward omnilight)
    E = x; //transformed mesh
    F = x.Faces.GetFaceCenter(0); //meshplane center of transformed mesh
# ---------- end orient_to_point_changebasis_rotate ----------
vdis_2 = VectorDisplay(Anchor=pt_4, Vector=orient_to_point_changebasis_rotate.A)
panel = Panel(superman.B)
panel_2 = Panel(superman.A)
panel_3 = Panel(superman.C)
panel_4 = Panel(superman.D)
panel_5 = Panel(superman.F)
geo = Geometry(orient_to_point_changebasis_rotate.C)
vdis_3 = VectorDisplay(Anchor=orient_to_point_changebasis_rotate.F, Vector=orient_to_point_changebasis_rotate.B)
geo_2 = Geometry(orient_to_point_changebasis_rotate.E)
geo_3 = Geometry(superman.B)
vdis_4 = VectorDisplay(Anchor=superman.F, Vector=superman.C)
pt_5 = Point(<point referenced from the Rhino model>)
pt_6 = Point(<point referenced from the Rhino model>)
mesh_3 = Mesh(<mesh referenced from the Rhino model>)
orienttopoint_changeofbasis_planetoplane = CSharpScript(x=mesh_3, v1=pt_6, v2=pt_5)  # -> out, A, B, C, D, E, F; inputs x: Mesh, v1: Vector3d, v2: Vector3d
# ---------- orienttopoint_changeofbasis_planetoplane: C# ----------
    //Omni Light Vector
    var v3 = v2 - v1;

    //COMPUTATION: Transform mesh to orient toward OmniLight origin using ChangeOfBasis + MeshPlane
    Plane mp = new Plane(x.Faces.GetFaceCenter(0), x.FaceNormals[0]); //plane oriented to face

    v2.Transform(Transform.ChangeBasis(Plane.WorldXY, mp)); //make omnilight coordinate relative to plane
    Plane mp2 = new Plane(x.Faces.GetFaceCenter(0), v2);//plane oriented to light point (note: this does orient as expected. It has me stumped)
    x.Transform(Transform.PlaneToPlane(mp, mp2)); //reorient mesh to new plane

    v2.Transform(Transform.ChangeBasis(mp, Plane.WorldXY)); //reset omnilight coordinate relative to worldXY

    //checks
    var nv2 = v2 - x.FaceNormals[0];

    //OUTPUTS

    B = nv2; //normal vector of transformed mesh
    C = mp; //initial meshplane
    D = mp2; //transformed meshplane
    E = x; //transformed mesh
    F = x.Faces.GetFaceCenter(0); //meshplane center of transformed mesh
# ---------- end orienttopoint_changeofbasis_planetoplane ----------
geo_4 = Geometry(orienttopoint_changeofbasis_planetoplane.E)
vdis_5 = VectorDisplay(Anchor=pt_6, Vector=orienttopoint_changeofbasis_planetoplane.A)
vdis_6 = VectorDisplay(Anchor=orienttopoint_changeofbasis_planetoplane.F, Vector=orienttopoint_changeofbasis_planetoplane.B)
pln = Plane([orienttopoint_changeofbasis_planetoplane.C, orienttopoint_changeofbasis_planetoplane.D])

# ---- group: Matrix_Invert_V1
c_script = CSharpScript(N=Slider(9, range=2..30), tolValue=Slider(0.0001, range=0.0001..1), fate=Slider(626, range=555..666))  # -> out, matrixRandom, matrixMultiplication, matrixInverted; inputs N: Int32, tolValue: Double, fate: Int32
# ---------- c_script: C# ----------
    Matrix M = new Matrix(N, N);
    Random rnd = new Random();

    for(int i = 0; i < N ; i++){
      for(int j = 0; j < N ; j++){
        M[i, j] = rnd.Next(0, N);
      }
    }

    matrixRandom = M;

    Matrix MInv = InvertMatrix(M, tolValue);
    matrixInverted = MInv;

    Matrix MM = MultiplyMatrices(M, MInv); // the Identity matrix
    matrixMultiplication = MM;
# ---------- c_script: C# additional code ----------
  private Matrix InvertMatrix(Matrix matrix, double tiny){

    int num_rows = matrix.RowCount;
    double[,] augmented = new double[num_rows, 2 * num_rows];
    for (int row = 0; row < num_rows; row++){
      for (int col = 0; col < num_rows; col++)  augmented[row, col] = matrix[row, col];
      augmented[row, row + num_rows] = 1;
    }

    int num_cols = 2 * num_rows;

    for (int row = 0; row < num_rows; row++){
      if (Math.Abs(augmented[row, row]) < tiny){
        for (int r2 = row + 1; r2 < num_rows; r2++){
          if (Math.Abs(augmented[r2, row]) > tiny){
            for (int c = 0; c < num_cols; c++){
              double tmp = augmented[row, c];
              augmented[row, c] = augmented[r2, c];
              augmented[r2, c] = tmp;
            }
            break;
          }
        }
      }

      if (Math.Abs(augmented[row, row]) > tiny){
        for (int col = 0; col < num_cols; col++)
          if (col != row) augmented[row, col] /= augmented[row, row];
        augmented[row, row] = 1;

        for (int row2 = 0; row2 < num_rows; row2++){
          if (row2 != row){
            double factor = augmented[row2, row] / augmented[row, row];
            for (int col = 0; col < num_cols; col++)
              augmented[row2, col] -= factor * augmented[row, col];
          }
        }
      }
    }

    if (augmented[num_rows - 1, num_rows - 1] == 0) return null;

    Matrix invert = new Matrix(num_rows, num_rows);
    for (int row = 0; row < num_rows; row++){
      for (int col = 0; col < num_rows; col++){
        invert[row, col] = augmented[row, col + num_rows];
      }
    }
    return invert;
  }

  public Matrix MultiplyMatrices(Matrix m1, Matrix m2)
  {
    int num_rows = m1.RowCount;
    Matrix result = new Matrix(num_rows, num_rows);
    for (int row = 0; row < num_rows; row++){
      for (int col = 0; col < num_rows; col++){
        double mvalue = 0;
        for (int i = 0; i < num_rows; i++)  mvalue += m1[row, i] * m2[i, col];
        result[row, col] = mvalue;
      }
    }
    return result;
  }
# ---------- end c_script ----------
matrix = DisplayMatrix(c_script.matrixRandom, Digits=0)
matrix_2 = DisplayMatrix(c_script.matrixMultiplication)
matrix_3 = DisplayMatrix(c_script.matrixInverted)

# ----
explode_tree = ExplodeTree()  # -> _00000, _00100, _00200, _00300, _00310, _00320, _00330, _00340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
gradient = Gradient(
    LowerLimit=0,
    UpperLimit=1,
    Parameter=Slider(0.12, range=0..1),
    stops=[0: RGB(234, 38, 0), 0.25: RGB(234, 126, 0), 0.5: RGB(254, 244, 84), 0.75: RGB(173, 203, 249), 1: RGB(75, 107, 169)])
gradient_2 = Gradient(
    LowerLimit=0,
    UpperLimit=1,
    Parameter=Slider(0.66, range=0..1),
    stops=[0: RGB(234, 38, 0), 0.25: RGB(234, 126, 0), 0.5: RGB(254, 244, 84), 0.75: RGB(173, 203, 249), 1: RGB(75, 107, 169)])
gradient_3 = Gradient(
    LowerLimit=0,
    UpperLimit=1,
    Parameter=Slider(0.51, range=0..1),
    stops=[0: RGB(234, 38, 0), 0.25: RGB(234, 126, 0), 0.5: RGB(254, 244, 84), 0.75: RGB(173, 203, 249), 1: RGB(75, 107, 169)])
gradient_4 = Gradient(LowerLimit=0, UpperLimit=1, Parameter=Slider(0.87, range=0..1), stops=[0.15: RGB(255, 130, 160), 0.85: RGB(220, 0, 40)])
gradient_5 = Gradient(LowerLimit=0, UpperLimit=1, Parameter=Slider(0.02, range=0..1), stops=[0.15: RGB(255, 130, 160), 0.85: RGB(220, 0, 40)])
gradient_6 = Gradient(
    LowerLimit=0,
    UpperLimit=1,
    Parameter=Slider(0, range=0..1),
    stops=[0.131: RGB(31, 197, 237), 0.19: RGB(29, 247, 176), 0.47: RGB(128, 180, 50), 0.85: RGB(220, 0, 40)])
gradient_7 = Gradient(
    LowerLimit=0,
    UpperLimit=1,
    Parameter=Slider(0.84, range=0..1),
    stops=[0: RGB(243, 57, 0), 0.1: RGB(236, 27, 60), 0.2: RGB(210, 0, 118), 0.3: RGB(103, 0, 120), 0.4: RGB(39, 72, 161), 0.6: RGB(18, 178, 90), 0.7: RGB(79, 186, 8), 0.8: RGB(220, 237, 32), 0.9: RGB(247, 159, 20), 1: RGB(243, 57, 0)])
gradient_8 = Gradient(
    LowerLimit=0,
    UpperLimit=1,
    Parameter=Slider(0.19, range=0..1),
    stops=[0: RGB(243, 57, 0), 0.1: RGB(236, 27, 60), 0.2: RGB(210, 0, 118), 0.3: RGB(103, 0, 120), 0.4: RGB(39, 72, 161), 0.6: RGB(18, 178, 90), 0.7: RGB(79, 186, 8), 0.8: RGB(220, 237, 32), 0.9: RGB(247, 159, 20), 1: RGB(243, 57, 0)])
gradient_9 = Gradient(
    LowerLimit=0,
    UpperLimit=1,
    Parameter=Slider(0.54, range=0..1),
    stops=[0: RGB(243, 57, 0), 0.1: RGB(236, 27, 60), 0.2: RGB(210, 0, 118), 0.3: RGB(103, 0, 120), 0.4: RGB(39, 72, 161), 0.6: RGB(18, 178, 90), 0.7: RGB(79, 186, 8), 0.8: RGB(220, 237, 32), 0.9: RGB(247, 159, 20), 1: RGB(243, 57, 0)])
gradient_10 = Gradient(LowerLimit=0, UpperLimit=1, Parameter=Slider(0.21, range=0..1), stops=[0.704: RGB(173, 203, 249), 1: RGB(75, 107, 169)])
gradient_11 = Gradient(LowerLimit=0, UpperLimit=1, Parameter=Slider(1, range=0..1), stops=[0.804: RGB(173, 203, 249), 1: RGB(75, 107, 169)])
gradient_12 = Gradient(
    LowerLimit=0,
    UpperLimit=1,
    Parameter=Slider(0.86, range=0..1),
    stops=[0: RGB(234, 38, 0), 0.25: RGB(234, 126, 0), 0.5: RGB(254, 244, 84), 0.75: RGB(173, 203, 249), 1: RGB(75, 107, 169)])
gradient_13 = Gradient(LowerLimit=0, UpperLimit=1, Parameter=Slider(0.97, range=0..1), stops=[0.704: RGB(173, 203, 249), 1: RGB(75, 107, 169)])
gradient_14 = Gradient(
    LowerLimit=0,
    UpperLimit=1,
    Parameter=Slider(0, range=0..1),
    stops=[0.131: RGB(31, 197, 237), 0.19: RGB(29, 247, 176), 0.85: RGB(220, 0, 40)])
gradient_15 = Gradient(
    LowerLimit=0,
    UpperLimit=1,
    Parameter=Slider(0.89, range=0..1),
    stops=[0: RGB(243, 57, 0), 0.1: RGB(236, 27, 60), 0.2: RGB(210, 0, 118), 0.3: RGB(103, 0, 120), 0.4: RGB(39, 72, 161), 0.6: RGB(18, 178, 90), 0.7: RGB(79, 186, 8), 0.8: RGB(220, 237, 32), 0.9: RGB(247, 159, 20), 1: RGB(243, 57, 0)])
gradient_16 = Gradient(LowerLimit=0, UpperLimit=1, Parameter=Slider(0.22, range=0..1), stops=[0.704: RGB(173, 203, 249), 1: RGB(75, 107, 169)])
custom_preview = CustomPreview(Geometry=explode_tree._00320, Material=gradient)
custom_preview_2 = CustomPreview(Geometry=explode_tree._00370, Material=gradient_2)
custom_preview_3 = CustomPreview(Geometry=explode_tree._00100, Material=gradient_3)
custom_preview_4 = CustomPreview(Geometry=explode_tree._00310, Material=gradient_4)
custom_preview_5 = CustomPreview(Geometry=explode_tree._00350, Material=gradient_5)
custom_preview_6 = CustomPreview(Geometry=explode_tree._00000, Material=gradient_6)
custom_preview_7 = CustomPreview(Geometry=explode_tree._00340, Material=gradient_7)
custom_preview_8 = CustomPreview(Geometry=explode_tree._00380, Material=gradient_8)
custom_preview_9 = CustomPreview(Geometry=explode_tree._00300, Material=gradient_9)
custom_preview_10 = CustomPreview(Geometry=explode_tree._00330, Material=gradient_10)
custom_preview_11 = CustomPreview(Geometry=explode_tree._00360, Material=gradient_11)
custom_preview_12 = CustomPreview(Geometry=explode_tree._00390, Material=gradient_12)
custom_preview_13 = CustomPreview(Geometry=explode_tree._00200, Material=gradient_13)
custom_preview_14 = CustomPreview(Geometry=explode_tree._003120, Material=gradient_4)
custom_preview_15 = CustomPreview(Geometry=explode_tree._00000, Material=gradient_14)
custom_preview_16 = CustomPreview(Geometry=explode_tree._003110, Material=gradient_15)
custom_preview_17 = CustomPreview(Geometry=explode_tree._003100, Material=gradient_16)

cylinder = Cylinder(Base=PlaneXY(0, 0, 0), Radius=Slider(3, range=0..10), Length=Slider(10, range=0..10))
number_slider = Slider(4, range=0..10)
gene_pool = GenePool(
    Decimals=2,
    Maximum=10,
    Minimum=0,
    Value=[5.03690901, 7.13642062, 1.49530972, 4.924220394, 2.853628086, 8.89438746, 4.306028855, 4.343537094, 9.35853824, 5.079026681, 2.15918162, 2.659271137, 3.960966288, 2.215905405, 7.845538998, 9.311837149])
value_list = ValueList({"One": 1, "Two": 2, "Three": 3}, selected="Two")
value_list_2 = ValueList({"One": 1, "Two": 2, "Three": 3}, selected="Two")
cap_holes = CapHoles(Brep=cylinder)
move = Move(Geometry=cap_holes, Motion=Vector(0, 0, 10))  # -> Geometry, Transform
value_list_3 = ValueList({"One": 1, "Two": 2, "Three": 3}, selected="One")
value_list_4 = ValueList({"One": 1, "Two": 2, "Three": 3}, selected="Two")
matrix_4 = Matrix(move.Transform)
display_matrix_2 = DisplayMatrix(matrix_4)

construct_matrix_2 = ConstructMatrix(Rows=number_slider, Columns=number_slider, Values=gene_pool)

display_matrix_3 = DisplayMatrix(construct_matrix_2)

matrix_5 = Matrix(construct_matrix_2)
matrix_6 = Matrix(matrix_5)
display_matrix_4 = DisplayMatrix(matrix_6)
panel_6 = Panel(construct_matrix_2)

invert_matrix_2 = InvertMatrix(Matrix=matrix_6, Tolerance=0)  # -> Matrix, Success

deconstruct_matrix_2 = DeconstructMatrix(Matrix=matrix_5)  # -> Rows, Columns, Values

matrix_7 = Matrix(invert_matrix_2.Matrix)
display_matrix_5 = DisplayMatrix(matrix_7)
panel_7 = Panel(deconstruct_matrix_2.Rows)
panel_8 = Panel(deconstruct_matrix_2.Columns)
panel_9 = Panel(deconstruct_matrix_2.Values)

transpose_matrix_2 = TransposeMatrix(Matrix=matrix_7)

matrix_8 = Matrix(transpose_matrix_2)
display_matrix_6 = DisplayMatrix(matrix_8)

swap_columns_2 = SwapColumns(Matrix=matrix_8, ColumnA=value_list, ColumnB=value_list_2)

matrix_9 = Matrix(swap_columns_2)
display_matrix_7 = DisplayMatrix(matrix_9)

swap_rows_2 = SwapRows(Matrix=matrix_9, RowA=value_list_3, RowB=value_list_4)

matrix_10 = Matrix(swap_rows_2)
display_matrix_8 = DisplayMatrix(matrix_10)
panel_10 = Panel(matrix_10)
