# Grasshopper definition MathDomain032B.gh (Grasshopper 1.0.7)
# Copyright: Wickerson Studios
# plug-ins: Bifocals

image_sampler = ImageSampler(
    FilePath="C:\Users\Sculpture\Documents\2020Grasshopper\ScreenShots2019\Screenshots2020\SurfaceEditAlgorithm.PNG",
    Filter="Value",
    Interpolate=False,
    Umax=1,
    Umin=0,
    Vmax=1,
    Vmin=0,
    Wrap=1)  # disabled
multiplication = Multiplication()
# 1001 GRASSHOPPER DEFINITIONS
# Wickerson Studio
# 
# created by: Michael Wickerson
# 
# Grasshopper for Rhino 3D Algorithmic Modeling
# 
# www.wickersonstudios.com
# www.michaelwickerson.com
# https://www.youtube.com/channel/UC7J48Ppcsa6oncp6d29R0xw
# https://github.com/mwickerson
# https://www.facebook.com/michael.wickerson
# https://www.linkedin.com/in/michael-wickerson-696a80156/
# https://www.grasshopper3d.com/profile/MichaelWickerson
# Math Matrix  032/1001
addition = Addition()
subtraction = Subtraction()
# Wickerson Studio
# created by: Michael Wickerson
# Grasshopper for Rhino 3D Algorithmic Modeling
# www.wickersonstudios.com
# www.michaelwickerson.com
# https://www.youtube.com/channel/UC7J48Ppcsa6oncp6d29R0xw
# https://github.com/mwickerson
# https://www.facebook.com/michael.wickerson
# https://www.linkedin.com/in/michael-wickerson-696a80156/
# https://www.grasshopper3d.com/profile/MichaelWickerson
division = Division()
mesh = Mesh()

number_slider = Slider(0.07, range=0..0.25)
point = Point(<point referenced from the Rhino model>)
vector_xyz = VectorXYZ(XComponent=number_slider, YComponent=0, ZComponent=0)  # -> Vector, Length
negative = Negative(Value=vector_xyz.Vector)
construct_plane = ConstructPlane(Origin=point, XAxis=Vector(1, 0, 0), YAxis=Vector(0, 1, 0))
populate_2d = Populate2D(Region={Plane=PlaneXY(0, 0, 0), Size=Domain2(u=0..20, v=0..10)}, Count=Slider(1, range=0..1), Seed=1)
mesh_2 = Mesh(<mesh referenced from the Rhino model>)
pi = Pi(Factor=number_slider)
line_sdl = LineSDL(Start=construct_plane, Direction=negative, Length=1)
rotate_3d = Rotate3D(Geometry=mesh_2, Angle=pi, Center=point, Axis=line_sdl)  # -> Geometry, Transform
deconstruct_mesh = DeconstructMesh(Mesh=rotate_3d.Geometry)  # -> Vertices, Faces, Colours, Normals
deconstruct_mesh_2 = DeconstructMesh(Mesh=rotate_3d.Geometry)  # -> Vertices, Faces, Colours, Normals
closest_point = ClosestPoint(Point=populate_2d, Cloud=deconstruct_mesh.Vertices)  # -> flatten(ClosestPoint), CPIndex, Distance
closest_point_2 = ClosestPoint(Point=populate_2d, Cloud=deconstruct_mesh_2.Vertices)  # -> ClosestPoint, CPIndex, Distance
closest_point_3 = ClosestPoint(Point=closest_point_2.ClosestPoint, Cloud=closest_point.ClosestPoint)  # -> ClosestPoint, CPIndex, Distance
orient = Orient(Geometry=rotate_3d.Geometry, Source=closest_point_3.ClosestPoint, Target=closest_point_2.ClosestPoint)  # -> Geometry, Transform
mesh_3 = Mesh([<mesh referenced from the Rhino model> x7])
deconstruct_mesh_3 = DeconstructMesh(Mesh=mesh_3)  # -> Vertices, Faces, Colours, Normals
deconstruct_mesh_4 = DeconstructMesh(Mesh=orient.Geometry)  # -> Vertices, Faces, Colours, Normals
closest_point_4 = ClosestPoint(Point=populate_2d, Cloud=deconstruct_mesh_4.Vertices)  # -> ClosestPoint, CPIndex, Distance
closest_point_5 = ClosestPoint(Point=closest_point_2.ClosestPoint, Cloud=deconstruct_mesh_3.Vertices)  # -> flatten(ClosestPoint), CPIndex, Distance
closest_point_6 = ClosestPoint(Point=closest_point_2.ClosestPoint, Cloud=closest_point_5.ClosestPoint)  # -> ClosestPoint, CPIndex, Distance
mesh_4 = Mesh([<mesh referenced from the Rhino model> x592])
orient_2 = Orient(Geometry=mesh_3, Source=closest_point_6.ClosestPoint, Target=closest_point_4.ClosestPoint)  # -> Geometry, Transform
deconstruct_mesh_5 = DeconstructMesh(Mesh=orient_2.Geometry)  # -> flatten(Vertices), Faces, Colours, Normals
deconstruct_mesh_6 = DeconstructMesh(Mesh=mesh_4)  # -> Vertices, Faces, Colours, Normals
closest_point_7 = ClosestPoint(Point=closest_point_4.ClosestPoint, Cloud=deconstruct_mesh_6.Vertices)  # -> flatten(ClosestPoint), CPIndex, Distance
closest_point_8 = ClosestPoint(Point=populate_2d, Cloud=deconstruct_mesh_5.Vertices)  # -> flatten(ClosestPoint), CPIndex, Distance
closest_point_9 = ClosestPoint(Point=closest_point_4.ClosestPoint, Cloud=closest_point_7.ClosestPoint)  # -> ClosestPoint, CPIndex, Distance
orient_3 = Orient(Geometry=mesh_4, Source=closest_point_9.ClosestPoint, Target=closest_point_8.ClosestPoint)  # -> Geometry, Transform

explode_tree = ExplodeTree()  # -> _00000, _00100, _00200, _00300, _00310, _00320, _00330, _00340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
gradient = Gradient(
    LowerLimit=0,
    UpperLimit=1,
    Parameter=Slider(0.12, range=0..1),
    stops=[0: RGB(234, 38, 0), 0.25: RGB(234, 126, 0), 0.5: RGB(254, 244, 84), 0.75: RGB(173, 203, 249), 1: RGB(75, 107, 169)])
gradient_2 = Gradient(
    LowerLimit=0,
    UpperLimit=1,
    Parameter=Slider(0.66, range=0..1),
    stops=[0: RGB(234, 38, 0), 0.25: RGB(234, 126, 0), 0.5: RGB(254, 244, 84), 0.75: RGB(173, 203, 249), 1: RGB(75, 107, 169)])
gradient_3 = Gradient(
    LowerLimit=0,
    UpperLimit=1,
    Parameter=Slider(0.51, range=0..1),
    stops=[0: RGB(234, 38, 0), 0.25: RGB(234, 126, 0), 0.5: RGB(254, 244, 84), 0.75: RGB(173, 203, 249), 1: RGB(75, 107, 169)])
gradient_4 = Gradient(LowerLimit=0, UpperLimit=1, Parameter=Slider(0.87, range=0..1), stops=[0.15: RGB(255, 130, 160), 0.85: RGB(220, 0, 40)])
gradient_5 = Gradient(LowerLimit=0, UpperLimit=1, Parameter=Slider(0.02, range=0..1), stops=[0.15: RGB(255, 130, 160), 0.85: RGB(220, 0, 40)])
gradient_6 = Gradient(
    LowerLimit=0,
    UpperLimit=1,
    Parameter=Slider(0, range=0..1),
    stops=[0.131: RGB(31, 197, 237), 0.19: RGB(29, 247, 176), 0.47: RGB(128, 180, 50), 0.85: RGB(220, 0, 40)])
gradient_7 = Gradient(
    LowerLimit=0,
    UpperLimit=1,
    Parameter=Slider(0.84, range=0..1),
    stops=[0: RGB(243, 57, 0), 0.1: RGB(236, 27, 60), 0.2: RGB(210, 0, 118), 0.3: RGB(103, 0, 120), 0.4: RGB(39, 72, 161), 0.6: RGB(18, 178, 90), 0.7: RGB(79, 186, 8), 0.8: RGB(220, 237, 32), 0.9: RGB(247, 159, 20), 1: RGB(243, 57, 0)])
gradient_8 = Gradient(
    LowerLimit=0,
    UpperLimit=1,
    Parameter=Slider(0.19, range=0..1),
    stops=[0: RGB(243, 57, 0), 0.1: RGB(236, 27, 60), 0.2: RGB(210, 0, 118), 0.3: RGB(103, 0, 120), 0.4: RGB(39, 72, 161), 0.6: RGB(18, 178, 90), 0.7: RGB(79, 186, 8), 0.8: RGB(220, 237, 32), 0.9: RGB(247, 159, 20), 1: RGB(243, 57, 0)])
gradient_9 = Gradient(
    LowerLimit=0,
    UpperLimit=1,
    Parameter=Slider(0.54, range=0..1),
    stops=[0: RGB(243, 57, 0), 0.1: RGB(236, 27, 60), 0.2: RGB(210, 0, 118), 0.3: RGB(103, 0, 120), 0.4: RGB(39, 72, 161), 0.6: RGB(18, 178, 90), 0.7: RGB(79, 186, 8), 0.8: RGB(220, 237, 32), 0.9: RGB(247, 159, 20), 1: RGB(243, 57, 0)])
gradient_10 = Gradient(LowerLimit=0, UpperLimit=1, Parameter=Slider(0.21, range=0..1), stops=[0.704: RGB(173, 203, 249), 1: RGB(75, 107, 169)])
gradient_11 = Gradient(LowerLimit=0, UpperLimit=1, Parameter=Slider(1, range=0..1), stops=[0.804: RGB(173, 203, 249), 1: RGB(75, 107, 169)])
gradient_12 = Gradient(
    LowerLimit=0,
    UpperLimit=1,
    Parameter=Slider(0.86, range=0..1),
    stops=[0: RGB(234, 38, 0), 0.25: RGB(234, 126, 0), 0.5: RGB(254, 244, 84), 0.75: RGB(173, 203, 249), 1: RGB(75, 107, 169)])
gradient_13 = Gradient(LowerLimit=0, UpperLimit=1, Parameter=Slider(0.97, range=0..1), stops=[0.704: RGB(173, 203, 249), 1: RGB(75, 107, 169)])
gradient_14 = Gradient(
    LowerLimit=0,
    UpperLimit=1,
    Parameter=Slider(0, range=0..1),
    stops=[0.131: RGB(31, 197, 237), 0.19: RGB(29, 247, 176), 0.85: RGB(220, 0, 40)])
gradient_15 = Gradient(
    LowerLimit=0,
    UpperLimit=1,
    Parameter=Slider(0.89, range=0..1),
    stops=[0: RGB(243, 57, 0), 0.1: RGB(236, 27, 60), 0.2: RGB(210, 0, 118), 0.3: RGB(103, 0, 120), 0.4: RGB(39, 72, 161), 0.6: RGB(18, 178, 90), 0.7: RGB(79, 186, 8), 0.8: RGB(220, 237, 32), 0.9: RGB(247, 159, 20), 1: RGB(243, 57, 0)])
gradient_16 = Gradient(LowerLimit=0, UpperLimit=1, Parameter=Slider(0.22, range=0..1), stops=[0.704: RGB(173, 203, 249), 1: RGB(75, 107, 169)])
custom_preview = CustomPreview(Geometry=explode_tree._00320, Material=gradient)
custom_preview_2 = CustomPreview(Geometry=explode_tree._00370, Material=gradient_2)
custom_preview_3 = CustomPreview(Geometry=explode_tree._00100, Material=gradient_3)
custom_preview_4 = CustomPreview(Geometry=explode_tree._00310, Material=gradient_4)
custom_preview_5 = CustomPreview(Geometry=explode_tree._00350, Material=gradient_5)
custom_preview_6 = CustomPreview(Geometry=explode_tree._00000, Material=gradient_6)
custom_preview_7 = CustomPreview(Geometry=explode_tree._00340, Material=gradient_7)
custom_preview_8 = CustomPreview(Geometry=explode_tree._00380, Material=gradient_8)
custom_preview_9 = CustomPreview(Geometry=explode_tree._00300, Material=gradient_9)
custom_preview_10 = CustomPreview(Geometry=explode_tree._00330, Material=gradient_10)
custom_preview_11 = CustomPreview(Geometry=explode_tree._00360, Material=gradient_11)
custom_preview_12 = CustomPreview(Geometry=explode_tree._00390, Material=gradient_12)
custom_preview_13 = CustomPreview(Geometry=explode_tree._00200, Material=gradient_13)
custom_preview_14 = CustomPreview(Geometry=explode_tree._003120, Material=gradient_4)
custom_preview_15 = CustomPreview(Geometry=explode_tree._00000, Material=gradient_14)
custom_preview_16 = CustomPreview(Geometry=explode_tree._003110, Material=gradient_15)
custom_preview_17 = CustomPreview(Geometry=explode_tree._003100, Material=gradient_16)
