# Grasshopper definition MathDomain034.gh (Grasshopper 1.0.7)
# Copyright: Wickerson Studios
# plug-ins: Bifocals

image_sampler = ImageSampler(
    FilePath="C:\Users\Sculpture\Documents\2020Grasshopper\ScreenShots2019\Screenshots2020\SurfaceEditAlgorithm.PNG",
    Filter="Value",
    Interpolate=False,
    Umax=1,
    Umin=0,
    Vmax=1,
    Vmin=0,
    Wrap=1)  # disabled

# ----
# Wickerson Studio
# created by: Michael Wickerson
# Grasshopper for Rhino 3D Algorithmic Modeling
# www.wickersonstudios.com
# www.michaelwickerson.com
# https://www.youtube.com/channel/UC7J48Ppcsa6oncp6d29R0xw
# https://github.com/mwickerson
# https://www.facebook.com/michael.wickerson
# https://www.linkedin.com/in/michael-wickerson-696a80156/
# https://www.grasshopper3d.com/profile/MichaelWickerson
factorial = Factorial()
# 1001 GRASSHOPPER DEFINITIONS
# Wickerson Studio
# 
# created by: Michael Wickerson
# 
# Grasshopper for Rhino 3D Algorithmic Modeling
# 
# www.wickersonstudios.com
# www.michaelwickerson.com
# https://www.youtube.com/channel/UC7J48Ppcsa6oncp6d29R0xw
# https://github.com/mwickerson
# https://www.facebook.com/michael.wickerson
# https://www.linkedin.com/in/michael-wickerson-696a80156/
# https://www.grasshopper3d.com/profile/MichaelWickerson
# Math OPERATORS  034/1001
absolute = Absolute()
integer_division = IntegerDivision()
modulus = Modulus()

polygon = Polygon(Plane=PlaneXY(0, 0, 0), Radius=3, Segments=Slider(6, range=0..10), FilletRadius=0)  # -> Polygon, Length
area = Area(Geometry=polygon.Polygon)  # -> Area, Centroid
control_polygon = ControlPolygon(Curve=polygon.Polygon)  # -> Polygon, Points
cull_index = CullIndex(List=control_polygon.Points, Indices="-1", Wrap=True)
vector_2pt = Vector2Pt(PointA=area.Centroid, PointB=cull_index, Unitize=False)  # -> flatten(Vector), Length
move = Move(Geometry=cull_index, Motion=vector_2pt.Vector)  # -> Geometry, Transform
line = Line(StartPoint=cull_index, EndPoint=move.Geometry)
point_on_curve = PointOnCurve(line, parameter=0.157)
construct_domain = ConstructDomain(DomainStart=expr(".1", 0), DomainEnd=Slider(2, range=0..2))
list_length = ListLength(List=point_on_curve)
range = Range(Domain=construct_domain, Steps=expr("x-1", list_length))
unit_z = UnitZ(Factor=range)
jitter = Jitter(List=unit_z, Jitter=1, Seed=Slider(55, range=0..100))  # -> Values, Indices
multiplication = Multiplication(A=jitter.Values, B=Slider(2.03, range=0..10))
move_2 = Move(Geometry=flatten(point_on_curve), Motion=multiplication)  # -> Geometry, Transform
interpolate = Interpolate(Vertices=move_2.Geometry, Degree=3, Periodic=True, KnotStyle=1)  # -> Curve, Length, Domain
arc_3pt = Arc3Pt(PointA=cull_index, PointB=move_2.Geometry, PointC=move.Geometry)  # -> Arc, Plane, Radius
curve = Curve(arc_3pt.Arc)
pipe = Pipe(
    Curve=reparameterize([interpolate.Curve, line, arc_3pt.Arc]),
    Radius=Slider(0.13, range=0..1),
    Caps=Slider(2, range=0..10))
loft = Loft(Curves=curve, Options={Adjust=False, Closed=True, LoftEnds=0, LoftSimp=0, LoftType=0, Rebuild=10, Refit=0.01})
brep = Brep(loft)
deconstruct_brep = DeconstructBrep(Brep=brep)  # -> Faces, Edges, Vertices
divide_domain = DivideDomain(Domain=deconstruct_brep.Faces, UCount=Slider(10, range=0..10), VCount=Slider(1, range=0..10))
panel = Panel(deconstruct_brep.Faces)
construct_domain_2 = ConstructDomain(DomainStart=Slider(-1, range=-6..7), DomainEnd=Slider(0, range=0..10))
list_length_2 = ListLength(List=divide_domain)
cylinder = Cylinder(Base=PlaneXY(0, 0, 0), Radius=0.5, Length=1)
cone = Cone(Base=PlaneXY(0, 0, 0), Radius=0.5, Length=1)  # -> Cone, Tip
sphere = Sphere(Base=PlaneXY(0, 0, 0), Radius=1)
cap_holes = CapHoles(Brep=cone.Cone)
cap_holes_2 = CapHoles(Brep=cylinder)
center_box = CenterBox(Base=PlaneXY(0, 0, 0), X=1, Y=1, Z=1)
random = Random(Range=construct_domain_2, Number=list_length_2, Seed=Slider(12, range=0..100))
bounding_box = BoundingBox(Content=sphere, Plane=PlaneXY(0, 0, 0))  # -> Box, Box_2
surface_box = SurfaceBox(Surface=deconstruct_brep.Faces, Domain=divide_domain, Height=random)
box_morph = BoxMorph(Geometry=sphere, Reference=bounding_box.Box, Target=surface_box)  # -> graft(Geometry)

explode_tree = ExplodeTree(Data=pipe)  # -> _0000, _000000, _000001, _000002, _000003, _000004, _000005, _000006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
explode_tree_2 = ExplodeTree(Data=box_morph)  # -> _000000000, _000000001, _000000002, _000000003, _000000004, _000000005, _000000006, _000000007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
gradient = Gradient(
    LowerLimit=0,
    UpperLimit=1,
    Parameter=Slider(0.12, range=0..1),
    stops=[0: RGB(234, 38, 0), 0.25: RGB(234, 126, 0), 0.5: RGB(254, 244, 84), 0.75: RGB(173, 203, 249), 1: RGB(75, 107, 169)])
gradient_2 = Gradient(
    LowerLimit=0,
    UpperLimit=1,
    Parameter=Slider(0.66, range=0..1),
    stops=[0: RGB(234, 38, 0), 0.25: RGB(234, 126, 0), 0.5: RGB(254, 244, 84), 0.75: RGB(173, 203, 249), 1: RGB(75, 107, 169)])
gradient_3 = Gradient(
    LowerLimit=0,
    UpperLimit=1,
    Parameter=Slider(0.51, range=0..1),
    stops=[0: RGB(234, 38, 0), 0.25: RGB(234, 126, 0), 0.5: RGB(254, 244, 84), 0.75: RGB(173, 203, 249), 1: RGB(75, 107, 169)])
gradient_4 = Gradient(LowerLimit=0, UpperLimit=1, Parameter=Slider(0.87, range=0..1), stops=[0.15: RGB(255, 130, 160), 0.85: RGB(220, 0, 40)])
gradient_5 = Gradient(LowerLimit=0, UpperLimit=1, Parameter=Slider(0.02, range=0..1), stops=[0.15: RGB(255, 130, 160), 0.85: RGB(220, 0, 40)])
gradient_6 = Gradient(
    LowerLimit=0,
    UpperLimit=1,
    Parameter=Slider(0, range=0..1),
    stops=[0.131: RGB(31, 197, 237), 0.19: RGB(29, 247, 176), 0.47: RGB(128, 180, 50), 0.85: RGB(220, 0, 40)])
gradient_7 = Gradient(
    LowerLimit=0,
    UpperLimit=1,
    Parameter=Slider(0.84, range=0..1),
    stops=[0: RGB(243, 57, 0), 0.1: RGB(236, 27, 60), 0.2: RGB(210, 0, 118), 0.3: RGB(103, 0, 120), 0.4: RGB(39, 72, 161), 0.6: RGB(18, 178, 90), 0.7: RGB(79, 186, 8), 0.8: RGB(220, 237, 32), 0.9: RGB(247, 159, 20), 1: RGB(243, 57, 0)])
gradient_8 = Gradient(
    LowerLimit=0,
    UpperLimit=1,
    Parameter=Slider(0.19, range=0..1),
    stops=[0: RGB(243, 57, 0), 0.1: RGB(236, 27, 60), 0.2: RGB(210, 0, 118), 0.3: RGB(103, 0, 120), 0.4: RGB(39, 72, 161), 0.6: RGB(18, 178, 90), 0.7: RGB(79, 186, 8), 0.8: RGB(220, 237, 32), 0.9: RGB(247, 159, 20), 1: RGB(243, 57, 0)])
gradient_9 = Gradient(
    LowerLimit=0,
    UpperLimit=1,
    Parameter=Slider(0.54, range=0..1),
    stops=[0: RGB(243, 57, 0), 0.1: RGB(236, 27, 60), 0.2: RGB(210, 0, 118), 0.3: RGB(103, 0, 120), 0.4: RGB(39, 72, 161), 0.6: RGB(18, 178, 90), 0.7: RGB(79, 186, 8), 0.8: RGB(220, 237, 32), 0.9: RGB(247, 159, 20), 1: RGB(243, 57, 0)])
gradient_10 = Gradient(LowerLimit=0, UpperLimit=1, Parameter=Slider(0.21, range=0..1), stops=[0.704: RGB(173, 203, 249), 1: RGB(75, 107, 169)])
gradient_11 = Gradient(LowerLimit=0, UpperLimit=1, Parameter=Slider(1, range=0..1), stops=[0.804: RGB(173, 203, 249), 1: RGB(75, 107, 169)])
gradient_12 = Gradient(
    LowerLimit=0,
    UpperLimit=1,
    Parameter=Slider(0.86, range=0..1),
    stops=[0: RGB(234, 38, 0), 0.25: RGB(234, 126, 0), 0.5: RGB(254, 244, 84), 0.75: RGB(173, 203, 249), 1: RGB(75, 107, 169)])
gradient_13 = Gradient(LowerLimit=0, UpperLimit=1, Parameter=Slider(0.97, range=0..1), stops=[0.704: RGB(173, 203, 249), 1: RGB(75, 107, 169)])
gradient_14 = Gradient(
    LowerLimit=0,
    UpperLimit=1,
    Parameter=Slider(0, range=0..1),
    stops=[0.131: RGB(31, 197, 237), 0.19: RGB(29, 247, 176), 0.85: RGB(220, 0, 40)])
gradient_15 = Gradient(
    LowerLimit=0,
    UpperLimit=1,
    Parameter=Slider(0.89, range=0..1),
    stops=[0: RGB(243, 57, 0), 0.1: RGB(236, 27, 60), 0.2: RGB(210, 0, 118), 0.3: RGB(103, 0, 120), 0.4: RGB(39, 72, 161), 0.6: RGB(18, 178, 90), 0.7: RGB(79, 186, 8), 0.8: RGB(220, 237, 32), 0.9: RGB(247, 159, 20), 1: RGB(243, 57, 0)])
gradient_16 = Gradient(LowerLimit=0, UpperLimit=1, Parameter=Slider(0.22, range=0..1), stops=[0.704: RGB(173, 203, 249), 1: RGB(75, 107, 169)])
custom_preview = CustomPreview(Geometry=[explode_tree_2._000000000, explode_tree_2._000000207], Material=gradient_6)
custom_preview_2 = CustomPreview(Geometry=[explode_tree_2._000000001, explode_tree_2._000000206], Material=gradient_3)
custom_preview_3 = CustomPreview(Geometry=[explode_tree_2._000000002, explode_tree_2._000000205], Material=gradient_13)
custom_preview_4 = CustomPreview(Geometry=[explode_tree_2._000000003, explode_tree_2._000000204], Material=gradient_9)
custom_preview_5 = CustomPreview(Geometry=[explode_tree_2._000000004, explode_tree_2._000000203], Material=gradient_4)
custom_preview_6 = CustomPreview(
    Geometry=[explode_tree_2._000000005, explode_tree._0000, explode_tree_2._000000209, explode_tree_2._000000208, explode_tree_2._000000106],
    Material=gradient)
custom_preview_7 = CustomPreview(
    Geometry=[explode_tree_2._000000006, explode_tree._000000, explode_tree_2._000000300, explode_tree_2._000000107],
    Material=gradient_10)
custom_preview_8 = CustomPreview(
    Geometry=[explode_tree_2._000000007, explode_tree._000001, explode_tree_2._000000301, explode_tree_2._000000108],
    Material=gradient_7)
custom_preview_9 = CustomPreview(
    Geometry=[explode_tree_2._000000008, explode_tree._000002, explode_tree_2._000000302, explode_tree_2._000000109],
    Material=gradient_5)
custom_preview_10 = CustomPreview(
    Geometry=[explode_tree_2._000000100, explode_tree._000003, explode_tree_2._000000303, explode_tree_2._000000200],
    Material=gradient_2)
custom_preview_11 = CustomPreview(Geometry=[explode_tree_2._000000009, explode_tree._000004, explode_tree_2._000000201], Material=gradient_11)
custom_preview_12 = CustomPreview(
    Geometry=[explode_tree_2._000000101, explode_tree._000005, explode_tree._000006, explode_tree_2._000000304, explode_tree_2._000000202],
    Material=gradient_8)
custom_preview_13 = CustomPreview(Geometry=[explode_tree_2._000000000, explode_tree._0001, explode_tree_2._000000305], Material=gradient_14)
custom_preview_14 = CustomPreview(Geometry=[explode_tree_2._000000102, explode_tree._0002, explode_tree_2._000000306], Material=gradient_12)
custom_preview_15 = CustomPreview(Geometry=[explode_tree_2._000000103, explode_tree.Branch10, explode_tree_2._000000307], Material=gradient_16)
custom_preview_16 = CustomPreview(Geometry=[explode_tree_2._000000104, explode_tree.Branch11, explode_tree_2._000000308], Material=gradient_15)
custom_preview_17 = CustomPreview(Geometry=[explode_tree_2._000000105, explode_tree.Branch12, explode_tree_2._000000309], Material=gradient_4)
