# Grasshopper definition MathDomain035SkeletonBonus002.gh (Grasshopper 1.0.7)
# Copyright: Wickerson Studios
# plug-ins: Firefly.X, Bifocals

# 1001 GRASSHOPPER DEFINITIONS
# Wickerson Studio
# 
# created by: Michael Wickerson
# 
# Grasshopper for Rhino 3D Algorithmic Modeling
# 
# www.wickersonstudios.com
# www.michaelwickerson.com
# https://www.youtube.com/channel/UC7J48Ppcsa6oncp6d29R0xw
# https://github.com/mwickerson
# https://www.facebook.com/michael.wickerson
# https://www.linkedin.com/in/michael-wickerson-696a80156/
# https://www.grasshopper3d.com/profile/MichaelWickerson
image_sampler = ImageSampler(
    FilePath="C:\Users\Sculpture\Documents\2020Grasshopper\ScreenShots2019\Screenshots2020\SurfaceEditAlgorithm.PNG",
    Filter="Value",
    Interpolate=False,
    Umax=1,
    Umin=0,
    Vmax=1,
    Vmin=0,
    Wrap=1)

# ----
# Top of Head
# Skull
# Bottom of Head
# Wickerson Studio
# created by: Michael Wickerson
# Grasshopper for Rhino 3D Algorithmic Modeling
# www.wickersonstudios.com
# www.michaelwickerson.com
# https://www.youtube.com/channel/UC7J48Ppcsa6oncp6d29R0xw
# https://github.com/mwickerson
# https://www.facebook.com/michael.wickerson
# https://www.linkedin.com/in/michael-wickerson-696a80156/
# https://www.grasshopper3d.com/profile/MichaelWickerson
# Jaw and Pivot Point
# Upper Arms
# Lower Arms
# Hand
number_slider = Slider(0.2, range=0..1)
sound_capture = SoundCapture(TimePeriod=number_slider, StartStopSoundCapture=Toggle(True))  # -> WavePressureSamplesFromLeftChannel, WavePressureSamplesFromRightChannel, Volume
timer = Timer(TimerInterval=20, Target=sound_capture)
sound_capture_2 = SoundCapture(TimePeriod=Slider(0.2, range=0..1), StartStopSoundCapture=Toggle(True))  # -> WavePressureSamplesFromLeftChannel, WavePressureSamplesFromRightChannel, Volume
sound_capture_3 = SoundCapture(TimePeriod=Slider(0.2, range=0..1), StartStopSoundCapture=Toggle(True))  # -> WavePressureSamplesFromLeftChannel, WavePressureSamplesFromRightChannel, Volume
sound_capture_4 = SoundCapture(TimePeriod=Slider(0.2, range=0..1), StartStopSoundCapture=Toggle(True))  # -> WavePressureSamplesFromLeftChannel, WavePressureSamplesFromRightChannel, Volume
timer_2 = Timer(TimerInterval=20, Target=sound_capture_2)
timer_3 = Timer(TimerInterval=20, Target=sound_capture_3)
timer_4 = Timer(TimerInterval=20, Target=sound_capture_4)
number_slider_2 = Slider(0.04, range=0..1)
number_slider_3 = Slider(0.04, range=0..1)
number_slider_4 = Slider(0.04, range=0..1)
number_slider_5 = Slider(0.04, range=0..1)
mesh = Mesh(<mesh referenced from the Rhino model>)
unit_x = UnitX(Factor=1)
unit_x_2 = UnitX(Factor=1)
number_slider_6 = Slider(12100, range=0..12100)
unit_x_3 = UnitX(Factor=1)
mesh_2 = Mesh(<mesh referenced from the Rhino model>)
point = Point(Point(-1.314412709, -7.332245749, 243.9325516))
mesh_3 = Mesh(<mesh referenced from the Rhino model>)
mesh_4 = Mesh(<mesh referenced from the Rhino model>)
# SKELETON BONUS RIGGING  036/1001
point_2 = Point(Point(-1.314412709, -2.594515377, 263.6941652))
point_3 = Point(<point referenced from the Rhino model>)
negative = Negative(Value=number_slider_6)
negative_2 = Negative(Value=Slider(221, range=0..12100))
deconstruct_mesh = DeconstructMesh(Mesh=mesh)  # -> Vertices, Faces, Colours, Normals
point_4 = Point(Point(0, 1.805833044, 213.7278485))
mesh_5 = Mesh(<mesh referenced from the Rhino model>)
deconstruct_mesh_2 = DeconstructMesh(Mesh=mesh_2)  # -> Vertices, Faces, Colours, Normals
unit_x_4 = UnitX(Factor=1)
division = Division(A=sound_capture.Volume, B=Slider(1131, range=0..12100))
pi = Pi(Factor=division)
division_2 = Division(A=sound_capture_3.Volume, B=number_slider_6)
pi_2 = Pi(Factor=division_2)
division_3 = Division(A=sound_capture_2.Volume, B=negative)
pi_3 = Pi(Factor=division_3)
division_4 = Division(A=sound_capture_4.Volume, B=negative_2)
pi_4 = Pi(Factor=division_4)
list_item = ListItem(List=deconstruct_mesh.Vertices, Index=Slider(192, range=0..2500), Wrap=True)
panel = Panel(division)
rotate_3d = Rotate3D(Geometry=mesh_4, Angle=pi, Center=point, Axis=unit_x_4)  # -> Geometry, Transform
list_item_2 = ListItem(List=deconstruct_mesh_2.Vertices, Index=Slider(1951, range=0..2500), Wrap=True)
panel_2 = Panel(division_3)
rotate_3d_2 = Rotate3D(Geometry=mesh_5, Angle=pi_2, Center=point_4, Axis=unit_x_2)  # -> Geometry, Transform
panel_3 = Panel(division_2)
panel_4 = Panel(division_4)
point_5 = Point(list_item)
deconstruct_mesh_3 = DeconstructMesh(Mesh=rotate_3d_2.Geometry)  # -> Vertices, Faces, Colours, Normals
point_6 = Point(list_item_2)
list_item_3 = ListItem(List=deconstruct_mesh_3.Vertices, Index=Slider(1500, range=0..1500), Wrap=True)
point_7 = Point(list_item_3)
explode_tree = ExplodeTree(Data=point_7)  # -> Branch0, Branch1
point_8 = Point(explode_tree.Branch0)
rotate_3d_3 = Rotate3D(Geometry=mesh_2, Angle=pi_4, Center=point_8, Axis=unit_x_3)  # -> Geometry, Transform
orient = Orient(Geometry=rotate_3d_3.Geometry, Source=point_6, Target=point_8)  # -> flatten(Geometry), Transform
deconstruct_mesh_4 = DeconstructMesh(Mesh=orient.Geometry)  # -> Vertices, Faces, Colours, Normals
list_item_4 = ListItem(List=deconstruct_mesh_4.Vertices, Index=Slider(1699, range=0..2500), Wrap=True)
point_9 = Point(list_item_4)
rotate_3d_4 = Rotate3D(Geometry=mesh, Angle=pi_3, Center=point_9, Axis=unit_x)  # -> Geometry, Transform
orient_2 = Orient(Geometry=rotate_3d_4.Geometry, Source=point_5, Target=point_9)  # -> flatten(Geometry), Transform
merge = Merge(Data1=mesh_3, Data2=rotate_3d.Geometry, Data3=rotate_3d_2.Geometry, Data4=orient.Geometry, Data5=orient_2.Geometry)

explode_tree_2 = ExplodeTree()  # -> Branch0, Branch1, Branch2, Branch3, Branch4, Branch5, Branch6, Branch7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
gradient = Gradient(
    LowerLimit=0,
    UpperLimit=1,
    Parameter=Slider(0.12, range=0..1),
    stops=[0: RGB(234, 38, 0), 0.25: RGB(234, 126, 0), 0.5: RGB(254, 244, 84), 0.75: RGB(173, 203, 249), 1: RGB(75, 107, 169)])
gradient_2 = Gradient(
    LowerLimit=0,
    UpperLimit=1,
    Parameter=Slider(0.66, range=0..1),
    stops=[0: RGB(234, 38, 0), 0.25: RGB(234, 126, 0), 0.5: RGB(254, 244, 84), 0.75: RGB(173, 203, 249), 1: RGB(75, 107, 169)])
gradient_3 = Gradient(
    LowerLimit=0,
    UpperLimit=1,
    Parameter=Slider(0.51, range=0..1),
    stops=[0: RGB(234, 38, 0), 0.25: RGB(234, 126, 0), 0.5: RGB(254, 244, 84), 0.75: RGB(173, 203, 249), 1: RGB(75, 107, 169)])
gradient_4 = Gradient(LowerLimit=0, UpperLimit=1, Parameter=Slider(0.87, range=0..1), stops=[0.15: RGB(255, 130, 160), 0.85: RGB(220, 0, 40)])
gradient_5 = Gradient(LowerLimit=0, UpperLimit=1, Parameter=Slider(0.02, range=0..1), stops=[0.15: RGB(255, 130, 160), 0.85: RGB(220, 0, 40)])
gradient_6 = Gradient(
    LowerLimit=0,
    UpperLimit=1,
    Parameter=Slider(0, range=0..1),
    stops=[0.131: RGB(31, 197, 237), 0.19: RGB(29, 247, 176), 0.47: RGB(128, 180, 50), 0.85: RGB(220, 0, 40)])
gradient_7 = Gradient(
    LowerLimit=0,
    UpperLimit=1,
    Parameter=Slider(0.84, range=0..1),
    stops=[0: RGB(243, 57, 0), 0.1: RGB(236, 27, 60), 0.2: RGB(210, 0, 118), 0.3: RGB(103, 0, 120), 0.4: RGB(39, 72, 161), 0.6: RGB(18, 178, 90), 0.7: RGB(79, 186, 8), 0.8: RGB(220, 237, 32), 0.9: RGB(247, 159, 20), 1: RGB(243, 57, 0)])
gradient_8 = Gradient(
    LowerLimit=0,
    UpperLimit=1,
    Parameter=Slider(0.19, range=0..1),
    stops=[0: RGB(243, 57, 0), 0.1: RGB(236, 27, 60), 0.2: RGB(210, 0, 118), 0.3: RGB(103, 0, 120), 0.4: RGB(39, 72, 161), 0.6: RGB(18, 178, 90), 0.7: RGB(79, 186, 8), 0.8: RGB(220, 237, 32), 0.9: RGB(247, 159, 20), 1: RGB(243, 57, 0)])
gradient_9 = Gradient(
    LowerLimit=0,
    UpperLimit=1,
    Parameter=Slider(0.54, range=0..1),
    stops=[0: RGB(243, 57, 0), 0.1: RGB(236, 27, 60), 0.2: RGB(210, 0, 118), 0.3: RGB(103, 0, 120), 0.4: RGB(39, 72, 161), 0.6: RGB(18, 178, 90), 0.7: RGB(79, 186, 8), 0.8: RGB(220, 237, 32), 0.9: RGB(247, 159, 20), 1: RGB(243, 57, 0)])
gradient_10 = Gradient(LowerLimit=0, UpperLimit=1, Parameter=Slider(0.21, range=0..1), stops=[0.704: RGB(173, 203, 249), 1: RGB(75, 107, 169)])
gradient_11 = Gradient(LowerLimit=0, UpperLimit=1, Parameter=Slider(1, range=0..1), stops=[0.804: RGB(173, 203, 249), 1: RGB(75, 107, 169)])
gradient_12 = Gradient(
    LowerLimit=0,
    UpperLimit=1,
    Parameter=Slider(0.86, range=0..1),
    stops=[0: RGB(234, 38, 0), 0.25: RGB(234, 126, 0), 0.5: RGB(254, 244, 84), 0.75: RGB(173, 203, 249), 1: RGB(75, 107, 169)])
gradient_13 = Gradient(LowerLimit=0, UpperLimit=1, Parameter=Slider(0.97, range=0..1), stops=[0.704: RGB(173, 203, 249), 1: RGB(75, 107, 169)])
gradient_14 = Gradient(
    LowerLimit=0,
    UpperLimit=1,
    Parameter=Slider(0, range=0..1),
    stops=[0.131: RGB(31, 197, 237), 0.19: RGB(29, 247, 176), 0.85: RGB(220, 0, 40)])
gradient_15 = Gradient(
    LowerLimit=0,
    UpperLimit=1,
    Parameter=Slider(0.89, range=0..1),
    stops=[0: RGB(243, 57, 0), 0.1: RGB(236, 27, 60), 0.2: RGB(210, 0, 118), 0.3: RGB(103, 0, 120), 0.4: RGB(39, 72, 161), 0.6: RGB(18, 178, 90), 0.7: RGB(79, 186, 8), 0.8: RGB(220, 237, 32), 0.9: RGB(247, 159, 20), 1: RGB(243, 57, 0)])
gradient_16 = Gradient(LowerLimit=0, UpperLimit=1, Parameter=Slider(0.22, range=0..1), stops=[0.704: RGB(173, 203, 249), 1: RGB(75, 107, 169)])
custom_preview = CustomPreview(Geometry=explode_tree_2.Branch5, Material=gradient)
custom_preview_2 = CustomPreview(Geometry=explode_tree_2.Branch10, Material=gradient_2)
custom_preview_3 = CustomPreview(Geometry=explode_tree_2.Branch1, Material=gradient_3)
custom_preview_4 = CustomPreview(Geometry=explode_tree_2.Branch4, Material=gradient_4)
custom_preview_5 = CustomPreview(Geometry=explode_tree_2.Branch8, Material=gradient_5)
custom_preview_6 = CustomPreview(Geometry=explode_tree_2.Branch0, Material=gradient_6)
custom_preview_7 = CustomPreview(Geometry=explode_tree_2.Branch7, Material=gradient_7)
custom_preview_8 = CustomPreview(Geometry=explode_tree_2.Branch11, Material=gradient_8)
custom_preview_9 = CustomPreview(Geometry=explode_tree_2.Branch3, Material=gradient_9)
custom_preview_10 = CustomPreview(Geometry=explode_tree_2.Branch6, Material=gradient_10)
custom_preview_11 = CustomPreview(Geometry=explode_tree_2.Branch9, Material=gradient_11)
custom_preview_12 = CustomPreview(Geometry=explode_tree_2.Branch12, Material=gradient_12)
custom_preview_13 = CustomPreview(Geometry=explode_tree_2.Branch2, Material=gradient_13)
custom_preview_14 = CustomPreview(Geometry=explode_tree_2.Branch15, Material=gradient_4)
custom_preview_15 = CustomPreview(Geometry=explode_tree_2.Branch0, Material=gradient_14)
custom_preview_16 = CustomPreview(Geometry=explode_tree_2.Branch14, Material=gradient_15)
custom_preview_17 = CustomPreview(Geometry=explode_tree_2.Branch13, Material=gradient_16)
