# Grasshopper definition MathDomain036.gh (Grasshopper 1.0.7)
# Copyright: Wickerson Studios
# plug-ins: Bifocals

image_sampler = ImageSampler(
    FilePath="C:\Users\Sculpture\Documents\2020Grasshopper\ScreenShots2019\Screenshots2020\SurfaceEditAlgorithm.PNG",
    Filter="Value",
    Interpolate=False,
    Umax=1,
    Umin=0,
    Vmax=1,
    Vmin=0,
    Wrap=1)

# ----
# Wickerson Studio
# created by: Michael Wickerson
# Grasshopper for Rhino 3D Algorithmic Modeling
# www.wickersonstudios.com
# www.michaelwickerson.com
# https://www.youtube.com/channel/UC7J48Ppcsa6oncp6d29R0xw
# https://github.com/mwickerson
# https://www.facebook.com/michael.wickerson
# https://www.linkedin.com/in/michael-wickerson-696a80156/
# https://www.grasshopper3d.com/profile/MichaelWickerson
factorial = Factorial()
# 1001 GRASSHOPPER DEFINITIONS
# Wickerson Studio
# 
# created by: Michael Wickerson
# 
# Grasshopper for Rhino 3D Algorithmic Modeling
# 
# www.wickersonstudios.com
# www.michaelwickerson.com
# https://www.youtube.com/channel/UC7J48Ppcsa6oncp6d29R0xw
# https://github.com/mwickerson
# https://www.facebook.com/michael.wickerson
# https://www.linkedin.com/in/michael-wickerson-696a80156/
# https://www.grasshopper3d.com/profile/MichaelWickerson
# MATH OPERATORS  036/1001
absolute = Absolute()
integer_division = IntegerDivision()
modulus = Modulus()

explode_tree = ExplodeTree()  # -> Branch0, Branch1, Branch2, Branch3, Branch4, Branch5, Branch6, Branch7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
gradient = Gradient(
    LowerLimit=0,
    UpperLimit=1,
    Parameter=Slider(0.12, range=0..1),
    stops=[0: RGB(234, 38, 0), 0.25: RGB(234, 126, 0), 0.5: RGB(254, 244, 84), 0.75: RGB(173, 203, 249), 1: RGB(75, 107, 169)])
gradient_2 = Gradient(
    LowerLimit=0,
    UpperLimit=1,
    Parameter=Slider(0.66, range=0..1),
    stops=[0: RGB(234, 38, 0), 0.25: RGB(234, 126, 0), 0.5: RGB(254, 244, 84), 0.75: RGB(173, 203, 249), 1: RGB(75, 107, 169)])
gradient_3 = Gradient(
    LowerLimit=0,
    UpperLimit=1,
    Parameter=Slider(0.51, range=0..1),
    stops=[0: RGB(234, 38, 0), 0.25: RGB(234, 126, 0), 0.5: RGB(254, 244, 84), 0.75: RGB(173, 203, 249), 1: RGB(75, 107, 169)])
gradient_4 = Gradient(LowerLimit=0, UpperLimit=1, Parameter=Slider(0.87, range=0..1), stops=[0.15: RGB(255, 130, 160), 0.85: RGB(220, 0, 40)])
gradient_5 = Gradient(LowerLimit=0, UpperLimit=1, Parameter=Slider(0.02, range=0..1), stops=[0.15: RGB(255, 130, 160), 0.85: RGB(220, 0, 40)])
gradient_6 = Gradient(
    LowerLimit=0,
    UpperLimit=1,
    Parameter=Slider(0, range=0..1),
    stops=[0.131: RGB(31, 197, 237), 0.19: RGB(29, 247, 176), 0.47: RGB(128, 180, 50), 0.85: RGB(220, 0, 40)])
gradient_7 = Gradient(
    LowerLimit=0,
    UpperLimit=1,
    Parameter=Slider(0.84, range=0..1),
    stops=[0: RGB(243, 57, 0), 0.1: RGB(236, 27, 60), 0.2: RGB(210, 0, 118), 0.3: RGB(103, 0, 120), 0.4: RGB(39, 72, 161), 0.6: RGB(18, 178, 90), 0.7: RGB(79, 186, 8), 0.8: RGB(220, 237, 32), 0.9: RGB(247, 159, 20), 1: RGB(243, 57, 0)])
gradient_8 = Gradient(
    LowerLimit=0,
    UpperLimit=1,
    Parameter=Slider(0.19, range=0..1),
    stops=[0: RGB(243, 57, 0), 0.1: RGB(236, 27, 60), 0.2: RGB(210, 0, 118), 0.3: RGB(103, 0, 120), 0.4: RGB(39, 72, 161), 0.6: RGB(18, 178, 90), 0.7: RGB(79, 186, 8), 0.8: RGB(220, 237, 32), 0.9: RGB(247, 159, 20), 1: RGB(243, 57, 0)])
gradient_9 = Gradient(
    LowerLimit=0,
    UpperLimit=1,
    Parameter=Slider(0.54, range=0..1),
    stops=[0: RGB(243, 57, 0), 0.1: RGB(236, 27, 60), 0.2: RGB(210, 0, 118), 0.3: RGB(103, 0, 120), 0.4: RGB(39, 72, 161), 0.6: RGB(18, 178, 90), 0.7: RGB(79, 186, 8), 0.8: RGB(220, 237, 32), 0.9: RGB(247, 159, 20), 1: RGB(243, 57, 0)])
gradient_10 = Gradient(LowerLimit=0, UpperLimit=1, Parameter=Slider(0.21, range=0..1), stops=[0.704: RGB(173, 203, 249), 1: RGB(75, 107, 169)])
gradient_11 = Gradient(LowerLimit=0, UpperLimit=1, Parameter=Slider(1, range=0..1), stops=[0.804: RGB(173, 203, 249), 1: RGB(75, 107, 169)])
gradient_12 = Gradient(
    LowerLimit=0,
    UpperLimit=1,
    Parameter=Slider(0.86, range=0..1),
    stops=[0: RGB(234, 38, 0), 0.25: RGB(234, 126, 0), 0.5: RGB(254, 244, 84), 0.75: RGB(173, 203, 249), 1: RGB(75, 107, 169)])
gradient_13 = Gradient(LowerLimit=0, UpperLimit=1, Parameter=Slider(0.97, range=0..1), stops=[0.704: RGB(173, 203, 249), 1: RGB(75, 107, 169)])
gradient_14 = Gradient(
    LowerLimit=0,
    UpperLimit=1,
    Parameter=Slider(0, range=0..1),
    stops=[0.131: RGB(31, 197, 237), 0.19: RGB(29, 247, 176), 0.85: RGB(220, 0, 40)])
gradient_15 = Gradient(
    LowerLimit=0,
    UpperLimit=1,
    Parameter=Slider(0.89, range=0..1),
    stops=[0: RGB(243, 57, 0), 0.1: RGB(236, 27, 60), 0.2: RGB(210, 0, 118), 0.3: RGB(103, 0, 120), 0.4: RGB(39, 72, 161), 0.6: RGB(18, 178, 90), 0.7: RGB(79, 186, 8), 0.8: RGB(220, 237, 32), 0.9: RGB(247, 159, 20), 1: RGB(243, 57, 0)])
gradient_16 = Gradient(LowerLimit=0, UpperLimit=1, Parameter=Slider(0.22, range=0..1), stops=[0.704: RGB(173, 203, 249), 1: RGB(75, 107, 169)])
custom_preview = CustomPreview(Geometry=explode_tree.Branch5, Material=gradient)
custom_preview_2 = CustomPreview(Geometry=explode_tree.Branch10, Material=gradient_2)
custom_preview_3 = CustomPreview(Geometry=explode_tree.Branch1, Material=gradient_3)
custom_preview_4 = CustomPreview(Geometry=explode_tree.Branch4, Material=gradient_4)
custom_preview_5 = CustomPreview(Geometry=explode_tree.Branch8, Material=gradient_5)
custom_preview_6 = CustomPreview(Geometry=explode_tree.Branch0, Material=gradient_6)
custom_preview_7 = CustomPreview(Geometry=explode_tree.Branch7, Material=gradient_7)
custom_preview_8 = CustomPreview(Geometry=explode_tree.Branch11, Material=gradient_8)
custom_preview_9 = CustomPreview(Geometry=explode_tree.Branch3, Material=gradient_9)
custom_preview_10 = CustomPreview(Geometry=explode_tree.Branch6, Material=gradient_10)
custom_preview_11 = CustomPreview(Geometry=explode_tree.Branch9, Material=gradient_11)
custom_preview_12 = CustomPreview(Geometry=explode_tree.Branch12, Material=gradient_12)
custom_preview_13 = CustomPreview(Geometry=explode_tree.Branch2, Material=gradient_13)
custom_preview_14 = CustomPreview(Geometry=explode_tree.Branch15, Material=gradient_4)
custom_preview_15 = CustomPreview(Geometry=explode_tree.Branch0, Material=gradient_14)
custom_preview_16 = CustomPreview(Geometry=explode_tree.Branch14, Material=gradient_15)
custom_preview_17 = CustomPreview(Geometry=explode_tree.Branch13, Material=gradient_16)

number_slider = Slider(4, range=3..5)
square = Square(Plane=PlaneXY(0, 0, 0), Size=number_slider, ExtentX=12, ExtentY=12)  # -> Cells, Points
polygon = Polygon(Plane=PlaneXY(0, 0, 0), Radius=number_slider, Segments=number_slider, FilletRadius=0)  # -> Polygon, Length
number_slider_2 = Slider(10, range=0..10)
number_slider_3 = Slider(5, range=0..5)
number_slider_4 = Slider(10, range=0..10)
number_slider_5 = Slider(4, range=0..10)
number_slider_6 = Slider(1, range=1..5)
cull_index = CullIndex(List=square.Points, Indices="-1", Wrap=True)
orient = Orient(Geometry=polygon.Polygon, Source=PlaneXY(0, 0, 0), Target=cull_index)  # -> Geometry, Transform
negative = Negative(Value=number_slider_3)
negative_2 = Negative(Value=number_slider_2)
negative_3 = Negative(Value=number_slider_4)
negative_4 = Negative(Value=number_slider_5)
explode_tree_2 = ExplodeTree(Data=orient.Geometry)  # -> _0000, _0010, _0020, _0030, _0040, _0050, _0060, _0070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
construct_domain = ConstructDomain(DomainStart=negative_2, DomainEnd=number_slider_2)
construct_domain_2 = ConstructDomain(DomainStart=0, DomainEnd=number_slider_2)
construct_domain_3 = ConstructDomain(DomainStart=negative_3, DomainEnd=number_slider_4)
construct_domain_4 = ConstructDomain(DomainStart=negative, DomainEnd=number_slider_3)
construct_domain_5 = ConstructDomain(DomainStart=negative_4, DomainEnd=number_slider_5)
construct_domain_6 = ConstructDomain(DomainStart=0, DomainEnd=number_slider_4)
construct_domain_7 = ConstructDomain(DomainStart=0, DomainEnd=number_slider_3)
construct_domain_8 = ConstructDomain(DomainStart=0, DomainEnd=number_slider_5)
curve = Curve(explode_tree_2._0000)
curve_2 = Curve(explode_tree_2._0010)
curve_3 = Curve(explode_tree_2._0020)
curve_4 = Curve(explode_tree_2._0030)
curve_5 = Curve(explode_tree_2._0040)
curve_6 = Curve(explode_tree_2._0050)
curve_7 = Curve(explode_tree_2._0060)
curve_8 = Curve(explode_tree_2._0070)
curve_9 = Curve(explode_tree_2._0080)
curve_10 = Curve(explode_tree_2._0090)
curve_11 = Curve(explode_tree_2._00100)
curve_12 = Curve(explode_tree_2._00110)
curve_13 = Curve(explode_tree_2._00120)
boundary_surfaces = BoundarySurfaces(Edges=curve)
boundary_surfaces_2 = BoundarySurfaces(Edges=curve_3)
boundary_surfaces_3 = BoundarySurfaces(Edges=curve_5)
boundary_surfaces_4 = BoundarySurfaces(Edges=curve_7)
boundary_surfaces_5 = BoundarySurfaces(Edges=curve_9)
boundary_surfaces_6 = BoundarySurfaces(Edges=curve_11)
boundary_surfaces_7 = BoundarySurfaces(Edges=curve_13)
list_length = ListLength(List=boundary_surfaces)
expression = Expression(x=list_length, Expression="x-1")
range = Range(Domain=construct_domain, Steps=expression)
range_2 = Range(Domain=construct_domain_2, Steps=expression)
range_3 = Range(Domain=construct_domain_3, Steps=expression)
range_4 = Range(Domain=construct_domain_4, Steps=expression)
range_5 = Range(Domain=construct_domain_5, Steps=expression)
range_6 = Range(Domain=construct_domain_6, Steps=expression)
range_7 = Range(Domain=construct_domain_7, Steps=expression)
range_8 = Range(Domain=construct_domain_8, Steps=expression)

factorial_2 = Factorial(Number=range_7)
factorial_3 = Factorial(Number=range_4)
absolute_2 = Absolute(Value=range_2)
absolute_3 = Absolute(Value=range)
integer_division_2 = IntegerDivision(A=range_8, B=number_slider_6)
integer_division_3 = IntegerDivision(A=range_5, B=number_slider_6)
modulus_2 = Modulus(A=range_3, B=Slider(5, range=1..5))

unit_z = UnitZ(Factor=absolute_2)
unit_z_2 = UnitZ(Factor=absolute_3)
unit_z_3 = UnitZ(Factor=factorial_2)
unit_z_4 = UnitZ(Factor=factorial_3)
unit_z_5 = UnitZ(Factor=integer_division_2)
unit_z_6 = UnitZ(Factor=integer_division_3)
unit_z_7 = UnitZ(Factor=modulus_2)
extrude = Extrude(Base=boundary_surfaces, Direction=unit_z)
extrude_2 = Extrude(Base=boundary_surfaces_2, Direction=unit_z_2)
extrude_3 = Extrude(Base=boundary_surfaces_3, Direction=unit_z_3)
extrude_4 = Extrude(Base=boundary_surfaces_4, Direction=unit_z_4)
extrude_5 = Extrude(Base=boundary_surfaces_5, Direction=unit_z_5)
extrude_6 = Extrude(Base=boundary_surfaces_6, Direction=unit_z_6)
extrude_7 = Extrude(Base=boundary_surfaces_7, Direction=unit_z_7)
