# Grasshopper definition MathDomain037.gh (Grasshopper 1.0.7)
# Copyright: Wickerson Studios
# plug-ins: Bifocals

image_sampler = ImageSampler(
    FilePath="C:\Users\Sculpture\Documents\2020Grasshopper\ScreenShots2019\Screenshots2020\SurfaceEditAlgorithm.PNG",
    Filter="Value",
    Interpolate=False,
    Umax=1,
    Umin=0,
    Vmax=1,
    Vmin=0,
    Wrap=1)

# ----
# 1001 GRASSHOPPER DEFINITIONS
# Wickerson Studio
# 
# created by: Michael Wickerson
# 
# Grasshopper for Rhino 3D Algorithmic Modeling
# 
# www.wickersonstudios.com
# www.michaelwickerson.com
# https://www.youtube.com/channel/UC7J48Ppcsa6oncp6d29R0xw
# https://github.com/mwickerson
# https://www.facebook.com/michael.wickerson
# https://www.linkedin.com/in/michael-wickerson-696a80156/
# https://www.grasshopper3d.com/profile/MichaelWickerson
# MATH OPERATORS  037/1001
mass_addition = MassAddition()  # -> Result, PartialResults
# Wickerson Studio
# created by: Michael Wickerson
# Grasshopper for Rhino 3D Algorithmic Modeling
# www.wickersonstudios.com
# www.michaelwickerson.com
# https://www.youtube.com/channel/UC7J48Ppcsa6oncp6d29R0xw
# https://github.com/mwickerson
# https://www.facebook.com/michael.wickerson
# https://www.linkedin.com/in/michael-wickerson-696a80156/
# https://www.grasshopper3d.com/profile/MichaelWickerson
mass_multiplication = MassMultiplication()  # -> Result, PartialResults
relative_differences = RelativeDifferences()

number_slider = Slider(2, range=0..2)
number_slider_2 = Slider(12, range=0..100)
number_slider_3 = Slider(46, range=0..100)
vector_xyz = VectorXYZ(XComponent=number_slider_2, YComponent=0, ZComponent=0)  # -> Vector, Length
vector_xyz_2 = VectorXYZ(XComponent=number_slider_3, YComponent=number_slider_3, ZComponent=number_slider_3)  # -> Vector, Length
construct_point = ConstructPoint(XCoordinate=number_slider_2, YCoordinate=0, ZCoordinate=0)
construct_point_2 = ConstructPoint(XCoordinate=number_slider_3, YCoordinate=number_slider_3, ZCoordinate=number_slider_3)

relative_differences_2 = RelativeDifferences(Values=[number_slider_2, number_slider_3])
relative_differences_3 = RelativeDifferences(Values=[construct_point, construct_point_2])
relative_differences_4 = RelativeDifferences(Values=[vector_xyz.Vector, vector_xyz_2.Vector])

panel = Panel(relative_differences_3)
explode_tree = ExplodeTree()  # -> Branch0, Branch1, Branch2, Branch3, Branch4, Branch5, Branch6, Branch7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
gradient = Gradient(
    LowerLimit=0,
    UpperLimit=1,
    Parameter=Slider(0.12, range=0..1),
    stops=[0: RGB(234, 38, 0), 0.25: RGB(234, 126, 0), 0.5: RGB(254, 244, 84), 0.75: RGB(173, 203, 249), 1: RGB(75, 107, 169)])
gradient_2 = Gradient(
    LowerLimit=0,
    UpperLimit=1,
    Parameter=Slider(0.66, range=0..1),
    stops=[0: RGB(234, 38, 0), 0.25: RGB(234, 126, 0), 0.5: RGB(254, 244, 84), 0.75: RGB(173, 203, 249), 1: RGB(75, 107, 169)])
gradient_3 = Gradient(
    LowerLimit=0,
    UpperLimit=1,
    Parameter=Slider(0.51, range=0..1),
    stops=[0: RGB(234, 38, 0), 0.25: RGB(234, 126, 0), 0.5: RGB(254, 244, 84), 0.75: RGB(173, 203, 249), 1: RGB(75, 107, 169)])
gradient_4 = Gradient(LowerLimit=0, UpperLimit=1, Parameter=Slider(0.87, range=0..1), stops=[0.15: RGB(255, 130, 160), 0.85: RGB(220, 0, 40)])
gradient_5 = Gradient(LowerLimit=0, UpperLimit=1, Parameter=Slider(0.02, range=0..1), stops=[0.15: RGB(255, 130, 160), 0.85: RGB(220, 0, 40)])
gradient_6 = Gradient(
    LowerLimit=0,
    UpperLimit=1,
    Parameter=Slider(0, range=0..1),
    stops=[0.131: RGB(31, 197, 237), 0.19: RGB(29, 247, 176), 0.47: RGB(128, 180, 50), 0.85: RGB(220, 0, 40)])
gradient_7 = Gradient(
    LowerLimit=0,
    UpperLimit=1,
    Parameter=Slider(0.84, range=0..1),
    stops=[0: RGB(243, 57, 0), 0.1: RGB(236, 27, 60), 0.2: RGB(210, 0, 118), 0.3: RGB(103, 0, 120), 0.4: RGB(39, 72, 161), 0.6: RGB(18, 178, 90), 0.7: RGB(79, 186, 8), 0.8: RGB(220, 237, 32), 0.9: RGB(247, 159, 20), 1: RGB(243, 57, 0)])
gradient_8 = Gradient(
    LowerLimit=0,
    UpperLimit=1,
    Parameter=Slider(0.19, range=0..1),
    stops=[0: RGB(243, 57, 0), 0.1: RGB(236, 27, 60), 0.2: RGB(210, 0, 118), 0.3: RGB(103, 0, 120), 0.4: RGB(39, 72, 161), 0.6: RGB(18, 178, 90), 0.7: RGB(79, 186, 8), 0.8: RGB(220, 237, 32), 0.9: RGB(247, 159, 20), 1: RGB(243, 57, 0)])
gradient_9 = Gradient(
    LowerLimit=0,
    UpperLimit=1,
    Parameter=Slider(0.54, range=0..1),
    stops=[0: RGB(243, 57, 0), 0.1: RGB(236, 27, 60), 0.2: RGB(210, 0, 118), 0.3: RGB(103, 0, 120), 0.4: RGB(39, 72, 161), 0.6: RGB(18, 178, 90), 0.7: RGB(79, 186, 8), 0.8: RGB(220, 237, 32), 0.9: RGB(247, 159, 20), 1: RGB(243, 57, 0)])
gradient_10 = Gradient(LowerLimit=0, UpperLimit=1, Parameter=Slider(0.21, range=0..1), stops=[0.704: RGB(173, 203, 249), 1: RGB(75, 107, 169)])
gradient_11 = Gradient(LowerLimit=0, UpperLimit=1, Parameter=Slider(1, range=0..1), stops=[0.804: RGB(173, 203, 249), 1: RGB(75, 107, 169)])
gradient_12 = Gradient(
    LowerLimit=0,
    UpperLimit=1,
    Parameter=Slider(0.86, range=0..1),
    stops=[0: RGB(234, 38, 0), 0.25: RGB(234, 126, 0), 0.5: RGB(254, 244, 84), 0.75: RGB(173, 203, 249), 1: RGB(75, 107, 169)])
gradient_13 = Gradient(LowerLimit=0, UpperLimit=1, Parameter=Slider(0.97, range=0..1), stops=[0.704: RGB(173, 203, 249), 1: RGB(75, 107, 169)])
gradient_14 = Gradient(
    LowerLimit=0,
    UpperLimit=1,
    Parameter=Slider(0, range=0..1),
    stops=[0.131: RGB(31, 197, 237), 0.19: RGB(29, 247, 176), 0.85: RGB(220, 0, 40)])
gradient_15 = Gradient(
    LowerLimit=0,
    UpperLimit=1,
    Parameter=Slider(0.89, range=0..1),
    stops=[0: RGB(243, 57, 0), 0.1: RGB(236, 27, 60), 0.2: RGB(210, 0, 118), 0.3: RGB(103, 0, 120), 0.4: RGB(39, 72, 161), 0.6: RGB(18, 178, 90), 0.7: RGB(79, 186, 8), 0.8: RGB(220, 237, 32), 0.9: RGB(247, 159, 20), 1: RGB(243, 57, 0)])
gradient_16 = Gradient(LowerLimit=0, UpperLimit=1, Parameter=Slider(0.22, range=0..1), stops=[0.704: RGB(173, 203, 249), 1: RGB(75, 107, 169)])
custom_preview = CustomPreview(Geometry=explode_tree.Branch5, Material=gradient)
custom_preview_2 = CustomPreview(Geometry=explode_tree.Branch10, Material=gradient_2)
custom_preview_3 = CustomPreview(Geometry=explode_tree.Branch1, Material=gradient_3)
custom_preview_4 = CustomPreview(Geometry=explode_tree.Branch4, Material=gradient_4)
custom_preview_5 = CustomPreview(Geometry=explode_tree.Branch8, Material=gradient_5)
custom_preview_6 = CustomPreview(Geometry=explode_tree.Branch0, Material=gradient_6)
custom_preview_7 = CustomPreview(Geometry=explode_tree.Branch7, Material=gradient_7)
custom_preview_8 = CustomPreview(Geometry=explode_tree.Branch11, Material=gradient_8)
custom_preview_9 = CustomPreview(Geometry=explode_tree.Branch3, Material=gradient_9)
custom_preview_10 = CustomPreview(Geometry=explode_tree.Branch6, Material=gradient_10)
custom_preview_11 = CustomPreview(Geometry=explode_tree.Branch9, Material=gradient_11)
custom_preview_12 = CustomPreview(Geometry=explode_tree.Branch12, Material=gradient_12)
custom_preview_13 = CustomPreview(Geometry=explode_tree.Branch2, Material=gradient_13)
custom_preview_14 = CustomPreview(Geometry=explode_tree.Branch15, Material=gradient_4)
custom_preview_15 = CustomPreview(Geometry=explode_tree.Branch0, Material=gradient_14)
custom_preview_16 = CustomPreview(Geometry=explode_tree.Branch14, Material=gradient_15)
custom_preview_17 = CustomPreview(Geometry=explode_tree.Branch13, Material=gradient_16)

surface = Surface(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)
dimensions = Dimensions(Surface=surface)  # -> UDimension, VDimension
number_slider_4 = Slider(67, range=0..100)
division = Division(A=dimensions.UDimension, B=dimensions.VDimension)
multiplication = Multiplication(A=division, B=number_slider_4)

area = Area(Geometry=surface)  # -> Area, Centroid
scale = Scale(Geometry=surface, Center=area.Centroid, Factor=Slider(2.66, range=0..5))  # -> Geometry, Transform
integer = Integer(multiplication)
md_slider = MDSlider(
    SliderMode=0,
    slider_value=Point(0.5374242271, 0.4837579495, 0.5),
    x_domain=Domain(0, 1),
    y_domain=Domain(0, 1),
    z_domain=Domain(0, 1))
expression = Expression(x=integer, Expression="x+1")
evaluate_surface = EvaluateSurface(Surface=reparameterize(scale.Geometry), Point=md_slider)  # -> Point, Normal, UDirection, VDirection, Frame
number_slider_5 = Slider(1, range=0..2)
number_slider_6 = Slider(0.278, range=0..2)

divide_surface = DivideSurface(Surface=surface, UCount=integer, VCount=number_slider_4)  # -> flatten(Points), Normals, Parameters

distance = Distance(PointA=evaluate_surface.Point, PointB=divide_surface.Points)
expression_2 = Expression(
    w=graft([number_slider_6, number_slider_5, number_slider]),
    t=distance,
    k=Slider(-3, range=-10..10),
    Expression="sin(w*t + k*sin(w*t))")
expression_3 = Expression(w=graft([number_slider_6, number_slider_5, number_slider]), t=distance, Expression="sin(w*t)^2")
expression_4 = Expression(w=graft([number_slider_6, number_slider_5, number_slider]), t=distance, Expression="sin(w*t)^2")
expression_5 = Expression(w=graft(number_slider_6), t=distance, Expression="sin(w*t)")

flip_matrix = FlipMatrix(Data=expression_3)

mass_multiplication_2 = MassMultiplication(Input=flip_matrix)  # -> flatten(Result), PartialResults
mass_addition_2 = MassAddition(Input=flip_matrix)  # -> flatten(Result), PartialResults

multiplication_2 = Multiplication(A=Slider(8.72, range=0..10), B=mass_addition_2.Result)
unit_z = UnitZ(Factor=multiplication_2)
move = Move(Geometry=divide_surface.Points, Motion=unit_z)  # -> Geometry, Transform
surface_from_points = SurfaceFromPoints(Points=move.Geometry, UCount=expression, Interpolate=False)
