# Grasshopper definition MathDomain042Flower.gh (Grasshopper 1.0.7)
# Copyright: Wickerson Studios
# plug-ins: MeshEdit Components, Kangaroo Components, Bifocals, Weaverbird

image_sampler = ImageSampler(
    FilePath="C:\Users\Sculpture\Documents\2020Grasshopper\ScreenShots2019\Screenshots2020\SurfaceEditAlgorithm.PNG",
    Filter="Value",
    Interpolate=False,
    Umax=1,
    Umin=0,
    Vmax=1,
    Vmin=0,
    Wrap=1)

# ----
# Wickerson Studio
# created by: Michael Wickerson
# Grasshopper for Rhino 3D Algorithmic Modeling
# www.wickersonstudios.com
# www.michaelwickerson.com
# https://www.youtube.com/channel/UC7J48Ppcsa6oncp6d29R0xw
# https://github.com/mwickerson
# https://www.facebook.com/michael.wickerson
# https://www.linkedin.com/in/michael-wickerson-696a80156/
# https://www.grasshopper3d.com/profile/MichaelWickerson
expression = Expression(Expression="Format(\"{0}, {1}\", x, y)")
# 1001 GRASSHOPPER DEFINITIONS
# Wickerson Studio
# 
# created by: Michael Wickerson
# 
# Grasshopper for Rhino 3D Algorithmic Modeling
# 
# www.wickersonstudios.com
# www.michaelwickerson.com
# https://www.youtube.com/channel/UC7J48Ppcsa6oncp6d29R0xw
# https://github.com/mwickerson
# https://www.facebook.com/michael.wickerson
# https://www.linkedin.com/in/michael-wickerson-696a80156/
# https://www.grasshopper3d.com/profile/MichaelWickerson
# MATH  SCRIPT 042FLOWER/1001
evaluate = Evaluate()
c_script = CSharpScript()  # -> Out, A
ghpython_script = GhPythonScript()  # -> Out, A
vb_script = VBScript()  # -> Out, A

number_slider = Slider(42, range=0..100)
construct_domain = ConstructDomain(DomainStart=Slider(0.1, range=0..0.1), DomainEnd=1)
range = Range(Domain=construct_domain, Steps=Slider(5, range=0..110))
graph_mapper = GraphMapper(range, x0=0, x1=1, y0=0, y1=10, container_name="Bezier", cpx=[0, 1, 0.4057970941, 1], cpy=[0, 0, 0.819444418, 1])
graph_mapper_2 = GraphMapper(
    range,
    x0=0,
    x1=1,
    y0=0,
    y1=10,
    container_name="Sine Summation",
    Equation0_px=[0.2, 0.3],
    Equation0_py=[0.2, 0.3],
    Equation1_px=[0.6, 0.9],
    Equation1_py=[0.3, 0.5])
graph_mapper_3 = GraphMapper(
    range,
    x0=0,
    x1=1,
    y0=0,
    y1=10,
    container_name="Sine",
    Equation_px=[0.04329909384, 0.2695016861],
    Equation_py=[0.2243902683, 0.7895031571])
multiplication = Multiplication(A=Slider(20, range=0..20), B=range)
one_over_x = OneOverX(Value=multiplication)
unit_x = UnitX(Factor=1)
unit_y = UnitY(Factor=1)
unit_z = UnitZ(Factor=1)
construct_point = ConstructPoint(XCoordinate=one_over_x, YCoordinate=multiplication, ZCoordinate=graph_mapper_3)
expression_2 = Expression(x=number_slider, Expression="x+1")
polar_array = PolarArray(Geometry=construct_point, Plane=unit_z, Count=Slider(10, range=0..10), Angle=6.283185307)  # -> Geometry, Transform
flip_matrix = FlipMatrix(Data=polar_array.Geometry)
interpolate = Interpolate(Vertices=flip_matrix, Degree=3, Periodic=False, KnotStyle=1)  # -> flatten(Curve), Length, Domain
scale = Scale(Geometry=interpolate.Curve, Center=Point(0, 0, 0), Factor=Slider(0.1, range=0..1))  # -> flatten(Geometry), Transform
weave = Weave(Pattern=[0, 1], Stream0=interpolate.Curve, Stream1=scale.Geometry, NullGaps=False)
loft = Loft(Curves=weave, Options={Adjust=False, Closed=True, LoftEnds=0, LoftSimp=0, LoftType=0, Rebuild=10, Refit=0.01})
surface = Surface(loft)
divide_surface = DivideSurface(Surface=surface, UCount=number_slider, VCount=number_slider)  # -> Points, Normals, Parameters
amplitude = Amplitude(Vector=divide_surface.Normals, Amplitude=Slider(0.981, range=0.001..2))
vector_display = VectorDisplay(Anchor=divide_surface.Points, Vector=divide_surface.Normals)
move = Move(Geometry=divide_surface.Points, Motion=amplitude)  # -> flatten(Geometry), Transform
surface_from_points = SurfaceFromPoints(Points=move.Geometry, UCount=expression_2, Interpolate=False)
mesh_frompoints = MeshFromPoints(Points=move.Geometry, UDirection=expression_2, VDirection=expression_2)
deconstruct_brep = DeconstructBrep(Brep=surface_from_points)  # -> Faces, graft(Edges), Vertices
deconstruct_brep_2 = DeconstructBrep(Brep=surface)  # -> Faces, graft(Edges), Vertices
loft_2 = Loft(
    Curves=[deconstruct_brep.Edges, deconstruct_brep_2.Edges],
    Options={Adjust=False, Closed=False, LoftEnds=0, LoftSimp=0, LoftType=0, Rebuild=10, Refit=0.01})  # -> flatten(Loft)
merge = Merge(Data1=surface_from_points, Data2=loft_2, Data3=surface)
brep_join = BrepJoin(Breps=merge)  # -> Breps, Closed

surface_2 = Surface(loft)  # disabled

# ---- group: Isotrim
md_slider = MDSlider(
    SliderMode=0,
    slider_value=Point(0.4793076864, 0.4561916444, 0.5),
    x_domain=Domain(0, 1),
    y_domain=Domain(0, 1),
    z_domain=Domain(0, 1))  # disabled
construct_domain_2 = ConstructDomain(DomainU=md_slider, DomainV=md_slider)  # disabled
isotrim = Isotrim(Surface=reparameterize(surface_2), Domain=construct_domain_2)  # disabled

# ----
deconstruct_brep_3 = DeconstructBrep(Brep=isotrim)  # -> Faces, Edges, Vertices; disabled
panel = Panel("2")  # disabled
list_item = ListItem(List=deconstruct_brep_3.Vertices, Index=panel, Wrap=True)  # disabled

surface_closest_point = SurfaceClosestPoint(Point=list_item, Surface=surface_2)  # -> Point, UVPoint, Distance; disabled
evaluate_surface = EvaluateSurface(Surface=surface_2, Point=surface_closest_point.UVPoint)  # -> Point, Normal, UDirection, VDirection, Frame; disabled

number_slider_2 = Slider(3.226, range=0..10)  # disabled
amplitude_2 = Amplitude(Vector=evaluate_surface.Normal, Amplitude=number_slider_2)  # disabled
multiplication_2 = Multiplication(A=evaluate_surface.Normal, B=number_slider_2)  # disabled
extrude = Extrude(Base=surface_2, Direction=multiplication_2)  # disabled
vector_display_2 = VectorDisplay(Anchor=evaluate_surface.Point, Vector=amplitude_2)  # disabled

# ---- group: Catenary2b
slider = Slider(7, range=-50..50)  # disabled
mesh = Mesh(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)  # disabled
wbnaked = WeaverBirdsNakedBoundary(MeshClosedPolylines=mesh)  # disabled
slider_2 = Slider(1.1, range=0..5)  # disabled
explode = Explode(Curve=wbnaked, Recursive=True)  # -> Segments, Vertices; disabled
wbedges = MeshEdges(Mesh=mesh)  # disabled
pt = Point(explode.Vertices)  # disabled
wbvertices = VerticesComponent(Mesh=mesh, Weld=True)  # disabled
Z = UnitZ(Factor=slider)  # disabled
len = Length(Curve=wbedges)  # disabled
multiplication_3 = Multiplication(A=len, B=slider_2)  # disabled
pt_2 = Point([Point(11.55226326, 6.497796059, 0), Point(12.78253746, 6.49780035, 0), Point(14.01280308, 6.497804642, 0), Point(15.24306107, 6.497791767, 0), Point(16.47332764, 6.497791767, 0), Point(17.70360184, 6.497796059, 0)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])  # disabled
uforce = UnaryForce(Point=wbvertices, Force=Z)  # disabled
pt_3 = Point([Point(11.55226326, 6.497796059, 0), Point(48.4602623, 6.497796059, 0), Point(11.55226326, 31.10312653, 0), Point(48.4602623, 31.10312653, 0)])  # disabled
curve = Curve(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)  # disabled
pt_4 = Point([Point(48.4602623, 31.10312653, 0), Point(47.2299881, 31.10312271, 0), Point(45.99972916, 31.1031189, 0), Point(44.76945496, 31.10313034, 0), Point(43.53919601, 31.10313034, 0), Point(42.30892181, 31.10312653, 0)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])  # disabled
curve_2 = Curve(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)  # disabled
toggle = BooleanToggle(False)  # disabled
bang = ExplodeTree(Data=graft(pt_3))  # -> Branch0, Branch1, Branch2, Branch3; disabled
end = EndPoints(Curve=curve)  # -> Start, End; disabled
end_2 = EndPoints(Curve=curve_2)  # -> Start, End; disabled
springs = SpringsFromLine(
    Connection=wbedges,
    Stiffness=1000,
    Damping=10,
    RestLength=multiplication_3,
    Cutoff=0,
    CompressionFail=0,
    TensileFail=0,
    Plasticity=0)  # disabled
ln = Line(StartPoint=end_2.Start, EndPoint=bang.Branch2)  # disabled
ln_2 = Line(StartPoint=end_2.End, EndPoint=bang.Branch3)  # disabled
ln_3 = Line(StartPoint=end.Start, EndPoint=bang.Branch0)  # disabled
ln_4 = Line(StartPoint=end.End, EndPoint=bang.Branch1)  # disabled
slider_3 = Slider(2000, range=0..2000)  # disabled
springs_2 = SpringsFromLine(Connection=[ln, ln_2, ln_3, ln_4], Stiffness=5000, Damping=10, RestLength=0, UpperCutoff=0, LowerCutoff=0, Plasticity=0)  # disabled
pt_5 = Point([Point(10.93712521, 10.80372334, 0), Point(11.55226326, 10.18859482, 0), Point(10.93713379, 9.573470116, 0), Point(11.55227089, 8.958332062, 0), Point(10.93713379, 8.34319973, 0), Point(11.55227089, 7.728066444, 0)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])  # disabled
curvepull = CurvePull(Curve=curve, Points=pt_2, Strength=slider_3)  # disabled
curvepull_2 = CurvePull(Curve=curve_2, Points=pt_4, Strength=slider_3)  # disabled
anchorxyz = AnchorXYZ(Point=pt_5, ConstrainX=True, ConstrainY=False, ConstrainZ=False)  # disabled
kangaroo = KangarooPhysics(
    ForceObjects=flatten([springs, uforce, curvepull_2, curvepull, anchorxyz, springs_2]),
    AnchorPoints=[end_2.Start, end_2.End, end.Start, end.End],
    Settings=null,
    Geometry=mesh,
    SimulationReset=toggle)  # -> Out, Iterations, ParticlesOut, GeometryOut, KE; disabled
timer = Timer(TimerInterval=1, Target=kangaroo)  # disabled
mesh_2 = Mesh(kangaroo.GeometryOut)  # disabled

# ---- group: ReciprocalForce / form-find compression only structure
mesh_3 = Mesh(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)  # disabled
pt_6 = Point([Point(34.18725204, 11.75998497, 0), Point(29.71782684, 43.80343628, 0), Point(28.18881035, 29.54838371, 0), Point(20.57556915, 50.85356903, 0), Point(14.86301517, 27.05437469, 0), Point(11.60977459, 45.14772034, 0)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])  # disabled
springsfrommesh = SpringsFromMesh(M=mesh_3, stiffness=4, B=0)  # disabled
gravity = Gravity(M=mesh_3, F=1)  # disabled
kangaroo_2 = KangarooPhysics(
    ForceObjects=flatten([gravity, springsfrommesh]),
    AnchorPoints=pt_6,
    Settings=null,
    Geometry=mesh_3,
    SimulationReset=True)  # -> Out, Iterations, ParticlesOut, GeometryOut, KE; disabled

# ---- group: Catenary2
slider_4 = Slider(7, range=-50..50)  # disabled
mesh_4 = Mesh(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)  # disabled
wbnaked_2 = WeaverBirdsNakedBoundary(MeshClosedPolylines=mesh_4)  # disabled
slider_5 = Slider(1.1, range=0..5)  # disabled
explode_2 = Explode(Curve=wbnaked_2, Recursive=True)  # -> Segments, Vertices; disabled
wbedges_2 = MeshEdges(Mesh=mesh_4)  # disabled
slider_6 = Slider(2000, range=0..2000)  # disabled
Z_2 = UnitZ(Factor=slider_4)  # disabled
wbvertices_2 = VerticesComponent(Mesh=mesh_4, Weld=True)  # disabled
len_2 = Length(Curve=wbedges_2)  # disabled
multiplication_4 = Multiplication(A=len_2, B=slider_5)  # disabled
pt_7 = Point([Point(11.55226326, 6.497796059, 0), Point(12.78253746, 6.49780035, 0), Point(14.01280308, 6.497804642, 0), Point(15.24306107, 6.497791767, 0), Point(16.47332764, 6.497791767, 0), Point(17.70360184, 6.497796059, 0)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])  # disabled
uforce_2 = UnaryForce(Point=wbvertices_2, Force=Z_2)  # disabled
curve_3 = Curve(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)  # disabled
pt_8 = Point([Point(48.4602623, 31.10312653, 0), Point(47.2299881, 31.10312271, 0), Point(45.99972916, 31.1031189, 0), Point(44.76945496, 31.10313034, 0), Point(43.53919601, 31.10313034, 0), Point(42.30892181, 31.10312653, 0)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])  # disabled
curve_4 = Curve(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)  # disabled
end_3 = EndPoints(Curve=[curve_4, curve_3])  # -> Start, End; disabled
springs_3 = SpringsFromLine(
    Connection=wbedges_2,
    Stiffness=1000,
    Damping=10,
    RestLength=multiplication_4,
    Cutoff=0,
    CompressionFail=0,
    TensileFail=0,
    Plasticity=0)  # disabled
toggle_2 = BooleanToggle(False)  # disabled
curvepull_3 = CurvePull(Curve=curve_3, Points=pt_7, Strength=slider_6)  # disabled
curvepull_4 = CurvePull(Curve=curve_4, Points=pt_8, Strength=slider_6)  # disabled
kangaroo_3 = KangarooPhysics(
    ForceObjects=flatten([springs_3, uforce_2, curvepull_4, curvepull_3]),
    AnchorPoints=[end_3.Start, end_3.End],
    Settings=null,
    Geometry=mesh_4,
    SimulationReset=toggle_2)  # -> Out, Iterations, ParticlesOut, GeometryOut, KE; disabled
timer_2 = Timer(TimerInterval=1, Target=kangaroo_3)  # disabled
mesh_5 = Mesh(kangaroo_3.GeometryOut)  # disabled

# ---- group: ReciprocalForce
# Once equilibrium has been reached, stop
# the first Kangaroo timer, and connect the
# mesh to the second part of the definition
mesh_6 = Mesh(kangaroo_2.GeometryOut)  # disabled
mesh_7 = Mesh(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)  # disabled

# ---- group: ReciprocalForce / Generate reciprocal force diagram
project = Project(Geometry=mesh_7, Plane=PlaneXY(0, 0, 0))  # -> Geometry, Transform; disabled
faceb = FaceBoundaries(Mesh=project.Geometry)  # disabled
explode_3 = Explode(Curve=faceb, Recursive=True)  # -> Segments, Vertices; disabled
eval = EvaluateCurve(Curve=reparameterize(explode_3.Segments), Parameter=0.5)  # -> Point, Tangent, Angle; disabled
rotate = Rotate(Geometry=explode_3.Segments, Angle=1.570796327, Plane=eval.Point)  # -> Geometry, Transform; disabled
scale_2 = Scale(Geometry=rotate.Geometry, Center=eval.Point, Factor=0.58)  # -> Geometry, Transform; disabled
dupln = RemoveDuplicateLines(Lines=flatten(scale_2.Geometry), Tolerance=0.01)  # disabled
end_4 = EndPoints(Curve=scale_2.Geometry)  # -> Start, End; disabled
inter = InterconnectPoints(Pts=end_4.End)  # disabled
end_5 = EndPoints(Curve=dupln)  # -> Start, End; disabled
springs_4 = SpringsFromLine(Connection=inter, Stiffness=1500, Damping=10, RestLength=0, UpperCutoff=0, LowerCutoff=0, Plasticity=0)  # disabled
translock = TranslationLock(Point1=end_5.Start, Point2=end_5.End)  # disabled
kangaroo_4 = KangarooPhysics(ForceObjects=flatten([translock, springs_4]), Settings=null, Geometry=dupln, SimulationReset=True)  # -> Out, Iterations, ParticlesOut, GeometryOut, KE; disabled
crv = Curve(kangaroo_4.GeometryOut)  # disabled

# ----
explode_tree = ExplodeTree()  # -> Branch0, Branch1, Branch2, Branch3, Branch4, Branch5, Branch6, Branch7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
gradient = Gradient(
    LowerLimit=0,
    UpperLimit=1,
    Parameter=Slider(0.12, range=0..1),
    stops=[0: RGB(234, 38, 0), 0.25: RGB(234, 126, 0), 0.5: RGB(254, 244, 84), 0.75: RGB(173, 203, 249), 1: RGB(75, 107, 169)])
gradient_2 = Gradient(
    LowerLimit=0,
    UpperLimit=1,
    Parameter=Slider(0.66, range=0..1),
    stops=[0: RGB(234, 38, 0), 0.25: RGB(234, 126, 0), 0.5: RGB(254, 244, 84), 0.75: RGB(173, 203, 249), 1: RGB(75, 107, 169)])
gradient_3 = Gradient(LowerLimit=0, UpperLimit=1, Parameter=Slider(0.02, range=0..1), stops=[0.15: RGB(255, 130, 160), 0.85: RGB(220, 0, 40)])
gradient_4 = Gradient(
    LowerLimit=0,
    UpperLimit=1,
    Parameter=Slider(0.84, range=0..1),
    stops=[0: RGB(243, 57, 0), 0.1: RGB(236, 27, 60), 0.2: RGB(210, 0, 118), 0.3: RGB(103, 0, 120), 0.4: RGB(39, 72, 161), 0.6: RGB(18, 178, 90), 0.7: RGB(79, 186, 8), 0.8: RGB(220, 237, 32), 0.9: RGB(247, 159, 20), 1: RGB(243, 57, 0)])
gradient_5 = Gradient(
    LowerLimit=0,
    UpperLimit=1,
    Parameter=Slider(0.19, range=0..1),
    stops=[0: RGB(243, 57, 0), 0.1: RGB(236, 27, 60), 0.2: RGB(210, 0, 118), 0.3: RGB(103, 0, 120), 0.4: RGB(39, 72, 161), 0.6: RGB(18, 178, 90), 0.7: RGB(79, 186, 8), 0.8: RGB(220, 237, 32), 0.9: RGB(247, 159, 20), 1: RGB(243, 57, 0)])
gradient_6 = Gradient(LowerLimit=0, UpperLimit=1, Parameter=Slider(0.87, range=0..1), stops=[0.15: RGB(255, 130, 160), 0.85: RGB(220, 0, 40)])
gradient_7 = Gradient(
    LowerLimit=0,
    UpperLimit=1,
    Parameter=Slider(0.54, range=0..1),
    stops=[0: RGB(243, 57, 0), 0.1: RGB(236, 27, 60), 0.2: RGB(210, 0, 118), 0.3: RGB(103, 0, 120), 0.4: RGB(39, 72, 161), 0.6: RGB(18, 178, 90), 0.7: RGB(79, 186, 8), 0.8: RGB(220, 237, 32), 0.9: RGB(247, 159, 20), 1: RGB(243, 57, 0)])
gradient_8 = Gradient(LowerLimit=0, UpperLimit=1, Parameter=Slider(0.21, range=0..1), stops=[0.704: RGB(173, 203, 249), 1: RGB(75, 107, 169)])
gradient_9 = Gradient(LowerLimit=0, UpperLimit=1, Parameter=Slider(1, range=0..1), stops=[0.804: RGB(173, 203, 249), 1: RGB(75, 107, 169)])
gradient_10 = Gradient(
    LowerLimit=0,
    UpperLimit=1,
    Parameter=Slider(0.86, range=0..1),
    stops=[0: RGB(234, 38, 0), 0.25: RGB(234, 126, 0), 0.5: RGB(254, 244, 84), 0.75: RGB(173, 203, 249), 1: RGB(75, 107, 169)])
gradient_11 = Gradient(LowerLimit=0, UpperLimit=1, Parameter=Slider(0.97, range=0..1), stops=[0.704: RGB(173, 203, 249), 1: RGB(75, 107, 169)])
gradient_12 = Gradient(
    LowerLimit=0,
    UpperLimit=1,
    Parameter=Slider(0, range=0..1),
    stops=[0.131: RGB(31, 197, 237), 0.19: RGB(29, 247, 176), 0.85: RGB(220, 0, 40)])
gradient_13 = Gradient(
    LowerLimit=0,
    UpperLimit=1,
    Parameter=Slider(0.89, range=0..1),
    stops=[0: RGB(243, 57, 0), 0.1: RGB(236, 27, 60), 0.2: RGB(210, 0, 118), 0.3: RGB(103, 0, 120), 0.4: RGB(39, 72, 161), 0.6: RGB(18, 178, 90), 0.7: RGB(79, 186, 8), 0.8: RGB(220, 237, 32), 0.9: RGB(247, 159, 20), 1: RGB(243, 57, 0)])
gradient_14 = Gradient(LowerLimit=0, UpperLimit=1, Parameter=Slider(0.22, range=0..1), stops=[0.704: RGB(173, 203, 249), 1: RGB(75, 107, 169)])
custom_preview = CustomPreview(Geometry=explode_tree.Branch5, Material=gradient)
custom_preview_2 = CustomPreview(Geometry=explode_tree.Branch10, Material=gradient_2)
custom_preview_3 = CustomPreview(Geometry=explode_tree.Branch4, Material=gradient_6)
custom_preview_4 = CustomPreview(Geometry=explode_tree.Branch8, Material=gradient_3)
custom_preview_5 = CustomPreview(Geometry=explode_tree.Branch7, Material=gradient_4)
custom_preview_6 = CustomPreview(Geometry=explode_tree.Branch11, Material=gradient_5)
custom_preview_7 = CustomPreview(Geometry=explode_tree.Branch3, Material=gradient_7)
custom_preview_8 = CustomPreview(Geometry=explode_tree.Branch6, Material=gradient_8)
custom_preview_9 = CustomPreview(Geometry=explode_tree.Branch9, Material=gradient_9)
custom_preview_10 = CustomPreview(Geometry=explode_tree.Branch12, Material=gradient_10)
custom_preview_11 = CustomPreview(Geometry=explode_tree.Branch2, Material=gradient_11)
custom_preview_12 = CustomPreview(Geometry=explode_tree.Branch0, Material=gradient_12)
custom_preview_13 = CustomPreview(Geometry=explode_tree.Branch15, Material=gradient_6)
custom_preview_14 = CustomPreview(Geometry=explode_tree.Branch14, Material=gradient_13)
custom_preview_15 = CustomPreview(Geometry=explode_tree.Branch13, Material=gradient_14)

# ==== cluster Gravity: Apply gravity to vertices of a mesh
M = ClusterInput()
F = ClusterInput()
mcomp = Decompose(Mesh=M)  # -> Vertices, Faces, Colours, Normals
Z = UnitZ(Factor=F)
duppt = RemoveDuplicatePts(Points=mcomp.Vertices, Tolerance=0.01)
uforce = UnaryForce(Point=duppt, Force=Z)
U = ClusterOutput(uforce)

# ==== cluster SpringsFromMesh: Turns all edges of a mesh into springs
M = ClusterInput()
medges = MeshEdges(Mesh=M)  # -> NakedEdges, InteriorEdges, NonManifoldEdges
crv = Curve([medges.NakedEdges, medges.InteriorEdges])
B = ClusterInput()
len = Length(Curve=crv)
multiplication = Multiplication(A=len, B=B)
stiffness = ClusterInput()
springs = SpringsFromLine(Connection=crv, Stiffness=stiffness, Damping=10, RestLength=multiplication, UpperCutoff=0, LowerCutoff=0, Plasticity=0)
S = ClusterOutput(springs)
