# Grasshopper definition MathScript043.gh (Grasshopper 1.0.7)
# Copyright: Wickerson Studios
# plug-ins: Bifocals

image_sampler = ImageSampler(
    FilePath="C:\Users\Sculpture\Documents\2020Grasshopper\ScreenShots2019\Screenshots2020\SurfaceEditAlgorithm.PNG",
    Filter="Value",
    Interpolate=False,
    Umax=1,
    Umin=0,
    Vmax=1,
    Vmin=0,
    Wrap=1)

# ----
# Wickerson Studio
# created by: Michael Wickerson
# Grasshopper for Rhino 3D Algorithmic Modeling
# www.wickersonstudios.com
# www.michaelwickerson.com
# https://www.youtube.com/channel/UC7J48Ppcsa6oncp6d29R0xw
# https://github.com/mwickerson
# https://www.facebook.com/michael.wickerson
# https://www.linkedin.com/in/michael-wickerson-696a80156/
# https://www.grasshopper3d.com/profile/MichaelWickerson
expression = Expression(Expression="Format(\"{0}, {1}\", x, y)")
# 1001 GRASSHOPPER DEFINITIONS
# Wickerson Studio
# 
# created by: Michael Wickerson
# 
# Grasshopper for Rhino 3D Algorithmic Modeling
# 
# www.wickersonstudios.com
# www.michaelwickerson.com
# https://www.youtube.com/channel/UC7J48Ppcsa6oncp6d29R0xw
# https://github.com/mwickerson
# https://www.facebook.com/michael.wickerson
# https://www.linkedin.com/in/michael-wickerson-696a80156/
# https://www.grasshopper3d.com/profile/MichaelWickerson
# MATH  SCRIPT 043/1001
evaluate = Evaluate()
c_script = CSharpScript()  # -> Out, A
ghpython_script = GhPythonScript()  # -> Out, A
vb_script = VBScript()  # -> Out, A

# ----
# if/then Conditional
number_slider = Slider(22, range=0..100)
evaluate_2 = Evaluate(Expression="if(x>5, \"Hippy\", y)", x=number_slider, y=Slider(69, range=0..100))
panel = Panel(evaluate_2)

# ----
# Concatenate
number_slider_2 = Slider(32, range=0..100)
concatenate = Concatenate(FragmentA="x>", FragmentB=number_slider_2)
concatenate_2 = Concatenate(FragmentA="The Cat ", FragmentB="is on the Table")
panel_2 = Panel(concatenate)
panel_3 = Panel(concatenate_2)

construct_domain = ConstructDomain(DomainStart=Slider(0.1, range=0..0.1), DomainEnd=Slider(10.02, range=1..12))
circle = Circle(Plane=PlaneXY(0, 0, 0), Radius=1)
range = Range(Domain=construct_domain, Steps=10)
scale = Scale(Geometry=circle, Center=Point(0, 0, 0), Factor=range)  # -> Geometry, Transform
curve = Curve(scale.Geometry)
deconstruct_arc = DeconstructArc(Arc=curve)  # -> BasePlane, Radius, Angle
evaluate_3 = Evaluate(Expression="x>8", x=deconstruct_arc.Radius)
cull_pattern = CullPattern(List=curve, CullPattern=evaluate_3)
unit_z = UnitZ(Factor=Slider(12, range=0..100))
extrude = Extrude(Base=cull_pattern, Direction=unit_z)

number_slider_3 = Slider(25, range=0..100)
construct_domain_2 = ConstructDomain(DomainStart=Slider(-2, range=-2..10), DomainEnd=Slider(2, range=0..10))
construct_domain_3 = ConstructDomain(DomainStart=Slider(-3, range=-3..10), DomainEnd=Slider(3, range=0..10))
range_2 = Range(Domain=construct_domain_2, Steps=number_slider_3)
range_3 = Range(Domain=construct_domain_3, Steps=number_slider_3)
cross_reference = CrossReference(ListA=range_2, ListB=range_3, CrossMode=1)  # -> ListA, ListB
list_length = ListLength(List=range_3)
evaluate_4 = Evaluate(Expression="-((x^2+y^2)/4)+4", x=cross_reference.ListA, y=cross_reference.ListB)
construct_point = ConstructPoint(XCoordinate=cross_reference.ListA, YCoordinate=cross_reference.ListB, ZCoordinate=evaluate_4)
surface_from_points = SurfaceFromPoints(Points=construct_point, UCount=list_length, Interpolate=False)

evaluate_5 = Evaluate(Expression="x>5", Variable_x=Slider(2, range=0..10))
evaluate_6 = Evaluate(Expression="x>5", Variable_x=[Slider(7, range=0..10), Slider(2, range=0..10)])
evaluate_7 = Evaluate(Expression="x+y=6", Variable_x=Slider(2, range=0..10), Variable_y=Slider(7, range=0..10))
panel_4 = Panel(evaluate_5)
panel_5 = Panel(evaluate_6)
panel_6 = Panel(evaluate_7)

# ----
# Other Operators: Contains
# 
# create a Line in Rhino Window with Line Command
# 
# Set one line to Line container node
line = Line(Line((36, -34, 0), (-84, 42, 0)))
panel_7 = Panel(line)
evaluate_8 = Evaluate(Expression="Contains(x,\"Line\")", x=panel_7)
panel_8 = Panel(evaluate_8)

# ----
# Other Operators: Contains
panel_9 = Panel("Contains(x,\"4\")")
panel_10 = Panel("""1
2
34
4
5
6
7
8
9""")
evaluate_9 = Evaluate(Expression=panel_9, Variable_x=panel_10)
panel_11 = Panel(evaluate_9)

# ----
# Rya Issa: Essential Mathematics
number_slider_4 = Slider(0.26, range=0..1)
# RAJAA ISSA
box = Box([{Plane=PlaneXY(-72, -5, 0), X=Domain(0, 88), Y=Domain(0, 34), Z=Domain(0, 17)}, {Plane=PlaneXY(-83, -97, 0), X=Domain(0, 18), Y=Domain(0, 31), Z=Domain(0, 20)}, {Plane=PlaneXY(25, -49, 0), X=Domain(0, 36), Y=Domain(0, 39), Z=Domain(0, 15)}, {Plane=PlaneXY(-60, -159, 0), X=Domain(0, 64), Y=Domain(0, 139), Z=Domain(0, 12)}])
pi = Pi(Factor=number_slider_4)
ghpython_script_2 = GhPythonScript(geom=box, angle=pi, scale=Slider(0.4, range=0..1))  # -> out, A, M; inputs geom: list of GeometryBase
# ---------- ghpython_script_2: Python ----------
__author__ = "RajaaIssa"
__version__ = "2019.05.30"

import Rhino

#Move to origin, find center
center = Rhino.Geometry.Point3d.Unset
if geom.Count > 0:
    bbox = geom[0].GetBoundingBox(True)
    for i in range(1, geom.Count):
        bbox.Union(geom[i].GetBoundingBox(True))
    center = bbox.Center

origin = Rhino.Geometry.Point3d.Origin
#Create move transformation matrix
m1 = Rhino.Geometry.Transform.Translation(origin - center)
#Create rotation transformation matrix
m2 = Rhino.Geometry.Transform.Rotation(angle, origin)
#Create scale transformation matrix
m3 = Rhino.Geometry.Transform.Scale(origin, scale)
#Create move back transformation matrix
m4 = Rhino.Geometry.Transform.Identity
result, m4 = m1.TryGetInverse()

#Multiply from last to first transformation
matrix = m4 * m3 * m2 * m1

#Apply transformation to all input geometry
for g in geom:
    g.Transform(matrix)

#Assign output
M = matrix
A = geom
# ---------- end ghpython_script_2 ----------
display_matrix = DisplayMatrix(ghpython_script_2.M)
geometry = Geometry(ghpython_script_2.A)

# ---- group: Input geometry
box_2 = Box([{Plane=PlaneXY(9, 6, 0), X=Domain(0, 6), Y=Domain(0, 8), Z=Domain(0, 2)}, {Plane=PlaneXY(14, 12, 0), X=Domain(0, 4), Y=Domain(0, 8), Z=Domain(0, 2)}, {Plane=PlaneXY(0, 18, 0), X=Domain(0, 7), Y=Domain(0, 2), Z=Domain(0, 2)}])

# ---- group: Rotation angle in radian
panel_12 = Panel("0.25*Pi")

# ---- group: Scale factor
panel_13 = Panel("0.2")

# ---- group: Tutorial solution using Python scripting
python = GhPythonScript(geom=box_2, angle=panel_12, scale=panel_13)  # -> out, A, M; inputs geom: list of GeometryBase; same code as ghpython_script_2

# ---- group: Tutorial solution using VB scripting
vb = VBScript(geom=box_2, angle=panel_12, scale=panel_13)  # -> out, A, M; inputs geom: list of GeometryBase
# ---------- vb: VB usings ----------
Imports System.IO
Imports System.Linq
Imports System.Data
Imports System.Drawing
Imports System.Reflection
Imports System.Windows.Forms
Imports System.Xml
Imports System.Xml.Linq
Imports Microsoft.VisualBasic
Imports System.Runtime.InteropServices

Imports Rhino.DocObjects
Imports Rhino.Collections
Imports GH_IO
Imports GH_IO.Serialization
# ---------- vb: VB ----------
    Dim center As Point3d = Point3d.Unset

    If geom.Count > 0 Then
      Dim bbox As BoundingBox = geom(0).GetBoundingBox(True)

      For i As Integer = 1 To geom.Count - 1
        bbox.Union(geom(i).GetBoundingBox(True))
      Next

      center = bbox.Center
    Else
      Return
    End If

    Dim m1 = Rhino.Geometry.Transform.Translation(Point3d.Origin - center)
    Dim m2 = Rhino.Geometry.Transform.Rotation(angle, Point3d.Origin)
    Dim m3 = Rhino.Geometry.Transform.Scale(Point3d.Origin, scale)
    Dim m4 = Rhino.Geometry.Transform.Identity
    m1.TryGetInverse(m4)
    Dim matrix = m4 * m3 * m2 * m1

    For i As Integer = 0 To geom.Count - 1
      geom(i).Transform(matrix)
    Next

    M = matrix
    A = geom
# ---------- end vb ----------

# ---- group: Tutorial solution using C# scripting
c_script_2 = CSharpScript(geom=box_2, angle=panel_12, scale=panel_13)  # -> out, A, M; inputs geom: list of GeometryBase, angle: Double, scale: Double
# ---------- c_script_2: C# ----------
    //Move to origin, find center
    Point3d center = Point3d.Unset;
    if(geom.Count > 0)
    {
      BoundingBox bbox = geom[0].GetBoundingBox(true);
      for(int i = 1; i < geom.Count ; i++)
      {
        bbox.Union(geom[i].GetBoundingBox(true));
      }
      center = bbox.Center;
    }
    else
      return;

    //Create move transformation matrix
    var m1 = Rhino.Geometry.Transform.Translation(Point3d.Origin - center);
    //Create rotation transformation matrix
    var m2 = Rhino.Geometry.Transform.Rotation(angle, Point3d.Origin);
    //Create scale transformation matrix
    var m3 = Rhino.Geometry.Transform.Scale(Point3d.Origin, scale);
    //Create move back transformation matrix
    var m4 = Rhino.Geometry.Transform.Identity;
    m1.TryGetInverse(out m4);

    //Multiply from last to first transformation
    var matrix = m4 * m3 * m2 * m1;

    //Apply transformation to all input geometry
    for(int i = 0; i < geom.Count ; i++)
    {
      geom[i].Transform(matrix);
    }

    //Assign output
    M = matrix;
    A = geom;
# ---------- end c_script_2 ----------

# ---- group: Master matrix with all 4 transformation
matrix = DisplayMatrix(python.M)

matrix_2 = DisplayMatrix(c_script_2.M)

matrix_3 = DisplayMatrix(vb.M)

# ----
explode_tree = ExplodeTree()  # -> Branch0, Branch1, Branch2, Branch3, Branch4, Branch5, Branch6, Branch7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
gradient = Gradient(
    LowerLimit=0,
    UpperLimit=1,
    Parameter=Slider(0.12, range=0..1),
    stops=[0: RGB(234, 38, 0), 0.25: RGB(234, 126, 0), 0.5: RGB(254, 244, 84), 0.75: RGB(173, 203, 249), 1: RGB(75, 107, 169)])
gradient_2 = Gradient(
    LowerLimit=0,
    UpperLimit=1,
    Parameter=Slider(0.66, range=0..1),
    stops=[0: RGB(234, 38, 0), 0.25: RGB(234, 126, 0), 0.5: RGB(254, 244, 84), 0.75: RGB(173, 203, 249), 1: RGB(75, 107, 169)])
gradient_3 = Gradient(LowerLimit=0, UpperLimit=1, Parameter=Slider(0.02, range=0..1), stops=[0.15: RGB(255, 130, 160), 0.85: RGB(220, 0, 40)])
gradient_4 = Gradient(
    LowerLimit=0,
    UpperLimit=1,
    Parameter=Slider(0.84, range=0..1),
    stops=[0: RGB(243, 57, 0), 0.1: RGB(236, 27, 60), 0.2: RGB(210, 0, 118), 0.3: RGB(103, 0, 120), 0.4: RGB(39, 72, 161), 0.6: RGB(18, 178, 90), 0.7: RGB(79, 186, 8), 0.8: RGB(220, 237, 32), 0.9: RGB(247, 159, 20), 1: RGB(243, 57, 0)])
gradient_5 = Gradient(
    LowerLimit=0,
    UpperLimit=1,
    Parameter=Slider(0.19, range=0..1),
    stops=[0: RGB(243, 57, 0), 0.1: RGB(236, 27, 60), 0.2: RGB(210, 0, 118), 0.3: RGB(103, 0, 120), 0.4: RGB(39, 72, 161), 0.6: RGB(18, 178, 90), 0.7: RGB(79, 186, 8), 0.8: RGB(220, 237, 32), 0.9: RGB(247, 159, 20), 1: RGB(243, 57, 0)])
# Once equilibrium has been reached, stop
# the first Kangaroo timer, and connect the
# mesh to the second part of the definition
gradient_6 = Gradient(LowerLimit=0, UpperLimit=1, Parameter=Slider(0.87, range=0..1), stops=[0.15: RGB(255, 130, 160), 0.85: RGB(220, 0, 40)])
gradient_7 = Gradient(
    LowerLimit=0,
    UpperLimit=1,
    Parameter=Slider(0.54, range=0..1),
    stops=[0: RGB(243, 57, 0), 0.1: RGB(236, 27, 60), 0.2: RGB(210, 0, 118), 0.3: RGB(103, 0, 120), 0.4: RGB(39, 72, 161), 0.6: RGB(18, 178, 90), 0.7: RGB(79, 186, 8), 0.8: RGB(220, 237, 32), 0.9: RGB(247, 159, 20), 1: RGB(243, 57, 0)])
gradient_8 = Gradient(LowerLimit=0, UpperLimit=1, Parameter=Slider(0.21, range=0..1), stops=[0.704: RGB(173, 203, 249), 1: RGB(75, 107, 169)])
gradient_9 = Gradient(LowerLimit=0, UpperLimit=1, Parameter=Slider(1, range=0..1), stops=[0.804: RGB(173, 203, 249), 1: RGB(75, 107, 169)])
gradient_10 = Gradient(
    LowerLimit=0,
    UpperLimit=1,
    Parameter=Slider(0.86, range=0..1),
    stops=[0: RGB(234, 38, 0), 0.25: RGB(234, 126, 0), 0.5: RGB(254, 244, 84), 0.75: RGB(173, 203, 249), 1: RGB(75, 107, 169)])
gradient_11 = Gradient(LowerLimit=0, UpperLimit=1, Parameter=Slider(0.97, range=0..1), stops=[0.704: RGB(173, 203, 249), 1: RGB(75, 107, 169)])
gradient_12 = Gradient(
    LowerLimit=0,
    UpperLimit=1,
    Parameter=Slider(0, range=0..1),
    stops=[0.131: RGB(31, 197, 237), 0.19: RGB(29, 247, 176), 0.85: RGB(220, 0, 40)])
gradient_13 = Gradient(
    LowerLimit=0,
    UpperLimit=1,
    Parameter=Slider(0.89, range=0..1),
    stops=[0: RGB(243, 57, 0), 0.1: RGB(236, 27, 60), 0.2: RGB(210, 0, 118), 0.3: RGB(103, 0, 120), 0.4: RGB(39, 72, 161), 0.6: RGB(18, 178, 90), 0.7: RGB(79, 186, 8), 0.8: RGB(220, 237, 32), 0.9: RGB(247, 159, 20), 1: RGB(243, 57, 0)])
gradient_14 = Gradient(LowerLimit=0, UpperLimit=1, Parameter=Slider(0.22, range=0..1), stops=[0.704: RGB(173, 203, 249), 1: RGB(75, 107, 169)])
custom_preview = CustomPreview(Geometry=explode_tree.Branch5, Material=gradient)
custom_preview_2 = CustomPreview(Geometry=explode_tree.Branch10, Material=gradient_2)
custom_preview_3 = CustomPreview(Geometry=explode_tree.Branch4, Material=gradient_6)
custom_preview_4 = CustomPreview(Geometry=explode_tree.Branch8, Material=gradient_3)
custom_preview_5 = CustomPreview(Geometry=explode_tree.Branch7, Material=gradient_4)
custom_preview_6 = CustomPreview(Geometry=explode_tree.Branch11, Material=gradient_5)
custom_preview_7 = CustomPreview(Geometry=explode_tree.Branch3, Material=gradient_7)
custom_preview_8 = CustomPreview(Geometry=explode_tree.Branch6, Material=gradient_8)
# rc
custom_preview_9 = CustomPreview(Geometry=explode_tree.Branch9, Material=gradient_9)
custom_preview_10 = CustomPreview(Geometry=explode_tree.Branch12, Material=gradient_10)
custom_preview_11 = CustomPreview(Geometry=explode_tree.Branch2, Material=gradient_11)
# rs
custom_preview_12 = CustomPreview(Geometry=explode_tree.Branch0, Material=gradient_12)
# Full multiplicity knots at start
# Simple knots
# Full multiplicity knots at end
# P1
# A=0.2*P1+ 0.8*P2
# D=0.2*A + 0.8*B
# P2
# B=0.47*P2 + 0.53*P3
# Full multiplicity knots at start
# E=0.7*B + 0.3*C
# P3
# Full multiplicity knots in the middle
# C=0.8*P3 + 0.2*P4
# P4
# Full multiplicity knots at end
# Compare knot spacing
# a - b
# b - a
# GH solution
# VB
# C#
# Python with RhinoCommon Only
# Pythong with RhinoScriptSyntax
# GH solution
# VB
# C#
# Python
# VB
custom_preview_13 = CustomPreview(Geometry=explode_tree.Branch15, Material=gradient_6)
custom_preview_14 = CustomPreview(Geometry=explode_tree.Branch14, Material=gradient_13)
custom_preview_15 = CustomPreview(Geometry=explode_tree.Branch13, Material=gradient_14)

# ----
# credit: TEDESCHI
number_slider_5 = Slider(0, range=0..100)
construct_domain_4 = ConstructDomain(DomainStart=number_slider_5, DomainEnd=Slider(18, range=0..100))
range_4 = Range(Domain=construct_domain_4, Steps=Slider(12, range=0..100))
panel_14 = Panel(range_4)

evaluate_10 = Evaluate(Expression="1/6*x^2", x=range_4)

construct_point_2 = ConstructPoint(XCoordinate=range_4, YCoordinate=evaluate_10, ZCoordinate=0)
panel_15 = Panel(construct_point_2)
interpolate = Interpolate(Vertices=construct_point_2, Degree=3, Periodic=False, KnotStyle=1)  # -> Curve, Length, Domain
mirror = Mirror(Geometry=interpolate.Curve, Plane=PlaneYZ(0, 0, 0))  # -> Geometry, Transform
join_curves = JoinCurves(Curves=[interpolate.Curve, mirror.Geometry], Preserve=False)

surface = Surface(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)
dimensions = Dimensions(Surface=surface)  # -> UDimension, VDimension
number_slider_6 = Slider(35, range=0..100)
division = Division(A=dimensions.UDimension, B=dimensions.VDimension)
multiplication = Multiplication(A=division, B=number_slider_6)

# ----
# CHRISTEV
number_slider_7 = Slider(2.66, range=0..5)
area = Area(Geometry=surface)  # -> Area, Centroid
scale_2 = Scale(Geometry=surface, Center=area.Centroid, Factor=number_slider_7)  # -> Geometry, Transform
integer = Integer(multiplication)
md_slider = MDSlider(
    SliderMode=0,
    slider_value=Point(0.6017106219, 0.4302889196, 0.5),
    x_domain=Domain(0, 1),
    y_domain=Domain(0, 1),
    z_domain=Domain(0, 1))
expression_2 = Expression(x=integer, Expression="x+1")
evaluate_surface = EvaluateSurface(Surface=reparameterize(scale_2.Geometry), Point=md_slider)  # -> Point, Normal, UDirection, VDirection, Frame
number_slider_8 = Slider(1, range=0..2)
number_slider_9 = Slider(1.414, range=0..2)
number_slider_10 = Slider(0.278, range=0..2)

divide_surface = DivideSurface(Surface=surface, UCount=integer, VCount=number_slider_6)  # -> flatten(Points), Normals, Parameters

distance = Distance(PointA=evaluate_surface.Point, PointB=divide_surface.Points)
expression_3 = Expression(
    w=graft([number_slider_10, number_slider_9, number_slider_8]),
    t=distance,
    k=Slider(-3, range=-10..10),
    Expression="sin(w*t + k*sin(w*t))")
expression_4 = Expression(w=graft([number_slider_10, number_slider_9, number_slider_8]), t=distance, Expression="sin(w*t)^2")
expression_5 = Expression(w=graft([number_slider_10, number_slider_9, number_slider_8]), t=distance, Expression="sin(w*t)^2")
expression_6 = Expression(w=graft(number_slider_10), t=distance, Expression="sin(w*t)")
multiplication_2 = Multiplication(A=Slider(8.72, range=0..10), B=expression_4)
unit_z_2 = UnitZ(Factor=multiplication_2)
move = Move(Geometry=divide_surface.Points, Motion=unit_z_2)  # -> Geometry, Transform
surface_from_points_2 = SurfaceFromPoints(Points=move.Geometry, UCount=expression_2, Interpolate=False)
