# Grasshopper definition MathTime044.gh (Grasshopper 1.0.7)
# Copyright: Wickerson Studios
# plug-ins: Bifocals

# 1001 GRASSHOPPER DEFINITIONS
# Wickerson Studio
# 
# created by: Michael Wickerson
# 
# Grasshopper for Rhino 3D Algorithmic Modeling
# 
# www.wickersonstudios.com
# www.michaelwickerson.com
# https://www.youtube.com/channel/UC7J48Ppcsa6oncp6d29R0xw
# https://github.com/mwickerson
# https://www.facebook.com/michael.wickerson
# https://www.linkedin.com/in/michael-wickerson-696a80156/
# https://www.grasshopper3d.com/profile/MichaelWickerson
# Wickerson Studio
# created by: Michael Wickerson
# Grasshopper for Rhino 3D Algorithmic Modeling
# www.wickersonstudios.com
# www.michaelwickerson.com
# https://www.youtube.com/channel/UC7J48Ppcsa6oncp6d29R0xw
# https://github.com/mwickerson
# https://www.facebook.com/michael.wickerson
# https://www.linkedin.com/in/michael-wickerson-696a80156/
# https://www.grasshopper3d.com/profile/MichaelWickerson
image_sampler = ImageSampler(
    FilePath="C:\Users\Sculpture\Documents\2020Grasshopper\ScreenShots2019\Screenshots2020\SurfaceEditAlgorithm.PNG",
    Filter="Value",
    Interpolate=False,
    Umax=1,
    Umin=0,
    Vmax=1,
    Vmin=0,
    Wrap=1)

# ----
# First Cool .gh File worth playing with!
number_slider = Slider(4.738, range=0..10)
negative = Negative(Value=number_slider)
construct_domain = ConstructDomain(DomainStart=negative, DomainEnd=number_slider)
sine = Sine(Value=construct_domain)
tangent = Tangent(Value=construct_domain)
cosine = Cosine(Value=construct_domain)
number_slider_2 = Slider(6, range=0..10)
merge = Merge(Data1=sine, Data2=cosine)
panel = Panel(merge)
range = Range(Domain=sine, Steps=10)
range_2 = Range(Domain=cosine, Steps=10)
multiplication = Multiplication(A=number_slider_2, B=range_2)
multiplication_2 = Multiplication(A=number_slider_2, B=range)
deconstruct_domain = DeconstructDomain(Domain=merge)  # -> Start, End
construct_point = ConstructPoint(XCoordinate=construct_domain, YCoordinate=multiplication_2, ZCoordinate=multiplication)
panel_2 = Panel(deconstruct_domain.Start)
panel_3 = Panel(deconstruct_domain.End)
polyline = PolyLine(Vertices=construct_point, Closed=True)
pipe = Pipe(Curve=polyline, Radius=Slider(0.905, range=0..1), Caps=2)

pi = Pi(Factor=Slider(0.5, range=0..2))
construct_domain_2 = ConstructDomain(DomainStart=0, DomainEnd=pi)
sinc = Sinc(Value=construct_domain_2)
sine_2 = Sine(Value=construct_domain_2)
cosine_2 = Cosine(Value=construct_domain_2)
merge_2 = Merge(Data1=sine_2, Data2=cosine_2, Data3=sinc)
panel_4 = Panel(merge_2)

radians = Radians(Degrees=Slider(0, range=0..360))
panel_5 = Panel(radians)
degrees = Degrees(Radians=radians)
panel_6 = Panel(degrees)

right_trigonometry = RightTrigonometry(Alpha=degrees(Slider(42, range=0..90)), PLength=Slider(6.65, range=1..10))  # -> Alpha, Beta, PLength, QLength, RLength
triangle_trigonometry = TriangleTrigonometry(Alpha=degrees(Slider(74, range=0..90)), Beta=degrees(Slider(58, range=0..90)), BLength=Slider(6.64, range=1..10))  # -> Alpha, Beta, Gamma, ALength, BLength, CLength
degrees_2 = Degrees(Radians=right_trigonometry.Beta)
degrees_3 = Degrees(Radians=triangle_trigonometry.Beta)
panel_7 = Panel(right_trigonometry.QLength)
panel_8 = Panel(degrees_2)
panel_9 = Panel(degrees_3)
panel_10 = Panel(triangle_trigonometry.CLength)

number_slider_3 = Slider(156, range=0..1000)
number_slider_4 = Slider(12, range=0..100)
extremes = Extremes(A=Slider(2, range=0..10), B=number_slider_4, C=number_slider_3)  # -> Mininum, Maximum
maximum = Maximum(A=number_slider_4, B=number_slider_3)
minimum = Minimum(A=number_slider_4, B=number_slider_3)
panel_11 = Panel(extremes.Mininum)
panel_12 = Panel(extremes.Maximum)
panel_13 = Panel(maximum)
panel_14 = Panel(minimum)

round = Round(Number=Slider(243.377, range=0..1000))  # -> Nearest, Floor, Ceiling
panel_15 = Panel(round.Nearest)
panel_16 = Panel(round.Floor)
panel_17 = Panel(round.Ceiling)

merge_3 = Merge(
    Data1=Slider(1, range=0..1),
    Data2=Slider(2, range=0..10),
    Data3=Slider(12, range=0..100),
    Data4=Slider(122, range=0..1000))
range_3 = Range(Domain=merge_3, Steps=Slider(51, range=0..100))
average = Average(Input=merge_3)
truncate = Truncate(Input=range_3, TruncationFactor=Slider(0.6, range=0..1))  # -> flatten(Result)
blur_numbers = BlurNumbers(
    Numbers=merge_3,
    Strength=Slider(0.36, range=0..1),
    Iterations=Slider(2, range=0..10),
    Lock=Toggle(True),
    Wrap=Toggle(False))
smooth_numbers = SmoothNumbers(Numbers=merge_3, SmoothDelay=2000)
interpolate_data = InterpolateData(Data=merge_3, Parameter=Slider(0.43, range=0..1), Interpolation=2)
panel_18 = Panel(average)
panel_19 = Panel(blur_numbers)
panel_20 = Panel(interpolate_data)
panel_21 = Panel(smooth_numbers)
panel_22 = Panel(truncate)
param_viewer = ParamViewer(panel_22)

epsilon = Epsilon(Factor=1)
natural_logarithm = NaturalLogarithm(Factor=1)
golden_ratio = GoldenRatio(Factor=1)
pi_2 = Pi(Factor=1)
merge_4 = Merge(Data1=epsilon, Data2=golden_ratio, Data3=natural_logarithm, Data4=pi_2)
panel_23 = Panel(merge_4)

list_length = ListLength(List=truncate)

interpolate_date = InterpolateDate(Interpolation=0)
date_range = DateRange(Count=10)
construct_smooth_time = ConstructSmoothTime(Days=0, Hours=0, Minutes=0, Seconds=0)
# MATH  TRIG 045/1001
deconstruct_date = DeconstructDate(Date=637291291701525939)  # -> Year, Month, Day, Hour, Minute, Second
construct_exotic_date = ConstructExoticDate(Calendar=0)
construct_time = ConstructTime(Hour=15, Minute=52, Second=0)
combine_date_time = CombineDateTime()
construct_date = ConstructDate(Year=2020, Month=6, Day=30, Hour=12, Minute=0, Second=0)

panel_24 = Panel(list_length)
explode_tree = ExplodeTree()  # -> Branch0, Branch1, Branch2, Branch3, Branch4, Branch5, Branch6, Branch7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
gradient = Gradient(
    LowerLimit=0,
    UpperLimit=1,
    Parameter=Slider(0.12, range=0..1),
    stops=[0: RGB(234, 38, 0), 0.25: RGB(234, 126, 0), 0.5: RGB(254, 244, 84), 0.75: RGB(173, 203, 249), 1: RGB(75, 107, 169)])
gradient_2 = Gradient(
    LowerLimit=0,
    UpperLimit=1,
    Parameter=Slider(0.66, range=0..1),
    stops=[0: RGB(234, 38, 0), 0.25: RGB(234, 126, 0), 0.5: RGB(254, 244, 84), 0.75: RGB(173, 203, 249), 1: RGB(75, 107, 169)])
gradient_3 = Gradient(LowerLimit=0, UpperLimit=1, Parameter=Slider(0.02, range=0..1), stops=[0.15: RGB(255, 130, 160), 0.85: RGB(220, 0, 40)])
gradient_4 = Gradient(
    LowerLimit=0,
    UpperLimit=1,
    Parameter=Slider(0.84, range=0..1),
    stops=[0: RGB(243, 57, 0), 0.1: RGB(236, 27, 60), 0.2: RGB(210, 0, 118), 0.3: RGB(103, 0, 120), 0.4: RGB(39, 72, 161), 0.6: RGB(18, 178, 90), 0.7: RGB(79, 186, 8), 0.8: RGB(220, 237, 32), 0.9: RGB(247, 159, 20), 1: RGB(243, 57, 0)])
gradient_5 = Gradient(
    LowerLimit=0,
    UpperLimit=1,
    Parameter=Slider(0.19, range=0..1),
    stops=[0: RGB(243, 57, 0), 0.1: RGB(236, 27, 60), 0.2: RGB(210, 0, 118), 0.3: RGB(103, 0, 120), 0.4: RGB(39, 72, 161), 0.6: RGB(18, 178, 90), 0.7: RGB(79, 186, 8), 0.8: RGB(220, 237, 32), 0.9: RGB(247, 159, 20), 1: RGB(243, 57, 0)])
gradient_6 = Gradient(LowerLimit=0, UpperLimit=1, Parameter=Slider(0.87, range=0..1), stops=[0.15: RGB(255, 130, 160), 0.85: RGB(220, 0, 40)])
gradient_7 = Gradient(
    LowerLimit=0,
    UpperLimit=1,
    Parameter=Slider(0.54, range=0..1),
    stops=[0: RGB(243, 57, 0), 0.1: RGB(236, 27, 60), 0.2: RGB(210, 0, 118), 0.3: RGB(103, 0, 120), 0.4: RGB(39, 72, 161), 0.6: RGB(18, 178, 90), 0.7: RGB(79, 186, 8), 0.8: RGB(220, 237, 32), 0.9: RGB(247, 159, 20), 1: RGB(243, 57, 0)])
gradient_8 = Gradient(LowerLimit=0, UpperLimit=1, Parameter=Slider(0.21, range=0..1), stops=[0.704: RGB(173, 203, 249), 1: RGB(75, 107, 169)])
gradient_9 = Gradient(LowerLimit=0, UpperLimit=1, Parameter=Slider(1, range=0..1), stops=[0.804: RGB(173, 203, 249), 1: RGB(75, 107, 169)])
gradient_10 = Gradient(
    LowerLimit=0,
    UpperLimit=1,
    Parameter=Slider(0.86, range=0..1),
    stops=[0: RGB(234, 38, 0), 0.25: RGB(234, 126, 0), 0.5: RGB(254, 244, 84), 0.75: RGB(173, 203, 249), 1: RGB(75, 107, 169)])
gradient_11 = Gradient(LowerLimit=0, UpperLimit=1, Parameter=Slider(0.97, range=0..1), stops=[0.704: RGB(173, 203, 249), 1: RGB(75, 107, 169)])
gradient_12 = Gradient(
    LowerLimit=0,
    UpperLimit=1,
    Parameter=Slider(0, range=0..1),
    stops=[0.131: RGB(31, 197, 237), 0.19: RGB(29, 247, 176), 0.85: RGB(220, 0, 40)])
gradient_13 = Gradient(
    LowerLimit=0,
    UpperLimit=1,
    Parameter=Slider(0.89, range=0..1),
    stops=[0: RGB(243, 57, 0), 0.1: RGB(236, 27, 60), 0.2: RGB(210, 0, 118), 0.3: RGB(103, 0, 120), 0.4: RGB(39, 72, 161), 0.6: RGB(18, 178, 90), 0.7: RGB(79, 186, 8), 0.8: RGB(220, 237, 32), 0.9: RGB(247, 159, 20), 1: RGB(243, 57, 0)])
gradient_14 = Gradient(LowerLimit=0, UpperLimit=1, Parameter=Slider(0.22, range=0..1), stops=[0.704: RGB(173, 203, 249), 1: RGB(75, 107, 169)])
custom_preview = CustomPreview(Geometry=explode_tree.Branch5, Material=gradient)
custom_preview_2 = CustomPreview(Geometry=explode_tree.Branch10, Material=gradient_2)
custom_preview_3 = CustomPreview(Geometry=explode_tree.Branch4, Material=gradient_6)
custom_preview_4 = CustomPreview(Geometry=explode_tree.Branch8, Material=gradient_3)
custom_preview_5 = CustomPreview(Geometry=explode_tree.Branch7, Material=gradient_4)
custom_preview_6 = CustomPreview(Geometry=explode_tree.Branch11, Material=gradient_5)
custom_preview_7 = CustomPreview(Geometry=explode_tree.Branch3, Material=gradient_7)
custom_preview_8 = CustomPreview(Geometry=explode_tree.Branch6, Material=gradient_8)
# rc
custom_preview_9 = CustomPreview(Geometry=explode_tree.Branch9, Material=gradient_9)
custom_preview_10 = CustomPreview(Geometry=explode_tree.Branch12, Material=gradient_10)
custom_preview_11 = CustomPreview(Geometry=explode_tree.Branch2, Material=gradient_11)
# rs
custom_preview_12 = CustomPreview(Geometry=explode_tree.Branch0, Material=gradient_12)
# Full multiplicity knots at start
# Simple knots
# Full multiplicity knots at end
# P1
# A=0.2*P1+ 0.8*P2
# D=0.2*A + 0.8*B
# P2
# B=0.47*P2 + 0.53*P3
# Full multiplicity knots at start
# E=0.7*B + 0.3*C
# P3
# Full multiplicity knots in the middle
# C=0.8*P3 + 0.2*P4
# P4
# Full multiplicity knots at end
# Compare knot spacing
# GH solution
# VB
# C#
# Python with RhinoCommon Only
# Pythong with RhinoScriptSyntax
# GH solution
# VB
# C#
# Python
# VB
custom_preview_13 = CustomPreview(Geometry=explode_tree.Branch15, Material=gradient_6)
custom_preview_14 = CustomPreview(Geometry=explode_tree.Branch14, Material=gradient_13)
custom_preview_15 = CustomPreview(Geometry=explode_tree.Branch13, Material=gradient_14)

year = Year(2020)
month = Month(5)
hour = Hour(12)
minute = Minute(0)
second = Second(0)
day = Day(21)
panel_25 = Panel(year)
second_2 = Second(0)
minute_2 = Minute(29)
hour_2 = Hour(12)
panel_26 = Panel(second)
panel_27 = Panel(month)
panel_28 = Panel(minute)
panel_29 = Panel(hour_2)
panel_30 = Panel(minute_2)
panel_31 = Panel(second_2)
month_2 = Month(Slider(3, range=1..12))
year_2 = Year("2020")
day_2 = Day(Slider(31, range=1..31))
panel_32 = Panel(day)
panel_33 = Panel(hour)

construct_exotic_date_2 = ConstructExoticDate(Year=year_2, Month=month_2, Day=day_2, Calendar=0)

construct_time_2 = ConstructTime(Hour=hour_2, Minute=minute_2, Second=second_2)

combine_date_time_2 = CombineDateTime(Date=construct_exotic_date_2, Time=construct_time_2)

construct_date_2 = ConstructDate(Year=year, Month=month, Day=day, Hour=hour, Minute=minute, Second=second)

date_range_2 = DateRange(TimeA=construct_date_2, TimeB=construct_exotic_date_2, Count=Slider(2, range=0..10))

interpolate_date_2 = InterpolateDate(DateA=construct_date_2, DateB=construct_exotic_date_2, Interpolation=Slider(6, range=0..10))

deconstruct_date_2 = DeconstructDate(Date=construct_date_2)  # -> Year, Month, Day, Hour, Minute, Second

panel_34 = Panel(combine_date_time_2)
panel_35 = Panel(construct_exotic_date_2)
panel_36 = Panel(construct_time_2)
panel_37 = Panel(construct_date_2)
panel_38 = Panel(date_range_2)
panel_39 = Panel(interpolate_date_2)
panel_40 = Panel(deconstruct_date_2.Year)
panel_41 = Panel(deconstruct_date_2.Day)
panel_42 = Panel(deconstruct_date_2.Hour)
panel_43 = Panel(deconstruct_date_2.Minute)
panel_44 = Panel(deconstruct_date_2.Month)
panel_45 = Panel(deconstruct_date_2.Second)
