# Grasshopper definition MathTime046.gh (Grasshopper 1.0.7)
# Copyright: Wickerson Studios
# plug-ins: Firefly.X, Bifocals

image_sampler = ImageSampler(
    FilePath="C:\Users\Sculpture\Documents\2020Grasshopper\ScreenShots2019\Screenshots2020\SurfaceEditAlgorithm.PNG",
    Filter="Value",
    Interpolate=False,
    Umax=1,
    Umin=0,
    Vmax=1,
    Vmin=0,
    Wrap=1)  # disabled

# ----
# First Cool .gh File worth playing with!
number_slider = Slider(4.738, range=0..10)  # disabled
negative = Negative(Value=number_slider)  # disabled
construct_domain = ConstructDomain(DomainStart=negative, DomainEnd=number_slider)  # disabled
sine = Sine(Value=construct_domain)  # disabled
tangent = Tangent(Value=construct_domain)  # disabled
cosine = Cosine(Value=construct_domain)  # disabled
number_slider_2 = Slider(6, range=0..10)  # disabled
merge = Merge(Data1=sine, Data2=cosine)  # disabled
panel = Panel(merge)  # disabled
range = Range(Domain=sine, Steps=10)  # disabled
range_2 = Range(Domain=cosine, Steps=10)  # disabled
number_slider_3 = Slider(0.905, range=0..1)  # disabled
multiplication = Multiplication(A=number_slider_2, B=range_2)  # disabled
multiplication_2 = Multiplication(A=number_slider_2, B=range)  # disabled
deconstruct_domain = DeconstructDomain(Domain=merge)  # -> Start, End; disabled
construct_point = ConstructPoint(XCoordinate=construct_domain, YCoordinate=multiplication_2, ZCoordinate=multiplication)  # disabled
panel_2 = Panel(deconstruct_domain.Start)  # disabled
panel_3 = Panel(deconstruct_domain.End)  # disabled
polyline = PolyLine(Vertices=construct_point, Closed=True)  # disabled
pipe = Pipe(Curve=polyline, Radius=number_slider_3, Caps=2)  # disabled

number_slider_4 = Slider(0.5, range=0..2)  # disabled
pi = Pi(Factor=number_slider_4)  # disabled
construct_domain_2 = ConstructDomain(DomainStart=0, DomainEnd=pi)  # disabled
sinc = Sinc(Value=construct_domain_2)  # disabled
sine_2 = Sine(Value=construct_domain_2)  # disabled
cosine_2 = Cosine(Value=construct_domain_2)  # disabled
merge_2 = Merge(Data1=sine_2, Data2=cosine_2, Data3=sinc)  # disabled
panel_4 = Panel(merge_2)  # disabled

number_slider_5 = Slider(0, range=0..360)  # disabled
radians = Radians(Degrees=number_slider_5)  # disabled
panel_5 = Panel(radians)  # disabled
degrees = Degrees(Radians=radians)  # disabled
panel_6 = Panel(degrees)  # disabled

number_slider_6 = Slider(42, range=0..90)  # disabled
number_slider_7 = Slider(74, range=0..90)  # disabled
number_slider_8 = Slider(58, range=0..90)  # disabled
number_slider_9 = Slider(6.65, range=1..10)  # disabled
number_slider_10 = Slider(6.64, range=1..10)  # disabled
right_trigonometry = RightTrigonometry(Alpha=degrees(number_slider_6), PLength=number_slider_9)  # -> Alpha, Beta, PLength, QLength, RLength; disabled
triangle_trigonometry = TriangleTrigonometry(Alpha=degrees(number_slider_7), Beta=degrees(number_slider_8), BLength=number_slider_10)  # -> Alpha, Beta, Gamma, ALength, BLength, CLength; disabled
degrees_2 = Degrees(Radians=right_trigonometry.Beta)  # disabled
degrees_3 = Degrees(Radians=triangle_trigonometry.Beta)  # disabled
panel_7 = Panel(right_trigonometry.QLength)  # disabled
panel_8 = Panel(degrees_2)  # disabled
panel_9 = Panel(degrees_3)  # disabled
panel_10 = Panel(triangle_trigonometry.CLength)  # disabled

# ----
# 1001 GRASSHOPPER DEFINITIONS
# Wickerson Studio
# 
# created by: Michael Wickerson
# 
# Grasshopper for Rhino 3D Algorithmic Modeling
# 
# www.wickersonstudios.com
# www.michaelwickerson.com
# https://www.youtube.com/channel/UC7J48Ppcsa6oncp6d29R0xw
# https://github.com/mwickerson
# https://www.facebook.com/michael.wickerson
# https://www.linkedin.com/in/michael-wickerson-696a80156/
# https://www.grasshopper3d.com/profile/MichaelWickerson
# MATH  TRIG 046/1001
sine_3 = Sine()  # disabled
cosine_3 = Cosine()  # disabled
sinc_2 = Sinc()  # disabled
tangent_2 = Tangent()  # disabled
arccosine = ArcCosine()  # disabled
arcsine = ArcSine()  # disabled
arctangent = ArcTangent()  # disabled
cosecant = CoSecant()  # disabled
cotangent = CoTangent()  # disabled
secant = Secant()  # disabled
# Wickerson Studio
# created by: Michael Wickerson
# Grasshopper for Rhino 3D Algorithmic Modeling
# www.wickersonstudios.com
# www.michaelwickerson.com
# https://www.youtube.com/channel/UC7J48Ppcsa6oncp6d29R0xw
# https://github.com/mwickerson
# https://www.facebook.com/michael.wickerson
# https://www.linkedin.com/in/michael-wickerson-696a80156/
# https://www.grasshopper3d.com/profile/MichaelWickerson
myfavoritetrig001 = MyFavoriteTrig001(factor=1, steps=10, factor_2=1)  # disabled

number_slider_11 = Slider(81, range=0..100)
number_slider_12 = Slider(4.47, range=0..10)
myfavoritetrig001_2 = MyFavoriteTrig001_2(
    B_2=number_slider_11,
    B=number_slider_11,
    factor=number_slider_12,
    steps=100,
    A=number_slider_12,
    factor_2=number_slider_12)
polar_array = PolarArray(Geometry=myfavoritetrig001_2, Plane=PlaneXY(0, 0, 0), Count=Slider(10, range=3..10), Angle=6.283185307)  # -> Geometry, Transform
perp_frames = PerpFrames(Curve=polar_array.Geometry, Count=Slider(2, range=0..10), Align=True)  # -> Frames, Parameters
polygon = Polygon(Plane=perp_frames.Frames, Radius=number_slider_11, Segments=Slider(3, range=3..10), FilletRadius=0)  # -> Polygon, Length
plane = Plane(perp_frames.Frames)
boolean_toggle = BooleanToggle(False)
control_polygon = ControlPolygon(Curve=polygon.Polygon)  # -> Polygon, Points
deconstruct_plane = DeconstructPlane(Plane=plane)  # -> Origin, XAxis, YAxis, ZAxis
interpolate = Interpolate(Vertices=control_polygon.Points, Degree=3, Periodic=boolean_toggle, KnotStyle=1)  # -> Curve, Length, Domain
vector = Vector(graft(deconstruct_plane.ZAxis))
curve = Curve(graft(control_polygon.Polygon))
curve_2 = Curve(graft(interpolate.Curve))
vector_display = VectorDisplay(Anchor=deconstruct_plane.Origin, Vector=vector)
boundary_surfaces = BoundarySurfaces(Edges=curve_2)
boundary_surfaces_2 = BoundarySurfaces(Edges=curve)
solid_difference = SolidDifference(BrepsA=boundary_surfaces_2, BrepsB=boundary_surfaces)
range_3 = Range(Domain=Domain(0, 1), Steps=10)
simplify_tree = SimplifyTree(Tree=solid_difference, Front=False)
amplitude = Amplitude(Vector=vector, Amplitude=Slider(5.05, range=0..10))
graph_mapper = GraphMapper(range_3, x0=0, x1=1, y0=0, y1=5, container_name="Sine", Equation_px=[0, 0.1982068121], Equation_py=[0.3649619222, 1])
extrude = Extrude(Base=simplify_tree, Direction=amplitude)
pipe_variable = PipeVariable(Curve=reparameterize(polar_array.Geometry), Parameters=range_3, Radii=graph_mapper, Caps=boolean_toggle)

number_slider_13 = Slider(156, range=0..1000)  # disabled
number_slider_14 = Slider(2, range=0..10)  # disabled
number_slider_15 = Slider(12, range=0..100)  # disabled
extremes = Extremes(A=number_slider_14, B=number_slider_15, C=number_slider_13)  # -> Mininum, Maximum; disabled
maximum = Maximum(A=number_slider_15, B=number_slider_13)  # disabled
minimum = Minimum(A=number_slider_15, B=number_slider_13)  # disabled
panel_11 = Panel(extremes.Maximum)  # disabled
panel_12 = Panel(extremes.Mininum)  # disabled
panel_13 = Panel(maximum)  # disabled
panel_14 = Panel(minimum)  # disabled

number_slider_16 = Slider(243.377, range=0..1000)  # disabled
round = Round(Number=number_slider_16)  # -> Nearest, Floor, Ceiling; disabled
panel_15 = Panel(round.Nearest)  # disabled
panel_16 = Panel(round.Floor)  # disabled
panel_17 = Panel(round.Ceiling)  # disabled

number_slider_17 = Slider(1, range=0..1)  # disabled
number_slider_18 = Slider(2, range=0..10)  # disabled
number_slider_19 = Slider(122, range=0..1000)  # disabled
number_slider_20 = Slider(12, range=0..100)  # disabled
number_slider_21 = Slider(51, range=0..100)  # disabled
number_slider_22 = Slider(0.36, range=0..1)  # disabled
number_slider_23 = Slider(2, range=0..10)  # disabled
number_slider_24 = Slider(0.43, range=0..1)  # disabled
boolean_toggle_2 = BooleanToggle(True)  # disabled
boolean_toggle_3 = BooleanToggle(False)  # disabled
number_slider_25 = Slider(0.6, range=0..1)  # disabled
merge_3 = Merge(Data1=number_slider_17, Data2=number_slider_18, Data3=number_slider_20, Data4=number_slider_19)  # disabled
range_4 = Range(Domain=merge_3, Steps=number_slider_21)  # disabled
average = Average(Input=merge_3)  # disabled
truncate = Truncate(Input=range_4, TruncationFactor=number_slider_25)  # -> flatten(Result); disabled
blur_numbers = BlurNumbers(Numbers=merge_3, Strength=number_slider_22, Iterations=number_slider_23, Lock=boolean_toggle_2, Wrap=boolean_toggle_3)  # disabled
smooth_numbers = SmoothNumbers(Numbers=merge_3, SmoothDelay=2000)  # disabled
interpolate_data = InterpolateData(Data=merge_3, Parameter=number_slider_24, Interpolation=2)  # disabled
panel_18 = Panel(average)  # disabled
panel_19 = Panel(blur_numbers)  # disabled
panel_20 = Panel(interpolate_data)  # disabled
panel_21 = Panel(smooth_numbers)  # disabled
panel_22 = Panel(truncate)  # disabled
param_viewer = ParamViewer(panel_22)  # disabled

epsilon = Epsilon(Factor=1)  # disabled
natural_logarithm = NaturalLogarithm(Factor=1)  # disabled
golden_ratio = GoldenRatio(Factor=1)  # disabled
pi_2 = Pi(Factor=1)  # disabled
merge_4 = Merge(Data1=epsilon, Data2=golden_ratio, Data3=natural_logarithm, Data4=pi_2)  # disabled
panel_23 = Panel(merge_4)  # disabled

list_length = ListLength(List=truncate)  # disabled
panel_24 = Panel(list_length)  # disabled
explode_tree = ExplodeTree(Data=simplify_tree)  # -> Branch0, Branch1
explode_tree_2 = ExplodeTree()  # -> Branch0, Branch1, Branch2, Branch3, Branch4, Branch5, Branch6, Branch7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
gradient = Gradient(
    LowerLimit=0,
    UpperLimit=1,
    Parameter=Slider(0.12, range=0..1),
    stops=[0: RGB(234, 38, 0), 0.25: RGB(234, 126, 0), 0.5: RGB(254, 244, 84), 0.75: RGB(173, 203, 249), 1: RGB(75, 107, 169)])
gradient_2 = Gradient(
    LowerLimit=0,
    UpperLimit=1,
    Parameter=Slider(0.66, range=0..1),
    stops=[0: RGB(234, 38, 0), 0.25: RGB(234, 126, 0), 0.5: RGB(254, 244, 84), 0.75: RGB(173, 203, 249), 1: RGB(75, 107, 169)])
gradient_3 = Gradient(LowerLimit=0, UpperLimit=1, Parameter=Slider(0.02, range=0..1), stops=[0.15: RGB(255, 130, 160), 0.85: RGB(220, 0, 40)])
gradient_4 = Gradient(
    LowerLimit=0,
    UpperLimit=1,
    Parameter=Slider(0.84, range=0..1),
    stops=[0: RGB(243, 57, 0), 0.1: RGB(236, 27, 60), 0.2: RGB(210, 0, 118), 0.3: RGB(103, 0, 120), 0.4: RGB(39, 72, 161), 0.6: RGB(18, 178, 90), 0.7: RGB(79, 186, 8), 0.8: RGB(220, 237, 32), 0.9: RGB(247, 159, 20), 1: RGB(243, 57, 0)])
gradient_5 = Gradient(
    LowerLimit=0,
    UpperLimit=1,
    Parameter=Slider(0.19, range=0..1),
    stops=[0: RGB(243, 57, 0), 0.1: RGB(236, 27, 60), 0.2: RGB(210, 0, 118), 0.3: RGB(103, 0, 120), 0.4: RGB(39, 72, 161), 0.6: RGB(18, 178, 90), 0.7: RGB(79, 186, 8), 0.8: RGB(220, 237, 32), 0.9: RGB(247, 159, 20), 1: RGB(243, 57, 0)])
gradient_6 = Gradient(LowerLimit=0, UpperLimit=1, Parameter=Slider(0.87, range=0..1), stops=[0.15: RGB(255, 130, 160), 0.85: RGB(220, 0, 40)])
gradient_7 = Gradient(
    LowerLimit=0,
    UpperLimit=1,
    Parameter=Slider(0.54, range=0..1),
    stops=[0: RGB(243, 57, 0), 0.1: RGB(236, 27, 60), 0.2: RGB(210, 0, 118), 0.3: RGB(103, 0, 120), 0.4: RGB(39, 72, 161), 0.6: RGB(18, 178, 90), 0.7: RGB(79, 186, 8), 0.8: RGB(220, 237, 32), 0.9: RGB(247, 159, 20), 1: RGB(243, 57, 0)])
gradient_8 = Gradient(LowerLimit=0, UpperLimit=1, Parameter=Slider(0.21, range=0..1), stops=[0.704: RGB(173, 203, 249), 1: RGB(75, 107, 169)])
gradient_9 = Gradient(LowerLimit=0, UpperLimit=1, Parameter=Slider(1, range=0..1), stops=[0.804: RGB(173, 203, 249), 1: RGB(75, 107, 169)])
gradient_10 = Gradient(
    LowerLimit=0,
    UpperLimit=1,
    Parameter=Slider(0.86, range=0..1),
    stops=[0: RGB(234, 38, 0), 0.25: RGB(234, 126, 0), 0.5: RGB(254, 244, 84), 0.75: RGB(173, 203, 249), 1: RGB(75, 107, 169)])
gradient_11 = Gradient(LowerLimit=0, UpperLimit=1, Parameter=Slider(0.97, range=0..1), stops=[0.704: RGB(173, 203, 249), 1: RGB(75, 107, 169)])
gradient_12 = Gradient(
    LowerLimit=0,
    UpperLimit=1,
    Parameter=Slider(0, range=0..1),
    stops=[0.131: RGB(31, 197, 237), 0.19: RGB(29, 247, 176), 0.85: RGB(220, 0, 40)])
gradient_13 = Gradient(
    LowerLimit=0,
    UpperLimit=1,
    Parameter=Slider(0.89, range=0..1),
    stops=[0: RGB(243, 57, 0), 0.1: RGB(236, 27, 60), 0.2: RGB(210, 0, 118), 0.3: RGB(103, 0, 120), 0.4: RGB(39, 72, 161), 0.6: RGB(18, 178, 90), 0.7: RGB(79, 186, 8), 0.8: RGB(220, 237, 32), 0.9: RGB(247, 159, 20), 1: RGB(243, 57, 0)])
gradient_14 = Gradient(LowerLimit=0, UpperLimit=1, Parameter=Slider(0.22, range=0..1), stops=[0.704: RGB(173, 203, 249), 1: RGB(75, 107, 169)])
custom_preview = CustomPreview(Geometry=explode_tree_2.Branch5, Material=gradient)
custom_preview_2 = CustomPreview(Geometry=explode_tree_2.Branch10, Material=gradient_2)
custom_preview_3 = CustomPreview(Geometry=explode_tree_2.Branch4, Material=gradient_6)
custom_preview_4 = CustomPreview(Geometry=explode_tree_2.Branch8, Material=gradient_3)
custom_preview_5 = CustomPreview(Geometry=explode_tree_2.Branch7, Material=gradient_4)
custom_preview_6 = CustomPreview(Geometry=explode_tree_2.Branch11, Material=gradient_5)
custom_preview_7 = CustomPreview(Geometry=explode_tree_2.Branch3, Material=gradient_7)
custom_preview_8 = CustomPreview(Geometry=explode_tree_2.Branch6, Material=gradient_8)
# rc
custom_preview_9 = CustomPreview(Geometry=explode_tree_2.Branch9, Material=gradient_9)
custom_preview_10 = CustomPreview(Geometry=explode_tree_2.Branch12, Material=gradient_10)
custom_preview_11 = CustomPreview(Geometry=explode_tree_2.Branch2, Material=gradient_11)
# rs
custom_preview_12 = CustomPreview(Geometry=explode_tree_2.Branch0, Material=gradient_12)
# Full multiplicity knots at start
# Simple knots
# Full multiplicity knots at end
# P1
# A=0.2*P1+ 0.8*P2
# D=0.2*A + 0.8*B
# P2
# B=0.47*P2 + 0.53*P3
# Full multiplicity knots at start
# E=0.7*B + 0.3*C
# P3
# Full multiplicity knots in the middle
# C=0.8*P3 + 0.2*P4
# P4
# Full multiplicity knots at end
# Compare knot spacing
custom_preview_13 = CustomPreview(Geometry=explode_tree_2.Branch15, Material=gradient_6)
custom_preview_14 = CustomPreview(Geometry=explode_tree_2.Branch14, Material=gradient_13)
custom_preview_15 = CustomPreview(Geometry=explode_tree_2.Branch13, Material=gradient_14)

number_slider_26 = Slider(11, range=0..100)  # disabled
number_slider_27 = Slider(59, range=0..100)  # disabled
number_slider_28 = Slider(0.2, range=0..1)  # disabled
construct_domain_3 = ConstructDomain(DomainStart=0, DomainEnd=number_slider_26)  # disabled
boolean_toggle_4 = BooleanToggle(True)  # disabled
number_slider_29 = Slider(3, range=0..5)  # disabled
panel_25 = Panel("2*sin(x)")  # disabled
number_slider_30 = Slider(11, range=0..100)  # disabled
range_5 = Range(Domain=construct_domain_3, Steps=number_slider_27)  # disabled
graph_mapper_2 = GraphMapper(
    range_5,
    x0=0,
    x1=11,
    y0=0,
    y1=1,
    Ox=0.5286316276,
    Oy=0.2361504436,
    Px=0.8431215882,
    Py=0.4113506675,
    container_name="Parabola")  # disabled
webcam_video_stream = WebCamVideoStream()  # disabled
sound_capture = SoundCapture(TimePeriod=number_slider_28, StartStopSoundCapture=boolean_toggle_4)  # -> WavePressureSamplesFromLeftChannel, WavePressureSamplesFromRightChannel, Volume; disabled
number_slider_31 = Slider(0, range=0..100)  # disabled
number_slider_32 = Slider(4, range=0..100)  # disabled
number_slider_33 = Slider(2, range=0..100)  # disabled
c_script = CSharpScript()  # -> Out, A; disabled
timer = Timer(TimerInterval=20, Target=sound_capture)  # disabled
graph_mapper_3 = GraphMapper(
    graph_mapper_2,
    x0=0,
    x1=11,
    y0=0,
    y1=1,
    container_name="Bezier",
    cpx=[0, 0.04908847809, 1, 1],
    cpy=[0, 0.8569073081, 0, 1])  # disabled
evaluate = Evaluate(Expression=panel_25, x=range_5)  # disabled
ghpython_script = GhPythonScript()  # -> Out, A; disabled
expression = Expression(x=range_5, Expression="sin(x)")  # disabled
vb_script = VBScript()  # -> Out, A; disabled
color_correction = ColorCorrection(
    BitmapToModify=webcam_video_stream,
    AlphaMultiplier=1,
    RedMultiplier=number_slider_31,
    GreenMultiplier=number_slider_32,
    BlueMultiplier=number_slider_33)  # disabled
panel_26 = Panel(sound_capture.Volume)  # disabled
video_averages = VideoAverages(BitmapToModify=color_correction, MinimumPointOfBoundingArea=Point(0, 0, 0), MaximumPointOfBoundingArea=Point(1, 1, 0))  # -> AverageColor, AverageMovementVector, CentroidOfMovement, CentroidOfRedPixels, CentroidOfGreenPixels, CentroidOfBluePixels; disabled
multiplication_3 = Multiplication(A=video_averages.AverageMovementVector, B=number_slider_29)  # disabled
panel_27 = Panel(video_averages.AverageMovementVector)  # disabled
number_slider_34 = Slider(12, range=0..100)  # disabled
panel_28 = Panel(evaluate)  # disabled
multiplication_4 = Multiplication(A=number_slider_34, B=video_averages.AverageMovementVector)  # disabled
# GH solution
# VB
# C#
# Python with RhinoCommon Only
# Pythong with RhinoScriptSyntax
# GH solution
# VB
# C#
# Python
# VB
param_viewer_2 = ParamViewer(video_averages.AverageMovementVector)  # disabled
construct_point_2 = ConstructPoint(XCoordinate=0, YCoordinate=0, ZCoordinate=0)  # disabled
number_slider_35 = Slider(1, range=0..1)  # disabled
unit_z = UnitZ(Factor=1)  # disabled
panel_30 = Panel(multiplication_4)  # disabled
line_sdl = LineSDL(Start=construct_point_2, Direction=unit_z, Length=number_slider_35)  # disabled

sine_4 = Sine(Value=range_5)  # disabled

addition = Addition(A=number_slider_30, B=sine_4)  # disabled
construct_point_3 = ConstructPoint(XCoordinate=addition, YCoordinate=multiplication_3, ZCoordinate=range_5)  # disabled
interpolate_2 = Interpolate(Vertices=construct_point_3, Degree=3, Periodic=False, KnotStyle=1)  # -> Curve, Length, Domain; disabled
revolution = Revolution(Curve=interpolate_2.Curve, Axis=line_sdl, Domain=Domain(0, 6.283185307))  # disabled

# ==== cluster MyFavoriteTrig001
factor = ClusterInput()
pi = Pi(Factor=factor)
construct_domain = ConstructDomain(DomainStart=0, DomainEnd=pi)
steps = ClusterInput()
range = Range(Domain=construct_domain, Steps=steps)
factor_2 = ClusterInput()
pi_2 = Pi(Factor=factor_2)
cosine = Cosine(Value=range)
sine = Sine(Value=range)
B = ClusterInput()
B_2 = ClusterInput()
A = ClusterInput()
multiplication = Multiplication(A=sine, B=B)
multiplication_2 = Multiplication(A=cosine, B=B_2)
multiplication_3 = Multiplication(A=A, B=pi_2)
multiplication_4 = Multiplication(A=range, B=multiplication_3)
construct_point = ConstructPoint(XCoordinate=multiplication, YCoordinate=multiplication_2, ZCoordinate=multiplication_4)
interpolate = Interpolate(Vertices=construct_point, Degree=3, Periodic=False, KnotStyle=1)  # -> Curve, Length, Domain
curve = ClusterOutput(interpolate.Curve)

# ==== cluster MyFavoriteTrig001_2
factor = ClusterInput()
pi = Pi(Factor=factor)
construct_domain = ConstructDomain(DomainStart=0, DomainEnd=pi)
steps = ClusterInput()
range = Range(Domain=construct_domain, Steps=steps)
factor_2 = ClusterInput()
pi_2 = Pi(Factor=factor_2)
cosine = Cosine(Value=range)
sine = Sine(Value=range)
A = ClusterInput()
B = ClusterInput()
B_2 = ClusterInput()
multiplication = Multiplication(A=sine, B=B_2)
multiplication_2 = Multiplication(A=cosine, B=B)
multiplication_3 = Multiplication(A=A, B=pi_2)
multiplication_4 = Multiplication(A=range, B=multiplication_3)
construct_point = ConstructPoint(XCoordinate=multiplication, YCoordinate=multiplication_2, ZCoordinate=multiplication_4)
interpolate = Interpolate(Vertices=construct_point, Degree=3, Periodic=False, KnotStyle=1)  # -> Curve, Length, Domain
curve = ClusterOutput(interpolate.Curve)
