# Grasshopper definition MathTrig049.gh (Grasshopper 1.0.7)
# Copyright: Wickerson Studios
# plug-ins: Bifocals

image_sampler = ImageSampler(
    FilePath="C:\Users\Sculpture\Documents\2020Grasshopper\ScreenShots2019\Screenshots2020\SurfaceEditAlgorithm.PNG",
    Filter="Value",
    Interpolate=False,
    Umax=1,
    Umin=0,
    Vmax=1,
    Vmin=0,
    Wrap=1)  # disabled

sinc = Sinc()  # disabled
cosine = Cosine()  # disabled
tangent = Tangent()  # disabled
arccosine = ArcCosine()  # disabled
arcsine = ArcSine()  # disabled
arctangent = ArcTangent()  # disabled
cosecant = CoSecant()  # disabled
cotangent = CoTangent()  # disabled
secant = Secant()  # disabled
# Wickerson Studio
# created by: Michael Wickerson
# Grasshopper for Rhino 3D Algorithmic Modeling
# www.wickersonstudios.com
# www.michaelwickerson.com
# https://www.youtube.com/channel/UC7J48Ppcsa6oncp6d29R0xw
# https://github.com/mwickerson
# https://www.facebook.com/michael.wickerson
# https://www.linkedin.com/in/michael-wickerson-696a80156/
# https://www.grasshopper3d.com/profile/MichaelWickerson
myfavoritetrig001 = MyFavoriteTrig001(factor=1, steps=10, factor_2=1)  # disabled
# 1001 GRASSHOPPER DEFINITIONS
# Wickerson Studio
# 
# created by: Michael Wickerson
# 
# Grasshopper for Rhino 3D Algorithmic Modeling
# 
# www.wickersonstudios.com
# www.michaelwickerson.com
# https://www.youtube.com/channel/UC7J48Ppcsa6oncp6d29R0xw
# https://github.com/mwickerson
# https://www.facebook.com/michael.wickerson
# https://www.linkedin.com/in/michael-wickerson-696a80156/
# https://www.grasshopper3d.com/profile/MichaelWickerson
# MATH  TRIG 049/1001
sine = Sine()  # disabled

number_slider = Slider(2, range=0..10)  # disabled
number_slider_2 = Slider(156, range=0..1000)  # disabled
number_slider_3 = Slider(12, range=0..100)  # disabled
extremes = Extremes(A=number_slider, B=number_slider_3, C=number_slider_2)  # -> Mininum, Maximum; disabled
maximum = Maximum(A=number_slider_3, B=number_slider_2)  # disabled
minimum = Minimum(A=number_slider_3, B=number_slider_2)  # disabled
panel = Panel(extremes.Mininum)  # disabled
panel_2 = Panel(extremes.Maximum)  # disabled
panel_3 = Panel(maximum)  # disabled
panel_4 = Panel(minimum)  # disabled

number_slider_4 = Slider(1, range=0..1)  # disabled
number_slider_5 = Slider(2, range=0..10)  # disabled
number_slider_6 = Slider(122, range=0..1000)  # disabled
number_slider_7 = Slider(12, range=0..100)  # disabled
number_slider_8 = Slider(51, range=0..100)  # disabled
number_slider_9 = Slider(0.36, range=0..1)  # disabled
number_slider_10 = Slider(2, range=0..10)  # disabled
number_slider_11 = Slider(0.43, range=0..1)  # disabled
boolean_toggle = BooleanToggle(True)  # disabled
boolean_toggle_2 = BooleanToggle(False)  # disabled
number_slider_12 = Slider(0.6, range=0..1)  # disabled
merge = Merge(Data1=number_slider_4, Data2=number_slider_5, Data3=number_slider_7, Data4=number_slider_6)  # disabled
range = Range(Domain=merge, Steps=number_slider_8)  # disabled
average = Average(Input=merge)  # disabled
truncate = Truncate(Input=range, TruncationFactor=number_slider_12)  # -> flatten(Result); disabled
blur_numbers = BlurNumbers(Numbers=merge, Strength=number_slider_9, Iterations=number_slider_10, Lock=boolean_toggle, Wrap=boolean_toggle_2)  # disabled
smooth_numbers = SmoothNumbers(Numbers=merge, SmoothDelay=2000)  # disabled
interpolate_data = InterpolateData(Data=merge, Parameter=number_slider_11, Interpolation=2)  # disabled
panel_5 = Panel(average)  # disabled
panel_6 = Panel(blur_numbers)  # disabled
panel_7 = Panel(interpolate_data)  # disabled
panel_8 = Panel(smooth_numbers)  # disabled
panel_9 = Panel(truncate)  # disabled
param_viewer = ParamViewer(panel_9)  # disabled

number_slider_13 = Slider(243.377, range=0..1000)  # disabled
round = Round(Number=number_slider_13)  # -> Nearest, Floor, Ceiling; disabled
panel_10 = Panel(round.Nearest)  # disabled
panel_11 = Panel(round.Floor)  # disabled
panel_12 = Panel(round.Ceiling)  # disabled

epsilon = Epsilon(Factor=1)  # disabled
natural_logarithm = NaturalLogarithm(Factor=1)  # disabled
golden_ratio = GoldenRatio(Factor=1)  # disabled
pi = Pi(Factor=1)  # disabled
merge_2 = Merge(Data1=epsilon, Data2=golden_ratio, Data3=natural_logarithm, Data4=pi)  # disabled
panel_13 = Panel(merge_2)  # disabled

list_length = ListLength(List=truncate)  # disabled
panel_14 = Panel(list_length)  # disabled

number_slider_14 = Slider(1, range=0..1)
construct_domain = ConstructDomain(DomainStart=0, DomainEnd=number_slider_14)
range_2 = Range(Domain=construct_domain, Steps=Slider(14, range=0..100))
sinc_2 = Sinc(Value=range_2)
tangent_2 = Tangent(Value=range_2)
secant_2 = Secant(Value=range_2)
arcsine_2 = ArcSine(Value=range_2)
arctangent_2 = ArcTangent(Value=range_2)
multiplication = Multiplication(A=tangent_2, B=Slider(1.281, range=0..10))
multiplication_2 = Multiplication(A=sinc_2, B=secant_2)
multiplication_3 = Multiplication(A=sinc_2, B=Slider(3, range=0..10))
construct_point = ConstructPoint(XCoordinate=0, YCoordinate=multiplication_2, ZCoordinate=number_slider_14)
construct_point_2 = ConstructPoint(XCoordinate=multiplication, YCoordinate=multiplication, ZCoordinate=multiplication_3)
interpolate = Interpolate(Vertices=construct_point, Degree=3, Periodic=False, KnotStyle=1)  # -> Curve, Length, Domain
interpolate_2 = Interpolate(Vertices=construct_point_2, Degree=3, Periodic=False, KnotStyle=1)  # -> Curve, Length, Domain
xz_plane = XZPlane(Origin=Point(0, 0, 0))
revolution = Revolution(Curve=interpolate_2.Curve, Axis=interpolate.Curve, Domain=Domain(0, 6.283185307))
mirror = Mirror(Geometry=revolution, Plane=xz_plane)  # -> Geometry, Transform
brep_join = BrepJoin(Breps=[revolution, mirror.Geometry])  # -> Breps, Closed
cap_holes = CapHoles(Brep=brep_join.Breps)
deconstruct_brep = DeconstructBrep(Brep=cap_holes)  # -> Faces, Edges, Vertices
deconstruct_brep_2 = DeconstructBrep(Brep=cap_holes)  # -> Faces, Edges, Vertices
number_slider_15 = Slider(5, range=1..11)
list_item = ListItem(List=deconstruct_brep.Faces, Index=0, Wrap=True)
list_item_2 = ListItem(List=deconstruct_brep_2.Faces, Index=Slider(1, range=0..10), Wrap=True)
divide_surface = DivideSurface(Surface=list_item, UCount=number_slider_15, VCount=number_slider_15)  # -> flatten(Points), Normals, Parameters
divide_surface_2 = DivideSurface(Surface=list_item_2, UCount=number_slider_15, VCount=number_slider_15)  # -> flatten(Points), Normals, Parameters
clean_tree = CleanTree(RemoveNulls=True, RemoveInvalid=True, RemoveEmpty=False, Tree=divide_surface.Points)
clean_tree_2 = CleanTree(RemoveNulls=True, RemoveInvalid=True, RemoveEmpty=False, Tree=divide_surface_2.Points)
shortest_list = ShortestList(ListA=clean_tree_2, ListB=clean_tree, TrimMode=2)  # -> ListA, ListB
vector_2pt = Vector2Pt(PointA=shortest_list.ListA, PointB=shortest_list.ListB, Unitize=False)  # -> Vector, Length
line_sdl = LineSDL(Start=clean_tree_2, Direction=vector_2pt.Vector, Length=Slider(12, range=0..100))
pipe = Pipe(Curve=line_sdl, Radius=Slider(0.21, range=0..0.3), Caps=1)  # -> flatten(Pipe)
solid_difference = SolidDifference(BrepsA=cap_holes, BrepsB=pipe)

number_slider_16 = Slider(42, range=0..90)  # disabled
number_slider_17 = Slider(74, range=0..90)  # disabled
number_slider_18 = Slider(58, range=0..90)  # disabled
number_slider_19 = Slider(6.65, range=1..10)  # disabled
number_slider_20 = Slider(6.64, range=1..10)  # disabled
right_trigonometry = RightTrigonometry(Alpha=degrees(number_slider_16), PLength=number_slider_19)  # -> Alpha, Beta, PLength, QLength, RLength; disabled
triangle_trigonometry = TriangleTrigonometry(Alpha=degrees(number_slider_17), Beta=degrees(number_slider_18), BLength=number_slider_20)  # -> Alpha, Beta, Gamma, ALength, BLength, CLength; disabled
degrees = Degrees(Radians=right_trigonometry.Beta)  # disabled
degrees_2 = Degrees(Radians=triangle_trigonometry.Beta)  # disabled
panel_15 = Panel(right_trigonometry.QLength)  # disabled
panel_16 = Panel(degrees)  # disabled
panel_17 = Panel(degrees_2)  # disabled
panel_18 = Panel(triangle_trigonometry.CLength)  # disabled

explode_tree = ExplodeTree()  # -> Branch0, Branch1, Branch2, Branch3, Branch4, Branch5, Branch6, Branch7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
gradient = Gradient(
    LowerLimit=0,
    UpperLimit=1,
    Parameter=Slider(0.12, range=0..1),
    stops=[0: RGB(234, 38, 0), 0.25: RGB(234, 126, 0), 0.5: RGB(254, 244, 84), 0.75: RGB(173, 203, 249), 1: RGB(75, 107, 169)])
gradient_2 = Gradient(
    LowerLimit=0,
    UpperLimit=1,
    Parameter=Slider(0.66, range=0..1),
    stops=[0: RGB(234, 38, 0), 0.25: RGB(234, 126, 0), 0.5: RGB(254, 244, 84), 0.75: RGB(173, 203, 249), 1: RGB(75, 107, 169)])
gradient_3 = Gradient(LowerLimit=0, UpperLimit=1, Parameter=Slider(0.02, range=0..1), stops=[0.15: RGB(255, 130, 160), 0.85: RGB(220, 0, 40)])
gradient_4 = Gradient(
    LowerLimit=0,
    UpperLimit=1,
    Parameter=Slider(0.84, range=0..1),
    stops=[0: RGB(243, 57, 0), 0.1: RGB(236, 27, 60), 0.2: RGB(210, 0, 118), 0.3: RGB(103, 0, 120), 0.4: RGB(39, 72, 161), 0.6: RGB(18, 178, 90), 0.7: RGB(79, 186, 8), 0.8: RGB(220, 237, 32), 0.9: RGB(247, 159, 20), 1: RGB(243, 57, 0)])
gradient_5 = Gradient(
    LowerLimit=0,
    UpperLimit=1,
    Parameter=Slider(0.19, range=0..1),
    stops=[0: RGB(243, 57, 0), 0.1: RGB(236, 27, 60), 0.2: RGB(210, 0, 118), 0.3: RGB(103, 0, 120), 0.4: RGB(39, 72, 161), 0.6: RGB(18, 178, 90), 0.7: RGB(79, 186, 8), 0.8: RGB(220, 237, 32), 0.9: RGB(247, 159, 20), 1: RGB(243, 57, 0)])
gradient_6 = Gradient(LowerLimit=0, UpperLimit=1, Parameter=Slider(0.87, range=0..1), stops=[0.15: RGB(255, 130, 160), 0.85: RGB(220, 0, 40)])
gradient_7 = Gradient(
    LowerLimit=0,
    UpperLimit=1,
    Parameter=Slider(0.54, range=0..1),
    stops=[0: RGB(243, 57, 0), 0.1: RGB(236, 27, 60), 0.2: RGB(210, 0, 118), 0.3: RGB(103, 0, 120), 0.4: RGB(39, 72, 161), 0.6: RGB(18, 178, 90), 0.7: RGB(79, 186, 8), 0.8: RGB(220, 237, 32), 0.9: RGB(247, 159, 20), 1: RGB(243, 57, 0)])
gradient_8 = Gradient(LowerLimit=0, UpperLimit=1, Parameter=Slider(0.21, range=0..1), stops=[0.704: RGB(173, 203, 249), 1: RGB(75, 107, 169)])
gradient_9 = Gradient(LowerLimit=0, UpperLimit=1, Parameter=Slider(1, range=0..1), stops=[0.804: RGB(173, 203, 249), 1: RGB(75, 107, 169)])
gradient_10 = Gradient(
    LowerLimit=0,
    UpperLimit=1,
    Parameter=Slider(0.86, range=0..1),
    stops=[0: RGB(234, 38, 0), 0.25: RGB(234, 126, 0), 0.5: RGB(254, 244, 84), 0.75: RGB(173, 203, 249), 1: RGB(75, 107, 169)])
gradient_11 = Gradient(LowerLimit=0, UpperLimit=1, Parameter=Slider(0.97, range=0..1), stops=[0.704: RGB(173, 203, 249), 1: RGB(75, 107, 169)])
gradient_12 = Gradient(
    LowerLimit=0,
    UpperLimit=1,
    Parameter=Slider(0, range=0..1),
    stops=[0.131: RGB(31, 197, 237), 0.19: RGB(29, 247, 176), 0.85: RGB(220, 0, 40)])
gradient_13 = Gradient(
    LowerLimit=0,
    UpperLimit=1,
    Parameter=Slider(0.89, range=0..1),
    stops=[0: RGB(243, 57, 0), 0.1: RGB(236, 27, 60), 0.2: RGB(210, 0, 118), 0.3: RGB(103, 0, 120), 0.4: RGB(39, 72, 161), 0.6: RGB(18, 178, 90), 0.7: RGB(79, 186, 8), 0.8: RGB(220, 237, 32), 0.9: RGB(247, 159, 20), 1: RGB(243, 57, 0)])
gradient_14 = Gradient(LowerLimit=0, UpperLimit=1, Parameter=Slider(0.22, range=0..1), stops=[0.704: RGB(173, 203, 249), 1: RGB(75, 107, 169)])
custom_preview = CustomPreview(Geometry=explode_tree.Branch5, Material=gradient)
custom_preview_2 = CustomPreview(Geometry=explode_tree.Branch10, Material=gradient_2)
custom_preview_3 = CustomPreview(Geometry=explode_tree.Branch4, Material=gradient_6)
custom_preview_4 = CustomPreview(Geometry=explode_tree.Branch8, Material=gradient_3)
custom_preview_5 = CustomPreview(Geometry=explode_tree.Branch7, Material=gradient_4)
custom_preview_6 = CustomPreview(Geometry=explode_tree.Branch11, Material=gradient_5)
custom_preview_7 = CustomPreview(Geometry=explode_tree.Branch3, Material=gradient_7)
custom_preview_8 = CustomPreview(Geometry=explode_tree.Branch6, Material=gradient_8)
# rc
custom_preview_9 = CustomPreview(Geometry=explode_tree.Branch9, Material=gradient_9)
custom_preview_10 = CustomPreview(Geometry=explode_tree.Branch12, Material=gradient_10)
custom_preview_11 = CustomPreview(Geometry=explode_tree.Branch2, Material=gradient_11)
# rs
custom_preview_12 = CustomPreview(Geometry=explode_tree.Branch0, Material=gradient_12)
# Full multiplicity knots at start
# Simple knots
# Full multiplicity knots at end
# P1
# A=0.2*P1+ 0.8*P2
# D=0.2*A + 0.8*B
# P2
# B=0.47*P2 + 0.53*P3
# Full multiplicity knots at start
# E=0.7*B + 0.3*C
# P3
# Full multiplicity knots in the middle
# C=0.8*P3 + 0.2*P4
# P4
# Full multiplicity knots at end
# Compare knot spacing
# GH solution
# VB
# C#
# Python with RhinoCommon Only
# Pythong with RhinoScriptSyntax
# GH solution
# VB
# C#
# Python
# VB
custom_preview_13 = CustomPreview(Geometry=explode_tree.Branch15, Material=gradient_6)
custom_preview_14 = CustomPreview(Geometry=explode_tree.Branch14, Material=gradient_13)
custom_preview_15 = CustomPreview(Geometry=explode_tree.Branch13, Material=gradient_14)

# ==== cluster MyFavoriteTrig001
factor = ClusterInput()
pi = Pi(Factor=factor)
construct_domain = ConstructDomain(DomainStart=0, DomainEnd=pi)
steps = ClusterInput()
range = Range(Domain=construct_domain, Steps=steps)
factor_2 = ClusterInput()
pi_2 = Pi(Factor=factor_2)
cosine = Cosine(Value=range)
sine = Sine(Value=range)
B = ClusterInput()
B_2 = ClusterInput()
A = ClusterInput()
multiplication = Multiplication(A=sine, B=B)
multiplication_2 = Multiplication(A=cosine, B=B_2)
multiplication_3 = Multiplication(A=A, B=pi_2)
multiplication_4 = Multiplication(A=range, B=multiplication_3)
construct_point = ConstructPoint(XCoordinate=multiplication, YCoordinate=multiplication_2, ZCoordinate=multiplication_4)
interpolate = Interpolate(Vertices=construct_point, Degree=3, Periodic=False, KnotStyle=1)  # -> Curve, Length, Domain
curve = ClusterOutput(interpolate.Curve)
