# Grasshopper definition MathTrig050.gh (Grasshopper 1.0.7)
# Copyright: Wickerson Studios
# plug-ins: Bifocals

image_sampler = ImageSampler(
    FilePath="C:\Users\Sculpture\Documents\2020Grasshopper\ScreenShots2019\Screenshots2020\SurfaceEditAlgorithm.PNG",
    Filter="Value",
    Interpolate=False,
    Umax=1,
    Umin=0,
    Vmax=1,
    Vmin=0,
    Wrap=1)  # disabled

# ----
# Wickerson Studio
# created by: Michael Wickerson
# Grasshopper for Rhino 3D Algorithmic Modeling
# www.wickersonstudios.com
# www.michaelwickerson.com
# https://www.youtube.com/channel/UC7J48Ppcsa6oncp6d29R0xw
# https://github.com/mwickerson
# https://www.facebook.com/michael.wickerson
# https://www.linkedin.com/in/michael-wickerson-696a80156/
# https://www.grasshopper3d.com/profile/MichaelWickerson
right_trigonometry = RightTrigonometry()  # -> Alpha, Beta, PLength, QLength, RLength
triangle_trigonometry = TriangleTrigonometry()  # -> Alpha, Beta, Gamma, ALength, BLength, CLength
circumcentre = Circumcentre()  # -> Circumcentre, BisectorAB, BisectorBC, BisectorCA
centroid = Centroid()  # -> Centroid, MedianAB, MedianBC, MedianCA
incentre = Incentre()  # -> Incentre, BisectorA, BisectorB, BisectorC
orthocentre = Orthocentre()  # -> Orthocentre, AltitudeAB, AltitudeBC, AltitudeCA
# 1001 GRASSHOPPER DEFINITIONS
# Wickerson Studio
# 
# created by: Michael Wickerson
# 
# Grasshopper for Rhino 3D Algorithmic Modeling
# 
# www.wickersonstudios.com
# www.michaelwickerson.com
# https://www.youtube.com/channel/UC7J48Ppcsa6oncp6d29R0xw
# https://github.com/mwickerson
# https://www.facebook.com/michael.wickerson
# https://www.linkedin.com/in/michael-wickerson-696a80156/
# https://www.grasshopper3d.com/profile/MichaelWickerson
# MATH  TRIG 050/1001
degrees = Degrees()
radians = Radians()

ellipse = Ellipse(Plane=PlaneXY(0, 0, 0), Radius1=Slider(25, range=0..100), Radius2=Slider(7, range=0..100))  # -> Ellipse, Focus1, Focus2
number_slider = Slider(10, range=0..10)
number_slider_2 = Slider(5, range=0..10)
divide_curve = DivideCurve(Curve=ellipse.Ellipse, Count=3, Kinks=False)  # -> graft(Points), Tangents, Parameters
radians_2 = Radians(Degrees=Slider(90, range=0..180))
explode_tree = ExplodeTree(Data=divide_curve.Points)  # -> Branch0, Branch1, Branch2
right_trigonometry_2 = RightTrigonometry(Alpha=Slider(0.75, range=0..1), PLength=number_slider_2, QLength=number_slider)  # -> Alpha, Beta, PLength, QLength, RLength
triangle_trigonometry_2 = TriangleTrigonometry(Alpha=radians_2, BLength=number_slider_2, CLength=number_slider)  # -> Alpha, Beta, Gamma, ALength, BLength, CLength
centroid_2 = Centroid(PointA=explode_tree.Branch0, PointB=explode_tree.Branch1, PointC=explode_tree.Branch2)  # -> Centroid, MedianAB, MedianBC, MedianCA
orthocentre_2 = Orthocentre(PointA=explode_tree.Branch0, PointB=explode_tree.Branch1, PointC=explode_tree.Branch2)  # -> Orthocentre, AltitudeAB, AltitudeBC, AltitudeCA
circumcentre_2 = Circumcentre(PointA=explode_tree.Branch0, PointB=explode_tree.Branch1, PointC=explode_tree.Branch2)  # -> Circumcentre, BisectorAB, BisectorBC, BisectorCA
incentre_2 = Incentre(PointA=explode_tree.Branch0, PointB=explode_tree.Branch1, PointC=explode_tree.Branch2)  # -> Incentre, BisectorA, BisectorB, BisectorC
panel = Panel(right_trigonometry_2.Beta)
panel_2 = Panel(right_trigonometry_2.RLength)
panel_3 = Panel(triangle_trigonometry_2.ALength)
panel_4 = Panel(triangle_trigonometry_2.Beta)
panel_5 = Panel(triangle_trigonometry_2.Gamma)
panel_6 = Panel(triangle_trigonometry_2.Alpha)
panel_7 = Panel(triangle_trigonometry_2.CLength)
panel_8 = Panel(triangle_trigonometry_2.BLength)
point = Point(centroid_2.Centroid)
line = Line(centroid_2.MedianAB)
line_2 = Line(centroid_2.MedianBC)
line_3 = Line(centroid_2.MedianCA)
point_2 = Point(circumcentre_2.Circumcentre)
line_4 = Line(circumcentre_2.BisectorAB)
line_5 = Line(circumcentre_2.BisectorBC)
line_6 = Line(circumcentre_2.BisectorCA)
point_3 = Point(incentre_2.Incentre)
line_7 = Line(incentre_2.BisectorA)
line_8 = Line(incentre_2.BisectorB)
point_4 = Point(orthocentre_2.Orthocentre)
line_9 = Line(orthocentre_2.AltitudeAB)
line_10 = Line(orthocentre_2.AltitudeBC)
line_11 = Line(incentre_2.BisectorC)
line_12 = Line(orthocentre_2.AltitudeCA)
move = Move(Geometry=point_2, Motion=Vector(0, 0, 10))  # -> Geometry, Transform
move_2 = Move(Geometry=point, Motion=Vector(0, 0, 10))  # -> Geometry, Transform
move_3 = Move(Geometry=point_3, Motion=Vector(0, 0, 10))  # -> Geometry, Transform
move_4 = Move(Geometry=point_4, Motion=Vector(0, 0, 10))  # -> Geometry, Transform
line_13 = Line(StartPoint=move_3.Geometry, EndPoint=divide_curve.Points)  # -> flatten(Line)
line_14 = Line(StartPoint=move_4.Geometry, EndPoint=divide_curve.Points)  # -> flatten(Line)
line_15 = Line(StartPoint=move_2.Geometry, EndPoint=divide_curve.Points)  # -> flatten(Line)
line_16 = Line(StartPoint=move.Geometry, EndPoint=divide_curve.Points)  # -> flatten(Line)
loft = Loft(Curves=line_15, Options={Adjust=False, Closed=False, LoftEnds=0, LoftSimp=0, LoftType=0, Rebuild=10, Refit=0.01})
loft_2 = Loft(Curves=line_14, Options={Adjust=False, Closed=False, LoftEnds=0, LoftSimp=0, LoftType=0, Rebuild=10, Refit=0.01})
loft_3 = Loft(Curves=line_13, Options={Adjust=False, Closed=False, LoftEnds=0, LoftSimp=0, LoftType=0, Rebuild=10, Refit=0.01})
loft_4 = Loft(Curves=line_16, Options={Adjust=False, Closed=False, LoftEnds=0, LoftSimp=0, LoftType=0, Rebuild=10, Refit=0.01})
merge = Merge(Data1=loft, Data2=loft_4, Data3=loft_3, Data4=loft_2)
list_length = ListLength(List=merge)
range = Range(Domain=Slider(1.07, range=0..2), Steps=expr("x-1", list_length))
merge_2 = Merge(Data1=centroid_2.Centroid, Data2=circumcentre_2.Circumcentre, Data3=incentre_2.Incentre, Data4=orthocentre_2.Orthocentre)
pi = Pi(Factor=range)
range_2 = Range(Domain=Slider(48, range=0..100), Steps=expr("x-1", list_length))
rotate_3d = Rotate3D(Geometry=merge, Angle=pi, Center=merge_2, Axis=Vector(0, 0, 1))  # -> flatten(Geometry), Transform
unit_z = UnitZ(Factor=range_2)
move_5 = Move(Geometry=rotate_3d.Geometry, Motion=unit_z)  # -> flatten(Geometry), Transform
surface = Surface(graft(move_5.Geometry))
number_slider_3 = Slider(1, range=0..10)
deconstruct_brep = DeconstructBrep(Brep=surface)  # -> Faces, Edges, flatten(Vertices)
point_5 = Point(deconstruct_brep.Vertices)
list_item = ListItem(List=deconstruct_brep.Vertices, Index=0, Wrap=True)
interpolate = Interpolate(Vertices=point_5, Degree=3, Periodic=False, KnotStyle=1)  # -> Curve, Length, Domain
divide_surface = DivideSurface(Surface=surface, UCount=number_slider_3, VCount=number_slider_3)  # -> Points, Normals, Parameters
range_3 = Range(Domain=Domain(0, 1), Steps=10)
graph_mapper = GraphMapper(
    range_3,
    x0=0,
    x1=1,
    y0=0,
    y1=1,
    container_name="Sine Summation",
    Equation0_px=[0.2, 0.3730433285],
    Equation0_py=[0.2, 0.8197092414],
    Equation1_px=[0.5307263136, 0.9],
    Equation1_py=[0.05594182014, 0.5])
vector_display = VectorDisplay(Anchor=divide_surface.Points, Vector=divide_surface.Normals)
negative = Negative(Value=divide_surface.Normals)
amplitude = Amplitude(Vector=negative, Amplitude=Slider(0.668, range=0..10))
extrude = Extrude(Base=surface, Direction=amplitude)  # -> flatten(Extrusion)
list_length_2 = ListLength(List=extrude)
range_4 = Range(Domain=Slider(2, range=0..2), Steps=expr("x-1", list_length_2))
pi_2 = Pi(Factor=range_4)
rotate_3d_2 = Rotate3D(Geometry=extrude, Angle=pi_2, Center=list_item, Axis=Vector(0, 0, 1))  # -> Geometry, Transform
pipe_variable = PipeVariable(Curve=reparameterize(interpolate.Curve), Parameters=range_3, Radii=graph_mapper, Caps=2)

number_slider_4 = Slider(2, range=0..10)  # disabled
number_slider_5 = Slider(156, range=0..1000)  # disabled
number_slider_6 = Slider(12, range=0..100)  # disabled
extremes = Extremes(A=number_slider_4, B=number_slider_6, C=number_slider_5)  # -> Mininum, Maximum; disabled
maximum = Maximum(A=number_slider_6, B=number_slider_5)  # disabled
minimum = Minimum(A=number_slider_6, B=number_slider_5)  # disabled
panel_11 = Panel(extremes.Mininum)  # disabled
panel_12 = Panel(extremes.Maximum)  # disabled
panel_13 = Panel(maximum)  # disabled
panel_14 = Panel(minimum)  # disabled

number_slider_7 = Slider(1, range=0..1)  # disabled
number_slider_8 = Slider(2, range=0..10)  # disabled
number_slider_9 = Slider(122, range=0..1000)  # disabled
number_slider_10 = Slider(12, range=0..100)  # disabled
number_slider_11 = Slider(51, range=0..100)  # disabled
number_slider_12 = Slider(0.36, range=0..1)  # disabled
number_slider_13 = Slider(2, range=0..10)  # disabled
number_slider_14 = Slider(0.43, range=0..1)  # disabled
boolean_toggle = BooleanToggle(True)  # disabled
boolean_toggle_2 = BooleanToggle(False)  # disabled
number_slider_15 = Slider(0.6, range=0..1)  # disabled
merge_3 = Merge(Data1=number_slider_7, Data2=number_slider_8, Data3=number_slider_10, Data4=number_slider_9)  # disabled
range_5 = Range(Domain=merge_3, Steps=number_slider_11)  # disabled
average = Average(Input=merge_3)  # disabled
truncate = Truncate(Input=range_5, TruncationFactor=number_slider_15)  # -> flatten(Result); disabled
blur_numbers = BlurNumbers(Numbers=merge_3, Strength=number_slider_12, Iterations=number_slider_13, Lock=boolean_toggle, Wrap=boolean_toggle_2)  # disabled
smooth_numbers = SmoothNumbers(Numbers=merge_3, SmoothDelay=2000)  # disabled
interpolate_data = InterpolateData(Data=merge_3, Parameter=number_slider_14, Interpolation=2)  # disabled
panel_15 = Panel(average)  # disabled
panel_16 = Panel(blur_numbers)  # disabled
panel_17 = Panel(interpolate_data)  # disabled
panel_18 = Panel(smooth_numbers)  # disabled
panel_19 = Panel(truncate)  # disabled
param_viewer = ParamViewer(panel_19)  # disabled

number_slider_16 = Slider(243.377, range=0..1000)  # disabled
round = Round(Number=number_slider_16)  # -> Nearest, Floor, Ceiling; disabled
panel_20 = Panel(round.Nearest)  # disabled
panel_21 = Panel(round.Floor)  # disabled
panel_22 = Panel(round.Ceiling)  # disabled

epsilon = Epsilon(Factor=1)  # disabled
natural_logarithm = NaturalLogarithm(Factor=1)  # disabled
golden_ratio = GoldenRatio(Factor=1)  # disabled
pi_3 = Pi(Factor=1)  # disabled
merge_4 = Merge(Data1=epsilon, Data2=golden_ratio, Data3=natural_logarithm, Data4=pi_3)  # disabled
panel_23 = Panel(merge_4)  # disabled

list_length_3 = ListLength(List=truncate)  # disabled
panel_24 = Panel(list_length_3)  # disabled
explode_tree_2 = ExplodeTree()  # -> Branch0, Branch1, Branch2, Branch3, Branch4, Branch5, Branch6, Branch7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
gradient = Gradient(
    LowerLimit=0,
    UpperLimit=1,
    Parameter=Slider(0.12, range=0..1),
    stops=[0: RGB(234, 38, 0), 0.25: RGB(234, 126, 0), 0.5: RGB(254, 244, 84), 0.75: RGB(173, 203, 249), 1: RGB(75, 107, 169)])
gradient_2 = Gradient(
    LowerLimit=0,
    UpperLimit=1,
    Parameter=Slider(0.66, range=0..1),
    stops=[0: RGB(234, 38, 0), 0.25: RGB(234, 126, 0), 0.5: RGB(254, 244, 84), 0.75: RGB(173, 203, 249), 1: RGB(75, 107, 169)])
gradient_3 = Gradient(LowerLimit=0, UpperLimit=1, Parameter=Slider(0.02, range=0..1), stops=[0.15: RGB(255, 130, 160), 0.85: RGB(220, 0, 40)])
gradient_4 = Gradient(
    LowerLimit=0,
    UpperLimit=1,
    Parameter=Slider(0.84, range=0..1),
    stops=[0: RGB(243, 57, 0), 0.1: RGB(236, 27, 60), 0.2: RGB(210, 0, 118), 0.3: RGB(103, 0, 120), 0.4: RGB(39, 72, 161), 0.6: RGB(18, 178, 90), 0.7: RGB(79, 186, 8), 0.8: RGB(220, 237, 32), 0.9: RGB(247, 159, 20), 1: RGB(243, 57, 0)])
gradient_5 = Gradient(
    LowerLimit=0,
    UpperLimit=1,
    Parameter=Slider(0.19, range=0..1),
    stops=[0: RGB(243, 57, 0), 0.1: RGB(236, 27, 60), 0.2: RGB(210, 0, 118), 0.3: RGB(103, 0, 120), 0.4: RGB(39, 72, 161), 0.6: RGB(18, 178, 90), 0.7: RGB(79, 186, 8), 0.8: RGB(220, 237, 32), 0.9: RGB(247, 159, 20), 1: RGB(243, 57, 0)])
gradient_6 = Gradient(LowerLimit=0, UpperLimit=1, Parameter=Slider(0.87, range=0..1), stops=[0.15: RGB(255, 130, 160), 0.85: RGB(220, 0, 40)])
gradient_7 = Gradient(
    LowerLimit=0,
    UpperLimit=1,
    Parameter=Slider(0.54, range=0..1),
    stops=[0: RGB(243, 57, 0), 0.1: RGB(236, 27, 60), 0.2: RGB(210, 0, 118), 0.3: RGB(103, 0, 120), 0.4: RGB(39, 72, 161), 0.6: RGB(18, 178, 90), 0.7: RGB(79, 186, 8), 0.8: RGB(220, 237, 32), 0.9: RGB(247, 159, 20), 1: RGB(243, 57, 0)])
gradient_8 = Gradient(LowerLimit=0, UpperLimit=1, Parameter=Slider(0.21, range=0..1), stops=[0.704: RGB(173, 203, 249), 1: RGB(75, 107, 169)])
gradient_9 = Gradient(LowerLimit=0, UpperLimit=1, Parameter=Slider(1, range=0..1), stops=[0.804: RGB(173, 203, 249), 1: RGB(75, 107, 169)])
gradient_10 = Gradient(
    LowerLimit=0,
    UpperLimit=1,
    Parameter=Slider(0.86, range=0..1),
    stops=[0: RGB(234, 38, 0), 0.25: RGB(234, 126, 0), 0.5: RGB(254, 244, 84), 0.75: RGB(173, 203, 249), 1: RGB(75, 107, 169)])
gradient_11 = Gradient(LowerLimit=0, UpperLimit=1, Parameter=Slider(0.97, range=0..1), stops=[0.704: RGB(173, 203, 249), 1: RGB(75, 107, 169)])
gradient_12 = Gradient(
    LowerLimit=0,
    UpperLimit=1,
    Parameter=Slider(0, range=0..1),
    stops=[0.131: RGB(31, 197, 237), 0.19: RGB(29, 247, 176), 0.85: RGB(220, 0, 40)])
gradient_13 = Gradient(
    LowerLimit=0,
    UpperLimit=1,
    Parameter=Slider(0.89, range=0..1),
    stops=[0: RGB(243, 57, 0), 0.1: RGB(236, 27, 60), 0.2: RGB(210, 0, 118), 0.3: RGB(103, 0, 120), 0.4: RGB(39, 72, 161), 0.6: RGB(18, 178, 90), 0.7: RGB(79, 186, 8), 0.8: RGB(220, 237, 32), 0.9: RGB(247, 159, 20), 1: RGB(243, 57, 0)])
gradient_14 = Gradient(LowerLimit=0, UpperLimit=1, Parameter=Slider(0.22, range=0..1), stops=[0.704: RGB(173, 203, 249), 1: RGB(75, 107, 169)])
custom_preview = CustomPreview(Geometry=explode_tree_2.Branch5, Material=gradient)
custom_preview_2 = CustomPreview(Geometry=explode_tree_2.Branch10, Material=gradient_2)
custom_preview_3 = CustomPreview(Geometry=explode_tree_2.Branch4, Material=gradient_6)
custom_preview_4 = CustomPreview(Geometry=explode_tree_2.Branch8, Material=gradient_3)
custom_preview_5 = CustomPreview(Geometry=explode_tree_2.Branch7, Material=gradient_4)
custom_preview_6 = CustomPreview(Geometry=explode_tree_2.Branch11, Material=gradient_5)
custom_preview_7 = CustomPreview(Geometry=explode_tree_2.Branch3, Material=gradient_7)
custom_preview_8 = CustomPreview(Geometry=explode_tree_2.Branch6, Material=gradient_8)
# rc
custom_preview_9 = CustomPreview(Geometry=explode_tree_2.Branch9, Material=gradient_9)
custom_preview_10 = CustomPreview(Geometry=explode_tree_2.Branch12, Material=gradient_10)
custom_preview_11 = CustomPreview(Geometry=explode_tree_2.Branch2, Material=gradient_11)
# rs
custom_preview_12 = CustomPreview(Geometry=explode_tree_2.Branch0, Material=gradient_12)
# Full multiplicity knots at start
# Simple knots
# Full multiplicity knots at end
# P1
# A=0.2*P1+ 0.8*P2
# D=0.2*A + 0.8*B
# P2
# B=0.47*P2 + 0.53*P3
# Full multiplicity knots at start
# E=0.7*B + 0.3*C
# P3
# Full multiplicity knots in the middle
# C=0.8*P3 + 0.2*P4
# P4
# Full multiplicity knots at end
# Compare knot spacing
# GH solution
# VB
# C#
# Python with RhinoCommon Only
# Pythong with RhinoScriptSyntax
# GH solution
# VB
# C#
# Python
# VB
custom_preview_13 = CustomPreview(Geometry=explode_tree_2.Branch15, Material=gradient_6)
custom_preview_14 = CustomPreview(Geometry=explode_tree_2.Branch14, Material=gradient_13)
custom_preview_15 = CustomPreview(Geometry=explode_tree_2.Branch13, Material=gradient_14)
