# Grasshopper definition MathTrig051.gh (Grasshopper 1.0.7)
# Copyright: Wickerson Studios
# plug-ins: Bifocals

image_sampler = ImageSampler(
    FilePath="C:\Users\Sculpture\Documents\2020Grasshopper\ScreenShots2019\Screenshots2020\SurfaceEditAlgorithm.PNG",
    Filter="Value",
    Interpolate=False,
    Umax=1,
    Umin=0,
    Vmax=1,
    Vmin=0,
    Wrap=1)  # disabled

# ----
# 1001 GRASSHOPPER DEFINITIONS
# Wickerson Studio
# 
# created by: Michael Wickerson
# 
# Grasshopper for Rhino 3D Algorithmic Modeling
# 
# www.wickersonstudios.com
# www.michaelwickerson.com
# https://www.youtube.com/channel/UC7J48Ppcsa6oncp6d29R0xw
# https://github.com/mwickerson
# https://www.facebook.com/michael.wickerson
# https://www.linkedin.com/in/michael-wickerson-696a80156/
# https://www.grasshopper3d.com/profile/MichaelWickerson
golden_ratio = GoldenRatio(Factor=1)
# Wickerson Studio
# created by: Michael Wickerson
# Grasshopper for Rhino 3D Algorithmic Modeling
# www.wickersonstudios.com
# www.michaelwickerson.com
# https://www.youtube.com/channel/UC7J48Ppcsa6oncp6d29R0xw
# https://github.com/mwickerson
# https://www.facebook.com/michael.wickerson
# https://www.linkedin.com/in/michael-wickerson-696a80156/
# https://www.grasshopper3d.com/profile/MichaelWickerson
natural_logarithm = NaturalLogarithm(Factor=1)
pi = Pi(Factor=1)
epsilon = Epsilon(Factor=1)

number_slider = Slider(2, range=0..10)  # disabled
number_slider_2 = Slider(156, range=0..1000)  # disabled
number_slider_3 = Slider(12, range=0..100)  # disabled
extremes = Extremes(A=number_slider, B=number_slider_3, C=number_slider_2)  # -> Mininum, Maximum; disabled
maximum = Maximum(A=number_slider_3, B=number_slider_2)  # disabled
minimum = Minimum(A=number_slider_3, B=number_slider_2)  # disabled
panel = Panel(extremes.Mininum)  # disabled
panel_2 = Panel(extremes.Maximum)  # disabled
panel_3 = Panel(maximum)  # disabled
panel_4 = Panel(minimum)  # disabled

number_slider_4 = Slider(1, range=0..1)  # disabled
number_slider_5 = Slider(2, range=0..10)  # disabled
number_slider_6 = Slider(122, range=0..1000)  # disabled
number_slider_7 = Slider(12, range=0..100)  # disabled
number_slider_8 = Slider(51, range=0..100)  # disabled
number_slider_9 = Slider(0.36, range=0..1)  # disabled
number_slider_10 = Slider(2, range=0..10)  # disabled
number_slider_11 = Slider(0.43, range=0..1)  # disabled
boolean_toggle = BooleanToggle(True)  # disabled
boolean_toggle_2 = BooleanToggle(False)  # disabled
number_slider_12 = Slider(0.6, range=0..1)  # disabled
merge = Merge(Data1=number_slider_4, Data2=number_slider_5, Data3=number_slider_7, Data4=number_slider_6)  # disabled
range = Range(Domain=merge, Steps=number_slider_8)  # disabled
average = Average(Input=merge)  # disabled
truncate = Truncate(Input=range, TruncationFactor=number_slider_12)  # -> flatten(Result); disabled
blur_numbers = BlurNumbers(Numbers=merge, Strength=number_slider_9, Iterations=number_slider_10, Lock=boolean_toggle, Wrap=boolean_toggle_2)  # disabled
smooth_numbers = SmoothNumbers(Numbers=merge, SmoothDelay=2000)  # disabled
interpolate_data = InterpolateData(Data=merge, Parameter=number_slider_11, Interpolation=2)  # disabled
panel_5 = Panel(average)  # disabled
panel_6 = Panel(blur_numbers)  # disabled
panel_7 = Panel(interpolate_data)  # disabled
panel_8 = Panel(smooth_numbers)  # disabled
panel_9 = Panel(truncate)  # disabled
param_viewer = ParamViewer(panel_9)  # disabled

number_slider_13 = Slider(243.377, range=0..1000)  # disabled
round = Round(Number=number_slider_13)  # -> Nearest, Floor, Ceiling; disabled
panel_10 = Panel(round.Nearest)  # disabled
panel_11 = Panel(round.Floor)  # disabled
panel_12 = Panel(round.Ceiling)  # disabled

epsilon_2 = Epsilon(Factor=1)  # disabled
natural_logarithm_2 = NaturalLogarithm(Factor=1)  # disabled
golden_ratio_2 = GoldenRatio(Factor=1)  # disabled
pi_2 = Pi(Factor=1)  # disabled
merge_2 = Merge(Data1=epsilon_2, Data2=golden_ratio_2, Data3=natural_logarithm_2, Data4=pi_2)  # disabled
panel_13 = Panel(merge_2)  # disabled

list_length = ListLength(List=truncate)  # disabled
panel_14 = Panel(list_length)  # disabled
explode_tree = ExplodeTree()  # -> Branch0, Branch1, Branch2, Branch3, Branch4, Branch5, Branch6, Branch7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
gradient = Gradient(
    LowerLimit=0,
    UpperLimit=1,
    Parameter=Slider(0.12, range=0..1),
    stops=[0: RGB(234, 38, 0), 0.25: RGB(234, 126, 0), 0.5: RGB(254, 244, 84), 0.75: RGB(173, 203, 249), 1: RGB(75, 107, 169)])
gradient_2 = Gradient(
    LowerLimit=0,
    UpperLimit=1,
    Parameter=Slider(0.66, range=0..1),
    stops=[0: RGB(234, 38, 0), 0.25: RGB(234, 126, 0), 0.5: RGB(254, 244, 84), 0.75: RGB(173, 203, 249), 1: RGB(75, 107, 169)])
gradient_3 = Gradient(LowerLimit=0, UpperLimit=1, Parameter=Slider(0.02, range=0..1), stops=[0.15: RGB(255, 130, 160), 0.85: RGB(220, 0, 40)])
gradient_4 = Gradient(
    LowerLimit=0,
    UpperLimit=1,
    Parameter=Slider(0.84, range=0..1),
    stops=[0: RGB(243, 57, 0), 0.1: RGB(236, 27, 60), 0.2: RGB(210, 0, 118), 0.3: RGB(103, 0, 120), 0.4: RGB(39, 72, 161), 0.6: RGB(18, 178, 90), 0.7: RGB(79, 186, 8), 0.8: RGB(220, 237, 32), 0.9: RGB(247, 159, 20), 1: RGB(243, 57, 0)])
gradient_5 = Gradient(
    LowerLimit=0,
    UpperLimit=1,
    Parameter=Slider(0.19, range=0..1),
    stops=[0: RGB(243, 57, 0), 0.1: RGB(236, 27, 60), 0.2: RGB(210, 0, 118), 0.3: RGB(103, 0, 120), 0.4: RGB(39, 72, 161), 0.6: RGB(18, 178, 90), 0.7: RGB(79, 186, 8), 0.8: RGB(220, 237, 32), 0.9: RGB(247, 159, 20), 1: RGB(243, 57, 0)])
gradient_6 = Gradient(LowerLimit=0, UpperLimit=1, Parameter=Slider(0.87, range=0..1), stops=[0.15: RGB(255, 130, 160), 0.85: RGB(220, 0, 40)])
gradient_7 = Gradient(
    LowerLimit=0,
    UpperLimit=1,
    Parameter=Slider(0.54, range=0..1),
    stops=[0: RGB(243, 57, 0), 0.1: RGB(236, 27, 60), 0.2: RGB(210, 0, 118), 0.3: RGB(103, 0, 120), 0.4: RGB(39, 72, 161), 0.6: RGB(18, 178, 90), 0.7: RGB(79, 186, 8), 0.8: RGB(220, 237, 32), 0.9: RGB(247, 159, 20), 1: RGB(243, 57, 0)])
gradient_8 = Gradient(LowerLimit=0, UpperLimit=1, Parameter=Slider(0.21, range=0..1), stops=[0.704: RGB(173, 203, 249), 1: RGB(75, 107, 169)])
gradient_9 = Gradient(LowerLimit=0, UpperLimit=1, Parameter=Slider(1, range=0..1), stops=[0.804: RGB(173, 203, 249), 1: RGB(75, 107, 169)])
gradient_10 = Gradient(
    LowerLimit=0,
    UpperLimit=1,
    Parameter=Slider(0.86, range=0..1),
    stops=[0: RGB(234, 38, 0), 0.25: RGB(234, 126, 0), 0.5: RGB(254, 244, 84), 0.75: RGB(173, 203, 249), 1: RGB(75, 107, 169)])
gradient_11 = Gradient(LowerLimit=0, UpperLimit=1, Parameter=Slider(0.97, range=0..1), stops=[0.704: RGB(173, 203, 249), 1: RGB(75, 107, 169)])
gradient_12 = Gradient(
    LowerLimit=0,
    UpperLimit=1,
    Parameter=Slider(0, range=0..1),
    stops=[0.131: RGB(31, 197, 237), 0.19: RGB(29, 247, 176), 0.85: RGB(220, 0, 40)])
gradient_13 = Gradient(
    LowerLimit=0,
    UpperLimit=1,
    Parameter=Slider(0.89, range=0..1),
    stops=[0: RGB(243, 57, 0), 0.1: RGB(236, 27, 60), 0.2: RGB(210, 0, 118), 0.3: RGB(103, 0, 120), 0.4: RGB(39, 72, 161), 0.6: RGB(18, 178, 90), 0.7: RGB(79, 186, 8), 0.8: RGB(220, 237, 32), 0.9: RGB(247, 159, 20), 1: RGB(243, 57, 0)])
gradient_14 = Gradient(LowerLimit=0, UpperLimit=1, Parameter=Slider(0.22, range=0..1), stops=[0.704: RGB(173, 203, 249), 1: RGB(75, 107, 169)])
custom_preview = CustomPreview(Geometry=explode_tree.Branch5, Material=gradient)
custom_preview_2 = CustomPreview(Geometry=explode_tree.Branch10, Material=gradient_2)
custom_preview_3 = CustomPreview(Geometry=explode_tree.Branch4, Material=gradient_6)
custom_preview_4 = CustomPreview(Geometry=explode_tree.Branch8, Material=gradient_3)
custom_preview_5 = CustomPreview(Geometry=explode_tree.Branch7, Material=gradient_4)
custom_preview_6 = CustomPreview(Geometry=explode_tree.Branch11, Material=gradient_5)
custom_preview_7 = CustomPreview(Geometry=explode_tree.Branch3, Material=gradient_7)
custom_preview_8 = CustomPreview(Geometry=explode_tree.Branch6, Material=gradient_8)
# rc
custom_preview_9 = CustomPreview(Geometry=explode_tree.Branch9, Material=gradient_9)
custom_preview_10 = CustomPreview(Geometry=explode_tree.Branch12, Material=gradient_10)
custom_preview_11 = CustomPreview(Geometry=explode_tree.Branch2, Material=gradient_11)
# rs
custom_preview_12 = CustomPreview(Geometry=explode_tree.Branch0, Material=gradient_12)
# Full multiplicity knots at start
# Simple knots
# Full multiplicity knots at end
# P1
# A=0.2*P1+ 0.8*P2
# D=0.2*A + 0.8*B
# P2
# B=0.47*P2 + 0.53*P3
# Full multiplicity knots at start
# E=0.7*B + 0.3*C
# P3
# Full multiplicity knots in the middle
# C=0.8*P3 + 0.2*P4
# P4
# Full multiplicity knots at end
# Compare knot spacing
# GH solution
# VB
# C#
# Python with RhinoCommon Only
# Pythong with RhinoScriptSyntax
# GH solution
# VB
# C#
# Python
# VB
custom_preview_13 = CustomPreview(Geometry=explode_tree.Branch15, Material=gradient_6)
custom_preview_14 = CustomPreview(Geometry=explode_tree.Branch14, Material=gradient_13)
custom_preview_15 = CustomPreview(Geometry=explode_tree.Branch13, Material=gradient_14)

golden_ratio_3 = GoldenRatio(Factor=1)
natural_logarithm_3 = NaturalLogarithm(Factor=1)
pi_3 = Pi(Factor=1)
# MATH  UTILITIES 051/1001
circle = Circle(Plane=PlaneXY(0, 0, 0), Radius=1)
construct_point = ConstructPoint(XCoordinate=0, YCoordinate=0, ZCoordinate=0)
scale = Scale(Geometry=circle, Center=Point(0, 0, 0), Factor=pi_3)  # -> Geometry, Transform
scale_2 = Scale(Geometry=circle, Center=Point(0, 0, 0), Factor=golden_ratio_3)  # -> Geometry, Transform
scale_3 = Scale(Geometry=circle, Center=Point(0, 0, 0), Factor=natural_logarithm_3)  # -> Geometry, Transform
divide_curve = DivideCurve(Curve=scale.Geometry, Count=10, Kinks=False)  # -> Points, Tangents, Parameters
divide_curve_2 = DivideCurve(Curve=scale_3.Geometry, Count=10, Kinks=False)  # -> Points, Tangents, Parameters
divide_curve_3 = DivideCurve(Curve=scale_2.Geometry, Count=10, Kinks=False)  # -> Points, Tangents, Parameters
pi_4 = Pi(Factor=1)
multiplication = Multiplication(A=pi_4, B=natural_logarithm_3)
multiplication_2 = Multiplication(A=pi_4, B=pi_3)
multiplication_3 = Multiplication(A=pi_4, B=golden_ratio_3)
rotate_3d = Rotate3D(Geometry=divide_curve_3.Points, Angle=multiplication_3, Center=Point(0, 0, 0), Axis=Vector(0, 0, 1))  # -> graft(Geometry), Transform
rotate_3d_2 = Rotate3D(Geometry=divide_curve_2.Points, Angle=multiplication, Center=Point(0, 0, 0), Axis=Vector(0, 0, 1))  # -> graft(Geometry), Transform
rotate_3d_3 = Rotate3D(Geometry=divide_curve.Points, Angle=multiplication_2, Center=Point(0, 0, 0), Axis=Vector(0, 0, 1))  # -> graft(Geometry), Transform
merge_3 = Merge(Data1=rotate_3d.Geometry, Data2=rotate_3d_2.Geometry, Data3=rotate_3d_3.Geometry)
number_slider_14 = Slider(10, range=0..10)
interpolate = Interpolate(Vertices=merge_3, Degree=3, Periodic=Toggle(False), KnotStyle=1)  # -> flatten(Curve), Length, Domain
list_length_2 = ListLength(List=interpolate.Curve)
range_2 = Range(Domain=number_slider_14, Steps=expr("x-1", list_length_2))
range_3 = Range(Domain=number_slider_14, Steps=expr("x-1", list_length_2))
unit_z = UnitZ(Factor=range_2)
move = Move(Geometry=interpolate.Curve, Motion=unit_z)  # -> Geometry, Transform
unit_z_2 = UnitZ(Factor=range_3)
move_2 = Move(Geometry=scale.Geometry, Motion=unit_z_2)  # -> Geometry, Transform
loft = Loft(Curves=move.Geometry, Options={Adjust=False, Closed=False, LoftEnds=0, LoftSimp=0, LoftType=0, Rebuild=10, Refit=0.01})
pipe = Pipe(Curve=move_2.Geometry, Radius=Slider(0.05, range=0..1), Caps=0)
surface = Surface(loft)
construct_domain = ConstructDomain(UMin=0, UMax=Slider(0.603, range=0..1), VMin=0, VMax=Slider(0.377, range=0..1))
isotrim = Isotrim(Surface=reparameterize(surface), Domain=construct_domain)
deconstruct_brep = DeconstructBrep(Brep=isotrim)  # -> Faces, Edges, Vertices
list_item = ListItem(List=deconstruct_brep.Vertices, Index=Slider(2, range=0..10), Wrap=True)

surface_closest_point = SurfaceClosestPoint(Point=list_item, Surface=surface)  # -> Point, UVPoint, Distance
evaluate_surface = EvaluateSurface(Surface=surface, Point=surface_closest_point.UVPoint)  # -> Point, Normal, UDirection, VDirection, Frame

amplitude = Amplitude(Vector=evaluate_surface.Normal, Amplitude=Slider(22, range=0..100))
multiplication_4 = Multiplication(A=evaluate_surface.Normal, B=Slider(0.477, range=0..10))
vector_display = VectorDisplay(Anchor=evaluate_surface.Point, Vector=amplitude)
extrude = Extrude(Base=surface, Direction=multiplication_4)
