# Grasshopper definition MathTrig052.gh (Grasshopper 1.0.7)
# Copyright: Wickerson Studios
# plug-ins: Bifocals

# 1001 GRASSHOPPER DEFINITIONS
# Wickerson Studio
# 
# created by: Michael Wickerson
# 
# Grasshopper for Rhino 3D Algorithmic Modeling
# 
# www.wickersonstudios.com
# www.michaelwickerson.com
# https://www.youtube.com/channel/UC7J48Ppcsa6oncp6d29R0xw
# https://github.com/mwickerson
# https://www.facebook.com/michael.wickerson
# https://www.linkedin.com/in/michael-wickerson-696a80156/
# https://www.grasshopper3d.com/profile/MichaelWickerson
image_sampler = ImageSampler(
    FilePath="C:\Users\Sculpture\Documents\2020Grasshopper\ScreenShots2019\Screenshots2020\SurfaceEditAlgorithm.PNG",
    Filter="Value",
    Interpolate=False,
    Umax=1,
    Umin=0,
    Vmax=1,
    Vmin=0,
    Wrap=1)

round = Round()  # -> Nearest, Floor, Ceiling
# MATH  UTILITIES 052/1001
# Wickerson Studio
# created by: Michael Wickerson
# Grasshopper for Rhino 3D Algorithmic Modeling
# www.wickersonstudios.com
# www.michaelwickerson.com
# https://www.youtube.com/channel/UC7J48Ppcsa6oncp6d29R0xw
# https://github.com/mwickerson
# https://www.facebook.com/michael.wickerson
# https://www.linkedin.com/in/michael-wickerson-696a80156/
# https://www.grasshopper3d.com/profile/MichaelWickerson
extremes = Extremes()  # -> Mininum, Maximum
maximum = Maximum()
minimum = Minimum()

number_slider = Slider(2, range=0..10)  # disabled
number_slider_2 = Slider(156, range=0..1000)  # disabled
number_slider_3 = Slider(12, range=0..100)  # disabled
extremes_2 = Extremes(A=number_slider, B=number_slider_3, C=number_slider_2)  # -> Mininum, Maximum; disabled
maximum_2 = Maximum(A=number_slider_3, B=number_slider_2)  # disabled
minimum_2 = Minimum(A=number_slider_3, B=number_slider_2)  # disabled
panel = Panel(extremes_2.Mininum)  # disabled
panel_2 = Panel(extremes_2.Maximum)  # disabled
panel_3 = Panel(maximum_2)  # disabled
panel_4 = Panel(minimum_2)  # disabled

number_slider_4 = Slider(1, range=0..1)  # disabled
number_slider_5 = Slider(2, range=0..10)  # disabled
number_slider_6 = Slider(122, range=0..1000)  # disabled
number_slider_7 = Slider(12, range=0..100)  # disabled
number_slider_8 = Slider(51, range=0..100)  # disabled
number_slider_9 = Slider(0.36, range=0..1)  # disabled
number_slider_10 = Slider(2, range=0..10)  # disabled
number_slider_11 = Slider(0.43, range=0..1)  # disabled
boolean_toggle = BooleanToggle(True)  # disabled
boolean_toggle_2 = BooleanToggle(False)  # disabled
number_slider_12 = Slider(0.6, range=0..1)  # disabled
merge = Merge(Data1=number_slider_4, Data2=number_slider_5, Data3=number_slider_7, Data4=number_slider_6)  # disabled
range = Range(Domain=merge, Steps=number_slider_8)  # disabled
average = Average(Input=merge)  # disabled
truncate = Truncate(Input=range, TruncationFactor=number_slider_12)  # -> flatten(Result); disabled
blur_numbers = BlurNumbers(Numbers=merge, Strength=number_slider_9, Iterations=number_slider_10, Lock=boolean_toggle, Wrap=boolean_toggle_2)  # disabled
smooth_numbers = SmoothNumbers(Numbers=merge, SmoothDelay=2000)  # disabled
interpolate_data = InterpolateData(Data=merge, Parameter=number_slider_11, Interpolation=2)  # disabled
panel_5 = Panel(average)  # disabled
panel_6 = Panel(blur_numbers)  # disabled
panel_7 = Panel(interpolate_data)  # disabled
panel_8 = Panel(smooth_numbers)  # disabled
panel_9 = Panel(truncate)  # disabled
param_viewer = ParamViewer(panel_9)  # disabled

number_slider_13 = Slider(243.377, range=0..1000)  # disabled
round_2 = Round(Number=number_slider_13)  # -> Nearest, Floor, Ceiling; disabled
panel_10 = Panel(round_2.Nearest)  # disabled
panel_11 = Panel(round_2.Floor)  # disabled
panel_12 = Panel(round_2.Ceiling)  # disabled

epsilon = Epsilon(Factor=1)  # disabled
natural_logarithm = NaturalLogarithm(Factor=1)  # disabled
golden_ratio = GoldenRatio(Factor=1)  # disabled
pi = Pi(Factor=1)  # disabled
merge_2 = Merge(Data1=epsilon, Data2=golden_ratio, Data3=natural_logarithm, Data4=pi)  # disabled
panel_13 = Panel(merge_2)  # disabled

list_length = ListLength(List=truncate)  # disabled
panel_14 = Panel(list_length)  # disabled
gradient = Gradient(
    LowerLimit=0,
    UpperLimit=1,
    Parameter=Slider(0.12, range=0..1),
    stops=[0: RGB(234, 38, 0), 0.25: RGB(234, 126, 0), 0.5: RGB(254, 244, 84), 0.75: RGB(173, 203, 249), 1: RGB(75, 107, 169)])
gradient_2 = Gradient(
    LowerLimit=0,
    UpperLimit=1,
    Parameter=Slider(0.66, range=0..1),
    stops=[0: RGB(234, 38, 0), 0.25: RGB(234, 126, 0), 0.5: RGB(254, 244, 84), 0.75: RGB(173, 203, 249), 1: RGB(75, 107, 169)])
gradient_3 = Gradient(LowerLimit=0, UpperLimit=1, Parameter=Slider(0.02, range=0..1), stops=[0.15: RGB(255, 130, 160), 0.85: RGB(220, 0, 40)])
gradient_4 = Gradient(
    LowerLimit=0,
    UpperLimit=1,
    Parameter=Slider(0.84, range=0..1),
    stops=[0: RGB(243, 57, 0), 0.1: RGB(236, 27, 60), 0.2: RGB(210, 0, 118), 0.3: RGB(103, 0, 120), 0.4: RGB(39, 72, 161), 0.6: RGB(18, 178, 90), 0.7: RGB(79, 186, 8), 0.8: RGB(220, 237, 32), 0.9: RGB(247, 159, 20), 1: RGB(243, 57, 0)])
gradient_5 = Gradient(
    LowerLimit=0,
    UpperLimit=1,
    Parameter=Slider(0.19, range=0..1),
    stops=[0: RGB(243, 57, 0), 0.1: RGB(236, 27, 60), 0.2: RGB(210, 0, 118), 0.3: RGB(103, 0, 120), 0.4: RGB(39, 72, 161), 0.6: RGB(18, 178, 90), 0.7: RGB(79, 186, 8), 0.8: RGB(220, 237, 32), 0.9: RGB(247, 159, 20), 1: RGB(243, 57, 0)])
gradient_6 = Gradient(LowerLimit=0, UpperLimit=1, Parameter=Slider(0.87, range=0..1), stops=[0.15: RGB(255, 130, 160), 0.85: RGB(220, 0, 40)])
gradient_7 = Gradient(
    LowerLimit=0,
    UpperLimit=1,
    Parameter=Slider(0.54, range=0..1),
    stops=[0: RGB(243, 57, 0), 0.1: RGB(236, 27, 60), 0.2: RGB(210, 0, 118), 0.3: RGB(103, 0, 120), 0.4: RGB(39, 72, 161), 0.6: RGB(18, 178, 90), 0.7: RGB(79, 186, 8), 0.8: RGB(220, 237, 32), 0.9: RGB(247, 159, 20), 1: RGB(243, 57, 0)])
gradient_8 = Gradient(LowerLimit=0, UpperLimit=1, Parameter=Slider(0.21, range=0..1), stops=[0.704: RGB(173, 203, 249), 1: RGB(75, 107, 169)])
gradient_9 = Gradient(LowerLimit=0, UpperLimit=1, Parameter=Slider(1, range=0..1), stops=[0.804: RGB(173, 203, 249), 1: RGB(75, 107, 169)])
gradient_10 = Gradient(
    LowerLimit=0,
    UpperLimit=1,
    Parameter=Slider(0.86, range=0..1),
    stops=[0: RGB(234, 38, 0), 0.25: RGB(234, 126, 0), 0.5: RGB(254, 244, 84), 0.75: RGB(173, 203, 249), 1: RGB(75, 107, 169)])
gradient_11 = Gradient(LowerLimit=0, UpperLimit=1, Parameter=Slider(0.97, range=0..1), stops=[0.704: RGB(173, 203, 249), 1: RGB(75, 107, 169)])
gradient_12 = Gradient(
    LowerLimit=0,
    UpperLimit=1,
    Parameter=Slider(0, range=0..1),
    stops=[0.131: RGB(31, 197, 237), 0.19: RGB(29, 247, 176), 0.85: RGB(220, 0, 40)])
gradient_13 = Gradient(
    LowerLimit=0,
    UpperLimit=1,
    Parameter=Slider(0.89, range=0..1),
    stops=[0: RGB(243, 57, 0), 0.1: RGB(236, 27, 60), 0.2: RGB(210, 0, 118), 0.3: RGB(103, 0, 120), 0.4: RGB(39, 72, 161), 0.6: RGB(18, 178, 90), 0.7: RGB(79, 186, 8), 0.8: RGB(220, 237, 32), 0.9: RGB(247, 159, 20), 1: RGB(243, 57, 0)])
gradient_14 = Gradient(LowerLimit=0, UpperLimit=1, Parameter=Slider(0.22, range=0..1), stops=[0.704: RGB(173, 203, 249), 1: RGB(75, 107, 169)])

range_2 = Range(Domain=Domain(0, 1), Steps=Slider(12, range=0..12))
graph_mapper = GraphMapper(range_2, x0=0, x1=1, y0=0, y1=1, Cx=0.5933475494, Cy=0.2502167225, container_name="Conic")
graph_mapper_2 = GraphMapper(range_2, x0=0, x1=1, y0=0, y1=1, Cx=0.7783415318, Cy=0.2016247511, container_name="Conic")
multiplication = Multiplication(A=Slider(1.84, range=0..10), B=range_2)
construct_point = ConstructPoint(XCoordinate=multiplication, YCoordinate=graph_mapper, ZCoordinate=graph_mapper_2)
interpolate = Interpolate(Vertices=construct_point, Degree=3, Periodic=False, KnotStyle=1)  # -> Curve, Length, Domain
xz_plane = XZPlane(Origin=Point(0, 0, 0))
mirror = Mirror(Geometry=interpolate.Curve, Plane=xz_plane)  # -> Geometry, Transform
end_points = EndPoints(Curve=interpolate.Curve)  # -> Start, End
end_points_2 = EndPoints(Curve=mirror.Geometry)  # -> Start, End
curve_curve = CurveCurve(CurveA=interpolate.Curve, CurveB=mirror.Geometry)  # -> Points, ParamsA, ParamsB
unit_x = UnitX(Factor=Slider(5, range=0..10))
move = Move(Geometry=curve_curve.Points, Motion=unit_x)  # -> Geometry, Transform
line = Line(StartPoint=move.Geometry, EndPoint=end_points_2.End)
line_2 = Line(StartPoint=end_points.End, EndPoint=move.Geometry)
join_curves = JoinCurves(Curves=[interpolate.Curve, mirror.Geometry, line, line_2], Preserve=False)  # -> graft(Curves)
number_slider_14 = Slider(0, range=0..100)
explode_tree = ExplodeTree(Data=join_curves)  # -> _00000, _00001
unit_z = UnitZ(Factor=1)
edge_surface = EdgeSurface(CurveA=explode_tree._00000, CurveB=explode_tree._00001)
extrude = Extrude(Base=edge_surface, Direction=unit_z)
deconstruct_brep = DeconstructBrep(Brep=extrude)  # -> Faces, Edges, Vertices
point_on_curve = PointOnCurve(deconstruct_brep.Edges, parameter=0.5)
panel_15 = Panel("""5
7
8""")
point_list = PointList(Points=point_on_curve, Size=Slider(0.42, range=0..10))
fillet_edge = FilletEdge(
    Shape=extrude,
    Blend=Slider(0, range=0..10),
    Metric=Slider(0, range=0..2),
    Edges=panel_15,
    Radii=Slider(0.23, range=0..1))
volume = Volume(Geometry=fillet_edge)  # -> Volume, Centroid
range_3 = Range(Domain=Domain(0, 1), Steps=Slider(57, range=0..100))
multiplication_2 = Multiplication(A=range_3, B=Slider(15, range=0..100))
cosine = Cosine(Value=multiplication_2)
sine = Sine(Value=multiplication_2)
range_4 = Range(Domain=Domain(0, 1), Steps=10)
multiplication_3 = Multiplication(A=sine, B=Slider(1.51, range=0..10))
multiplication_4 = Multiplication(A=cosine, B=Slider(1.43, range=0..10))
construct_point_2 = ConstructPoint(XCoordinate=multiplication_2, YCoordinate=multiplication_3, ZCoordinate=multiplication_4)
graph_mapper_3 = GraphMapper(
    range_4,
    x0=0,
    x1=1,
    y0=0,
    y1=1,
    container_name="Sine Summation",
    Equation0_px=[0, 0.7840452194],
    Equation0_py=[0, 0.1417934895],
    Equation1_px=[0.04264323041, 1],
    Equation1_py=[0.05706167221, 0.2204722762])
interpolate_2 = Interpolate(Vertices=construct_point_2, Degree=3, Periodic=False, KnotStyle=1)  # -> Curve, Length, Domain
pi_2 = Pi(Factor=Slider(0, range=0..1))
pipe_variable = PipeVariable(Curve=reparameterize(interpolate_2.Curve), Parameters=range_4, Radii=graph_mapper_3, Caps=2)

round_3 = Round()  # -> Nearest, Floor, Ceiling
extremes_3 = Extremes(A=graph_mapper, B=range_2)  # -> Mininum, Maximum
maximum_3 = Maximum()
minimum_3 = Minimum()

cull_index = CullIndex(List=extremes_3.Mininum, Indices=number_slider_14, Wrap=True)  # -> graft(List)
cull_index_2 = CullIndex(List=extremes_3.Maximum, Indices=number_slider_14, Wrap=True)  # -> graft(List)
panel_16 = Panel(cull_index)
panel_17 = Panel(cull_index_2)
scale = Scale(Geometry=fillet_edge, Center=volume.Centroid, Factor=cull_index)  # -> flatten(Geometry), Transform
list_length_2 = ListLength(List=scale.Geometry)
scale_2 = Scale(Geometry=fillet_edge, Center=volume.Centroid, Factor=cull_index_2)  # -> flatten(Geometry), Transform
range_5 = Range(Domain=Slider(5.08, range=0..10), Steps=expr("x-1", list_length_2))
pi_3 = Pi(Factor=range_5)
rotate_3d = Rotate3D(Geometry=scale_2.Geometry, Angle=pi_3, Center=Point(0, 0, 0), Axis=Vector(0, 0, 1))  # -> Geometry, Transform
unit_z_2 = UnitZ(Factor=range_5)
move_2 = Move(Geometry=rotate_3d.Geometry, Motion=unit_z_2)  # -> Geometry, Transform
volume_2 = Volume(Geometry=move_2.Geometry)  # -> Volume, Centroid
list_length_3 = ListLength(List=volume_2.Centroid)
perp_frames = PerpFrames(Curve=interpolate_2.Curve, Count=list_length_3, Align=True)  # -> Frames, Parameters
geometry = Geometry(move_2.Geometry)
rotate_plane = RotatePlane(Plane=perp_frames.Frames, Angle=pi_2)
orient = Orient(Geometry=geometry, Source=volume_2.Centroid, Target=rotate_plane)  # -> graft(Geometry), Transform

explode_tree_2 = ExplodeTree(Data=[orient.Geometry, pipe_variable])  # -> Branch0, _0000, _0001, _0002, _0003, _0004, _0005, _0006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
custom_preview = CustomPreview(Geometry=explode_tree_2._0004, Material=gradient)
custom_preview_2 = CustomPreview(Geometry=explode_tree_2.Branch10, Material=gradient_2)
custom_preview_3 = CustomPreview(Geometry=explode_tree_2._0003, Material=gradient_6)
custom_preview_4 = CustomPreview(Geometry=explode_tree_2._0007, Material=gradient_3)
custom_preview_5 = CustomPreview(Geometry=explode_tree_2._0006, Material=gradient_4)
custom_preview_6 = CustomPreview(Geometry=explode_tree_2._00010, Material=gradient_5)
custom_preview_7 = CustomPreview(Geometry=explode_tree_2._0002, Material=gradient_7)
custom_preview_8 = CustomPreview(Geometry=explode_tree_2._0005, Material=gradient_8)
# rc
custom_preview_9 = CustomPreview(Geometry=explode_tree_2._0008, Material=gradient_9)
custom_preview_10 = CustomPreview(Geometry=explode_tree_2._00011, Material=gradient_10)
custom_preview_11 = CustomPreview(Geometry=explode_tree_2._0001, Material=gradient_11)
# rs
custom_preview_12 = CustomPreview(Geometry=explode_tree_2.Branch0, Material=gradient_12)
# Full multiplicity knots at start
# Simple knots
# Full multiplicity knots at end
# P1
# A=0.2*P1+ 0.8*P2
# D=0.2*A + 0.8*B
# P2
# B=0.47*P2 + 0.53*P3
# Full multiplicity knots at start
# E=0.7*B + 0.3*C
# P3
# Full multiplicity knots in the middle
# C=0.8*P3 + 0.2*P4
# P4
# Full multiplicity knots at end
# Compare knot spacing
# GH solution
# VB
# C#
# Python with RhinoCommon Only
# Pythong with RhinoScriptSyntax
# GH solution
# VB
# C#
# Python
# VB
custom_preview_13 = CustomPreview(Geometry=explode_tree_2.Branch15, Material=gradient_6)
custom_preview_14 = CustomPreview(Geometry=explode_tree_2.Branch14, Material=gradient_13)
custom_preview_15 = CustomPreview(Geometry=explode_tree_2._00012, Material=gradient_14)
