# Grasshopper definition MathTrig053b.gh (Grasshopper 1.0.7)
# Copyright: Wickerson Studios
# plug-ins: Bifocals

image_sampler = ImageSampler(
    FilePath="C:\Users\Sculpture\Documents\2020Grasshopper\ScreenShots2019\Screenshots2020\SurfaceEditAlgorithm.PNG",
    Filter="Value",
    Interpolate=False,
    Umax=1,
    Umin=0,
    Vmax=1,
    Vmin=0,
    Wrap=1)
weighted_average = WeightedAverage()
# 1001 GRASSHOPPER DEFINITIONS
# Wickerson Studio
# 
# created by: Michael Wickerson
# 
# Grasshopper for Rhino 3D Algorithmic Modeling
# 
# www.wickersonstudios.com
# www.michaelwickerson.com
# https://www.youtube.com/channel/UC7J48Ppcsa6oncp6d29R0xw
# https://github.com/mwickerson
# https://www.facebook.com/michael.wickerson
# https://www.linkedin.com/in/michael-wickerson-696a80156/
# https://www.grasshopper3d.com/profile/MichaelWickerson
# MATH  UTILITIES 053/1001
# Wickerson Studio
# created by: Michael Wickerson
# Grasshopper for Rhino 3D Algorithmic Modeling
# www.wickersonstudios.com
# www.michaelwickerson.com
# https://www.youtube.com/channel/UC7J48Ppcsa6oncp6d29R0xw
# https://github.com/mwickerson
# https://www.facebook.com/michael.wickerson
# https://www.linkedin.com/in/michael-wickerson-696a80156/
# https://www.grasshopper3d.com/profile/MichaelWickerson
average = Average()
truncate = Truncate(TruncationFactor=0)
blur_numbers = BlurNumbers(Strength=0.5, Iterations=1, Lock=True, Wrap=False)
smooth_numbers = SmoothNumbers(SmoothDelay=2000)
interpolate_data = InterpolateData(Interpolation=2)

number_slider = Slider(2, range=0..10)  # disabled
number_slider_2 = Slider(156, range=0..1000)  # disabled
number_slider_3 = Slider(12, range=0..100)  # disabled
extremes = Extremes(A=number_slider, B=number_slider_3, C=number_slider_2)  # -> Mininum, Maximum; disabled
maximum = Maximum(A=number_slider_3, B=number_slider_2)  # disabled
minimum = Minimum(A=number_slider_3, B=number_slider_2)  # disabled
panel = Panel(extremes.Mininum)  # disabled
panel_2 = Panel(extremes.Maximum)  # disabled
panel_3 = Panel(maximum)  # disabled
panel_4 = Panel(minimum)  # disabled

number_slider_4 = Slider(1, range=0..1)  # disabled
number_slider_5 = Slider(2, range=0..10)  # disabled
number_slider_6 = Slider(122, range=0..1000)  # disabled
number_slider_7 = Slider(12, range=0..100)  # disabled
number_slider_8 = Slider(51, range=0..100)  # disabled
number_slider_9 = Slider(0.36, range=0..1)  # disabled
number_slider_10 = Slider(2, range=0..10)  # disabled
number_slider_11 = Slider(0.43, range=0..1)  # disabled
boolean_toggle = BooleanToggle(True)  # disabled
boolean_toggle_2 = BooleanToggle(False)  # disabled
number_slider_12 = Slider(0.6, range=0..1)  # disabled
merge = Merge(Data1=number_slider_4, Data2=number_slider_5, Data3=number_slider_7, Data4=number_slider_6)  # disabled
range = Range(Domain=merge, Steps=number_slider_8)  # disabled
average_2 = Average(Input=merge)  # disabled
truncate_2 = Truncate(Input=range, TruncationFactor=number_slider_12)  # -> flatten(Result); disabled
blur_numbers_2 = BlurNumbers(Numbers=merge, Strength=number_slider_9, Iterations=number_slider_10, Lock=boolean_toggle, Wrap=boolean_toggle_2)  # disabled
smooth_numbers_2 = SmoothNumbers(Numbers=merge, SmoothDelay=2000)  # disabled
interpolate_data_2 = InterpolateData(Data=merge, Parameter=number_slider_11, Interpolation=2)  # disabled
panel_5 = Panel(average_2)  # disabled
panel_6 = Panel(blur_numbers_2)  # disabled
panel_7 = Panel(interpolate_data_2)  # disabled
panel_8 = Panel(smooth_numbers_2)  # disabled
panel_9 = Panel(truncate_2)  # disabled
param_viewer = ParamViewer(panel_9)  # disabled

number_slider_13 = Slider(243.377, range=0..1000)  # disabled
round = Round(Number=number_slider_13)  # -> Nearest, Floor, Ceiling; disabled
panel_10 = Panel(round.Nearest)  # disabled
panel_11 = Panel(round.Floor)  # disabled
panel_12 = Panel(round.Ceiling)  # disabled

epsilon = Epsilon(Factor=1)  # disabled
natural_logarithm = NaturalLogarithm(Factor=1)  # disabled
golden_ratio = GoldenRatio(Factor=1)  # disabled
pi = Pi(Factor=1)  # disabled
merge_2 = Merge(Data1=epsilon, Data2=golden_ratio, Data3=natural_logarithm, Data4=pi)  # disabled
panel_13 = Panel(merge_2)  # disabled

list_length = ListLength(List=truncate_2)  # disabled
number_slider_14 = Slider(30, range=0..30)
panel_14 = Panel(list_length)  # disabled
number_slider_15 = Slider(5.67, range=0..10)
polygon = Polygon(Plane=PlaneXY(0, 0, 0), Radius=3, Segments=Slider(3, range=3..10), FilletRadius=0)  # -> Polygon, Length
rectangle = Rectangle(Plane=PlaneXY(0, 0, 0), XSize=number_slider_14, YSize=number_slider_14, Radius=Slider(3, range=0..100))  # -> Rectangle, Length
rectangular_array = RectangularArray(Geometry=polygon.Polygon, Cell=rectangle.Rectangle, XCount=number_slider_15, YCount=number_slider_15)  # -> Geometry, Transform
point = Point(<point referenced from the Rhino model>)
curve = Curve(rectangular_array.Geometry)
area = Area(Geometry=curve)  # -> Area, Centroid
vector_2pt = Vector2Pt(PointA=area.Centroid, PointB=point, Unitize=Toggle(False))  # -> Vector, Length
remap = Remap(data=vector_2pt.Length, min=0, max=1)
remap_2 = Remap(data=vector_2pt.Length, min=0, max=1)
vector_display = VectorDisplay(Anchor=area.Centroid, Vector=vector_2pt.Vector)
unit_vector = UnitVector(Vector=vector_2pt.Vector)
unit_z = UnitZ(Factor=1)
pi_2 = Pi(Factor=Slider(0.38, range=0..1))
graph_mapper = GraphMapper(
    remap,
    x0=0,
    x1=1,
    y0=0,
    y1=1,
    container_name="Sine",
    Equation_px=[0.0657215938, 0.5216665864],
    Equation_py=[0.55552876, 0.4417812824])
graph_mapper_2 = GraphMapper(remap_2, x0=0, x1=1, y0=0, y1=1, container_name="Sine", Equation_px=[0, 0.7286713123], Equation_py=[0, 0.7709518671])
rotate = Rotate(Vector=unit_vector, Axis=unit_z, Angle=pi_2)
remap_3 = Remap(data=graph_mapper, min=Slider(0.2, range=0..1), max=Slider(105, range=0..1000))
remap_4 = Remap(data=graph_mapper_2, min=Slider(0.2, range=0..1), max=Slider(3, range=0..3))
vector_display_2 = VectorDisplay(Anchor=area.Centroid, Vector=rotate)
multiplication = Multiplication(A=rotate, B=remap_4)
multiplication_2 = Multiplication(A=rotate, B=remap_3)
unit_x = UnitX(Factor=1)
move = Move(Geometry=area.Centroid, Motion=expr("-x", multiplication_2))  # -> Geometry, Transform
orient_direction = OrientDirection(Geometry=curve, PointA=area.Centroid, DirectionA=unit_x, PointB=move.Geometry, DirectionB=multiplication)  # -> Geometry, Transform
move_2 = Move(Geometry=orient_direction.Geometry, Motion=vector_2pt.Vector)  # -> Geometry, Transform
boundary_surfaces = BoundarySurfaces(Edges=move_2.Geometry)
extrude_point = ExtrudePoint(Base=move_2.Geometry, Point=area.Centroid)
cap_holes = CapHoles(Brep=extrude_point)
explode_tree = ExplodeTree()  # -> Branch0, _0000, _0001, _0002, _0003, _0004, _0005, _0006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
gradient = Gradient(
    LowerLimit=0,
    UpperLimit=1,
    Parameter=Slider(0.12, range=0..1),
    stops=[0: RGB(234, 38, 0), 0.25: RGB(234, 126, 0), 0.5: RGB(254, 244, 84), 0.75: RGB(173, 203, 249), 1: RGB(75, 107, 169)])
gradient_2 = Gradient(
    LowerLimit=0,
    UpperLimit=1,
    Parameter=Slider(0.66, range=0..1),
    stops=[0: RGB(234, 38, 0), 0.25: RGB(234, 126, 0), 0.5: RGB(254, 244, 84), 0.75: RGB(173, 203, 249), 1: RGB(75, 107, 169)])
gradient_3 = Gradient(LowerLimit=0, UpperLimit=1, Parameter=Slider(0.02, range=0..1), stops=[0.15: RGB(255, 130, 160), 0.85: RGB(220, 0, 40)])
gradient_4 = Gradient(
    LowerLimit=0,
    UpperLimit=1,
    Parameter=Slider(0.84, range=0..1),
    stops=[0: RGB(243, 57, 0), 0.1: RGB(236, 27, 60), 0.2: RGB(210, 0, 118), 0.3: RGB(103, 0, 120), 0.4: RGB(39, 72, 161), 0.6: RGB(18, 178, 90), 0.7: RGB(79, 186, 8), 0.8: RGB(220, 237, 32), 0.9: RGB(247, 159, 20), 1: RGB(243, 57, 0)])
gradient_5 = Gradient(
    LowerLimit=0,
    UpperLimit=1,
    Parameter=Slider(0.19, range=0..1),
    stops=[0: RGB(243, 57, 0), 0.1: RGB(236, 27, 60), 0.2: RGB(210, 0, 118), 0.3: RGB(103, 0, 120), 0.4: RGB(39, 72, 161), 0.6: RGB(18, 178, 90), 0.7: RGB(79, 186, 8), 0.8: RGB(220, 237, 32), 0.9: RGB(247, 159, 20), 1: RGB(243, 57, 0)])
gradient_6 = Gradient(LowerLimit=0, UpperLimit=1, Parameter=Slider(0.87, range=0..1), stops=[0.15: RGB(255, 130, 160), 0.85: RGB(220, 0, 40)])
gradient_7 = Gradient(
    LowerLimit=0,
    UpperLimit=1,
    Parameter=Slider(0.54, range=0..1),
    stops=[0: RGB(243, 57, 0), 0.1: RGB(236, 27, 60), 0.2: RGB(210, 0, 118), 0.3: RGB(103, 0, 120), 0.4: RGB(39, 72, 161), 0.6: RGB(18, 178, 90), 0.7: RGB(79, 186, 8), 0.8: RGB(220, 237, 32), 0.9: RGB(247, 159, 20), 1: RGB(243, 57, 0)])
gradient_8 = Gradient(LowerLimit=0, UpperLimit=1, Parameter=Slider(0.21, range=0..1), stops=[0.704: RGB(173, 203, 249), 1: RGB(75, 107, 169)])
gradient_9 = Gradient(LowerLimit=0, UpperLimit=1, Parameter=Slider(1, range=0..1), stops=[0.804: RGB(173, 203, 249), 1: RGB(75, 107, 169)])
gradient_10 = Gradient(
    LowerLimit=0,
    UpperLimit=1,
    Parameter=Slider(0.86, range=0..1),
    stops=[0: RGB(234, 38, 0), 0.25: RGB(234, 126, 0), 0.5: RGB(254, 244, 84), 0.75: RGB(173, 203, 249), 1: RGB(75, 107, 169)])
gradient_11 = Gradient(LowerLimit=0, UpperLimit=1, Parameter=Slider(0.97, range=0..1), stops=[0.704: RGB(173, 203, 249), 1: RGB(75, 107, 169)])
gradient_12 = Gradient(
    LowerLimit=0,
    UpperLimit=1,
    Parameter=Slider(0, range=0..1),
    stops=[0.131: RGB(31, 197, 237), 0.19: RGB(29, 247, 176), 0.85: RGB(220, 0, 40)])
gradient_13 = Gradient(
    LowerLimit=0,
    UpperLimit=1,
    Parameter=Slider(0.89, range=0..1),
    stops=[0: RGB(243, 57, 0), 0.1: RGB(236, 27, 60), 0.2: RGB(210, 0, 118), 0.3: RGB(103, 0, 120), 0.4: RGB(39, 72, 161), 0.6: RGB(18, 178, 90), 0.7: RGB(79, 186, 8), 0.8: RGB(220, 237, 32), 0.9: RGB(247, 159, 20), 1: RGB(243, 57, 0)])
gradient_14 = Gradient(LowerLimit=0, UpperLimit=1, Parameter=Slider(0.22, range=0..1), stops=[0.704: RGB(173, 203, 249), 1: RGB(75, 107, 169)])
custom_preview = CustomPreview(Geometry=explode_tree._0004, Material=gradient)
custom_preview_2 = CustomPreview(Geometry=explode_tree.Branch10, Material=gradient_2)
custom_preview_3 = CustomPreview(Geometry=explode_tree._0003, Material=gradient_6)
custom_preview_4 = CustomPreview(Geometry=explode_tree._0007, Material=gradient_3)
custom_preview_5 = CustomPreview(Geometry=explode_tree._0006, Material=gradient_4)
custom_preview_6 = CustomPreview(Geometry=explode_tree._00010, Material=gradient_5)
custom_preview_7 = CustomPreview(Geometry=explode_tree._0002, Material=gradient_7)
custom_preview_8 = CustomPreview(Geometry=explode_tree._0005, Material=gradient_8)
# rc
custom_preview_9 = CustomPreview(Geometry=explode_tree._0008, Material=gradient_9)
custom_preview_10 = CustomPreview(Geometry=explode_tree._00011, Material=gradient_10)
custom_preview_11 = CustomPreview(Geometry=explode_tree._0001, Material=gradient_11)
# rs
custom_preview_12 = CustomPreview(Geometry=explode_tree.Branch0, Material=gradient_12)
# Full multiplicity knots at start
# Simple knots
# Full multiplicity knots at end
# P1
# A=0.2*P1+ 0.8*P2
# D=0.2*A + 0.8*B
# P2
# B=0.47*P2 + 0.53*P3
# Full multiplicity knots at start
# E=0.7*B + 0.3*C
# P3
# Full multiplicity knots in the middle
# C=0.8*P3 + 0.2*P4
# P4
# Full multiplicity knots at end
# Compare knot spacing
# GH solution
# VB
# C#
# Python with RhinoCommon Only
# Pythong with RhinoScriptSyntax
# GH solution
# VB
# C#
# Python
# VB
custom_preview_13 = CustomPreview(Geometry=explode_tree.Branch15, Material=gradient_6)
custom_preview_14 = CustomPreview(Geometry=explode_tree.Branch14, Material=gradient_13)
custom_preview_15 = CustomPreview(Geometry=explode_tree._00012, Material=gradient_14)

# ==== cluster Remap: Remaps numbers
data = ClusterInput()
min = ClusterInput()
max = ClusterInput()
bnd = Bounds(Numbers=data)
dom = ConstructDomain(DomainStart=min, DomainEnd=max)
remap = RemapNumbers(Value=data, Source=bnd, Target=dom)  # -> Mapped, Clipped
R = ClusterOutput(remap.Mapped)
