# Grasshopper definition MathTrig056.gh (Grasshopper 1.0.7)
# Copyright: Wickerson Studios
# plug-ins: Bifocals

image_sampler = ImageSampler(
    FilePath="C:\Users\Sculpture\Documents\2020Grasshopper\ScreenShots2019\Screenshots2020\SurfaceEditAlgorithm.PNG",
    Filter="Value",
    Interpolate=False,
    Umax=1,
    Umin=0,
    Vmax=1,
    Vmin=0,
    Wrap=1)

weighted_average = WeightedAverage()
# 1001 GRASSHOPPER DEFINITIONS
# Wickerson Studio
# 
# created by: Michael Wickerson
# 
# Grasshopper for Rhino 3D Algorithmic Modeling
# 
# www.wickersonstudios.com
# www.michaelwickerson.com
# https://www.youtube.com/channel/UC7J48Ppcsa6oncp6d29R0xw
# https://github.com/mwickerson
# https://www.facebook.com/michael.wickerson
# https://www.linkedin.com/in/michael-wickerson-696a80156/
# https://www.grasshopper3d.com/profile/MichaelWickerson
# MATH  UTILITIES 055/1001
# Wickerson Studio
# created by: Michael Wickerson
# Grasshopper for Rhino 3D Algorithmic Modeling
# www.wickersonstudios.com
# www.michaelwickerson.com
# https://www.youtube.com/channel/UC7J48Ppcsa6oncp6d29R0xw
# https://github.com/mwickerson
# https://www.facebook.com/michael.wickerson
# https://www.linkedin.com/in/michael-wickerson-696a80156/
# https://www.grasshopper3d.com/profile/MichaelWickerson
average = Average()
truncate = Truncate(TruncationFactor=0)
blur_numbers = BlurNumbers(Strength=0.5, Iterations=1, Lock=True, Wrap=False)
smooth_numbers = SmoothNumbers(SmoothDelay=2000)
interpolate_data = InterpolateData(Interpolation=2)

merge = Merge(
    Data1=Slider(1, range=0..1),
    Data2=Slider(2, range=0..10),
    Data3=Slider(16, range=0..100),
    Data4=Slider(122, range=0..1000))
range = Range(Domain=merge, Steps=Slider(21, range=0..100))
average_2 = Average(Input=merge)
smooth_numbers_2 = SmoothNumbers(Numbers=merge, SmoothDelay=2000)
truncate_2 = Truncate(Input=range, TruncationFactor=Slider(0.4, range=0..1))  # -> flatten(Result)
blur_numbers_2 = BlurNumbers(
    Numbers=merge,
    Strength=Slider(0.56, range=0..1),
    Iterations=Slider(5, range=0..10),
    Lock=Toggle(True),
    Wrap=Toggle(True))
interpolate_data_2 = InterpolateData(Data=merge, Parameter=Slider(0.62, range=0..1), Interpolation=2)
list_length = ListLength(List=truncate_2)
panel = Panel(average_2)
panel_2 = Panel(blur_numbers_2)
panel_3 = Panel(interpolate_data_2)
panel_4 = Panel(smooth_numbers_2)
panel_5 = Panel(list_length)
panel_6 = Panel(truncate_2)
param_viewer = ParamViewer(panel_6)

gradient = Gradient(
    LowerLimit=0,
    UpperLimit=1,
    Parameter=Slider(0.46, range=0..1),
    stops=[0: RGB(234, 38, 0), 0.25: RGB(234, 126, 0), 0.5: RGB(254, 244, 84), 0.75: RGB(173, 203, 249), 1: RGB(75, 107, 169)])
gradient_2 = Gradient(LowerLimit=0, UpperLimit=1, Parameter=Slider(0.02, range=0..1), stops=[0.15: RGB(255, 130, 160), 0.85: RGB(220, 0, 40)])
gradient_3 = Gradient(
    LowerLimit=0,
    UpperLimit=1,
    Parameter=Slider(0.12, range=0..1),
    stops=[0: RGB(234, 38, 0), 0.25: RGB(234, 126, 0), 0.5: RGB(254, 244, 84), 0.75: RGB(173, 203, 249), 1: RGB(75, 107, 169)])
gradient_4 = Gradient(
    LowerLimit=0,
    UpperLimit=1,
    Parameter=Slider(0.84, range=0..1),
    stops=[0: RGB(243, 57, 0), 0.1: RGB(236, 27, 60), 0.2: RGB(210, 0, 118), 0.3: RGB(103, 0, 120), 0.4: RGB(39, 72, 161), 0.6: RGB(18, 178, 90), 0.7: RGB(79, 186, 8), 0.8: RGB(220, 237, 32), 0.9: RGB(247, 159, 20), 1: RGB(243, 57, 0)])
gradient_5 = Gradient(
    LowerLimit=0,
    UpperLimit=1,
    Parameter=Slider(0.19, range=0..1),
    stops=[0: RGB(243, 57, 0), 0.1: RGB(236, 27, 60), 0.2: RGB(210, 0, 118), 0.305: RGB(103, 0, 120), 0.4: RGB(39, 72, 161), 0.6: RGB(18, 178, 90), 0.7: RGB(79, 186, 8), 0.8: RGB(220, 237, 32), 0.9: RGB(247, 159, 20), 1: RGB(243, 57, 0)])
gradient_6 = Gradient(LowerLimit=0, UpperLimit=1, Parameter=Slider(0.87, range=0..1), stops=[0.15: RGB(255, 130, 160), 0.85: RGB(220, 0, 40)])
gradient_7 = Gradient(
    LowerLimit=0,
    UpperLimit=1,
    Parameter=Slider(0.54, range=0..1),
    stops=[0: RGB(243, 57, 0), 0.1: RGB(236, 27, 60), 0.2: RGB(210, 0, 118), 0.3: RGB(103, 0, 120), 0.4: RGB(39, 72, 161), 0.6: RGB(18, 178, 90), 0.7: RGB(79, 186, 8), 0.8: RGB(220, 237, 32), 0.9: RGB(247, 159, 20), 1: RGB(243, 57, 0)])
gradient_8 = Gradient(LowerLimit=0, UpperLimit=1, Parameter=Slider(0.21, range=0..1), stops=[0.704: RGB(173, 203, 249), 1: RGB(75, 107, 169)])
gradient_9 = Gradient(
    LowerLimit=0,
    UpperLimit=1,
    Parameter=Slider(1, range=0..1),
    stops=[0.221: RGB(152, 89, 100), 0.754: RGB(173, 203, 249), 1: RGB(75, 107, 169)])
gradient_10 = Gradient(
    LowerLimit=0,
    UpperLimit=1,
    Parameter=Slider(0.43, range=0..1),
    stops=[0.447: RGB(31, 197, 237), 0.567: RGB(110, 169, 24), 0.85: RGB(220, 0, 40)])
gradient_11 = Gradient(
    LowerLimit=0,
    UpperLimit=1,
    Parameter=Slider(0.42, range=0..1),
    stops=[0: RGB(0, 86, 238), 0.25: RGB(234, 126, 0), 1: RGB(75, 107, 169)])
gradient_12 = Gradient(LowerLimit=0, UpperLimit=1, Parameter=Slider(0.39, range=0..1), stops=[0.804: RGB(173, 203, 249), 1: RGB(75, 107, 169)])
gradient_13 = Gradient(
    LowerLimit=0,
    UpperLimit=1,
    Parameter=Slider(0.89, range=0..1),
    stops=[0: RGB(243, 57, 0), 0.1: RGB(236, 27, 60), 0.2: RGB(210, 0, 118), 0.3: RGB(103, 0, 120), 0.4: RGB(39, 72, 161), 0.6: RGB(18, 178, 90), 0.7: RGB(79, 186, 8), 0.8: RGB(220, 237, 32), 0.9: RGB(247, 159, 20), 1: RGB(243, 57, 0)])
gradient_14 = Gradient(LowerLimit=0, UpperLimit=1, Parameter=Slider(0.22, range=0..1), stops=[0.704: RGB(173, 203, 249), 1: RGB(75, 107, 169)])
custom_preview = CustomPreview(Material=gradient_5)
custom_preview_2 = CustomPreview(Material=gradient_12)

number_slider = Slider(0.06, range=0..0.2)
range_2 = Range(Domain=Slider(73, range=0..100), Steps=Slider(14, range=0..40))
list_length_2 = ListLength(List=range_2)
series = Series(Start=Slider(38, range=0..100), Step=Slider(4, range=0..4), Count=list_length_2)
panel_7 = Panel(range_2)
construct_point = ConstructPoint(XCoordinate=0, YCoordinate=0, ZCoordinate=0)
unit_z = UnitZ(Factor=1)
line_sdl = LineSDL(Start=construct_point, Direction=unit_z, Length=1)
number_slider_2 = Slider(7, range=0..10)
addition = Addition(A=number_slider_2, B=Slider(1, range=0..10))
unit_z_2 = UnitZ(Factor=Slider(15.34, range=0..30))
range_3 = Range(Domain=Domain(0, 1), Steps=10)
graph_mapper = GraphMapper(
    range_3,
    x0=0,
    x1=1,
    y0=0,
    y1=1,
    container_name="Sine Summation",
    Equation0_px=[0.2, 0.9747125506],
    Equation0_py=[0.2, 0.3524202704],
    Equation1_px=[0.6, 1],
    Equation1_py=[0.3, 0.7965120673])
multiplication = Multiplication(A=Slider(7.94, range=0..10), B=graph_mapper)

truncate_3 = Truncate(Input=range_2, TruncationFactor=number_slider)
weighted_average_2 = WeightedAverage(Input=range_2, Weights=series)
blur_numbers_3 = BlurNumbers(Numbers=range_2, Strength=number_slider, Iterations=Slider(88, range=0..100), Lock=Toggle(False), Wrap=Toggle(True))  # -> flatten(Numbers)
interpolate_data_3 = InterpolateData(Data=range_2, Parameter=number_slider, Interpolation=2)
smooth_numbers_3 = SmoothNumbers(Numbers=range_2, SmoothDelay=2000)

addition_2 = Addition(A=blur_numbers_3, B=Slider(7.764, range=0..20))
sine = Sine(Value=addition_2)
panel_8 = Panel(blur_numbers_3)
multiplication_2 = Multiplication(A=sine, B=Slider(97, range=0..100))
cosine = Cosine(Value=blur_numbers_3)
construct_point_2 = ConstructPoint(XCoordinate=cosine, YCoordinate=multiplication_2, ZCoordinate=expr("x*2", range_2))
interpolate = Interpolate(Vertices=construct_point_2, Degree=3, Periodic=Toggle(False), KnotStyle=1)  # -> Curve, Length, Domain
revolution = Revolution(Curve=interpolate.Curve, Axis=line_sdl, Domain=Domain(0, 6.283185307))
surface = Surface(revolution)
divide_surface = DivideSurface(Surface=surface, UCount=number_slider_2, VCount=number_slider_2)  # -> Points, Normals, Parameters
deconstruct_brep = DeconstructBrep(Brep=surface)  # -> Faces, Edges, Vertices
list_item = ListItem(List=deconstruct_brep.Edges, Index=Slider(3, range=0..10), Wrap=True)
vector_display = VectorDisplay(Anchor=divide_surface.Points, Vector=divide_surface.Normals)
amplitude = Amplitude(Vector=divide_surface.Normals, Amplitude=Slider(30, range=0..30))
move = Move(Geometry=divide_surface.Points, Motion=amplitude)  # -> flatten(Geometry), Transform
cap_holes = CapHoles(Brep=surface)
surface_from_points = SurfaceFromPoints(Points=move.Geometry, UCount=addition, Interpolate=False)
deconstruct_brep_2 = DeconstructBrep(Brep=surface_from_points)  # -> Faces, Edges, Vertices
deconstruct_brep_3 = DeconstructBrep(Brep=surface_from_points)  # -> Faces, flatten(Edges), Vertices
list_item_2 = ListItem(List=deconstruct_brep_2.Edges, Index=Slider(0, range=0..10), Wrap=True)
cap_holes_2 = CapHoles(Brep=surface_from_points)
list_item_3 = ListItem(List=deconstruct_brep_3.Edges, Index=Slider(0, range=0..2), Wrap=True)
boundary_surfaces = BoundarySurfaces(Edges=list_item_3)
extrude = Extrude(Base=boundary_surfaces, Direction=expr("-x", unit_z_2))
solid_difference = SolidDifference(BrepsA=cap_holes_2, BrepsB=cap_holes)
solid_union = SolidUnion(Breps=[extrude, solid_difference])
deconstruct_brep_4 = DeconstructBrep(Brep=solid_union)  # -> Faces, Edges, Vertices
list_item_4 = ListItem(List=deconstruct_brep_4.Faces, Index=[Slider(1, range=0..100), Slider(6, range=0..10)], Wrap=True)
surface_2 = Surface(list_item_4)
area = Area(Geometry=surface_2)  # -> Area, Centroid
interpolate_2 = Interpolate(Vertices=area.Centroid, Degree=3, Periodic=False, KnotStyle=1)  # -> Curve, Length, Domain
pipe_variable = PipeVariable(Curve=reparameterize(interpolate_2.Curve), Parameters=range_3, Radii=multiplication, Caps=0)  # -> graft(Pipe)
solid_union_2 = SolidUnion(Breps=[pipe_variable, solid_union])

explode_tree = ExplodeTree(Data=graft(solid_union_2))  # -> Branch0, Branch1, _000000, _001000, _002000, Branch5, Branch6, Branch7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
custom_preview_3 = CustomPreview(Geometry=explode_tree.Branch5, Material=gradient_3)
custom_preview_4 = CustomPreview(Geometry=explode_tree.Branch10, Material=gradient)
custom_preview_5 = CustomPreview(Geometry=explode_tree._000000, Material=gradient_9)
custom_preview_6 = CustomPreview(Geometry=explode_tree.Branch8, Material=gradient_2)
custom_preview_7 = CustomPreview(Geometry=explode_tree.Branch7, Material=gradient_4)
custom_preview_8 = CustomPreview(Geometry=explode_tree._002000, Material=gradient_3)
custom_preview_9 = CustomPreview(Geometry=explode_tree._001000, Material=gradient_7)
custom_preview_10 = CustomPreview(Geometry=explode_tree.Branch6, Material=gradient_8)
# Full multiplicity knots at start
# Simple knots
# Full multiplicity knots at end
# P1
# A=0.2*P1+ 0.8*P2
# D=0.2*A + 0.8*B
# P2
# B=0.47*P2 + 0.53*P3
# Full multiplicity knots at start
# E=0.7*B + 0.3*C
# P3
# Full multiplicity knots in the middle
# C=0.8*P3 + 0.2*P4
# P4
# Full multiplicity knots at end
# Compare knot spacing
# GH solution
# VB
# C#
# Python with RhinoCommon Only
# Pythong with RhinoScriptSyntax
# GH solution
# VB
# C#
# Python
# VB
custom_preview_11 = CustomPreview(Geometry=explode_tree.Branch15, Material=gradient_6)
custom_preview_12 = CustomPreview(Geometry=explode_tree.Branch14, Material=gradient_13)
custom_preview_13 = CustomPreview(Geometry=explode_tree.Branch13, Material=gradient_14)
# rs
custom_preview_14 = CustomPreview(Geometry=[explode_tree.Branch12, explode_tree.Branch9, explode_tree.Branch1], Material=gradient_11)
# rc
custom_preview_15 = CustomPreview(Geometry=explode_tree.Branch0, Material=gradient_10)
