# Grasshopper definition OmVoronoiChair90.gh (Grasshopper 1.0.7)
# Copyright: Wickerson Studios
# plug-ins: MeshEdit Components, HoopSnake, Bifocals, Weaverbird, Element

image_sampler = ImageSampler(
    FilePath="C:\Users\Sculpture\Documents\2020Grasshopper\ScreenShots2019\Screenshots2020\SurfaceEditAlgorithm.PNG",
    Filter="Value",
    Interpolate=False,
    Umax=1,
    Umin=0,
    Vmax=1,
    Vmin=0,
    Wrap=1)
# Wickerson Studio
# created by: Michael Wickerson
# Grasshopper for Rhino 3D Algorithmic Modeling
# www.wickersonstudios.com
# www.michaelwickerson.com
# https://www.youtube.com/channel/UC7J48Ppcsa6oncp6d29R0xw
# https://github.com/mwickerson
# https://www.facebook.com/michael.wickerson
# https://www.linkedin.com/in/michael-wickerson-696a80156/
# https://www.grasshopper3d.com/profile/MichaelWickerson
geometry = Geometry(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)
# 1001 GRASSHOPPER DEFINITIONS
# Wickerson Studio
# 
# created by: Michael Wickerson
# 
# Grasshopper for Rhino 3D Algorithmic Modeling
# 
# www.wickersonstudios.com
# www.michaelwickerson.com
# https://www.youtube.com/channel/UC7J48Ppcsa6oncp6d29R0xw
# https://github.com/mwickerson
# https://www.facebook.com/michael.wickerson
# https://www.linkedin.com/in/michael-wickerson-696a80156/
# https://www.grasshopper3d.com/profile/MichaelWickerson
# *OM TUTORIAL* 090
mesh = Mesh(<mesh referenced from the Rhino model>)
surface = Surface(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)
surface_2 = Surface(<surface referenced from the Rhino model>)
populate_geometry = PopulateGeometry(Geometry=surface, Count=Slider(50, range=0..100), Seed=1)
hoopsnake = HoopSnake(
    StartingData=populate_geometry,
    Data=average,
    TerminationCondition=Slider(6, range=0..10),
    Hoopsnake_Data_autoUpdate=False,
    Hoopsnake_Data_dataLimit=2147483647,
    Hoopsnake_Data_resetCounter=True,
    Hoopsnake_Data_updateView=True)  # -> Feedback, FeedbackHistory, LoopsCounter, IterationsCounter
cluster = Cluster(point=hoopsnake.Feedback, content=surface)
average = Average(Input=cluster)  # -> flatten(ArithmeticMean)
average_2 = Average(Input=cluster)
list_item = ListItem(List=cluster, Index=0, Wrap=True)
list_length = ListLength(List=cluster)
panel = Panel(list_length)
merge = Merge(Data1=cluster, Data2=list_item)
panel_2 = Panel(average)
scale = Scale(Geometry=merge, Center=average_2, Factor=Slider(0.39, range=0..1))  # -> Geometry, Transform
mesh_plane = MeshPlane(
    Boundary={Plane=PlaneXY(0, 0, 0), Size=Domain2(u=-10..10, v=-10..10)},
    WidthCount=list_length,
    HeightCount=Slider(1, range=0..10))  # -> Mesh, Area
deconstruct_mesh = DeconstructMesh(Mesh=mesh_plane.Mesh)  # -> Vertices, Faces, Colours, Normals
merge_2 = Merge(Data1=merge, Data2=scale.Geometry)
construct_mesh = ConstructMesh(Vertices=merge_2, Faces=deconstruct_mesh.Faces)
element_mesh_combine_clean = ElementMeshCombineClean(Mesh=construct_mesh, Angle=100, MergeVertices=True, FlipMesh=False, CombineType=0)
mesh_join = MeshJoin(Meshes=flatten(element_mesh_combine_clean))
panel_3 = Panel(construct_mesh)
param_viewer = ParamViewer(mesh_join)
mesh_weldvertices = MeshWeldVertices(Mesh=mesh_join, Tolerance=0.01)  # -> RuntimeMessage, Mesh
weaverbird_s_join_meshes_and_weld = WeaverbirdsJoinMeshesAndWeld(Mesh=mesh_weldvertices.Mesh, Weld=False)
weaverbird_s_mesh_thicken = WeaverbirdsMeshThicken(MeshCurves=weaverbird_s_join_meshes_and_weld, Distance=Slider(0.7424, range=0..1), OffsetType=Slider(1, range=0..10))
# rc
# rs
# Full multiplicity knots at start
# Simple knots
# Full multiplicity knots at end
# P1
# A=0.2*P1+ 0.8*P2
# D=0.2*A + 0.8*B
# P2
# B=0.47*P2 + 0.53*P3
# Full multiplicity knots at start
# E=0.7*B + 0.3*C
# P3
# Full multiplicity knots in the middle
# C=0.8*P3 + 0.2*P4
# P4
# Full multiplicity knots at end
# Compare knot spacing
# GH solution
# VB
# C#
# Python with RhinoCommon Only
# Pythong with RhinoScriptSyntax
# GH solution
# VB
# C#
# Python
# VB
weaverbird_s_catmull_clark_subdivision = WeaverbirdsCatmullClarkSubdivision(MeshCurves=weaverbird_s_mesh_thicken, Level=Slider(3, range=0..10), SmoothNakedEdges=1)

# ==== cluster Cluster

# ---- group: Cluster Input
content = ClusterInput()

point = ClusterInput()

# ----
bounding_box = BoundingBox(Content=content, Plane=PlaneXY(0, 0, 0))  # -> Box, Box_2
point_2 = Point(point)
voronoi_3d = Voronoi3D(Points=point_2, Box=bounding_box.Box)  # -> Cells, Boundary
brep_edges = BrepEdges(Brep=voronoi_3d.Cells)  # -> Naked, Interior, NonManifold
brep_curve = BrepCurve(Brep=content, Curve=brep_edges.Interior)  # -> Curves, Points
shift_paths = ShiftPaths(Data=brep_curve.Points, Offset=-1)
vector_2pt = Vector2Pt(PointA=graft(point_2), PointB=shift_paths, Unitize=False)  # -> Vector, Length
plane_fit = PlaneFit(Points=shift_paths)  # -> Plane, Deviation
deconstruct_plane = DeconstructPlane(Plane=plane_fit.Plane)  # -> Origin, XAxis, YAxis, ZAxis
angle = Angle(VectorA=vector_2pt.Vector, VectorB=deconstruct_plane.XAxis, Plane=plane_fit.Plane)  # -> Angle, Reflex
sort_list = SortList(Keys=angle.Angle, ValuesValuesA=shift_paths)  # -> Keys, ValuesValuesA
panel = Panel(sort_list.ValuesValuesA)
polyline = PolyLine(Vertices=sort_list.ValuesValuesA, Closed=False)

# ---- group: Cluster Output
values_a = ClusterOutput(sort_list.ValuesValuesA)
