# Grasshopper definition ParamsGeometry001.gh (Grasshopper 1.0.7)
# Copyright: Wickerson Studios
# plug-ins: KUKA|prc - parametric robot control, HoopSnake, PlanktonGh, Bifocals, LunchBox

# 1001 GRASSHOPPER DEFINITIONS
# Wickerson Studio
# 
# created by: Michael Wickerson
# 
# Grasshopper for Rhino 3D Algorithmic Modeling
# 
# www.wickersonstudios.com
# www.michaelwickerson.com
# https://www.youtube.com/channel/UC7J48Ppcsa6oncp6d29R0xw
# https://github.com/mwickerson
# https://www.facebook.com/michael.wickerson
# https://www.linkedin.com/in/michael-wickerson-696a80156/
# https://www.grasshopper3d.com/profile/MichaelWickerson
image_sampler = ImageSampler(
    FilePath="C:\Users\Sculpture\Documents\2020Grasshopper\ScreenShots2019\Screenshots2020\SurfaceEditAlgorithm.PNG",
    Filter="Value",
    Interpolate=False,
    Umax=1,
    Umin=0,
    Vmax=1,
    Vmin=0,
    Wrap=1)

# ----
# Wickerson Studio
# created by: Michael Wickerson
# Grasshopper for Rhino 3D Algorithmic Modeling
# www.wickersonstudios.com
# www.michaelwickerson.com
# https://www.youtube.com/channel/UC7J48Ppcsa6oncp6d29R0xw
# https://github.com/mwickerson
# https://www.facebook.com/michael.wickerson
# https://www.linkedin.com/in/michael-wickerson-696a80156/
# https://www.grasshopper3d.com/profile/MichaelWickerson
point = Point()

vector = Vector()

circle = Circle()

geometry_pipeline = GeometryPipeline(
    GroupByLayer=False,
    GroupByType=False,
    IncludeHidden=True,
    IncludeLocked=True,
    LayerFilter="*",
    NameFilter="*",
    SublayerFiltering=True,
    TypeFilter=0)
geometry_cache = GeometryCache(MaintainReferences=False)
curve = Curve()
plane = Plane()
rectangle = Rectangle()
brep = Brep()
mesh_face = MeshFace()
planktonmesh = PlanktonMesh()
twisted_box = TwistedBox()
field = Field()
group = Group()
circular_arc = CircularArc()
line = Line()
box = Box()
mesh = Mesh()
surface = Surface()
geometry = Geometry()
transform = Transform()
domain = Domain()
boolean = Boolean()
integer = Integer()
number = Number()
text = Text()
colour = Colour()
complex = Complex()
culture = Culture()
domain² = Domain²()
guid = Guid()
matrix = Matrix()
time = Time()
data = Data()
data_path = DataPath()
file_path = FilePath()
kuka_prc_command = KUKAPrcCommand()
shader = Shader()

# ----
# Params Geometry 001/1001
number_slider = Slider(6.26, range=0..10)
xz_plane = XZPlane(Origin=Point(0, 0, 0))
circle_2 = Circle(Plane=xz_plane, Radius=Slider(7.46, range=0..10))
series = Series(Start=Slider(0, range=0..10), Step=Slider(1, range=0..1), Count=Slider(30, range=0..100))
construct_point = ConstructPoint(XCoordinate=Slider(0, range=0..10), YCoordinate=Slider(0, range=0..10), ZCoordinate=Slider(0, range=0..10))
expression = Expression(x=series, Expression="sin(x²)")
expression_2 = Expression(x=series, Expression="cos(x²)")
vector_xyz = VectorXYZ(XComponent=Slider(5.86, range=0..10), YComponent=Slider(5.1, range=0..10), ZComponent=Slider(5.76, range=0..10))  # -> Vector, Length
construct_point_2 = ConstructPoint(XCoordinate=number_slider, YCoordinate=Slider(4.13, range=0..10), ZCoordinate=Slider(2.73, range=0..10))
construct_point_3 = ConstructPoint(XCoordinate=expression, YCoordinate=expression_2, ZCoordinate=0)
list_length = ListLength(List=construct_point_3)
sort_list = SortList(Keys=construct_point_3, ValuesValuesA=construct_point_3)  # -> Keys, ValuesValuesA
panel = Panel(list_length)
geometry_2 = Geometry([<curve referenced from the Rhino model> x33])
geometry_3 = Geometry([<curve referenced from the Rhino model> x36])
nurbs_curve = NurbsCurve(Vertices=construct_point_3, Degree=3, Periodic=False)  # -> Curve, Length, Domain
nurbs_curve_2 = NurbsCurve(Vertices=sort_list.ValuesValuesA, Degree=3, Periodic=False)  # -> Curve, Length, Domain
pipe = Pipe(Curve=geometry_2, Radius=Slider(0.1, range=0..0.1), Caps=0)

vector_2 = Vector(vector_xyz.Vector)

point_2 = Point(construct_point_2)

amplitude = Amplitude(Vector=vector_2, Amplitude=Slider(7.93, range=0..10))
vector_display = VectorDisplay(Anchor=point_2, Vector=amplitude)

circle_3 = Circle(circle_2)

hoopsnake = HoopSnake(
    StartingData=Slider(0, range=0..100),
    Data=expression_3,
    TerminationCondition=Slider(30, range=0..100),
    Hoopsnake_Data_autoUpdate=False,
    Hoopsnake_Data_dataLimit=2147483647,
    Hoopsnake_Data_resetCounter=True,
    Hoopsnake_Data_updateView=True)  # -> Feedback, FeedbackHistory, LoopsCounter, IterationsCounter
expression_3 = Expression(x=hoopsnake.Feedback, Expression="x+2")
panel_2 = Panel(hoopsnake.FeedbackHistory)
panel_3 = Panel(hoopsnake.Feedback)
panel_4 = Panel(hoopsnake.LoopsCounter)
expression_4 = Expression(x=hoopsnake.Feedback, Expression="x+1")
list_item = ListItem(List=construct_point_3, Index=hoopsnake.Feedback, Wrap=True)
list_item_2 = ListItem(List=construct_point_3, Index=expression_4, Wrap=True)
panel_6 = Panel(list_item)
line_2 = Line(StartPoint=list_item, EndPoint=list_item_2)
object_bake = ObjectBake(
    BakeToggle=Slider(1, range=0..1),
    GeometryObjects=line_2,
    Layer="GH_Bake",
    ObjectName="GH_Obj",
    ObjectColor=RGB(255, 255, 255),
    LayerColor=RGB(255, 255, 255))
