# Grasshopper definition ParamsGeometry002.gh (Grasshopper 1.0.7)
# Copyright: Wickerson Studios
# plug-ins: KUKA|prc - parametric robot control, PlanktonGh, Bifocals

# 1001 GRASSHOPPER DEFINITIONS
# Wickerson Studio
# 
# created by: Michael Wickerson
# 
# Grasshopper for Rhino 3D Algorithmic Modeling
# 
# www.wickersonstudios.com
# www.michaelwickerson.com
# https://www.youtube.com/channel/UC7J48Ppcsa6oncp6d29R0xw
# https://github.com/mwickerson
# https://www.facebook.com/michael.wickerson
# https://www.linkedin.com/in/michael-wickerson-696a80156/
# https://www.grasshopper3d.com/profile/MichaelWickerson
image_sampler = ImageSampler(
    FilePath="C:\Users\Sculpture\Documents\2020Grasshopper\ScreenShots2019\Screenshots2020\SurfaceEditAlgorithm.PNG",
    Filter="Value",
    Interpolate=False,
    Umax=1,
    Umin=0,
    Vmax=1,
    Vmin=0,
    Wrap=1)

# ----
# Wickerson Studio
# created by: Michael Wickerson
# Grasshopper for Rhino 3D Algorithmic Modeling
# www.wickersonstudios.com
# www.michaelwickerson.com
# https://www.youtube.com/channel/UC7J48Ppcsa6oncp6d29R0xw
# https://github.com/mwickerson
# https://www.facebook.com/michael.wickerson
# https://www.linkedin.com/in/michael-wickerson-696a80156/
# https://www.grasshopper3d.com/profile/MichaelWickerson
circular_arc = CircularArc()

curve = Curve()

line = Line()

geometry_pipeline = GeometryPipeline(
    GroupByLayer=False,
    GroupByType=False,
    IncludeHidden=True,
    IncludeLocked=True,
    LayerFilter="*",
    NameFilter="*",
    SublayerFiltering=True,
    TypeFilter=0)
geometry_cache = GeometryCache(MaintainReferences=False)
plane = Plane()
rectangle = Rectangle()
brep = Brep()
mesh_face = MeshFace()
planktonmesh = PlanktonMesh()
twisted_box = TwistedBox()
field = Field()
group = Group()
transform = Transform()
box = Box()
mesh = Mesh()
surface = Surface()
geometry = Geometry()
domain = Domain()
boolean = Boolean()
integer = Integer()
number = Number()
text = Text()
colour = Colour()
complex = Complex()
culture = Culture()
domain² = Domain²()
guid = Guid()
matrix = Matrix()
time = Time()
data = Data()
data_path = DataPath()
file_path = FilePath()
kuka_prc_command = KUKAPrcCommand()
shader = Shader()

# ----
# Params Geometry 002/1001
number_slider = Slider(1.29, range=0..2)
construct_domain = ConstructDomain(DomainStart=0, DomainEnd=Slider(12, range=0..100))
xy_plane = XYPlane(Origin=Point(0, 0, 0))
xz_plane = XZPlane(Origin=Point(0, 0, 0))
yz_plane = YZPlane(Origin=Point(0, 0, 0))
pi = Pi(Factor=number_slider)
number_slider_2 = Slider(2.75, range=0..10)
range = Range(Domain=construct_domain, Steps=10)
merge = Merge(Data1=xy_plane, Data2=xz_plane, Data3=yz_plane)
sine = Sine(Value=range)
cosine = Cosine(Value=range)
multiplication = Multiplication(A=sine, B=number_slider_2)
multiplication_2 = Multiplication(A=cosine, B=number_slider_2)
number_slider_3 = Slider(4, range=0..10)
arc = Arc(Plane=merge, Radius=Slider(3.76, range=0..10), Angle=pi)  # -> Arc, Length
construct_point = ConstructPoint(XCoordinate=range, YCoordinate=multiplication, ZCoordinate=multiplication_2)
construct_point_2 = ConstructPoint(XCoordinate=range, YCoordinate=cosine, ZCoordinate=sine)
yz_plane_2 = YZPlane(Origin=Point(0, 0, 0))
interpolate = Interpolate(Vertices=construct_point, Degree=3, Periodic=False, KnotStyle=1)  # -> Curve, Length, Domain
curve_closest_point = CurveClosestPoint(Point=construct_point, Curve=reparameterize(interpolate.Curve))  # -> Point, Parameter, Distance
interpolate_2 = Interpolate(Vertices=construct_point_2, Degree=3, Periodic=False, KnotStyle=1)  # -> Curve, Length, Domain
curve_closest_point_2 = CurveClosestPoint(Point=construct_point_2, Curve=reparameterize(interpolate_2.Curve))  # -> Point, Parameter, Distance
line_2 = Line(StartPoint=curve_closest_point.Point, EndPoint=curve_closest_point_2.Point)
line_3 = Line(line_2)
loft = Loft(Curves=line_3, Options={Adjust=False, Closed=False, LoftEnds=0, LoftSimp=0, LoftType=0, Rebuild=10, Refit=0.01})
md_slider = MDSlider(SliderMode=0, slider_value=Point(0.5, 0.5, 0.5), x_domain=Domain(0, 1), y_domain=Domain(0, 1), z_domain=Domain(0, 1))
md_slider_2 = MDSlider(SliderMode=0, slider_value=Point(0.5, 0.5, 0.5), x_domain=Domain(0, 1), y_domain=Domain(0, 1), z_domain=Domain(0, 1))
evaluate_surface = EvaluateSurface(Surface=loft, Point=md_slider)  # -> Point, Normal, UDirection, VDirection, Frame
point = Point(evaluate_surface.Point)
vector_display = VectorDisplay(Anchor=point, Vector=evaluate_surface.Normal)
vector_display_2 = VectorDisplay(Anchor=point, Vector=evaluate_surface.UDirection)
vector_display_3 = VectorDisplay(Anchor=point, Vector=evaluate_surface.VDirection)
plane_2 = Plane(evaluate_surface.Frame)

circular_arc_2 = CircularArc(flatten(arc.Arc))

curve_2 = Curve(interpolate.Curve)
curve_3 = Curve(interpolate_2.Curve)

multiple_curves = MultipleCurves(Curves=reparameterize(circular_arc_2))  # -> Points, IndexA, IndexB, ParamA, ParamB
point_2 = Point(multiple_curves.Points)
polar_array = PolarArray(Geometry=curve_2, Plane=yz_plane_2, Count=number_slider_3, Angle=6.283185307)  # -> Geometry, Transform
polar_array_2 = PolarArray(Geometry=curve_3, Plane=yz_plane_2, Count=number_slider_3, Angle=6.283185307)  # -> Geometry, Transform
panel = Panel(multiple_curves.IndexA)
panel_2 = Panel(multiple_curves.ParamA)
loft_2 = Loft(
    Curves=[curve_2, curve_3],
    Options={Adjust=False, Closed=False, LoftEnds=0, LoftSimp=0, LoftType=0, Rebuild=10, Refit=0.01})
panel_3 = Panel(multiple_curves.IndexB)
panel_4 = Panel(multiple_curves.ParamB)
evaluate_surface_2 = EvaluateSurface(Surface=loft_2, Point=md_slider_2)  # -> Point, Normal, UDirection, VDirection, Frame
point_3 = Point(evaluate_surface_2.Point)
vector_display_4 = VectorDisplay(Anchor=point_3, Vector=evaluate_surface_2.Normal)
vector_display_5 = VectorDisplay(Anchor=point_3, Vector=evaluate_surface_2.UDirection)
vector_display_6 = VectorDisplay(Anchor=point_3, Vector=evaluate_surface_2.VDirection)
plane_3 = Plane(evaluate_surface_2.Frame)

curve_4 = Curve(polar_array.Geometry)
curve_5 = Curve(polar_array_2.Geometry)

loft_3 = Loft(
    Curves=[curve_4, curve_5],
    Options={Adjust=False, Closed=False, LoftEnds=0, LoftSimp=0, LoftType=0, Rebuild=10, Refit=0.01})
