# Grasshopper definition ParamsGeometry003.gh (Grasshopper 1.0.7)
# Copyright: Wickerson Studios
# plug-ins: KUKA|prc - parametric robot control, PlanktonGh, Bifocals

# 1001 GRASSHOPPER DEFINITIONS
# Wickerson Studio
# 
# created by: Michael Wickerson
# 
# Grasshopper for Rhino 3D Algorithmic Modeling
# 
# www.wickersonstudios.com
# www.michaelwickerson.com
# https://www.youtube.com/channel/UC7J48Ppcsa6oncp6d29R0xw
# https://github.com/mwickerson
# https://www.facebook.com/michael.wickerson
# https://www.linkedin.com/in/michael-wickerson-696a80156/
# https://www.grasshopper3d.com/profile/MichaelWickerson
image_sampler = ImageSampler(
    FilePath="C:\Users\Sculpture\Documents\2020Grasshopper\ScreenShots2019\Screenshots2020\SurfaceEditAlgorithm.PNG",
    Filter="Value",
    Interpolate=False,
    Umax=1,
    Umin=0,
    Vmax=1,
    Vmin=0,
    Wrap=1)

# ----
# Params Geometry 003/1001
# Wickerson Studio
# created by: Michael Wickerson
# Grasshopper for Rhino 3D Algorithmic Modeling
# www.wickersonstudios.com
# www.michaelwickerson.com
# https://www.youtube.com/channel/UC7J48Ppcsa6oncp6d29R0xw
# https://github.com/mwickerson
# https://www.facebook.com/michael.wickerson
# https://www.linkedin.com/in/michael-wickerson-696a80156/
# https://www.grasshopper3d.com/profile/MichaelWickerson
plane = Plane()

rectangle = Rectangle()

box = Box()

construct_domain = ConstructDomain(DomainStart=0, DomainEnd=Slider(10, range=0..10))
number_slider = Slider(1.77, range=0..2)
rectangle_2 = Rectangle(Plane=PlaneXY(0, 0, 0), XSize=Domain(-1, 1), YSize=Domain(-2, 2), Radius=0)  # -> Rectangle, Length
construct_point = ConstructPoint(XCoordinate=Slider(1.03, range=0..10), YCoordinate=Slider(3, range=0..10), ZCoordinate=Slider(10, range=0..10))
construct_point_2 = ConstructPoint(XCoordinate=0, YCoordinate=0, ZCoordinate=0)
range = Range(Domain=construct_domain, Steps=10)
xy_plane = XYPlane(Origin=Point(0, 0, 0))
rectangle_3 = Rectangle(Plane=PlaneXY(0, 0, 0), XSize=Slider(10, range=0..10), YSize=Slider(9.28, range=0..10), Radius=Slider(2.72, range=0..4))  # -> Rectangle, Length
construct_domain_2 = ConstructDomain(DomainStart=0, DomainEnd=number_slider)
unit_z = UnitZ(Factor=range)
box_rectangle = BoxRectangle(Rectangle=rectangle_2.Rectangle, Height=Domain(0, 10))
box_2pt = Box2Pt(PointA=construct_point_2, PointB=construct_point, Plane=PlaneXY(0, 0, 0))
domain_box = DomainBox(Base=PlaneXY(0, 0, 0), X=Domain(-2, 2), Y=Domain(-0.5, 0.5), Z=Domain(0, 0.25))
center_box = CenterBox(Base=PlaneXY(0, 0, 0), X=1, Y=1, Z=1)
explode = Explode(Curve=rectangle_3.Rectangle, Recursive=True)  # -> Segments, Vertices
rectangle_4 = Rectangle(rectangle_3.Rectangle)
range_2 = Range(Domain=construct_domain_2, Steps=10)
move = Move(Geometry=xy_plane, Motion=unit_z)  # -> Geometry, Transform
unit_z_2 = UnitZ(Factor=Slider(0, range=0..100))

box_2 = Box(box_2pt)
box_3 = Box(box_rectangle)
box_4 = Box(center_box)
box_5 = Box(domain_box)

list_item = ListItem(List=explode.Vertices, Index=0, Wrap=True)  # -> Item, Item1, Item2, Item3, Item4, Item5, Item6, Item7
list_item_2 = ListItem(List=explode.Segments, Index=0, Wrap=True)  # -> Item, Item1, Item2, Item3, Item4, Item5, Item6, Item7
pi = Pi(Factor=range_2)
align_planes = AlignPlanes(Planes=move.Geometry)
construct_domain_3 = ConstructDomain(DomainStart=0, DomainEnd=number_slider)
unit_x = UnitX(Factor=1)
unit_y = UnitY(Factor=1)
move_2 = Move(Geometry=box_2, Motion=unit_z_2)  # -> Geometry, Transform
unit_z_3 = UnitZ(Factor=1)
line = Line(StartPoint=list_item.Item7, EndPoint=list_item.Item4)
line_2 = Line(StartPoint=list_item.Item, EndPoint=list_item.Item3)
line_3 = Line(StartPoint=list_item.Item2, EndPoint=list_item.Item5)
line_4 = Line(StartPoint=list_item.Item1, EndPoint=list_item.Item6)
xz_plane = XZPlane(Origin=Point(0, 0, 0))
curve = Curve(list_item_2.Item3)
curve_2 = Curve(list_item_2.Item7)
curve_3 = Curve(list_item_2.Item1)
curve_4 = Curve(list_item_2.Item5)
volume = Volume(Geometry=move_2.Geometry)  # -> Volume, Centroid
pi_2 = Pi(Factor=Slider(0.41, range=0..2))
range_3 = Range(Domain=construct_domain_3, Steps=10)
merge = Merge(Data1=curve_3, Data2=curve, Data3=curve_4, Data4=curve_2, Data5=line, Data6=line_2, Data7=line_3, Data8=line_4)  # -> flatten(Result)
merge_2 = Merge(Data1=unit_y, Data2=unit_x, Data3=unit_z_3)
pi_3 = Pi(Factor=range_3)
rotate_3d = Rotate3D(Geometry=move_2.Geometry, Angle=pi_2, Center=volume.Centroid, Axis=merge_2)  # -> Geometry, Transform
rotate_3d_2 = Rotate3D(Geometry=align_planes, Angle=range_3, Center=Point(0, 0, 0), Axis=xz_plane)  # -> Geometry, Transform
boundary_surfaces = BoundarySurfaces(Edges=merge)  # -> flatten(Surfaces)
bounding_box = BoundingBox(Content=graft(rotate_3d.Geometry), Plane=PlaneXY(0, 0, 0), UnionBox=False)  # -> Box, Box_2
bounding_box_2 = BoundingBox(Content=rotate_3d.Geometry, Plane=PlaneXY(0, 0, 0), UnionBox=True)  # -> Box, Box_2
dispatch = Dispatch(List=boundary_surfaces, DispatchPattern=[True, False])  # -> ListA, ListB
rotate_plane = RotatePlane(Plane=rotate_3d_2.Geometry, Angle=pi)
xz_plane_2 = XZPlane(Origin=Point(0, 0, 0))
number_slider_2 = Slider(1, range=0..1)

box_6 = Box(bounding_box.Box)
box_7 = Box(bounding_box_2.Box)

deconstruct_plane = DeconstructPlane(Plane=rotate_plane)  # -> Origin, XAxis, YAxis, ZAxis
geometry = Geometry(dispatch.ListA)
geometry_2 = Geometry(dispatch.ListB)
deconstruct_brep = DeconstructBrep(Brep=box_6)  # -> Faces, Edges, Vertices
arc = Arc(Plane=xz_plane_2, Radius=Slider(4.824, range=0..10), Angle=Domain(0, 3.141592654))  # -> Arc, Length
region_union = RegionUnion(Curves=[geometry, geometry_2])
line_sdl = LineSDL(Start=deconstruct_plane.Origin, Direction=deconstruct_plane.XAxis, Length=Slider(40, range=0..100))
vector_xyz = VectorXYZ(XComponent=number_slider_2, YComponent=number_slider_2, ZComponent=number_slider_2)  # -> Vector, Length
boundary_surfaces_2 = BoundarySurfaces(Edges=region_union)
list_item_3 = ListItem(List=deconstruct_brep.Faces, Index=Slider(5, range=0..10), Wrap=True)
bend_deform = BendDeform(Geometry=rotate_3d.Geometry, BendingArc=arc.Arc)
end_points = EndPoints(Curve=line_sdl)  # -> Start, End
area = Area(Geometry=list_item_3)  # -> Area, Centroid
move_3 = Move(Geometry=end_points.End, Motion=vector_xyz.Vector)  # -> Geometry, Transform
circle = Circle(Plane=PlaneXY(0, 0, 0), Radius=Slider(12, range=0..100))

cylinder = Cylinder(Base=rotate_plane, Radius=end_points.Start, Length=move_3.Geometry)
quad_sphere = QuadSphere(Base=rotate_plane, Radius=end_points.Start)
cone = Cone(Base=rotate_plane, Radius=end_points.Start, Length=move_3.Geometry)  # -> Cone, Tip
cap_holes = CapHoles(Brep=cylinder)
center_box_2 = CenterBox(Base=rotate_plane, X=end_points.Start, Y=move_3.Geometry, Z=1)

horizontal_frames = HorizontalFrames(Curve=circle, Count=10)  # -> Frames, Parameters
perp_frames = PerpFrames(Curve=circle, Count=10, Align=True)  # -> Frames, Parameters

box_2pt_2 = Box2Pt(PointA=end_points.Start, PointB=move_3.Geometry, Plane=rotate_plane)
loft = Loft(Curves=line_sdl, Options={Adjust=False, Closed=False, LoftEnds=0, LoftSimp=0, LoftType=0, Rebuild=10, Refit=0.01})
merge_3 = Merge(Data1=loft, Data2=quad_sphere)
orient = Orient(Geometry=box_6, Source=area.Centroid, Target=perp_frames.Frames)  # -> Geometry, Transform
unit_x_2 = UnitX(Factor=Slider(22, range=0..100))
move_4 = Move(Geometry=merge_3, Motion=unit_x_2)  # -> Geometry, Transform
mirror = Mirror(Geometry=move_4.Geometry, Plane=PlaneYZ(0, 0, 0))  # -> Geometry, Transform
merge_4 = Merge(Data1=move_4.Geometry, Data2=mirror.Geometry)

plane_2 = Plane(rotate_plane)

geometry_pipeline = GeometryPipeline(
    GroupByLayer=False,
    GroupByType=False,
    IncludeHidden=True,
    IncludeLocked=True,
    LayerFilter="*",
    NameFilter="*",
    SublayerFiltering=True,
    TypeFilter=0)
geometry_cache = GeometryCache(MaintainReferences=False)
brep = Brep()
mesh = Mesh()
mesh_face = MeshFace()
planktonmesh = PlanktonMesh()
surface = Surface()
twisted_box = TwistedBox()
field = Field()
geometry_3 = Geometry()
group = Group()
transform = Transform()
boolean = Boolean()
colour = Colour()
culture = Culture()
domain = Domain()
domain² = Domain²()
guid = Guid()
data = Data()
data_path = DataPath()
file_path = FilePath()
shader = Shader()
integer = Integer()
number = Number()
text = Text()
complex = Complex()
matrix = Matrix()
time = Time()
kuka_prc_command = KUKAPrcCommand()
