# Grasshopper definition ParamsGeometry004.gh (Grasshopper 1.0.7)
# Copyright: Wickerson Studios
# plug-ins: Pufferfish, KUKA|prc - parametric robot control, PlanktonGh, Bifocals

# 1001 GRASSHOPPER DEFINITIONS
# Wickerson Studio
# 
# created by: Michael Wickerson
# 
# Grasshopper for Rhino 3D Algorithmic Modeling
# 
# www.wickersonstudios.com
# www.michaelwickerson.com
# https://www.youtube.com/channel/UC7J48Ppcsa6oncp6d29R0xw
# https://github.com/mwickerson
# https://www.facebook.com/michael.wickerson
# https://www.linkedin.com/in/michael-wickerson-696a80156/
# https://www.grasshopper3d.com/profile/MichaelWickerson
image_sampler = ImageSampler(
    FilePath="C:\Users\Sculpture\Documents\2020Grasshopper\ScreenShots2019\Screenshots2020\SurfaceEditAlgorithm.PNG",
    Filter="Value",
    Interpolate=False,
    Umax=1,
    Umin=0,
    Vmax=1,
    Vmin=0,
    Wrap=1)

# ----
# Params Geometry 004/1001
# Wickerson Studio
# created by: Michael Wickerson
# Grasshopper for Rhino 3D Algorithmic Modeling
# www.wickersonstudios.com
# www.michaelwickerson.com
# https://www.youtube.com/channel/UC7J48Ppcsa6oncp6d29R0xw
# https://github.com/mwickerson
# https://www.facebook.com/michael.wickerson
# https://www.linkedin.com/in/michael-wickerson-696a80156/
# https://www.grasshopper3d.com/profile/MichaelWickerson
brep = Brep()

geometry_pipeline = GeometryPipeline(
    GroupByLayer=False,
    GroupByType=False,
    IncludeHidden=True,
    IncludeLocked=True,
    LayerFilter="*",
    NameFilter="*",
    SublayerFiltering=True,
    TypeFilter=0)
geometry_cache = GeometryCache(MaintainReferences=False)

mesh = Mesh()

planktonmesh = PlanktonMesh()
mesh_face = MeshFace()
surface = Surface()
twisted_box = TwistedBox()
field = Field()
geometry = Geometry()
group = Group()
transform = Transform()
boolean = Boolean()
colour = Colour()
culture = Culture()
domain = Domain()
domain² = Domain²()
guid = Guid()
data = Data()
data_path = DataPath()
file_path = FilePath()
shader = Shader()
integer = Integer()
number = Number()
text = Text()
complex = Complex()
matrix = Matrix()
time = Time()
kuka_prc_command = KUKAPrcCommand()

mesh_plane = MeshPlane(Boundary={Plane=PlaneXY(0, 0, 0), Size=Domain2(u=-10..10, v=-10..10)}, WidthCount=10, HeightCount=10)  # -> Mesh, Area
mesh_sphere = MeshSphere(Base=PlaneXY(0, 0, 0), Radius=10, UCount=10, VCount=20)
number_slider = Slider(1, range=0..1)
gene_pool = GenePool(
    Decimals=2,
    Maximum=1,
    Minimum=0,
    Value=[0.182976042, 0.1401476139, 0.7737346593, 0.55, 0.02244124097, 0.939633118, 0.9401333695, 0.8215368282, 0.6812063468, 0.283459026])
gene_pool_2 = GenePool(
    Decimals=2,
    Maximum=10,
    Minimum=0,
    Value=[5.639065534, 9.693311251, 1.946302717, 4.441258566, 7.987217428, 9.889837179, 1.087543949, 1.403620576, 1.835409085, 7.34889525])
number_slider_2 = Slider(1.99, range=0..10)
circle = Circle(Plane=PlaneXY(0, 0, 0), Radius=1)
sphere = Sphere(Base=PlaneXY(0, 0, 0), Radius=number_slider)
brep_2 = Brep(mesh_plane.Mesh)
brep_3 = Brep(mesh_sphere)
boundary_surfaces = BoundarySurfaces(Edges=circle)
division = Division(A=number_slider, B=Slider(2, range=0..10))
unit_z = UnitZ(Factor=Slider(0.55, range=0..1))
unit_z_2 = UnitZ(Factor=gene_pool)
mesh_2 = Mesh(mesh_sphere)
mesh_3 = Mesh(mesh_plane.Mesh)
unit_z_3 = UnitZ(Factor=gene_pool_2)
unit_x = UnitX(Factor=Slider(0.87, range=0..1))
brep_4 = Brep(boundary_surfaces)
brep_5 = Brep(circle)
sphere_2 = Sphere(Base=PlaneXY(0, 0, 0), Radius=division)
brep_6 = Brep(sphere)
move = Move(Geometry=brep_5, Motion=unit_z)  # -> Geometry, Transform
move_2 = Move(Geometry=brep_5, Motion=unit_z_2)  # -> Geometry, Transform
mesh_4 = Mesh(circle)
mesh_5 = Mesh(sphere)
move_3 = Move(Geometry=mesh_3, Motion=unit_z_3)  # -> Geometry, Transform
move_4 = Move(Geometry=sphere_2, Motion=unit_x)  # -> Geometry, Transform
split_brep = SplitBrep(Brep=brep_6, Cutter=move.Geometry)  # -> flatten(Result)
split_brep_multiple = SplitBrepMultiple(Brep=brep_6, Cutters=move_2.Geometry)  # -> flatten(Result)
polar_array = PolarArray(Geometry=move_4.Geometry, Plane=PlaneXY(0, 0, 0), Count=Slider(4, range=0..10), Angle=6.283185307)  # -> Geometry, Transform
dispatch = Dispatch(List=split_brep_multiple, DispatchPattern=[True, False])  # -> ListA, ListB
dispatch_2 = Dispatch(List=split_brep, DispatchPattern=[True, False])  # -> ListA, ListB
mesh_split = MeshSplit(Mesh=mesh_2, Splitters=move_3.Geometry)  # -> flatten(Result)
solid_intersection = SolidIntersection(BrepsA=brep_6, BrepsB=brep_5)
solid_difference = SolidDifference(BrepsA=brep_6, BrepsB=brep_5)
solid_union = SolidUnion(Breps=[brep_6, move.Geometry])
trim_solid = TrimSolid(Shape=brep_6, Cutters=polar_array.Geometry)
dispatch_3 = Dispatch(List=mesh_split, DispatchPattern=[True, False])  # -> ListA, ListB
mesh_difference = MeshDifference(MeshesA=mesh_2, MeshesB=mesh_3)
mesh_intersection = MeshIntersection(MeshesA=mesh_2, MeshesB=mesh_3)
mesh_union = MeshUnion(Meshes=[mesh_2, mesh_3])
cap_holes = CapHoles(Brep=trim_solid)

negative = Negative(Value=unit_z_3)

brep_7 = Brep(solid_difference)
brep_8 = Brep(solid_intersection)
brep_9 = Brep(solid_union)
brep_10 = Brep(dispatch_2.ListA)
brep_11 = Brep(dispatch_2.ListB)
brep_12 = Brep(dispatch.ListA)
brep_13 = Brep(dispatch.ListB)

mesh_6 = Mesh(mesh_difference)
mesh_7 = Mesh(mesh_union)
mesh_8 = Mesh(dispatch_3.ListA)
mesh_9 = Mesh(mesh_intersection)
mesh_10 = Mesh(dispatch_3.ListB)

cap_holes_2 = CapHoles(Brep=brep_12)
cap_holes_3 = CapHoles(Brep=brep_13)
close_mesh = CloseMesh(Mesh=mesh_10, Quadrangulate=True)  # -> Closed, Amount, Openings, ResultBoolean
close_mesh_2 = CloseMesh(Mesh=mesh_8, Quadrangulate=True)  # -> Closed, Amount, Openings, ResultBoolean
