# Grasshopper definition ParamsGeometry005.gh (Grasshopper 1.0.7)
# Copyright: Wickerson Studios
# plug-ins: KUKA|prc - parametric robot control, PlanktonGh, Bifocals, Weaverbird, Leopard version 0a1

# 1001 GRASSHOPPER DEFINITIONS
# Wickerson Studio
# 
# created by: Michael Wickerson
# 
# Grasshopper for Rhino 3D Algorithmic Modeling
# 
# www.wickersonstudios.com
# www.michaelwickerson.com
# https://www.youtube.com/channel/UC7J48Ppcsa6oncp6d29R0xw
# https://github.com/mwickerson
# https://www.facebook.com/michael.wickerson
# https://www.linkedin.com/in/michael-wickerson-696a80156/
# https://www.grasshopper3d.com/profile/MichaelWickerson
image_sampler = ImageSampler(
    FilePath="C:\Users\Sculpture\Documents\2020Grasshopper\ScreenShots2019\Screenshots2020\SurfaceEditAlgorithm.PNG",
    Filter="Value",
    Interpolate=False,
    Umax=1,
    Umin=0,
    Vmax=1,
    Vmin=0,
    Wrap=1)
geometry_pipeline = GeometryPipeline(
    GroupByLayer=False,
    GroupByType=False,
    IncludeHidden=True,
    IncludeLocked=True,
    LayerFilter="*",
    NameFilter="*",
    SublayerFiltering=True,
    TypeFilter=0)
geometry_cache = GeometryCache(MaintainReferences=False)
surface = Surface()
twisted_box = TwistedBox()
field = Field()
geometry = Geometry()
group = Group()
transform = Transform()

# ----
# Wickerson Studio
# created by: Michael Wickerson
# Grasshopper for Rhino 3D Algorithmic Modeling
# www.wickersonstudios.com
# www.michaelwickerson.com
# https://www.youtube.com/channel/UC7J48Ppcsa6oncp6d29R0xw
# https://github.com/mwickerson
# https://www.facebook.com/michael.wickerson
# https://www.linkedin.com/in/michael-wickerson-696a80156/
# https://www.grasshopper3d.com/profile/MichaelWickerson
mesh_face = MeshFace()

planktonmesh = PlanktonMesh()

weaverbird_s_catmull_clark_subdivision = WeaverbirdsCatmullClarkSubdivision(Level=1, SmoothNakedEdges=1)
matrix = Matrix()
data_path = DataPath()
shader = Shader()
domain² = Domain²()
culture = Culture()
boolean = Boolean()
colour = Colour()
data = Data()
integer = Integer()
number = Number()
text = Text()
complex = Complex()
kuka_prc_command = KUKAPrcCommand()
guid = Guid()
time = Time()
domain = Domain()
file_path = FilePath()
import_pdb = ImportPDB()  # -> Atoms, Bonds

number_slider = Slider(5, range=0..100)
number_slider_2 = Slider(18, range=0..100)
number_slider_3 = Slider(57, range=0..100)
number_slider_4 = Slider(31, range=0..100)
number_slider_5 = Slider(5, range=0..10)
number_slider_6 = Slider(10, range=0..100)
number_slider_7 = Slider(66, range=0..100)
rectangle = Rectangle(Plane=PlaneXY(0, 0, 0), XSize=number_slider_2, YSize=number_slider_2, Radius=0)  # -> Rectangle, Length
rectangle_2 = Rectangle(Plane=PlaneXY(0, 0, 0), XSize=number_slider_3, YSize=number_slider_3, Radius=0)  # -> Rectangle, Length
rectangle_3 = Rectangle(Plane=PlaneXY(0, 0, 0), XSize=number_slider, YSize=number_slider, Radius=0)  # -> Rectangle, Length
mesh_sphere = MeshSphere(Base=PlaneXY(0, 0, 0), Radius=10, UCount=10, VCount=20)
mesh_plane = MeshPlane(Boundary=rectangle_3.Rectangle, WidthCount=10, HeightCount=10)  # -> Mesh, Area
populate_2d = Populate2D(Region=rectangle_3.Rectangle, Count=Slider(2, range=0..10), Seed=1)
planktonmesh_2 = PlanktonMesh(mesh_sphere)
leopard_s_catmullclark_subdivision = LeopardsCatmullClarkSubdivision(Mesh=planktonmesh_2, Level=Slider(0, range=0..3), Mode=0)
panel = Panel(leopard_s_catmullclark_subdivision)
leopard_s_vertices = LeopardsVertices(Mesh=leopard_s_catmullclark_subdivision)  # -> VertexPoints, VectorNormal, VertexNakedPoints, VertexNakedPointsIndex, VertexClosedPoints, VertexClosedPointsIndex
leopard_s_faces = LeopardsFaces(Mesh=leopard_s_catmullclark_subdivision)  # -> FaceCenters, FaceBoundaryCurves, NakedFaces, NakedFacesIndices, ClosedFaces, ClosedFacesIndices
leopard_s_edges = LeopardsEdges(Mesh=leopard_s_catmullclark_subdivision)  # -> Edges, NakedEdges, NakedEdgesIndices, ClosedEdges, ClosedEdgesIndices
leopard_s_dualmesh = LeopardsDualMesh(Mesh=leopard_s_catmullclark_subdivision)
panel_2 = Panel(leopard_s_dualmesh)

planktonmesh_3 = PlanktonMesh(mesh_plane.Mesh)

planktonfrompoints = PlanktonFromPoints(PMesh=planktonmesh_3, Vertices=populate_2d)
leopard_s_selectmeshedges = LeopardsSelectMeshEdges(Mesh=planktonmesh_3, lock=False, maintain=False, order=False)  # -> Geometry, Index
leopard_s_selectmeshfaces = LeopardsSelectMeshFaces(Mesh=planktonmesh_3, lock=False, maintain=False, order=True)  # -> Geometry, Index
leopard_s_selectmeshvertices = LeopardsSelectMeshVertices(Mesh=planktonmesh_3, lock=False, maintain=False, order=False)  # -> Geometry, Index
deconstructplankton = DeconstructPlankton(PMesh=planktonfrompoints)  # -> Vertex_Points, Vertex_Outgoing_Halfedge, Halfedge_StartVertex, Halfedge_AdjacentFace, Halfedge_NextHalfedge, Halfedge_PrevHalfedge, Halfedge_Pair, Face_Halfedge
point = Point(deconstructplankton.Vertex_Points)
panel_3 = Panel(point)
param_viewer = ParamViewer(deconstructplankton.Vertex_Points)
panel_4 = Panel(deconstructplankton.Vertex_Outgoing_Halfedge)
panel_5 = Panel(deconstructplankton.Halfedge_StartVertex)
panel_6 = Panel(deconstructplankton.Halfedge_AdjacentFace)
panel_7 = Panel(deconstructplankton.Halfedge_NextHalfedge)
panel_8 = Panel(deconstructplankton.Halfedge_PrevHalfedge)
panel_9 = Panel(deconstructplankton.Halfedge_Pair)
panel_10 = Panel(deconstructplankton.Face_Halfedge)

corner_c = CornerC(2)
corner_b = CornerB(1)
# Params Geometry 005/1001
corner_a = CornerA(0)
corner_c_2 = CornerC(2)
corner_d = CornerD(3)
corner_a_2 = CornerA(0)
corner_b_2 = CornerB(1)
faces = Faces({A=0, B=1, C=2, D=3})
vertices = Vertices([Point(0, 0, 0), Point(10, 0, 0), Point(10, 10, 0), Point(0, 10, 0)])
panel_11 = Panel(vertices)
panel_12 = Panel([corner_a, corner_b_2, corner_c_2, corner_d])
panel_13 = Panel([corner_a_2, corner_b, corner_c])
panel_14 = Panel(faces)
mesh_triangle = MeshTriangle(CornerA=corner_a_2, CornerB=corner_b, CornerC=corner_c)
mesh_quad = MeshQuad(CornerA=corner_a, CornerB=corner_b_2, CornerC=corner_c_2, CornerD=corner_d)
construct_mesh = ConstructMesh(Vertices=vertices, Faces=faces)
deconstruct_mesh = DeconstructMesh(Mesh=construct_mesh)  # -> Vertices, Faces, Colours, Normals
panel_15 = Panel(deconstruct_mesh.Normals)
panel_16 = Panel(deconstruct_mesh.Vertices)

mesh_face_2 = MeshFace(mesh_triangle)
mesh_face_3 = MeshFace(mesh_quad)
mesh_face_4 = MeshFace(deconstruct_mesh.Faces)

deconstruct_face = DeconstructFace(Face=mesh_face_4)  # -> CornerA, CornerB, CornerC, CornerD
panel_17 = Panel(mesh_face_3)
panel_18 = Panel(mesh_face_2)
panel_19 = Panel(deconstruct_face.CornerA)
panel_20 = Panel(deconstruct_face.CornerC)
panel_21 = Panel(deconstruct_face.CornerD)
panel_22 = Panel(deconstruct_face.CornerB)
