# Grasshopper definition ParamsGeometry006.gh (Grasshopper 1.0.7)
# Copyright: Wickerson Studios
# plug-ins: Pufferfish, KUKA|prc - parametric robot control, Bifocals

# 1001 GRASSHOPPER DEFINITIONS
# Wickerson Studio
# 
# created by: Michael Wickerson
# 
# Grasshopper for Rhino 3D Algorithmic Modeling
# 
# www.wickersonstudios.com
# www.michaelwickerson.com
# https://www.youtube.com/channel/UC7J48Ppcsa6oncp6d29R0xw
# https://github.com/mwickerson
# https://www.facebook.com/michael.wickerson
# https://www.linkedin.com/in/michael-wickerson-696a80156/
# https://www.grasshopper3d.com/profile/MichaelWickerson
image_sampler = ImageSampler(
    FilePath="C:\Users\Sculpture\Documents\2020Grasshopper\ScreenShots2019\Screenshots2020\SurfaceEditAlgorithm.PNG",
    Filter="Value",
    Interpolate=False,
    Umax=1,
    Umin=0,
    Vmax=1,
    Vmin=0,
    Wrap=1)

# ----
# Params Geometry 006/1001
# Wickerson Studio
# created by: Michael Wickerson
# Grasshopper for Rhino 3D Algorithmic Modeling
# www.wickersonstudios.com
# www.michaelwickerson.com
# https://www.youtube.com/channel/UC7J48Ppcsa6oncp6d29R0xw
# https://github.com/mwickerson
# https://www.facebook.com/michael.wickerson
# https://www.linkedin.com/in/michael-wickerson-696a80156/
# https://www.grasshopper3d.com/profile/MichaelWickerson
surface = Surface()

twisted_box = TwistedBox()

geometry_pipeline = GeometryPipeline(
    GroupByLayer=False,
    GroupByType=False,
    IncludeHidden=True,
    IncludeLocked=True,
    LayerFilter="*",
    NameFilter="*",
    SublayerFiltering=True,
    TypeFilter=0)
geometry_cache = GeometryCache(MaintainReferences=False)
group = Group()
transform = Transform()
field = Field()
geometry = Geometry()

md_slider = MDSlider(
    SliderMode=0,
    slider_value=Point(0.1483628808, 0.7956557855, 0.5),
    x_domain=Domain(0, 1),
    y_domain=Domain(0, 1),
    z_domain=Domain(0, 1))
md_slider_2 = MDSlider(
    SliderMode=0,
    slider_value=Point(0.9403286445, 0.2734226134, 0.5),
    x_domain=Domain(0, 1),
    y_domain=Domain(0, 1),
    z_domain=Domain(0, 1))
md_slider_3 = MDSlider(
    SliderMode=0,
    slider_value=Point(0.5718310629, 0.5087123964, 0.5),
    x_domain=Domain(0, 1),
    y_domain=Domain(0, 1),
    z_domain=Domain(0, 1))

matrix = Matrix()
data_path = DataPath()
shader = Shader()
domain² = Domain²()
culture = Culture()
boolean = Boolean()
colour = Colour()
data = Data()
integer = Integer()
number = Number()
text = Text()
complex = Complex()
kuka_prc_command = KUKAPrcCommand()
guid = Guid()
time = Time()
domain = Domain()
file_path = FilePath()
import_pdb = ImportPDB()  # -> Atoms, Bonds

construct_domain = ConstructDomain(DomainStart=Slider(-100, range=-100..101), DomainEnd=Slider(100, range=-100..101))
number_slider = Slider(36, range=0..50)
plane_surface = PlaneSurface(Plane=PlaneXY(0, 0, 0), XSize=construct_domain, YSize=construct_domain)
surface_2 = Surface(plane_surface)
dimensions = Dimensions(Surface=surface_2)  # -> UDimension, VDimension
division = Division(A=dimensions.UDimension, B=dimensions.VDimension)
area = Area(Geometry=surface_2)  # -> Area, Centroid
multiplication = Multiplication(A=division, B=number_slider)
scale = Scale(Geometry=surface_2, Center=area.Centroid, Factor=Slider(2.72, range=0..5))  # -> Geometry, Transform
integer_2 = Integer(multiplication)
divide_surface = DivideSurface(Surface=surface_2, UCount=integer_2, VCount=number_slider)  # -> flatten(Points), Normals, Parameters
number_slider_2 = Slider(0.241, range=0..2)
number_slider_3 = Slider(0.11, range=0..2)
expression = Expression(x=integer_2, Expression="x+1")
evaluate_surface = EvaluateSurface(Surface=reparameterize(scale.Geometry), Point=[md_slider, md_slider_3, md_slider_2])  # -> Point, Normal, UDirection, VDirection, Frame
distance = Distance(PointA=graft(evaluate_surface.Point), PointB=divide_surface.Points)
expression_2 = Expression(w=graft(Slider(1.363, range=0..2)), t=distance, Expression="sin(w*t)^2")

flip_matrix = FlipMatrix(Data=expression_2)
mass_multiplication = MassMultiplication(Input=flip_matrix)  # -> flatten(Result), PartialResults
mass_addition = MassAddition(Input=flip_matrix)  # -> flatten(Result), PartialResults

multiplication_2 = Multiplication(A=Slider(3.14, range=0..20), B=mass_addition.Result)
unit_z = UnitZ(Factor=multiplication_2)
move = Move(Geometry=divide_surface.Points, Motion=unit_z)  # -> Geometry, Transform
surface_from_points = SurfaceFromPoints(Points=move.Geometry, UCount=expression, Interpolate=False)

surface_3 = Surface(surface_from_points)

number_slider_4 = Slider(41, range=0..100)
center_box = CenterBox(Base=PlaneXY(0, 0, 0), X=Slider(26.68, range=0..100), Y=Slider(12.67, range=0..100), Z=Slider(79.13, range=0..100))
pi = Pi(Factor=Slider(0, range=0..2))
deconstruct_brep = DeconstructBrep(Brep=center_box)  # -> Faces, Edges, Vertices
populate_2d = Populate2D(Region={Plane=PlaneXY(0, 0, 0), Size=Domain2(u=0..20, v=0..10)}, Count=4, Seed=number_slider_4)
populate_2d_2 = Populate2D(Region={Plane=PlaneXY(0, 0, 0), Size=Domain2(u=0..20, v=0..10)}, Count=4, Seed=number_slider_4)
list_item = ListItem(List=deconstruct_brep.Vertices, Index=0, Wrap=True)  # -> Item, Item1, Item2, Item3, Item4, Item5, Item6, Item7
rotate_3d = Rotate3D(Geometry=populate_2d, Angle=pi, Center=Point(0, 0, 0), Axis=Vector(0, 0, 1))  # -> Geometry, Transform
move_2 = Move(Geometry=populate_2d_2, Motion=Vector(0, 0, 10))  # -> Geometry, Transform
average_twisted_box = AverageTwistedBox()
weighted_average_twisted_box = WeightedAverageTwistedBox()
tween_consecutive_twisted_boxes = TweenConsecutiveTwistedBoxes(Factor=0.5, Weighted=False, Degree=3, InterpolationType=0)
tween_through_twisted_boxes = TweenThroughTwistedBoxes(Factor=0.5, Normalized=True, Equalized=False, Weighted=False, Degree=3, InterpolationType=0)
list_item_2 = ListItem(List=rotate_3d.Geometry, Index=0, Wrap=True)  # -> Item, Item1, Item2, Item3
list_item_3 = ListItem(List=move_2.Geometry, Index=0, Wrap=True)  # -> Item, Item1, Item2, Item3
twisted_box_consecutive_curves = TwistedBoxConsecutiveCurves(
    Thickness=2,
    ParametersU=[0, 0.25, 0.5, 0.75, 1],
    ParametersV=[0, 0.25, 0.5, 0.75, 1],
    ParametersW=[0, 0.5, 1],
    Weighted=False,
    InterpolationType=1,
    Refit=0,
    PointSample=0)
twisted_box_surface = TwistedBoxSurface(
    Thickness=2,
    ParametersU=[0, 0.25, 0.5, 0.75, 1],
    ParametersV=[0, 0.25, 0.5, 0.75, 1],
    ParametersW=[0, 0.5, 1],
    Refit=0,
    PointSample=0)
tween_two_twisted_boxes = TweenTwoTwistedBoxes(Factor=0.5)

twisted_box_2 = TwistedBox(
    CornerA=list_item.Item,
    CornerB=list_item.Item1,
    CornerC=list_item.Item2,
    CornerD=list_item.Item3,
    CornerE=list_item.Item4,
    CornerF=list_item.Item5,
    CornerG=list_item.Item6,
    CornerH=list_item.Item7)

twisted_box_3 = TwistedBox(
    CornerA=list_item_2.Item,
    CornerB=list_item_2.Item2,
    CornerC=list_item_2.Item1,
    CornerD=list_item_2.Item3,
    CornerE=list_item_3.Item,
    CornerF=list_item_3.Item2,
    CornerG=list_item_3.Item1,
    CornerH=list_item_3.Item3)

panel = Panel(twisted_box_2)
deconstruct_brep_2 = DeconstructBrep(Brep=twisted_box_3)  # -> Faces, Edges, Vertices
