# Grasshopper definition ParamsGeometry007.gh (Grasshopper 1.0.7)
# Copyright: Wickerson Studios
# plug-ins: KUKA|prc - parametric robot control, Bifocals

# 1001 GRASSHOPPER DEFINITIONS
# Wickerson Studio
# 
# created by: Michael Wickerson
# 
# Grasshopper for Rhino 3D Algorithmic Modeling
# 
# www.wickersonstudios.com
# www.michaelwickerson.com
# https://www.youtube.com/channel/UC7J48Ppcsa6oncp6d29R0xw
# https://github.com/mwickerson
# https://www.facebook.com/michael.wickerson
# https://www.linkedin.com/in/michael-wickerson-696a80156/
# https://www.grasshopper3d.com/profile/MichaelWickerson
image_sampler = ImageSampler(
    FilePath="C:\Users\Sculpture\Documents\2020Grasshopper\ScreenShots2019\Screenshots2020\SurfaceEditAlgorithm.PNG",
    Filter="Value",
    Interpolate=False,
    Umax=1,
    Umin=0,
    Vmax=1,
    Vmin=0,
    Wrap=1)
geometry_pipeline = GeometryPipeline(
    GroupByLayer=False,
    GroupByType=False,
    IncludeHidden=True,
    IncludeLocked=True,
    LayerFilter="*",
    NameFilter="*",
    SublayerFiltering=True,
    TypeFilter=0)

# ----
# Params Geometry 007/1001
# Wickerson Studio
# created by: Michael Wickerson
# Grasshopper for Rhino 3D Algorithmic Modeling
# www.wickersonstudios.com
# www.michaelwickerson.com
# https://www.youtube.com/channel/UC7J48Ppcsa6oncp6d29R0xw
# https://github.com/mwickerson
# https://www.facebook.com/michael.wickerson
# https://www.linkedin.com/in/michael-wickerson-696a80156/
# https://www.grasshopper3d.com/profile/MichaelWickerson
field = Field()

geometry = Geometry()
geometry_cache = GeometryCache(MaintainReferences=False)
group = Group()
transform = Transform()
matrix = Matrix()
data_path = DataPath()
shader = Shader()
domain² = Domain²()
culture = Culture()
boolean = Boolean()
colour = Colour()
data = Data()
integer = Integer()
number = Number()
text = Text()
complex = Complex()
kuka_prc_command = KUKAPrcCommand()
guid = Guid()
time = Time()
domain = Domain()
file_path = FilePath()
import_pdb = ImportPDB()  # -> Atoms, Bonds

circle = Circle(Plane=PlaneXY(0, 0, 0), Radius=Slider(100, range=0..100))
boundary_surfaces = BoundarySurfaces(Edges=circle)
point = Point(Point(14, 48, 0))
point_2 = Point(Point(26, -24, 0))
point_3 = Point(Point(-39, -13, 0))
populate_geometry = PopulateGeometry(Geometry=boundary_surfaces, Count=Slider(13, range=0..100), Seed=1)  # -> flatten(Population)
populate_3d = Populate3D(Region=boundary_surfaces, Count=100, Seed=1)
list_item = ListItem(List=populate_geometry, Index=0, Wrap=True)  # -> Item, Item1, Item2, Item3, Item4, Item5, Item6
merge = Merge(Data1=list_item.Item, Data2=list_item.Item4, Data3=list_item.Item6)
closest_point = ClosestPoint(Point=merge, Cloud=[point_3, point, point_2])  # -> ClosestPoint, CPIndex, Distance
multiplication = Multiplication(A=closest_point.Distance, B=Slider(66, range=0..100))
construct_domain = ConstructDomain(DomainStart=0, DomainEnd=Slider(45.93, range=0..100))

spin_force = SpinForce(Plane=point_3, Strength=1, Radius=Slider(20, range=0..100), Decay=2)
spin_force_2 = SpinForce(Plane=point, Strength=1, Radius=Slider(42.15, range=0..100), Decay=2)
spin_force_3 = SpinForce(Plane=point_2, Strength=1, Radius=Slider(43.45, range=0..100), Decay=2)

merge_fields = MergeFields(Fields=[spin_force, spin_force_2, spin_force_3])

field_2 = Field(merge_fields)

field_line = FieldLine(Field=field_2, Point=merge, Steps=multiplication, Accuracy=0.1, Method=3)
list_length = ListLength(List=field_line)
expression = Expression(x=list_length, Expression="x-1")
range = Range(Domain=construct_domain, Steps=expression)
jitter = Jitter(List=range, Jitter=1, Seed=Slider(60, range=0..100))  # -> Values, Indices
unit_z = UnitZ(Factor=jitter.Values)
move = Move(Geometry=field_line, Motion=unit_z)  # -> flatten(Geometry), Transform
dispatch = Dispatch(List=move.Geometry, DispatchPattern=[True, False])  # -> ListA, ListB
loft = Loft(
    Curves=[dispatch.ListA, dispatch.ListB],
    Options={Adjust=False, Closed=False, LoftEnds=0, LoftSimp=0, LoftType=0, Rebuild=10, Refit=0.01})
