# Grasshopper definition ParamsGeometry008.gh (Grasshopper 1.0.7)
# Copyright: Wickerson Studios
# plug-ins: KUKA|prc - parametric robot control, Bifocals

# 1001 GRASSHOPPER DEFINITIONS
# Wickerson Studio
# 
# created by: Michael Wickerson
# 
# Grasshopper for Rhino 3D Algorithmic Modeling
# 
# www.wickersonstudios.com
# www.michaelwickerson.com
# https://www.youtube.com/channel/UC7J48Ppcsa6oncp6d29R0xw
# https://github.com/mwickerson
# https://www.facebook.com/michael.wickerson
# https://www.linkedin.com/in/michael-wickerson-696a80156/
# https://www.grasshopper3d.com/profile/MichaelWickerson
image_sampler = ImageSampler(
    FilePath="C:\Users\Sculpture\Documents\2020Grasshopper\ScreenShots2019\Screenshots2020\SurfaceEditAlgorithm.PNG",
    Filter="Value",
    Interpolate=False,
    Umax=1,
    Umin=0,
    Vmax=1,
    Vmin=0,
    Wrap=1)

geometry_pipeline = GeometryPipeline(
    GroupByLayer=False,
    GroupByType=False,
    IncludeHidden=True,
    IncludeLocked=True,
    LayerFilter="*",
    NameFilter="*",
    SublayerFiltering=True,
    TypeFilter=1073741885)

geometry_cache = GeometryCache(MaintainReferences=False)

group = Group()

# ----
# Params Geometry 008/1001
# Wickerson Studio
# created by: Michael Wickerson
# Grasshopper for Rhino 3D Algorithmic Modeling
# www.wickersonstudios.com
# www.michaelwickerson.com
# https://www.youtube.com/channel/UC7J48Ppcsa6oncp6d29R0xw
# https://github.com/mwickerson
# https://www.facebook.com/michael.wickerson
# https://www.linkedin.com/in/michael-wickerson-696a80156/
# https://www.grasshopper3d.com/profile/MichaelWickerson
geometry = Geometry()

transform = Transform()

geometry_pipeline_2 = GeometryPipeline(
    GroupByLayer=False,
    GroupByType=False,
    IncludeHidden=True,
    IncludeLocked=True,
    LayerFilter="*",
    NameFilter="*",
    SublayerFiltering=True,
    TypeFilter=32)
geometry_pipeline_3 = GeometryPipeline(
    GroupByLayer=False,
    GroupByType=False,
    IncludeHidden=True,
    IncludeLocked=True,
    LayerFilter="*",
    NameFilter="*",
    SublayerFiltering=True,
    TypeFilter=1)
geometry_pipeline_4 = GeometryPipeline(
    GroupByLayer=False,
    GroupByType=False,
    IncludeHidden=True,
    IncludeLocked=True,
    LayerFilter="*",
    NameFilter="*",
    SublayerFiltering=True,
    TypeFilter=4)
geometry_pipeline_5 = GeometryPipeline(
    GroupByLayer=False,
    GroupByType=False,
    IncludeHidden=True,
    IncludeLocked=True,
    LayerFilter="*",
    NameFilter="*",
    SublayerFiltering=True,
    TypeFilter=1073741848)

matrix = Matrix()
data_path = DataPath()
shader = Shader()
domain² = Domain²()
culture = Culture()
boolean = Boolean()
colour = Colour()
data = Data()
integer = Integer()
number = Number()
text = Text()
complex = Complex()
kuka_prc_command = KUKAPrcCommand()
guid = Guid()
time = Time()
domain = Domain()
file_path = FilePath()
import_pdb = ImportPDB()  # -> Atoms, Bonds

panel = Panel(geometry_pipeline)
construct_point = ConstructPoint(XCoordinate=0, YCoordinate=0, ZCoordinate=0)
circle = Circle(Plane=PlaneXY(0, 0, 0), Radius=1)
construct_plane = ConstructPlane(Origin=Point(0, 0, 0), XAxis=Vector(1, 0, 0), YAxis=Vector(0, 1, 0))
center_box = CenterBox(Base=PlaneXY(0, 0, 0), X=1, Y=1, Z=1)
vector_xyz = VectorXYZ(XComponent=0, YComponent=0, ZComponent=0)  # -> Vector, Length
polygon = Polygon(Plane=PlaneXY(0, 0, 0), Radius=3, Segments=6, FilletRadius=0)  # -> Polygon, Length
radial = Radial(Plane=PlaneXY(0, 0, 0), Size=1, ExtentR=5, ExtentP=20)  # -> Cells, Points
mesh_sphere = MeshSphere(Base=PlaneXY(0, 0, 0), Radius=10, UCount=10, VCount=20)
panel_2 = Panel(geometry_pipeline_3)
panel_3 = Panel(geometry_pipeline_2)
geometry_2 = Geometry(mesh_sphere)
merge = Merge(Data1=geometry_pipeline_3, Data2=geometry_pipeline_4, Data3=geometry_pipeline_5, Data4=geometry_pipeline_2)
shear = Shear(Base=PlaneXY(0, 0, 0), Grip=Point(0, 0, 1), Target=Point(0, 0, 1))  # -> Geometry, Transform
polar_array = PolarArray(Plane=PlaneXY(0, 0, 0), Count=10, Angle=6.283185307)  # -> Geometry, Transform

geometry_3 = Geometry(construct_plane)
geometry_4 = Geometry(polygon.Polygon)
geometry_5 = Geometry(construct_point)
geometry_6 = Geometry(construct_point)
geometry_7 = Geometry(vector_xyz.Vector)
geometry_8 = Geometry(radial.Cells)
geometry_9 = Geometry(circle)
geometry_10 = Geometry(center_box)

group_2 = Group(merge)

merge_2 = Merge(
    Data1=geometry_6,
    Data2=geometry_7,
    Data3=geometry_3,
    Data4=geometry_8,
    Data5=geometry_9,
    Data6=geometry_4,
    Data7=geometry_5,
    Data8=geometry_10,
    Data9=geometry_2)
scale = Scale(Geometry=group_2, Center=Point(0, 0, 0), Factor=0.5)  # -> Geometry, Transform
orient_direction = OrientDirection(Geometry=group_2, PointA=Point(0, 0, 0), DirectionA=Vector(0, 0, 1), PointB=Point(0, 0, 0), DirectionB=Vector(0, 0, 1))  # -> Geometry, Transform
project = Project(Geometry=group_2, Plane=PlaneXY(0, 0, 0))  # -> Geometry, Transform
curve_array = CurveArray(Geometry=group_2, Curve=<geometry referenced from the Rhino model>, Count=10)  # -> Geometry, Transform
linear_array = LinearArray(Geometry=group_2, Direction=Vector(10, 0, 0), Count=10)  # -> Geometry, Transform
move = Move(Geometry=group_2, Motion=Vector(0, 0, 10))  # -> Geometry, Transform
mirror = Mirror(Geometry=group_2, Plane=PlaneYZ(0, 0, 0))  # -> Geometry, Transform
rotate_3d = Rotate3D(Geometry=group_2, Angle=1.570796327, Center=Point(0, 0, 0), Axis=Vector(0, 0, 1))  # -> Geometry, Transform
scale_2 = Scale(Geometry=group_2, Center=Point(0, 0, 0), Factor=0.5)  # -> Geometry, Transform
merge_3 = Merge(
    Data1=scale.Transform,
    Data2=shear.Transform,
    Data3=orient_direction.Transform,
    Data4=project.Transform,
    Data5=curve_array.Transform,
    Data6=linear_array.Transform,
    Data7=linear_array.Transform,
    Data8=polar_array.Geometry,
    Data9=move.Transform,
    Data10=rotate_3d.Transform,
    Data11=mirror.Transform,
    Data12=scale_2.Transform)

geometry_cache_2 = GeometryCache(merge_2, MaintainReferences=False)

transform_2 = Transform(merge_3)

panel_4 = Panel(transform_2)
param_viewer = ParamViewer(transform_2)
