# Grasshopper definition ParamsInputs020.gh (Grasshopper 1.0.7)
# Copyright: Wickerson Studios
# plug-ins: Bifocals

image_sampler = ImageSampler(
    FilePath="C:\Users\Sculpture\Documents\2020Grasshopper\ScreenShots2019\Screenshots2020\SurfaceEditAlgorithm.PNG",
    Filter="Value",
    Interpolate=False,
    Umax=1,
    Umin=0,
    Vmax=1,
    Vmin=0,
    Wrap=1)

# ----
# 1001 GRASSHOPPER DEFINITIONS
# Wickerson Studio
# 
# created by: Michael Wickerson
# 
# Grasshopper for Rhino 3D Algorithmic Modeling
# 
# www.wickersonstudios.com
# www.michaelwickerson.com
# https://www.youtube.com/channel/UC7J48Ppcsa6oncp6d29R0xw
# https://github.com/mwickerson
# https://www.facebook.com/michael.wickerson
# https://www.linkedin.com/in/michael-wickerson-696a80156/
# https://www.grasshopper3d.com/profile/MichaelWickerson
# Params Inputs  020/1001
number_slider = Slider(18, range=-3..31)
# Wickerson Studio
# created by: Michael Wickerson
# Grasshopper for Rhino 3D Algorithmic Modeling
# www.wickersonstudios.com
# www.michaelwickerson.com
# https://www.youtube.com/channel/UC7J48Ppcsa6oncp6d29R0xw
# https://github.com/mwickerson
# https://www.facebook.com/michael.wickerson
# https://www.linkedin.com/in/michael-wickerson-696a80156/
# https://www.grasshopper3d.com/profile/MichaelWickerson
number_slider_2 = Slider(0.41, range=0..1)

boolean_toggle = BooleanToggle(False)
md_slider = MDSlider(
    SliderMode=0,
    slider_value=Point(0.5945226158, 0.5337576517, 0.5),
    x_domain=Domain(0, 1),
    y_domain=Domain(0, 1),
    z_domain=Domain(0, 1))
gene_pool = GenePool(
    Decimals=2,
    Maximum=100,
    Minimum=0,
    Value=[95.07898525, 5.240855648, 22.2709016, 88.01748515, 59.03292683, 7.532103084, 89.70449692, 28.28111296, 70.77448297, 4.425968372])
graph_mapper = GraphMapper(
    Slider(0.25, range=0..1),
    x0=0,
    x1=1,
    y0=0,
    y1=1,
    Ox=0.5,
    Oy=0,
    Px=0.8252315521,
    Py=0.5183309317,
    container_name="Parabola")
panel = Panel(graph_mapper)

panel_2 = Panel(Slider(0.25, range=0..1))

number_slider_3 = Slider(10, range=0..10)
number_slider_4 = Slider(1, range=0..1)
number_slider_5 = Slider(10, range=0..10)
number_slider_6 = Slider(1, range=0..1)
number_slider_7 = Slider(100, range=0..100)
number_slider_8 = Slider(100, range=0..100)
number_slider_9 = Slider(299, range=0..1000)
md_slider_2 = MDSlider(
    SliderMode=0,
    slider_value=Point(0.5945226158, 0.5337576517, 0.5),
    x_domain=Domain(0, 1),
    y_domain=Domain(0, 1),
    z_domain=Domain(0, 1))
gene_pool_2 = GenePool(Decimals=2, Maximum=100, Minimum=0, Value=[50, 50, 50, 50, 50, 50, 50, 50, 50, 50])
boolean_toggle_2 = BooleanToggle(False)
construct_domain = ConstructDomain(DomainStart=0, DomainEnd=1)
divide_domain² = DivideDomain²(UCount=10, VCount=10)
sine = Sine()
pi = Pi(Factor=1)
graph_mapper_2 = GraphMapper(
    Slider(0.215, range=0..1),
    x0=0,
    x1=1,
    y0=0,
    y1=1,
    container_name="Bezier",
    cpx=[0, 0.08058696985, 0.8568018079, 1],
    cpy=[0, 0.6479634047, 0.2421158552, 1])
addition = Addition()
division = Division()
multiplication = Multiplication()
subtraction = Subtraction()
minimum = Minimum()
maximum = Maximum()
larger_than = LargerThan(SecondNumber=0)  # -> LargerThan, OrEqualTo
equality = Equality()  # -> Equality, Inequality
expression = Expression(Expression="Format(\"{0}, {1}\", x, y)")
ghpython_script = GhPythonScript()  # -> Out, A
panel_3 = Panel(graph_mapper_2)

number_slider_10 = Slider(0.25, range=0..1)
number_slider_11 = Slider(1, range=0..1)
number_slider_12 = Slider(2, range=0..10)
number_slider_13 = Slider(1, range=0..1)
number_slider_14 = Slider(123, range=0..1000)
number_slider_15 = Slider(3, range=0..10)
number_slider_16 = Slider(21, range=0..100)
number_slider_17 = Slider(26.89, range=0..100)
boolean_toggle_3 = BooleanToggle(True)
button = Button()
construct_domain_2 = ConstructDomain(DomainStart=Slider(0.519, range=0..3), DomainEnd=number_slider_16)
range = Range(Domain=construct_domain_2, Steps=number_slider_15)
cosine = Cosine(Value=range)
sine_2 = Sine(Value=range)
multiplication_2 = Multiplication(A=cosine, B=number_slider_17)
multiplication_3 = Multiplication(A=sine_2, B=number_slider_17)
graph_mapper_3 = GraphMapper(
    multiplication_2,
    x0=0,
    x1=1,
    y0=0,
    y1=1,
    container_name="Bezier",
    cpx=[0, 0, 0.792116046, 1],
    cpy=[0, 0.0503000617, 0.3419843912, 1])
construct_point = ConstructPoint(XCoordinate=multiplication_3, YCoordinate=graph_mapper_3, ZCoordinate=range)
division_2 = Division(A=range, B=number_slider_16)
larger_than_2 = LargerThan(FirstNumber=multiplication_3, SecondNumber=graph_mapper_3)  # -> LargerThan, OrEqualTo
panel_4 = Panel("""5
8
11
14
17""")
pi_2 = Pi(Factor=division_2)
cull_pattern = CullPattern(List=construct_point, CullPattern=larger_than_2.LargerThan)
cherry_picker = CherryPicker(panel_4, ListIndex=4, TreePath_path="{0}")
construct_plane = ConstructPlane(Origin=cull_pattern, XAxis=Vector(1, 0, 0), YAxis=Vector(0, 1, 0))
panel_5 = Panel(larger_than_2.LargerThan)
rotate_plane = RotatePlane(Plane=construct_plane, Angle=pi_2)
square = Square(Plane=rotate_plane, Size=1, ExtentX=cherry_picker, ExtentY=cherry_picker)  # -> Cells, flatten(Points)
deconstruct = Deconstruct(Point=square.Points)  # -> XComponent, YComponent, ZComponent
maximum_2 = Maximum(A=deconstruct.YComponent, B=deconstruct.ZComponent)
minimum_2 = Minimum(A=deconstruct.XComponent, B=deconstruct.YComponent)
construct_point_2 = ConstructPoint(XCoordinate=maximum_2, YCoordinate=minimum_2, ZCoordinate=deconstruct.XComponent)  # -> graft(Point)
construct_point_3 = ConstructPoint(XCoordinate=minimum_2, YCoordinate=maximum_2, ZCoordinate=deconstruct.XComponent)  # -> graft(Point)
cross_reference = CrossReference(ListA=construct_point_2, ListB=construct_point_3, CrossMode=1)  # -> flatten(ListA), flatten(ListB)
gene_pool_3 = GenePool(Decimals=2, Maximum=1, Minimum=0, Value=[0, 0.23, 0.71, 0.81, 0.93, 1])
md_slider_3 = MDSlider(
    SliderMode=0,
    slider_value=Point(0.7831882384, 0.5996651998, 0.5),
    x_domain=Domain(0, 1),
    y_domain=Domain(0, 1),
    z_domain=Domain(0, 1))
surface_from_points = SurfaceFromPoints(Points=cross_reference.ListB, UCount=9, Interpolate=False)
surface_from_points_2 = SurfaceFromPoints(Points=cross_reference.ListA, UCount=9, Interpolate=False)
range_2 = Range(Domain=Domain(0, 1), Steps=Slider(5, range=0..10))
graph_mapper_4 = GraphMapper(
    range_2,
    x0=0,
    x1=21,
    y0=0,
    y1=21,
    container_name="Bezier",
    cpx=[0, 0, 0.040140789, 1],
    cpy=[0.3026211262, 0.5991812348, 1, 1])
evaluate_surface = EvaluateSurface(Surface=reparameterize([surface_from_points_2, surface_from_points]), Point=md_slider_3)  # -> Point, Normal, UDirection, VDirection, Frame
line_sdl = LineSDL(Start=evaluate_surface.Point, Direction=evaluate_surface.Normal, Length=1)
pipe_variable = PipeVariable(Curve=reparameterize(line_sdl), Parameters=gene_pool_3, Radii=graph_mapper_4, Caps=0)
divide_domain²_2 = DivideDomain²(Domain=pipe_variable, UCount=number_slider_15, VCount=number_slider_15)
isotrim = Isotrim(Surface=pipe_variable, Domain=divide_domain²_2)  # -> flatten(Surface)
geometry = Geometry(isotrim)
list_length = ListLength(List=geometry)
expression_2 = Expression(x=list_length, Expression="x-1")
range_3 = Range(Domain=Domain(0, 1), Steps=expression_2)
multiplication_4 = Multiplication(A=evaluate_surface.Normal, B=range_3)
multiplication_5 = Multiplication(A=multiplication_4, B=Slider(10, range=0..10))
jitter = Jitter(List=multiplication_5, Jitter=1, Seed=2)  # -> Values, Indices
move = Move(Geometry=geometry, Motion=jitter.Values)  # -> Geometry, Transform
geometry_2 = Geometry(move.Geometry)
surface = Surface([surface_from_points_2, surface_from_points])
