# Grasshopper definition ParamsInputs021.gh (Grasshopper 1.0.7)
# Copyright: Wickerson Studios
# plug-ins: Bifocals

# Wickerson Studio
# 
# created by: Michael Wickerson
# 
# Grasshopper for Rhino 3D Algorithmic Modeling
# 
# www.wickersonstudios.com
# www.michaelwickerson.com
# https://www.youtube.com/channel/UC7J48Ppcsa6oncp6d29R0xw
# https://github.com/mwickerson
# https://www.facebook.com/michael.wickerson
# https://www.linkedin.com/in/michael-wickerson-696a80156/
# https://www.grasshopper3d.com/profile/MichaelWickerson
image_sampler = ImageSampler(
    FilePath="C:\Users\Sculpture\Documents\2020Grasshopper\ScreenShots2019\Screenshots2020\SurfaceEditAlgorithm.PNG",
    Filter="Value",
    Interpolate=False,
    Umax=1,
    Umin=0,
    Vmax=1,
    Vmin=0,
    Wrap=1)
number_slider = Slider(66, range=0..100)

md_slider = MDSlider(
    SliderMode=0,
    slider_value=Point(0.5340021387, 0.4905306188, 0.5),
    x_domain=Domain(0, 1),
    y_domain=Domain(0, 1),
    z_domain=Domain(0, 1))
value_list = ValueList({"One": 1, "Two": 2, "Three": 2² - 1, "Four": Sqrt(16)}, selected="Two")
# 1001 GRASSHOPPER DEFINITIONS
# Params Inputs  021/1001
boolean_toggle = BooleanToggle(True)
# Wickerson Studio
# created by: Michael Wickerson
# Grasshopper for Rhino 3D Algorithmic Modeling
# www.wickersonstudios.com
# www.michaelwickerson.com
# https://www.youtube.com/channel/UC7J48Ppcsa6oncp6d29R0xw
# https://github.com/mwickerson
# https://www.facebook.com/michael.wickerson
# https://www.linkedin.com/in/michael-wickerson-696a80156/
# https://www.grasshopper3d.com/profile/MichaelWickerson
number_slider_2 = Slider(0.25, range=0..1)
control_knob = ControlKnob(Decimals=2, Limit=True, Maximum=10, Minimum=0, Range=1, Value=4.12)
digit_scroller = DigitScroller(Scroller_Digits=12, Scroller_Prefix="Digit Scroller", Scroller_Radix=9, Scroller_Value=0.25)

negative = Negative(Value=number_slider)

panel = Panel("""One   = 1
Two   = 2
Three = 2² - 1
Four  = Sqrt(16)""")
panel_2 = Panel(value_list)
panel_3 = Panel(panel)
list_item = ListItem(List=panel_3, Index=Slider(2, range=0..3), Wrap=True)
panel_4 = Panel(list_item)

construct_domain = ConstructDomain(DomainStart=negative, DomainEnd=number_slider)
panel_5 = Panel(Button())
panel_6 = Panel(digit_scroller)
plane_surface = PlaneSurface(Plane=PlaneXY(0, 0, 0), XSize=Domain(-10, 10), YSize=Domain(-10, 10))

value_list_2 = ValueList({"One": 1, "Two": 2, "Three": 2² - 1, "Four": Sqrt(16)}, selected="Four")

plane_surface_2 = PlaneSurface(Plane=PlaneXY(0, 0, 0), XSize=construct_domain, YSize=construct_domain)
evaluate_surface = EvaluateSurface(Surface=reparameterize(plane_surface), Point=md_slider)  # -> Point, Normal, UDirection, VDirection, Frame
divide_domain² = DivideDomain²(Domain=plane_surface_2, UCount=value_list_2, VCount=value_list_2)
divide_surface = DivideSurface(Surface=plane_surface, UCount=evaluate_surface.UDirection, VCount=evaluate_surface.VDirection)  # -> Points, Normals, Parameters
isotrim = Isotrim(Surface=plane_surface_2, Domain=divide_domain²)

md_slider_2 = MDSlider(
    SliderMode=0,
    slider_value=Point(0.270676453, 0.4657280154, 0.5),
    x_domain=Domain(0, 1),
    y_domain=Domain(0, 1),
    z_domain=Domain(0, 1))

digit_scroller_2 = DigitScroller(Scroller_Digits=12, Scroller_Prefix="Digit Scroller", Scroller_Radix=9, Scroller_Value=40.25)

area = Area(Geometry=isotrim)  # -> Area, Centroid
evaluate_surface_2 = EvaluateSurface(Surface=reparameterize(isotrim), Point=md_slider_2)  # -> graft(Point), Normal, UDirection, VDirection, Frame
line_sdl = LineSDL(Start=evaluate_surface_2.Point, Direction=evaluate_surface_2.Normal, Length=digit_scroller_2)
divide_surface_2 = DivideSurface(Surface=plane_surface_2, UCount=evaluate_surface_2.UDirection, VCount=evaluate_surface_2.VDirection)  # -> Points, Normals, Parameters
end_points = EndPoints(Curve=line_sdl)  # -> Start, End
shift_list = ShiftList(List=end_points.End, Shift=1, Wrap=True)
arc_sed = ArcSED(Start=area.Centroid, End=shift_list, Direction=evaluate_surface_2.Normal)  # -> flatten(Arc), Plane, Radius

control_knob_2 = ControlKnob(Decimals=2, Limit=True, Maximum=2, Minimum=0, Range=1, Value=0)

list_length = ListLength(List=arc_sed.Arc)
construct_domain_2 = ConstructDomain(DomainStart=0, DomainEnd=control_knob_2)
evaluate = Evaluate(Expression="x-1", x=list_length)
range = Range(Domain=construct_domain_2, Steps=evaluate)
jitter = Jitter(List=range, Jitter=1, Seed=2)  # -> Values, Indices
rotate_3d = Rotate3D(Geometry=arc_sed.Arc, Angle=jitter.Values, Center=Point(0, 0, 0), Axis=Vector(0, 0, 1))  # -> Geometry, Transform
range_2 = Range(Domain=Domain(0, 1), Steps=10)
graph_mapper = GraphMapper(
    range_2,
    x0=0,
    x1=1,
    y0=0,
    y1=5,
    container_name="Sine Summation",
    Equation0_px=[0.1057978123, 0.2217398435],
    Equation0_py=[0.1130424142, 0.269564867],
    Equation1_px=[0.4176821411, 0.4880601168],
    Equation1_py=[0.05797100067, 0.1202091575])
graph_mapper_2 = GraphMapper(
    range_2,
    x0=0,
    x1=1,
    y0=0,
    y1=10,
    container_name="Sine Summation",
    Equation0_px=[0.2, 0.4669561088],
    Equation0_py=[0.2, 0.6394202113],
    Equation1_px=[0.4176821411, 0.8808699846],
    Equation1_py=[0.05797100067, 0.3782604933])

button = Button()

pipe_variable = PipeVariable(Curve=reparameterize(rotate_3d.Geometry), Parameters=range_2, Radii=graph_mapper, Caps=Toggle(True))  # -> graft(Pipe)
panel_7 = Panel(pipe_variable)
param_viewer = ParamViewer(pipe_variable)
solid_intersection = SolidIntersection(BrepsA=pipe_variable, BrepsB=pipe_variable)  # disabled
geometry = Geometry(solid_intersection)  # disabled
