# Grasshopper definition ParamsInputs023.gh (Grasshopper 1.0.7)
# Copyright: Wickerson Studios
# plug-ins: Firefly.X, Bifocals, goat

image_sampler = ImageSampler(
    FilePath="C:\Users\Sculpture\Documents\2020Grasshopper\ScreenShots2019\Screenshots2020\SurfaceEditAlgorithm.PNG",
    Filter="Value",
    Interpolate=False,
    Umax=1,
    Umin=0,
    Vmax=1,
    Vmin=0,
    Wrap=1)

# ----
# 1001 GRASSHOPPER DEFINITIONS
# Wickerson Studio
# 
# created by: Michael Wickerson
# 
# Grasshopper for Rhino 3D Algorithmic Modeling
# 
# www.wickersonstudios.com
# www.michaelwickerson.com
# https://www.youtube.com/channel/UC7J48Ppcsa6oncp6d29R0xw
# https://github.com/mwickerson
# https://www.facebook.com/michael.wickerson
# https://www.linkedin.com/in/michael-wickerson-696a80156/
# https://www.grasshopper3d.com/profile/MichaelWickerson
# Params Inputs  023/1001
calendar = Calendar()
# Wickerson Studio
# created by: Michael Wickerson
# Grasshopper for Rhino 3D Algorithmic Modeling
# www.wickersonstudios.com
# www.michaelwickerson.com
# https://www.youtube.com/channel/UC7J48Ppcsa6oncp6d29R0xw
# https://github.com/mwickerson
# https://www.facebook.com/michael.wickerson
# https://www.linkedin.com/in/michael-wickerson-696a80156/
# https://www.grasshopper3d.com/profile/MichaelWickerson
clock = Clock(SecondHand=True)
gradient = Gradient(LowerLimit=0, UpperLimit=1, stops=[0.15: RGB(255, 130, 160), 0.85: RGB(220, 0, 40)])  # disabled
colour_wheel = ColourWheel(
    ColourGrips_Style=31,
    ColourGrips_Grip=[0, 2.094395102, 4.188790205, 3.141592654],
    ColourGrips_Lum=[0.1, 0.5],
    ColourGrips_Range=[0.2617993878, 0.2617993878, 0.2617993878, 0.2617993878],
    ColourGrips_Sat=[0.2, 0.6])  # disabled
colour_picker = ColourPicker(PickedColour=RGB(255, 105, 180))  # disabled
graph_mapper = GraphMapper()  # disabled
image_sampler_2 = ImageSampler(Filter="Colour", Interpolate=False, Umax=1, Umin=0, Vmax=1, Vmin=0, Wrap=1)  # disabled
colour_swatch = ColourSwatch(SwatchColor=RGB(255, 255, 255))  # disabled
panel = Panel(clock)
panel_2 = Panel(calendar)
number_slider = Slider(0.29778, range=0..1)
number_slider_2 = Slider(2, range=0..10)  # disabled
colour_picker_2 = ColourPicker(PickedColour=RGB(116, 100, 80))  # disabled
construct_domain = ConstructDomain(DomainStart=0, DomainEnd=Slider(19, range=0..100))
image_sampler_3 = ImageSampler(Filter="Colour", Interpolate=False, Umax=1, Umin=0, Vmax=1, Vmin=0, Wrap=1)
sphere = Sphere(Base=PlaneXY(0, 0, 0), Radius=1)
rectangular = Rectangular(
    Plane=PlaneXY(0, 0, 0),
    SizeX=number_slider,
    SizeY=number_slider,
    ExtentX=Slider(100, range=0..1000),
    ExtentY=Slider(130, range=0..1000))  # -> Cells, Points
colour_wheel_2 = ColourWheel(
    number_slider_2,
    ColourGrips_Style=31,
    ColourGrips_Grip=[2.975720419, 5.070115521, 0.8813253162, 5.303926678],
    ColourGrips_Lum=[0.2790459612, 0.6479816889],
    ColourGrips_Range=[0.3109321537, 0.3109321537, 0.3109321537, 0.3109321537],
    ColourGrips_Sat=[0, 0.7760000562])  # disabled
gradient_2 = Gradient(
    LowerLimit=Slider(0.27, range=0..1),
    UpperLimit=Slider(0.67, range=0..1),
    Parameter=Slider(0.24, range=0..1),
    stops=[0.223: RGB(19, 232, 10), 1: RGB(225, 221, 199)])
range = Range(Domain=construct_domain, Steps=Slider(33, range=0..100))
image_sampler_4 = ImageSampler(
    rectangular.Points,
    FilePath="C:\Users\Sculpture\Documents\2020Grasshopper\ScreenShots2019\BlackandWhiteMax.PNG",
    Filter="Value",
    Interpolate=True,
    Umax=30,
    Umin=0,
    Vmax=40,
    Vmin=0,
    Wrap=0)
image_sampler_5 = ImageSampler(
    FilePath="C:\Users\Sculpture\Documents\2020Grasshopper\ScreenShots2019\BlackAndWhiteSharpImageSampler.PNG",
    Filter="Value",
    Interpolate=True,
    Umax=30,
    Umin=0,
    Vmax=30,
    Vmin=0,
    Wrap=1)
panel_3 = Panel(colour_picker_2)  # disabled
panel_4 = Panel(colour_wheel_2)  # disabled
division = Division(A=image_sampler_4, B=Slider(10.732, range=0..100))
graph_mapper_2 = GraphMapper(range, x0=0, x1=1, y0=0, y1=1, container_name="Sine", Equation_px=[0, 0.2637682855], Equation_py=[0, 0.6782598495])
param_viewer = ParamViewer(colour_wheel_2)  # disabled
custom_preview = CustomPreview(Geometry=sphere, Material=colour_picker_2)  # disabled
panel_5 = Panel(image_sampler_4)
circle_cnr = CircleCNR(Center=rectangular.Points, Normal=Vector(0, 0, 1), Radius=division)
custom_preview_2 = CustomPreview(Geometry=sphere, Material=gradient_2)
custom_preview_3 = CustomPreview(Geometry=sphere, Material=colour_wheel_2)  # disabled
graph_mapper_3 = GraphMapper(
    graph_mapper_2,
    x0=0,
    x1=1,
    y0=0,
    y1=1,
    container_name="Bezier",
    cpx=[0, 0.2362317145, 0.9202898741, 1],
    cpy=[0, 0.4623191953, 0.4101438522, 1])
construct_point = ConstructPoint(XCoordinate=range, YCoordinate=graph_mapper_3, ZCoordinate=graph_mapper_2)
boundary_surfaces = BoundarySurfaces(Edges=circle_cnr)
panel_6 = Panel(gradient_2)
param_viewer_2 = ParamViewer(image_sampler_4)
interpolate = Interpolate(Vertices=construct_point, Degree=3, Periodic=False, KnotStyle=1)  # -> Curve, Length, Domain
extrude = Extrude()

# ----
# Doubleclick Me!
import_pdb = ImportPDB()  # -> Atoms, Bonds; disabled
cluster_input = ClusterInput()  # disabled
cluster_output = ClusterOutput()  # disabled
fitness_landscape = FitnessLandscape(Count=-1, ColourMode=1, ContourMode=2, Remap=False)  # disabled
param_viewer_3 = ParamViewer()  # disabled
timer = Timer(TimerInterval=1000)  # disabled
galapagos = Galapagos()
gene_pool = GenePool(Decimals=2, Maximum=100, Minimum=0, Value=[50, 50, 50, 50, 50, 50, 50, 50, 50, 50])  # disabled
goat = Goat()
panel_7 = Panel()  # disabled
data_recorder = DataRecorder(DataLimit=-10, RecordData=True)  # disabled
cherry_picker = CherryPicker(ListIndex=0)  # disabled
data_dam = DataDam(DataDataA=panel_7, BufferDelay=10000000, BufferMode=0)  # disabled
read_file = ReadFile(PerLineParse=True)  # disabled
relay = Relay()  # disabled
atom_data = AtomData()  # -> Point, Element, Chain, Residue, Charge, Occupancy, Temperature, AtomicNumber, SerialNumber, ResidueNumber; disabled
import_image = ImportImage()  # disabled
import_coordinates = ImportCoordinates(Separator=",", XIndex=0, YIndex=1, ZIndex=2)  # disabled
import_3dm = Import3DM(Layer="*", Name="*")  # disabled
panel_8 = Panel(data_dam)  # disabled
object_details = ObjectDetails()  # -> Referenced, Available, Name, Layer, Colour, Guid; disabled
data_input = DataInput(UpdateDelay=5)  # disabled
import_shp = ImportSHP()  # -> Points, Curves, Regions; disabled
data_output = DataOutput()  # disabled
suirify = Suirify()  # disabled

# ----
# Scribble Tool
number_slider_3 = Slider(0.54, range=0..1)  # disabled
frequency_spectrum = FrequencySpectrum()  # -> NoteVolume, PeakFrequency, PeakNote; disabled
cluster_input_2 = ClusterInput()  # disabled
gene_pool_2 = GenePool(Decimals=2, Maximum=11, Minimum=0, Value=[0.21, 5.58, 3.13, 11, 4.49])  # disabled
gene_pool_3 = GenePool(Decimals=2, Maximum=1, Minimum=0, Value=[0, 0.26, 0.84, 0.49, 0.85])  # disabled
digit_scroller = DigitScroller(Scroller_Digits=12, Scroller_Prefix="Digit Scroller", Scroller_Radix=9, Scroller_Value=200000000)  # disabled
data_recorder_2 = DataRecorder(frequency_spectrum.NoteVolume, DataLimit=-10, RecordData=True)  # disabled
timer_2 = Timer(TimerInterval=1000, Target=data_recorder_2)  # disabled
pipe_variable = PipeVariable(Curve=reparameterize(<geometry referenced from the Rhino model>), Parameters=gene_pool_3, Radii=gene_pool_2, Caps=0)  # disabled
relay_2 = Relay()  # disabled
multiplication = Multiplication(A=digit_scroller, B=data_recorder_2)  # disabled
param_viewer_4 = ParamViewer(data_recorder_2)  # disabled
cluster_output_2 = ClusterOutput()  # disabled
panel_9 = Panel(multiplication)  # disabled

panel_10 = Panel("""12
2""")  # disabled
integer = Integer(panel_10)  # disabled
data_dam_2 = DataDam(DataDataA=integer, BufferDelay=20000000, BufferMode=0)  # disabled
panel_11 = Panel(data_dam_2)  # disabled

fitness_landscape_2 = FitnessLandscape(Count=-1, ColourMode=1, ContourMode=2, Remap=False)  # disabled
galapagos_2 = Galapagos()
goat_2 = Goat()

brep = Brep(<brep referenced from the Rhino model>)  # disabled
volume = Volume(Geometry=brep)  # -> Volume, Centroid; disabled
scale = Scale(Geometry=brep, Center=volume.Centroid, Factor=number_slider_3)  # -> Geometry, Transform; disabled
