# Grasshopper definition ParamsInputs024.gh (Grasshopper 1.0.7)
# Copyright: Wickerson Studios
# plug-ins: Firefly.X, Bifocals, goat

# Wickerson Studio
# 
# created by: Michael Wickerson
# 
# Grasshopper for Rhino 3D Algorithmic Modeling
# 
# www.wickersonstudios.com
# www.michaelwickerson.com
# https://www.youtube.com/channel/UC7J48Ppcsa6oncp6d29R0xw
# https://github.com/mwickerson
# https://www.facebook.com/michael.wickerson
# https://www.linkedin.com/in/michael-wickerson-696a80156/
# https://www.grasshopper3d.com/profile/MichaelWickerson
image_sampler = ImageSampler(
    FilePath="C:\Users\Sculpture\Documents\2020Grasshopper\ScreenShots2019\Screenshots2020\SurfaceEditAlgorithm.PNG",
    Filter="Value",
    Interpolate=False,
    Umax=1,
    Umin=0,
    Vmax=1,
    Vmin=0,
    Wrap=1)  # disabled

# ----
# 1001 GRASSHOPPER DEFINITIONS
# Params Inputs  024/1001
# Wickerson Studio
# created by: Michael Wickerson
# Grasshopper for Rhino 3D Algorithmic Modeling
# www.wickersonstudios.com
# www.michaelwickerson.com
# https://www.youtube.com/channel/UC7J48Ppcsa6oncp6d29R0xw
# https://github.com/mwickerson
# https://www.facebook.com/michael.wickerson
# https://www.linkedin.com/in/michael-wickerson-696a80156/
# https://www.grasshopper3d.com/profile/MichaelWickerson
atom_data = AtomData()  # -> Point, Element, Chain, Residue, Charge, Occupancy, Temperature, AtomicNumber, SerialNumber, ResidueNumber; disabled
import_pdb = ImportPDB()  # -> Atoms, Bonds; disabled

import_image = ImportImage()  # disabled

import_coordinates = ImportCoordinates(Separator=",", XIndex=0, YIndex=1, ZIndex=2)  # disabled

import_3dm = Import3DM(Layer="*", Name="*")  # disabled

object_details = ObjectDetails()  # -> Referenced, Available, Name, Layer, Colour, Guid; disabled

import_shp = ImportSHP()  # -> Points, Curves, Regions; disabled

read_file = ReadFile(PerLineParse=True)  # disabled

# ----
# Enough Said!!!
# 
# https://www.grasshopper3d.com/forum/topics/protein-database-downloader
# alternative tutorial: https://www.rcsb.org/
# 
# https://www.youtube.com/watch?v=f3NkIS1ga24
# alternative tutorial: https://www.rcsb.org/
# 
# https://www.youtube.com/watch?v=f3NkIS1ga24
panel = Panel("https://www.grasshopper3d.com/forum/topics/protein-database-downloader")  # disabled

# ----
# Doubleclick Me!
cherry_picker = CherryPicker(ListIndex=0)  # disabled
cluster_input = ClusterInput()  # disabled
cluster_output = ClusterOutput()  # disabled
fitness_landscape = FitnessLandscape(Count=-1, ColourMode=1, ContourMode=2, Remap=False)  # disabled
param_viewer = ParamViewer()  # disabled
timer = Timer(TimerInterval=1000)  # disabled
galapagos = Galapagos()
gene_pool = GenePool(Decimals=2, Maximum=100, Minimum=0, Value=[50, 50, 50, 50, 50, 50, 50, 50, 50, 50])  # disabled
goat = Goat()
panel_2 = Panel()  # disabled
data_recorder = DataRecorder(DataLimit=-10, RecordData=True)  # disabled
data_dam = DataDam(DataDataA=panel_2, BufferDelay=10000000, BufferMode=0)  # disabled
relay = Relay()  # disabled
panel_3 = Panel(data_dam)  # disabled
data_input = DataInput(UpdateDelay=5)  # disabled
data_output = DataOutput()  # disabled
suirify = Suirify()  # disabled

control_knob = ControlKnob(Decimals=2, Limit=True, Maximum=10, Minimum=0, Range=1, Value=0.25)  # disabled

# ----
# Scribble Tool
number_slider = Slider(0.54, range=0..1)  # disabled
frequency_spectrum = FrequencySpectrum()  # -> NoteVolume, PeakFrequency, PeakNote; disabled
cluster_input_2 = ClusterInput()  # disabled
gene_pool_2 = GenePool(Decimals=2, Maximum=11, Minimum=0, Value=[0.21, 5.58, 3.13, 11, 4.49])  # disabled
gene_pool_3 = GenePool(Decimals=2, Maximum=1, Minimum=0, Value=[0, 0.26, 0.84, 0.49, 0.85])  # disabled
digit_scroller = DigitScroller(Scroller_Digits=12, Scroller_Prefix="Digit Scroller", Scroller_Radix=9, Scroller_Value=200000000)  # disabled
data_recorder_2 = DataRecorder(frequency_spectrum.NoteVolume, DataLimit=-10, RecordData=True)  # disabled
timer_2 = Timer(TimerInterval=1000, Target=data_recorder_2)  # disabled
pipe_variable = PipeVariable(Curve=reparameterize(<geometry referenced from the Rhino model>), Parameters=gene_pool_3, Radii=gene_pool_2, Caps=0)  # disabled
relay_2 = Relay()  # disabled
multiplication = Multiplication(A=digit_scroller, B=data_recorder_2)  # disabled
param_viewer_2 = ParamViewer(data_recorder_2)  # disabled
cluster_output_2 = ClusterOutput()  # disabled
panel_4 = Panel(multiplication)  # disabled

panel_5 = Panel("""12
2""")  # disabled
integer = Integer(panel_5)  # disabled
data_dam_2 = DataDam(DataDataA=integer, BufferDelay=20000000, BufferMode=0)  # disabled
panel_6 = Panel(data_dam_2)  # disabled

fitness_landscape_2 = FitnessLandscape(Count=-1, ColourMode=1, ContourMode=2, Remap=False)  # disabled
galapagos_2 = Galapagos()
goat_2 = Goat()

brep = Brep(<brep referenced from the Rhino model>)  # disabled
volume = Volume(Geometry=brep)  # -> Volume, Centroid; disabled
scale = Scale(Geometry=brep, Center=volume.Centroid, Factor=number_slider)  # -> Geometry, Transform; disabled

number_slider_2 = Slider(56, range=0..100)  # disabled
file_path = FilePath("C:\Users\Sculpture\Desktop\Double click to edit panel content TEXT test002.docx")  # disabled
file_path_2 = FilePath("C:\Users\Sculpture\Desktop\FloorPlanSculpture001.3dmbak")  # disabled
file_path_3 = FilePath("C:\Users\Sculpture\Desktop\Jim and Welding Screens.docx")  # disabled
file_path_4 = FilePath("C:\Users\Sculpture\Downloads\1btn.pdb")  # disabled
file_path_5 = FilePath("C:\Users\Sculpture\Downloads\4hhb.pdb")  # disabled
file = File("C:\Users\Sculpture\Desktop\SHP Files\be.shp")  # disabled
geometry = Geometry(<brep referenced from the Rhino model>)  # disabled
file_path_6 = FilePath("C:\Users\Sculpture\Desktop\Jim and Welding Screens.docx")  # disabled
number_slider_3 = Slider(201, range=0..201)  # disabled
rectangle = Rectangle(Plane=PlaneXY(0, 0, 0), XSize=number_slider_2, YSize=number_slider_2, Radius=0)  # -> Rectangle, Length; disabled

import_3dm_2 = Import3DM(File=file_path_2, Layer="*", Name="*")  # disabled

import_coordinates_2 = ImportCoordinates(File=file_path, Separator=",", XIndex=0, YIndex=1, ZIndex=2)  # disabled

import_pdb_2 = ImportPDB(File=file_path_4)  # -> Atoms, Bonds; disabled

import_shp_2 = ImportSHP(File=file)  # -> Points, Curves, Regions; disabled

object_details_2 = ObjectDetails(Object=geometry)  # -> Referenced, Available, Name, Layer, Colour, Guid; disabled

python = GhPythonScript(x=geometry)  # -> out, a; disabled
# ---------- python: Python ----------
__author__ = "Sculpture"
__version__ = "2020.03.15"

import rhinoscriptsyntax as rs

for input in ghenv.Component.Params.Input:
    for source in input.Sources:
        a = str (source.InstanceGuid)
# ---------- end python ----------
panel_7 = Panel(object_details_2.Guid)  # disabled
panel_8 = Panel(python.a)  # disabled

atom_data_2 = AtomData(Atom=import_pdb_2.Atoms)  # -> Point, Element, Chain, Residue, Charge, Occupancy, Temperature, AtomicNumber, SerialNumber, ResidueNumber; disabled

read_file_2 = ReadFile(File=file_path_6, PerLineParse=False)  # disabled
read_file_3 = ReadFile(File=file_path_6, PerLineParse=True)  # disabled

curve = Curve(import_shp_2.Curves)  # disabled
point = Point(import_shp_2.Points)  # disabled
brep_2 = Brep(import_shp_2.Regions)  # disabled
curve_2 = Curve(import_3dm_2)  # disabled
panel_9 = Panel(object_details_2.Referenced)  # disabled
param_viewer_3 = ParamViewer(import_coordinates_2)  # disabled
panel_10 = Panel(import_coordinates_2)  # disabled
param_viewer_4 = ParamViewer(curve)  # disabled
panel_11 = Panel(curve)  # disabled
panel_12 = Panel(object_details_2.Layer)  # disabled
panel_13 = Panel(object_details_2.Available)  # disabled
panel_14 = Panel(read_file_3)  # disabled
panel_15 = Panel(read_file_2)  # disabled
panel_16 = Panel(object_details_2.Colour)  # disabled
panel_17 = Panel(object_details_2.Name)  # disabled
panel_18 = Panel(atom_data_2.Point)  # disabled

import_image_2 = ImportImage(
    File="C:\Users\Sculpture\Documents\2020Grasshopper\ScreenShots2019\BlackAndWhiteSharpImageSampler.PNG",
    Rectangle=rectangle.Rectangle,
    XSamples=number_slider_3,
    YSamples=number_slider_3)  # disabled
