# Grasshopper definition ParamsInputs025.gh (Grasshopper 1.0.7)
# Copyright: Wickerson Studios
# plug-ins: Firefly.X, Fologram For Grasshopper Utilities, Bifocals, goat

# 1001 GRASSHOPPER DEFINITIONS
# Wickerson Studio
# 
# created by: Michael Wickerson
# 
# Grasshopper for Rhino 3D Algorithmic Modeling
# 
# www.wickersonstudios.com
# www.michaelwickerson.com
# https://www.youtube.com/channel/UC7J48Ppcsa6oncp6d29R0xw
# https://github.com/mwickerson
# https://www.facebook.com/michael.wickerson
# https://www.linkedin.com/in/michael-wickerson-696a80156/
# https://www.grasshopper3d.com/profile/MichaelWickerson
image_sampler = ImageSampler(
    FilePath="C:\Users\Sculpture\Documents\2020Grasshopper\ScreenShots2019\Screenshots2020\SurfaceEditAlgorithm.PNG",
    Filter="Value",
    Interpolate=False,
    Umax=1,
    Umin=0,
    Vmax=1,
    Vmin=0,
    Wrap=1)  # disabled
fitness_landscape = FitnessLandscape(Count=-1, ColourMode=1, ContourMode=2, Remap=False)  # disabled

# ----
# Params Inputs  025/1001
# Wickerson Studio
# created by: Michael Wickerson
# Grasshopper for Rhino 3D Algorithmic Modeling
# www.wickersonstudios.com
# www.michaelwickerson.com
# https://www.youtube.com/channel/UC7J48Ppcsa6oncp6d29R0xw
# https://github.com/mwickerson
# https://www.facebook.com/michael.wickerson
# https://www.linkedin.com/in/michael-wickerson-696a80156/
# https://www.grasshopper3d.com/profile/MichaelWickerson
# Doubleclick Me!
# Do with me what you wish!
# I stay visible!!!
cherry_picker = CherryPicker(ListIndex=0)

data_input = DataInput(UpdateDelay=5)  # disabled
galapagos = Galapagos()
gene_pool = GenePool(Decimals=2, Maximum=100, Minimum=0, Value=[50, 50, 50, 50, 50, 50, 50, 50, 50, 50])  # disabled
goat = Goat()
cluster_input = ClusterInput()  # disabled
cluster_output = ClusterOutput()  # disabled

data_dam = DataDam(BufferDelay=10000000, BufferMode=0)

data_recorder = DataRecorder(DataLimit=-10, RecordData=True)
timer = Timer(TimerInterval=1000)

relay = Relay()  # disabled
data_output = DataOutput()  # disabled
suirify = Suirify()  # disabled

number_slider = Slider(4, range=0..20)
timer_2 = Timer(TimerInterval=2000, Target=data_recorder_2)
data_recorder_2 = DataRecorder(number_slider, DataLimit=-10, RecordData=True)
panel = Panel(data_recorder_2)
ellipse = Ellipse(Plane=PlaneXY(0, 0, 0), Radius1=data_recorder_2, Radius2=expr("x*3", data_recorder_2))  # -> Ellipse, Focus1, Focus2
unit_x = UnitX(Factor=number_slider)
construct_point = ConstructPoint(XCoordinate=0, YCoordinate=0, ZCoordinate=0)
circle = Circle(Plane=PlaneXY(0, 0, 0), Radius=1)
unit_z = UnitZ(Factor=data_recorder_2)
move = Move(Geometry=ellipse.Ellipse, Motion=unit_z)  # -> Geometry, Transform
line_sdl = LineSDL(Start=construct_point, Direction=unit_x, Length=1)
B = B(0.05)
rotate_axis = RotateAxis(Geometry=move.Geometry, Angle=data_recorder_2, Axis=line_sdl)  # -> Geometry, Transform
multiplication = Multiplication(A=number_slider, B=B)
mesh_pipe = MeshPipe(Polylines=rotate_axis.Geometry, NumberOfSides=4, Tolerance=0.1, Radius=multiplication, Cap=False, Join=False)
pipe = Pipe(Radius=1, Caps=0)

panel_2 = Panel("Michael Wickerson is great!")  # disabled

data_dam_2 = DataDam(DataDataA=panel_2, BufferDelay=100000000, BufferMode=2)  # disabled

panel_3 = Panel(data_dam_2)  # disabled

# ----
# Scribble Tool
number_slider_2 = Slider(0.54, range=0..1)  # disabled
frequency_spectrum = FrequencySpectrum()  # -> NoteVolume, PeakFrequency, PeakNote; disabled
cluster_input_2 = ClusterInput()  # disabled
gene_pool_2 = GenePool(Decimals=2, Maximum=11, Minimum=0, Value=[0.21, 5.58, 3.13, 11, 4.49])  # disabled
gene_pool_3 = GenePool(Decimals=2, Maximum=1, Minimum=0, Value=[0, 0.26, 0.84, 0.49, 0.85])  # disabled
digit_scroller = DigitScroller(Scroller_Digits=12, Scroller_Prefix="Digit Scroller", Scroller_Radix=9, Scroller_Value=200000000)  # disabled
data_recorder_3 = DataRecorder(frequency_spectrum.NoteVolume, DataLimit=-10, RecordData=True)  # disabled
timer_3 = Timer(TimerInterval=1000, Target=data_recorder_3)  # disabled
pipe_variable = PipeVariable(Curve=reparameterize(<geometry referenced from the Rhino model>), Parameters=gene_pool_3, Radii=gene_pool_2, Caps=0)  # disabled
relay_2 = Relay()  # disabled
multiplication_2 = Multiplication(A=digit_scroller, B=data_recorder_3)  # disabled
param_viewer = ParamViewer(data_recorder_3)  # disabled
cluster_output_2 = ClusterOutput()  # disabled
panel_4 = Panel(multiplication_2)  # disabled

panel_5 = Panel("""12
2""")  # disabled
integer = Integer(panel_5)  # disabled
data_dam_3 = DataDam(DataDataA=integer, BufferDelay=20000000, BufferMode=0)  # disabled
panel_6 = Panel(data_dam_3)  # disabled

fitness_landscape_2 = FitnessLandscape(Count=-1, ColourMode=1, ContourMode=2, Remap=False)  # disabled
galapagos_2 = Galapagos()
goat_2 = Goat()

brep = Brep(<brep referenced from the Rhino model>)  # disabled
volume = Volume(Geometry=brep)  # -> Volume, Centroid; disabled
scale = Scale(Geometry=brep, Center=volume.Centroid, Factor=number_slider_2)  # -> Geometry, Transform; disabled

number_slider_3 = Slider(2, range=0..10)  # disabled
range = Range(Domain=Domain(0, 1), Steps=number_slider_3)  # disabled
sdfsd = Circle(Plane=PlaneXY(0, 0, 0), Radius=1)  # disabled
unit_z_2 = UnitZ(Factor=range)  # disabled
move_2 = Move(Geometry=sdfsd, Motion=unit_z_2)  # -> graft(Geometry), Transform; disabled
explode_tree = ExplodeTree(Data=move_2.Geometry)  # -> Branch0, Branch1, Branch2, Branch3, Branch4, Branch5; disabled
length = Length(Curve=move_2.Geometry)  # disabled
panel_7 = Panel(explode_tree.Branch1)  # disabled
length_2 = Length(Curve=move_2.Geometry)  # disabled
explode_tree_2 = ExplodeTree(Data=length_2)  # -> Branch0, Branch1, Branch2, Branch3, Branch4, Branch5, Branch6, Branch7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; disabled
explode_tree_3 = ExplodeTree(Data=length)  # -> Branch0, Branch1, Branch2, Branch3, Branch4, Branch5, Branch6, Branch7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; disabled
panel_8 = Panel(explode_tree_2.Branch5)  # disabled
param_viewer_2 = ParamViewer(panel_8)  # disabled

cherry_picker_2 = CherryPicker(length, ListIndex=0, TreePath_path="{0;0;2}")  # disabled
cherry_picker_3 = CherryPicker(move_2.Geometry, ListIndex=0, TreePath_path="{0;0;6}")  # disabled

panel_9 = Panel(cherry_picker_3)  # disabled
panel_10 = Panel(cherry_picker_2)  # disabled
param_viewer_3 = ParamViewer(panel_9)  # disabled
param_viewer_4 = ParamViewer(panel_10)  # disabled
