# Grasshopper definition ParamsInputs026.gh (Grasshopper 1.0.7)
# Copyright: Wickerson Studios
# plug-ins: Firefly.X, Bifocals, goat

image_sampler = ImageSampler(
    FilePath="C:\Users\Sculpture\Documents\2020Grasshopper\ScreenShots2019\Screenshots2020\SurfaceEditAlgorithm.PNG",
    Filter="Value",
    Interpolate=False,
    Umax=1,
    Umin=0,
    Vmax=1,
    Vmin=0,
    Wrap=1)  # disabled
fitness_landscape = FitnessLandscape(Count=-1, ColourMode=1, ContourMode=2, Remap=False)  # disabled
galapagos = Galapagos()
goat = Goat()

data_input = DataInput(UpdateDelay=5)  # disabled
data_output = DataOutput()  # disabled

gene_pool = GenePool(Decimals=2, Maximum=100, Minimum=0, Value=[50, 50, 100, 50, 50, 50, 50, 50, 50, 50])  # disabled

cluster_output = ClusterOutput()  # disabled
cluster_input = ClusterInput()  # disabled

# ----
# 1001 GRASSHOPPER DEFINITIONS
# Wickerson Studio
# 
# created by: Michael Wickerson
# 
# Grasshopper for Rhino 3D Algorithmic Modeling
# 
# www.wickersonstudios.com
# www.michaelwickerson.com
# https://www.youtube.com/channel/UC7J48Ppcsa6oncp6d29R0xw
# https://github.com/mwickerson
# https://www.facebook.com/michael.wickerson
# https://www.linkedin.com/in/michael-wickerson-696a80156/
# https://www.grasshopper3d.com/profile/MichaelWickerson
# Params Inputs  026/1001
relay = Relay()  # disabled

# ----
# Wickerson Studio
# created by: Michael Wickerson
# Grasshopper for Rhino 3D Algorithmic Modeling
# www.wickersonstudios.com
# www.michaelwickerson.com
# https://www.youtube.com/channel/UC7J48Ppcsa6oncp6d29R0xw
# https://github.com/mwickerson
# https://www.facebook.com/michael.wickerson
# https://www.linkedin.com/in/michael-wickerson-696a80156/
# https://www.grasshopper3d.com/profile/MichaelWickerson
suirify = Suirify()  # disabled

input = DataInput(
    Destination="C:\Users\Sculpture\Downloads\data.ghdata",
    RelativePath="C:\Users\Sculpture\Downloads\data.ghdata|..\..\..\Downloads\data.ghdata",
    UpdateDelay=5)  # -> A, B, C, D; disabled

gene_pool_2 = GenePool(Decimals=2, Maximum=1, Minimum=0, Value=[0, 0.27, 0.48, 0.71, 1])  # disabled
gene_pool_3 = GenePool(Decimals=2, Maximum=2.4, Minimum=0, Value=[0.7195835501, 0.1269150396, 0.723039772, 0.1596085009, 1.930533147])  # disabled

# ----
# Open a Data file you saved from Data Output Component
# Save Data file to your disk
number_slider = Slider(0.5, range=0..1)  # disabled
number_slider_2 = Slider(1, range=0..1)  # disabled
number_slider_3 = Slider(3, range=0..10)  # disabled
boolean_toggle = BooleanToggle(True)  # disabled
number_slider_4 = Slider(25, range=0..100)  # disabled
webcam_video_stream = WebCamVideoStream()  # disabled
number_slider_5 = Slider(0.45, range=0..1)  # disabled
number_slider_6 = Slider(0.06, range=0..1)  # disabled
number_slider_7 = Slider(0.19, range=0..1)  # disabled
number_slider_8 = Slider(2, range=0..10)  # disabled
number_slider_9 = Slider(7, range=0..100)  # disabled
timer = Timer(TimerInterval=50, Target=sound_capture)  # disabled
sound_capture = SoundCapture(TimePeriod=number_slider, StartStopSoundCapture=boolean_toggle)  # -> WavePressureSamplesFromLeftChannel, WavePressureSamplesFromRightChannel, Volume; disabled
construct_domain = ConstructDomain(DomainStart=number_slider_2, DomainEnd=number_slider_3)  # disabled
number_slider_10 = Slider(4, range=0..10)  # disabled
number_slider_11 = Slider(20, range=0..20)  # disabled
range = Range(Domain=construct_domain, Steps=10)  # disabled
unit_x = UnitX(Factor=number_slider_8)  # disabled
center_box = CenterBox(Base=PlaneXY(0, 0, 0), X=number_slider_6, Y=number_slider_5, Z=number_slider_7)  # disabled
crv = Curve(input.A)  # disabled
pt = Point(input.B)  # disabled
brep = Brep(input.C)  # disabled
srf = Surface(input.D)  # disabled
circle = Circle(Plane=PlaneXY(0, 0, 0), Radius=range)  # -> graft(Circle); disabled
circle_2 = Circle(Plane=PlaneXY(0, 0, 0), Radius=number_slider_9)  # disabled
move = Move(Geometry=center_box, Motion=unit_x)  # -> Geometry, Transform; disabled
panel = Panel(number_slider_4)  # disabled
number_slider_12 = Slider(0.03, range=0..1)  # disabled
number_slider_13 = Slider(3, range=0..10)  # disabled
panel_3 = Panel(circle)  # disabled
panel_4 = Panel(brep)  # disabled
panel_5 = Panel(srf)  # disabled
panel_6 = Panel(crv)  # disabled
panel_7 = Panel(pt)  # disabled
panel_8 = Panel(sound_capture.Volume)  # disabled
data_recorder = DataRecorder(sound_capture.Volume, DataLimit=20, RecordData=True)  # disabled
polar_array = PolarArray(Geometry=move.Geometry, Plane=PlaneXY(0, 0, 0), Count=10, Angle=6.283185307)  # -> Geometry, Transform; disabled
series = Series(Start=number_slider_10, Step=number_slider_10, Count=number_slider_11)  # disabled
length = Length(Curve=circle_2)  # disabled
explode_tree = ExplodeTree(Data=circle)  # -> Branch0, Branch1, Branch2, Branch3, Branch4, Branch5, Branch6, Branch7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; disabled
divide_curve = DivideCurve(Curve=circle_2, Count=10, Kinks=False)  # -> Points, Tangents, Parameters; disabled
clean_tree = CleanTree(RemoveNulls=True, RemoveInvalid=True, RemoveEmpty=False, Tree=circle)  # disabled
number_slider_14 = Slider(0.796, range=0..2)  # disabled
multiplication = Multiplication(A=data_recorder, B=number_slider_12)  # disabled
simplify_tree = SimplifyTree(Tree=circle, Front=False)  # disabled
number_slider_15 = Slider(8, range=0..100)  # disabled
cluster_input_2 = ClusterInput()  # disabled
cluster_input_3 = ClusterInput()  # disabled
crv_2 = Curve([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])  # disabled
pt_2 = Point([Point(-2, -1, 0), Point(-4, -1, 0), Point(-4, 0, 0)])  # disabled
brep_2 = Brep(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)  # disabled
srf_2 = Surface([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])  # disabled
panel_9 = Panel(data_recorder)  # disabled
interpolate = Interpolate(Vertices=divide_curve.Points, Degree=3, Periodic=False, KnotStyle=1)  # -> Curve, Length, Domain; disabled
boolean_toggle_2 = BooleanToggle(True)  # disabled
unit_z = UnitZ(Factor=multiplication)  # disabled
polygon = Polygon(Plane=PlaneXY(0, 0, 0), Radius=series, Segments=number_slider_13, FilletRadius=0)  # -> Polygon, Length; disabled
pdecon = Deconstruct(Point=pt_2)  # -> XComponent, YComponent, ZComponent; disabled
explode_tree_2 = ExplodeTree(Data=simplify_tree)  # -> Branch0, Branch1, Branch2, Branch3, Branch4, Branch5, Branch6, Branch7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; disabled
explode_tree_3 = ExplodeTree(Data=clean_tree)  # -> Branch0, Branch1, Branch2, Branch3, Branch4, Branch5, Branch6, Branch7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; disabled
debrep = DeconstructBrep(Brep=brep_2)  # -> Faces, Edges, Vertices; disabled
debrep_2 = DeconstructBrep(Brep=srf_2)  # -> Faces, Edges, Vertices; disabled
scale = Scale(Geometry=crv_2, Center=Point(0, 0, 0), Factor=0.5)  # -> Geometry, Transform; disabled
pi = Pi(Factor=multiplication)  # disabled
multiplication_2 = Multiplication(A=pdecon.XComponent, B=pdecon.XComponent)  # disabled
multiplication_3 = Multiplication(A=pdecon.YComponent, B=pdecon.YComponent)  # disabled
pipe_variable = PipeVariable(Curve=reparameterize(interpolate.Curve), Parameters=gene_pool_2, Radii=gene_pool_3, Caps=boolean_toggle_2)  # disabled
panel_10 = Panel(simplify_tree)  # disabled
unit_y = UnitY(Factor=number_slider_15)  # disabled
panel_11 = Panel(clean_tree)  # disabled
panel_12 = Panel(pi)  # disabled
move_2 = Move(Geometry=[debrep.Faces, debrep_2.Faces], Motion=unit_y)  # -> Geometry, Transform; disabled
move_3 = Move(Geometry=reverse(polygon.Polygon), Motion=unit_z)  # -> Geometry, Transform; disabled
construct_point = ConstructPoint(XCoordinate=multiplication_2, YCoordinate=multiplication_3, ZCoordinate=pdecon.ZComponent)  # disabled
cluster_output_2 = ClusterOutput()  # disabled
xz_plane = XZPlane(Origin=Point(0, 0, 0))  # disabled
yz_plane = YZPlane(Origin=Point(0, 0, 0))  # disabled
rectangle = Rectangle(Plane=[xz_plane, yz_plane], XSize=Domain(-1, 1), YSize=series, Radius=0)  # -> Rectangle, Length; disabled
boundary_surfaces = BoundarySurfaces(Edges=rectangle.Rectangle)  # disabled
rotate = Rotate(Geometry=boundary_surfaces, Angle=pi, Plane=yz_plane)  # -> Geometry, Transform; disabled
output = DataOutput(
    A=scale.Geometry,
    B=construct_point,
    C=move_2.Geometry,
    D=move_2.Geometry,
    Destination="C:\Users\Sculpture\Downloads\data.ghdata",
    RelativePath="C:\Users\Sculpture\Downloads\data.ghdata|..\..\..\Downloads\data.ghdata")  # disabled
deconstruct_brep = DeconstructBrep(Brep=rotate.Geometry)  # -> Faces, Edges, Vertices; disabled
number_slider_16 = Slider(2, range=0..10)  # disabled
number_slider_17 = Slider(3, range=0..10)  # disabled
list_item = ListItem(List=deconstruct_brep.Vertices, Index=number_slider_16, Wrap=True)  # disabled
mesh_sphere = MeshSphere(Base=list_item, Radius=pi, UCount=number_slider_17, VCount=number_slider_17)  # disabled

# ----
# Simplify
# Consistently
suirify_2 = Suirify(circle)  # disabled

wstransformation = WSTransformation(geometry=polar_array.Geometry, domain_end=number_slider_14)  # disabled

explode_tree_4 = ExplodeTree(Data=suirify_2)  # -> Branch0, Branch1, Branch2, Branch3, Branch4, Branch5, Branch6, Branch7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; disabled
panel_13 = Panel(suirify_2)  # disabled
panel_14 = Panel(wstransformation)  # disabled

# ==== cluster WSTransformation: Rotates range of geometries around z axis
geometry = ClusterInput()
domain_end = ClusterInput()
geometry_2 = Geometry(flatten(geometry))
list_length = ListLength(List=geometry_2)
volume = Volume(Geometry=geometry_2)  # -> Volume, Centroid
construct_domain = ConstructDomain(DomainStart=0, DomainEnd=domain_end)
expression = Expression(x=list_length, Expression="x-1")
range = Range(Domain=construct_domain, Steps=expression)
unit_z = UnitZ(Factor=1)
pi = Pi(Factor=range)
rotate_3d = Rotate3D(Geometry=geometry_2, Angle=pi, Center=volume.Centroid, Axis=unit_z)  # -> Geometry, Transform

# ---- group: Cluster Output / Unresolved Proxy
geometry_3 = ClusterOutput(rotate_3d.Geometry)
