# Grasshopper definition ParamsInputs027.gh (Grasshopper 1.0.7)
# Copyright: Wickerson Studios
# plug-ins: Bifocals

# Wickerson Studio
# 
# created by: Michael Wickerson
# 
# Grasshopper for Rhino 3D Algorithmic Modeling
# 
# www.wickersonstudios.com
# www.michaelwickerson.com
# https://www.youtube.com/channel/UC7J48Ppcsa6oncp6d29R0xw
# https://github.com/mwickerson
# https://www.facebook.com/michael.wickerson
# https://www.linkedin.com/in/michael-wickerson-696a80156/
# https://www.grasshopper3d.com/profile/MichaelWickerson
image_sampler = ImageSampler(
    FilePath="C:\Users\Sculpture\Documents\2020Grasshopper\ScreenShots2019\Screenshots2020\SurfaceEditAlgorithm.PNG",
    Filter="Value",
    Interpolate=False,
    Umax=1,
    Umin=0,
    Vmax=1,
    Vmin=0,
    Wrap=1)  # disabled

number_slider = Slider(0.45, range=0..1)
number_slider_2 = Slider(0.56, range=0..1)
md_slider = MDSlider(
    SliderMode=0,
    slider_value=Point(0.122893489, 0.09253971751, 0.5),
    x_domain=Domain(0, 1),
    y_domain=Domain(0, 1),
    z_domain=Domain(0, 1))
md_slider_2 = MDSlider(
    SliderMode=0,
    slider_value=Point(0.7238162901, 0.620516149, 0.5),
    x_domain=Domain(0, 1),
    y_domain=Domain(0, 1),
    z_domain=Domain(0, 1))
md_slider_3 = MDSlider(
    SliderMode=0,
    slider_value=Point(0.3220951732, 0.9935436714, 0.5),
    x_domain=Domain(0, 1),
    y_domain=Domain(0, 1),
    z_domain=Domain(0, 1))

# ----
# Wickerson Studio
# created by: Michael Wickerson
# Grasshopper for Rhino 3D Algorithmic Modeling
# www.wickersonstudios.com
# www.michaelwickerson.com
# https://www.youtube.com/channel/UC7J48Ppcsa6oncp6d29R0xw
# https://github.com/mwickerson
# https://www.facebook.com/michael.wickerson
# https://www.linkedin.com/in/michael-wickerson-696a80156/
# https://www.grasshopper3d.com/profile/MichaelWickerson
galapagos = Galapagos()
# 1001 GRASSHOPPER DEFINITIONS
# Params Inputs  027/1001
# Evolutionary Solver
fitness_landscape = FitnessLandscape(Count=-1, ColourMode=1, ContourMode=2, Remap=False)

gene_pool = GenePool(Decimals=2, Maximum=100, Minimum=0, Value=[50, 50, 50, 50, 49.34, 50])
characters = Characters(Text="evolve")  # -> Result, Unicode
ghpython_script = GhPythonScript()  # -> Out, A
subtraction = Subtraction(A=characters.Unicode, B=gene_pool)
ghpython_script_2 = GhPythonScript()  # -> Out, A
absolute = Absolute(Value=subtraction)
mass_addition = MassAddition()  # -> Result, PartialResults

point = Point([md_slider_3, md_slider, md_slider_2])
construct_point = ConstructPoint(XCoordinate=number_slider_2, YCoordinate=number_slider, ZCoordinate=0)
interpolate = Interpolate(Vertices=point, Degree=3, Periodic=False, KnotStyle=1)  # -> Curve, Length, Domain
curve = Curve(interpolate.Curve)
point_2 = Point(construct_point)

gene_pool_2 = GenePool(Decimals=2, Maximum=100, Minimum=0, Value=[53.18340364, 8.999166316, 33.77468518, 45.87403314, 34.08452651])

number_slider_3 = Slider(0.658, range=0..1)
number_slider_4 = Slider(0.53, range=0..1)
number_slider_5 = Slider(0.722, range=0..1)
number_slider_6 = Slider(0.482, range=0..1)
number_slider_7 = Slider(0.17, range=0..1)
number_slider_8 = Slider(0.514, range=0..1)
number_slider_9 = Slider(0.562, range=0..1)
number_slider_10 = Slider(0.402, range=0..1)

fitness_landscape_2 = FitnessLandscape(Count=-1, ColourMode=1, ContourMode=2, Remap=False)
galapagos_2 = Galapagos(gene=gene_pool_2)
galapagos_3 = Galapagos(gene=[number_slider_5, number_slider_3, number_slider_9, number_slider_6])
# Special Connector
galapagos_4 = Galapagos(gene=[number_slider_7, number_slider_4, number_slider_10, number_slider_8, number_slider_5, number_slider_3, number_slider_9, number_slider_6])

curve_closest_point = CurveClosestPoint(Point=point_2, Curve=curve)  # -> Point, Parameter, Distance
distance = Distance(PointA=curve_closest_point.Point, PointB=point_2)
number = Number(distance)
panel = Panel(number)

# ----
# Input Generation Analysis
# 
# Online Example Tutorial: NESIS
# https://www.youtube.com/watch?v=TGVwz4c6ieY&t=34s
galapagos_5 = Galapagos(fitness=number, gene=[number_slider, number_slider_2])
