# Grasshopper definition ParamsPrimitive0010.gh (Grasshopper 1.0.7)
# Copyright: Wickerson Studios
# plug-ins: KUKA|prc - parametric robot control, Bifocals

# 1001 GRASSHOPPER DEFINITIONS
# Wickerson Studio
# 
# created by: Michael Wickerson
# 
# Grasshopper for Rhino 3D Algorithmic Modeling
# 
# www.wickersonstudios.com
# www.michaelwickerson.com
# https://www.youtube.com/channel/UC7J48Ppcsa6oncp6d29R0xw
# https://github.com/mwickerson
# https://www.facebook.com/michael.wickerson
# https://www.linkedin.com/in/michael-wickerson-696a80156/
# https://www.grasshopper3d.com/profile/MichaelWickerson
image_sampler = ImageSampler(
    FilePath="C:\Users\Sculpture\Documents\2020Grasshopper\ScreenShots2019\Screenshots2020\SurfaceEditAlgorithm.PNG",
    Filter="Value",
    Interpolate=False,
    Umax=1,
    Umin=0,
    Vmax=1,
    Vmin=0,
    Wrap=1)

# ----
# Wickerson Studio
# created by: Michael Wickerson
# Grasshopper for Rhino 3D Algorithmic Modeling
# www.wickersonstudios.com
# www.michaelwickerson.com
# https://www.youtube.com/channel/UC7J48Ppcsa6oncp6d29R0xw
# https://github.com/mwickerson
# https://www.facebook.com/michael.wickerson
# https://www.linkedin.com/in/michael-wickerson-696a80156/
# https://www.grasshopper3d.com/profile/MichaelWickerson
boolean = Boolean()

integer = Integer()
number = Number()
matrix = Matrix()
data_path = DataPath()
shader = Shader()
domain² = Domain²()
culture = Culture()
expression = Expression(Expression="Format(\"{0}, {1}\", x, y)")
text = Text()
colour = Colour()
complex = Complex()
data = Data()
kuka_prc_command = KUKAPrcCommand()
guid = Guid()
time = Time()
domain = Domain()
file_path = FilePath()
import_pdb = ImportPDB()  # -> Atoms, Bonds

number_slider = Slider(3, range=0..10)
# Params Primitive 009/1001
number_slider_2 = Slider(6, range=0..10)
polygon = Polygon(Plane=PlaneXY(0, 0, 0), Radius=Slider(21, range=0..100), Segments=6, FilletRadius=0)  # -> Polygon, Length
unit_x = UnitX(Factor=Slider(26, range=0..100))
larger_than = LargerThan(FirstNumber=number_slider_2, SecondNumber=number_slider)  # -> LargerThan, OrEqualTo
equality = Equality(FirstNumber=number_slider_2, SecondNumber=number_slider)  # -> Equality, Inequality
populate_2d = Populate2D(Region={Plane=PlaneXY(0, 0, 0), Size=Domain2(u=0..20, v=0..10)}, Count=Slider(62, range=0..100), Seed=1)
move = Move(Geometry=polygon.Polygon, Motion=unit_x)  # -> Geometry, Transform
list_length = ListLength(List=populate_2d)
list_item = ListItem(List=populate_2d, Index=Slider(18, range=0..100), Wrap=True)
polar_array = PolarArray(Geometry=move.Geometry, Plane=PlaneXY(0, 0, 0), Count=Slider(6, range=0..10), Angle=6.283185307)  # -> Geometry, Transform
number_slider_3 = Slider(7.84, range=0..10)
point = Point(list_item)
point_2 = Point(populate_2d)
distance = Distance(PointA=point_2, PointB=point)
populate_2d_2 = Populate2D(Region={Plane=PlaneXY(0, 0, 0), Size=Domain2(u=0..20, v=0..10)}, Count=Slider(12, range=0..100), Seed=1)
region_difference = RegionDifference(CurvesA=polygon.Polygon, CurvesB=polar_array.Geometry)
region_difference_2 = RegionDifference(CurvesA=polar_array.Geometry, CurvesB=polygon.Polygon)
region_union = RegionUnion(Curves=[polar_array.Geometry, polygon.Polygon])
smaller_than = SmallerThan(FirstNumber=distance, SecondNumber=number_slider_3)  # -> SmallerThan, OrEqualTo
panel = Panel(distance)
larger_than_2 = LargerThan(FirstNumber=distance, SecondNumber=number_slider_3)  # -> LargerThan, OrEqualTo
gate_or = GateOr()
gate_and = GateAnd()
point_in_curves = PointInCurves(Point=populate_2d_2, Curves=region_difference)  # -> Relationship, Index, Point
panel_2 = Panel(point_in_curves.Relationship)
cull_pattern = CullPattern(List=point_2, CullPattern=larger_than_2.LargerThan)
cull_pattern_2 = CullPattern(List=point_2, CullPattern=smaller_than.SmallerThan)
panel_3 = Panel(point_in_curves.Index)
line = Line(StartPoint=cull_pattern, EndPoint=point)
line_2 = Line(StartPoint=cull_pattern_2, EndPoint=point)
panel_4 = Panel(point_in_curves.Point)
construct_domain = ConstructDomain(DomainStart=0, DomainEnd=1)
range = Range(Domain=construct_domain, Steps=10)
pipe = Pipe(Curve=line_2, Radius=1, Caps=0)
graph_mapper = GraphMapper(
    range,
    x0=0,
    x1=1,
    y0=0,
    y1=1,
    container_name="Bezier",
    cpx=[0, 0.1070602536, 0.9419000149, 1],
    cpy=[0, 0.6555228829, 0.4027523994, 1])
pipe_variable = PipeVariable(Curve=line_2, Parameters=range, Radii=graph_mapper, Caps=0)

boolean_2 = Boolean(equality.Equality)
boolean_3 = Boolean(larger_than.OrEqualTo)

boundary_surfaces = BoundarySurfaces(Edges=region_union)
boundary_surfaces_2 = BoundarySurfaces(Edges=region_difference)
boundary_surfaces_3 = BoundarySurfaces(Edges=region_difference_2)

boolean_4 = Boolean(larger_than_2.LargerThan)
boolean_5 = Boolean(smaller_than.SmallerThan)

panel_5 = Panel(boolean_2)
panel_6 = Panel(boolean_3)
project_point = ProjectPoint(Point=populate_2d_2, Direction=Vector(0, 0, -1), Geometry=boundary_surfaces_2)  # -> Point, Index
panel_7 = Panel(boolean_5)
panel_8 = Panel(project_point.Point)
null_item = NullItem(Item=project_point.Point)  # -> NullFlags, InvalidFlags, Description
panel_9 = Panel(null_item.NullFlags)
clean_tree = CleanTree(RemoveNulls=True, RemoveInvalid=True, RemoveEmpty=False, Tree=project_point.Point)
panel_10 = Panel(clean_tree)

boolean_6 = Boolean(panel_9)
