# Grasshopper definition ParamsPrimitive0011.gh (Grasshopper 1.0.7)
# Copyright: Wickerson Studios
# plug-ins: KUKA|prc - parametric robot control, Bifocals

# 1001 GRASSHOPPER DEFINITIONS
# Wickerson Studio
# 
# created by: Michael Wickerson
# 
# Grasshopper for Rhino 3D Algorithmic Modeling
# 
# www.wickersonstudios.com
# www.michaelwickerson.com
# https://www.youtube.com/channel/UC7J48Ppcsa6oncp6d29R0xw
# https://github.com/mwickerson
# https://www.facebook.com/michael.wickerson
# https://www.linkedin.com/in/michael-wickerson-696a80156/
# https://www.grasshopper3d.com/profile/MichaelWickerson
image_sampler = ImageSampler(
    FilePath="C:\Users\Sculpture\Documents\2020Grasshopper\ScreenShots2019\Screenshots2020\SurfaceEditAlgorithm.PNG",
    Filter="Value",
    Interpolate=False,
    Umax=1,
    Umin=0,
    Vmax=1,
    Vmin=0,
    Wrap=1)

# ----
# Wickerson Studio
# created by: Michael Wickerson
# Grasshopper for Rhino 3D Algorithmic Modeling
# www.wickersonstudios.com
# www.michaelwickerson.com
# https://www.youtube.com/channel/UC7J48Ppcsa6oncp6d29R0xw
# https://github.com/mwickerson
# https://www.facebook.com/michael.wickerson
# https://www.linkedin.com/in/michael-wickerson-696a80156/
# https://www.grasshopper3d.com/profile/MichaelWickerson
complex = Complex()

colour = Colour()

culture = Culture()

culture_2 = Culture(1036)

list = ValueList({"Nederlands", "Norsk", "Francais", "Invariant"}, selected="Francais")
round = Round(Number=Slider(321, range=0..1000))  # -> Nearest, Floor, Ceiling
panel = Panel("""{0}
{0:0.0}
{0:#,0}
{0:#,0.0##}
{0:E}
{0:R}""")
panel_2 = Panel(culture_2)
format = Format(Format="(0)", Culture=culture_2, Data0=round.Nearest)

culture_3 = Culture(list)

num = Number("1234567.250001")
panel_3 = Panel(round.Nearest)
format_2 = Format(Format=panel, Culture=culture_3, Data0=num)
panel_4 = Panel(format)
panel_5 = Panel(format_2)
panel_6 = Panel()
text_case = TextCase(Text=panel_6, Culture=culture_2)  # -> UpperCase, LowerCase
panel_7 = Panel(text_case.UpperCase)
panel_8 = Panel(text_case.LowerCase)
domain² = Domain²()
shader = Shader()
matrix = Matrix()
data_path = DataPath()
kuka_prc_command = KUKAPrcCommand()
data = Data()
file_path = FilePath()
domain = Domain()
time = Time()
guid = Guid()

# ----
# Params Primitive 011/1001
number_slider = Slider(2, range=0..10)
create_complex = CreateComplex(Real=number_slider, Imaginary=Slider(3.28, range=0..10))
gradient = Gradient(
    LowerLimit=Slider(0, range=0..1),
    UpperLimit=Slider(0.59, range=0..1),
    Parameter=Slider(0.33, range=0..1),
    stops=[0: RGB(234, 38, 0), 0.25: RGB(234, 126, 0), 0.519: RGB(173, 203, 249), 0.755: RGB(75, 107, 169), 1: RGB(254, 244, 84)])
sphere = Sphere(Base=PlaneXY(0, 0, 0), Radius=1)
complex_argument = ComplexArgument(Complex=create_complex)
complex_components = ComplexComponents(Complex=create_complex)  # -> Real, Imaginary
complex_conjugate = ComplexConjugate(Complex=create_complex)
complex_modulus = ComplexModulus(Complex=create_complex)
panel_9 = Panel(complex_argument)
panel_10 = Panel(complex_conjugate)
panel_11 = Panel(complex_modulus)
number = Number(complex_components.Real)
number_2 = Number(complex_components.Imaginary)

complex_2 = Complex(create_complex)

colour_2 = Colour(gradient)

panel_12 = Panel(complex_2)
custom_preview = CustomPreview(Geometry=sphere, Material=colour_2)
panel_13 = Panel(colour_2)
