# Grasshopper definition ParamsPrimitive0012.gh (Grasshopper 1.0.7)
# Copyright: Wickerson Studios
# plug-ins: KUKA|prc - parametric robot control, Bifocals

# 1001 GRASSHOPPER DEFINITIONS
# Wickerson Studio
# 
# created by: Michael Wickerson
# 
# Grasshopper for Rhino 3D Algorithmic Modeling
# 
# www.wickersonstudios.com
# www.michaelwickerson.com
# https://www.youtube.com/channel/UC7J48Ppcsa6oncp6d29R0xw
# https://github.com/mwickerson
# https://www.facebook.com/michael.wickerson
# https://www.linkedin.com/in/michael-wickerson-696a80156/
# https://www.grasshopper3d.com/profile/MichaelWickerson
image_sampler = ImageSampler(
    FilePath="C:\Users\Sculpture\Documents\2020Grasshopper\ScreenShots2019\Screenshots2020\SurfaceEditAlgorithm.PNG",
    Filter="Value",
    Interpolate=False,
    Umax=1,
    Umin=0,
    Vmax=1,
    Vmin=0,
    Wrap=1)
shader = Shader()
matrix = Matrix()
data_path = DataPath()

# ----
# Wickerson Studio
# created by: Michael Wickerson
# Grasshopper for Rhino 3D Algorithmic Modeling
# www.wickersonstudios.com
# www.michaelwickerson.com
# https://www.youtube.com/channel/UC7J48Ppcsa6oncp6d29R0xw
# https://github.com/mwickerson
# https://www.facebook.com/michael.wickerson
# https://www.linkedin.com/in/michael-wickerson-696a80156/
# https://www.grasshopper3d.com/profile/MichaelWickerson
domain = Domain()

domain² = Domain²()

ghpython_script = GhPythonScript()  # -> Out, A
kuka_prc_command = KUKAPrcCommand()
data = Data()
file_path = FilePath()
time = Time()
guid = Guid()

md_slider = MDSlider(
    SliderMode=0,
    slider_value=Point(0.2809482404, 0.13568934, 0.5),
    x_domain=Domain(0, 100),
    y_domain=Domain(0, 100),
    z_domain=Domain(0, 1))
md_slider_2 = MDSlider(
    SliderMode=0,
    slider_value=Point(0.8229128324, 0.8543842595, 0.5),
    x_domain=Domain(0, 100),
    y_domain=Domain(0, 100),
    z_domain=Domain(0, 1))

consecutive_domains = ConsecutiveDomains(Numbers=[0, 0.5, 1, 1.5, 2], Additive=True)
divide_domain = DivideDomain(Domain=Domain(0, 1), Count=10)
find_domain = FindDomain(Strict=False)  # -> Index, Neighbour
includes = Includes(Domain=Domain(0, 1))  # -> Includes, Deviation

bounds_2d = Bounds2D()
divide_domain² = DivideDomain²(UCount=10, VCount=10)

construct_domain = ConstructDomain(DomainStart=Slider(0, range=0..100), DomainEnd=Slider(12, range=0..100))
range = Range(Domain=Slider(12, range=0..100), Steps=10)
range_2 = Range(Domain=construct_domain, Steps=10)
panel = Panel([range, range_2])

# ----
# Params Primitive 012/1001
number_slider = Slider(0, range=0..100)
number_slider_2 = Slider(100, range=0..100)
construct_domain_2 = ConstructDomain(DomainStart=number_slider, DomainEnd=Slider(100, range=0..100))
construct_domain² = ConstructDomain²(DomainU=md_slider, DomainV=md_slider_2)
construct_domain²_2 = ConstructDomain²(UMin=md_slider, UMax=md_slider_2, VMin=md_slider, VMax=md_slider_2)
rectangle = Rectangle(Plane=PlaneXY(0, 0, 0), XSize=number_slider_2, YSize=number_slider_2, Radius=0)  # -> Rectangle, Length
boundary_surfaces = BoundarySurfaces(Edges=rectangle.Rectangle)
number_slider_3 = Slider(0.1, range=0..1)
number_slider_4 = Slider(0.333, range=0..2)
construct_domain_3 = ConstructDomain(DomainStart=number_slider_3, DomainEnd=number_slider_4)

domain_2 = Domain(construct_domain_2)

domain²_2 = Domain²(construct_domain²_2)
domain²_3 = Domain²(construct_domain²)

deconstruct_domain = DeconstructDomain(Domain=domain_2)  # -> Start, End
deconstruct_domain² = DeconstructDomain²(Domain=domain²_3)  # -> UComponent, VComponent
deconstruct_domain²_2 = DeconstructDomain²(Domain=domain²_2)  # -> UMin, UMax, VMin, VMax
construct_point = ConstructPoint(XCoordinate=deconstruct_domain.Start, YCoordinate=deconstruct_domain.Start, ZCoordinate=0)
construct_point_2 = ConstructPoint(XCoordinate=deconstruct_domain.End, YCoordinate=deconstruct_domain.End, ZCoordinate=0)
panel_2 = Panel(deconstruct_domain².UComponent)
panel_3 = Panel(deconstruct_domain².VComponent)
panel_4 = Panel(deconstruct_domain²_2.UMax)
panel_5 = Panel(deconstruct_domain²_2.UMin)
panel_6 = Panel(deconstruct_domain²_2.VMin)
panel_7 = Panel(deconstruct_domain²_2.VMax)
construct_domain_4 = ConstructDomain(DomainStart=deconstruct_domain²_2.VMin, DomainEnd=deconstruct_domain²_2.VMax)
construct_domain_5 = ConstructDomain(DomainStart=deconstruct_domain²_2.UMin, DomainEnd=deconstruct_domain²_2.UMax)
bounds = Bounds(Numbers=construct_point_2)
plane_surface = PlaneSurface(Plane=PlaneXY(0, 0, 0), XSize=deconstruct_domain².UComponent, YSize=deconstruct_domain².VComponent)
plane_surface_2 = PlaneSurface(Plane=PlaneXY(0, 0, 0), XSize=construct_domain_5, YSize=construct_domain_4)

distance = Distance(PointA=construct_point, PointB=construct_point_2)
line = Line(StartPoint=construct_point, EndPoint=construct_point_2)

remap = Remap(data=distance, min=number_slider_3, max=number_slider_4)
remap_numbers = RemapNumbers(Value=distance, Source=bounds, Target=construct_domain_3)  # -> Mapped, Clipped
scale = Scale(Geometry=line, Center=Point(0, 0, 0), Factor=remap_numbers.Mapped)  # -> Geometry, Transform
scale_2 = Scale(Geometry=line, Center=Point(0, 0, 0), Factor=remap)  # -> Geometry, Transform

# ==== cluster Remap: Remaps numbers
data = ClusterInput()
min = ClusterInput()
max = ClusterInput()
bnd = Bounds(Numbers=data)
dom = ConstructDomain(DomainStart=min, DomainEnd=max)
remap = RemapNumbers(Value=data, Source=bnd, Target=dom)  # -> Mapped, Clipped
R = ClusterOutput(remap.Mapped)
