# Grasshopper definition ParamsPrimitive013.gh (Grasshopper 1.0.7)
# Copyright: Wickerson Studios
# plug-ins: KUKA|prc - parametric robot control, Bifocals

# 1001 GRASSHOPPER DEFINITIONS
# Wickerson Studio
# 
# created by: Michael Wickerson
# 
# Grasshopper for Rhino 3D Algorithmic Modeling
# 
# www.wickersonstudios.com
# www.michaelwickerson.com
# https://www.youtube.com/channel/UC7J48Ppcsa6oncp6d29R0xw
# https://github.com/mwickerson
# https://www.facebook.com/michael.wickerson
# https://www.linkedin.com/in/michael-wickerson-696a80156/
# https://www.grasshopper3d.com/profile/MichaelWickerson
image_sampler = ImageSampler(
    FilePath="C:\Users\Sculpture\Documents\2020Grasshopper\ScreenShots2019\Screenshots2020\SurfaceEditAlgorithm.PNG",
    Filter="Value",
    Interpolate=False,
    Umax=1,
    Umin=0,
    Vmax=1,
    Vmin=0,
    Wrap=1)
shader = Shader()
matrix = Matrix()

ghpython_script = GhPythonScript()  # -> Out, A

data_path = DataPath()

# ----
# Wickerson Studio
# created by: Michael Wickerson
# Grasshopper for Rhino 3D Algorithmic Modeling
# www.wickersonstudios.com
# www.michaelwickerson.com
# https://www.youtube.com/channel/UC7J48Ppcsa6oncp6d29R0xw
# https://github.com/mwickerson
# https://www.facebook.com/michael.wickerson
# https://www.linkedin.com/in/michael-wickerson-696a80156/
# https://www.grasshopper3d.com/profile/MichaelWickerson
guid = Guid()

kuka_prc_command = KUKAPrcCommand()
data = Data()
file_path = FilePath()
time = Time()
# Karl Singline Robotics Extraordinaire!
# 
# https://www.youtube.com/watch?v=HQzXb5W2x1U&list=PL9_ezjc1QnA-cNAS_c81a1GBbJPISV50O&index=15&t=0s&app=desktop
# 
# CONTROL C
cylinder = Cylinder(Base=PlaneXY(0, 0, 0), Radius=0.5, Length=1)
panel = Panel("""<?xml version="1.0" encoding="utf-8" standalone="yes"?>
<Archive name="Root">
  <!--Grasshopper archive-->
  <!--Grasshopper and GH_IO.dll are copyrighted by Robert McNeel & Associates-->
  <!--Archive generated by GH_IO.dll file utility library {0.2.0002}-->
  <items count="1">
    <item name="ArchiveVersion" type_name="gh_version" type_code="80">
      <Major>0</Major>
      <Minor>2</Minor>
      <Revision>2</Revision>
    </item>
  </items>
  <chunks count="1">
    <chunk name="Clipboard">
      <items count="1">
        <item name="plugin_version" type_name="gh_version" type_code="80">
          <Major>1</Major>
          <Minor>0</Minor>
          <Revision>7</Revision>
        </item>
      </items>
      <chunks count="6">
        <chunk name="DocumentHeader">
          <items count="6">
            <item name="DocumentID" type_name="gh_guid" type_code="9">30c26c43-b55d-45a8-99fc-fbd80b716d93</item>
            <item name="Preview" type_name="gh_string" type_code="10">Shaded</item>
            <item name="PreviewFilter" type_name="gh_string" type_code="10">Selection</item>
            <item name="PreviewMeshType" type_name="gh_int32" type_code="3">1</item>
            <item name="PreviewNormal" type_name="gh_drawing_color" type_code="36">
              <ARGB>155;243;121;70</ARGB>
            </item>
            <item name="PreviewSelected" type_name="gh_drawing_color" type_code="36">
              <ARGB>225;0;152;200</ARGB>
            </item>
          </items>
        </chunk>
        <chunk name="DefinitionProperties">
          <items count="3">
            <item name="Date" type_name="gh_date" type_code="8">637282413605492182</item>
            <item name="Description" type_name="gh_string" type_code="10"></item>
            <item name="Name" type_name="gh_string" type_code="10">ParamsPrimitive013.gh</item>
          </items>
          <chunks count="3">
            <chunk name="Revisions">
              <items count="1">
                <item name="RevisionCount" type_name="gh_int32" type_code="3">0</item>
              </items>
            </chunk>
            <chunk name="Projection">
              <items count="2">
                <item name="Target" type_name="gh_drawing_point" type_code="30">
                  <X>-17</X>
                  <Y>-548</Y>
                </item>
                <item name="Zoom" type_name="gh_single" type_code="5">0.903125644</item>
              </items>
            </chunk>
            <chunk name="Views">
              <items count="1">
                <item name="ViewCount" type_name="gh_int32" type_code="3">0</item>
              </items>
            </chunk>
          </chunks>
        </chunk>
        <chunk name="RcpLayout">
          <items count="1">
            <item name="GroupCount" type_name="gh_int32" type_code="3">0</item>
          </items>
        </chunk>
        <chunk name="Author">
          <items count="7">
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""")
cylinder_2 = Cylinder(Base=PlaneXY(0, 0, 0), Radius=0.5, Length=1)
python = GhPythonScript(x=cylinder_2)  # -> out, a
# ---------- python: Python ----------
__author__ = "Sculpture"
__version__ = "2020.03.15"

import rhinoscriptsyntax as rs

for input in ghenv.Component.Params.Input:
    for source in input.Sources:
        a = str (source.InstanceGuid)
# ---------- end python ----------
panel_2 = Panel(python.a)

construct_point = ConstructPoint(XCoordinate=0, YCoordinate=0, ZCoordinate=0)
# Params Primitive 013/1001
circle = Circle(Plane=PlaneXY(0, 0, 0), Radius=1)
center_box = CenterBox(Base=PlaneXY(0, 0, 0), X=1, Y=1, Z=1)

python_2 = GhPythonScript(x=circle)  # -> out, a; same code as python
python_3 = GhPythonScript(x=construct_point)  # -> out, a; same code as python
python_4 = GhPythonScript(x=cylinder)  # -> out, a; same code as python

panel_3 = Panel(python_2.a)
panel_4 = Panel(python_3.a)
panel_5 = Panel(python_4.a)

guid_2 = Guid(panel_3)
guid_3 = Guid(panel_4)
guid_4 = Guid(panel_5)
