# Grasshopper definition ParamsPrimitive014.gh (Grasshopper 1.0.7)
# Copyright: Wickerson Studios
# plug-ins: KUKA|prc - parametric robot control, Bifocals

# 1001 GRASSHOPPER DEFINITIONS
# Wickerson Studio
# 
# created by: Michael Wickerson
# 
# Grasshopper for Rhino 3D Algorithmic Modeling
# 
# www.wickersonstudios.com
# www.michaelwickerson.com
# https://www.youtube.com/channel/UC7J48Ppcsa6oncp6d29R0xw
# https://github.com/mwickerson
# https://www.facebook.com/michael.wickerson
# https://www.linkedin.com/in/michael-wickerson-696a80156/
# https://www.grasshopper3d.com/profile/MichaelWickerson
image_sampler = ImageSampler(
    FilePath="C:\Users\Sculpture\Documents\2020Grasshopper\ScreenShots2019\Screenshots2020\SurfaceEditAlgorithm.PNG",
    Filter="Value",
    Interpolate=False,
    Umax=1,
    Umin=0,
    Vmax=1,
    Vmin=0,
    Wrap=1)

# ----
# Wickerson Studio
# created by: Michael Wickerson
# Grasshopper for Rhino 3D Algorithmic Modeling
# www.wickersonstudios.com
# www.michaelwickerson.com
# https://www.youtube.com/channel/UC7J48Ppcsa6oncp6d29R0xw
# https://github.com/mwickerson
# https://www.facebook.com/michael.wickerson
# https://www.linkedin.com/in/michael-wickerson-696a80156/
# https://www.grasshopper3d.com/profile/MichaelWickerson
matrix = Matrix()

ghpython_script = GhPythonScript()  # -> Out, A

shader = Shader()
data_path = DataPath()
kuka_prc_command = KUKAPrcCommand()
data = Data()
number_slider = Slider(56, range=0..100)
file_path = FilePath()
xz_plane = XZPlane(Origin=Point(0, 0, 0))
time = Time()
cylinder = Cylinder(Base=xz_plane, Radius=number_slider, Length=number_slider)

# ----
# Rya Issa: Essential Mathematics
number_slider_2 = Slider(0.4, range=0..1)
box = Box([{Plane=PlaneXY(-72, -5, 0), X=Domain(0, 88), Y=Domain(0, 34), Z=Domain(0, 17)}, {Plane=PlaneXY(-83, -97, 0), X=Domain(0, 18), Y=Domain(0, 31), Z=Domain(0, 20)}, {Plane=PlaneXY(25, -49, 0), X=Domain(0, 36), Y=Domain(0, 39), Z=Domain(0, 15)}, {Plane=PlaneXY(-60, -159, 0), X=Domain(0, 64), Y=Domain(0, 139), Z=Domain(0, 12)}])
pi = Pi(Factor=number_slider_2)
ghpython_script_2 = GhPythonScript(geom=[cylinder, box], angle=pi, scale=Slider(0.4, range=0..1))  # -> out, A, M; inputs geom: list of GeometryBase
# ---------- ghpython_script_2: Python ----------
__author__ = "RajaaIssa"
__version__ = "2019.05.30"

import Rhino

#Move to origin, find center
center = Rhino.Geometry.Point3d.Unset
if geom.Count > 0:
    bbox = geom[0].GetBoundingBox(True)
    for i in range(1, geom.Count):
        bbox.Union(geom[i].GetBoundingBox(True))
    center = bbox.Center

origin = Rhino.Geometry.Point3d.Origin
#Create move transformation matrix
m1 = Rhino.Geometry.Transform.Translation(origin - center)
#Create rotation transformation matrix
m2 = Rhino.Geometry.Transform.Rotation(angle, origin)
#Create scale transformation matrix
m3 = Rhino.Geometry.Transform.Scale(origin, scale)
#Create move back transformation matrix
m4 = Rhino.Geometry.Transform.Identity
result, m4 = m1.TryGetInverse()

#Multiply from last to first transformation
matrix = m4 * m3 * m2 * m1

#Apply transformation to all input geometry
for g in geom:
    g.Transform(matrix)

#Assign output
M = matrix
A = geom
# ---------- end ghpython_script_2 ----------
display_matrix = DisplayMatrix(ghpython_script_2.M)
geometry = Geometry(ghpython_script_2.A)

# ----
# Params Primitive 014/1001
number_slider_3 = Slider(4, range=0..10)
panel = Panel("""1
2
3
4
5
2
3
7
8
9
8
7
6
5
4
3""")
list_length = ListLength(List=panel)
construct_matrix = ConstructMatrix(Rows=number_slider_3, Columns=number_slider_3, Values=panel)
panel_2 = Panel(list_length)
deconstruct_matrix = DeconstructMatrix(Matrix=construct_matrix)  # -> Rows, Columns, Values
transpose_matrix = TransposeMatrix(Matrix=construct_matrix)

matrix_2 = Matrix(construct_matrix)

matrix_3 = Matrix(construct_matrix)

matrix_4 = Matrix(transpose_matrix)

invert_matrix = InvertMatrix(Matrix=matrix_2, Tolerance=0)  # -> Matrix, Success
swap_columns = SwapColumns(Matrix=matrix_2, ColumnA=Slider(2, range=0..10), ColumnB=Slider(3, range=0..10))
swap_rows = SwapRows(Matrix=matrix_2, RowA=Slider(2, range=0..10), RowB=Slider(1, range=0..10))
display_matrix_2 = DisplayMatrix(invert_matrix.Matrix)
display_matrix_3 = DisplayMatrix(swap_columns)
display_matrix_4 = DisplayMatrix(swap_columns)
display_matrix_5 = DisplayMatrix(matrix_3)
display_matrix_6 = DisplayMatrix(matrix_4)
