# Grasshopper definition ParamsPrimitive015.gh (Grasshopper 1.0.7)
# Copyright: Wickerson Studios
# plug-ins: KUKA|prc - parametric robot control, Bifocals

image_sampler = ImageSampler(
    FilePath="C:\Users\Sculpture\Documents\2020Grasshopper\ScreenShots2019\Screenshots2020\SurfaceEditAlgorithm.PNG",
    Filter="Value",
    Interpolate=False,
    Umax=1,
    Umin=0,
    Vmax=1,
    Vmin=0,
    Wrap=1)

# ----
# 1001 GRASSHOPPER DEFINITIONS
# Wickerson Studio
# 
# created by: Michael Wickerson
# 
# Grasshopper for Rhino 3D Algorithmic Modeling
# 
# www.wickersonstudios.com
# www.michaelwickerson.com
# https://www.youtube.com/channel/UC7J48Ppcsa6oncp6d29R0xw
# https://github.com/mwickerson
# https://www.facebook.com/michael.wickerson
# https://www.linkedin.com/in/michael-wickerson-696a80156/
# https://www.grasshopper3d.com/profile/MichaelWickerson
# Wickerson Studio
# created by: Michael Wickerson
# Grasshopper for Rhino 3D Algorithmic Modeling
# www.wickersonstudios.com
# www.michaelwickerson.com
# https://www.youtube.com/channel/UC7J48Ppcsa6oncp6d29R0xw
# https://github.com/mwickerson
# https://www.facebook.com/michael.wickerson
# https://www.linkedin.com/in/michael-wickerson-696a80156/
# https://www.grasshopper3d.com/profile/MichaelWickerson
time = Time()

file_path = FilePath()
data_path = DataPath()
data = Data()
kuka_prc_command = KUKAPrcCommand()
shader = Shader()

# ----
# Params Primitive 015/1001
# Time parameter
# 
# 
# 
#  Represents a collection of Time and Date values. Time parameters are capable of storing persistent data. You can set the persistent records through the parameter menu.
# 
# 
#  Developer contact
# 
# 
#  Remarks:
# • Time parameters are currently not used in any Grasshopper components. They are included for future functionality.
construct_date = ConstructDate(Year=2020, Month=6, Day=22, Hour=12, Minute=0, Second=0)
construct_smooth_time = ConstructSmoothTime(Days=0, Hours=0, Minutes=0, Seconds=0)
construct_exotic_date = ConstructExoticDate(Calendar=0)
interpolate_date = InterpolateDate(Interpolation=0)
construct_time = ConstructTime(Hour=21, Minute=34, Second=0)
deconstruct_date = DeconstructDate(Date=637284584588103922)  # -> Year, Month, Day, Hour, Minute, Second
combine_date_time = CombineDateTime()
date_range = DateRange(Count=10)
time_2 = Time(construct_date)
time_3 = Time(construct_smooth_time)
year = Year(2020)
month = Month(5)
hour = Hour(12)
minute = Minute(0)
second = Second(0)
day = Day(21)
second_2 = Second(0)
minute_2 = Minute(29)
hour_2 = Hour(12)
panel = Panel(year)
panel_2 = Panel(second)
panel_3 = Panel(month)
panel_4 = Panel(minute)
panel_5 = Panel(hour_2)
panel_6 = Panel(minute_2)
panel_7 = Panel(second_2)
year_2 = Year("2020")
month_2 = Month(Slider(3, range=1..12))
day_2 = Day(Slider(31, range=1..31))
panel_8 = Panel(day)
panel_9 = Panel(hour)

time_4 = Time(construct_time)

construct_time_2 = ConstructTime(Hour=hour_2, Minute=minute_2, Second=second_2)

construct_exotic_date_2 = ConstructExoticDate(Year=year_2, Month=month_2, Day=day_2, Calendar=0)

construct_date_2 = ConstructDate(Year=year, Month=month, Day=day, Hour=hour, Minute=minute, Second=second)

time_5 = Time(construct_date_2)

combine_date_time_2 = CombineDateTime(Date=construct_exotic_date_2, Time=construct_time_2)

deconstruct_date_2 = DeconstructDate(Date=construct_date_2)  # -> Year, Month, Day, Hour, Minute, Second

panel_10 = Panel(construct_time_2)
time_6 = Time(construct_exotic_date_2)
panel_11 = Panel(construct_exotic_date_2)
panel_12 = Panel(construct_date_2)
panel_13 = Panel(combine_date_time_2)
panel_14 = Panel(deconstruct_date_2.Year)
panel_15 = Panel(deconstruct_date_2.Day)
panel_16 = Panel(deconstruct_date_2.Hour)
panel_17 = Panel(deconstruct_date_2.Minute)
panel_18 = Panel(deconstruct_date_2.Month)
panel_19 = Panel(deconstruct_date_2.Second)

interpolate_date_2 = InterpolateDate(DateA=time_5, DateB=time_6, Interpolation=Toggle(False))
date_range_2 = DateRange(TimeA=time_5, TimeB=time_6, Count=10)

panel_20 = Panel(date_range_2)
panel_21 = Panel(interpolate_date_2)
