# Grasshopper definition ParamsPrimitive016.gh (Grasshopper 1.0.7)
# Copyright: Wickerson Studios
# plug-ins: Bifocals

# 1001 GRASSHOPPER DEFINITIONS
# Wickerson Studio
# 
# created by: Michael Wickerson
# 
# Grasshopper for Rhino 3D Algorithmic Modeling
# 
# www.wickersonstudios.com
# www.michaelwickerson.com
# https://www.youtube.com/channel/UC7J48Ppcsa6oncp6d29R0xw
# https://github.com/mwickerson
# https://www.facebook.com/michael.wickerson
# https://www.linkedin.com/in/michael-wickerson-696a80156/
# https://www.grasshopper3d.com/profile/MichaelWickerson
image_sampler = ImageSampler(
    FilePath="C:\Users\Sculpture\Documents\2020Grasshopper\ScreenShots2019\Screenshots2020\SurfaceEditAlgorithm.PNG",
    Filter="Value",
    Interpolate=False,
    Umax=1,
    Umin=0,
    Vmax=1,
    Vmin=0,
    Wrap=1)

range = Range(Domain=Domain(0, 1), Steps=10)
# Wickerson Studio
# created by: Michael Wickerson
# Grasshopper for Rhino 3D Algorithmic Modeling
# www.wickersonstudios.com
# www.michaelwickerson.com
# https://www.youtube.com/channel/UC7J48Ppcsa6oncp6d29R0xw
# https://github.com/mwickerson
# https://www.facebook.com/michael.wickerson
# https://www.linkedin.com/in/michael-wickerson-696a80156/
domain = Domain()

mesh = Mesh(<mesh referenced from the Rhino model>)
mesh_2 = Mesh(<mesh referenced from the Rhino model>)
mesh_3 = Mesh(<mesh referenced from the Rhino model>)
# Params Primitive 016/1001
deconstruct_mesh = DeconstructMesh(Mesh=mesh)  # -> Vertices, Faces, Colours, Normals
deconstruct_mesh_2 = DeconstructMesh(Mesh=mesh_2)  # -> Vertices, Faces, Colours, Normals
deconstruct_mesh_3 = DeconstructMesh(Mesh=mesh_3)  # -> Vertices, Faces, Colours, Normals
deconstruct = Deconstruct(Point=deconstruct_mesh.Vertices)  # -> XComponent, YComponent, ZComponent
deconstruct_2 = Deconstruct(Point=deconstruct_mesh_2.Vertices)  # -> XComponent, YComponent, ZComponent
deconstruct_3 = Deconstruct(Point=deconstruct_mesh_3.Vertices)  # -> XComponent, YComponent, ZComponent
sort_list = SortList(Keys=deconstruct.XComponent, ValuesA=deconstruct.XComponent)  # -> Keys, flatten(ValuesA)
sort_list_2 = SortList(Keys=deconstruct.YComponent, ValuesValuesA=deconstruct.YComponent)  # -> Keys, flatten(ValuesValuesA)
sort_list_3 = SortList(Keys=deconstruct.ZComponent, ValuesValuesA=deconstruct.ZComponent)  # -> Keys, flatten(ValuesValuesA)
sort_list_4 = SortList(Keys=deconstruct_2.XComponent, ValuesValuesA=deconstruct_2.XComponent)  # -> Keys, flatten(ValuesValuesA)
sort_list_5 = SortList(Keys=deconstruct_2.YComponent, ValuesValuesA=deconstruct_2.YComponent)  # -> Keys, flatten(ValuesValuesA)
sort_list_6 = SortList(Keys=deconstruct_2.ZComponent, ValuesValuesA=deconstruct_2.ZComponent)  # -> Keys, flatten(ValuesValuesA)
sort_list_7 = SortList(Keys=deconstruct_3.XComponent, ValuesValuesA=deconstruct_3.XComponent)  # -> Keys, flatten(ValuesValuesA)
sort_list_8 = SortList(Keys=deconstruct_3.YComponent, ValuesValuesA=deconstruct_3.YComponent)  # -> Keys, flatten(ValuesValuesA)
sort_list_9 = SortList(Keys=deconstruct_3.ZComponent, ValuesValuesA=deconstruct_3.ZComponent)  # -> Keys, flatten(ValuesValuesA)
panel = Panel("""0
-1""")
panel_2 = Panel("""0
-1""")
panel_3 = Panel("""0
-1""")
panel_4 = Panel("""0
-1""")
panel_5 = Panel("""0
-1""")
panel_6 = Panel("""0
-1""")
panel_7 = Panel("""0
-1""")
panel_8 = Panel("""0
-1""")
panel_9 = Panel("""0
-1""")
list_item = ListItem(List=sort_list.ValuesA, Index=graft(panel), Wrap=True)  # -> flatten(Item)
list_item_2 = ListItem(List=sort_list_4.ValuesValuesA, Index=graft(panel_4), Wrap=True)  # -> flatten(Item)
list_item_3 = ListItem(List=sort_list_2.ValuesValuesA, Index=graft(panel_3), Wrap=True)
list_item_4 = ListItem(List=sort_list_3.ValuesValuesA, Index=graft(panel_2), Wrap=True)
list_item_5 = ListItem(List=sort_list_5.ValuesValuesA, Index=graft(panel_5), Wrap=True)
list_item_6 = ListItem(List=sort_list_6.ValuesValuesA, Index=graft(panel_6), Wrap=True)
list_item_7 = ListItem(List=sort_list_7.ValuesValuesA, Index=graft(panel_7), Wrap=True)  # -> flatten(Item)
list_item_8 = ListItem(List=sort_list_8.ValuesValuesA, Index=graft(panel_8), Wrap=True)
list_item_9 = ListItem(List=sort_list_9.ValuesValuesA, Index=graft(panel_9), Wrap=True)
dispatch = Dispatch(List=flatten(list_item), DispatchPattern=[True, False])  # -> ListA, ListB
dispatch_2 = Dispatch(List=flatten(list_item_3), DispatchPattern=[True, False])  # -> ListA, ListB
dispatch_3 = Dispatch(List=flatten(list_item_4), DispatchPattern=[True, False])  # -> ListA, ListB
dispatch_4 = Dispatch(List=flatten(list_item_2), DispatchPattern=[True, False])  # -> ListA, ListB
dispatch_5 = Dispatch(List=flatten(list_item_5), DispatchPattern=[True, False])  # -> ListA, ListB
dispatch_6 = Dispatch(List=flatten(list_item_6), DispatchPattern=[True, False])  # -> ListA, ListB
dispatch_7 = Dispatch(List=flatten(list_item_7), DispatchPattern=[True, False])  # -> ListA, ListB
dispatch_8 = Dispatch(List=flatten(list_item_8), DispatchPattern=[True, False])  # -> ListA, ListB
dispatch_9 = Dispatch(List=flatten(list_item_9), DispatchPattern=[True, False])  # -> ListA, ListB
panel_10 = Panel(dispatch.ListA)
panel_11 = Panel(dispatch.ListB)
panel_12 = Panel(dispatch_2.ListA)
panel_13 = Panel(dispatch_2.ListB)
panel_14 = Panel(dispatch_3.ListB)
panel_15 = Panel(dispatch_3.ListA)
panel_16 = Panel(dispatch_6.ListB)
panel_17 = Panel(dispatch_4.ListA)
panel_18 = Panel(dispatch_4.ListB)
panel_19 = Panel(dispatch_5.ListA)
panel_20 = Panel(dispatch_5.ListB)
panel_21 = Panel(dispatch_6.ListA)
panel_22 = Panel(dispatch_9.ListB)
panel_23 = Panel(dispatch_7.ListA)
panel_24 = Panel(dispatch_7.ListB)
panel_25 = Panel(dispatch_8.ListA)
panel_26 = Panel(dispatch_8.ListB)
panel_27 = Panel(dispatch_9.ListA)
construct_point = ConstructPoint(XCoordinate=panel_10, YCoordinate=panel_12, ZCoordinate=panel_15)
construct_point_2 = ConstructPoint(XCoordinate=panel_11, YCoordinate=panel_13, ZCoordinate=panel_14)
construct_point_3 = ConstructPoint(XCoordinate=panel_17, YCoordinate=panel_19, ZCoordinate=panel_21)
construct_point_4 = ConstructPoint(XCoordinate=panel_18, YCoordinate=panel_20, ZCoordinate=panel_16)
construct_point_5 = ConstructPoint(XCoordinate=panel_23, YCoordinate=panel_25, ZCoordinate=panel_27)
construct_point_6 = ConstructPoint(XCoordinate=panel_24, YCoordinate=panel_26, ZCoordinate=panel_22)
line = Line(StartPoint=construct_point, EndPoint=construct_point_2)
line_2 = Line(StartPoint=construct_point_3, EndPoint=construct_point_4)
line_3 = Line(StartPoint=construct_point_5, EndPoint=construct_point_6)
number_slider = Slider(8.07, range=0..10)
line_4 = Line(StartPoint=construct_point, EndPoint=construct_point_4)
merge = Merge(
    Data1=construct_point,
    Data2=construct_point_2,
    Data3=construct_point_3,
    Data4=construct_point_4,
    Data5=construct_point_5,
    Data6=construct_point_6)
merge_2 = Merge(Data1=line_2, Data2=line_3)
merge_3 = Merge(Data1=line, Data2=line_4)
number_slider_2 = Slider(10, range=3..10)
mesh_sphere = MeshSphere(Base=merge, Radius=expr("x*2", number_slider), UCount=number_slider_2, VCount=number_slider_2)

construct_domain = ConstructDomain(DomainStart=0, DomainEnd=Slider(1, range=0..1))
construct_domain_2 = ConstructDomain(DomainStart=Slider(2.52, range=0..10), DomainEnd=Slider(8.07, range=0..10))
range_2 = Range(Domain=construct_domain_2, Steps=10)
range_3 = Range(Domain=construct_domain, Steps=10)

construct_domain_3 = ConstructDomain(DomainStart=0, DomainEnd=Slider(1, range=0..1))
construct_domain_4 = ConstructDomain(DomainStart=Slider(2.52, range=0..10), DomainEnd=number_slider)
range_4 = Range(Domain=construct_domain_4, Steps=10)
range_5 = Range(Domain=construct_domain_3, Steps=10)

graph_mapper = GraphMapper(
    range_4,
    x0=0,
    x1=20,
    y0=0,
    y1=20,
    container_name="Sine",
    Equation_px=[0.3499030471, 0.1856388748],
    Equation_py=[0.3819279075, 0.9020544887])
graph_mapper_2 = GraphMapper(
    range_2,
    x0=0,
    x1=20,
    y0=0,
    y1=20,
    container_name="Sine Summation",
    Equation0_px=[0.2, 0.05199487507],
    Equation0_py=[0.2, 0.4931834936],
    Equation1_px=[0.0724549219, 0.9],
    Equation1_py=[0.04987633228, 0.5])
pipe_variable = PipeVariable(Curve=reparameterize(merge_3), Parameters=range_5, Radii=graph_mapper, Caps=Toggle(True))
pipe_variable_2 = PipeVariable(Curve=reparameterize(merge_2), Parameters=range_3, Radii=graph_mapper_2, Caps=Toggle(True))
merge_4 = Merge(Data1=pipe_variable, Data2=mesh_sphere, Data3=pipe_variable_2)
mirror = Mirror(Geometry=merge_4, Plane=PlaneYZ(0, 0, 0))  # -> Geometry, Transform

merge_5 = Merge(Data1=merge_4, Data2=mirror.Geometry)
