# Grasshopper definition ParamsPrimitive017.gh (Grasshopper 1.0.7)
# Copyright: Wickerson Studios
# plug-ins: KUKA|prc - parametric robot control, Bifocals

image_sampler = ImageSampler(
    FilePath="C:\Users\Sculpture\Documents\2020Grasshopper\ScreenShots2019\Screenshots2020\SurfaceEditAlgorithm.PNG",
    Filter="Value",
    Interpolate=False,
    Umax=1,
    Umin=0,
    Vmax=1,
    Vmin=0,
    Wrap=1)

# ----
# 1001 GRASSHOPPER DEFINITIONS
# Wickerson Studio
# 
# created by: Michael Wickerson
# 
# Grasshopper for Rhino 3D Algorithmic Modeling
# 
# www.wickersonstudios.com
# www.michaelwickerson.com
# https://www.youtube.com/channel/UC7J48Ppcsa6oncp6d29R0xw
# https://github.com/mwickerson
# https://www.facebook.com/michael.wickerson
# https://www.linkedin.com/in/michael-wickerson-696a80156/
# https://www.grasshopper3d.com/profile/MichaelWickerson
file_path = FilePath()
# Wickerson Studio
# created by: Michael Wickerson
# Grasshopper for Rhino 3D Algorithmic Modeling
# www.wickersonstudios.com
# www.michaelwickerson.com
# https://www.youtube.com/channel/UC7J48Ppcsa6oncp6d29R0xw
# https://github.com/mwickerson
# https://www.facebook.com/michael.wickerson
# https://www.linkedin.com/in/michael-wickerson-696a80156/
# https://www.grasshopper3d.com/profile/MichaelWickerson
data = Data()

# ---- group: Jump
data_path = DataPath()

# ----
kuka_prc_command = KUKAPrcCommand()
shader = Shader()

# ----
# Params Primitive 017/1001
file_path_2 = FilePath("C:\Users\Sculpture\Documents\2020Grasshopper\ScreenShots2019\BlackandWhiteMax.PNG")
file_path_3 = FilePath("C:\Users\Sculpture\Documents\2020Grasshopper\ScreenShots2019\BlackandWhiteOscar.PNG")

data_2 = Data(file_path_2)
data_3 = Data(file_path_3)

image_sampler_2 = ImageSampler(
    FilePath="C:\Users\Sculpture\Documents\2020Grasshopper\ScreenShots2019\BlackandWhiteMax.PNG",
    Filter="Value",
    Interpolate=True,
    Umax=1,
    Umin=0,
    Vmax=1,
    Vmin=0,
    Wrap=1)
file_path_4 = FilePath("C:\Users\Sculpture\Downloads\1btn.pdb")
import_pdb = ImportPDB(File=file_path_4)  # -> Atoms, Bonds
image_sampler_3 = ImageSampler(
    file_path_3,
    FilePath="C:\Users\Sculpture\Documents\2020Grasshopper\ScreenShots2019\BlackandWhiteMax.PNG",
    Filter="Value",
    Interpolate=True,
    Umax=1,
    Umin=0,
    Vmax=1,
    Vmin=0,
    Wrap=1)
panel = Panel(data_2)
panel_2 = Panel(data_3)
atom_data = AtomData(Atom=import_pdb.Atoms)  # -> Point, Element, Chain, Residue, Charge, Occupancy, Temperature, AtomicNumber, SerialNumber, ResidueNumber
data_4 = Data(import_pdb.Atoms)
panel_3 = Panel(image_sampler_3)
unit_z = UnitZ(Factor=Slider(2, range=0..10))
range = Range(Domain=Domain(0, 1), Steps=Slider(5, range=0..10))
range_2 = Range(Domain=Domain(0, 1), Steps=Slider(2, range=0..10))
panel_4 = Panel(atom_data.Point)
panel_5 = Panel(atom_data.Element)
panel_6 = Panel(atom_data.Temperature)
panel_7 = Panel(atom_data.AtomicNumber)
panel_8 = Panel(atom_data.SerialNumber)
panel_9 = Panel(atom_data.ResidueNumber)
unit_z_2 = UnitZ(Factor=range_2)
pi = Pi(Factor=range)
construct_point = ConstructPoint(XCoordinate=0, YCoordinate=0, ZCoordinate=0)
move = Move(Geometry=construct_point, Motion=unit_z)  # -> Geometry, Transform
line = Line(StartPoint=construct_point, EndPoint=move.Geometry)
cylinder = Cylinder(Base=PlaneXY(0, 0, 0), Radius=0.5, Length=1)
move_2 = Move(Geometry=cylinder, Motion=unit_z_2)  # -> Geometry, Transform
rotate_3d = Rotate3D(Geometry=move_2.Geometry, Angle=pi, Center=Point(0, 0, 0), Axis=Vector(0, 0, 1))  # -> Geometry, Transform
panel_10 = Panel(data_4)
data_path_2 = DataPath(construct_point)
list_length = ListLength(List=panel_4)
param_viewer = ParamViewer(panel_4)
division = Division(A=list_length, B=Slider(1.011, range=1.001..1.1))
panel_11 = Panel(data_path_2)
random_reduce = RandomReduce(List=panel_4, Reduction=division, Seed=Slider(66, range=0..100))
range_3 = Range(Domain=Domain(0, 1), Steps=10)
shift_list = ShiftList(List=random_reduce, Shift=1, Wrap=True)
range_4 = Range(Domain=Domain(0, 1), Steps=10)
shift_list_2 = ShiftList(List=random_reduce, Shift=Slider(2, range=0..10), Wrap=True)
line_2 = Line(StartPoint=random_reduce, EndPoint=shift_list)
line_3 = Line(StartPoint=random_reduce, EndPoint=shift_list_2)
graph_mapper = GraphMapper(
    range_4,
    x0=0,
    x1=1,
    y0=0,
    y1=1,
    Ox=0.4750463367,
    Oy=0.04184091091,
    Px=0.6260792017,
    Py=0.2023147345,
    container_name="Parabola")
graph_mapper_2 = GraphMapper(
    range_3,
    x0=0,
    x1=1,
    y0=0,
    y1=1,
    container_name="Sine Summation",
    Equation0_px=[0.2, 0.7553233504],
    Equation0_py=[0.2, 0.5267325044],
    Equation1_px=[0.1535485238, 0.7312524915],
    Equation1_py=[0.1977618933, 0.3983534575])
pipe_variable = PipeVariable(Curve=reparameterize(line_2), Parameters=range_3, Radii=graph_mapper_2, Caps=0)
path_compare = PathCompare(Mask="*")
pipe_variable_2 = PipeVariable(Curve=reparameterize(line_3), Parameters=range_4, Radii=graph_mapper, Caps=0)
path_mapper = PathMapper()
construct_path = ConstructPath()
replace_paths = ReplacePaths(Search="*")
shift_paths = ShiftPaths(Offset=-1)

data_path_3 = DataPath(line)
data_path_4 = DataPath(cylinder)
data_path_5 = DataPath(move_2.Geometry)
data_path_6 = DataPath(rotate_3d.Geometry)

panel_12 = Panel(data_path_3)
panel_13 = Panel(data_path_4)
panel_14 = Panel(data_path_5)
panel_15 = Panel(data_path_6)
deconstruct_path = DeconstructPath(Branch=data_path_4)
deconstruct_path_2 = DeconstructPath(Branch=data_path_5)
deconstruct_path_3 = DeconstructPath(Branch=data_path_6)
panel_16 = Panel(deconstruct_path)
panel_17 = Panel(deconstruct_path_2)
panel_18 = Panel(deconstruct_path_3)
