# Grasshopper definition ParamsPrimitive018.gh (Grasshopper 1.0.7)
# Copyright: Wickerson Studios
# plug-ins: Robots, KUKA|prc - parametric robot control, Bifocals

# Wickerson Studio
# 
# created by: Michael Wickerson
# 
# Grasshopper for Rhino 3D Algorithmic Modeling
# 
# www.wickersonstudios.com
# www.michaelwickerson.com
# https://www.youtube.com/channel/UC7J48Ppcsa6oncp6d29R0xw
# https://github.com/mwickerson
# https://www.facebook.com/michael.wickerson
# https://www.linkedin.com/in/michael-wickerson-696a80156/
# https://www.grasshopper3d.com/profile/MichaelWickerson
image_sampler = ImageSampler(
    FilePath="C:\Users\Sculpture\Documents\2020Grasshopper\ScreenShots2019\Screenshots2020\SurfaceEditAlgorithm.PNG",
    Filter="Value",
    Interpolate=False,
    Umax=1,
    Umin=0,
    Vmax=1,
    Vmin=0,
    Wrap=1)

# ----
# Wickerson Studio
# created by: Michael Wickerson
# Grasshopper for Rhino 3D Algorithmic Modeling
# www.wickersonstudios.com
# www.michaelwickerson.com
# https://www.youtube.com/channel/UC7J48Ppcsa6oncp6d29R0xw
# https://github.com/mwickerson
# https://www.facebook.com/michael.wickerson
# https://www.linkedin.com/in/michael-wickerson-696a80156/
# https://www.grasshopper3d.com/profile/MichaelWickerson
kuka_prc_command = KUKAPrcCommand()

shader = Shader()

number_slider = Slider(6, range=0..10)  # disabled
crv = Curve([<curve referenced from the Rhino model> x2])  # disabled
dim_u = Slider(1, range=0..100)
dim_v = Slider(21, range=0..100)
crv_2 = Curve(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)
panel = Panel("""0
1""")
loft = Loft(Curves=crv, Options={Adjust=False, Closed=False, LoftEnds=0, LoftSimp=0, LoftType=0, Rebuild=10, Refit=0.01})  # disabled
Z = UnitZ(Factor=1)  # disabled
eval = EvaluateCurve(Curve=reparameterize(crv_2), Parameter=[Slider(0, range=0..1), Slider(1, range=0..1)])  # -> Point, Tangent, Angle
contour = Contour(Shape=loft, Point=Point(0, 0, 0), Direction=Z, Distance=number_slider)  # disabled
multiplication = Multiplication(A=dim_u, B=dim_v)
range = Range(Domain=Domain(0, 1), Steps=dim_u)
rev = ReverseList(List=range)
pl = PlaneNormal(Origin=eval.Point, ZAxis=eval.Tangent)
subtraction = Subtraction(A=multiplication, B="1")
split = SplitList(List=rev, Index="1")  # -> ListA, ListB
polygon = Polygon(
    Plane=pl,
    Radius=[Slider(100, range=0..100), Slider(58, range=0..100)],
    Segments=[Slider(5, range=0..10), Slider(3, range=0..10)],
    FilletRadius=0)  # -> Polygon, Length
range_2 = Range(Domain=Domain(0, 1), Steps=subtraction)
rev_2 = ReverseList(List=split.ListB)
swp1 = Sweep1(Rail=crv_2, Sections=polygon.Polygon, Miter=1)
dup = DuplicateData(Data=rev_2, Number=dim_v, Order=True)
debrep = DeconstructBrep(Brep=swp1)  # -> Faces, Edges, Vertices
pt = ConstructPoint(XCoordinate=range_2, YCoordinate=dup, ZCoordinate=0)
evalsrf = EvaluateSurface(Surface=reparameterize(debrep.Faces), Point=graft(pt))  # -> Point, Normal, UDirection, VDirection, Frame
pt_2 = Point(Point(118.2418033, 2762.993519, 55.07248368))
mesh_sphere = MeshSphere(Base=PlaneXY(0, 0, 0), Radius=Slider(100, range=0..100), UCount=10, VCount=20)
deplane = DeconstructPlane(Plane=evalsrf.Frame)  # -> Origin, XAxis, YAxis, ZAxis
mesh = Mesh(mesh_sphere)
pl_2 = PlaneNormal(Origin=deplane.Origin, ZAxis=deplane.XAxis)
orient_pln = OrientPlaneKUKAPrc(Plane=pl_2, OrientPoint=pt_2)
number_slider_2 = Slider(0.2258813, range=0..1)
custom_tool = CustomToolKUKAPrc(
    CustomToolGeometry=mesh,
    toolid=6,
    toolvala=0,
    toolvalb=0,
    toolvalc=0,
    toolvalx=333,
    toolvaly=333,
    toolvalz=88,
    valuesset=True)
kr90_kr270_r3100 = QuantecKR90KR270R3100Robot(infiniterot=False)
lin_move = LINearMovementKUKAPrc(TargetAsPlane=orient_pln, extaxenabled=False, interpolation="C_DIS")  # -> flatten(KUKAPrcCommand)
spindle = GenericSpindleKUKAPrc(ToolLength=100, ToolDiameter=10, ToolNumber=6)
kr3_r540 = AgilusKR3R540Robot(infiniterot=False)
kuka_prc_command_2 = KUKAPrcCommand(lin_move)
play = KUKAPrcPlay(Loop=False, Reset=Toggle(False), savedtime=70.95999939)
kuka_prc = KUKAPrcCORE(
    SimulationSlider=play,
    KUKAPrcCommands=kuka_prc_command_2,
    Tool=custom_tool,
    Robot=kr90_kr270_r3100,
    PRC_BaseExpose=False,
    PRC_SaveNameExpose=False,
    PRCsettings="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")  # -> RobotGeometry, AnalysisOutput

# ----
# 1001 GRASSHOPPER DEFINITIONS
# Params Primitive 018/1001
number_toolpaths = Slider(7, range=1..20)
range_3 = Range(Domain=Domain(0, 1), Steps=number_toolpaths)
crv_3 = Curve(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)
crv_4 = Curve(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)
pt_3 = ConstructPoint(XCoordinate=range_3, YCoordinate=0, ZCoordinate=0)
loft_2 = Loft(Curves=[crv_4, crv_3], Options={Adjust=False, Closed=False, LoftEnds=0, LoftSimp=0, LoftType=0, Rebuild=10, Refit=0.01})
iso = IsoCurve(Surface=reparameterize(loft_2), UVPoint=pt_3)  # -> UIsocurve, VIsocurve
pt_4 = Point(Point(-865.1763755, -295, 96.91372562))
mesh_sphere_2 = MeshSphere(Base=PlaneXY(0, 0, 0), Radius=10, UCount=10, VCount=20)
mesh_sphere_3 = MeshSphere(Base=PlaneXY(0, 0, 0), Radius=10, UCount=10, VCount=20)
kuka_spindle = KUKAHSDSpindle(ToolLength=100, ToolDiameter=10, ToolNumber=6)
list = ValueList({"AA-KR60", "AA-KR30", "AA-KR60_KR30", "AARCH IRB120", "AARCH IRB6620", "AAU-Utzon-UR10", "Automata", "Bartlett-IRB120", "Bartlett-IRB1600", "Bartlett-KR6"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}, selected="Bartlett-IRB1600")
load_robot_system = LoadRobotSystem(Name=list, Base=PlaneXY(0, 0, 0))

# ---- group: Flip every second curve, Zig-Zag movement
dispatch = Dispatch(List=flatten(iso.VIsocurve), DispatchPattern=[True, False])  # -> ListA, ListB
flip = FlipCurve(Curve=dispatch.ListA)  # -> Curve, Flag
weave = Weave(Pattern=[0, 1], Stream0=flip.Curve, Stream1=dispatch.ListB, NullGaps=False)

# ---- group: Adaptive curve division
topoly = CurveToPolyline(Curve=weave, ToleranceDistance=Slider(0.25, range=0..1), ToleranceAngle=0)  # -> Polyline, Segments

# ---- group: Get normal vectors
cp = ControlPoints(Curve=topoly.Polyline)  # -> Points, Weights, Knots
srf_cp = SurfaceClosestPoint(Point=cp.Points, Surface=loft_2)  # -> Point, UVPoint, Distance
evalsrf_2 = EvaluateSurface(Surface=loft_2, Point=srf_cp.UVPoint)  # -> Point, Normal, Frame

# ---- group: For easier reachability
orient_pln_2 = KUKAPrcOrientPlane(Plane=evalsrf_2.Frame, OrientPoint=pt_4)

# ---- group: Collision checking will be performed with custom mesh geometry and cell geometry, as well as the robot itself
kr_90_270_r2700 = KUKAQuantecKR90KR270R2700(infiniterot=False)
move_backpanel = Slider(36, range=-100..100)
mesh_2 = Mesh(mesh_sphere_2)
mesh_3 = Mesh(mesh_sphere_3)
vec = VectorXYZ(XComponent=move_backpanel, YComponent=0, ZComponent=0)  # -> Vector, Length
robot_cell = KUKAPrcRobotCell(KUKAPrcRobotInput=kr_90_270_r2700, CellGeometry=mesh_2)
move = Move(Geometry=mesh_3, Motion=vec.Vector)  # -> Geometry, Transform

# ----
lin_move_2 = KUKAPrcLINearMovement(TargetAsPlane=flatten(orient_pln_2), extaxenabled=False, interpolation="C_DIS")
tangential_offset = KUKAPrcTangentialOffset(KUKAPrcCommand=lin_move_2, TangentialOffset=150, OffsetStart=True, OffsetEnd=True)

kuka_prc_command_3 = KUKAPrcCommand(tangential_offset)

kuka_prc_2 = KUKAPrcCORE(
    SimulationSlider=Slider(0.424, range=0..1),
    KUKAPrcCommands=kuka_prc_command_3,
    KUKAPrcTool=kuka_spindle,
    KUKAPrcRobot=robot_cell,
    KUKAPrcCollisionGeometry=move.Geometry,
    PRC_BaseExpose=False,
    PRC_SaveNameExpose=False,
    PRCsettings="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")  # -> RobotGeometry, AnalysisOutput
