# Grasshopper definition ParamsPrimitive019.gh (Grasshopper 1.0.7)
# Copyright: Wickerson Studios
# plug-ins: Bifocals

image_sampler = ImageSampler(
    FilePath="C:\Users\Sculpture\Documents\2020Grasshopper\ScreenShots2019\Screenshots2020\SurfaceEditAlgorithm.PNG",
    Filter="Value",
    Interpolate=False,
    Umax=1,
    Umin=0,
    Vmax=1,
    Vmin=0,
    Wrap=1)

# ----
# 1001 GRASSHOPPER DEFINITIONS
# Wickerson Studio
# 
# created by: Michael Wickerson
# 
# Grasshopper for Rhino 3D Algorithmic Modeling
# 
# www.wickersonstudios.com
# www.michaelwickerson.com
# https://www.youtube.com/channel/UC7J48Ppcsa6oncp6d29R0xw
# https://github.com/mwickerson
# https://www.facebook.com/michael.wickerson
# https://www.linkedin.com/in/michael-wickerson-696a80156/
# https://www.grasshopper3d.com/profile/MichaelWickerson
# Wickerson Studio
# created by: Michael Wickerson
# Grasshopper for Rhino 3D Algorithmic Modeling
# www.wickersonstudios.com
# www.michaelwickerson.com
# https://www.youtube.com/channel/UC7J48Ppcsa6oncp6d29R0xw
# https://github.com/mwickerson
# https://www.facebook.com/michael.wickerson
# https://www.linkedin.com/in/michael-wickerson-696a80156/
# https://www.grasshopper3d.com/profile/MichaelWickerson
shader = Shader()

number_slider = Slider(0.76, range=0..1)
# Params Primitive 019/1001
colour_picker = ColourPicker(PickedColour=RGB(71, 118, 203))
number_slider_2 = Slider(1, range=0..1)
colour_swatch = ColourSwatch(SwatchColor=RGB(113, 151, 175))
number_slider_3 = Slider(0.25, range=0..1)
gradient = Gradient(
    LowerLimit=number_slider_2,
    UpperLimit=number_slider,
    Parameter=number_slider_3,
    stops=[0: RGB(234, 38, 0), 0.25: RGB(234, 126, 0), 0.5: RGB(254, 244, 84), 0.75: RGB(173, 203, 249), 1: RGB(75, 107, 169)])
gradient_2 = Gradient(
    LowerLimit=number_slider_2,
    UpperLimit=number_slider,
    Parameter=number_slider_3,
    stops=[0.1: RGB(255, 255, 255), 0.2: RGB(0, 0, 0), 0.3: RGB(255, 255, 255), 0.4: RGB(0, 0, 0), 0.6: RGB(0, 0, 0), 0.7: RGB(255, 255, 255), 0.8: RGB(0, 0, 0), 0.9: RGB(255, 255, 255)])
gradient_3 = Gradient(
    LowerLimit=number_slider_2,
    UpperLimit=number_slider,
    Parameter=number_slider_3,
    stops=[0.15: RGB(255, 130, 160), 0.78: RGB(220, 0, 40)])
diffuse = Diffuse(colour_picker)
specular = Specular(colour_picker)
emission = Emission(colour_picker)
create_material = CreateMaterial(Diffuse=diffuse, Specular=specular, Emission=emission, Transparency=Slider(0, range=0..1), Shine=Slider(0, range=0..100))
sphere = Sphere(Base=PlaneXY(0, 0, 0), Radius=1)

shader_2 = Shader(create_material)

panel = Panel(shader_2)
custom_preview = CustomPreview(Geometry=sphere, Material=shader_2)
