# Grasshopper definition ParamsPrimitive020.gh (Grasshopper 1.0.7)
# Copyright: Wickerson Studios
# plug-ins: Bifocals

image_sampler = ImageSampler(
    FilePath="C:\Users\Sculpture\Documents\2020Grasshopper\ScreenShots2019\Screenshots2020\SurfaceEditAlgorithm.PNG",
    Filter="Value",
    Interpolate=False,
    Umax=1,
    Umin=0,
    Vmax=1,
    Vmin=0,
    Wrap=1)

number_slider = Slider(1, range=0..1)
number_slider_2 = Slider(0.25, range=0..1)
number_slider_3 = Slider(2, range=0..10)
number_slider_4 = Slider(2, range=0..10)
number_slider_5 = Slider(1, range=0..1)
number_slider_6 = Slider(20.47, range=0..100)
number_slider_7 = Slider(123, range=0..1000)
number_slider_8 = Slider(9, range=0..100)
boolean_toggle = BooleanToggle(False)
construct_domain = ConstructDomain(DomainStart=Slider(0.351, range=0..3), DomainEnd=number_slider_8)
range = Range(Domain=construct_domain, Steps=number_slider_3)
cosine = Cosine(Value=range)
sine = Sine(Value=range)
multiplication = Multiplication(A=cosine, B=number_slider_6)
multiplication_2 = Multiplication(A=sine, B=number_slider_6)
graph_mapper = GraphMapper(
    multiplication,
    x0=0,
    x1=1,
    y0=0,
    y1=1,
    container_name="Bezier",
    cpx=[0, 0, 0.9083535075, 1],
    cpy=[0, 0.0503000617, 0.2617240548, 1])
construct_point = ConstructPoint(XCoordinate=multiplication_2, YCoordinate=graph_mapper, ZCoordinate=range)
division = Division(A=range, B=number_slider_8)
larger_than = LargerThan(FirstNumber=multiplication_2, SecondNumber=graph_mapper)  # -> LargerThan, OrEqualTo
panel = Panel("""5
8
11
14
17""")
pi = Pi(Factor=division)
cull_pattern = CullPattern(List=construct_point, CullPattern=larger_than.LargerThan)
cherry_picker = CherryPicker(panel, ListIndex=3, TreePath_path="{0}")
construct_plane = ConstructPlane(Origin=cull_pattern, XAxis=Vector(1, 0, 0), YAxis=Vector(0, 1, 0))
panel_2 = Panel(cull_pattern)
rotate_plane = RotatePlane(Plane=construct_plane, Angle=pi)
square = Square(Plane=rotate_plane, Size=1, ExtentX=cherry_picker, ExtentY=cherry_picker)  # -> Cells, flatten(Points)
deconstruct = Deconstruct(Point=square.Points)  # -> XComponent, YComponent, ZComponent
maximum = Maximum(A=deconstruct.YComponent, B=deconstruct.ZComponent)
minimum = Minimum(A=deconstruct.XComponent, B=deconstruct.YComponent)
number_slider_9 = Slider(9, range=0..100)
construct_point_2 = ConstructPoint(XCoordinate=maximum, YCoordinate=minimum, ZCoordinate=deconstruct.XComponent)  # -> graft(Point)
construct_point_3 = ConstructPoint(XCoordinate=minimum, YCoordinate=maximum, ZCoordinate=deconstruct.XComponent)  # -> graft(Point)
cross_reference = CrossReference(ListA=construct_point_2, ListB=construct_point_3, CrossMode=1)  # -> flatten(ListA), flatten(ListB)
gene_pool = GenePool(Decimals=2, Maximum=1, Minimum=0, Value=[0, 0.23, 0.71, 0.81, 0.93, 1])
md_slider = MDSlider(
    SliderMode=0,
    slider_value=Point(0, 0.3160958639, 0.5),
    x_domain=Domain(0, 1),
    y_domain=Domain(0, 1),
    z_domain=Domain(0, 1))
surface_from_points = SurfaceFromPoints(Points=cross_reference.ListB, UCount=number_slider_9, Interpolate=False)
surface_from_points_2 = SurfaceFromPoints(Points=cross_reference.ListA, UCount=number_slider_9, Interpolate=False)
range_2 = Range(Domain=Domain(0, 1), Steps=Slider(5, range=0..10))
graph_mapper_2 = GraphMapper(range_2, x0=0, x1=21, y0=0, y1=21, container_name="Bezier", cpx=[0, 0, 1, 1], cpy=[0, 0.8226813674, 0, 1])
evaluate_surface = EvaluateSurface(Surface=reparameterize([surface_from_points_2, surface_from_points]), Point=md_slider)  # -> Point, Normal, UDirection, VDirection, Frame
line_sdl = LineSDL(Start=evaluate_surface.Point, Direction=evaluate_surface.Normal, Length=1)
pipe_variable = PipeVariable(Curve=reparameterize(line_sdl), Parameters=gene_pool, Radii=graph_mapper_2, Caps=0)
divide_domain² = DivideDomain²(Domain=pipe_variable, UCount=number_slider_3, VCount=number_slider_3)
isotrim = Isotrim(Surface=pipe_variable, Domain=divide_domain²)  # -> flatten(Surface)
geometry = Geometry(isotrim)
list_length = ListLength(List=geometry)
expression = Expression(x=list_length, Expression="x-1")
range_3 = Range(Domain=Domain(0, 1), Steps=expression)
multiplication_3 = Multiplication(A=evaluate_surface.Normal, B=range_3)
multiplication_4 = Multiplication(A=multiplication_3, B=Slider(10, range=0..10))
jitter = Jitter(List=multiplication_4, Jitter=1, Seed=2)  # -> Values, Indices
move = Move(Geometry=geometry, Motion=jitter.Values)  # -> Geometry, Transform
geometry_2 = Geometry(move.Geometry)
surface = Surface([surface_from_points_2, surface_from_points])

# ----
# Wickerson Studio
# created by: Michael Wickerson
# Grasshopper for Rhino 3D Algorithmic Modeling
# www.wickersonstudios.com
# www.michaelwickerson.com
# https://www.youtube.com/channel/UC7J48Ppcsa6oncp6d29R0xw
# https://github.com/mwickerson
# https://www.facebook.com/michael.wickerson
# https://www.linkedin.com/in/michael-wickerson-696a80156/
# https://www.grasshopper3d.com/profile/MichaelWickerson
number_slider_10 = Slider(0.25, range=0..1)
md_slider_2 = MDSlider(
    SliderMode=0,
    slider_value=Point(0.5945226158, 0.5337576517, 0.5),
    x_domain=Domain(0, 1),
    y_domain=Domain(0, 1),
    z_domain=Domain(0, 1))
gene_pool_2 = GenePool(Decimals=2, Maximum=100, Minimum=0, Value=[50, 50, 50, 50, 50, 50, 50, 50, 50, 50])
boolean_toggle_2 = BooleanToggle(False)
graph_mapper_3 = GraphMapper(
    number_slider_10,
    x0=0,
    x1=1,
    y0=0,
    y1=1,
    container_name="Bezier",
    cpx=[0, 0.08058696985, 0.8568018079, 1],
    cpy=[0, 0.6479634047, 0.2421158552, 1])
panel_3 = Panel(graph_mapper_3)

# ----
# 1001 GRASSHOPPER DEFINITIONS
# Wickerson Studio
# 
# created by: Michael Wickerson
# 
# Grasshopper for Rhino 3D Algorithmic Modeling
# 
# www.wickersonstudios.com
# www.michaelwickerson.com
# https://www.youtube.com/channel/UC7J48Ppcsa6oncp6d29R0xw
# https://github.com/mwickerson
# https://www.facebook.com/michael.wickerson
# https://www.linkedin.com/in/michael-wickerson-696a80156/
# https://www.grasshopper3d.com/profile/MichaelWickerson
# Params Primitive 020/1001
number_slider_11 = Slider(0.25, range=0..1)
panel_4 = Panel(number_slider_11)

number_slider_12 = Slider(2, range=0..10)
number_slider_13 = Slider(1, range=0..1)
number_slider_14 = Slider(2, range=0..10)
number_slider_15 = Slider(1, range=0..1)
number_slider_16 = Slider(12, range=0..100)
number_slider_17 = Slider(12, range=0..100)
number_slider_18 = Slider(123, range=0..1000)
md_slider_3 = MDSlider(
    SliderMode=0,
    slider_value=Point(0.5945226158, 0.5337576517, 0.5),
    x_domain=Domain(0, 1),
    y_domain=Domain(0, 1),
    z_domain=Domain(0, 1))
gene_pool_3 = GenePool(Decimals=2, Maximum=100, Minimum=0, Value=[50, 50, 50, 50, 50, 50, 50, 50, 50, 50])
boolean_toggle_3 = BooleanToggle(False)
construct_domain_2 = ConstructDomain(DomainStart=0, DomainEnd=1)
divide_domain²_2 = DivideDomain²(UCount=10, VCount=10)
sine_2 = Sine()
pi_2 = Pi(Factor=1)
graph_mapper_4 = GraphMapper(
    Slider(0.25, range=0..1),
    x0=0,
    x1=1,
    y0=0,
    y1=1,
    container_name="Bezier",
    cpx=[0, 0.08058696985, 0.8568018079, 1],
    cpy=[0, 0.6479634047, 0.2421158552, 1])
addition = Addition()
division_2 = Division()
multiplication_5 = Multiplication()
subtraction = Subtraction()
minimum_2 = Minimum()
maximum_2 = Maximum()
larger_than_2 = LargerThan(SecondNumber=0)  # -> LargerThan, OrEqualTo
equality = Equality()  # -> Equality, Inequality
expression_2 = Expression(Expression="Format(\"{0}, {1}\", x, y)")
ghpython_script = GhPythonScript()  # -> Out, A
panel_5 = Panel(graph_mapper_4)
