# Grasshopper definition SetsList057.gh (Grasshopper 1.0.7)
# Copyright: Wickerson Studios
# plug-ins: Bifocals

image_sampler = ImageSampler(
    FilePath="C:\Users\Sculpture\Documents\2020Grasshopper\ScreenShots2019\Screenshots2020\SurfaceEditAlgorithm.PNG",
    Filter="Value",
    Interpolate=False,
    Umax=1,
    Umin=0,
    Vmax=1,
    Vmin=0,
    Wrap=1)
# 1001 GRASSHOPPER DEFINITIONS
# Wickerson Studio
# 
# created by: Michael Wickerson
# 
# Grasshopper for Rhino 3D Algorithmic Modeling
# 
# www.wickersonstudios.com
# www.michaelwickerson.com
# https://www.youtube.com/channel/UC7J48Ppcsa6oncp6d29R0xw
# https://github.com/mwickerson
# https://www.facebook.com/michael.wickerson
# https://www.linkedin.com/in/michael-wickerson-696a80156/
# https://www.grasshopper3d.com/profile/MichaelWickerson
# SETS LIST 057/1001
insert_items = InsertItems(Wrap=True)
list_length = ListLength()
# Wickerson Studio
# created by: Michael Wickerson
# Grasshopper for Rhino 3D Algorithmic Modeling
# www.wickersonstudios.com
# www.michaelwickerson.com
# https://www.youtube.com/channel/UC7J48Ppcsa6oncp6d29R0xw
# https://github.com/mwickerson
# https://www.facebook.com/michael.wickerson
# https://www.linkedin.com/in/michael-wickerson-696a80156/
# https://www.grasshopper3d.com/profile/MichaelWickerson
item_index = ItemIndex()
list_item = ListItem(Index=0, Wrap=True)
number_slider = Slider(6, range=0..100)
number_slider_2 = Slider(12, range=0..100)
negative = Negative(Value=number_slider)
negative_2 = Negative(Value=number_slider_2)
construct_domain = ConstructDomain(DomainStart=negative_2, DomainEnd=number_slider_2)
construct_domain_2 = ConstructDomain(DomainStart=negative, DomainEnd=number_slider)
rectangle = Rectangle(Plane=PlaneXY(0, 0, 0), XSize=construct_domain, YSize=construct_domain_2, Radius=0)  # -> Rectangle, Length
number_slider_3 = Slider(2, range=0..10)
area = Area(Geometry=rectangle.Rectangle)  # -> Area, Centroid
explode = Explode(Curve=rectangle.Rectangle, Recursive=True)  # -> Segments, Vertices
negative_3 = Negative(Value=number_slider_3)
point_on_curve = PointOnCurve(explode.Segments, parameter=0.5)
list_item_2 = ListItem(List=explode.Segments, Index=[Slider(0, range=0..10), Slider(2, range=0..10)], Wrap=True)
subtraction = Subtraction(A=negative_3, B=Slider(1, range=0..1))
divide_curve = DivideCurve(Curve=list_item_2, Count=10, Kinks=False)  # -> Points, Tangents, Parameters
list_item_3 = ListItem(List=divide_curve.Points, Index=[number_slider_3, subtraction], Wrap=True)
xz_plane = XZPlane(Origin=list_item_3)
circle = Circle(Plane=xz_plane, Radius=Slider(2.39, range=0..10))
area_2 = Area(Geometry=circle)  # -> Area, Centroid
number_slider_4 = Slider(2.03, range=0..10)
offset_curve = OffsetCurve(Curve=circle, Distance=1, Plane=PlaneXY(0, 0, 0), Corners=1)  # -> flatten(Curve)
number_slider_5 = Slider(12, range=0..100)
number_slider_6 = Slider(1, range=0..1)
merge = Merge(Data1=circle, Data2=offset_curve)  # -> graft(Result)
unit_y = UnitY(Factor=number_slider_6)
negative_4 = Negative(Value=number_slider_6)
unit_y_2 = UnitY(Factor=negative_4)  # -> graft(UnitVector)
move = Move(Geometry=merge, Motion=unit_y)  # -> graft(Geometry), Transform
scale = Scale(Geometry=circle, Center=area_2.Centroid, Factor=number_slider_4)  # -> graft(Geometry), Transform
scale_2 = Scale(Geometry=circle, Center=area_2.Centroid, Factor=number_slider_4)  # -> graft(Geometry), Transform
move_2 = Move(Geometry=merge, Motion=unit_y_2)  # -> graft(Geometry), Transform
move_3 = Move(Geometry=merge, Motion=unit_y_2)  # -> Geometry, Transform
move_4 = Move(Geometry=merge, Motion=unit_y)  # -> Geometry, Transform
divide_curve_2 = DivideCurve(Curve=scale.Geometry, Count=10, Kinks=False)  # -> graft(Points), Tangents, Parameters
divide_curve_3 = DivideCurve(Curve=move_3.Geometry, Count=10, Kinks=False)  # -> graft(Points), Tangents, Parameters
divide_curve_4 = DivideCurve(Curve=move.Geometry, Count=10, Kinks=False)  # -> graft(Points), Tangents, Parameters
loft = Loft(
    Curves=[move.Geometry, scale.Geometry, move_3.Geometry],
    Options={Adjust=False, Closed=False, LoftEnds=0, LoftSimp=0, LoftType=0, Rebuild=10, Refit=0.01})
loft_2 = Loft(
    Curves=[move_4.Geometry, scale_2.Geometry, move_2.Geometry],
    Options={Adjust=False, Closed=False, LoftEnds=0, LoftSimp=0, LoftType=0, Rebuild=10, Refit=0.01})
panel = Panel(divide_curve_4.Points)
brep_join = BrepJoin(Breps=[loft, loft_2])  # -> Breps, Closed
explode_tree = ExplodeTree()  # -> Branch0, Branch1, _000000, _001000, _002000, Branch5, Branch6, Branch7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
gradient = Gradient(
    LowerLimit=0,
    UpperLimit=1,
    Parameter=Slider(0.46, range=0..1),
    stops=[0: RGB(234, 38, 0), 0.25: RGB(234, 126, 0), 0.5: RGB(254, 244, 84), 0.75: RGB(173, 203, 249), 1: RGB(75, 107, 169)])
gradient_2 = Gradient(LowerLimit=0, UpperLimit=1, Parameter=Slider(0.02, range=0..1), stops=[0.15: RGB(255, 130, 160), 0.85: RGB(220, 0, 40)])
gradient_3 = Gradient(
    LowerLimit=0,
    UpperLimit=1,
    Parameter=Slider(0.12, range=0..1),
    stops=[0: RGB(234, 38, 0), 0.25: RGB(234, 126, 0), 0.5: RGB(254, 244, 84), 0.75: RGB(173, 203, 249), 1: RGB(75, 107, 169)])
gradient_4 = Gradient(
    LowerLimit=0,
    UpperLimit=1,
    Parameter=Slider(0.84, range=0..1),
    stops=[0: RGB(243, 57, 0), 0.1: RGB(236, 27, 60), 0.2: RGB(210, 0, 118), 0.3: RGB(103, 0, 120), 0.4: RGB(39, 72, 161), 0.6: RGB(18, 178, 90), 0.7: RGB(79, 186, 8), 0.8: RGB(220, 237, 32), 0.9: RGB(247, 159, 20), 1: RGB(243, 57, 0)])
gradient_5 = Gradient(
    LowerLimit=0,
    UpperLimit=1,
    Parameter=Slider(0.19, range=0..1),
    stops=[0: RGB(243, 57, 0), 0.1: RGB(236, 27, 60), 0.2: RGB(210, 0, 118), 0.305: RGB(103, 0, 120), 0.4: RGB(39, 72, 161), 0.6: RGB(18, 178, 90), 0.7: RGB(79, 186, 8), 0.8: RGB(220, 237, 32), 0.9: RGB(247, 159, 20), 1: RGB(243, 57, 0)])
gradient_6 = Gradient(LowerLimit=0, UpperLimit=1, Parameter=Slider(0.87, range=0..1), stops=[0.15: RGB(255, 130, 160), 0.85: RGB(220, 0, 40)])
gradient_7 = Gradient(
    LowerLimit=0,
    UpperLimit=1,
    Parameter=Slider(0.54, range=0..1),
    stops=[0: RGB(243, 57, 0), 0.1: RGB(236, 27, 60), 0.2: RGB(210, 0, 118), 0.3: RGB(103, 0, 120), 0.4: RGB(39, 72, 161), 0.6: RGB(18, 178, 90), 0.7: RGB(79, 186, 8), 0.8: RGB(220, 237, 32), 0.9: RGB(247, 159, 20), 1: RGB(243, 57, 0)])
gradient_8 = Gradient(LowerLimit=0, UpperLimit=1, Parameter=Slider(0.21, range=0..1), stops=[0.704: RGB(173, 203, 249), 1: RGB(75, 107, 169)])
gradient_9 = Gradient(
    LowerLimit=0,
    UpperLimit=1,
    Parameter=Slider(1, range=0..1),
    stops=[0.221: RGB(152, 89, 100), 0.754: RGB(173, 203, 249), 1: RGB(75, 107, 169)])
gradient_10 = Gradient(
    LowerLimit=0,
    UpperLimit=1,
    Parameter=Slider(0.43, range=0..1),
    stops=[0.447: RGB(31, 197, 237), 0.567: RGB(110, 169, 24), 0.85: RGB(220, 0, 40)])
gradient_11 = Gradient(
    LowerLimit=0,
    UpperLimit=1,
    Parameter=Slider(0.42, range=0..1),
    stops=[0: RGB(0, 86, 238), 0.25: RGB(234, 126, 0), 1: RGB(75, 107, 169)])
gradient_12 = Gradient(LowerLimit=0, UpperLimit=1, Parameter=Slider(0.39, range=0..1), stops=[0.804: RGB(173, 203, 249), 1: RGB(75, 107, 169)])
gradient_13 = Gradient(
    LowerLimit=0,
    UpperLimit=1,
    Parameter=Slider(0.89, range=0..1),
    stops=[0: RGB(243, 57, 0), 0.1: RGB(236, 27, 60), 0.2: RGB(210, 0, 118), 0.3: RGB(103, 0, 120), 0.4: RGB(39, 72, 161), 0.6: RGB(18, 178, 90), 0.7: RGB(79, 186, 8), 0.8: RGB(220, 237, 32), 0.9: RGB(247, 159, 20), 1: RGB(243, 57, 0)])
gradient_14 = Gradient(LowerLimit=0, UpperLimit=1, Parameter=Slider(0.22, range=0..1), stops=[0.704: RGB(173, 203, 249), 1: RGB(75, 107, 169)])
custom_preview = CustomPreview(Geometry=explode_tree.Branch5, Material=gradient_3)
custom_preview_2 = CustomPreview(Geometry=explode_tree.Branch10, Material=gradient)
custom_preview_3 = CustomPreview(Geometry=explode_tree._000000, Material=gradient_9)
custom_preview_4 = CustomPreview(Geometry=explode_tree.Branch8, Material=gradient_2)
custom_preview_5 = CustomPreview(Geometry=explode_tree.Branch7, Material=gradient_4)
custom_preview_6 = CustomPreview(Geometry=explode_tree._002000, Material=gradient_3)
custom_preview_7 = CustomPreview(Material=gradient_5)
custom_preview_8 = CustomPreview(Geometry=explode_tree._001000, Material=gradient_7)
custom_preview_9 = CustomPreview(Geometry=explode_tree.Branch6, Material=gradient_8)
custom_preview_10 = CustomPreview(Material=gradient_12)
# Full multiplicity knots at start
# Simple knots
# Full multiplicity knots at end
# P1
# A=0.2*P1+ 0.8*P2
# D=0.2*A + 0.8*B
# P2
# B=0.47*P2 + 0.53*P3
# Full multiplicity knots at start
# E=0.7*B + 0.3*C
# P3
# Full multiplicity knots in the middle
# C=0.8*P3 + 0.2*P4
# P4
# Full multiplicity knots at end
# Compare knot spacing
# GH solution
# VB
# C#
# Python with RhinoCommon Only
# Pythong with RhinoScriptSyntax
# GH solution
# VB
# C#
# Python
# VB
custom_preview_11 = CustomPreview(Geometry=explode_tree.Branch15, Material=gradient_6)
custom_preview_12 = CustomPreview(Geometry=explode_tree.Branch14, Material=gradient_13)
custom_preview_13 = CustomPreview(Geometry=explode_tree.Branch13, Material=gradient_14)
# rs
custom_preview_14 = CustomPreview(Geometry=[explode_tree.Branch12, explode_tree.Branch9, explode_tree.Branch1], Material=gradient_11)
# rc
custom_preview_15 = CustomPreview(Geometry=explode_tree.Branch0, Material=gradient_10)
