# Grasshopper definition SetsList057g.gh (Grasshopper 1.0.7)
# Copyright: Wickerson Studios
# plug-ins: Bifocals

image_sampler = ImageSampler(
    FilePath="C:\Users\Sculpture\Documents\2020Grasshopper\ScreenShots2019\Screenshots2020\SurfaceEditAlgorithm.PNG",
    Filter="Value",
    Interpolate=False,
    Umax=1,
    Umin=0,
    Vmax=1,
    Vmin=0,
    Wrap=1)

# ----
# 1001 GRASSHOPPER DEFINITIONS
# Wickerson Studio
# 
# created by: Michael Wickerson
# 
# Grasshopper for Rhino 3D Algorithmic Modeling
# 
# www.wickersonstudios.com
# www.michaelwickerson.com
# https://www.youtube.com/channel/UC7J48Ppcsa6oncp6d29R0xw
# https://github.com/mwickerson
# https://www.facebook.com/michael.wickerson
# https://www.linkedin.com/in/michael-wickerson-696a80156/
# https://www.grasshopper3d.com/profile/MichaelWickerson
# SETS LIST 057e/1001
insert_items = InsertItems(Wrap=True)
list_length = ListLength()
# Wickerson Studio
# created by: Michael Wickerson
# Grasshopper for Rhino 3D Algorithmic Modeling
# www.wickersonstudios.com
# www.michaelwickerson.com
# https://www.youtube.com/channel/UC7J48Ppcsa6oncp6d29R0xw
# https://github.com/mwickerson
# https://www.facebook.com/michael.wickerson
# https://www.linkedin.com/in/michael-wickerson-696a80156/
# https://www.grasshopper3d.com/profile/MichaelWickerson
item_index = ItemIndex()
list_item = ListItem(Index=0, Wrap=True)

number_slider = Slider(0.19, range=0..1)  # disabled
number_slider_2 = Slider(0.12, range=0..1)  # disabled
number_slider_3 = Slider(0.38, range=0..1)  # disabled
number_slider_4 = Slider(0.87, range=0..1)  # disabled
number_slider_5 = Slider(0.02, range=0..1)  # disabled
number_slider_6 = Slider(0.72, range=0..1)  # disabled
number_slider_7 = Slider(0.54, range=0..1)  # disabled
number_slider_8 = Slider(0.21, range=0..1)  # disabled
number_slider_9 = Slider(0.36, range=0..1)  # disabled
number_slider_10 = Slider(1, range=0..1)  # disabled
number_slider_11 = Slider(0.39, range=0..1)  # disabled
number_slider_12 = Slider(0.43, range=0..1)  # disabled
number_slider_13 = Slider(0.89, range=0..1)  # disabled
number_slider_14 = Slider(0.22, range=0..1)  # disabled
gradient = Gradient(
    LowerLimit=0,
    UpperLimit=1,
    Parameter=number_slider_3,
    stops=[0: RGB(234, 38, 0), 0.25: RGB(234, 126, 0), 0.5: RGB(254, 244, 84), 0.75: RGB(173, 203, 249), 1: RGB(75, 107, 169)])  # disabled
gradient_2 = Gradient(
    LowerLimit=0,
    UpperLimit=1,
    Parameter=number_slider_8,
    stops=[0.361: RGB(42, 113, 210), 0.704: RGB(173, 203, 249), 1: RGB(75, 107, 169)])  # disabled
gradient_3 = Gradient(LowerLimit=0, UpperLimit=1, Parameter=number_slider_5, stops=[0.15: RGB(255, 130, 160), 0.85: RGB(220, 0, 40)])  # disabled
gradient_4 = Gradient(
    LowerLimit=0,
    UpperLimit=1,
    Parameter=number_slider_2,
    stops=[0: RGB(234, 38, 0), 0.25: RGB(234, 126, 0), 0.5: RGB(254, 244, 84), 0.75: RGB(173, 203, 249), 1: RGB(75, 107, 169)])  # disabled
gradient_5 = Gradient(
    LowerLimit=0,
    UpperLimit=1,
    Parameter=number_slider_6,
    stops=[0: RGB(243, 57, 0), 0.1: RGB(236, 27, 60), 0.2: RGB(210, 0, 118), 0.3: RGB(103, 0, 120), 0.4: RGB(39, 72, 161), 0.6: RGB(18, 178, 90), 0.7: RGB(79, 186, 8), 0.8: RGB(220, 237, 32), 0.9: RGB(247, 159, 20), 1: RGB(243, 57, 0)])  # disabled
gradient_6 = Gradient(
    LowerLimit=0,
    UpperLimit=1,
    Parameter=number_slider,
    stops=[0: RGB(243, 57, 0), 0.1: RGB(236, 27, 60), 0.2: RGB(210, 0, 118), 0.305: RGB(103, 0, 120), 0.4: RGB(39, 72, 161), 0.6: RGB(18, 178, 90), 0.7: RGB(79, 186, 8), 0.8: RGB(220, 237, 32), 0.9: RGB(247, 159, 20), 1: RGB(243, 57, 0)])  # disabled
gradient_7 = Gradient(LowerLimit=0, UpperLimit=1, Parameter=number_slider_4, stops=[0.15: RGB(255, 130, 160), 0.85: RGB(220, 0, 40)])  # disabled
gradient_8 = Gradient(
    LowerLimit=0,
    UpperLimit=1,
    Parameter=number_slider_7,
    stops=[0: RGB(243, 57, 0), 0.1: RGB(236, 27, 60), 0.2: RGB(210, 0, 118), 0.3: RGB(103, 0, 120), 0.4: RGB(39, 72, 161), 0.6: RGB(18, 178, 90), 0.7: RGB(79, 186, 8), 0.8: RGB(220, 237, 32), 0.9: RGB(247, 159, 20), 1: RGB(243, 57, 0)])  # disabled
gradient_9 = Gradient(
    LowerLimit=0,
    UpperLimit=1,
    Parameter=number_slider_10,
    stops=[0.221: RGB(152, 89, 100), 0.754: RGB(173, 203, 249), 1: RGB(75, 107, 169)])  # disabled
gradient_10 = Gradient(
    LowerLimit=0,
    UpperLimit=1,
    Parameter=number_slider_11,
    stops=[0.423: RGB(225, 141, 68), 0.804: RGB(173, 203, 249), 1: RGB(75, 107, 169)])  # disabled
gradient_11 = Gradient(
    LowerLimit=0,
    UpperLimit=1,
    Parameter=number_slider_12,
    stops=[0.447: RGB(31, 197, 237), 0.567: RGB(110, 169, 24), 0.85: RGB(220, 0, 40)])  # disabled
gradient_12 = Gradient(LowerLimit=0, UpperLimit=1, Parameter=number_slider_9, stops=[0.691: RGB(168, 133, 140), 1: RGB(75, 107, 169)])  # disabled
gradient_13 = Gradient(
    LowerLimit=0,
    UpperLimit=1,
    Parameter=number_slider_13,
    stops=[0: RGB(243, 57, 0), 0.1: RGB(236, 27, 60), 0.2: RGB(210, 0, 118), 0.3: RGB(103, 0, 120), 0.4: RGB(39, 72, 161), 0.6: RGB(18, 178, 90), 0.7: RGB(79, 186, 8), 0.8: RGB(220, 237, 32), 0.9: RGB(247, 159, 20), 1: RGB(243, 57, 0)])  # disabled
gradient_14 = Gradient(
    LowerLimit=0,
    UpperLimit=1,
    Parameter=number_slider_14,
    stops=[0.313: RGB(132, 69, 178), 0.504: RGB(72, 107, 184), 0.704: RGB(173, 203, 249), 1: RGB(75, 107, 169)])  # disabled

number_slider_15 = Slider(3.32, range=0..10)
range = Range(Domain=Domain(0, 1), Steps=10)
sinc = Sinc(Value=range)
multiplication = Multiplication(A=sinc, B=number_slider_15)
multiplication_2 = Multiplication(A=range, B=Slider(4.75, range=0..10))
multiplication_3 = Multiplication(A=multiplication, B=multiplication)
xz_plane = XZPlane(Origin=Point(0, 0, 0))
construct_point = ConstructPoint(XCoordinate=0, YCoordinate=multiplication_2, ZCoordinate=0)
construct_point_2 = ConstructPoint(XCoordinate=0, YCoordinate=multiplication_2, ZCoordinate=multiplication_3)
nurbs_curve = NurbsCurve(Vertices=construct_point_2, Degree=3, Periodic=False)  # -> Curve, Length, Domain
nurbs_curve_2 = NurbsCurve(Vertices=construct_point, Degree=3, Periodic=False)  # -> Curve, Length, Domain
mirror = Mirror(Geometry=nurbs_curve.Curve, Plane=xz_plane)  # -> Geometry, Transform
construct_point_3 = ConstructPoint(XCoordinate=0, YCoordinate=0, ZCoordinate=0)
join_curves = JoinCurves(Curves=[nurbs_curve.Curve, mirror.Geometry], Preserve=False)
end_points = EndPoints(Curve=join_curves)  # -> Start, End
line = Line(StartPoint=construct_point_3, EndPoint=end_points.End)
xz_plane_2 = XZPlane(Origin=Point(0, 0, 0))
revolution = Revolution(Curve=join_curves, Axis=nurbs_curve_2.Curve, Domain=Domain(0, 6.283185307))
polar_array = PolarArray(Geometry=line, Plane=xz_plane_2, Count=Slider(4, range=0..10), Angle=6.283185307)  # -> Geometry, Transform
xz_plane_3 = XZPlane(Origin=Point(0, 0, 0))
deconstruct_brep = DeconstructBrep(Brep=revolution)  # -> Faces, Edges, Vertices
cylinder = Cylinder(Base=xz_plane_3, Radius=number_slider_15, Length=number_slider_15)
mirror_2 = Mirror(Geometry=polar_array.Geometry, Plane=xz_plane_3)  # -> Geometry, Transform
mirror_3 = Mirror(Geometry=cylinder, Plane=xz_plane_3)  # -> Geometry, Transform
range_2 = Range(Domain=Domain(0, 1), Steps=10)
merge = Merge(Data1=cylinder, Data2=mirror_3.Geometry)
merge_2 = Merge(Data1=polar_array.Geometry, Data2=mirror_2.Geometry)
graph_mapper = GraphMapper(range_2, x0=0, x1=1, y0=0, y1=3, container_name="Bezier", cpx=[0, 0, 1, 1], cpy=[0, 0.8166884184, 0.0802205205, 1])
pipe_variable = PipeVariable(Curve=reparameterize(merge_2), Parameters=range_2, Radii=graph_mapper, Caps=Slider(2, range=0..2))  # -> flatten(Pipe)
cap_holes = CapHoles(Brep=merge)

list_item_2 = ListItem(List=deconstruct_brep.Edges, Index=[Slider(0, range=0..100), Slider(2, range=0..10)], Wrap=True)

loft = Loft(Curves=list_item_2, Options={Adjust=True, Closed=False, LoftEnds=0, LoftSimp=0, LoftType=0, Rebuild=10, Refit=0.01})
merge_3 = Merge(Data1=revolution, Data2=loft)  # -> flatten(Result)
merge_4 = Merge(Data1=merge_3, Data2=cap_holes, Data3=pipe_variable)
brep_join = BrepJoin(Breps=merge_4)  # -> Breps, Closed
solid_union = SolidUnion(Breps=brep_join.Breps)

brep = Brep(solid_union)
deconstruct_brep_2 = DeconstructBrep(Brep=brep)  # -> Faces, Edges, Vertices
number_slider_16 = Slider(18, range=0..100)
is_planar = IsPlanar(Surface=deconstruct_brep_2.Faces, Interior=True)  # -> Planar, Plane
cull_pattern = CullPattern(List=deconstruct_brep_2.Faces, CullPattern=is_planar.Planar)
unit_y = UnitY(Factor=number_slider_16)
list_item_3 = ListItem(List=cull_pattern, Index=0, Wrap=True)
extrude = Extrude(Base=list_item_3, Direction=unit_y)
number_slider_17 = Slider(11, range=0..100)
merge_5 = Merge(Data1=brep, Data2=extrude)  # -> flatten(Result)
negative = Negative(Value=number_slider_17)
multiplication_4 = Multiplication(A=number_slider_16, B=Slider(1, range=0..10))
negative_2 = Negative(Value=multiplication_4)
brep_join_2 = BrepJoin(Breps=merge_5)  # -> Breps, Closed
construct_domain = ConstructDomain(DomainStart=negative_2, DomainEnd=multiplication_4)
construct_domain_2 = ConstructDomain(DomainStart=negative, DomainEnd=number_slider_17)
area = Area(Geometry=list_item_3)  # -> Area, Centroid
solid_union_2 = SolidUnion(Breps=brep_join_2.Breps)
rectangle = Rectangle(Plane=PlaneXY(0, 0, 0), XSize=construct_domain, YSize=construct_domain_2, Radius=0)  # -> Rectangle, Length
explode = Explode(Curve=rectangle.Rectangle, Recursive=True)  # -> Segments, Vertices
panel = Panel("""1
0
0
1""")
cull_index = CullIndex(List=explode.Vertices, Indices=Slider(0, range=0..100), Wrap=True)
cull_pattern_2 = CullPattern(List=cull_index, CullPattern=panel)
xz_plane_4 = XZPlane(Origin=Point(0, 0, 0))
orient = Orient(Geometry=solid_union_2, Source=area.Centroid, Target=cull_pattern_2)  # -> Geometry, Transform
mirror_4 = Mirror(Geometry=orient.Geometry, Plane=xz_plane_4)  # -> Geometry, Transform
merge_6 = Merge(Data1=orient.Geometry, Data2=mirror_4.Geometry)
brep_join_3 = BrepJoin(Breps=merge_6)  # -> Breps, Closed
solid_union_3 = SolidUnion(Breps=brep_join_3.Breps)

brep_2 = Brep(solid_union_3)
deconstruct_brep_3 = DeconstructBrep(Brep=brep_2)  # -> Faces, Edges, Vertices
is_planar_2 = IsPlanar(Surface=deconstruct_brep_3.Faces, Interior=True)  # -> Planar, Plane
cull_pattern_3 = CullPattern(List=deconstruct_brep_3.Faces, CullPattern=is_planar_2.Planar)
deconstruct_brep_4 = DeconstructBrep(Brep=cull_pattern_3)  # -> Faces, Edges, Vertices
list_item_4 = ListItem(List=deconstruct_brep_4.Edges, Index=0, Wrap=True)
list_item_5 = ListItem(List=flatten(list_item_4), Index=0, Wrap=True)  # -> Item, Item1, Item2, Item3
end_points_2 = EndPoints(Curve=list_item_4)  # -> Start, End
explode_tree = ExplodeTree(Data=end_points_2.Start)  # -> _00000, _00001, _00010, _00011
explode_tree_2 = ExplodeTree(Data=end_points_2.End)  # -> _00000, _00001, _00010, _00011
point_on_curve = PointOnCurve(list_item_5.Item3, parameter=0.5)
point_on_curve_2 = PointOnCurve(list_item_5.Item2, parameter=0.5)
point_on_curve_3 = PointOnCurve(list_item_5.Item1, parameter=0.5)
point_on_curve_4 = PointOnCurve(list_item_5.Item, parameter=0.5)
line_2 = Line(StartPoint=explode_tree._00000, EndPoint=explode_tree_2._00001)
line_3 = Line(StartPoint=explode_tree._00001, EndPoint=explode_tree_2._00000)
line_4 = Line(StartPoint=explode_tree._00010, EndPoint=explode_tree_2._00011)
line_5 = Line(StartPoint=explode_tree._00011, EndPoint=explode_tree_2._00010)
line_6 = Line(StartPoint=point_on_curve_2, EndPoint=point_on_curve)
line_7 = Line(StartPoint=point_on_curve_4, EndPoint=point_on_curve_3)
point_on_curve_5 = PointOnCurve(line_2, parameter=0.5)
point_on_curve_6 = PointOnCurve(line_3, parameter=0.5)
point_on_curve_7 = PointOnCurve(line_4, parameter=0.5)
point_on_curve_8 = PointOnCurve(line_5, parameter=0.5)
point_on_curve_9 = PointOnCurve(line_6, parameter=0.5)
point_on_curve_10 = PointOnCurve(line_7, parameter=0.5)
circle_3pt = Circle3Pt(PointA=point_on_curve_5, PointB=point_on_curve_10, PointC=point_on_curve_6)  # -> Circle, Plane, Radius
circle_3pt_2 = Circle3Pt(PointA=point_on_curve_7, PointB=point_on_curve_9, PointC=point_on_curve_8)  # -> Circle, Plane, Radius
unit_z = UnitZ(Factor=number_slider_16)
move = Move(Geometry=[end_points_2.Start, end_points_2.End], Motion=unit_z)  # -> Geometry, Transform
move_2 = Move(Geometry=[end_points_2.End, end_points_2.Start], Motion=unit_z)  # -> Geometry, Transform
sphere = Sphere(Base=circle_3pt.Circle, Radius=circle_3pt.Radius)
sphere_2 = Sphere(Base=circle_3pt_2.Circle, Radius=circle_3pt_2.Radius)
volume = Volume(Geometry=sphere)  # -> Volume, Centroid
volume_2 = Volume(Geometry=sphere_2)  # -> Volume, Centroid
cross_reference = CrossReference(ListListA=move_2.Geometry, ListListB=volume_2.Centroid, CrossMode=1)  # -> ListListA, ListListB
cross_reference_2 = CrossReference(ListListA=move.Geometry, ListListB=volume.Centroid, CrossMode=1)  # -> ListListA, ListListB
line_8 = Line(StartPoint=cross_reference.ListListA, EndPoint=cross_reference.ListListB)
line_9 = Line(StartPoint=cross_reference_2.ListListA, EndPoint=cross_reference_2.ListListB)
pipe = Pipe(Curve=[line_9, line_8], Radius=Slider(1, range=0..1), Caps=Slider(2, range=0..10))  # -> graft(Pipe)
solid_union_4 = SolidUnion(Breps=pipe)

unit_y_2 = UnitY(Factor=1)
plane = Plane(is_planar_2.Plane)
plane_2 = Plane(flatten(deconstruct_brep_4.Vertices))
negative_3 = Negative(Value=unit_y_2)
plane_normal = PlaneNormal(Origin=plane_2, ZAxis=[unit_y_2, negative_3])
boolean_toggle = BooleanToggle(False)
flip_plane = FlipPlane(Plane=plane_normal, ReverseX=boolean_toggle, ReverseY=boolean_toggle, SwapAxes=True)
cone = Cone(Base=[plane, plane_normal, flip_plane], Radius=0.5, Length=Slider(10, range=0..10))  # -> Cone, Tip
merge_7 = Merge(Data1=plane_normal, Data2=flip_plane)
explode_tree_3 = ExplodeTree(Data=cone.Tip)  # -> Branch0, _0000, _0001
circle = Circle(Plane=PlaneXY(0, 0, 0), Radius=Slider(3, range=0..100))
explode_tree_4 = ExplodeTree(Data=cone.Cone)  # -> Branch0, _0000, _0001
divide_curve = DivideCurve(Curve=circle, Count=Slider(3, range=0..100), Kinks=False)  # -> Points, Tangents, Parameters
arc_3pt = Arc3Pt(PointA=merge_7, PointB=divide_curve.Points, PointC=explode_tree_3.Branch0)  # -> Arc, Plane, Radius
bend_deform = BendDeform(Geometry=explode_tree_4.Branch0, BendingArc=graft(arc_3pt.Arc))
cap_holes_2 = CapHoles(Brep=cone.Cone)
group = Group(Objects=cap_holes_2)
geometry = Geometry(bend_deform)

multiplication_5 = Multiplication(A=number_slider_17, B=Slider(7.643, range=0..10))
brep_join_4 = BrepJoin(Breps=merge_6)  # -> Breps, Closed
solid_union_5 = SolidUnion(Breps=brep_join_4.Breps)
# Full multiplicity knots at start
# Simple knots
# Full multiplicity knots at end
# P1
# A=0.2*P1+ 0.8*P2
# D=0.2*A + 0.8*B
# P2
# B=0.47*P2 + 0.53*P3
# Full multiplicity knots at start
# E=0.7*B + 0.3*C
# P3
# Full multiplicity knots in the middle
# C=0.8*P3 + 0.2*P4
# P4
# Full multiplicity knots at end
# Compare knot spacing
# GH solution
# VB
# C#
# Python with RhinoCommon Only
# Pythong with RhinoScriptSyntax
# GH solution
# VB
# C#
# Python
# VB
custom_preview = CustomPreview(Geometry=geometry, Material=gradient_7)  # disabled

curve = Curve(line_9)
end_points_3 = EndPoints(Curve=curve)  # -> Start, End
list_item_6 = ListItem(List=end_points_3.Start, Index=0, Wrap=True)  # -> flatten(Item), flatten(Item1), Item2, Item3
point = Point(list_item_6.Item)
point_2 = Point(list_item_6.Item1)
list_item_7 = ListItem(List=point, Index=0, Wrap=True)  # -> Item, Item1, Item2, Item3
list_item_8 = ListItem(List=point_2, Index=0, Wrap=True)  # -> Item, Item1, Item2, Item3
line_10 = Line(StartPoint=list_item_7.Item, EndPoint=list_item_7.Item2)
line_11 = Line(StartPoint=list_item_8.Item1, EndPoint=list_item_8.Item3)
divide_curve_2 = DivideCurve(Curve=line_10, Count=10, Kinks=False)  # -> Points, Tangents, Parameters
divide_curve_3 = DivideCurve(Curve=line_11, Count=10, Kinks=False)  # -> Points, Tangents, Parameters
point_on_curve_11 = PointOnCurve(line_10, parameter=0.5)
unit_z_2 = UnitZ(Factor=multiplication_5)
move_3 = Move(Geometry=point_on_curve_11, Motion=unit_z_2)  # -> Geometry, Transform
arc_3pt_2 = Arc3Pt(PointA=divide_curve_2.Points, PointB=move_3.Geometry, PointC=divide_curve_3.Points)  # -> Arc, Plane, Radius
loft_2 = Loft(Curves=arc_3pt_2.Arc, Options={Adjust=True, Closed=True, LoftEnds=0, LoftSimp=0, LoftType=0, Rebuild=10, Refit=0.01})
deconstruct_brep_5 = DeconstructBrep(Brep=loft_2)  # -> graft(Faces), Edges, Vertices
merge_8 = Merge(Data1=deconstruct_brep_5.Faces)
construct_domain_3 = ConstructDomain(UMin=0, UMax=Slider(0.603, range=0..1), VMin=0, VMax=Slider(0.377, range=0..1))
surface = Surface(merge_8)
isotrim = Isotrim(Surface=reparameterize(surface), Domain=construct_domain_3)
deconstruct_brep_6 = DeconstructBrep(Brep=isotrim)  # -> Faces, Edges, Vertices
list_item_9 = ListItem(List=deconstruct_brep_6.Vertices, Index=Slider(2, range=0..10), Wrap=True)

surface_closest_point = SurfaceClosestPoint(Point=list_item_9, Surface=surface)  # -> Point, UVPoint, Distance
evaluate_surface = EvaluateSurface(Surface=surface, Point=surface_closest_point.UVPoint)  # -> Point, Normal, UDirection, VDirection, Frame

amplitude = Amplitude(Vector=evaluate_surface.Normal, Amplitude=Slider(57, range=0..100))
multiplication_6 = Multiplication(A=evaluate_surface.Normal, B=Slider(10, range=0..10))
extrude_2 = Extrude(Base=surface, Direction=multiplication_6)
vector_display = VectorDisplay(Anchor=evaluate_surface.Point, Vector=amplitude)

cap_holes_3 = CapHoles(Brep=extrude_2)
explode_tree_5 = ExplodeTree(Data=graft([solid_union_3, solid_union_4, sphere, sphere_2, cap_holes_3, group]))  # -> Branch0, _0000, _00000, _000000, _00000000, _000001, _00000100, _00000200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; disabled
custom_preview_2 = CustomPreview(Geometry=[explode_tree_5._000001, explode_tree_5._00000100, explode_tree_5._00001100], Material=gradient_4)  # disabled
custom_preview_3 = CustomPreview(Geometry=[explode_tree_5.Branch13, explode_tree_5._00011000, explode_tree_5._00011200], Material=gradient)  # disabled
# rc
# rs
custom_preview_4 = CustomPreview(Geometry=explode_tree_5._00000, Material=gradient_9)  # disabled
custom_preview_5 = CustomPreview(Geometry=explode_tree_5._00000300, Material=gradient_3)  # disabled
custom_preview_6 = CustomPreview(
    Geometry=[explode_tree_5._00000200, explode_tree_5._00001300, explode_tree_5._00010200, explode_tree_5._00011300],
    Material=gradient_5)  # disabled
custom_preview_7 = CustomPreview(Geometry=explode_tree_5._00000000, Material=gradient_4)  # disabled
custom_preview_8 = CustomPreview(Geometry=[explode_tree_5.Branch0, explode_tree_5._00011100], Material=gradient_6)  # disabled
custom_preview_9 = CustomPreview(Geometry=[explode_tree_5._000000, explode_tree_5._00001000], Material=gradient_8)  # disabled
custom_preview_10 = CustomPreview(Geometry=explode_tree_5._00001200, Material=gradient_2)  # disabled
custom_preview_11 = CustomPreview(Geometry=explode_tree_5._00010, Material=gradient_10)  # disabled
custom_preview_12 = CustomPreview(Geometry=[explode_tree_5._00010000, explode_tree_5._00010300], Material=gradient_13)  # disabled
custom_preview_13 = CustomPreview(Geometry=[explode_tree_5._000000, explode_tree_5._000100], Material=gradient_14)  # disabled
custom_preview_14 = CustomPreview(Geometry=explode_tree_5._00011200, Material=gradient_12)  # disabled
custom_preview_15 = CustomPreview(Geometry=explode_tree_5._0000, Material=gradient_11)  # disabled
