# Grasshopper definition SetsList059.gh (Grasshopper 1.0.7)
# Copyright: Wickerson Studios
# plug-ins: Bifocals

image_sampler = ImageSampler(
    FilePath="C:\Users\Sculpture\Documents\2020Grasshopper\ScreenShots2019\Screenshots2020\SurfaceEditAlgorithm.PNG",
    Filter="Value",
    Interpolate=False,
    Umax=1,
    Umin=0,
    Vmax=1,
    Vmin=0,
    Wrap=1)

# ----
# Wickerson Studio
# 
# created by: Michael Wickerson
# 
# Grasshopper for Rhino 3D Algorithmic Modeling
# 
# www.wickersonstudios.com
# www.michaelwickerson.com
# https://www.youtube.com/channel/UC7J48Ppcsa6oncp6d29R0xw
# https://github.com/mwickerson
# https://www.facebook.com/michael.wickerson
# https://www.linkedin.com/in/michael-wickerson-696a80156/
# https://www.grasshopper3d.com/profile/MichaelWickerson
insert_items = InsertItems(Wrap=True)
list_length = ListLength()
# Wickerson Studio
# created by: Michael Wickerson
# Grasshopper for Rhino 3D Algorithmic Modeling
# www.wickersonstudios.com
# www.michaelwickerson.com
# https://www.youtube.com/channel/UC7J48Ppcsa6oncp6d29R0xw
# https://github.com/mwickerson
# https://www.facebook.com/michael.wickerson
# https://www.linkedin.com/in/michael-wickerson-696a80156/
# https://www.grasshopper3d.com/profile/MichaelWickerson
item_index = ItemIndex()
list_item = ListItem(Index=0, Wrap=True)
# 1001 GRASSHOPPER DEFINITIONS
# SETS LIST 059/1001
partition_list = PartitionList(Size=[3, 2])
replace_items = ReplaceItems(Wrap=False)
shift_list = ShiftList(Shift=1, Wrap=True)
reverse_list = ReverseList()
sort_list = SortList()  # -> Keys, ValuesA
sub_list = SubList(Wrap=True)  # -> List, Index
split_list = SplitList()  # -> ListA, ListB

insert_items_2 = InsertItems(Wrap=True)
list_length_2 = ListLength()
item_index_2 = ItemIndex()
list_item_2 = ListItem(Index=0, Wrap=True)
partition_list_2 = PartitionList(Size=[3, 2])
replace_items_2 = ReplaceItems(Wrap=False)
shift_list_2 = ShiftList(Shift=1, Wrap=True)
reverse_list_2 = ReverseList()
sort_list_2 = SortList()  # -> Keys, ValuesValuesA
sub_list_2 = SubList(Wrap=True)  # -> List, Index
split_list_2 = SplitList()  # -> ListA, ListB
explode_tree = ExplodeTree()  # -> _0000, _0001, _0002, _0003, _0004, _0005, _0006, _0007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
gradient = Gradient(
    LowerLimit=0,
    UpperLimit=1,
    Parameter=Slider(0.46, range=0..1),
    stops=[0: RGB(234, 38, 0), 0.25: RGB(234, 126, 0), 0.5: RGB(254, 244, 84), 0.75: RGB(173, 203, 249), 1: RGB(75, 107, 169)])
gradient_2 = Gradient(LowerLimit=0, UpperLimit=1, Parameter=Slider(0.02, range=0..1), stops=[0.15: RGB(255, 130, 160), 0.85: RGB(220, 0, 40)])
gradient_3 = Gradient(
    LowerLimit=0,
    UpperLimit=1,
    Parameter=Slider(0.12, range=0..1),
    stops=[0: RGB(234, 38, 0), 0.25: RGB(234, 126, 0), 0.5: RGB(254, 244, 84), 0.75: RGB(173, 203, 249), 1: RGB(75, 107, 169)])
gradient_4 = Gradient(
    LowerLimit=0,
    UpperLimit=1,
    Parameter=Slider(0.84, range=0..1),
    stops=[0: RGB(243, 57, 0), 0.1: RGB(236, 27, 60), 0.2: RGB(210, 0, 118), 0.3: RGB(103, 0, 120), 0.4: RGB(39, 72, 161), 0.6: RGB(18, 178, 90), 0.7: RGB(79, 186, 8), 0.8: RGB(220, 237, 32), 0.9: RGB(247, 159, 20), 1: RGB(243, 57, 0)])
gradient_5 = Gradient(
    LowerLimit=0,
    UpperLimit=1,
    Parameter=Slider(0.19, range=0..1),
    stops=[0: RGB(243, 57, 0), 0.1: RGB(236, 27, 60), 0.2: RGB(210, 0, 118), 0.305: RGB(103, 0, 120), 0.4: RGB(39, 72, 161), 0.6: RGB(18, 178, 90), 0.7: RGB(79, 186, 8), 0.8: RGB(220, 237, 32), 0.9: RGB(247, 159, 20), 1: RGB(243, 57, 0)])
gradient_6 = Gradient(LowerLimit=0, UpperLimit=1, Parameter=Slider(0.87, range=0..1), stops=[0.15: RGB(255, 130, 160), 0.85: RGB(220, 0, 40)])
gradient_7 = Gradient(
    LowerLimit=0,
    UpperLimit=1,
    Parameter=Slider(0.54, range=0..1),
    stops=[0: RGB(243, 57, 0), 0.1: RGB(236, 27, 60), 0.2: RGB(210, 0, 118), 0.3: RGB(103, 0, 120), 0.4: RGB(39, 72, 161), 0.6: RGB(18, 178, 90), 0.7: RGB(79, 186, 8), 0.8: RGB(220, 237, 32), 0.9: RGB(247, 159, 20), 1: RGB(243, 57, 0)])
gradient_8 = Gradient(LowerLimit=0, UpperLimit=1, Parameter=Slider(0.21, range=0..1), stops=[0.704: RGB(173, 203, 249), 1: RGB(75, 107, 169)])
gradient_9 = Gradient(
    LowerLimit=0,
    UpperLimit=1,
    Parameter=Slider(1, range=0..1),
    stops=[0.221: RGB(152, 89, 100), 0.754: RGB(173, 203, 249), 1: RGB(75, 107, 169)])
gradient_10 = Gradient(
    LowerLimit=0,
    UpperLimit=1,
    Parameter=Slider(0.43, range=0..1),
    stops=[0.447: RGB(31, 197, 237), 0.567: RGB(110, 169, 24), 0.85: RGB(220, 0, 40)])
gradient_11 = Gradient(
    LowerLimit=0,
    UpperLimit=1,
    Parameter=Slider(0.42, range=0..1),
    stops=[0: RGB(0, 86, 238), 0.25: RGB(234, 126, 0), 1: RGB(75, 107, 169)])
gradient_12 = Gradient(LowerLimit=0, UpperLimit=1, Parameter=Slider(0.39, range=0..1), stops=[0.804: RGB(173, 203, 249), 1: RGB(75, 107, 169)])
gradient_13 = Gradient(
    LowerLimit=0,
    UpperLimit=1,
    Parameter=Slider(0.89, range=0..1),
    stops=[0: RGB(243, 57, 0), 0.1: RGB(236, 27, 60), 0.2: RGB(210, 0, 118), 0.3: RGB(103, 0, 120), 0.4: RGB(39, 72, 161), 0.6: RGB(18, 178, 90), 0.7: RGB(79, 186, 8), 0.8: RGB(220, 237, 32), 0.9: RGB(247, 159, 20), 1: RGB(243, 57, 0)])
gradient_14 = Gradient(LowerLimit=0, UpperLimit=1, Parameter=Slider(0.22, range=0..1), stops=[0.704: RGB(173, 203, 249), 1: RGB(75, 107, 169)])
custom_preview = CustomPreview(Geometry=[explode_tree._0005, explode_tree._0006, explode_tree._00010], Material=gradient_3)
custom_preview_2 = CustomPreview(Geometry=explode_tree._00013, Material=gradient)
custom_preview_3 = CustomPreview(Geometry=explode_tree._0002, Material=gradient_9)
custom_preview_4 = CustomPreview(Geometry=explode_tree._0008, Material=gradient_2)
custom_preview_5 = CustomPreview(Geometry=[explode_tree._0007, explode_tree._00012, explode_tree._00018], Material=gradient_4)
custom_preview_6 = CustomPreview(Geometry=explode_tree._0004, Material=gradient_3)
custom_preview_7 = CustomPreview(Geometry=explode_tree._0000, Material=gradient_5)
custom_preview_8 = CustomPreview(Geometry=[explode_tree._0003, explode_tree._0009], Material=gradient_7)
custom_preview_9 = CustomPreview(Geometry=explode_tree._00011, Material=gradient_8)
custom_preview_10 = CustomPreview(Geometry=explode_tree._00014, Material=gradient_12)
# Full multiplicity knots at start
# Simple knots
# Full multiplicity knots at end
# P1
# A=0.2*P1+ 0.8*P2
# D=0.2*A + 0.8*B
# P2
# B=0.47*P2 + 0.53*P3
# Full multiplicity knots at start
# E=0.7*B + 0.3*C
# P3
# Full multiplicity knots in the middle
# C=0.8*P3 + 0.2*P4
# P4
# Full multiplicity knots at end
# Compare knot spacing
# GH solution
# VB
# C#
# Python with RhinoCommon Only
# Pythong with RhinoScriptSyntax
# GH solution
# VB
# C#
# Python
# VB
custom_preview_11 = CustomPreview(Geometry=explode_tree._00017, Material=gradient_6)
custom_preview_12 = CustomPreview(Geometry=[explode_tree._00016, explode_tree._00019], Material=gradient_13)
custom_preview_13 = CustomPreview(Geometry=[explode_tree._0003, explode_tree._00015], Material=gradient_14)
custom_preview_14 = CustomPreview(Geometry=explode_tree._0002, Material=gradient_11)
# rc
# rs
custom_preview_15 = CustomPreview(Geometry=explode_tree._0001, Material=gradient_10)
