# Grasshopper definition SetsList061.gh (Grasshopper 1.0.7)
# Copyright: Wickerson Studios
# plug-ins: Bifocals

image_sampler = ImageSampler(
    FilePath="C:\Users\Sculpture\Documents\2020Grasshopper\ScreenShots2019\Screenshots2020\SurfaceEditAlgorithm.PNG",
    Filter="Value",
    Interpolate=False,
    Umax=1,
    Umin=0,
    Vmax=1,
    Vmin=0,
    Wrap=1)

# ----
# Wickerson Studio
# 
# created by: Michael Wickerson
# 
# Grasshopper for Rhino 3D Algorithmic Modeling
# 
# www.wickersonstudios.com
# www.michaelwickerson.com
# https://www.youtube.com/channel/UC7J48Ppcsa6oncp6d29R0xw
# https://github.com/mwickerson
# https://www.facebook.com/michael.wickerson
# https://www.linkedin.com/in/michael-wickerson-696a80156/
# https://www.grasshopper3d.com/profile/MichaelWickerson
insert_items = InsertItems(Wrap=True)
list_length = ListLength()
# Wickerson Studio
# created by: Michael Wickerson
# Grasshopper for Rhino 3D Algorithmic Modeling
# www.wickersonstudios.com
# www.michaelwickerson.com
# https://www.youtube.com/channel/UC7J48Ppcsa6oncp6d29R0xw
# https://github.com/mwickerson
# https://www.facebook.com/michael.wickerson
# https://www.linkedin.com/in/michael-wickerson-696a80156/
# https://www.grasshopper3d.com/profile/MichaelWickerson
item_index = ItemIndex()
list_item = ListItem(Index=0, Wrap=True)
# 1001 GRASSHOPPER DEFINITIONS
# SETS LIST 061/1001
partition_list = PartitionList(Size=[3, 2])
replace_items = ReplaceItems(Wrap=False)
shift_list = ShiftList(Shift=1, Wrap=True)
reverse_list = ReverseList()
sort_list = SortList()  # -> Keys, ValuesValuesA
sub_list = SubList(Wrap=True)  # -> List, Index
split_list = SplitList()  # -> ListA, ListB

pi = Pi(Factor=Slider(2, range=0..2))
construct_domain = ConstructDomain(DomainStart=0, DomainEnd=pi)
range = Range(Domain=construct_domain, Steps=Slider(10, range=0..10))
sine = Sine(Value=range)
natural_logarithm = NaturalLogarithm(Value=range)
sinc = Sinc(Value=range)
circle = Circle(Plane=PlaneXY(0, 0, 0), Radius=Slider(15, range=0..100))
multiplication = Multiplication(A=Slider(0.726, range=0..1), B=sine)
horizontal_frames = HorizontalFrames(Curve=circle, Count=10)  # -> graft(Frames), Parameters
construct_point = ConstructPoint(XCoordinate=0, YCoordinate=multiplication, ZCoordinate=range)
construct_point_2 = ConstructPoint(XCoordinate=0, YCoordinate=0, ZCoordinate=0)
orient = Orient(Geometry=construct_point, Source=construct_point_2, Target=horizontal_frames.Frames)  # -> Geometry, Transform
explode_tree = ExplodeTree()  # -> Branch0, Branch1, Branch2, Branch3, Branch4, Branch5, Branch6, Branch7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
gradient = Gradient(
    LowerLimit=0,
    UpperLimit=1,
    Parameter=Slider(0.46, range=0..1),
    stops=[0: RGB(234, 38, 0), 0.25: RGB(234, 126, 0), 0.5: RGB(254, 244, 84), 0.75: RGB(173, 203, 249), 1: RGB(75, 107, 169)])
gradient_2 = Gradient(LowerLimit=0, UpperLimit=1, Parameter=Slider(0.02, range=0..1), stops=[0.15: RGB(255, 130, 160), 0.85: RGB(220, 0, 40)])
gradient_3 = Gradient(
    LowerLimit=0,
    UpperLimit=1,
    Parameter=Slider(0.12, range=0..1),
    stops=[0: RGB(234, 38, 0), 0.25: RGB(234, 126, 0), 0.5: RGB(254, 244, 84), 0.75: RGB(173, 203, 249), 1: RGB(75, 107, 169)])
gradient_4 = Gradient(
    LowerLimit=0,
    UpperLimit=1,
    Parameter=Slider(0.84, range=0..1),
    stops=[0: RGB(243, 57, 0), 0.1: RGB(236, 27, 60), 0.2: RGB(210, 0, 118), 0.3: RGB(103, 0, 120), 0.4: RGB(39, 72, 161), 0.6: RGB(18, 178, 90), 0.7: RGB(79, 186, 8), 0.8: RGB(220, 237, 32), 0.9: RGB(247, 159, 20), 1: RGB(243, 57, 0)])
gradient_5 = Gradient(
    LowerLimit=0,
    UpperLimit=1,
    Parameter=Slider(0.19, range=0..1),
    stops=[0: RGB(243, 57, 0), 0.1: RGB(236, 27, 60), 0.2: RGB(210, 0, 118), 0.305: RGB(103, 0, 120), 0.4: RGB(39, 72, 161), 0.6: RGB(18, 178, 90), 0.7: RGB(79, 186, 8), 0.8: RGB(220, 237, 32), 0.9: RGB(247, 159, 20), 1: RGB(243, 57, 0)])
gradient_6 = Gradient(LowerLimit=0, UpperLimit=1, Parameter=Slider(0.87, range=0..1), stops=[0.15: RGB(255, 130, 160), 0.85: RGB(220, 0, 40)])
gradient_7 = Gradient(
    LowerLimit=0,
    UpperLimit=1,
    Parameter=Slider(0.54, range=0..1),
    stops=[0: RGB(243, 57, 0), 0.1: RGB(236, 27, 60), 0.2: RGB(210, 0, 118), 0.3: RGB(103, 0, 120), 0.4: RGB(39, 72, 161), 0.6: RGB(18, 178, 90), 0.7: RGB(79, 186, 8), 0.8: RGB(220, 237, 32), 0.9: RGB(247, 159, 20), 1: RGB(243, 57, 0)])
gradient_8 = Gradient(LowerLimit=0, UpperLimit=1, Parameter=Slider(0.21, range=0..1), stops=[0.704: RGB(173, 203, 249), 1: RGB(75, 107, 169)])
gradient_9 = Gradient(
    LowerLimit=0,
    UpperLimit=1,
    Parameter=Slider(1, range=0..1),
    stops=[0.221: RGB(152, 89, 100), 0.754: RGB(173, 203, 249), 1: RGB(75, 107, 169)])
gradient_10 = Gradient(
    LowerLimit=0,
    UpperLimit=1,
    Parameter=Slider(0.43, range=0..1),
    stops=[0.447: RGB(31, 197, 237), 0.567: RGB(110, 169, 24), 0.85: RGB(220, 0, 40)])
gradient_11 = Gradient(
    LowerLimit=0,
    UpperLimit=1,
    Parameter=Slider(0.42, range=0..1),
    stops=[0: RGB(0, 86, 238), 0.25: RGB(234, 126, 0), 1: RGB(75, 107, 169)])
gradient_12 = Gradient(LowerLimit=0, UpperLimit=1, Parameter=Slider(0.39, range=0..1), stops=[0.804: RGB(173, 203, 249), 1: RGB(75, 107, 169)])
gradient_13 = Gradient(
    LowerLimit=0,
    UpperLimit=1,
    Parameter=Slider(0.89, range=0..1),
    stops=[0: RGB(243, 57, 0), 0.1: RGB(236, 27, 60), 0.2: RGB(210, 0, 118), 0.3: RGB(103, 0, 120), 0.4: RGB(39, 72, 161), 0.6: RGB(18, 178, 90), 0.7: RGB(79, 186, 8), 0.8: RGB(220, 237, 32), 0.9: RGB(247, 159, 20), 1: RGB(243, 57, 0)])
gradient_14 = Gradient(LowerLimit=0, UpperLimit=1, Parameter=Slider(0.22, range=0..1), stops=[0.704: RGB(173, 203, 249), 1: RGB(75, 107, 169)])
custom_preview = CustomPreview(Geometry=[explode_tree.Branch5, explode_tree.Branch6, explode_tree.Branch10], Material=gradient_3)
custom_preview_2 = CustomPreview(Geometry=explode_tree.Branch13, Material=gradient)
custom_preview_3 = CustomPreview(Geometry=explode_tree.Branch2, Material=gradient_9)
custom_preview_4 = CustomPreview(Geometry=explode_tree.Branch8, Material=gradient_2)
custom_preview_5 = CustomPreview(Geometry=[explode_tree.Branch7, explode_tree.Branch12, explode_tree.Branch18], Material=gradient_4)
custom_preview_6 = CustomPreview(Geometry=explode_tree.Branch4, Material=gradient_3)
custom_preview_7 = CustomPreview(Geometry=explode_tree.Branch0, Material=gradient_5)
custom_preview_8 = CustomPreview(Geometry=[explode_tree.Branch3, explode_tree.Branch9], Material=gradient_7)
custom_preview_9 = CustomPreview(Geometry=explode_tree.Branch11, Material=gradient_8)
custom_preview_10 = CustomPreview(Geometry=explode_tree.Branch14, Material=gradient_12)
# Full multiplicity knots at start
# Simple knots
# Full multiplicity knots at end
# P1
# A=0.2*P1+ 0.8*P2
# D=0.2*A + 0.8*B
# P2
# B=0.47*P2 + 0.53*P3
# Full multiplicity knots at start
# E=0.7*B + 0.3*C
# P3
# Full multiplicity knots in the middle
# C=0.8*P3 + 0.2*P4
# P4
# Full multiplicity knots at end
# Compare knot spacing
# GH solution
# VB
# C#
# Python with RhinoCommon Only
# Pythong with RhinoScriptSyntax
# GH solution
# VB
# C#
# Python
# VB
custom_preview_11 = CustomPreview(Geometry=explode_tree.Branch17, Material=gradient_6)
custom_preview_12 = CustomPreview(Geometry=[explode_tree.Branch16, explode_tree.Branch19], Material=gradient_13)
custom_preview_13 = CustomPreview(Geometry=[explode_tree.Branch3, explode_tree.Branch15], Material=gradient_14)
custom_preview_14 = CustomPreview(Geometry=explode_tree.Branch2, Material=gradient_11)
# rc
# rs
custom_preview_15 = CustomPreview(Geometry=explode_tree.Branch1, Material=gradient_10)
