# Grasshopper definition SetsList064pipes.gh (Grasshopper 1.0.7)
# Copyright: Wickerson Studios
# plug-ins: MeshEdit Components, Bifocals

image_sampler = ImageSampler(
    FilePath="C:\Users\Sculpture\Documents\2020Grasshopper\ScreenShots2019\Screenshots2020\SurfaceEditAlgorithm.PNG",
    Filter="Value",
    Interpolate=False,
    Umax=1,
    Umin=0,
    Vmax=1,
    Vmin=0,
    Wrap=1)

cull_nth = CullNth(CullFrequency=2)
# Wickerson Studio
# created by: Michael Wickerson
# Grasshopper for Rhino 3D Algorithmic Modeling
# www.wickersonstudios.com
# www.michaelwickerson.com
# https://www.youtube.com/channel/UC7J48Ppcsa6oncp6d29R0xw
# https://github.com/mwickerson
# https://www.facebook.com/michael.wickerson
# https://www.linkedin.com/in/michael-wickerson-696a80156/
# https://www.grasshopper3d.com/profile/MichaelWickerson
cull_pattern = CullPattern(CullPattern=[False, False, True, True])
random_reduce = RandomReduce(Seed=1)
# 1001 GRASSHOPPER DEFINITIONS
# Wickerson Studio
# 
# created by: Michael Wickerson
# 
# Grasshopper for Rhino 3D Algorithmic Modeling
# 
# www.wickersonstudios.com
# www.michaelwickerson.com
# https://www.youtube.com/channel/UC7J48Ppcsa6oncp6d29R0xw
# https://github.com/mwickerson
# https://www.facebook.com/michael.wickerson
# https://www.linkedin.com/in/michael-wickerson-696a80156/
# https://www.grasshopper3d.com/profile/MichaelWickerson
cull_index = CullIndex(Wrap=True)
list_item = ListItem(Index=0, Wrap=True)

# ----
# SETS SEQUENCE 063/1001
number_slider = Slider(0.01, range=0..0.01)
number_slider_2 = Slider(6, range=6..10)
construct_domain = ConstructDomain(DomainStart=number_slider, DomainEnd=1)
range = Range(Domain=construct_domain, Steps=number_slider_2)
sine = Sine(Value=range)
power_of_e = PowerOfE(Value=sine)
multiplication = Multiplication(A=range, B=number_slider_2)
square = Square(Value=range)
jitter = Jitter(List=power_of_e, Jitter=Slider(0.27, range=0..1), Seed=2)  # -> Values, Indices
construct_point = ConstructPoint(XCoordinate=graft(multiplication), YCoordinate=range, ZCoordinate=jitter.Values)  # -> flatten(Point)
list_length = ListLength(List=construct_point)  # -> flatten(Length)
gene_pool = GenePool(
    Decimals=0,
    Maximum=121,
    Minimum=0,
    Value=[18.43561626, 8.667949039, 39.94531263, 24.21488729, 76.01636418, 42.4316288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])
panel = Panel(list_length)
random_reduce_2 = RandomReduce(List=construct_point, Reduction=Slider(2, range=0..30), Seed=Slider(100, range=0..100))

cull_index_2 = CullIndex(List=random_reduce_2, Indices=gene_pool, Wrap=True)

# ---- group: Jump
cull_nth_2 = CullNth(List=cull_index_2, CullFrequency=Slider(6, range=0..10))

# ----
unit_z = UnitZ(Factor=1)
construct_point_2 = ConstructPoint(XCoordinate=0, YCoordinate=0, ZCoordinate=0)
point = Point(cull_nth_2)
interpolate = Interpolate(Vertices=point, Degree=3, Periodic=False, KnotStyle=1)  # -> Curve, Length, Domain
line_sdl = LineSDL(Start=construct_point_2, Direction=unit_z, Length=1)
revolution = Revolution(Curve=interpolate.Curve, Axis=line_sdl, Domain=Domain(0, 6.283185307))
surface = Surface(revolution)
number_slider_3 = Slider(1, range=0..1)
construct_domain_2 = ConstructDomain(DomainU=number_slider_3, DomainV=number_slider_3)
surface_2 = Surface(surface)
isotrim = Isotrim(Surface=reparameterize(surface_2), Domain=construct_domain_2)
number_slider_4 = Slider(43, range=0..100)
deconstruct_brep = DeconstructBrep(Brep=isotrim)  # -> Faces, flatten(Edges), Vertices
area = Area(Geometry=deconstruct_brep.Faces)  # -> Area, Centroid
surface_closest_point = SurfaceClosestPoint(Point=area.Centroid, Surface=deconstruct_brep.Faces)  # -> Point, UVPoint, Distance
divide_surface = DivideSurface(Surface=surface_2, UCount=number_slider_4, VCount=number_slider_4)  # -> Points, Normals, Parameters
evaluate_surface = EvaluateSurface(Surface=deconstruct_brep.Faces, Point=surface_closest_point.UVPoint)  # -> Point, Normal, UDirection, VDirection, Frame
vector_display = VectorDisplay(Anchor=divide_surface.Points, Vector=divide_surface.Normals)
amplitude = Amplitude(Vector=divide_surface.Normals, Amplitude=Slider(2.277, range=0..10))
vector_display_2 = VectorDisplay(Anchor=evaluate_surface.Point, Vector=evaluate_surface.Normal)
addition = Addition(A=number_slider_4, B=Slider(1, range=0..10))
move = Move(Geometry=divide_surface.Points, Motion=amplitude)  # -> flatten(Geometry), Transform
surface_from_points = SurfaceFromPoints(Points=move.Geometry, UCount=addition, Interpolate=False)
mesh_frompoints = MeshFromPoints(Points=move.Geometry, UDirection=addition, VDirection=addition)  # disabled
number_slider_5 = Slider(2, range=0..10)
deconstruct_brep_2 = DeconstructBrep(Brep=surface_from_points)  # -> Faces, flatten(Edges), Vertices
list_item_2 = ListItem(List=deconstruct_brep_2.Edges, Index=0, Wrap=True)
list_item_3 = ListItem(List=deconstruct_brep.Edges, Index=0, Wrap=True)
list_item_4 = ListItem(List=deconstruct_brep_2.Edges, Index=number_slider_5, Wrap=True)
list_item_5 = ListItem(List=deconstruct_brep.Edges, Index=number_slider_5, Wrap=True)
loft = Loft(
    Curves=[list_item_5, list_item_4],
    Options={Adjust=False, Closed=False, LoftEnds=0, LoftSimp=0, LoftType=0, Rebuild=10, Refit=0.01})
loft_2 = Loft(
    Curves=[list_item_3, list_item_2],
    Options={Adjust=False, Closed=False, LoftEnds=0, LoftSimp=0, LoftType=0, Rebuild=10, Refit=0.01})
merge = Merge(Data1=surface_from_points, Data2=loft_2, Data3=surface_2, Data4=loft)
list_item_6 = ListItem(List=merge, Index=0, Wrap=True)
panel_2 = Panel(merge)
deconstruct_brep_3 = DeconstructBrep(Brep=list_item_6)  # -> Faces, flatten(Edges), Vertices
curve = Curve(deconstruct_brep_3.Edges)
pipe = Pipe(Curve=curve, Radius=Slider(0.24, range=0..10), Caps=Slider(1, range=0..1))
geometry = Geometry(pipe)
explode_tree = ExplodeTree(Data=graft(merge))  # -> Branch0, _00000, Branch2, Branch3, Branch4, Branch5, Branch6, Branch7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; disabled
gradient = Gradient(
    LowerLimit=0,
    UpperLimit=1,
    Parameter=Slider(0.46, range=0..1),
    stops=[0: RGB(234, 38, 0), 0.25: RGB(234, 126, 0), 0.5: RGB(254, 244, 84), 0.75: RGB(173, 203, 249), 1: RGB(75, 107, 169)])
gradient_2 = Gradient(LowerLimit=0, UpperLimit=1, Parameter=Slider(0.02, range=0..1), stops=[0.15: RGB(255, 130, 160), 0.85: RGB(220, 0, 40)])
gradient_3 = Gradient(
    LowerLimit=0,
    UpperLimit=1,
    Parameter=Slider(0.12, range=0..1),
    stops=[0: RGB(234, 38, 0), 0.25: RGB(234, 126, 0), 0.5: RGB(254, 244, 84), 0.75: RGB(173, 203, 249), 1: RGB(75, 107, 169)])
gradient_4 = Gradient(
    LowerLimit=0,
    UpperLimit=1,
    Parameter=Slider(0.84, range=0..1),
    stops=[0: RGB(243, 57, 0), 0.1: RGB(236, 27, 60), 0.2: RGB(210, 0, 118), 0.3: RGB(103, 0, 120), 0.4: RGB(39, 72, 161), 0.6: RGB(18, 178, 90), 0.7: RGB(79, 186, 8), 0.8: RGB(220, 237, 32), 0.9: RGB(247, 159, 20), 1: RGB(243, 57, 0)])
gradient_5 = Gradient(
    LowerLimit=0,
    UpperLimit=1,
    Parameter=Slider(0.19, range=0..1),
    stops=[0: RGB(243, 57, 0), 0.1: RGB(236, 27, 60), 0.2: RGB(210, 0, 118), 0.305: RGB(103, 0, 120), 0.4: RGB(39, 72, 161), 0.6: RGB(18, 178, 90), 0.7: RGB(79, 186, 8), 0.8: RGB(220, 237, 32), 0.9: RGB(247, 159, 20), 1: RGB(243, 57, 0)])
gradient_6 = Gradient(LowerLimit=0, UpperLimit=1, Parameter=Slider(0.87, range=0..1), stops=[0.15: RGB(255, 130, 160), 0.85: RGB(220, 0, 40)])
gradient_7 = Gradient(
    LowerLimit=0,
    UpperLimit=1,
    Parameter=Slider(0.54, range=0..1),
    stops=[0: RGB(243, 57, 0), 0.1: RGB(236, 27, 60), 0.2: RGB(210, 0, 118), 0.3: RGB(103, 0, 120), 0.4: RGB(39, 72, 161), 0.6: RGB(18, 178, 90), 0.7: RGB(79, 186, 8), 0.8: RGB(220, 237, 32), 0.9: RGB(247, 159, 20), 1: RGB(243, 57, 0)])
gradient_8 = Gradient(LowerLimit=0, UpperLimit=1, Parameter=Slider(0.21, range=0..1), stops=[0.704: RGB(173, 203, 249), 1: RGB(75, 107, 169)])
gradient_9 = Gradient(
    LowerLimit=0,
    UpperLimit=1,
    Parameter=Slider(1, range=0..1),
    stops=[0.221: RGB(152, 89, 100), 0.754: RGB(173, 203, 249), 1: RGB(75, 107, 169)])
gradient_10 = Gradient(
    LowerLimit=0,
    UpperLimit=1,
    Parameter=Slider(0.9, range=0..1),
    stops=[0.447: RGB(31, 197, 237), 0.567: RGB(110, 169, 24), 0.85: RGB(220, 0, 40)])
gradient_11 = Gradient(
    LowerLimit=0,
    UpperLimit=1,
    Parameter=Slider(0.67, range=0..1),
    stops=[0: RGB(57, 146, 70), 0: RGB(0, 86, 238), 0.634: RGB(234, 126, 0), 1: RGB(75, 107, 169)])
gradient_12 = Gradient(LowerLimit=0, UpperLimit=1, Parameter=Slider(0.39, range=0..1), stops=[0.804: RGB(173, 203, 249), 1: RGB(75, 107, 169)])
gradient_13 = Gradient(
    LowerLimit=0,
    UpperLimit=1,
    Parameter=Slider(0.89, range=0..1),
    stops=[0: RGB(243, 57, 0), 0.1: RGB(236, 27, 60), 0.2: RGB(210, 0, 118), 0.3: RGB(103, 0, 120), 0.4: RGB(39, 72, 161), 0.6: RGB(18, 178, 90), 0.7: RGB(79, 186, 8), 0.8: RGB(220, 237, 32), 0.9: RGB(247, 159, 20), 1: RGB(243, 57, 0)])
gradient_14 = Gradient(LowerLimit=0, UpperLimit=1, Parameter=Slider(0.22, range=0..1), stops=[0.406: RGB(173, 203, 249), 1: RGB(75, 107, 169)])
custom_preview = CustomPreview(Geometry=[explode_tree.Branch5, explode_tree.Branch6, explode_tree.Branch10], Material=gradient_3)
custom_preview_2 = CustomPreview(Geometry=explode_tree.Branch0, Material=gradient)
custom_preview_3 = CustomPreview(Geometry=explode_tree.Branch2, Material=gradient_9)
custom_preview_4 = CustomPreview(Geometry=explode_tree.Branch8, Material=gradient_2)
custom_preview_5 = CustomPreview(Geometry=[explode_tree.Branch7, explode_tree.Branch12, explode_tree.Branch18], Material=gradient_4)
custom_preview_6 = CustomPreview(Geometry=explode_tree.Branch4, Material=gradient_3)
custom_preview_7 = CustomPreview(Geometry=explode_tree.Branch3, Material=gradient_5)
custom_preview_8 = CustomPreview(Geometry=[explode_tree.Branch3, explode_tree.Branch9], Material=gradient_7)
custom_preview_9 = CustomPreview(Geometry=explode_tree.Branch11, Material=gradient_8)
custom_preview_10 = CustomPreview(Geometry=explode_tree.Branch14, Material=gradient_12)
# Full multiplicity knots at start
# Simple knots
# Full multiplicity knots at end
# P1
# A=0.2*P1+ 0.8*P2
# D=0.2*A + 0.8*B
# P2
# B=0.47*P2 + 0.53*P3
# Full multiplicity knots at start
# E=0.7*B + 0.3*C
# P3
# Full multiplicity knots in the middle
# C=0.8*P3 + 0.2*P4
# P4
# Full multiplicity knots at end
# Compare knot spacing
# GH solution
# VB
# C#
# Python with RhinoCommon Only
# Pythong with RhinoScriptSyntax
# GH solution
# VB
# C#
# Python
# VB
custom_preview_11 = CustomPreview(Geometry=explode_tree.Branch17, Material=gradient_6)
# rs
custom_preview_12 = CustomPreview(Geometry=[explode_tree.Branch16, explode_tree.Branch19], Material=gradient_13)
custom_preview_13 = CustomPreview(Geometry=explode_tree.Branch3, Material=gradient_14)
# rc
custom_preview_14 = CustomPreview(Geometry=explode_tree.Branch2, Material=gradient_11)
custom_preview_15 = CustomPreview(Geometry=explode_tree._00000, Material=gradient_10)
