# Grasshopper definition SetsList066.gh (Grasshopper 1.0.7)
# Copyright: Wickerson Studios

# Wickerson Studio
# 
# created by: Michael Wickerson
# 
# Grasshopper for Rhino 3D Algorithmic Modeling
# 
# www.wickersonstudios.com
# www.michaelwickerson.com
# https://www.youtube.com/channel/UC7J48Ppcsa6oncp6d29R0xw
# https://github.com/mwickerson
# https://www.facebook.com/michael.wickerson
# https://www.linkedin.com/in/michael-wickerson-696a80156/
# https://www.grasshopper3d.com/profile/MichaelWickerson
image_sampler = ImageSampler(
    FilePath="C:\Users\Sculpture\Documents\2020Grasshopper\ScreenShots2019\Screenshots2020\SurfaceEditAlgorithm.PNG",
    Filter="Value",
    Interpolate=False,
    Umax=1,
    Umin=0,
    Vmax=1,
    Vmin=0,
    Wrap=1)

# ----
# Wickerson Studio
# created by: Michael Wickerson
# Grasshopper for Rhino 3D Algorithmic Modeling
# www.wickersonstudios.com
# www.michaelwickerson.com
# https://www.youtube.com/channel/UC7J48Ppcsa6oncp6d29R0xw
# https://github.com/mwickerson
# https://www.facebook.com/michael.wickerson
# https://www.linkedin.com/in/michael-wickerson-696a80156/
# https://www.grasshopper3d.com/profile/MichaelWickerson
number_slider = Slider(1, range=0..1)
# 1001 GRASSHOPPER DEFINITIONS
# RETURN TO THE BASICS 066/1001
yz_plane = YZPlane(Origin=Point(0, 0, 0))
plane = Plane(PlaneXY(0, 0, 0))
arc = Arc(Plane=PlaneXY(0, 0, 0), Radius=1, Angle=Domain(0, 3.141592654))  # -> Arc, Length
circle = Circle(Plane=plane, Radius=Slider(0.441, range=0..1))
circle_2 = Circle(Plane=yz_plane, Radius=number_slider)
divide_curve = DivideCurve(Curve=[circle_2, circle], Count=Slider(4, range=0..12), Kinks=False)  # -> Points, Tangents, Parameters
explode_tree = ExplodeTree(Data=divide_curve.Points)  # -> Branch0, Branch1, Branch2, Branch3
line = Line(StartPoint=explode_tree.Branch0, EndPoint=explode_tree.Branch1)
merge = Merge(Data1=circle_2, Data2=circle, Data3=line)  # -> graft(Result)
pipe = Pipe(Curve=merge, Radius=Slider(0.07, range=0..1), Caps=0)
panel = Panel(pipe)

range = Range(Domain=Domain(0, 1), Steps=10)
graph_mapper = GraphMapper(
    range,
    x0=0,
    x1=1,
    y0=0,
    y1=1,
    container_name="Sine",
    Equation_px=[0.1892567575, 0.5984629989],
    Equation_py=[0.09249919653, 0.3584842682])
# rc
# rs
# Full multiplicity knots at start
# Simple knots
# Full multiplicity knots at end
# P1
# A=0.2*P1+ 0.8*P2
# D=0.2*A + 0.8*B
# P2
# B=0.47*P2 + 0.53*P3
# Full multiplicity knots at start
# E=0.7*B + 0.3*C
# P3
# Full multiplicity knots in the middle
# C=0.8*P3 + 0.2*P4
# P4
# Full multiplicity knots at end
# Compare knot spacing
# GH solution
# VB
# C#
# Python with RhinoCommon Only
# Pythong with RhinoScriptSyntax
# GH solution
# VB
# C#
# Python
# VB
pipe_variable = PipeVariable(Curve=reparameterize(merge), Parameters=range, Radii=graph_mapper, Caps=Slider(2, range=0..10))
