# Grasshopper definition SetsList067.gh (Grasshopper 1.0.7)
# Copyright: Wickerson Studios

# 1001 GRASSHOPPER DEFINITIONS
# Wickerson Studio
# 
# created by: Michael Wickerson
# 
# Grasshopper for Rhino 3D Algorithmic Modeling
# 
# www.wickersonstudios.com
# www.michaelwickerson.com
# https://www.youtube.com/channel/UC7J48Ppcsa6oncp6d29R0xw
# https://github.com/mwickerson
# https://www.facebook.com/michael.wickerson
# https://www.linkedin.com/in/michael-wickerson-696a80156/
# https://www.grasshopper3d.com/profile/MichaelWickerson
image_sampler = ImageSampler(
    FilePath="C:\Users\Sculpture\Documents\2020Grasshopper\ScreenShots2019\Screenshots2020\SurfaceEditAlgorithm.PNG",
    Filter="Value",
    Interpolate=False,
    Umax=1,
    Umin=0,
    Vmax=1,
    Vmin=0,
    Wrap=1)

# ----
# RETURN TO THE BASICS 067/1001
# Wickerson Studio
# created by: Michael Wickerson
# Grasshopper for Rhino 3D Algorithmic Modeling
# www.wickersonstudios.com
# www.michaelwickerson.com
# https://www.youtube.com/channel/UC7J48Ppcsa6oncp6d29R0xw
# https://github.com/mwickerson
# https://www.facebook.com/michael.wickerson
# https://www.linkedin.com/in/michael-wickerson-696a80156/
# https://www.grasshopper3d.com/profile/MichaelWickerson
number_slider = Slider(0, range=0..10)
number_slider_2 = Slider(7.348, range=0..10)
number_slider_3 = Slider(18, range=0..100)
number_slider_4 = Slider(7.8, range=0..10)
series = Series(Start=number_slider, Step=number_slider_2, Count=number_slider_3)
cosine = Cosine(Value=series)
sine = Sine(Value=series)
multiplication = Multiplication(A=sine, B=number_slider_4)
multiplication_2 = Multiplication(A=cosine, B=number_slider_4)

range = Range(Domain=Domain(0, 1), Steps=10)
cylinder = Cylinder(Base=PlaneXY(0, 0, 0), Radius=number_slider_3, Length=number_slider_3)
construct_point = ConstructPoint(XCoordinate=series, YCoordinate=multiplication_2, ZCoordinate=multiplication)
panel = Panel(construct_point)

shift_list = ShiftList(List=construct_point, Shift=Slider(6, range=1..18), Wrap=True)
reverse_list = ReverseList(List=construct_point)
list_length = ListLength(List=construct_point)
interpolate = Interpolate(Vertices=shift_list, Degree=3, Periodic=False, KnotStyle=1)  # -> Curve, Length, Domain
param_viewer = ParamViewer(list_length)
panel_2 = Panel(list_length)
# GH solution
# VB
# C#
# Python with RhinoCommon Only
# Pythong with RhinoScriptSyntax
# GH solution
# VB
# C#
# Python
# VB
pipe = Pipe(Curve=interpolate.Curve, Radius=number_slider_2, Caps=Slider(2, range=0..2))
# rc
# rs
# Full multiplicity knots at start
# Simple knots
# Full multiplicity knots at end
# P1
# A=0.2*P1+ 0.8*P2
# D=0.2*A + 0.8*B
# P2
# B=0.47*P2 + 0.53*P3
# Full multiplicity knots at start
# E=0.7*B + 0.3*C
# P3
# Full multiplicity knots in the middle
# C=0.8*P3 + 0.2*P4
# P4
# Full multiplicity knots at end
# Compare knot spacing
panel_3 = Panel(construct_point)
