# Grasshopper definition SetsList068.gh (Grasshopper 1.0.7)
# Copyright: Wickerson Studios

# 1001 GRASSHOPPER DEFINITIONS
# Wickerson Studio
# 
# created by: Michael Wickerson
# 
# Grasshopper for Rhino 3D Algorithmic Modeling
# 
# www.wickersonstudios.com
# www.michaelwickerson.com
# https://www.youtube.com/channel/UC7J48Ppcsa6oncp6d29R0xw
# https://github.com/mwickerson
# https://www.facebook.com/michael.wickerson
# https://www.linkedin.com/in/michael-wickerson-696a80156/
# https://www.grasshopper3d.com/profile/MichaelWickerson
image_sampler = ImageSampler(
    FilePath="C:\Users\Sculpture\Documents\2020Grasshopper\ScreenShots2019\Screenshots2020\SurfaceEditAlgorithm.PNG",
    Filter="Value",
    Interpolate=False,
    Umax=1,
    Umin=0,
    Vmax=1,
    Vmin=0,
    Wrap=1)
# Wickerson Studio
# created by: Michael Wickerson
# Grasshopper for Rhino 3D Algorithmic Modeling
# www.wickersonstudios.com
# www.michaelwickerson.com
# https://www.youtube.com/channel/UC7J48Ppcsa6oncp6d29R0xw
# https://github.com/mwickerson
# https://www.facebook.com/michael.wickerson
# https://www.linkedin.com/in/michael-wickerson-696a80156/
# https://www.grasshopper3d.com/profile/MichaelWickerson
number_slider = Slider(0.62, range=0..12)
number_slider_2 = Slider(11, range=0..100)
# RETURN TO THE BASICS 068/1001
yz_plane = YZPlane(Origin=Point(0, 0, 0))
radial = Radial(Plane=yz_plane, Size=number_slider, ExtentR=number_slider_2, ExtentP=number_slider_2)  # -> Cells, Points
hexagonal = Hexagonal(Plane=PlaneXY(0, 0, 0), Size=1, ExtentX=5, ExtentY=5)  # -> Cells, Points
curve = Curve(radial.Cells)
area = Area(Geometry=curve)  # -> Area, Centroid
point = Point(radial.Points)
flip_matrix = FlipMatrix(Data=point)
point_2 = Point(area.Centroid)
list_item = ListItem(List=flip_matrix, Index=0, Wrap=True)
construct_domain = ConstructDomain(DomainStart=Slider(1, range=0..1), DomainEnd=Slider(28, range=0..100))
line = Line(StartPoint=point_2, EndPoint=list_item)
list_length = ListLength(List=line)
panel = Panel(list_length)
range = Range(Domain=construct_domain, Steps=list_length)
unit_x = UnitX(Factor=range)
move = Move(Geometry=line, Motion=unit_x)  # -> Geometry, Transform
param_viewer = ParamViewer(move.Geometry)
panel_2 = Panel(move.Geometry)
loft = Loft(Curves=move.Geometry, Options={Adjust=False, Closed=False, LoftEnds=0, LoftSimp=0, LoftType=0, Rebuild=10, Refit=0.01})
# GH solution
# VB
# C#
# Python with RhinoCommon Only
# Pythong with RhinoScriptSyntax
# GH solution
# VB
# C#
# Python
# VB
panel_3 = Panel(point)
panel_4 = Panel(point_2)
param_viewer_2 = ParamViewer(point_2)
# rc
# rs
# Full multiplicity knots at start
# Simple knots
# Full multiplicity knots at end
# P1
# A=0.2*P1+ 0.8*P2
# D=0.2*A + 0.8*B
# P2
# B=0.47*P2 + 0.53*P3
# Full multiplicity knots at start
# E=0.7*B + 0.3*C
# P3
# Full multiplicity knots in the middle
# C=0.8*P3 + 0.2*P4
# P4
# Full multiplicity knots at end
# Compare knot spacing
param_viewer_3 = ParamViewer(point)
