# Grasshopper definition SetsList069.gh (Grasshopper 1.0.7)
# Copyright: Wickerson Studios

# 1001 GRASSHOPPER DEFINITIONS
# Wickerson Studio
# 
# created by: Michael Wickerson
# 
# Grasshopper for Rhino 3D Algorithmic Modeling
# 
# www.wickersonstudios.com
# www.michaelwickerson.com
# https://www.youtube.com/channel/UC7J48Ppcsa6oncp6d29R0xw
# https://github.com/mwickerson
# https://www.facebook.com/michael.wickerson
# https://www.linkedin.com/in/michael-wickerson-696a80156/
# https://www.grasshopper3d.com/profile/MichaelWickerson
image_sampler = ImageSampler(
    FilePath="C:\Users\Sculpture\Documents\2020Grasshopper\ScreenShots2019\Screenshots2020\SurfaceEditAlgorithm.PNG",
    Filter="Value",
    Interpolate=False,
    Umax=1,
    Umin=0,
    Vmax=1,
    Vmin=0,
    Wrap=1)
# RETURN TO THE BASICS 069/1001
# Wickerson Studio
# created by: Michael Wickerson
# Grasshopper for Rhino 3D Algorithmic Modeling
# www.wickersonstudios.com
# www.michaelwickerson.com
# https://www.youtube.com/channel/UC7J48Ppcsa6oncp6d29R0xw
# https://github.com/mwickerson
# https://www.facebook.com/michael.wickerson
# https://www.linkedin.com/in/michael-wickerson-696a80156/
# https://www.grasshopper3d.com/profile/MichaelWickerson
number_slider = Slider(10, range=0..100)
number_slider_2 = Slider(60, range=0..60)
construct_domain = ConstructDomain(DomainStart=0, DomainEnd=number_slider)
range = Range(Domain=construct_domain, Steps=number_slider_2)
jitter = Jitter(List=range, Jitter=Slider(0.74, range=0..1), Seed=2)  # -> Values, Indices
sphere = Sphere(Base=PlaneXY(0, 0, 0), Radius=jitter.Values)
cylinder = Cylinder(Base=PlaneXY(0, 0, 0), Radius=jitter.Values, Length=Slider(3, range=0..100))
construct_domain_2 = ConstructDomain(DomainStart=0, DomainEnd=Slider(100, range=0..100))
cap_holes = CapHoles(Brep=sphere)
range_2 = Range(Domain=construct_domain_2, Steps=number_slider_2)
construct_domain_3 = ConstructDomain(DomainStart=0, DomainEnd=Slider(1.68, range=0..2))
param_viewer = ParamViewer(cap_holes)
unit_x = UnitX(Factor=range_2)
jitter_2 = Jitter(List=unit_x, Jitter=Slider(0.05, range=0..1), Seed=2)  # -> Values, Indices
move = Move(Geometry=cap_holes, Motion=jitter_2.Values)  # -> Geometry, Transform
range_3 = Range(Domain=construct_domain_3, Steps=number_slider_2)
construct_point = ConstructPoint(XCoordinate=0, YCoordinate=0, ZCoordinate=0)
pi = Pi(Factor=range_3)
construct_domain_4 = ConstructDomain(DomainStart=0, DomainEnd=Slider(100, range=0..100))
param_viewer_2 = ParamViewer(move.Geometry)
jitter_3 = Jitter(List=pi, Jitter=Slider(0.13, range=0..1), Seed=2)  # -> Values, Indices
rotate_3d = Rotate3D(Geometry=move.Geometry, Angle=jitter_3.Values, Center=construct_point, Axis=Vector(0, 0, 1))  # -> Geometry, Transform
range_4 = Range(Domain=construct_domain_4, Steps=number_slider_2)
param_viewer_3 = ParamViewer(rotate_3d.Geometry)
unit_z = UnitZ(Factor=range_4)
construct_domain_5 = ConstructDomain(DomainStart=0, DomainEnd=Slider(2, range=0..2))
jitter_4 = Jitter(List=unit_z, Jitter=Slider(0.04, range=0..1), Seed=2)  # -> Values, Indices
move_2 = Move(Geometry=rotate_3d.Geometry, Motion=jitter_4.Values)  # -> Geometry, Transform
range_5 = Range(Domain=construct_domain_5, Steps=number_slider_2)
volume = Volume(Geometry=move_2.Geometry)  # -> Volume, Centroid
unit_x_2 = UnitX(Factor=1)
pi_2 = Pi(Factor=range_5)
line_sdl = LineSDL(Start=volume.Centroid, Direction=unit_x_2, Length=Slider(12, range=0..100))
jitter_5 = Jitter(List=pi_2, Jitter=Slider(0.96, range=0..1), Seed=2)  # -> Values, Indices
param_viewer_4 = ParamViewer(move_2.Geometry)
rotate_3d_2 = Rotate3D(Geometry=move_2.Geometry, Angle=jitter_5.Values, Center=volume.Centroid, Axis=line_sdl)  # -> Geometry, Transform
param_viewer_5 = ParamViewer(rotate_3d_2.Geometry)
polar_array = PolarArray(Geometry=rotate_3d_2.Geometry, Plane=PlaneXY(0, 0, 0), Count=Slider(3, range=0..10), Angle=6.283185307)  # -> Geometry, Transform
param_viewer_6 = ParamViewer(polar_array.Geometry)
# rc
# rs
# Full multiplicity knots at start
# Simple knots
# Full multiplicity knots at end
# P1
# A=0.2*P1+ 0.8*P2
# D=0.2*A + 0.8*B
# P2
# B=0.47*P2 + 0.53*P3
# Full multiplicity knots at start
# E=0.7*B + 0.3*C
# P3
# Full multiplicity knots in the middle
# C=0.8*P3 + 0.2*P4
# P4
# Full multiplicity knots at end
# Compare knot spacing
# GH solution
# VB
# C#
# Python with RhinoCommon Only
# Pythong with RhinoScriptSyntax
# GH solution
# VB
# C#
# Python
# VB
list_item = ListItem(List=polar_array.Geometry, Index=Slider(0, range=0..10), Wrap=True)
