# Grasshopper definition SetsList070.gh (Grasshopper 1.0.7)
# Copyright: Wickerson Studios
# plug-ins: Bifocals

# 1001 GRASSHOPPER DEFINITIONS
# Wickerson Studio
# 
# created by: Michael Wickerson
# 
# Grasshopper for Rhino 3D Algorithmic Modeling
# 
# www.wickersonstudios.com
# www.michaelwickerson.com
# https://www.youtube.com/channel/UC7J48Ppcsa6oncp6d29R0xw
# https://github.com/mwickerson
# https://www.facebook.com/michael.wickerson
# https://www.linkedin.com/in/michael-wickerson-696a80156/
# https://www.grasshopper3d.com/profile/MichaelWickerson
image_sampler = ImageSampler(
    FilePath="C:\Users\Sculpture\Documents\2020Grasshopper\ScreenShots2019\Screenshots2020\SurfaceEditAlgorithm.PNG",
    Filter="Value",
    Interpolate=False,
    Umax=1,
    Umin=0,
    Vmax=1,
    Vmin=0,
    Wrap=1)

# ----
# RETURN TO THE BASICS 070/1001
# Wickerson Studio
# created by: Michael Wickerson
# Grasshopper for Rhino 3D Algorithmic Modeling
# www.wickersonstudios.com
# www.michaelwickerson.com
# https://www.youtube.com/channel/UC7J48Ppcsa6oncp6d29R0xw
# https://github.com/mwickerson
# https://www.facebook.com/michael.wickerson
# https://www.linkedin.com/in/michael-wickerson-696a80156/
# https://www.grasshopper3d.com/profile/MichaelWickerson
number_slider = Slider(17, range=0..100)
construct_domain = ConstructDomain(DomainStart=0, DomainEnd=number_slider)
range = Range(Domain=construct_domain, Steps="2")
sine = Sine(Value=range)
graph_mapper = GraphMapper(
    sine,
    x0=0,
    x1=1,
    y0=0,
    y1=3,
    container_name="Sine",
    Equation_px=[0.2779993415, 0.7658162117],
    Equation_py=[0.1275115609, 0.7971754074])
construct_domain_2 = ConstructDomain(DomainStart=0, DomainEnd=Slider(10, range=0..100))
construct_point = ConstructPoint(XCoordinate=range, YCoordinate=0, ZCoordinate=graph_mapper)  # -> graft(Point)
range_2 = Range(Domain=construct_domain_2, Steps="2")
rotate_3d = Rotate3D(Geometry=construct_point, Angle=1.570796327, Center=Point(0, 0, 0), Axis=Vector(0, 0, 1))  # -> Geometry, Transform
unit_y = UnitY(Factor=range_2)
unit_x = UnitX(Factor=range_2)
move = Move(Geometry=construct_point, Motion=unit_y)  # -> Geometry, Transform
move_2 = Move(Geometry=rotate_3d.Geometry, Motion=unit_x)  # -> Geometry, Transform
flip_matrix = FlipMatrix(Data=move_2.Geometry)
flip_matrix_2 = FlipMatrix(Data=move.Geometry)
interpolate = Interpolate(Vertices=flip_matrix, Degree=3, Periodic=False, KnotStyle=1)  # -> flatten(Curve), Length, Domain
list_length = ListLength(List=interpolate.Curve)
interpolate_2 = Interpolate(Vertices=flip_matrix_2, Degree=3, Periodic=False, KnotStyle=1)  # -> flatten(Curve), Length, Domain
list_length_2 = ListLength(List=interpolate_2.Curve)
range_3 = Range(Domain=Slider(8, range=0..100), Steps=expr("x-1", list_length))
range_4 = Range(Domain=Slider(10, range=0..100), Steps=expr("x-1", list_length_2))
unit_z = UnitZ(Factor=range_3)
unit_z_2 = UnitZ(Factor=range_4)
jitter = Jitter(List=unit_z, Jitter=1, Seed=Slider(27, range=0..100))  # -> Values, Indices
jitter_2 = Jitter(List=unit_z_2, Jitter=1, Seed=Slider(100, range=0..100))  # -> Values, Indices
move_3 = Move(Geometry=interpolate_2.Curve, Motion=jitter_2.Values)  # -> Geometry, Transform
move_4 = Move(Geometry=interpolate.Curve, Motion=jitter.Values)  # -> Geometry, Transform
param_viewer = ParamViewer(interpolate_2.Curve)
panel = Panel(interpolate.Curve)
network_surface = NetworkSurface(CurvesU=move_3.Geometry, CurvesV=move_4.Geometry, Continuity=2)
number_slider_2 = Slider(6, range=0..100)
divide_domain² = DivideDomain²(Domain=network_surface, UCount=number_slider_2, VCount=number_slider_2)
isotrim = Isotrim(Surface=network_surface, Domain=divide_domain²)
area = Area(Geometry=isotrim)  # -> Area, Centroid
unit_z_3 = UnitZ(Factor=Slider(5, range=0..100))
extrude = Extrude(Base=network_surface, Direction=unit_z_3)
deconstruct_brep = DeconstructBrep(Brep=extrude)  # -> Faces, Edges, Vertices
volume = Volume(Geometry=extrude)  # -> Volume, Centroid
list_item = ListItem(List=deconstruct_brep.Faces, Index=Slider(5, range=0..10), Wrap=True)
divide_domain²_2 = DivideDomain²(Domain=list_item, UCount=number_slider_2, VCount=number_slider_2)
vector_2pt = Vector2Pt(PointA=volume.Centroid, PointB=area.Centroid, Unitize=False)  # -> Vector, Length
move_5 = Move(Geometry=area.Centroid, Motion=vector_2pt.Vector)  # -> Geometry, Transform
isotrim_2 = Isotrim(Surface=list_item, Domain=divide_domain²_2)
area_2 = Area(Geometry=isotrim_2)  # -> Area, Centroid
unit_z_4 = UnitZ(Factor=Slider(1, range=0..100))
extrude_2 = Extrude(Base=network_surface, Direction=unit_z_4)
volume_2 = Volume(Geometry=extrude_2)  # -> Volume, Centroid
# VB
# C#
# Python
# VB
vector_2pt_2 = Vector2Pt(PointA=volume_2.Centroid, PointB=area_2.Centroid, Unitize=False)  # -> Vector, Length
move_6 = Move(Geometry=area_2.Centroid, Motion=vector_2pt_2.Vector)  # -> Geometry, Transform
# GH solution
# VB
# C#
# Python with RhinoCommon Only
# Pythong with RhinoScriptSyntax
# GH solution
extrude_point = ExtrudePoint(Base=isotrim_2, Point=move_6.Geometry)
extrude_point_2 = ExtrudePoint(Base=isotrim, Point=move_5.Geometry)
# rc
# rs
# Full multiplicity knots at start
# Simple knots
# Full multiplicity knots at end
# P1
# A=0.2*P1+ 0.8*P2
# D=0.2*A + 0.8*B
# P2
# B=0.47*P2 + 0.53*P3
# Full multiplicity knots at start
# E=0.7*B + 0.3*C
# P3
# Full multiplicity knots in the middle
# C=0.8*P3 + 0.2*P4
# P4
# Full multiplicity knots at end
# Compare knot spacing
geometry = Geometry(extrude)
