# Grasshopper definition SetsList071.gh (Grasshopper 1.0.7)
# Copyright: Wickerson Studios
# plug-ins: Bifocals

image_sampler = ImageSampler(
    FilePath="C:\Users\Sculpture\Documents\2020Grasshopper\ScreenShots2019\Screenshots2020\SurfaceEditAlgorithm.PNG",
    Filter="Value",
    Interpolate=False,
    Umax=1,
    Umin=0,
    Vmax=1,
    Vmin=0,
    Wrap=1)

# ----
# Wickerson Studio
# created by: Michael Wickerson
# Grasshopper for Rhino 3D Algorithmic Modeling
# www.wickersonstudios.com
# www.michaelwickerson.com
# https://www.youtube.com/channel/UC7J48Ppcsa6oncp6d29R0xw
# https://github.com/mwickerson
# https://www.facebook.com/michael.wickerson
# https://www.linkedin.com/in/michael-wickerson-696a80156/
# https://www.grasshopper3d.com/profile/MichaelWickerson
number_slider = Slider(10, range=0..10)
number_slider_2 = Slider(7.39, range=0..10)
number_slider_3 = Slider(7.618, range=0..10)
# RETURN TO THE BASICS 071/1001
plane = Plane(PlaneXY(0, 0, 0))
rectangular = Rectangular(Plane=plane, SizeX=number_slider, SizeY=Slider(10, range=0..10), ExtentX=number_slider_2, ExtentY=number_slider_3)  # -> Cells, Points
hexagonal = Hexagonal(Plane=PlaneXY(0, 0, 0), Size=number_slider, ExtentX=number_slider_2, ExtentY=number_slider_3)  # -> Cells, Points
radial = Radial(Plane=PlaneXY(0, 0, 0), Size=number_slider, ExtentR=number_slider_2, ExtentP=number_slider_3)  # -> Cells, Points
# 1001 GRASSHOPPER DEFINITIONS
# Wickerson Studio
# 
# created by: Michael Wickerson
# 
# Grasshopper for Rhino 3D Algorithmic Modeling
# 
# www.wickersonstudios.com
# www.michaelwickerson.com
# https://www.youtube.com/channel/UC7J48Ppcsa6oncp6d29R0xw
# https://github.com/mwickerson
# https://www.facebook.com/michael.wickerson
# https://www.linkedin.com/in/michael-wickerson-696a80156/
# https://www.grasshopper3d.com/profile/MichaelWickerson
triangular = Triangular(Plane=PlaneXY(0, 0, 0), Size=number_slider, ExtentX=number_slider_2, ExtentY=number_slider_3)  # -> Cells, Points
number_slider_4 = Slider(22, range=0..100)
curve = Curve(triangular.Cells)
point = Point(triangular.Points)
list_length = ListLength(List=point)
construct_domain = ConstructDomain(DomainStart=0, DomainEnd=number_slider_4)
construct_domain_2 = ConstructDomain(DomainStart=0, DomainEnd=number_slider_4)
panel = Panel(curve)
range = Range(Domain=construct_domain, Steps=expr("x-1", list_length))
range_2 = Range(Domain=construct_domain_2, Steps=expr("x-1", list_length))
param_viewer = ParamViewer(point)
flip_matrix = FlipMatrix(Data=point)
unit_z = UnitZ(Factor=range_2)
unit_z_2 = UnitZ(Factor=range)
jitter = Jitter(List=unit_z, Jitter=1, Seed=2)  # -> Values, Indices
jitter_2 = Jitter(List=unit_z_2, Jitter=1, Seed=2)  # -> Values, Indices
negative = Negative(Value=jitter.Values)
move = Move(Geometry=point, Motion=jitter_2.Values)  # -> Geometry, Transform
move_2 = Move(Geometry=flip_matrix, Motion=negative)  # -> Geometry, Transform
interpolate = Interpolate(Vertices=move.Geometry, Degree=3, Periodic=False, KnotStyle=1)  # -> flatten(Curve), Length, Domain
interpolate_2 = Interpolate(Vertices=move_2.Geometry, Degree=3, Periodic=False, KnotStyle=1)  # -> flatten(Curve), Length, Domain
loft = Loft(
    Curves=interpolate.Curve,
    Options={Adjust=False, Closed=False, LoftEnds=0, LoftSimp=0, LoftType=0, Rebuild=10, Refit=0.01})
loft_2 = Loft(
    Curves=interpolate_2.Curve,
    Options={Adjust=False, Closed=False, LoftEnds=0, LoftSimp=0, LoftType=0, Rebuild=10, Refit=0.01})
deconstruct_brep = DeconstructBrep(Brep=loft)  # -> Faces, flatten(Edges), Vertices
deconstruct_brep_2 = DeconstructBrep(Brep=loft_2)  # -> Faces, flatten(Edges), Vertices
list_item = ListItem(List=deconstruct_brep.Edges, Index=0, Wrap=True)  # -> Item, Item1, Item2, Item3
list_item_2 = ListItem(List=deconstruct_brep_2.Edges, Index=0, Wrap=True)  # -> Item, Item1, Item2, Item3
flip_curve = FlipCurve(Curve=list_item.Item)  # -> Curve, Flag
flip_curve_2 = FlipCurve(Curve=list_item.Item1)  # -> Curve, Flag
flip_curve_3 = FlipCurve(Curve=list_item.Item2)  # -> Curve, Flag
flip_curve_4 = FlipCurve(Curve=list_item.Item3)  # -> Curve, Flag
loft_3 = Loft(
    Curves=[flip_curve.Curve, list_item_2.Item3],
    Options={Adjust=True, Closed=False, LoftEnds=0, LoftSimp=0, LoftType=0, Rebuild=10, Refit=0.01})
loft_4 = Loft(
    Curves=[flip_curve_2.Curve, list_item_2.Item2],
    Options={Adjust=True, Closed=False, LoftEnds=0, LoftSimp=0, LoftType=0, Rebuild=10, Refit=0.01})
loft_5 = Loft(
    Curves=[list_item.Item2, list_item_2.Item1],
    Options={Adjust=True, Closed=False, LoftEnds=0, LoftSimp=0, LoftType=0, Rebuild=10, Refit=0.01})
loft_6 = Loft(
    Curves=[flip_curve_4.Curve, list_item_2.Item],
    Options={Adjust=True, Closed=False, LoftEnds=0, LoftSimp=0, LoftType=0, Rebuild=10, Refit=0.01})
# rc
# rs
# Full multiplicity knots at start
# Simple knots
# Full multiplicity knots at end
# P1
# A=0.2*P1+ 0.8*P2
# D=0.2*A + 0.8*B
# P2
# B=0.47*P2 + 0.53*P3
# Full multiplicity knots at start
# E=0.7*B + 0.3*C
# P3
# Full multiplicity knots in the middle
# C=0.8*P3 + 0.2*P4
# P4
# Full multiplicity knots at end
# Compare knot spacing
# GH solution
# VB
# C#
# Python with RhinoCommon Only
# Pythong with RhinoScriptSyntax
# GH solution
# VB
# C#
# Python
# VB
surface = Surface(loft_2)
surface_2 = Surface(loft)
