# Grasshopper definition SetsList072.gh (Grasshopper 1.0.7)
# Copyright: Wickerson Studios
# plug-ins: Bifocals

image_sampler = ImageSampler(
    FilePath="C:\Users\Sculpture\Documents\2020Grasshopper\ScreenShots2019\Screenshots2020\SurfaceEditAlgorithm.PNG",
    Filter="Value",
    Interpolate=False,
    Umax=1,
    Umin=0,
    Vmax=1,
    Vmin=0,
    Wrap=1)

# ----
# Optional Gene Pool
# for Dispatch Pattern
gene_pool = GenePool(
    Decimals=0,
    Maximum=1,
    Minimum=0,
    Value=[0.04290850695, 0.9898891849, 0.6828581149, 0.5724806337, 0.2219707213, 0.8742685601, 0.9894216089, 0.7192833688, 0.2905124292, 0.1133561479])

# ----
# Wickerson Studio
# created by: Michael Wickerson
# Grasshopper for Rhino 3D Algorithmic Modeling
# www.wickersonstudios.com
# www.michaelwickerson.com
# https://www.youtube.com/channel/UC7J48Ppcsa6oncp6d29R0xw
# https://github.com/mwickerson
# https://www.facebook.com/michael.wickerson
# https://www.linkedin.com/in/michael-wickerson-696a80156/
# https://www.grasshopper3d.com/profile/MichaelWickerson
# Parameters to Play with!
number_slider = Slider(15, range=0..100)
xz_plane = XZPlane(Origin=Point(0, 0, 0))
# 1001 GRASSHOPPER DEFINITIONS
# Wickerson Studio
# 
# created by: Michael Wickerson
# 
# Grasshopper for Rhino 3D Algorithmic Modeling
# 
# www.wickersonstudios.com
# www.michaelwickerson.com
# https://www.youtube.com/channel/UC7J48Ppcsa6oncp6d29R0xw
# https://github.com/mwickerson
# https://www.facebook.com/michael.wickerson
# https://www.linkedin.com/in/michael-wickerson-696a80156/
# https://www.grasshopper3d.com/profile/MichaelWickerson
# RETURN TO THE BASICS 072/1001
xy_plane = XYPlane(Origin=Point(0, 0, 0))
yz_plane = YZPlane(Origin=Point(0, 0, 0))
ellipse = Ellipse(Plane=xz_plane, Radius1=1, Radius2=1)  # -> Ellipse, Focus1, Focus2
rectangle = Rectangle(Plane=yz_plane, XSize=Domain(-1, 1), YSize=Domain(-2, 2), Radius=0)  # -> Rectangle, Length
circle = Circle(Plane=xy_plane, Radius=1)
gene_pool_2 = GenePool(
    Decimals=0,
    Maximum=1,
    Minimum=0,
    Value=[0.7990924352, 0.02413889068, 0.4341624898, 0.9827744709, 0.06047093126, 0.6704583311, 0.5270109081, 0.2372891545, 0.8100134282, 0.6010166046, 0.01685250505, 0.5705936978, 0.05661994641, 0.9017565459, 0.6164741831, 0.7945774788, 0.7574947238, 0.9565391359, 0.3513677122, 0.7096803741, 0.752452894, 0.9178452417, 0.425889319, 0.8923323606, 0.3973289036, 0.3999651705, 0.9784549069, 0.5966155229, 0.04388343452, 0.03868078535])
divide_curve = DivideCurve(Curve=rectangle.Rectangle, Count=number_slider, Kinks=False)  # -> Points, Tangents, Parameters
divide_curve_2 = DivideCurve(Curve=ellipse.Ellipse, Count=number_slider, Kinks=False)  # -> Points, Tangents, Parameters
divide_curve_3 = DivideCurve(Curve=circle, Count=number_slider, Kinks=False)  # -> Points, Tangents, Parameters
dispatch = Dispatch(List=divide_curve_3.Points, DispatchPattern=gene_pool_2)  # -> ListA, ListB
sift_pattern = SiftPattern(List=divide_curve_2.Points, SiftPattern=gene_pool_2)  # -> Output0, Output1
cull_pattern = CullPattern(List=divide_curve.Points, CullPattern=gene_pool_2)
interpolate = Interpolate(Vertices=[dispatch.ListA, sift_pattern.Output0, cull_pattern], Degree=3, Periodic=False, KnotStyle=1)  # -> Curve, Length, Domain
combine_data = CombineData()  # -> Result, Index
pipe = Pipe(Curve=interpolate.Curve, Radius=Slider(0.12, range=0..1), Caps=2)
uv_point_count = Slider(18, range=0..500)
optional_seed_for_jitter_node = Slider(100, range=0..100)
width = Slider(10, range=0..10)
height_map = Slider(5, range=0..5)
thickness_of_zinc = Slider(0.86, range=0..10)
rectangle_2 = Rectangle(Plane=PlaneXY(0, 0, 0), XSize=uv_point_count, YSize=width, Radius=0)  # -> Rectangle, Length
divide_surface = DivideSurface(Surface=rectangle_2.Rectangle, UCount=uv_point_count, VCount=uv_point_count)  # -> flatten(Points), Normals, Parameters
construct_domain = ConstructDomain(DomainStart=0, DomainEnd=height_map)
dispatch_2 = Dispatch(List=divide_surface.Points, DispatchPattern=gene_pool)  # -> ListA, ListB
surface_from_points = SurfaceFromPoints(Points=divide_surface.Points, UCount=expr("x+1", uv_point_count), Interpolate=False)
list_length = ListLength(List=dispatch_2.ListA)  # -> flatten(Length)
range = Range(Domain=construct_domain, Steps=expr("x-1", list_length))
unit_z = UnitZ(Factor=range)
number_slider_2 = Slider(12, range=0..100)
construct_point = ConstructPoint(XCoordinate=0, YCoordinate=0, ZCoordinate=0)

# ----
# Optional Jitter
# Node for
# SEED
jitter = Jitter(List=unit_z, Jitter=Slider(0.4, range=0..1), Seed=optional_seed_for_jitter_node)  # -> Values, Indices

point_deform = PointDeform(Geometry=surface_from_points, Points=dispatch_2.ListA, Motion=jitter.Values)
scale = Scale(Geometry=point_deform, Center=Point(0, 0, 0), Factor=Slider(6, range=0..20))  # -> Geometry, Transform
divide_domain² = DivideDomain²(Domain=scale.Geometry, UCount=number_slider_2, VCount=number_slider_2)
isotrim = Isotrim(Surface=scale.Geometry, Domain=divide_domain²)
# Python
# VB
area = Area(Geometry=isotrim)  # -> Area, Centroid
# rc
# rs
# Full multiplicity knots at start
# Simple knots
# Full multiplicity knots at end
# P1
# A=0.2*P1+ 0.8*P2
# D=0.2*A + 0.8*B
# P2
# B=0.47*P2 + 0.53*P3
# Full multiplicity knots at start
# E=0.7*B + 0.3*C
# P3
# Full multiplicity knots in the middle
# C=0.8*P3 + 0.2*P4
# P4
# Full multiplicity knots at end
# Compare knot spacing
# GH solution
# VB
# C#
# Python with RhinoCommon Only
# Pythong with RhinoScriptSyntax
# GH solution
# VB
# C#
orient = Orient(Geometry=pipe, Source=construct_point, Target=area.Centroid)  # -> Geometry, Transform
