# Grasshopper definition SetsList074.gh (Grasshopper 1.0.7)
# Copyright: Wickerson Studios
# plug-ins: Bifocals

# 1001 GRASSHOPPER DEFINITIONS
# Wickerson Studio
# 
# created by: Michael Wickerson
# 
# Grasshopper for Rhino 3D Algorithmic Modeling
# 
# www.wickersonstudios.com
# www.michaelwickerson.com
# https://www.youtube.com/channel/UC7J48Ppcsa6oncp6d29R0xw
# https://github.com/mwickerson
# https://www.facebook.com/michael.wickerson
# https://www.linkedin.com/in/michael-wickerson-696a80156/
# https://www.grasshopper3d.com/profile/MichaelWickerson
image_sampler = ImageSampler(
    FilePath="C:\Users\Sculpture\Documents\2020Grasshopper\ScreenShots2019\Screenshots2020\SurfaceEditAlgorithm.PNG",
    Filter="Value",
    Interpolate=False,
    Umax=1,
    Umin=0,
    Vmax=1,
    Vmin=0,
    Wrap=1)
# Wickerson Studio
# created by: Michael Wickerson
# Grasshopper for Rhino 3D Algorithmic Modeling
# www.wickersonstudios.com
# www.michaelwickerson.com
# https://www.youtube.com/channel/UC7J48Ppcsa6oncp6d29R0xw
# https://github.com/mwickerson
# https://www.facebook.com/michael.wickerson
# https://www.linkedin.com/in/michael-wickerson-696a80156/
# https://www.grasshopper3d.com/profile/MichaelWickerson
geometry = Geometry(<mesh referenced from the Rhino model>)
xz_plane = XZPlane(Origin=Point(0, 0, 0))

number_slider = Slider(71, range=-80..71)
number_slider_2 = Slider(10, range=0..10)
# RETURN TO THE BASICS 074/1001
number_slider_3 = Slider(30, range=0..100)
radial = Radial(Plane=xz_plane, Size=Slider(11, range=0..100), ExtentR=number_slider_2, ExtentP=number_slider_2)  # -> Cells, Points
addition = Addition(A=number_slider, B=Slider(0, range=0..100))
vector_xyz = VectorXYZ(XComponent=number_slider_3, YComponent=number_slider_3, ZComponent=0)  # -> Vector, Length
curve = Curve(flatten(radial.Cells))
point = Point(flatten(radial.Points))
construct_point = ConstructPoint(XCoordinate=number_slider, YCoordinate=Slider(0, range=0..100), ZCoordinate=addition)
move = Move(Geometry=construct_point, Motion=vector_xyz.Vector)  # -> Geometry, Transform
closest_points = ClosestPoints(Point=construct_point, Cloud=point, Count=Slider(8, range=0..10))  # -> ClosestPoint, CPIndex, Distance
sphere = Sphere(Base=move.Geometry, Radius=Slider(8.44, range=0..10))
populate_geometry = PopulateGeometry(Geometry=sphere, Count=Slider(8, range=0..10), Seed=1)
gene_pool = GenePool(Decimals=2, Maximum=1, Minimum=0, Value=[0.350779955, 0.2573049302, 0.7076511219, 0.2143066056, 0.8643706673])
gene_pool_2 = GenePool(Decimals=2, Maximum=1, Minimum=0, Value=[0, 0.25, 0.5, 0.74, 1])
range = Range(Domain=Domain(0, 1), Steps=10)
line = Line(StartPoint=populate_geometry, EndPoint=closest_points.ClosestPoint)
point_on_curve = PointOnCurve(line, parameter=0.481)
graph_mapper = GraphMapper(
    range,
    x0=0,
    x1=1,
    y0=0,
    y1=1,
    container_name="Sine",
    Equation_px=[0, 0.2853986919],
    Equation_py=[0.197299242, 0.8014340401])
shift_list = ShiftList(List=point_on_curve, Shift=1, Wrap=True)
explode = Explode(Curve=curve, Recursive=True)  # -> Segments, Vertices
end_points = EndPoints(Curve=line)  # -> Start, End
vector_2pt = Vector2Pt(PointA=point_on_curve, PointB=shift_list, Unitize=False)  # -> Vector, Length
move_2 = Move(Geometry=point_on_curve, Motion=expr("-x", vector_2pt.Vector))  # -> Geometry, Transform
arc_3pt = Arc3Pt(PointA=end_points.Start, PointB=move_2.Geometry, PointC=end_points.End)  # -> Arc, Plane, Radius
pipe_variable = PipeVariable(Curve=reparameterize(graft(explode.Segments)), Parameters=range, Radii=graph_mapper, Caps=2)
pipe_variable_2 = PipeVariable(Curve=reparameterize(arc_3pt.Arc), Parameters=gene_pool_2, Radii=expr("x*3", gene_pool), Caps=2)
# rc
# rs
geometry_2 = Geometry(sphere)

number_slider_4 = Slider(10, range=0..10)
list_length = ListLength(List=closest_points.ClosestPoint)
orient = Orient(Geometry=geometry, Source=PlaneXY(0, 0, 0), Target=closest_points.ClosestPoint)  # -> Geometry, Transform
range_2 = Range(Domain=Slider(0, range=0..2), Steps=list_length)
pi = Pi(Factor=range_2)
# Full multiplicity knots at start
# Simple knots
# Full multiplicity knots at end
# P1
# A=0.2*P1+ 0.8*P2
# D=0.2*A + 0.8*B
# P2
# B=0.47*P2 + 0.53*P3
# Full multiplicity knots at start
# E=0.7*B + 0.3*C
# P3
# Full multiplicity knots in the middle
# C=0.8*P3 + 0.2*P4
# P4
# Full multiplicity knots at end
# Compare knot spacing
# GH solution
# VB
# C#
# Python with RhinoCommon Only
# Pythong with RhinoScriptSyntax
# GH solution
# VB
# C#
# Python
# VB
rotate = Rotate(Geometry=orient.Geometry, Angle=pi, Plane=PlaneXY(0, 0, 0))  # -> Geometry, Transform
