# Grasshopper definition SetsList075FindGibbles.gh (Grasshopper 1.0.7)
# Copyright: Wickerson Studios
# plug-ins: MeshEdit Components, Bifocals

# 1001 GRASSHOPPER DEFINITIONS
# Wickerson Studio
# 
# created by: Michael Wickerson
# 
# Grasshopper for Rhino 3D Algorithmic Modeling
# 
# www.wickersonstudios.com
# www.michaelwickerson.com
# https://www.youtube.com/channel/UC7J48Ppcsa6oncp6d29R0xw
# https://github.com/mwickerson
# https://www.facebook.com/michael.wickerson
# https://www.linkedin.com/in/michael-wickerson-696a80156/
# https://www.grasshopper3d.com/profile/MichaelWickerson
image_sampler = ImageSampler(
    FilePath="C:\Users\Sculpture\Documents\2020Grasshopper\ScreenShots2019\Screenshots2020\SurfaceEditAlgorithm.PNG",
    Filter="Value",
    Interpolate=False,
    Umax=1,
    Umin=0,
    Vmax=1,
    Vmin=0,
    Wrap=1)
# Wickerson Studio
# created by: Michael Wickerson
# Grasshopper for Rhino 3D Algorithmic Modeling
# www.wickersonstudios.com
# www.michaelwickerson.com
# https://www.youtube.com/channel/UC7J48Ppcsa6oncp6d29R0xw
# https://github.com/mwickerson
# https://www.facebook.com/michael.wickerson
# https://www.linkedin.com/in/michael-wickerson-696a80156/
# https://www.grasshopper3d.com/profile/MichaelWickerson
geometry = Geometry(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)

# ----
# RETURN TO THE BASICS 075/1001
uv_point_count = Slider(15, range=0..500)
optional_seed_for_jitter_node = Slider(25, range=0..100)
width = Slider(10, range=0..10)
height_map = Slider(1.18, range=0..2)
gene_pool = GenePool(
    Decimals=0,
    Maximum=1,
    Minimum=0,
    Value=[0.3155491442, 0.1201800998, 0.6541016277, 0.7992127043, 0.8653403404, 0.4632558061, 0.8534100991, 0.791429202, 0.1217518128, 0.07210340773])
rectangle = Rectangle(Plane=PlaneXY(0, 0, 0), XSize=uv_point_count, YSize=width, Radius=0)  # -> Rectangle, Length
divide_surface = DivideSurface(Surface=rectangle.Rectangle, UCount=uv_point_count, VCount=uv_point_count)  # -> flatten(Points), Normals, Parameters
construct_domain = ConstructDomain(DomainStart=0, DomainEnd=height_map)
thickness_of_zinc = Slider(4.81, range=0..10)
dispatch = Dispatch(List=divide_surface.Points, DispatchPattern=gene_pool)  # -> ListA, ListB
surface_from_points = SurfaceFromPoints(Points=divide_surface.Points, UCount=expr("x+1", uv_point_count), Interpolate=False)
list_length = ListLength(List=dispatch.ListA)  # -> flatten(Length)
range = Range(Domain=construct_domain, Steps=expr("x-1", list_length))
unit_z = UnitZ(Factor=range)
unit_z_2 = UnitZ(Factor=thickness_of_zinc)
jitter = Jitter(List=unit_z, Jitter=1, Seed=optional_seed_for_jitter_node)  # -> Values, Indices
number_slider = Slider(14, range=0..20)
point_deform = PointDeform(Geometry=surface_from_points, Points=dispatch.ListA, Motion=jitter.Values)
area = Area(Geometry=point_deform)  # -> Area, Centroid
number_slider_2 = Slider(6, range=0..100)
scale = Scale(Geometry=point_deform, Center=area.Centroid, Factor=number_slider)  # -> Geometry, Transform
divide_domain² = DivideDomain²(Domain=scale.Geometry, UCount=number_slider_2, VCount=number_slider_2)
isotrim = Isotrim(Surface=scale.Geometry, Domain=divide_domain²)
construct_domain_2 = ConstructDomain(DomainStart=Slider(0, range=0..100), DomainEnd=Slider(3, range=0..100))
area_2 = Area(Geometry=isotrim)  # -> Area, Centroid
construct_point = ConstructPoint(XCoordinate=0, YCoordinate=0, ZCoordinate=0)
jitter_2 = Jitter(List=area_2.Centroid, Jitter=Slider(0.28, range=0..1), Seed=2)  # -> Values, Indices
sub_list = SubList(List=jitter_2.Values, Domain=construct_domain_2, Wrap=True)  # -> List, Index
cull_index = CullIndex(List=sub_list.List, Indices=Slider(0, range=0..100), Wrap=True)
orient = Orient(Geometry=geometry, Source=construct_point, Target=cull_index)  # -> flatten(Geometry), Transform
list_length_2 = ListLength(List=orient.Geometry)
range_2 = Range(Domain=Slider(0.58, range=0..2), Steps=expr("x-1", list_length_2))
panel = Panel(sub_list.List)
mesh_area = MeshArea(Mesh=orient.Geometry)  # -> Area, Centroid
pi = Pi(Factor=range_2)
# Full multiplicity knots in the middle
# Full multiplicity knots at end
# Compare knot spacing
# GH solution
# VB
# C#
# Python with RhinoCommon Only
# Pythong with RhinoScriptSyntax
# GH solution
# VB
# C#
# Python
# VB
rotate_3d = Rotate3D(Geometry=orient.Geometry, Angle=pi, Center=mesh_area.Centroid, Axis=Vector(0, 0, 1))  # -> Geometry, Transform

extrude = Extrude(Base=point_deform, Direction=unit_z_2)

# ----
# rc
# rs
# Full multiplicity knots at start
# Simple knots
# Full multiplicity knots at end
# P1
# A=0.2*P1+ 0.8*P2
# D=0.2*A + 0.8*B
# P2
# B=0.47*P2 + 0.53*P3
# Full multiplicity knots at start
# E=0.7*B + 0.3*C
# P3
# C=0.8*P3 + 0.2*P4
# P4
scale_2 = Scale(Geometry=extrude, Center=area.Centroid, Factor=number_slider)  # -> Geometry, Transform
