# Grasshopper definition SetsList076.gh (Grasshopper 1.0.7)
# Copyright: Wickerson Studios
# plug-ins: Bifocals

# 1001 GRASSHOPPER DEFINITIONS
# Wickerson Studio
# 
# created by: Michael Wickerson
# 
# Grasshopper for Rhino 3D Algorithmic Modeling
# 
# www.wickersonstudios.com
# www.michaelwickerson.com
# https://www.youtube.com/channel/UC7J48Ppcsa6oncp6d29R0xw
# https://github.com/mwickerson
# https://www.facebook.com/michael.wickerson
# https://www.linkedin.com/in/michael-wickerson-696a80156/
# https://www.grasshopper3d.com/profile/MichaelWickerson
image_sampler = ImageSampler(
    FilePath="C:\Users\Sculpture\Documents\2020Grasshopper\ScreenShots2019\Screenshots2020\SurfaceEditAlgorithm.PNG",
    Filter="Value",
    Interpolate=False,
    Umax=1,
    Umin=0,
    Vmax=1,
    Vmin=0,
    Wrap=1)
# Wickerson Studio
# created by: Michael Wickerson
# Grasshopper for Rhino 3D Algorithmic Modeling
# www.wickersonstudios.com
# www.michaelwickerson.com
# https://www.youtube.com/channel/UC7J48Ppcsa6oncp6d29R0xw
# https://github.com/mwickerson
# https://www.facebook.com/michael.wickerson
# https://www.linkedin.com/in/michael-wickerson-696a80156/
# https://www.grasshopper3d.com/profile/MichaelWickerson
geometry = Geometry(<brep referenced from the Rhino model>)
# RETURN TO THE BASICS 076/1001
surface = Surface(<surface referenced from the Rhino model>)
sphere = Sphere(Base=PlaneXY(0, 0, 0), Radius=Slider(6, range=0..100))
offset_surface = OffsetSurface(Surface=surface, Distance=Slider(0.9, range=0..1), Retrim=True)
populate_3d = Populate3D(Region=sphere, Count=Slider(31, range=0..100), Seed=1)
construct_point = ConstructPoint(XCoordinate=0, YCoordinate=0, ZCoordinate=0)
vector_2pt = Vector2Pt(PointA=construct_point, PointB=populate_3d, Unitize=False)  # -> Vector, Length
plane_normal = PlaneNormal(Origin=construct_point, ZAxis=vector_2pt.Vector)
brep_plane = BrepPlane(Brep=offset_surface, Plane=plane_normal)  # -> Curves, Points
panel = Panel(brep_plane.Curves)
surface_split = SurfaceSplit(Surface=surface, Curves=flatten(brep_plane.Curves))
offset_on_srf = OffsetOnSrf(Curve=brep_plane.Curves, Distance=Slider(0.9, range=0..1), Surface=offset_surface)
brep_wireframe = BrepWireframe(Brep=surface_split, Density=-1)
weave = Weave(Pattern=[0, 1], Stream0=graft(brep_plane.Curves), Stream1=offset_on_srf, NullGaps=False)
panel_2 = Panel(weave)
join_curves = JoinCurves(Curves=brep_wireframe, Preserve=False)
loft = Loft(Curves=weave, Options={Adjust=False, Closed=False, LoftEnds=0, LoftSimp=0, LoftType=0, Rebuild=10, Refit=0.01})
divide_curve = DivideCurve(Curve=join_curves, Count=10, Kinks=False)  # -> Points, Tangents, Parameters
offset_surface_2 = OffsetSurface(Surface=loft, Distance=Slider(0.9, range=0..1), Retrim=True)
average = Average(Input=divide_curve.Points)
brep_wireframe_2 = BrepWireframe(Brep=loft, Density=-1)
brep_wireframe_3 = BrepWireframe(Brep=offset_surface_2, Density=-1)
deconstruct = Deconstruct(Point=average)  # -> XComponent, YComponent, ZComponent
weave_2 = Weave(Pattern=[0, 1], Stream0=graft(brep_wireframe_2), Stream1=graft(brep_wireframe_3), NullGaps=False)
larger_than = LargerThan(FirstNumber=deconstruct.ZComponent, SecondNumber=Slider(10.678, range=0..100))  # -> LargerThan, OrEqualTo
loft_2 = Loft(Curves=weave_2, Options={Adjust=False, Closed=False, LoftEnds=0, LoftSimp=0, LoftType=0, Rebuild=10, Refit=0.01})
geometry_2 = Geometry(loft_2)
shift_paths = ShiftPaths(Data=loft_2, Offset=-1)
weave_3 = Weave(Pattern=[0, 1], Stream0=shift_paths, Stream1=offset_surface_2, NullGaps=False)
brep_join = BrepJoin(Breps=weave_3)  # -> Breps, Closed
# Compare knot spacing
# GH solution
# VB
# C#
# Python with RhinoCommon Only
# Pythong with RhinoScriptSyntax
# GH solution
# VB
# C#
# Python
# VB
cull_pattern = CullPattern(List=surface_split, CullPattern=flatten(larger_than.LargerThan))
# rc
# rs
# Full multiplicity knots at start
# Simple knots
# Full multiplicity knots at end
# P1
# A=0.2*P1+ 0.8*P2
# D=0.2*A + 0.8*B
# P2
# B=0.47*P2 + 0.53*P3
# Full multiplicity knots at start
# E=0.7*B + 0.3*C
# P3
# Full multiplicity knots in the middle
# C=0.8*P3 + 0.2*P4
# P4
# Full multiplicity knots at end
panel_3 = Panel(shift_paths)
