# Grasshopper definition SetsList076d.gh (Grasshopper 1.0.7)
# Copyright: Wickerson Studios
# plug-ins: MeshEdit Components, Bifocals

image_sampler = ImageSampler(
    FilePath="C:\Users\Sculpture\Documents\2020Grasshopper\ScreenShots2019\Screenshots2020\SurfaceEditAlgorithm.PNG",
    Filter="Value",
    Interpolate=False,
    Umax=1,
    Umin=0,
    Vmax=1,
    Vmin=0,
    Wrap=1)
# Wickerson Studio
# created by: Michael Wickerson
# Grasshopper for Rhino 3D Algorithmic Modeling
# www.wickersonstudios.com
# www.michaelwickerson.com
# https://www.youtube.com/channel/UC7J48Ppcsa6oncp6d29R0xw
# https://github.com/mwickerson
# https://www.facebook.com/michael.wickerson
# https://www.linkedin.com/in/michael-wickerson-696a80156/
# https://www.grasshopper3d.com/profile/MichaelWickerson
geometry = Geometry(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)
# 1001 GRASSHOPPER DEFINITIONS
# Wickerson Studio
# 
# created by: Michael Wickerson
# 
# Grasshopper for Rhino 3D Algorithmic Modeling
# 
# www.wickersonstudios.com
# www.michaelwickerson.com
# https://www.youtube.com/channel/UC7J48Ppcsa6oncp6d29R0xw
# https://github.com/mwickerson
# https://www.facebook.com/michael.wickerson
# https://www.linkedin.com/in/michael-wickerson-696a80156/
# https://www.grasshopper3d.com/profile/MichaelWickerson
# RETURN TO THE BASICS 076/1001
number_slider = Slider(50, range=40..50)

addition = Addition(A=number_slider, B=1)
number_slider_2 = Slider(6, range=0..10)
construct_domain = ConstructDomain(DomainStart=number_slider, DomainEnd=Slider(8, range=0..10))
construct_domain_2 = ConstructDomain(DomainStart=number_slider, DomainEnd=addition)
range = Range(Domain=construct_domain_2, Steps=number_slider_2)
range_2 = Range(Domain=construct_domain, Steps=number_slider_2)
create_set = CreateSet(List=range)  # -> Set, Map
create_set_2 = CreateSet(List=range_2)  # -> Set, Map
set_difference = SetDifference(SetA=create_set_2.Set, SetB=create_set.Set)
set_difference_2 = SetDifference(SetA=create_set_2.Set, SetB=create_set.Set)
number_slider_3 = Slider(70, range=0..70)
number_slider_4 = Slider(16, range=0..100)
cosine = Cosine(Value=set_difference)
sine = Sine(Value=set_difference)
sine_2 = Sine(Value=set_difference_2)
cosine_2 = Cosine(Value=set_difference_2)
multiplication = Multiplication(A=number_slider_3, B=cosine)
multiplication_2 = Multiplication(A=number_slider_3, B=sine)
multiplication_3 = Multiplication(A=number_slider_4, B=sine_2)
multiplication_4 = Multiplication(A=number_slider_4, B=cosine_2)
construct_point = ConstructPoint(XCoordinate=set_difference_2, YCoordinate=multiplication_3, ZCoordinate=multiplication_4)
construct_point_2 = ConstructPoint(XCoordinate=set_difference, YCoordinate=multiplication_2, ZCoordinate=multiplication)
nurbs_curve = NurbsCurve(Vertices=construct_point_2, Degree=3, Periodic=False)  # -> Curve, Length, Domain
nurbs_curve_2 = NurbsCurve(Vertices=construct_point, Degree=3, Periodic=False)  # -> Curve, Length, Domain
loft = Loft(
    Curves=[nurbs_curve.Curve, nurbs_curve_2.Curve],
    Options={Adjust=False, Closed=False, LoftEnds=0, LoftSimp=0, LoftType=0, Rebuild=10, Refit=0.01})
number_slider_5 = Slider(20, range=0..20)
surface = Surface(loft)
divide_surface = DivideSurface(Surface=surface, UCount=number_slider_5, VCount=number_slider_5)  # -> Points, Normals, Parameters
amplitude = Amplitude(Vector=divide_surface.Normals, Amplitude=Slider(32, range=0.001..32))
move = Move(Geometry=divide_surface.Points, Motion=amplitude)  # -> flatten(Geometry), Transform
vector_display = VectorDisplay(Anchor=divide_surface.Points, Vector=divide_surface.Normals)
expression = Expression(x=number_slider_5, Expression="x+1")
surface_from_points = SurfaceFromPoints(Points=move.Geometry, UCount=expression, Interpolate=False)
mesh_frompoints = MeshFromPoints(Points=move.Geometry, UDirection=expression, VDirection=expression)
deconstruct_brep = DeconstructBrep(Brep=surface_from_points)  # -> Faces, graft(Edges), Vertices
deconstruct_brep_2 = DeconstructBrep(Brep=surface)  # -> Faces, graft(Edges), Vertices
loft_2 = Loft(
    Curves=[deconstruct_brep.Edges, deconstruct_brep_2.Edges],
    Options={Adjust=False, Closed=False, LoftEnds=0, LoftSimp=0, LoftType=0, Rebuild=10, Refit=0.01})  # -> flatten(Loft)
merge = Merge(Data1=surface_from_points, Data2=loft_2, Data3=surface)
brep_join = BrepJoin(Breps=merge)  # -> flatten(Breps), Closed
dispatch = Dispatch(List=brep_join.Breps, DispatchPattern=[True, False])  # -> ListA, ListB
brep = Brep(dispatch.ListA)
brep_2 = Brep(dispatch.ListB)
deconstruct_brep_3 = DeconstructBrep(Brep=brep)  # -> Faces, Edges, Vertices
deconstruct_brep_4 = DeconstructBrep(Brep=brep_2)  # -> Faces, Edges, Vertices
number_slider_6 = Slider(29, range=0..100)
number_slider_7 = Slider(11, range=0..20)
curve = Curve(graft(deconstruct_brep_4.Edges))
curve_2 = Curve(graft(deconstruct_brep_3.Edges))
loft_3 = Loft(
    Curves=[curve_2, curve],
    Options={Adjust=False, Closed=False, LoftEnds=0, LoftSimp=0, LoftType=0, Rebuild=10, Refit=0.01})
range_3 = Range(Domain=number_slider_7, Steps=number_slider_6)
merge_2 = Merge(Data1=brep, Data2=brep_2, Data3=loft_3)  # -> flatten(Result)
unit_x = UnitX(Factor=range_3)
range_4 = Range(Domain=Slider(2, range=0..2), Steps=number_slider_6)
panel = Panel(merge_2)
brep_join_2 = BrepJoin(Breps=merge_2)  # -> Breps, Closed
multiplication_5 = Multiplication(A=unit_x, B=number_slider_7)
move_2 = Move(Geometry=brep_join_2.Breps, Motion=multiplication_5)  # -> Geometry, Transform
pi = Pi(Factor=range_4)
rotate_3d = Rotate3D(Geometry=move_2.Geometry, Angle=pi, Center=Point(0, 0, 0), Axis=Vector(0, 0, 1))  # -> Geometry, Transform
volume = Volume(Geometry=rotate_3d.Geometry)  # -> Volume, Centroid
rotate_3d_2 = Rotate3D(Geometry=rotate_3d.Geometry, Angle=pi, Center=volume.Centroid, Axis=Vector(0, 0, 1))  # -> flatten(Geometry), Transform

# ----
# rc
# rs
# Full multiplicity knots at start
# Simple knots
# Full multiplicity knots at end
# P1
# A=0.2*P1+ 0.8*P2
# D=0.2*A + 0.8*B
# P2
# B=0.47*P2 + 0.53*P3
# Full multiplicity knots at start
# E=0.7*B + 0.3*C
# P3
# Full multiplicity knots in the middle
# C=0.8*P3 + 0.2*P4
# P4
# Full multiplicity knots at end
# Compare knot spacing
# GH solution
# VB
# C#
# Python with RhinoCommon Only
# Pythong with RhinoScriptSyntax
# GH solution
# VB
# C#
# Python
# VB
solid_union = SolidUnion(Breps=rotate_3d_2.Geometry)  # disabled
