# Grasshopper definition SetsList077.gh (Grasshopper 1.0.7)
# Copyright: Wickerson Studios
# plug-ins: Bifocals

# 1001 GRASSHOPPER DEFINITIONS
# Wickerson Studio
# 
# created by: Michael Wickerson
# 
# Grasshopper for Rhino 3D Algorithmic Modeling
# 
# www.wickersonstudios.com
# www.michaelwickerson.com
# https://www.youtube.com/channel/UC7J48Ppcsa6oncp6d29R0xw
# https://github.com/mwickerson
# https://www.facebook.com/michael.wickerson
# https://www.linkedin.com/in/michael-wickerson-696a80156/
# https://www.grasshopper3d.com/profile/MichaelWickerson
image_sampler = ImageSampler(
    FilePath="C:\Users\Sculpture\Documents\2020Grasshopper\ScreenShots2019\Screenshots2020\SurfaceEditAlgorithm.PNG",
    Filter="Value",
    Interpolate=False,
    Umax=1,
    Umin=0,
    Vmax=1,
    Vmin=0,
    Wrap=1)
# Wickerson Studio
# created by: Michael Wickerson
# Grasshopper for Rhino 3D Algorithmic Modeling
# www.wickersonstudios.com
# www.michaelwickerson.com
# https://www.youtube.com/channel/UC7J48Ppcsa6oncp6d29R0xw
# https://github.com/mwickerson
# https://www.facebook.com/michael.wickerson
# https://www.linkedin.com/in/michael-wickerson-696a80156/
# https://www.grasshopper3d.com/profile/MichaelWickerson
geometry = Geometry(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)

number_slider = Slider(10, range=0..10)
# RETURN TO THE BASICS 077/1001
number_slider_2 = Slider(0.387, range=0..3)
ghpython_script = GhPythonScript(a=number_slider)  # -> out, a; inputs a: Int32
# ---------- ghpython_script: Python ----------
__author__ = "Sculpture"
__version__ = "2020.07.11"

import rhinoscriptsyntax as rs

def pattern(n):
    k = n -2
    for i in range(n,-1,-1):
        for j in range(k,0,-1):
            print(.2)
        k = k + 1
        for j in range(0,i+1):
            print(.4)
    k = 2 * n - 2
    for i in range(0,n+1):
        for j in range(0,k):
            print(.6)
        k = k - 1
        for j in range(0,i+1):
            print(.8)
        
pattern(a)
# ---------- end ghpython_script ----------
ghpython_script_2 = GhPythonScript(a=number_slider)  # -> out, a; inputs a: Int32
# ---------- ghpython_script_2: Python ----------
__author__ = "Sculpture"
__version__ = "2020.07.11"

import rhinoscriptsyntax as rs

def pattern(n):
    k = 2*n -2
    for i in range(0, n-1):
        for j in range(0,k):
            print(.2)
        k = k-2
        for j in range(0,i+1):
            print(.4)
    k = -1
    for i in range(n-1,-1,-1):
        for j in range(k,-1,-1):
            print(.6)
        k = k + 2
        for j in range(0,i+1):
            print(.8)
        
pattern(a)
# ---------- end ghpython_script_2 ----------
ghpython_script_3 = GhPythonScript(a=number_slider, x=Slider(3, range=0..10))  # -> out, a; inputs a: Int32, x: Int32
# ---------- ghpython_script_3: Python ----------
__author__ = "Sculpture"
__version__ = "2020.07.11"

import rhinoscriptsyntax as rs

def pattern(n):
    k = x * n -2
    for i in range(0, n-1):
        for j in range(0,k):
            print(.2)
        k = k-2
        for j in range(0,i+1):
            print(.4)
    k = -1
    for i in range(n-1,-1,-1):
        for j in range(k,-1,-1):
            print(.6)
        k = k + 2
        for j in range(0,i+1):
            print(.8)
        
pattern(a)
# ---------- end ghpython_script_3 ----------
ghpython_script_4 = GhPythonScript(a=number_slider)  # -> out, a; inputs a: Int32
# ---------- ghpython_script_4: Python ----------
__author__ = "Sculpture"
__version__ = "2020.07.11"

import rhinoscriptsyntax as rs

def pattern(n):
    k = 2 * n - 2
    for i in range(0,n):
        for j in range(0,k):
            print(.3)
        k = k -2
        for j in range(0,i+1):
            print(.6)
        
pattern(a)
# ---------- end ghpython_script_4 ----------
series = Series(Start=0, Step=number_slider_2, Count=expr("x*2", number_slider))
list_length = ListLength(List=ghpython_script_3.out)
panel = Panel(list_length)
construct_point = ConstructPoint(XCoordinate=graft(series), YCoordinate=series, ZCoordinate=0)  # -> flatten(Point)
number_slider_3 = Slider(10, range=0..10)
panel_2 = Panel(ghpython_script_3.out)
list_length_2 = ListLength(List=construct_point)
mesh_sphere = MeshSphere(Base=construct_point, Radius=Slider(1, range=0..1), UCount=number_slider_3, VCount=number_slider_3)
panel_3 = Panel(list_length_2)
volume = Volume(Geometry=mesh_sphere)  # -> Volume, Centroid
scale = Scale(Geometry=mesh_sphere, Center=volume.Centroid, Factor=ghpython_script_3.out)  # -> Geometry, Transform
# rc
# rs
# Full multiplicity knots at start
# Simple knots
# Full multiplicity knots at end
# P1
# A=0.2*P1+ 0.8*P2
# D=0.2*A + 0.8*B
# P2
# B=0.47*P2 + 0.53*P3
# Full multiplicity knots at start
# E=0.7*B + 0.3*C
# P3
# Full multiplicity knots in the middle
# C=0.8*P3 + 0.2*P4
# P4
# Full multiplicity knots at end
# Compare knot spacing
# GH solution
# VB
# C#
# Python with RhinoCommon Only
# Pythong with RhinoScriptSyntax
# GH solution
# VB
# C#
# Python
# VB
mesh_join = MeshJoin(Meshes=scale.Geometry)

param_viewer = ParamViewer(ghpython_script_3.out)
