# Grasshopper definition SetsList078.gh (Grasshopper 1.0.7)
# Copyright: Wickerson Studios
# plug-ins: Bifocals

# 1001 GRASSHOPPER DEFINITIONS
# Wickerson Studio
# 
# created by: Michael Wickerson
# 
# Grasshopper for Rhino 3D Algorithmic Modeling
# 
# www.wickersonstudios.com
# www.michaelwickerson.com
# https://www.youtube.com/channel/UC7J48Ppcsa6oncp6d29R0xw
# https://github.com/mwickerson
# https://www.facebook.com/michael.wickerson
# https://www.linkedin.com/in/michael-wickerson-696a80156/
# https://www.grasshopper3d.com/profile/MichaelWickerson
image_sampler = ImageSampler(
    FilePath="C:\Users\Sculpture\Documents\2020Grasshopper\ScreenShots2019\Screenshots2020\SurfaceEditAlgorithm.PNG",
    Filter="Value",
    Interpolate=False,
    Umax=1,
    Umin=0,
    Vmax=1,
    Vmin=0,
    Wrap=1)
# Wickerson Studio
# created by: Michael Wickerson
# Grasshopper for Rhino 3D Algorithmic Modeling
# www.wickersonstudios.com
# www.michaelwickerson.com
# https://www.youtube.com/channel/UC7J48Ppcsa6oncp6d29R0xw
# https://github.com/mwickerson
# https://www.facebook.com/michael.wickerson
# https://www.linkedin.com/in/michael-wickerson-696a80156/
# https://www.grasshopper3d.com/profile/MichaelWickerson
geometry = Geometry(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)
path_mapper = PathMapper()
# VB
# C#
# Python
# VB
number_slider = Slider(12, range=0..100)
number_slider_2 = Slider(0.1, range=0..1)

# ----
# RETURN TO THE BASICS 078/1001
range = Range(Domain=Domain(0, 1), Steps=10)
construct_point = ConstructPoint(XCoordinate=range, YCoordinate=expr("x+1", range), ZCoordinate=expr("x+2", range))
path_mapper_2 = PathMapper(construct_point, source="{A;B}(i)", target="{A;B}(item_count - 8 - i)")
path_mapper_3 = PathMapper(construct_point, source="{A;B}(i)", target="{A;B}(item_count - 3 - i)")
path_mapper_4 = PathMapper(construct_point, source="{A;B}(i)", target="{A;i;B}")
param_viewer = ParamViewer(path_mapper_4)
param_viewer_2 = ParamViewer(path_mapper_4)
panel = Panel(path_mapper_4)
construct_point_2 = ConstructPoint(XCoordinate=path_mapper_4, YCoordinate=construct_point, ZCoordinate=construct_point)
path_mapper_5 = PathMapper(construct_point, source="{A;B}(i)", target="{i;B;A}")
param_viewer_3 = ParamViewer(path_mapper_5)
param_viewer_4 = ParamViewer(path_mapper_5)
panel_2 = Panel(path_mapper_5)
construct_point_3 = ConstructPoint(XCoordinate=path_mapper_5, YCoordinate=construct_point, ZCoordinate=construct_point)
panel_3 = Panel(path_mapper_3)
construct_point_4 = ConstructPoint(XCoordinate=path_mapper_3, YCoordinate=construct_point, ZCoordinate=construct_point)
construct_point_5 = ConstructPoint(XCoordinate=path_mapper_2, YCoordinate=construct_point, ZCoordinate=construct_point)
panel_4 = Panel(path_mapper_2)

# ---- group: Graft Mapping
path_mapper_6 = PathMapper(construct_point, source="{A;B}(i)", target="{A;B;i}")

# ---- group: Null Mapping
path_mapper_7 = PathMapper(construct_point, source="{A;B}", target="{A;B}")

# ---- group: Flatten Mapping
path_mapper_8 = PathMapper(construct_point, source="{A;B}", target="{0}")

# ---- group: Trim Mapping
path_mapper_9 = PathMapper(construct_point, source="{A;B}", target="{A}")

# ---- group: Reverse Mapping
path_mapper_10 = PathMapper(construct_point, source="{A;B}(i)", target="{A;B}(item_count - 1 - i)")

# ---- group: Renumber Mapping
path_mapper_11 = PathMapper(construct_point, source="{A;B}", target="{path_index}")

# ----
construct_point_6 = ConstructPoint(XCoordinate=path_mapper_6, YCoordinate=construct_point, ZCoordinate=construct_point)
panel_5 = Panel(path_mapper_7)
panel_6 = Panel(path_mapper_8)
construct_point_7 = ConstructPoint(XCoordinate=path_mapper_7, YCoordinate=construct_point, ZCoordinate=construct_point)
panel_7 = Panel(path_mapper_6)
construct_point_8 = ConstructPoint(XCoordinate=path_mapper_8, YCoordinate=construct_point, ZCoordinate=construct_point)
param_viewer_5 = ParamViewer(path_mapper_6)
param_viewer_6 = ParamViewer(path_mapper_6)
panel_8 = Panel(path_mapper_9)
construct_point_9 = ConstructPoint(XCoordinate=path_mapper_9, YCoordinate=construct_point, ZCoordinate=construct_point)
panel_9 = Panel(path_mapper_11)
construct_point_10 = ConstructPoint(XCoordinate=path_mapper_11, YCoordinate=construct_point, ZCoordinate=construct_point)
panel_10 = Panel(path_mapper_10)
construct_point_11 = ConstructPoint(XCoordinate=path_mapper_10, YCoordinate=construct_point, ZCoordinate=construct_point)

point_list = PointList(Points=construct_point_4, Size=number_slider_2)
# rc
# rs
point_list_2 = PointList(Points=construct_point_11, Size=number_slider_2)
# Full multiplicity knots at start
# Simple knots
# Full multiplicity knots at end
# P1
# A=0.2*P1+ 0.8*P2
# D=0.2*A + 0.8*B
# P2
# B=0.47*P2 + 0.53*P3
# Full multiplicity knots at start
# E=0.7*B + 0.3*C
# P3
# Full multiplicity knots in the middle
# C=0.8*P3 + 0.2*P4
# P4
# Full multiplicity knots at end
# Compare knot spacing
# GH solution
# VB
# C#
# Python with RhinoCommon Only
# Pythong with RhinoScriptSyntax
# GH solution
point_list_3 = PointList(Points=construct_point_5, Size=number_slider_2)
