# Grasshopper definition SetsList079d.gh (Grasshopper 1.0.7)
# Copyright: Wickerson Studios
# plug-ins: Bifocals

# 1001 GRASSHOPPER DEFINITIONS
# Wickerson Studio
# 
# created by: Michael Wickerson
# 
# Grasshopper for Rhino 3D Algorithmic Modeling
# 
# www.wickersonstudios.com
# www.michaelwickerson.com
# https://www.youtube.com/channel/UC7J48Ppcsa6oncp6d29R0xw
# https://github.com/mwickerson
# https://www.facebook.com/michael.wickerson
# https://www.linkedin.com/in/michael-wickerson-696a80156/
# https://www.grasshopper3d.com/profile/MichaelWickerson
image_sampler = ImageSampler(
    FilePath="C:\Users\Sculpture\Documents\2020Grasshopper\ScreenShots2019\Screenshots2020\SurfaceEditAlgorithm.PNG",
    Filter="Value",
    Interpolate=False,
    Umax=1,
    Umin=0,
    Vmax=1,
    Vmin=0,
    Wrap=1)
# Wickerson Studio
# created by: Michael Wickerson
# Grasshopper for Rhino 3D Algorithmic Modeling
# www.wickersonstudios.com
# www.michaelwickerson.com
# https://www.youtube.com/channel/UC7J48Ppcsa6oncp6d29R0xw
# https://github.com/mwickerson
# https://www.facebook.com/michael.wickerson
# https://www.linkedin.com/in/michael-wickerson-696a80156/
# https://www.grasshopper3d.com/profile/MichaelWickerson
geometry = Geometry(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)
# RETURN TO THE BASICS 079/1001
number_slider = Slider(2, range=0..10)
range = Range(Domain=Domain(0, 1), Steps=number_slider)
construct_point = ConstructPoint(XCoordinate=range, YCoordinate=graft(range), ZCoordinate=0)
construct_point_2 = ConstructPoint(XCoordinate=graft(range), YCoordinate=range, ZCoordinate=0)
unit_z = UnitZ(Factor=range)
path_mapper = PathMapper(construct_point, source="{A;B;C}(i)", target="{A;B;C+1;i}")
path_mapper_2 = PathMapper(construct_point, source="{A;B;C}(i)", target="{A;B;i;C}")
path_mapper_3 = PathMapper(construct_point, source="{A;B;C}(i)", target="{A;B;i;C}")
path_mapper_4 = PathMapper(construct_point, source="{A;B;C}(i)", target="{A;B;i;A}")
path_mapper_5 = PathMapper(construct_point, source="{A;B;C}(i)", target="{A;i;C;B}")
path_mapper_6 = PathMapper(construct_point_2, source="{A;B;C}", target="{A;B;C}")
path_mapper_7 = PathMapper(construct_point, source="{A;B;C}(i)", target="{A;B+1;C;i}")
path_mapper_8 = PathMapper(construct_point, source="{A;B;C}(i)", target="{A;B+1;i;i}")
path_mapper_9 = PathMapper(construct_point, source="{A;B;C}(i)", target="{A;i;C;i}")
path_mapper_10 = PathMapper(construct_point, source="{A;B;C}(i)", target="A+2;i;i;i}")
path_mapper_11 = PathMapper(construct_point, source="{A;B;C}(i)", target="{i;B+1;C;i}")
move = Move(Geometry=graft(path_mapper), Motion=unit_z)  # -> Geometry, Transform
move_2 = Move(Geometry=graft(path_mapper_6), Motion=unit_z)  # -> Geometry, Transform
param_viewer = ParamViewer(path_mapper_3)
param_viewer_2 = ParamViewer(move_2.Geometry)
interpolate = Interpolate(Vertices=move_2.Geometry, Degree=3, Periodic=False, KnotStyle=1)  # -> Curve, Length, Domain
interpolate_2 = Interpolate(Vertices=move.Geometry, Degree=3, Periodic=False, KnotStyle=1)  # -> Curve, Length, Domain
line = Line(StartPoint=move_2.Geometry, EndPoint=path_mapper_7)
line_2 = Line(StartPoint=move.Geometry, EndPoint=path_mapper_9)
line_3 = Line(StartPoint=move.Geometry, EndPoint=path_mapper_11)
line_4 = Line(StartPoint=move_2.Geometry, EndPoint=path_mapper_8)
line_5 = Line(StartPoint=move.Geometry, EndPoint=path_mapper_10)
number_slider_2 = Slider(0.12, range=0..0.12)
line_6 = Line(StartPoint=move_2.Geometry, EndPoint=path_mapper_3)
line_7 = Line(StartPoint=move_2.Geometry, EndPoint=move.Geometry)
param_viewer_3 = ParamViewer(path_mapper_4)
point_list = PointList(Points=move.Geometry, Size=number_slider_2)
point_list_2 = PointList(Points=move_2.Geometry, Size=number_slider_2)
param_viewer_4 = ParamViewer(path_mapper_5)
multiplication = Multiplication(A=number_slider_2, B=number_slider_2)
# GH solution
# VB
# C#
# Python with RhinoCommon Only
# Pythong with RhinoScriptSyntax
# GH solution
# VB
# C#
# Python
# VB
pipe = Pipe(Curve=line_5, Radius=multiplication, Caps=2)
pipe_2 = Pipe(Curve=line_4, Radius=multiplication, Caps=2)
pipe_3 = Pipe(Curve=line_2, Radius=multiplication, Caps=2)
pipe_4 = Pipe(Curve=line, Radius=multiplication, Caps=2)
pipe_5 = Pipe(Curve=line_3, Radius=multiplication, Caps=2)
multiplication_2 = Multiplication(A=number_slider_2, B=number_slider_2)
multiplication_3 = Multiplication(A=number_slider_2, B=number_slider_2)
pipe_6 = Pipe(Curve=line_7, Radius=multiplication, Caps=2)
pipe_7 = Pipe(Curve=line_6, Radius=multiplication, Caps=2)
pipe_8 = Pipe(Curve=line, Radius=multiplication, Caps=2)
pipe_9 = Pipe(Curve=interpolate.Curve, Radius=multiplication_2, Caps=2)
param_viewer_5 = ParamViewer(path_mapper_2)
pipe_10 = Pipe(Curve=interpolate_2.Curve, Radius=multiplication_3, Caps=2)
panel = Panel(move_2.Geometry)
# rc
# rs
# Full multiplicity knots at start
# Simple knots
# Full multiplicity knots at end
# P1
# A=0.2*P1+ 0.8*P2
# D=0.2*A + 0.8*B
# P2
# B=0.47*P2 + 0.53*P3
# Full multiplicity knots at start
# E=0.7*B + 0.3*C
# P3
# Full multiplicity knots in the middle
# C=0.8*P3 + 0.2*P4
# P4
# Full multiplicity knots at end
# Compare knot spacing
panel_2 = Panel(move.Geometry)
