# Grasshopper definition SetsList080.gh (Grasshopper 1.0.7)
# Copyright: Wickerson Studios
# plug-ins: Bifocals

# Wickerson Studio
# 
# created by: Michael Wickerson
# 
# Grasshopper for Rhino 3D Algorithmic Modeling
# 
# www.wickersonstudios.com
# www.michaelwickerson.com
# https://www.youtube.com/channel/UC7J48Ppcsa6oncp6d29R0xw
# https://github.com/mwickerson
# https://www.facebook.com/michael.wickerson
# https://www.linkedin.com/in/michael-wickerson-696a80156/
# https://www.grasshopper3d.com/profile/MichaelWickerson
image_sampler = ImageSampler(
    FilePath="C:\Users\Sculpture\Documents\2020Grasshopper\ScreenShots2019\Screenshots2020\SurfaceEditAlgorithm.PNG",
    Filter="Value",
    Interpolate=False,
    Umax=1,
    Umin=0,
    Vmax=1,
    Vmin=0,
    Wrap=1)
# Wickerson Studio
# created by: Michael Wickerson
# Grasshopper for Rhino 3D Algorithmic Modeling
# www.wickersonstudios.com
# www.michaelwickerson.com
# https://www.youtube.com/channel/UC7J48Ppcsa6oncp6d29R0xw
# https://github.com/mwickerson
# https://www.facebook.com/michael.wickerson
# https://www.linkedin.com/in/michael-wickerson-696a80156/
# https://www.grasshopper3d.com/profile/MichaelWickerson
geometry = Geometry(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)
# 1001 GRASSHOPPER DEFINITIONS
# RETURN TO THE BASICS 080/1001
rectangular = Rectangular(
    Plane=[Plane(origin=(-20, 11, 0), x=(0.9997830567, -0.02082881368, 0), y=(0.02062895904, 0.9901900337, 0.1381960319)), Plane(origin=(139, 94, 0), x=(0.8645071867, 0.5026204574, 0), y=(-0.3992604973, 0.6867280554, 0.6074501076))],
    SizeX=12,
    SizeY=[13, 6],
    ExtentX=[12, 8],
    ExtentY=[5, 4])  # -> Cells, simplify(Points)
point_list = PointList(Points=rectangular.Points, Size=3)
path_mapper = PathMapper()
param_viewer = ParamViewer(rectangular.Points)
polyline = PolyLine(Vertices=rectangular.Points, Closed=False)
# rc
# rs
# Full multiplicity knots at start
# Simple knots
# Full multiplicity knots at end
# P1
# A=0.2*P1+ 0.8*P2
# D=0.2*A + 0.8*B
# P2
# B=0.47*P2 + 0.53*P3
# Full multiplicity knots at start
# E=0.7*B + 0.3*C
# P3
# Full multiplicity knots in the middle
# C=0.8*P3 + 0.2*P4
# P4
# Full multiplicity knots at end
# Compare knot spacing
# GH solution
# VB
# C#
# Python with RhinoCommon Only
# Pythong with RhinoScriptSyntax
# GH solution
# VB
# C#
# Python
# VB
pipe = Pipe(Curve=polyline, Radius=Slider(0.18, range=0..1), Caps=0)
