# Grasshopper definition SetsList080c.gh (Grasshopper 1.0.7)
# Copyright: Wickerson Studios
# plug-ins: Bifocals

# Wickerson Studio
# 
# created by: Michael Wickerson
# 
# Grasshopper for Rhino 3D Algorithmic Modeling
# 
# www.wickersonstudios.com
# www.michaelwickerson.com
# https://www.youtube.com/channel/UC7J48Ppcsa6oncp6d29R0xw
# https://github.com/mwickerson
# https://www.facebook.com/michael.wickerson
# https://www.linkedin.com/in/michael-wickerson-696a80156/
# https://www.grasshopper3d.com/profile/MichaelWickerson
image_sampler = ImageSampler(
    FilePath="C:\Users\Sculpture\Documents\2020Grasshopper\ScreenShots2019\Screenshots2020\SurfaceEditAlgorithm.PNG",
    Filter="Value",
    Interpolate=False,
    Umax=1,
    Umin=0,
    Vmax=1,
    Vmin=0,
    Wrap=1)
# Wickerson Studio
# created by: Michael Wickerson
# Grasshopper for Rhino 3D Algorithmic Modeling
# www.wickersonstudios.com
# www.michaelwickerson.com
# https://www.youtube.com/channel/UC7J48Ppcsa6oncp6d29R0xw
# https://github.com/mwickerson
# https://www.facebook.com/michael.wickerson
# https://www.linkedin.com/in/michael-wickerson-696a80156/
# https://www.grasshopper3d.com/profile/MichaelWickerson
geometry = Geometry(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)
rectangular = Rectangular(Plane=PlaneXY(0, 0, 0), SizeX=10, SizeY=10, ExtentX=10, ExtentY=10)  # -> Cells, Points
# 1001 GRASSHOPPER DEFINITIONS
# RETURN TO THE BASICS 080/1001
rectangular_2 = Rectangular(
    Plane=[Plane(origin=(-20, 11, 0), x=(0.9997830567, -0.02082881368, 0), y=(0.02062895904, 0.9901900337, 0.1381960319)), Plane(origin=(139, 94, 0), x=(0.8645071867, 0.5026204574, 0), y=(-0.3992604973, 0.6867280554, 0.6074501076))],
    SizeX=12,
    SizeY=[13, 6],
    ExtentX=[12, 8],
    ExtentY=[5, 4])  # -> Cells, simplify(Points)
path_mapper = PathMapper(rectangular_2.Points, source="{A;B}(i)", target="{A;i}(B)")
path_mapper_2 = PathMapper(rectangular_2.Points, source="{A;B}", target="{5+path_index}")
path_mapper_3 = PathMapper(rectangular_2.Points, source="{A;B}", target="{path_index^2}")
# Override and
# create gaps
# in a tree
path_mapper_4 = PathMapper(rectangular_2.Points, source="{A;B}(i)", target="{A;B}(i*2)")
relative_item = RelativeItem(
    Tree=rectangular.Points,
    Offset=["{0;0;+1}(+1)", "{0;0;+1}(-1)", "{0;0;+1}(0)", "{0;0;0}(+1)"],
    WrapPaths=False,
    WrapItems=False)  # -> ItemA, ItemB
path_mapper_5 = PathMapper(rectangular_2.Points, source="{A;B}(i)", target="{A;B}(0)")
relative_items = RelativeItems(WrapPaths=False, WrapItems=False)  # -> ItemA, ItemB
path_mapper_6 = PathMapper(rectangular_2.Points, source="{A;B}", target="{A;B}")
path_mapper_7 = PathMapper(rectangular_2.Points, source="{A;B}", target="{0}")
path_mapper_8 = PathMapper(rectangular_2.Points, source="{A;B}", target="{A}")
point_list = PointList(Points=rectangular.Points, Size=3)
path_mapper_9 = PathMapper(rectangular.Points, source="{A;B;C}", target="{A;B;C}")
line = Line(StartPoint=relative_item.ItemA, EndPoint=relative_item.ItemB)
param_viewer = ParamViewer(path_mapper_7)
param_viewer_2 = ParamViewer(path_mapper_6)
param_viewer_3 = ParamViewer(path_mapper_8)
param_viewer_4 = ParamViewer(path_mapper_5)
# Successfully Flipped Each Grid (Flip Matrix in
# Path Mapper for more than single groups of
# data)
param_viewer_5 = ParamViewer(path_mapper)
param_viewer_6 = ParamViewer(path_mapper_4)
panel = Panel(path_mapper_4)
polyline = PolyLine(Vertices=path_mapper_8, Closed=False)
point_list_2 = PointList(Points=path_mapper_3, Size=3)
# rc
# rs
# Full multiplicity knots at start
# Simple knots
# Full multiplicity knots at end
# P1
# A=0.2*P1+ 0.8*P2
# D=0.2*A + 0.8*B
# P2
# B=0.47*P2 + 0.53*P3
# Full multiplicity knots at start
# E=0.7*B + 0.3*C
# P3
# Full multiplicity knots in the middle
# C=0.8*P3 + 0.2*P4
# P4
# Full multiplicity knots at end
# Compare knot spacing
# GH solution
# VB
# C#
# Python with RhinoCommon Only
# Pythong with RhinoScriptSyntax
# GH solution
# VB
# C#
# Python
# VB
pipe = Pipe(Curve=line, Radius=Slider(0.19, range=0..1), Caps=0)
