# Grasshopper definition SetsList080d.gh (Grasshopper 1.0.7)
# Copyright: Wickerson Studios
# plug-ins: Bifocals

image_sampler = ImageSampler(
    FilePath="C:\Users\Sculpture\Documents\2020Grasshopper\ScreenShots2019\Screenshots2020\SurfaceEditAlgorithm.PNG",
    Filter="Value",
    Interpolate=False,
    Umax=1,
    Umin=0,
    Vmax=1,
    Vmin=0,
    Wrap=1)
# Wickerson Studio
# created by: Michael Wickerson
# Grasshopper for Rhino 3D Algorithmic Modeling
# www.wickersonstudios.com
# www.michaelwickerson.com
# https://www.youtube.com/channel/UC7J48Ppcsa6oncp6d29R0xw
# https://github.com/mwickerson
# https://www.facebook.com/michael.wickerson
# https://www.linkedin.com/in/michael-wickerson-696a80156/
# https://www.grasshopper3d.com/profile/MichaelWickerson
geometry = Geometry(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)
panel = Panel("""{0;0}
{0;2}
{0;4}
{0;6}
{0;8}
{1;0}
{1;2}
{1;4}""")
panel_2 = Panel("""{(0,1);0}
{(0,1);2}
{(0,1);4}
{(0,1);6}
{(0,1);8}""")
rectangular = Rectangular(
    Plane=[Plane(origin=(-20, 11, 0), x=(0.9997830567, -0.02082881368, 0), y=(0.02062895904, 0.9901900337, 0.1381960319)), Plane(origin=(139, 94, 0), x=(0.8645071867, 0.5026204574, 0), y=(-0.3992604973, 0.6867280554, 0.6074501076))],
    SizeX=12,
    SizeY=[13, 6],
    ExtentX=[12, 8],
    ExtentY=[5, 4])  # -> Cells, simplify(Points)
rectangular_2 = Rectangular(Plane=PlaneXY(0, 0, 0), SizeX=10, SizeY=10, ExtentX=10, ExtentY=10)  # -> Cells, Points
# 1001 GRASSHOPPER DEFINITIONS
# Wickerson Studio
# 
# created by: Michael Wickerson
# 
# Grasshopper for Rhino 3D Algorithmic Modeling
# 
# www.wickersonstudios.com
# www.michaelwickerson.com
# https://www.youtube.com/channel/UC7J48Ppcsa6oncp6d29R0xw
# https://github.com/mwickerson
# https://www.facebook.com/michael.wickerson
# https://www.linkedin.com/in/michael-wickerson-696a80156/
# https://www.grasshopper3d.com/profile/MichaelWickerson
# RETURN TO THE BASICS 080/1001
rectangular_3 = Rectangular(
    Plane=[Plane(origin=(-20, 11, 0), x=(0.9997830567, -0.02082881368, 0), y=(0.02062895904, 0.9901900337, 0.1381960319)), Plane(origin=(139, 94, 0), x=(0.8645071867, 0.5026204574, 0), y=(-0.3992604973, 0.6867280554, 0.6074501076))],
    SizeX=12,
    SizeY=[13, 6],
    ExtentX=[12, 8],
    ExtentY=[5, 4])  # -> Cells, simplify(Points)
# Works with any # of grids!!!
panel_3 = Panel("""{(0,1,2);0}
{(0,1,2);2}
{(0,1,2);4}
{(0,1,2);6}
{(0,1,2);8}""")
gene_pool = GenePool(Decimals=0, Maximum=10, Minimum=0, Value=[1, 3, 7])
path_mapper = PathMapper()
panel_4 = Panel("{?;(0,2,...)}[0,2,...,10]")
panel_5 = Panel("{?}[2]")

panel_6 = Panel("{?;?;9}[2]")
panel_7 = Panel("{*;9}[2]")
panel_8 = Panel("{*;9;*}[2]")

path_mapper_2 = PathMapper(rectangular_3.Points, source="{A;B}(i)", target="{A;i}(B)")
path_mapper_3 = PathMapper(rectangular_3.Points, source="{A;B}", target="{5+path_index}")
path_mapper_4 = PathMapper(rectangular_3.Points, source="{A;B}", target="{path_index^2}")
# Override and
# create gaps
# in a tree
path_mapper_5 = PathMapper(rectangular_3.Points, source="{A;B}(i)", target="{A;B}(i*2)")
panel_10 = Panel("{?;(1 to 8) and !5}")
panel_11 = Panel("{?;!5}")
panel_12 = Panel("""{?;0}
{?;2}
{?;4}
{?;6}
{?;8}""")
panel_13 = Panel("{?;(0,2,...)}[0,2,...]")
panel_14 = Panel("{?;0,2,4,,6}")
panel_15 = Panel("{?;(>3)}")
panel_16 = Panel("{?;(2 to 4)}")
# AWESOME!!!
panel_17 = Panel("{?;(0,2,...)}")
relative_item = RelativeItem(
    Tree=rectangular_2.Points,
    Offset=["{0;0;+1}(+1)", "{0;0;+1}(-1)", "{0;0;+1}(0)", "{0;0;0}(+1)"],
    WrapPaths=False,
    WrapItems=False)  # -> ItemA, ItemB

divide_surface = DivideSurface(UCount=10, VCount=10)  # -> simplify(Points), Normals, Parameters

# ----
# Pythong with RhinoScriptSyntax
# GH solution
# VB
# C#
# Python
# VB
relative_items = RelativeItems(WrapPaths=False, WrapItems=False)  # -> ItemA, ItemB
path_mapper_6 = PathMapper(rectangular_3.Points, source="{A;B}(i)", target="{A;B}(0)")
point_list = PointList(Points=rectangular.Points, Size=3)
path_mapper_7 = PathMapper(rectangular_3.Points, source="{A;B}", target="{A;B}")
path_mapper_8 = PathMapper(rectangular_3.Points, source="{A;B}", target="{0}")
path_mapper_9 = PathMapper(rectangular_3.Points, source="{A;B}", target="{A}")
point_list_2 = PointList(Points=rectangular_2.Points, Size=3)
relative_item_2 = RelativeItem(WrapPaths=False, WrapItems=False)  # -> ItemA, ItemB
path_mapper_10 = PathMapper(rectangular_2.Points, source="{A;B;C}", target="{A;B;C}")
join = Join(";")
entwine = Entwine(
    Branch00=Slider(0.25, range=0..1),
    Branch01=Slider(0.618, range=0..1),
    Branch02=Slider(0.554, range=0..1),
    FlattenInputs=True)
line = Line(StartPoint=relative_item.ItemA, EndPoint=relative_item.ItemB)
split_tree = SplitTree()  # -> Positive, Negative
construct_path = ConstructPath(Indices=gene_pool)
merge = Merge(Data1=Slider(0.25, range=0..1), Data2=Slider(0.25, range=0..1), Data3=Slider(0.25, range=0..1))
panel_18 = Panel(join)
split_tree_2 = SplitTree(Data=rectangular.Points, Masks=flatten("{*}[2]"))  # -> Positive, Negative
integer = Integer(gene_pool)
param_viewer = ParamViewer(path_mapper_8)
param_viewer_2 = ParamViewer(path_mapper_7)
param_viewer_3 = ParamViewer(path_mapper_9)
param_viewer_4 = ParamViewer(path_mapper_6)
# Successfully Flipped Each Grid (Flip Matrix in
# Path Mapper for more than single groups of
# data)
param_viewer_5 = ParamViewer(path_mapper_2)
param_viewer_6 = ParamViewer(path_mapper_5)
panel_19 = Panel(merge)
# GH solution
# VB
# C#
# Python with RhinoCommon Only
panel_20 = Panel(entwine)
deconstruct_path = DeconstructPath(Branch=construct_path)
param_viewer_7 = ParamViewer(rectangular.Points)
panel_21 = Panel(construct_path)
text_join = TextJoin(Text=integer, Join=join)
param_viewer_8 = ParamViewer(split_tree_2.Positive)
# PASS
# FAIL
param_viewer_9 = ParamViewer(split_tree_2.Negative)
# Full multiplicity knots at start
# Simple knots
panel_22 = Panel(deconstruct_path)
# Full multiplicity knots at end
# P1
# A=0.2*P1+ 0.8*P2
# D=0.2*A + 0.8*B
# P2
# B=0.47*P2 + 0.53*P3
# Full multiplicity knots at start
# E=0.7*B + 0.3*C
# P3
# Full multiplicity knots in the middle
# C=0.8*P3 + 0.2*P4
# P4
# Full multiplicity knots at end
# Compare knot spacing
panel_23 = Panel(text_join)
panel_24 = Panel(path_mapper_5)
polyline = PolyLine(Vertices=path_mapper_9, Closed=False)
point_list_3 = PointList(Points=path_mapper_4, Size=3)
# rc
# rs
pipe = Pipe(Curve=line, Radius=Slider(0.19, range=0..1), Caps=0)
