# Grasshopper definition SetsList088.gh (Grasshopper 1.0.7)
# Copyright: Wickerson Studios
# plug-ins: Bifocals

# Wickerson Studio
# 
# created by: Michael Wickerson
# 
# Grasshopper for Rhino 3D Algorithmic Modeling
# 
# www.wickersonstudios.com
# www.michaelwickerson.com
# https://www.youtube.com/channel/UC7J48Ppcsa6oncp6d29R0xw
# https://github.com/mwickerson
# https://www.facebook.com/michael.wickerson
# https://www.linkedin.com/in/michael-wickerson-696a80156/
# https://www.grasshopper3d.com/profile/MichaelWickerson
image_sampler = ImageSampler(
    FilePath="C:\Users\Sculpture\Documents\2020Grasshopper\ScreenShots2019\Screenshots2020\SurfaceEditAlgorithm.PNG",
    Filter="Value",
    Interpolate=False,
    Umax=1,
    Umin=0,
    Vmax=1,
    Vmin=0,
    Wrap=1)
# Wickerson Studio
# created by: Michael Wickerson
# Grasshopper for Rhino 3D Algorithmic Modeling
# www.wickersonstudios.com
# www.michaelwickerson.com
# https://www.youtube.com/channel/UC7J48Ppcsa6oncp6d29R0xw
# https://github.com/mwickerson
# https://www.facebook.com/michael.wickerson
# https://www.linkedin.com/in/michael-wickerson-696a80156/
# https://www.grasshopper3d.com/profile/MichaelWickerson
geometry = Geometry(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)
number_slider = Slider(4, range=0..10)
number_slider_2 = Slider(8, range=0..10)
# SETS LIST  088
number_slider_3 = Slider(3, range=0..10)
number_slider_4 = Slider(10, range=0..10)
cylinder = Cylinder(Base=PlaneXY(0, 0, 0), Radius=number_slider_4, Length=number_slider_3)
sphere = Sphere(Base=PlaneXY(0, 0, 0), Radius=number_slider_4)
cone = Cone(Base=PlaneXY(0, 0, 0), Radius=number_slider, Length=number_slider_4)  # -> Cone, Tip
# 1001 GRASSHOPPER DEFINITIONS
divide_surface = DivideSurface(Surface=[cylinder, sphere, cone.Cone], UCount=number_slider_3, VCount=number_slider_3)  # -> flatten(Points), Normals, Parameters
divide_surface_2 = DivideSurface(Surface=[cylinder, sphere, cone.Cone], UCount=number_slider_2, VCount=number_slider_2)  # -> flatten(Points), Normals, Parameters
divide_surface_3 = DivideSurface(Surface=[cylinder, sphere, cone.Cone], UCount=number_slider, VCount=number_slider)  # -> flatten(Points), Normals, Parameters
combine_data = CombineData(Input0=divide_surface.Points, Input1=divide_surface_2.Points, Input2=divide_surface_3.Points)  # -> Result, Index
gene_pool = GenePool(
    Decimals=0,
    Maximum=1,
    Minimum=0,
    Value=[0.0625514109, 0.08030504877, 0.9858138845, 0.3673706671, 0.1208812134, 0.5469403288, 0.9505298901, 0.3978400656, 0.05337381505, 0.1759854435])
sift_pattern = SiftPattern(List=combine_data.Result, SiftPattern=gene_pool)  # -> Output0, Output1
clean_tree = CleanTree(RemoveNulls=True, RemoveInvalid=True, RemoveEmpty=False, Tree=sift_pattern.Output1)
clean_tree_2 = CleanTree(RemoveNulls=True, RemoveInvalid=True, RemoveEmpty=False, Tree=sift_pattern.Output0)
point = Point(clean_tree_2)
range = Range(Domain=Domain(0, 1), Steps=10)
line = Line(StartPoint=point, EndPoint=clean_tree)
graph_mapper = GraphMapper(
    range,
    x0=0,
    x1=1,
    y0=0,
    y1=1,
    container_name="Bezier",
    cpx=[0, 0.1375957429, 0.8580642939, 1],
    cpy=[0, 0.7471887469, 0.3097260594, 1])
# rc
# rs
# Full multiplicity knots at start
# Simple knots
# Full multiplicity knots at end
# P1
# A=0.2*P1+ 0.8*P2
# D=0.2*A + 0.8*B
# P2
# B=0.47*P2 + 0.53*P3
# Full multiplicity knots at start
# E=0.7*B + 0.3*C
# P3
# Full multiplicity knots in the middle
# C=0.8*P3 + 0.2*P4
# P4
# Full multiplicity knots at end
# Compare knot spacing
# GH solution
# VB
# C#
# Python with RhinoCommon Only
# Pythong with RhinoScriptSyntax
# GH solution
# VB
# C#
# Python
# VB
pipe_variable = PipeVariable(Curve=reparameterize(line), Parameters=range, Radii=graph_mapper, Caps=2)
