# Grasshopper definition SetsTree082.gh (Grasshopper 1.0.7)
# Copyright: Wickerson Studios
# plug-ins: Bifocals

image_sampler = ImageSampler(
    FilePath="C:\Users\Sculpture\Documents\2020Grasshopper\ScreenShots2019\Screenshots2020\SurfaceEditAlgorithm.PNG",
    Filter="Value",
    Interpolate=False,
    Umax=1,
    Umin=0,
    Vmax=1,
    Vmin=0,
    Wrap=1)
# Wickerson Studio
# created by: Michael Wickerson
# Grasshopper for Rhino 3D Algorithmic Modeling
# www.wickersonstudios.com
# www.michaelwickerson.com
# https://www.youtube.com/channel/UC7J48Ppcsa6oncp6d29R0xw
# https://github.com/mwickerson
# https://www.facebook.com/michael.wickerson
# https://www.linkedin.com/in/michael-wickerson-696a80156/
# https://www.grasshopper3d.com/profile/MichaelWickerson
geometry = Geometry(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)

# ----
# Wickerson Studio
# 
# created by: Michael Wickerson
# 
# Grasshopper for Rhino 3D Algorithmic Modeling
# 
# www.wickersonstudios.com
# www.michaelwickerson.com
# https://www.youtube.com/channel/UC7J48Ppcsa6oncp6d29R0xw
# https://github.com/mwickerson
# https://www.facebook.com/michael.wickerson
# https://www.linkedin.com/in/michael-wickerson-696a80156/
# https://www.grasshopper3d.com/profile/MichaelWickerson
# SETS TREE 082/1001
number_slider = Slider(10, range=0..10)
# 1001 GRASSHOPPER DEFINITIONS
series = Series(Start=0, Step=number_slider, Count=Slider(3, range=0..10))
cross_reference = CrossReference(ListListA=series, ListListB=series, ListA=series, CrossMode=1)  # -> ListListA, ListListB, ListA
construct_point = ConstructPoint(XCoordinate=cross_reference.ListListA, YCoordinate=cross_reference.ListListB, ZCoordinate=cross_reference.ListA)
panel = Panel(construct_point)
panel_2 = Panel("{0;0;1,8,...}[*]")
panel_3 = Panel("{0;0;2,4,...}[?]")
panel_4 = Panel("{0;0;1,4,...}[?]")
panel_5 = Panel("{0;0;2,6,...}[*]")
path_mapper = PathMapper(construct_point, source="{A;B}", target="{A;B}")
path_mapper_2 = PathMapper(construct_point, source="{A;B}(i)", target="{A;B;i}")
split_tree = SplitTree(Data=path_mapper_2, Masks=flatten("{0;0;1,8,...}[?]"))  # -> Positive, Negative
point_list = PointList(Points=split_tree.Positive, Size=3)
point = Point(flatten(split_tree.Negative))
point_2 = Point(flatten(split_tree.Positive))
nurbs_curve = NurbsCurve(Vertices=point_2, Degree=3, Periodic=False)  # -> Curve, Length, Domain
nurbs_curve_2 = NurbsCurve(Vertices=point, Degree=3, Periodic=False)  # -> Curve, Length, Domain
relative_item = RelativeItem(WrapPaths=False, WrapItems=False)  # -> ItemA, ItemB
divide_curve = DivideCurve(Curve=nurbs_curve.Curve, Count=10, Kinks=False)  # -> Points, Tangents, Parameters
divide_curve_2 = DivideCurve(Curve=nurbs_curve_2.Curve, Count=10, Kinks=False)  # -> Points, Tangents, Parameters
line = Line(StartPoint=divide_curve.Points, EndPoint=divide_curve_2.Points)
range = Range(Domain=Domain(0, 1), Steps=Slider(7, range=0..10))
graph_mapper = GraphMapper(
    range,
    x0=0,
    x1=1,
    y0=0,
    y1=2,
    container_name="Sine",
    Equation_px=[0, 0.1411362737],
    Equation_py=[0.3436259627, 0.8043813705])
merge = Merge(Data1=nurbs_curve.Curve, Data2=line, Data3=nurbs_curve_2.Curve)  # -> flatten(Result)
# GH solution
# VB
# C#
# Python with RhinoCommon Only
# Pythong with RhinoScriptSyntax
# GH solution
# VB
# C#
# Python
# VB
pipe_variable = PipeVariable(Curve=reparameterize(merge), Parameters=range, Radii=graph_mapper, Caps=2)
param_viewer = ParamViewer(split_tree.Positive)
# rc
# rs
# Full multiplicity knots at start
# Simple knots
# Full multiplicity knots at end
# P1
# A=0.2*P1+ 0.8*P2
# D=0.2*A + 0.8*B
# P2
# B=0.47*P2 + 0.53*P3
# Full multiplicity knots at start
# E=0.7*B + 0.3*C
# P3
# Full multiplicity knots in the middle
# C=0.8*P3 + 0.2*P4
# P4
# Full multiplicity knots at end
# Compare knot spacing
panel_6 = Panel(split_tree.Positive)
