# Grasshopper definition SetsTree083dGOODONEb.gh (Grasshopper 1.0.7)
# Copyright: Wickerson Studios
# plug-ins: Bifocals, FologramForGrasshopper

# 1001 GRASSHOPPER DEFINITIONS
# Wickerson Studio
# 
# created by: Michael Wickerson
# 
# Grasshopper for Rhino 3D Algorithmic Modeling
# 
# www.wickersonstudios.com
# www.michaelwickerson.com
# https://www.youtube.com/channel/UC7J48Ppcsa6oncp6d29R0xw
# https://github.com/mwickerson
# https://www.facebook.com/michael.wickerson
# https://www.linkedin.com/in/michael-wickerson-696a80156/
# https://www.grasshopper3d.com/profile/MichaelWickerson
image_sampler = ImageSampler(
    FilePath="C:\Users\Sculpture\Documents\2020Grasshopper\ScreenShots2019\Screenshots2020\SurfaceEditAlgorithm.PNG",
    Filter="Value",
    Interpolate=False,
    Umax=1,
    Umin=0,
    Vmax=1,
    Vmin=0,
    Wrap=1)
# Wickerson Studio
# created by: Michael Wickerson
# Grasshopper for Rhino 3D Algorithmic Modeling
# www.wickersonstudios.com
# www.michaelwickerson.com
# https://www.youtube.com/channel/UC7J48Ppcsa6oncp6d29R0xw
# https://github.com/mwickerson
# https://www.facebook.com/michael.wickerson
# https://www.linkedin.com/in/michael-wickerson-696a80156/
# https://www.grasshopper3d.com/profile/MichaelWickerson
geometry = Geometry(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)
number_slider = Slider(120, range=0..120)
# SETS TREE 084/1001
number_slider_2 = Slider(3, range=0..10)
number_slider_3 = Slider(6, range=0..100)
number_slider_4 = Slider(16, range=0..100)
series = Series(Start=0, Step=number_slider, Count=number_slider_2)
sphere = Sphere(Base=PlaneXY(0, 0, 0), Radius=number_slider)
cylinder = Cylinder(Base=PlaneXY(0, 0, 0), Radius=number_slider, Length=number_slider)
cross_reference = CrossReference(ListListA=series, ListListB=series, ListA=series, CrossMode=1)  # -> ListListA, ListListB, ListA
divide_surface = DivideSurface(Surface=sphere, UCount=number_slider_3, VCount=number_slider_4)  # -> Points, Normals, Parameters
construct_point = ConstructPoint(XCoordinate=cross_reference.ListListA, YCoordinate=cross_reference.ListListB, ZCoordinate=cross_reference.ListA)
panel = Panel(divide_surface.Points)
param_viewer = ParamViewer(divide_surface.Points)
panel_2 = Panel("{0;0;2,6,...}[*]")
panel_3 = Panel("{0;0;1,4,...,8}[*]")
panel_4 = Panel("{0;0;1,4,...}[?]")
panel_5 = Panel("{0;0;2,4,...}[?]")
path_mapper = PathMapper(divide_surface.Points, source="{A;B;C}", target="{A;B;C}")
path_mapper_2 = PathMapper(divide_surface.Points, source="{A;B;C}(i)", target="{A;B;C;i}")
number_slider_5 = Slider(0.18, range=0..1)
split_tree = SplitTree(Data=path_mapper, Masks=flatten("{0;0;1,8,...}[?]"))  # -> Positive, Negative
param_viewer_2 = ParamViewer(path_mapper_2)
point = Point(flatten(split_tree.Positive))
jitter = Jitter(List=point, Jitter=number_slider_5, Seed=2)  # -> Values, Indices
number_slider_6 = Slider(100, range=0..100)
point_2 = Point(flatten(split_tree.Negative))
panel_6 = Panel(path_mapper)
point_list = PointList(Points=split_tree.Negative, Size=3)
nurbs_curve = NurbsCurve(Vertices=jitter.Values, Degree=3, Periodic=False)  # -> Curve, Length, Domain
nurbs_curve_2 = NurbsCurve(Vertices=point_2, Degree=3, Periodic=False)  # -> Curve, Length, Domain
relative_item = RelativeItem(WrapPaths=False, WrapItems=False)  # -> ItemA, ItemB
divide_curve = DivideCurve(Curve=nurbs_curve.Curve, Count=number_slider_6, Kinks=False)  # -> Points, Tangents, Parameters
number_slider_7 = Slider(7, range=0..10)
divide_curve_2 = DivideCurve(Curve=nurbs_curve_2.Curve, Count=number_slider_6, Kinks=False)  # -> Points, Tangents, Parameters
number_slider_8 = Slider(0.287, range=0..1)
line = Line(StartPoint=divide_curve.Points, EndPoint=divide_curve_2.Points)
range = Range(Domain=Domain(0, 1), Steps=number_slider_7)
sync_parameters = SyncParameters(
    augmented_trigger_0_key=number_slider_2,
    augmented_trigger_1_key=number_slider,
    augmented_trigger_2_key=number_slider_7,
    augmented_trigger_3_key=number_slider_3,
    augmented_trigger_4_key=number_slider_4,
    augmented_trigger_5_key=number_slider_6,
    augmented_trigger_6_key=number_slider_5,
    augmented_trigger_7_key=number_slider_8,
    componentVersion=1,
    num_augmented_triggers=8)
graph_mapper = GraphMapper(
    range,
    x0=0,
    x1=1,
    y0=0,
    y1=3,
    Ox=0.5225144029,
    Oy=0.3233904839,
    Px=0.6255613565,
    Py=0.5451327562,
    container_name="Parabola")
merge = Merge(Data1=nurbs_curve.Curve, Data2=line, Data3=nurbs_curve_2.Curve)  # -> flatten(Result)
pipe_variable = PipeVariable(Curve=reparameterize(merge), Parameters=range, Radii=graph_mapper, Caps=2)
construct_domain = ConstructDomain(DomainStart=0, DomainEnd=number_slider_8)
param_viewer_3 = ParamViewer(split_tree.Positive)
pi = Pi(Factor=construct_domain)
rotate_3d = Rotate3D(Geometry=pipe_variable, Angle=pi, Center=Point(0, 0, 0), Axis=Vector(0, 0, 1))  # -> Geometry, Transform
panel_7 = Panel(split_tree.Positive)
# rc
# rs
# Full multiplicity knots at start
# Simple knots
# Full multiplicity knots at end
# P1
# A=0.2*P1+ 0.8*P2
# D=0.2*A + 0.8*B
# P2
# B=0.47*P2 + 0.53*P3
# Full multiplicity knots at start
# E=0.7*B + 0.3*C
# P3
# Full multiplicity knots in the middle
# C=0.8*P3 + 0.2*P4
# P4
# Full multiplicity knots at end
# Compare knot spacing
# GH solution
# VB
# C#
# Python with RhinoCommon Only
# Pythong with RhinoScriptSyntax
# GH solution
# VB
# C#
# Python
# VB
sync_object = SyncObject(
    GM=rotate_3d.Geometry,
    AlwaysIncludeTextureCoordinates=False,
    Clickable=False,
    DefaultCurveThicknessMillimeters=2.5,
    DefaultGlossPercent=0,
    DefaultMaterialColor=RGB(255, 255, 255),
    DefaultSpecularPercent=0,
    Interactive=False,
    hasSerializedData=True)
