# Grasshopper definition SetsTree083dGOODONEc.gh (Grasshopper 1.0.7)
# Copyright: Wickerson Studios
# plug-ins: Bifocals

# 1001 GRASSHOPPER DEFINITIONS
# Wickerson Studio
# 
# created by: Michael Wickerson
# 
# Grasshopper for Rhino 3D Algorithmic Modeling
# 
# www.wickersonstudios.com
# www.michaelwickerson.com
# https://www.youtube.com/channel/UC7J48Ppcsa6oncp6d29R0xw
# https://github.com/mwickerson
# https://www.facebook.com/michael.wickerson
# https://www.linkedin.com/in/michael-wickerson-696a80156/
# https://www.grasshopper3d.com/profile/MichaelWickerson
image_sampler = ImageSampler(
    FilePath="C:\Users\Sculpture\Documents\2020Grasshopper\ScreenShots2019\Screenshots2020\SurfaceEditAlgorithm.PNG",
    Filter="Value",
    Interpolate=False,
    Umax=1,
    Umin=0,
    Vmax=1,
    Vmin=0,
    Wrap=1)
# Wickerson Studio
# created by: Michael Wickerson
# Grasshopper for Rhino 3D Algorithmic Modeling
# www.wickersonstudios.com
# www.michaelwickerson.com
# https://www.youtube.com/channel/UC7J48Ppcsa6oncp6d29R0xw
# https://github.com/mwickerson
# https://www.facebook.com/michael.wickerson
# https://www.linkedin.com/in/michael-wickerson-696a80156/
# https://www.grasshopper3d.com/profile/MichaelWickerson
geometry = Geometry(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)

number_slider = Slider(361, range=0..2000)
# SETS TREE 084/1001
mesh = Mesh(<mesh referenced from the Rhino model>)
mesh_2 = Mesh(<mesh referenced from the Rhino model>)
deconstruct_mesh = DeconstructMesh(Mesh=mesh)  # -> Vertices, Faces, Colours, Normals
deconstruct_mesh_2 = DeconstructMesh(Mesh=mesh_2)  # -> Vertices, Faces, Colours, Normals
random_reduce = RandomReduce(List=deconstruct_mesh.Vertices, Reduction=number_slider, Seed=number_slider)
random_reduce_2 = RandomReduce(List=deconstruct_mesh_2.Vertices, Reduction=Slider(1497, range=0..2000), Seed=number_slider)
panel = Panel("{0;0;1,8,...}[?]")
panel_2 = Panel("{0;0;1,4,...,8}[*]")
panel_3 = Panel("{0;0;1,4,...}[?]")
path_mapper = PathMapper(random_reduce, source="{A;B;C}", target="{A;B;C}")
path_mapper_2 = PathMapper(random_reduce_2, source="{A;B;C}", target="{A;B;C}")
split_tree = SplitTree(Data=path_mapper, Masks=flatten("{0;0;2,4,...}[?]"))  # -> Positive, Negative
split_tree_2 = SplitTree(Data=path_mapper_2, Masks=flatten("{0;0;2,6,...}[*]"))  # -> Positive, Negative
point = Point(flatten(split_tree_2.Negative))
point_2 = Point(flatten(split_tree.Negative))
nurbs_curve = NurbsCurve(Vertices=point, Degree=3, Periodic=False)  # -> Curve, Length, Domain
range = Range(Domain=Domain(0, 1), Steps=Slider(30, range=0..30))
range_2 = Range(Domain=Domain(0, 1), Steps=Slider(30, range=0..30))
nurbs_curve_2 = NurbsCurve(Vertices=point_2, Degree=3, Periodic=False)  # -> Curve, Length, Domain
graph_mapper = GraphMapper(
    range,
    x0=0,
    x1=1,
    y0=0,
    y1=2,
    Ox=0.5225144029,
    Oy=0.3233904839,
    Px=0.6496350169,
    Py=0.3874345422,
    container_name="Parabola")
graph_mapper_2 = GraphMapper(
    range_2,
    x0=0,
    x1=1,
    y0=0,
    y1=2,
    Ox=0.5225144029,
    Oy=0.3233904839,
    Px=0.6994397044,
    Py=0.3914391994,
    container_name="Parabola")
merge = Merge(Data3=nurbs_curve.Curve)  # -> flatten(Result)
merge_2 = Merge(Data3=nurbs_curve_2.Curve)  # -> flatten(Result)
pipe_variable = PipeVariable(Curve=reparameterize(merge_2), Parameters=range_2, Radii=graph_mapper_2, Caps=2)
# rc
# rs
# Full multiplicity knots at start
# Simple knots
# Full multiplicity knots at end
# P1
# A=0.2*P1+ 0.8*P2
# D=0.2*A + 0.8*B
# P2
# B=0.47*P2 + 0.53*P3
# Full multiplicity knots at start
# E=0.7*B + 0.3*C
# P3
# Full multiplicity knots in the middle
# C=0.8*P3 + 0.2*P4
# P4
# Full multiplicity knots at end
# Compare knot spacing
# GH solution
# VB
# C#
# Python with RhinoCommon Only
# Pythong with RhinoScriptSyntax
# GH solution
# VB
# C#
# Python
# VB
pipe_variable_2 = PipeVariable(Curve=reparameterize(merge), Parameters=range, Radii=graph_mapper, Caps=2)
