# Grasshopper definition SetsTree085.gh (Grasshopper 1.0.7)
# Copyright: Wickerson Studios
# plug-ins: Bifocals, FologramForGrasshopper

# 1001 GRASSHOPPER DEFINITIONS
# Wickerson Studio
# 
# created by: Michael Wickerson
# 
# Grasshopper for Rhino 3D Algorithmic Modeling
# 
# www.wickersonstudios.com
# www.michaelwickerson.com
# https://www.youtube.com/channel/UC7J48Ppcsa6oncp6d29R0xw
# https://github.com/mwickerson
# https://www.facebook.com/michael.wickerson
# https://www.linkedin.com/in/michael-wickerson-696a80156/
# https://www.grasshopper3d.com/profile/MichaelWickerson
image_sampler = ImageSampler(
    FilePath="C:\Users\Sculpture\Documents\2020Grasshopper\ScreenShots2019\Screenshots2020\SurfaceEditAlgorithm.PNG",
    Filter="Value",
    Interpolate=False,
    Umax=1,
    Umin=0,
    Vmax=1,
    Vmin=0,
    Wrap=1)
# Wickerson Studio
# created by: Michael Wickerson
# Grasshopper for Rhino 3D Algorithmic Modeling
# www.wickersonstudios.com
# www.michaelwickerson.com
# https://www.youtube.com/channel/UC7J48Ppcsa6oncp6d29R0xw
# https://github.com/mwickerson
# https://www.facebook.com/michael.wickerson
# https://www.linkedin.com/in/michael-wickerson-696a80156/
# https://www.grasshopper3d.com/profile/MichaelWickerson
geometry = Geometry(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)

# ----
# SETS TREE 085/1001
number_slider = Slider(28, range=0..100)
construct_point = ConstructPoint(XCoordinate=0, YCoordinate=0, ZCoordinate=0)
negative = Negative(Value=number_slider)
negative_2 = Negative(Value=Slider(48, range=0..100))
unit_y = UnitY(Factor=1)
center_box = CenterBox(Base=PlaneXY(0, 0, 0), X=negative, Y=negative, Z=negative_2)
pi = Pi(Factor=Slider(0.33, range=0..2))
line_sdl = LineSDL(Start=construct_point, Direction=unit_y, Length=1)
volume = Volume(Geometry=center_box)  # -> Volume, Centroid
rotate_3d = Rotate3D(Geometry=center_box, Angle=pi, Center=volume.Centroid, Axis=line_sdl)  # -> Geometry, Transform
gravity = Gravity(Vector(0, 0, -1))
deconstruct_brep = DeconstructBrep(Brep=rotate_3d.Geometry)  # -> Faces, Edges, flatten(Vertices)
negative_3 = Negative(Value=gravity)
point = Point(deconstruct_brep.Vertices)
unit_z = UnitZ(Factor=Slider(100, range=0..100))
negative_4 = Negative(Value=unit_z)
number_slider_2 = Slider(100, range=0..100)
negative_5 = Negative(Value=number_slider_2)
construct_domain = ConstructDomain(DomainStart=negative_5, DomainEnd=number_slider_2)

populate_3d = Populate3D(Region=center_box, Count=Slider(5, range=-1..10), Seed=1)  # -> graft(Population)
voronoi_3d = Voronoi3D(Points=populate_3d, Box=center_box)  # -> Cells, Boundary
panel = Panel(populate_3d)
param_viewer = ParamViewer(populate_3d)
mesh_edges = MeshEdges(Mesh=voronoi_3d.Cells)  # -> NakedEdges, InteriorEdges, NonManifoldEdges

catenary = Catenary(PointA=point, PointB=populate_3d, Length=Slider(115, range=0..200), Gravity=negative_3)
panel_2 = Panel(catenary)
cull_index = CullIndex(List=catenary, Indices=Slider(2, range=0..10), Wrap=True)
end_points = EndPoints(Curve=catenary)  # -> Start, End
move = Move(Geometry=[end_points.Start, end_points.End], Motion=negative_4)  # -> Geometry, Transform
merge = Merge(Data1=end_points.Start, Data2=end_points.End)
point_2 = Point(flatten(move.Geometry))
deconstruct = Deconstruct(Point=point_2)  # -> XComponent, YComponent, ZComponent
sort_list = SortList(Keys=deconstruct.ZComponent, ValuesA=deconstruct.ZComponent)  # -> Keys, ValuesA
line = Line(StartPoint=merge, EndPoint=move.Geometry)
merge_2 = Merge(Data1=line, Data2=cull_index)
list_item = ListItem(List=sort_list.ValuesA, Index=-1, Wrap=True)
construct_point_2 = ConstructPoint(XCoordinate=0, YCoordinate=0, ZCoordinate=list_item)
panel_3 = Panel(sort_list.ValuesA)
pipe = Pipe(Curve=merge_2, Radius=1, Caps=2)  # -> graft(Pipe)
plane_origin = PlaneOrigin(Base=construct_point_2, Origin=construct_point_2)
panel_4 = Panel(pipe)
rectangle = Rectangle(Plane=plane_origin, XSize=construct_domain, YSize=construct_domain, Radius=0)  # -> Rectangle, Length
boundary_surfaces = BoundarySurfaces(Edges=rectangle.Rectangle)
solid_union = SolidUnion(Breps=pipe)
param_viewer_2 = ParamViewer(pipe)
split_brep = SplitBrep(Brep=solid_union, Cutter=boundary_surfaces)
dispatch = Dispatch(List=split_brep, DispatchPattern=[True, False])  # -> ListA, ListB
geometry_2 = Geometry(dispatch.ListB)
geometry_3 = Geometry(dispatch.ListA)

range = Range(Domain=Domain(0, 1), Steps=10)
graph_mapper = GraphMapper(
    range,
    x0=0,
    x1=1,
    y0=0,
    y1=3,
    Ox=0.5565220714,
    Oy=0.3450775743,
    Px=0.3014499843,
    Py=0.5150260329,
    container_name="Parabola")
pipe_variable = PipeVariable(Curve=reparameterize(cull_index), Parameters=range, Radii=graph_mapper, Caps=2)  # disabled

# ----
# rc
# rs
# Full multiplicity knots at start
# Simple knots
# Full multiplicity knots at end
# P1
# A=0.2*P1+ 0.8*P2
# D=0.2*A + 0.8*B
# P2
# B=0.47*P2 + 0.53*P3
# Full multiplicity knots at start
# E=0.7*B + 0.3*C
# P3
# Full multiplicity knots in the middle
# C=0.8*P3 + 0.2*P4
# P4
# Full multiplicity knots at end
# Compare knot spacing
# GH solution
# VB
# C#
# Python with RhinoCommon Only
# Pythong with RhinoScriptSyntax
# GH solution
# VB
# C#
# Python
# VB
sync_object = SyncObject(
    GM=geometry_3,
    AlwaysIncludeTextureCoordinates=False,
    Clickable=False,
    DefaultCurveThicknessMillimeters=2.5,
    DefaultGlossPercent=0,
    DefaultMaterialColor=RGB(255, 255, 255),
    DefaultSpecularPercent=0,
    Interactive=False,
    hasSerializedData=True)
