# Grasshopper definition SetsTree086.gh (Grasshopper 1.0.7)
# Copyright: Wickerson Studios
# plug-ins: Bifocals

# 1001 GRASSHOPPER DEFINITIONS
# Wickerson Studio
# 
# created by: Michael Wickerson
# 
# Grasshopper for Rhino 3D Algorithmic Modeling
# 
# www.wickersonstudios.com
# www.michaelwickerson.com
# https://www.youtube.com/channel/UC7J48Ppcsa6oncp6d29R0xw
# https://github.com/mwickerson
# https://www.facebook.com/michael.wickerson
# https://www.linkedin.com/in/michael-wickerson-696a80156/
# https://www.grasshopper3d.com/profile/MichaelWickerson
image_sampler = ImageSampler(
    FilePath="C:\Users\Sculpture\Documents\2020Grasshopper\ScreenShots2019\Screenshots2020\SurfaceEditAlgorithm.PNG",
    Filter="Value",
    Interpolate=False,
    Umax=1,
    Umin=0,
    Vmax=1,
    Vmin=0,
    Wrap=1)
# Wickerson Studio
# created by: Michael Wickerson
# Grasshopper for Rhino 3D Algorithmic Modeling
# www.wickersonstudios.com
# www.michaelwickerson.com
# https://www.youtube.com/channel/UC7J48Ppcsa6oncp6d29R0xw
# https://github.com/mwickerson
# https://www.facebook.com/michael.wickerson
# https://www.linkedin.com/in/michael-wickerson-696a80156/
# https://www.grasshopper3d.com/profile/MichaelWickerson
geometry = Geometry(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)
# SETS TREE 086/1001
number_slider = Slider(436, range=0..2000)

number_slider_2 = Slider(1497, range=0..2000)
number_slider_3 = Slider(1076, range=0..2000)
mesh = Mesh(<mesh referenced from the Rhino model>)
mesh_2 = Mesh(<mesh referenced from the Rhino model>)
deconstruct_mesh = DeconstructMesh(Mesh=mesh)  # -> Vertices, Faces, Colours, Normals
deconstruct_mesh_2 = DeconstructMesh(Mesh=mesh_2)  # -> Vertices, Faces, Colours, Normals
random_reduce = RandomReduce(List=deconstruct_mesh.Vertices, Reduction=number_slider, Seed=number_slider_3)
random_reduce_2 = RandomReduce(List=deconstruct_mesh_2.Vertices, Reduction=number_slider_2, Seed=number_slider_3)
panel = Panel("{0;0;1,8,...}[?]")
panel_2 = Panel("{0;0;1,4,...,8}[*]")
panel_3 = Panel("{0;0;1,4,...}[?]")
path_mapper = PathMapper(random_reduce, source="{A;B;C}", target="{A;B;C}")
path_mapper_2 = PathMapper(random_reduce_2, source="{A;B;C}", target="{A;B;C}")
split_tree = SplitTree(Data=path_mapper, Masks=flatten("{0;0;2,4,...}[?]"))  # -> Positive, Negative
split_tree_2 = SplitTree(Data=path_mapper_2, Masks=flatten("{0;0;2,6,...}[*]"))  # -> Positive, Negative
point = Point(flatten(split_tree_2.Negative))
point_2 = Point(flatten(split_tree.Negative))
nurbs_curve = NurbsCurve(Vertices=point, Degree=3, Periodic=False)  # -> Curve, Length, Domain
range = Range(Domain=Domain(0, 1), Steps=Slider(30, range=0..30))
range_2 = Range(Domain=Domain(0, 1), Steps=Slider(30, range=0..30))
nurbs_curve_2 = NurbsCurve(Vertices=point_2, Degree=3, Periodic=False)  # -> Curve, Length, Domain
graph_mapper = GraphMapper(
    range,
    x0=0,
    x1=1,
    y0=0,
    y1=2,
    Ox=0.5225144029,
    Oy=0.3233904839,
    Px=0.6496350169,
    Py=0.3874345422,
    container_name="Parabola")
merge = Merge(Data3=nurbs_curve.Curve)  # -> flatten(Result)
graph_mapper_2 = GraphMapper(
    range_2,
    x0=0,
    x1=1,
    y0=0,
    y1=2,
    Ox=0.5225144029,
    Oy=0.3233904839,
    Px=0.6994397044,
    Py=0.3914391994,
    container_name="Parabola")
merge_2 = Merge(Data3=nurbs_curve_2.Curve)  # -> flatten(Result)
pipe_variable = PipeVariable(Curve=reparameterize(merge_2), Parameters=range_2, Radii=graph_mapper_2, Caps=2)
# rc
# rs
pipe_variable_2 = PipeVariable(Curve=reparameterize(merge), Parameters=range, Radii=graph_mapper, Caps=2)

mesh_3 = Mesh(<mesh referenced from the Rhino model>)
mesh_4 = Mesh(<mesh referenced from the Rhino model>)
mesh_5 = Mesh(<mesh referenced from the Rhino model>)
mesh_6 = Mesh(<mesh referenced from the Rhino model>)
mesh_7 = Mesh([<mesh referenced from the Rhino model> x2])
mesh_8 = Mesh([<mesh referenced from the Rhino model> x2])
mesh_9 = Mesh(<mesh referenced from the Rhino model>)
mesh_10 = Mesh(<mesh referenced from the Rhino model>)
deconstruct_mesh_3 = DeconstructMesh(Mesh=mesh_3)  # -> Vertices, Faces, Colours, Normals
deconstruct_mesh_4 = DeconstructMesh(Mesh=mesh_4)  # -> Vertices, Faces, Colours, Normals
mesh_11 = Mesh([<mesh referenced from the Rhino model> x2])
mesh_12 = Mesh([<mesh referenced from the Rhino model> x2])
deconstruct_mesh_5 = DeconstructMesh(Mesh=mesh_5)  # -> Vertices, Faces, Colours, Normals
deconstruct_mesh_6 = DeconstructMesh(Mesh=mesh_6)  # -> Vertices, Faces, Colours, Normals
deconstruct_mesh_7 = DeconstructMesh(Mesh=mesh_7)  # -> flatten(Vertices), Faces, Colours, Normals
deconstruct_mesh_8 = DeconstructMesh(Mesh=mesh_8)  # -> flatten(Vertices), Faces, Colours, Normals
deconstruct_mesh_9 = DeconstructMesh(Mesh=mesh_9)  # -> Vertices, Faces, Colours, Normals
deconstruct_mesh_10 = DeconstructMesh(Mesh=mesh_10)  # -> Vertices, Faces, Colours, Normals
deconstruct_mesh_11 = DeconstructMesh(Mesh=mesh_11)  # -> flatten(Vertices), Faces, Colours, Normals
deconstruct_mesh_12 = DeconstructMesh(Mesh=mesh_12)  # -> flatten(Vertices), Faces, Colours, Normals
random_reduce_3 = RandomReduce(List=deconstruct_mesh_3.Vertices, Reduction=number_slider_2, Seed=number_slider_3)
random_reduce_4 = RandomReduce(List=deconstruct_mesh_4.Vertices, Reduction=number_slider_2, Seed=number_slider_3)
random_reduce_5 = RandomReduce(List=deconstruct_mesh_5.Vertices, Reduction=number_slider_2, Seed=number_slider_3)
random_reduce_6 = RandomReduce(List=deconstruct_mesh_6.Vertices, Reduction=number_slider_2, Seed=number_slider_3)
random_reduce_7 = RandomReduce(List=deconstruct_mesh_7.Vertices, Reduction=number_slider_2, Seed=number_slider_3)
random_reduce_8 = RandomReduce(List=deconstruct_mesh_8.Vertices, Reduction=number_slider_2, Seed=number_slider_3)
random_reduce_9 = RandomReduce(List=deconstruct_mesh_9.Vertices, Reduction=number_slider_2, Seed=number_slider_3)
random_reduce_10 = RandomReduce(List=deconstruct_mesh_10.Vertices, Reduction=number_slider_2, Seed=number_slider_3)
random_reduce_11 = RandomReduce(List=deconstruct_mesh_11.Vertices, Reduction=number_slider_2, Seed=number_slider_3)
random_reduce_12 = RandomReduce(List=deconstruct_mesh_12.Vertices, Reduction=number_slider_2, Seed=number_slider_3)
path_mapper_3 = PathMapper(random_reduce_3, source="{A;B;C}", target="{A;B;C}")
path_mapper_4 = PathMapper(random_reduce_4, source="{A;B;C}", target="{A;B;C}")
path_mapper_5 = PathMapper(random_reduce_5, source="{A;B;C}", target="{A;B;C}")
path_mapper_6 = PathMapper(random_reduce_6, source="{A;B;C}", target="{A;B;C}")
path_mapper_7 = PathMapper(random_reduce_7, source="{A;B}", target="{A;B}")
path_mapper_8 = PathMapper(random_reduce_8, source="{A;B}", target="{A;B}")
path_mapper_9 = PathMapper(random_reduce_9, source="{A;B;C}", target="{A;B;C}")
path_mapper_10 = PathMapper(random_reduce_10, source="{A;B;C}", target="{A;B;C}")
path_mapper_11 = PathMapper(random_reduce_11, source="{A;B}", target="{A;B}")
path_mapper_12 = PathMapper(random_reduce_12, source="{A;B}", target="{A;B}")
split_tree_3 = SplitTree(Data=path_mapper_3, Masks=flatten("{0;0;2,6,...}[*]"))  # -> Positive, Negative
split_tree_4 = SplitTree(Data=path_mapper_4, Masks=flatten("{0;0;2,6,...}[*]"))  # -> Positive, Negative
split_tree_5 = SplitTree(Data=path_mapper_5, Masks=flatten("{0;0;2,6,...}[*]"))  # -> Positive, Negative
split_tree_6 = SplitTree(Data=path_mapper_6, Masks=flatten("{0;0;2,6,...}[*]"))  # -> Positive, Negative
split_tree_7 = SplitTree(Data=path_mapper_7, Masks=flatten("{0;0;2,6,...}[*]"))  # -> Positive, Negative
split_tree_8 = SplitTree(Data=path_mapper_8, Masks=flatten("{0;0;2,6,...}[*]"))  # -> Positive, Negative
split_tree_9 = SplitTree(Data=path_mapper_9, Masks=flatten("{0;0;2,6,...}[*]"))  # -> Positive, Negative
split_tree_10 = SplitTree(Data=path_mapper_10, Masks=flatten("{0;0;2,6,...}[*]"))  # -> Positive, Negative
split_tree_11 = SplitTree(Data=path_mapper_11, Masks=flatten("{0;0;2,6,...}[*]"))  # -> Positive, Negative
split_tree_12 = SplitTree(Data=path_mapper_12, Masks=flatten("{0;0;2,6,...}[*]"))  # -> Positive, Negative
point_3 = Point(flatten(split_tree_3.Negative))
point_4 = Point(flatten(split_tree_4.Negative))
point_5 = Point(flatten(split_tree_5.Negative))
point_6 = Point(flatten(split_tree_6.Negative))
point_7 = Point(flatten(split_tree_7.Negative))
point_8 = Point(flatten(split_tree_8.Negative))
point_9 = Point(flatten(split_tree_9.Negative))
point_10 = Point(flatten(split_tree_10.Negative))
nurbs_curve_3 = NurbsCurve(Vertices=point_3, Degree=3, Periodic=False)  # -> Curve, Length, Domain
range_3 = Range(Domain=Domain(0, 1), Steps=Slider(30, range=0..30))
nurbs_curve_4 = NurbsCurve(Vertices=point_4, Degree=3, Periodic=False)  # -> Curve, Length, Domain
range_4 = Range(Domain=Domain(0, 1), Steps=Slider(30, range=0..30))
point_11 = Point(flatten(split_tree_11.Negative))
point_12 = Point(flatten(split_tree_12.Negative))
nurbs_curve_5 = NurbsCurve(Vertices=point_5, Degree=3, Periodic=False)  # -> Curve, Length, Domain
range_5 = Range(Domain=Domain(0, 1), Steps=Slider(30, range=0..30))
nurbs_curve_6 = NurbsCurve(Vertices=point_6, Degree=3, Periodic=False)  # -> Curve, Length, Domain
range_6 = Range(Domain=Domain(0, 1), Steps=Slider(30, range=0..30))
nurbs_curve_7 = NurbsCurve(Vertices=point_7, Degree=3, Periodic=False)  # -> Curve, Length, Domain
range_7 = Range(Domain=Domain(0, 1), Steps=Slider(30, range=0..30))
nurbs_curve_8 = NurbsCurve(Vertices=point_8, Degree=3, Periodic=False)  # -> Curve, Length, Domain
range_8 = Range(Domain=Domain(0, 1), Steps=Slider(30, range=0..30))
nurbs_curve_9 = NurbsCurve(Vertices=point_9, Degree=3, Periodic=False)  # -> Curve, Length, Domain
range_9 = Range(Domain=Domain(0, 1), Steps=Slider(30, range=0..30))
nurbs_curve_10 = NurbsCurve(Vertices=point_10, Degree=3, Periodic=False)  # -> Curve, Length, Domain
range_10 = Range(Domain=Domain(0, 1), Steps=Slider(30, range=0..30))
nurbs_curve_11 = NurbsCurve(Vertices=point_11, Degree=3, Periodic=False)  # -> Curve, Length, Domain
range_11 = Range(Domain=Domain(0, 1), Steps=Slider(30, range=0..30))
nurbs_curve_12 = NurbsCurve(Vertices=point_12, Degree=3, Periodic=False)  # -> Curve, Length, Domain
range_12 = Range(Domain=Domain(0, 1), Steps=Slider(30, range=0..30))
graph_mapper_3 = GraphMapper(
    range_3,
    x0=0,
    x1=1,
    y0=0,
    y1=2,
    Ox=0.5225144029,
    Oy=0.3233904839,
    Px=0.6496350169,
    Py=0.3874345422,
    container_name="Parabola")
graph_mapper_4 = GraphMapper(
    range_4,
    x0=0,
    x1=1,
    y0=0,
    y1=2,
    Ox=0.5225144029,
    Oy=0.3233904839,
    Px=0.6496350169,
    Py=0.3874345422,
    container_name="Parabola")
merge_3 = Merge(Data3=nurbs_curve_3.Curve)  # -> flatten(Result)
merge_4 = Merge(Data3=nurbs_curve_4.Curve)  # -> flatten(Result)
graph_mapper_5 = GraphMapper(
    range_5,
    x0=0,
    x1=1,
    y0=0,
    y1=2,
    Ox=0.5225144029,
    Oy=0.3233904839,
    Px=0.6496350169,
    Py=0.3874345422,
    container_name="Parabola")
graph_mapper_6 = GraphMapper(
    range_6,
    x0=0,
    x1=1,
    y0=0,
    y1=2,
    Ox=0.5225144029,
    Oy=0.3233904839,
    Px=0.6496350169,
    Py=0.3874345422,
    container_name="Parabola")
merge_5 = Merge(Data3=nurbs_curve_5.Curve)  # -> flatten(Result)
merge_6 = Merge(Data3=nurbs_curve_6.Curve)  # -> flatten(Result)
graph_mapper_7 = GraphMapper(
    range_7,
    x0=0,
    x1=1,
    y0=0,
    y1=2,
    Ox=0.5225144029,
    Oy=0.3233904839,
    Px=0.6496350169,
    Py=0.3874345422,
    container_name="Parabola")
graph_mapper_8 = GraphMapper(
    range_8,
    x0=0,
    x1=1,
    y0=0,
    y1=2,
    Ox=0.5225144029,
    Oy=0.3233904839,
    Px=0.6496350169,
    Py=0.3874345422,
    container_name="Parabola")
merge_7 = Merge(Data3=nurbs_curve_7.Curve)  # -> flatten(Result)
merge_8 = Merge(Data3=nurbs_curve_8.Curve)  # -> flatten(Result)
graph_mapper_9 = GraphMapper(
    range_9,
    x0=0,
    x1=1,
    y0=0,
    y1=2,
    Ox=0.5225144029,
    Oy=0.3233904839,
    Px=0.6496350169,
    Py=0.3874345422,
    container_name="Parabola")
graph_mapper_10 = GraphMapper(
    range_10,
    x0=0,
    x1=1,
    y0=0,
    y1=2,
    Ox=0.5225144029,
    Oy=0.3233904839,
    Px=0.6496350169,
    Py=0.3874345422,
    container_name="Parabola")
merge_9 = Merge(Data3=nurbs_curve_9.Curve)  # -> flatten(Result)
merge_10 = Merge(Data3=nurbs_curve_10.Curve)  # -> flatten(Result)
graph_mapper_11 = GraphMapper(
    range_11,
    x0=0,
    x1=1,
    y0=0,
    y1=2,
    Ox=0.5225144029,
    Oy=0.3233904839,
    Px=0.6496350169,
    Py=0.3874345422,
    container_name="Parabola")
merge_11 = Merge(Data3=nurbs_curve_11.Curve)  # -> flatten(Result)
merge_12 = Merge(Data3=nurbs_curve_12.Curve)  # -> flatten(Result)
graph_mapper_12 = GraphMapper(
    range_12,
    x0=0,
    x1=1,
    y0=0,
    y1=2,
    Ox=0.5225144029,
    Oy=0.3233904839,
    Px=0.6496350169,
    Py=0.3874345422,
    container_name="Parabola")
pipe_variable_3 = PipeVariable(Curve=reparameterize(merge_3), Parameters=range_3, Radii=graph_mapper_3, Caps=2)
pipe_variable_4 = PipeVariable(Curve=reparameterize(merge_4), Parameters=range_4, Radii=graph_mapper_4, Caps=2)
pipe_variable_5 = PipeVariable(Curve=reparameterize(merge_5), Parameters=range_5, Radii=graph_mapper_5, Caps=2)
pipe_variable_6 = PipeVariable(Curve=reparameterize(merge_6), Parameters=range_6, Radii=graph_mapper_6, Caps=2)
pipe_variable_7 = PipeVariable(Curve=reparameterize(merge_7), Parameters=range_7, Radii=graph_mapper_7, Caps=2)
pipe_variable_8 = PipeVariable(Curve=reparameterize(merge_8), Parameters=range_8, Radii=graph_mapper_8, Caps=2)
# Full multiplicity knots at start
# Simple knots
# Full multiplicity knots at end
# P1
# A=0.2*P1+ 0.8*P2
# D=0.2*A + 0.8*B
# P2
# B=0.47*P2 + 0.53*P3
# Full multiplicity knots at start
# E=0.7*B + 0.3*C
# P3
# Full multiplicity knots in the middle
# C=0.8*P3 + 0.2*P4
# P4
# Full multiplicity knots at end
pipe_variable_9 = PipeVariable(Curve=reparameterize(merge_9), Parameters=range_9, Radii=graph_mapper_9, Caps=2)
pipe_variable_10 = PipeVariable(Curve=reparameterize(merge_10), Parameters=range_10, Radii=graph_mapper_10, Caps=2)
# Compare knot spacing
pipe_variable_11 = PipeVariable(Curve=reparameterize(merge_11), Parameters=range_11, Radii=graph_mapper_11, Caps=2)
# GH solution
# VB
# C#
# Python with RhinoCommon Only
# Pythong with RhinoScriptSyntax
# GH solution
# VB
# C#
# Python
# VB
pipe_variable_12 = PipeVariable(Curve=reparameterize(merge_12), Parameters=range_12, Radii=graph_mapper_12, Caps=2)
