# Grasshopper definition SetsTree087(ComplexNumbers55e).gh (Grasshopper 1.0.7)
# Copyright: Wickerson Studios
# plug-ins: Bifocals

image_sampler = ImageSampler(
    FilePath="C:\Users\Sculpture\Documents\2020Grasshopper\ScreenShots2019\Screenshots2020\SurfaceEditAlgorithm.PNG",
    Filter="Value",
    Interpolate=False,
    Umax=1,
    Umin=0,
    Vmax=1,
    Vmin=0,
    Wrap=1)
# Wickerson Studio
# created by: Michael Wickerson
# Grasshopper for Rhino 3D Algorithmic Modeling
# www.wickersonstudios.com
# www.michaelwickerson.com
# https://www.youtube.com/channel/UC7J48Ppcsa6oncp6d29R0xw
# https://github.com/mwickerson
# https://www.facebook.com/michael.wickerson
# https://www.linkedin.com/in/michael-wickerson-696a80156/
# https://www.grasshopper3d.com/profile/MichaelWickerson
geometry = Geometry(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)

# ----
# 1001 GRASSHOPPER DEFINITIONS
# Wickerson Studio
# 
# created by: Michael Wickerson
# 
# Grasshopper for Rhino 3D Algorithmic Modeling
# 
# www.wickersonstudios.com
# www.michaelwickerson.com
# https://www.youtube.com/channel/UC7J48Ppcsa6oncp6d29R0xw
# https://github.com/mwickerson
# https://www.facebook.com/michael.wickerson
# https://www.linkedin.com/in/michael-wickerson-696a80156/
# https://www.grasshopper3d.com/profile/MichaelWickerson
# SETS TREE 087/1001 (COMPLEX NUMBERS 55e)
complex_argument = ComplexArgument()
complex_components = ComplexComponents()  # -> Real, Imaginary
create_complex = CreateComplex(Real=0, Imaginary=0)
complex_modulus = ComplexModulus()
complex_conjugate = ComplexConjugate()

create_complex_2 = CreateComplex(Real=Slider(5.84, range=0..10), Imaginary=Slider(8.18, range=0..10))
complex_conjugate_2 = ComplexConjugate(Complex=create_complex_2)
complex_components_2 = ComplexComponents(Complex=create_complex_2)  # -> Real, Imaginary
complex_modulus_2 = ComplexModulus(Complex=create_complex_2)
construct_path = ConstructPath(Indices=create_complex_2)
complex_argument_2 = ComplexArgument(Complex=create_complex_2)
deconstruct_path = DeconstructPath(Branch=create_complex_2)
panel = Panel(create_complex_2)
panel_2 = Panel(deconstruct_path)
panel_3 = Panel(construct_path)
panel_4 = Panel(complex_conjugate_2)
panel_5 = Panel(complex_modulus_2)
panel_6 = Panel(complex_components_2.Real)
panel_7 = Panel(complex_components_2.Imaginary)
panel_8 = Panel(complex_argument_2)
number_slider = Slider(3, range=0..10)
param_viewer = ParamViewer(deconstruct_path)
param_viewer_2 = ParamViewer(deconstruct_path)
param_viewer_3 = ParamViewer(construct_path)
cylinder = Cylinder(Base=PlaneXY(0, 0, 0), Radius=panel_2, Length=panel_2)
cylinder_2 = Cylinder(Base=PlaneXY(0, 0, 0), Radius=panel_7, Length=panel_7)
cylinder_3 = Cylinder(Base=PlaneXY(0, 0, 0), Radius=panel_5, Length=panel_5)
cylinder_4 = Cylinder(Base=PlaneXY(0, 0, 0), Radius=panel_8, Length=panel_8)
number_slider_2 = Slider(0, range=0..1)
number_slider_3 = Slider(5, range=1..5)
divide_surface = DivideSurface(Surface=cylinder, UCount=number_slider, VCount=number_slider)  # -> flatten(Points), Normals, Parameters
divide_surface_2 = DivideSurface(Surface=cylinder_3, UCount=number_slider, VCount=number_slider)  # -> flatten(Points), Normals, Parameters
divide_surface_3 = DivideSurface(Surface=cylinder_2, UCount=number_slider, VCount=number_slider)  # -> flatten(Points), Normals, Parameters
divide_surface_4 = DivideSurface(Surface=cylinder_4, UCount=number_slider, VCount=number_slider)  # -> flatten(Points), Normals, Parameters
polyline = PolyLine(Vertices=divide_surface_2.Points, Closed=number_slider_2)
polyline_2 = PolyLine(Vertices=divide_surface_3.Points, Closed=number_slider_2)
polyline_3 = PolyLine(Vertices=divide_surface_4.Points, Closed=number_slider_2)
nurbs_curve = NurbsCurve(Vertices=divide_surface_2.Points, Degree=number_slider_3, Periodic=number_slider_2)  # -> Curve, Length, Domain
nurbs_curve_2 = NurbsCurve(Vertices=divide_surface.Points, Degree=number_slider_3, Periodic=number_slider_2)  # -> Curve, Length, Domain
polyline_4 = PolyLine(Vertices=divide_surface.Points, Closed=number_slider_2)
nurbs_curve_3 = NurbsCurve(Vertices=divide_surface_2.Points, Degree=number_slider_3, Periodic=number_slider_2)  # -> Curve, Length, Domain
nurbs_curve_4 = NurbsCurve(Vertices=divide_surface_3.Points, Degree=number_slider_3, Periodic=number_slider_2)  # -> Curve, Length, Domain
merge = Merge(Data1=polyline_4, Data2=polyline, Data3=polyline_2, Data4=polyline_3)
merge_2 = Merge(Data1=nurbs_curve_2.Curve, Data3=nurbs_curve.Curve, Data4=nurbs_curve_4.Curve, Data5=nurbs_curve_3.Curve)  # -> flatten(Result)
pipe = Pipe(Curve=merge, Radius=Slider(0.5, range=0..1), Caps=2)
pipe_2 = Pipe(Curve=reparameterize(merge_2), Radius=Slider(0.5, range=0..1), Caps=2)  # -> flatten(Pipe)
list_item = ListItem(List=pipe_2, Index=0, Wrap=True)  # -> Item, Item1, Item2, Item3
geometry_2 = Geometry(list_item.Item3)
geometry_3 = Geometry(list_item.Item)
geometry_4 = Geometry(list_item.Item1)
# GH solution
# VB
# C#
# Python with RhinoCommon Only
# Pythong with RhinoScriptSyntax
# GH solution
# VB
# C#
# Python
# VB
geometry_5 = Geometry(list_item.Item2)
# rc
# rs
# Full multiplicity knots at start
# Simple knots
# Full multiplicity knots at end
# P1
# A=0.2*P1+ 0.8*P2
# D=0.2*A + 0.8*B
# P2
# B=0.47*P2 + 0.53*P3
# Full multiplicity knots at start
# E=0.7*B + 0.3*C
# P3
# Full multiplicity knots in the middle
# C=0.8*P3 + 0.2*P4
# P4
# Full multiplicity knots at end
# Compare knot spacing
panel_9 = Panel(geometry_3)
