# Grasshopper definition SetsTree102.gh (Grasshopper 1.0.7)
# Copyright: Wickerson Studios
# plug-ins: Bifocals

# 1001 GRASSHOPPER DEFINITIONS
# Wickerson Studio
# 
# created by: Michael Wickerson
# 
# Grasshopper for Rhino 3D Algorithmic Modeling
# 
# www.wickersonstudios.com
# www.michaelwickerson.com
# https://www.youtube.com/channel/UC7J48Ppcsa6oncp6d29R0xw
# https://github.com/mwickerson
# https://www.facebook.com/michael.wickerson
# https://www.linkedin.com/in/michael-wickerson-696a80156/
# https://www.grasshopper3d.com/profile/MichaelWickerson
image_sampler = ImageSampler(
    FilePath="C:\Users\Sculpture\Documents\2020Grasshopper\ScreenShots2019\Screenshots2020\SurfaceEditAlgorithm.PNG",
    Filter="Value",
    Interpolate=False,
    Umax=1,
    Umin=0,
    Vmax=1,
    Vmin=0,
    Wrap=1)

# ----
# SETS TREE 102/1001 NODE: Data Trees
# Wickerson Studio
# created by: Michael Wickerson
# Grasshopper for Rhino 3D Algorithmic Modeling
# www.wickersonstudios.com
# www.michaelwickerson.com
# https://www.youtube.com/channel/UC7J48Ppcsa6oncp6d29R0xw
# https://github.com/mwickerson
# https://www.facebook.com/michael.wickerson
# https://www.linkedin.com/in/michael-wickerson-696a80156/
# https://www.grasshopper3d.com/profile/MichaelWickerson
number_slider = Slider(40, range=0..40)
number_slider_2 = Slider(40, range=0..40)
number_slider_3 = Slider(6, range=0..10)
geometry = Geometry(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)
sphere = Sphere(Base=PlaneXY(0, 0, 0), Radius=number_slider)
series = Series(Start=0, Step=Slider(10, range=0..10), Count=Slider(10, range=0..40))
divide_surface = DivideSurface(Surface=sphere, UCount=number_slider_3, VCount=number_slider_3)  # -> Points, Normals, Parameters
unit_z = UnitZ(Factor=series)
move = Move(Geometry=graft(divide_surface.Points), Motion=unit_z)  # -> Geometry, Transform

param_viewer = ParamViewer(move.Geometry)
path_mapper = PathMapper(move.Geometry, source="{A;B;C;D}(i)", target="{floor(i/(path_index^(1/2)))}")
path_mapper_2 = PathMapper(move.Geometry, source="{A;B;C;D}(i)", target="{floor(i/(path_index^(1)))}")
path_mapper_3 = PathMapper(move.Geometry, source="{A;B;C;D}(i)", target="{floor(i/(path_index^(1/4)))}")
path_mapper_4 = PathMapper(move.Geometry, source="{A;B;C;D}(i)", target="{floor(i/(path_index^(1/6)))}")

path_mapper_5 = PathMapper(move.Geometry, source="{A;B;C;D}(i)", target="{floor(i/(path_index^(1/3)))}")
number_slider_4 = Slider(2.89, range=0..6)
point_list = PointList(Points=move.Geometry, Size=number_slider_4)
nurbs_curve = NurbsCurve(Vertices=path_mapper_5, Degree=Slider(3, range=1..3), Periodic=False)  # -> Curve, Length, Domain

path_mapper_6 = PathMapper(move.Geometry, source="{A;B;C;D}", target="{A;B;C;D}")
panel = Panel("{0;0;1,3,...;2,4,...}[?]")
panel_2 = Panel("{0;0;1,3,...;2,4,...}[?]")
split_tree = SplitTree(Data=path_mapper_6, Masks=flatten(panel))  # -> Positive, Negative
param_viewer_2 = ParamViewer(path_mapper_6)
param_viewer_3 = ParamViewer(split_tree.Positive)
point_list_2 = PointList(Points=split_tree.Positive, Size=number_slider_4)
point_list_3 = PointList(Points=split_tree.Positive, Size=number_slider_4)
point_list_4 = PointList(Points=split_tree.Negative, Size=number_slider_4)
nurbs_curve_2 = NurbsCurve(Vertices=split_tree.Positive, Degree=3, Periodic=False)  # -> Curve, Length, Domain
nurbs_curve_3 = NurbsCurve(Vertices=split_tree.Negative, Degree=3, Periodic=False)  # -> Curve, Length, Domain
# GH solution
# VB
# C#
# Python with RhinoCommon Only
# Pythong with RhinoScriptSyntax
# GH solution
# VB
# C#
# Python
# VB
curve = Curve(nurbs_curve_2.Curve)

panel_8 = Panel("{2,4,...}[?]")
panel_9 = Panel("{0,2,4,6}[?]")
panel_10 = Panel("{1,4,...,6}[?]")
panel_11 = Panel("{1,6,...}[?]")
panel_12 = Panel("{?}[?]")
panel_13 = Panel("{2,4,...}[*]")
split_tree_2 = SplitTree(Data=path_mapper_6, Masks=flatten(panel))  # -> Positive, Negative
param_viewer_4 = ParamViewer(split_tree_2.Positive)
point_list_5 = PointList(Points=split_tree_2.Positive, Size=number_slider_4)
point_list_6 = PointList(Points=split_tree_2.Positive, Size=number_slider_4)
point_list_7 = PointList(Points=split_tree_2.Negative, Size=number_slider_4)
nurbs_curve_4 = NurbsCurve(Vertices=split_tree_2.Positive, Degree=3, Periodic=False)  # -> Curve, Length, Domain
nurbs_curve_5 = NurbsCurve(Vertices=split_tree_2.Negative, Degree=3, Periodic=False)  # -> Curve, Length, Domain
curve_2 = Curve(nurbs_curve_4.Curve)

param_viewer_5 = ParamViewer(split_tree.Positive)
point_list_8 = PointList(Points=split_tree.Positive, Size=number_slider_4)
clean_tree = CleanTree(RemoveNulls=True, RemoveInvalid=True, RemoveEmpty=Slider(1, range=0..1), Tree=nurbs_curve_2.Curve)

list_length = ListLength(List=clean_tree)
range = Range(Domain=Domain(0, 1), Steps=list_length)
graph_mapper = GraphMapper(
    range,
    x0=0,
    x1=1,
    y0=0,
    y1=5,
    container_name="Bezier",
    cpx=[0, 0, 0.8711656332, 1],
    cpy=[0.2919903994, 0.8034986258, 0.297101438, 1])
pipe_variable = PipeVariable(Curve=reparameterize(curve), Parameters=range, Radii=graph_mapper, Caps=2)  # -> flatten(Pipe)
list_length_2 = ListLength(List=pipe_variable)
range_2 = Range(Domain=Slider(1, range=0..4), Steps=expr("x-1", list_length_2))
pi = Pi(Factor=range_2)
rotate_3d = Rotate3D(Geometry=pipe_variable, Angle=pi, Center=Point(0, 0, 0), Axis=Vector(0, 0, 1))  # -> Geometry, Transform

series_2 = Series(Start=0, Step=Slider(1, range=0..10), Count=Slider(3, range=0..10))
cull_index = CullIndex(List=rotate_3d.Geometry, Indices=series_2, Wrap=True)
list_item = ListItem(List=rotate_3d.Geometry, Index=series_2, Wrap=True)
geometry_2 = Geometry(list_item)
# rc
# rs
# Full multiplicity knots at start
# Simple knots
# Full multiplicity knots at end
# P1
# A=0.2*P1+ 0.8*P2
# D=0.2*A + 0.8*B
# P2
# B=0.47*P2 + 0.53*P3
# Full multiplicity knots at start
# E=0.7*B + 0.3*C
# P3
# Full multiplicity knots in the middle
# C=0.8*P3 + 0.2*P4
# P4
# Full multiplicity knots at end
# Compare knot spacing
geometry_3 = Geometry(cull_index)
