# Grasshopper definition SetsTree104.gh (Grasshopper 1.0.7)
# Copyright: Wickerson Studios
# plug-ins: Bifocals

# 1001 GRASSHOPPER DEFINITIONS
# Wickerson Studio
# 
# created by: Michael Wickerson
# 
# Grasshopper for Rhino 3D Algorithmic Modeling
# 
# www.wickersonstudios.com
# www.michaelwickerson.com
# https://www.youtube.com/channel/UC7J48Ppcsa6oncp6d29R0xw
# https://github.com/mwickerson
# https://www.facebook.com/michael.wickerson
# https://www.linkedin.com/in/michael-wickerson-696a80156/
# https://www.grasshopper3d.com/profile/MichaelWickerson
image_sampler = ImageSampler(
    FilePath="C:\Users\Sculpture\Documents\2020Grasshopper\ScreenShots2019\Screenshots2020\SurfaceEditAlgorithm.PNG",
    Filter="Value",
    Interpolate=False,
    Umax=1,
    Umin=0,
    Vmax=1,
    Vmin=0,
    Wrap=1)
panel = Panel("{0;0;0;0;0,3,...}[?]")

# ----
# SETS TREE 104/1001 NODE: Data Trees
# Wickerson Studio
# created by: Michael Wickerson
# Grasshopper for Rhino 3D Algorithmic Modeling
# www.wickersonstudios.com
# www.michaelwickerson.com
# https://www.youtube.com/channel/UC7J48Ppcsa6oncp6d29R0xw
# https://github.com/mwickerson
# https://www.facebook.com/michael.wickerson
# https://www.linkedin.com/in/michael-wickerson-696a80156/
# https://www.grasshopper3d.com/profile/MichaelWickerson
number_slider = Slider(40, range=0..40)
number_slider_2 = Slider(10, range=0..10)
number_slider_3 = Slider(2, range=0..4)
center_box = CenterBox(Base=PlaneXY(0, 0, 0), X=number_slider, Y=number_slider, Z=number_slider)
param_viewer = ParamViewer(center_box)
deconstruct_brep = DeconstructBrep(Brep=center_box)  # -> Faces, Edges, Vertices
param_viewer_2 = ParamViewer(deconstruct_brep.Faces)
divide_surface = DivideSurface(Surface=deconstruct_brep.Faces, UCount=number_slider_3, VCount=number_slider_3)  # -> Points, Normals, Parameters
series = Series(Start=0, Step=number_slider_2, Count=number_slider_2)
unit_z = UnitZ(Factor=series)
param_viewer_3 = ParamViewer(divide_surface.Points)
construct_domain = ConstructDomain(DomainStart=Slider(0.44, range=0..1), DomainEnd=Slider(1, range=0..1))
move = Move(Geometry=graft(divide_surface.Points), Motion=unit_z)  # -> Geometry, Transform
range = Range(Domain=construct_domain, Steps=expr("x-1", Slider(3, range=0..10)))
param_viewer_4 = ParamViewer(move.Geometry)

path_mapper = PathMapper(center_box, source="{A}", target="{A}")
panel_2 = Panel("{1,3,...}")
panel_3 = Panel("{0,2,...}")
panel_4 = Panel("{?}")
panel_5 = Panel("{1}")
split_tree = SplitTree(Data=path_mapper, Masks=flatten("{0}"))  # -> Positive, Negative
geometry = Geometry(split_tree.Positive)
geometry_2 = Geometry(split_tree.Negative)

path_mapper_2 = PathMapper(deconstruct_brep.Faces, source="{A;B}(i)", target="{A;B}(i)")
path_mapper_3 = PathMapper(deconstruct_brep.Faces, source="{A;B}(i)", target="{i;A}(B)")
path_mapper_4 = PathMapper(deconstruct_brep.Faces, source="{A;B}(i)", target="{A;i}(B)")
panel_6 = Panel("{0;0,2,...}[?]")
split_tree_2 = SplitTree(Data=path_mapper_3, Masks=flatten("{0;0}[0,1,...]"))  # -> Positive, Negative
geometry_3 = Geometry(split_tree_2.Positive)
geometry_4 = Geometry(split_tree_2.Negative)

average = Average(Input=move.Geometry)

scale = Scale(Geometry=move.Geometry, Center=average, Factor=range)  # -> Geometry, Transform
point_list = PointList(Points=scale.Geometry, Size=Slider(10, range=0..10))
param_viewer_5 = ParamViewer(scale.Geometry)

path_mapper_5 = PathMapper(divide_surface.Points, source="{A;B;C;D}(i)", target="{A;B;C;D}(i)")
path_mapper_6 = PathMapper(divide_surface.Points, source="{A;B;C;D}(i)", target="{A;B;C;i}(D)")
path_mapper_7 = PathMapper(divide_surface.Points, source="{A;B;C;D}(i)", target="{A;B;i;D}(C)")
path_mapper_8 = PathMapper(divide_surface.Points, source="{A;B;C;D}", target="{A;B;C;D}")
path_mapper_9 = PathMapper(divide_surface.Points, source="{A;B;C;D}", target="{A;B;C;D}")
path_mapper_10 = PathMapper(divide_surface.Points, source="{A;B;C;D}", target="{A;B;C;D}")
path_mapper_11 = PathMapper(divide_surface.Points, source="{A;B;C;D}(i)", target="{A;B;i;i}(D)")
path_mapper_12 = PathMapper(divide_surface.Points, source="{A;B;C;D}(i)", target="{A;B;i;D}(C)")
panel_7 = Panel("{0;0;1,3,...;0}[1,3,...]")
panel_8 = Panel("{0;0;0,2,...;1,4,...}[?]")
split_tree_3 = SplitTree(Data=path_mapper_12, Masks=flatten("{0;0;1,2,...;0,4,...}[?]"))  # -> Positive, Negative
geometry_5 = Geometry(split_tree_3.Positive)
geometry_6 = Geometry(split_tree_3.Negative)
number_slider_4 = Slider(1, range=0..1)
nurbs_curve = NurbsCurve(Vertices=geometry_5, Degree=3, Periodic=False)  # -> Curve, Length, Domain
nurbs_curve_2 = NurbsCurve(Vertices=split_tree_3.Negative, Degree=3, Periodic=False)  # -> Curve, Length, Domain
clean_tree = CleanTree(RemoveNulls=True, RemoveInvalid=True, RemoveEmpty=number_slider_4, Tree=nurbs_curve.Curve)
number_slider_5 = Slider(2, range=0..100)
pipe = Pipe(Curve=clean_tree, Radius=Slider(4.52, range=0..10), Caps=2)  # -> flatten(Pipe)
cull_index = CullIndex(List=pipe, Indices=number_slider_5, Wrap=True)
list_item = ListItem(List=pipe, Index=number_slider_5, Wrap=True)
panel_9 = Panel(clean_tree)
clean_tree_2 = CleanTree(RemoveNulls=True, RemoveInvalid=True, RemoveEmpty=number_slider_4, Tree=cull_index)
param_viewer_6 = ParamViewer(clean_tree_2)

path_mapper_13 = PathMapper(move.Geometry, source="{A;B;C;D;E}(i)", target="{A;B;C;D;E}(i)")
path_mapper_14 = PathMapper(move.Geometry, source="{A;B;C;D;E}(i)", target="{A;B;C;D;i}(E)")
path_mapper_15 = PathMapper(move.Geometry, source="{A;B;C;D;E}(i)", target="{A;B;C;i;E}(D)")
path_mapper_16 = PathMapper(move.Geometry, source="{A;B;C;D;E}(i)", target="{A;B;C;i;i}(E)")
path_mapper_17 = PathMapper(move.Geometry, source="{A;B;C;D;E}(i)", target="{A;B;C;i;i}(D)")
path_mapper_18 = PathMapper(move.Geometry, source="{A;B;C;D;E}(i)", target="{A;B;i;D;E}(C)")
path_mapper_19 = PathMapper(move.Geometry, source="{A;B;C;D;E}(i)", target="{A;B;i;D;E}(C)")
panel_10 = Panel("{0;0;0,2,...;0;0}[*]")
panel_11 = Panel("{0;0;1,3,...;2,4,...}[?]")
panel_12 = Panel("{0;0;0;0;0}[1,3,...]")
split_tree_4 = SplitTree(Data=path_mapper_19, Masks=flatten("{0;0;0;0,2,...;1,4,...}[?]"))  # -> Positive, Negative
geometry_7 = Geometry(split_tree_4.Positive)
geometry_8 = Geometry(split_tree_4.Negative)
number_slider_6 = Slider(1, range=0..1)
nurbs_curve_3 = NurbsCurve(Vertices=split_tree_4.Positive, Degree=3, Periodic=False)  # -> Curve, Length, Domain
nurbs_curve_4 = NurbsCurve(Vertices=split_tree_4.Negative, Degree=3, Periodic=False)  # -> Curve, Length, Domain
clean_tree_3 = CleanTree(RemoveNulls=True, RemoveInvalid=True, RemoveEmpty=number_slider_6, Tree=nurbs_curve_3.Curve)
number_slider_7 = Slider(2, range=0..100)
pipe_2 = Pipe(Curve=clean_tree_3, Radius=Slider(4.52, range=0..10), Caps=2)  # -> flatten(Pipe)
cull_index_2 = CullIndex(List=pipe_2, Indices=number_slider_7, Wrap=True)
list_item_2 = ListItem(List=pipe_2, Index=number_slider_7, Wrap=True)
panel_13 = Panel(clean_tree_3)
clean_tree_4 = CleanTree(RemoveNulls=True, RemoveInvalid=True, RemoveEmpty=number_slider_6, Tree=cull_index_2)
param_viewer_7 = ParamViewer(clean_tree_4)

path_mapper_20 = PathMapper(scale.Geometry, source="{A;B;C;D;E}(i)", target="{A;B;i;i;i}(E)")

path_mapper_21 = PathMapper(scale.Geometry, source="{A;B;C;D;E}(i)", target="{A;B;C;D;E}(i)")
path_mapper_22 = PathMapper(scale.Geometry, source="{A;B;C;D;E}(i)", target="{A;B;C;D;i}(E)")
path_mapper_23 = PathMapper(scale.Geometry, source="{A;B;C;D;E}(i)", target="{A;B;i;D;E}(C)")
path_mapper_24 = PathMapper(scale.Geometry, source="{A;B;C;D;E}(i)", target="{A;B;C;i;E}(D)")
path_mapper_25 = PathMapper(scale.Geometry, source="{A;B;C;D;E}(i)", target="{A;B;C;i;i}(E)")
path_mapper_26 = PathMapper(scale.Geometry, source="{A;B;C;D;E}(i)", target="{A;B;C;i;i}(D)")
panel_14 = Panel("{0;0;0;0;0,2,...}[?]")
split_tree_5 = SplitTree(Data=path_mapper_20, Masks=flatten("{0;0;0;0;?}[?]"))  # -> Positive, Negative
geometry_9 = Geometry(split_tree_5.Positive)
geometry_10 = Geometry(split_tree_5.Negative)
number_slider_8 = Slider(1, range=0..1)
nurbs_curve_5 = NurbsCurve(Vertices=geometry_9, Degree=3, Periodic=False)  # -> Curve, Length, Domain
nurbs_curve_6 = NurbsCurve(Vertices=geometry_10, Degree=3, Periodic=False)  # -> Curve, Length, Domain
range_2 = Range(Domain=Domain(0, 1), Steps=10)
clean_tree_5 = CleanTree(RemoveNulls=True, RemoveInvalid=True, RemoveEmpty=number_slider_8, Tree=nurbs_curve_6.Curve)
number_slider_9 = Slider(3, range=0..100)
graph_mapper = GraphMapper(range_2, x0=0, x1=1, y0=0, y1=6, container_name="Gaussian", factor=0.7751410007, mean=0.4874095917, sdev=0.177777797)
# C#
# Python with RhinoCommon Only
# Pythong with RhinoScriptSyntax
# GH solution
# VB
# C#
# Python
# VB
pipe_variable = PipeVariable(Curve=reparameterize(clean_tree_5), Parameters=range_2, Radii=graph_mapper, Caps=2)
list_item_3 = ListItem(List=pipe_variable, Index=number_slider_9, Wrap=True)
cull_index_3 = CullIndex(List=pipe_variable, Indices=number_slider_9, Wrap=True)
clean_tree_6 = CleanTree(RemoveNulls=True, RemoveInvalid=True, RemoveEmpty=number_slider_8, Tree=cull_index_3)
panel_15 = Panel(clean_tree_5)
# rc
# rs
# Full multiplicity knots at start
# Simple knots
# Full multiplicity knots at end
# P1
# A=0.2*P1+ 0.8*P2
# D=0.2*A + 0.8*B
# P2
# B=0.47*P2 + 0.53*P3
# Full multiplicity knots at start
# E=0.7*B + 0.3*C
# P3
# Full multiplicity knots in the middle
# C=0.8*P3 + 0.2*P4
# P4
# Full multiplicity knots at end
# Compare knot spacing
# GH solution
# VB
param_viewer_8 = ParamViewer(clean_tree_6)
