# Grasshopper definition SetsTree105.gh (Grasshopper 1.0.7)
# Copyright: Wickerson Studios
# plug-ins: Bifocals

# 1001 GRASSHOPPER DEFINITIONS
# Wickerson Studio
# 
# created by: Michael Wickerson
# 
# Grasshopper for Rhino 3D Algorithmic Modeling
# 
# www.wickersonstudios.com
# www.michaelwickerson.com
# https://www.youtube.com/channel/UC7J48Ppcsa6oncp6d29R0xw
# https://github.com/mwickerson
# https://www.facebook.com/michael.wickerson
# https://www.linkedin.com/in/michael-wickerson-696a80156/
# https://www.grasshopper3d.com/profile/MichaelWickerson
image_sampler = ImageSampler(
    FilePath="C:\Users\Sculpture\Documents\2020Grasshopper\ScreenShots2019\Screenshots2020\SurfaceEditAlgorithm.PNG",
    Filter="Value",
    Interpolate=False,
    Umax=1,
    Umin=0,
    Vmax=1,
    Vmin=0,
    Wrap=1)
# SETS TREE 105/1001 NODE: Data Trees
# Wickerson Studio
# created by: Michael Wickerson
# Grasshopper for Rhino 3D Algorithmic Modeling
# www.wickersonstudios.com
# www.michaelwickerson.com
# https://www.youtube.com/channel/UC7J48Ppcsa6oncp6d29R0xw
# https://github.com/mwickerson
# https://www.facebook.com/michael.wickerson
# https://www.linkedin.com/in/michael-wickerson-696a80156/
# https://www.grasshopper3d.com/profile/MichaelWickerson
number_slider = Slider(100, range=0..100)
range = Range(Domain=number_slider, Steps=10)
construct_point = ConstructPoint(XCoordinate=range, YCoordinate=graft(range), ZCoordinate=0)  # -> simplify(Point)
construct_point_2 = ConstructPoint(XCoordinate=range, YCoordinate=range, ZCoordinate=0)  # -> simplify(Point)
data = Data(construct_point)
param_viewer = ParamViewer(construct_point_2)
param_viewer_2 = ParamViewer(construct_point)

path_mapper = PathMapper(data, source="{A}", target="{A}")
path_mapper_2 = PathMapper(data, source="{A}(i)", target="{i}(A)")
panel = Panel("{0}[1,3,...]")
split_tree = SplitTree(Data=path_mapper_2, Masks=flatten("{0,2,...}[0,4,...]"))  # -> Positive, Negative
split_tree_2 = SplitTree(Data=path_mapper_2, Masks=flatten("{0,4,...}[0,4,...]"))  # -> Positive, Negative
geometry = Geometry(flatten(split_tree.Positive))
geometry_2 = Geometry(graft(split_tree_2.Positive))
line = Line(StartPoint=geometry, EndPoint=geometry_2)

path_mapper_3 = PathMapper(construct_point_2, source="{A;B}(i)", target="{A;B}(i)")
panel_2 = Panel("{0;0}[6]")
split_tree_3 = SplitTree(Data=path_mapper_3, Masks=flatten("{0;0}[0,2,...]"))  # -> Positive, Negative
geometry_3 = Geometry(split_tree_3.Positive)
geometry_4 = Geometry(split_tree_3.Negative)

number_slider_2 = Slider(10, range=0..10)
panel_3 = Panel("{1,5,...}[1,5,...]")
number_slider_3 = Slider(3, range=0..10)
series = Series(Start=0, Step=number_slider_2, Count=number_slider_2)
split_tree_4 = SplitTree(Data=path_mapper_3, Masks=flatten("{0;0}[1,3,...]"))  # -> Positive, Negative
unit_z = UnitZ(Factor=series)
geometry_5 = Geometry(split_tree_4.Negative)
geometry_6 = Geometry(split_tree_4.Positive)
move = Move(Geometry=graft(construct_point), Motion=unit_z)  # -> Geometry, Transform
list_length = ListLength(List=move.Geometry)

path_mapper_4 = PathMapper(move.Geometry, source="{A;B}(i)", target="{A;B}(i)")
panel_4 = Panel("{0;0}[0,1,...]")
panel_5 = Panel("{0,4,...;0,4,...}[?]")
panel_6 = Panel("{0,5,...;0,5,...}[0,8,...]")
panel_7 = Panel("{0,4,...;0}[?]")
split_tree_5 = SplitTree(Data=path_mapper_4, Masks=flatten("{0;0,2,...}[?]"))  # -> Positive, Negative
split_tree_6 = SplitTree(Data=path_mapper_4, Masks=flatten("{1,5,...;1,4,...}[1,8,...]"))  # -> Positive, Negative
geometry_7 = Geometry(graft(split_tree_5.Positive))
geometry_8 = Geometry(split_tree_6.Positive)
line_2 = Line(StartPoint=geometry_7, EndPoint=geometry_8)
pipe = Pipe(Curve=line_2, Radius=Slider(2.09, range=0..10), Caps=2)

param_viewer_3 = ParamViewer(move.Geometry)
construct_domain = ConstructDomain(DomainStart=Slider(1, range=0..1), DomainEnd=Slider(2, range=0..2))
average = Average(Input=move.Geometry)
range_2 = Range(Domain=construct_domain, Steps=expr("x-1", list_length))
scale = Scale(Geometry=move.Geometry, Center=average, Factor=range_2)  # -> simplify(Geometry), Transform
point_list = PointList(Points=scale.Geometry, Size=Slider(5, range=0..10))
param_viewer_4 = ParamViewer(scale.Geometry)

path_mapper_5 = PathMapper(scale.Geometry, source="{A;B}(i)", target="{A;i}(B)")
path_mapper_6 = PathMapper(scale.Geometry, source="{A;B}(i)", target="{A;B}(i)")
path_mapper_7 = PathMapper(scale.Geometry, source="{A;B}(i)", target="{i;B}(A)")
panel_8 = Panel("{0;0,2,...}[?]")
panel_9 = Panel("{0,2,...;0,2,...}[0,2,...]")
split_tree_7 = SplitTree(Data=path_mapper_6, Masks=flatten("{0;0}[?]"))  # -> Positive, Negative
split_tree_8 = SplitTree(Data=path_mapper_5, Masks=flatten("{0;0}[?]"))  # -> Positive, Negative
split_tree_9 = SplitTree(Data=path_mapper_7, Masks=flatten("{0;0}[?]"))  # -> Positive, Negative
number_slider_4 = Slider(1, range=0..1)
geometry_9 = Geometry(split_tree_7.Positive)
geometry_10 = Geometry(split_tree_8.Positive)
geometry_11 = Geometry(split_tree_9.Positive)
nurbs_curve = NurbsCurve(Vertices=geometry_9, Degree=3, Periodic=False)  # -> Curve, Length, Domain
nurbs_curve_2 = NurbsCurve(Vertices=geometry_10, Degree=3, Periodic=False)  # -> Curve, Length, Domain
nurbs_curve_3 = NurbsCurve(Vertices=geometry_11, Degree=3, Periodic=False)  # -> Curve, Length, Domain
number_slider_5 = Slider(4.52, range=0..10)
clean_tree = CleanTree(RemoveNulls=True, RemoveInvalid=True, RemoveEmpty=number_slider_4, Tree=nurbs_curve.Curve)
clean_tree_2 = CleanTree(RemoveNulls=True, RemoveInvalid=True, RemoveEmpty=number_slider_4, Tree=nurbs_curve_2.Curve)
clean_tree_3 = CleanTree(RemoveNulls=True, RemoveInvalid=True, RemoveEmpty=number_slider_4, Tree=nurbs_curve_3.Curve)
pipe_2 = Pipe(Curve=clean_tree_2, Radius=number_slider_5, Caps=2)
# rc
pipe_3 = Pipe(Curve=clean_tree, Radius=number_slider_5, Caps=2)
# rs
# Full multiplicity knots at start
# Simple knots
# Full multiplicity knots at end
# P1
# A=0.2*P1+ 0.8*P2
# D=0.2*A + 0.8*B
# P2
# B=0.47*P2 + 0.53*P3
# Full multiplicity knots at start
# E=0.7*B + 0.3*C
# P3
# Full multiplicity knots in the middle
# C=0.8*P3 + 0.2*P4
# P4
# Full multiplicity knots at end
# Compare knot spacing
# GH solution
# VB
# C#
# Python with RhinoCommon Only
# Pythong with RhinoScriptSyntax
# GH solution
# VB
# C#
# Python
# VB
pipe_4 = Pipe(Curve=clean_tree_3, Radius=number_slider_5, Caps=2)
