# Grasshopper definition SetsTree108.gh (Grasshopper 1.0.7)
# Copyright: Wickerson Studios
# plug-ins: Bifocals, LunchBox

# 1001 GRASSHOPPER DEFINITIONS
# Wickerson Studio
# 
# created by: Michael Wickerson
# 
# Grasshopper for Rhino 3D Algorithmic Modeling
# 
# www.wickersonstudios.com
# www.michaelwickerson.com
# https://www.youtube.com/channel/UC7J48Ppcsa6oncp6d29R0xw
# https://github.com/mwickerson
# https://www.facebook.com/michael.wickerson
# https://www.linkedin.com/in/michael-wickerson-696a80156/
# https://www.grasshopper3d.com/profile/MichaelWickerson
image_sampler = ImageSampler(
    FilePath="C:\Users\Sculpture\Documents\2020Grasshopper\ScreenShots2019\Screenshots2020\SurfaceEditAlgorithm.PNG",
    Filter="Value",
    Interpolate=False,
    Umax=1,
    Umin=0,
    Vmax=1,
    Vmin=0,
    Wrap=1)

# ----
# VECTOR FEILD 106/1001 NODE: CHARGES/FORCES
# Wickerson Studio
# created by: Michael Wickerson
# Grasshopper for Rhino 3D Algorithmic Modeling
# www.wickersonstudios.com
# www.michaelwickerson.com
# https://www.youtube.com/channel/UC7J48Ppcsa6oncp6d29R0xw
# https://github.com/mwickerson
# https://www.facebook.com/michael.wickerson
# https://www.linkedin.com/in/michael-wickerson-696a80156/
# https://www.grasshopper3d.com/profile/MichaelWickerson
line = Line(Line((10, 86, 0), (32, 32, 0)))
number_slider = Slider(3.76, range=0..10)
bounds = Bounds({Plane=PlaneXY(-42, -16, 0), X=Domain(0, 75), Y=Domain(0, 62), Z=Domain(0, 36)})
charge = Charge(1)
spin_force = SpinForce(
    Plane=PlaneXY(0, 0, 0),
    Strength=Slider(1.6, range=0..10),
    Radius=Slider(4.776, range=0..10),
    Decay=number_slider,
    Bounds=bounds)
point_charge = PointCharge(Point=[Point(-1, -9, 0), Point(-22, -4, 0), Point(9, 23, 0)], Charge=charge, Decay=number_slider, Bounds=bounds)
line_charge = LineCharge(Line=line, Charge=charge, Bounds=bounds)
merge_fields = MergeFields(Fields=[point_charge, spin_force, line_charge])
field_line = FieldLine(
    Field=merge_fields,
    Point=[Point(-1, -9, 0), Point(-22, -4, 0), Point(9, 23, 0)],
    Steps=Slider(640, range=0..10000),
    Accuracy=Slider(0.512, range=0..1),
    Method=Slider(1, range=1..4))  # -> graft(Curve)
range = Range(Domain=Slider(30, range=0..30), Steps=Slider(5, range=3..11))
param_viewer = ParamViewer(field_line)
unit_z = UnitZ(Factor=range)
move = Move(Geometry=field_line, Motion=unit_z)  # -> Geometry, Transform
construct_domain = ConstructDomain(DomainStart=Slider(0.24, range=0..1), DomainEnd=Slider(1.37, range=1..2))
path_mapper = PathMapper(move.Geometry, source="{A;B}(i)", target="{A;i}(B)")
param_viewer_2 = ParamViewer(move.Geometry)
split_tree = SplitTree(Data=path_mapper, Masks=flatten("{0;0,2,...}[?]"))  # -> Positive, Negative
list_length = ListLength(List=split_tree.Negative)
list_length_2 = ListLength(List=split_tree.Negative)
range_2 = Range(Domain=construct_domain, Steps=expr("x-1", list_length))
range_3 = Range(Domain=construct_domain, Steps=expr("x-1", list_length_2))
pi = Pi(Factor=range_3)
pi_2 = Pi(Factor=range_2)
geometry = Geometry(split_tree.Positive)
geometry_2 = Geometry(split_tree.Negative)
negative = Negative(Value=pi_2)
construct_point = ConstructPoint(XCoordinate=0, YCoordinate=0, ZCoordinate=0)
unit_z_2 = UnitZ(Factor=1)
line_sdl = LineSDL(Start=construct_point, Direction=unit_z_2, Length=1)
rotate_3d = Rotate3D(Geometry=geometry, Angle=pi, Center=construct_point, Axis=line_sdl)  # -> graft(Geometry), Transform
rotate_3d_2 = Rotate3D(Geometry=geometry_2, Angle=negative, Center=construct_point, Axis=line_sdl)  # -> graft(Geometry), Transform
number_slider_2 = Slider(1, range=0..1)
clean_tree = CleanTree(RemoveNulls=True, RemoveInvalid=True, RemoveEmpty=number_slider_2, Tree=rotate_3d.Geometry)  # -> flatten(Tree)
clean_tree_2 = CleanTree(RemoveNulls=True, RemoveInvalid=True, RemoveEmpty=number_slider_2, Tree=rotate_3d_2.Geometry)  # -> flatten(Tree)
number_slider_3 = Slider(0, range=0..10)
param_viewer_3 = ParamViewer(clean_tree_2)
param_viewer_4 = ParamViewer(clean_tree)
list_item = ListItem(List=flatten(clean_tree), Index=number_slider_3, Wrap=True)  # -> Item, Item1, Item2, Item3, Item4, Item5
list_item_2 = ListItem(List=flatten(clean_tree_2), Index=number_slider_3, Wrap=True)  # -> Item, Item1, Item2, Item3, Item4, Item5, Item6, Item7, Item8, Item9

loft = Loft(
    Curves=[list_item.Item, list_item_2.Item],
    Options={Adjust=False, Closed=False, LoftEnds=0, LoftSimp=0, LoftType=0, Rebuild=10, Refit=0.01})
loft_2 = Loft(
    Curves=[list_item.Item, list_item_2.Item3],
    Options={Adjust=False, Closed=False, LoftEnds=0, LoftSimp=0, LoftType=0, Rebuild=10, Refit=0.01})
loft_3 = Loft(
    Curves=[list_item.Item, list_item_2.Item6],
    Options={Adjust=False, Closed=False, LoftEnds=0, LoftSimp=0, LoftType=0, Rebuild=10, Refit=0.01})

loft_4 = Loft(
    Curves=[list_item.Item, list_item_2.Item1],
    Options={Adjust=False, Closed=False, LoftEnds=0, LoftSimp=0, LoftType=0, Rebuild=10, Refit=0.01})
loft_5 = Loft(
    Curves=[list_item.Item, list_item_2.Item4],
    Options={Adjust=False, Closed=False, LoftEnds=0, LoftSimp=0, LoftType=0, Rebuild=10, Refit=0.01})
loft_6 = Loft(
    Curves=[list_item.Item, list_item_2.Item7],
    Options={Adjust=False, Closed=False, LoftEnds=0, LoftSimp=0, LoftType=0, Rebuild=10, Refit=0.01})

loft_7 = Loft(
    Curves=[list_item.Item, list_item_2.Item2],
    Options={Adjust=False, Closed=False, LoftEnds=0, LoftSimp=0, LoftType=0, Rebuild=10, Refit=0.01})
loft_8 = Loft(
    Curves=[list_item.Item, list_item_2.Item5],
    Options={Adjust=False, Closed=False, LoftEnds=0, LoftSimp=0, LoftType=0, Rebuild=10, Refit=0.01})
loft_9 = Loft(
    Curves=[list_item.Item, list_item_2.Item8],
    Options={Adjust=False, Closed=False, LoftEnds=0, LoftSimp=0, LoftType=0, Rebuild=10, Refit=0.01})

deconstruct_brep = DeconstructBrep(Brep=loft_3)  # -> Faces, Edges, Vertices
number_slider_4 = Slider(2, range=0..10)
rebuild_surface = RebuildSurface(
    Surface=deconstruct_brep.Faces,
    UDegree=number_slider_4,
    VDegree=number_slider_4,
    UNumber=number_slider_4,
    VNumber=number_slider_4)
offset_surface = OffsetSurface(Surface=rebuild_surface, Distance=Slider(5.83, range=0..21), Retrim=True)
offset_surface_2 = OffsetSurface(Surface=rebuild_surface, Distance=Slider(12.67, range=0..21), Retrim=True)

number_slider_5 = Slider(42, range=0..100)
surface = Surface(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)
divide_surface = DivideSurface(Surface=surface, UCount=number_slider_5, VCount=number_slider_5)  # -> Points, Normals, Parameters
amplitude = Amplitude(Vector=divide_surface.Normals, Amplitude=Slider(0.981, range=0.001..2))
vector_display = VectorDisplay(Anchor=divide_surface.Points, Vector=divide_surface.Normals)
move_2 = Move(Geometry=divide_surface.Points, Motion=amplitude)  # -> flatten(Geometry), Transform
expression = Expression(x=number_slider_5, Expression="x+1")
surface_from_points = SurfaceFromPoints(Points=move_2.Geometry, UCount=expression, Interpolate=False)
deconstruct_brep_2 = DeconstructBrep(Brep=surface)  # -> Faces, graft(Edges), Vertices
# rc
# rs
# Full multiplicity knots at start
# Simple knots
# Full multiplicity knots at end
# P1
# A=0.2*P1+ 0.8*P2
# D=0.2*A + 0.8*B
# P2
# B=0.47*P2 + 0.53*P3
# Full multiplicity knots at start
# E=0.7*B + 0.3*C
# P3
# Full multiplicity knots in the middle
# C=0.8*P3 + 0.2*P4
# P4
# Full multiplicity knots at end
# Compare knot spacing
deconstruct_brep_3 = DeconstructBrep(Brep=surface_from_points)  # -> Faces, graft(Edges), Vertices
loft_10 = Loft(
    Curves=[deconstruct_brep_3.Edges, deconstruct_brep_2.Edges],
    Options={Adjust=False, Closed=False, LoftEnds=0, LoftSimp=0, LoftType=0, Rebuild=10, Refit=0.01})  # -> flatten(Loft)

merge = Merge(Data1=surface_from_points, Data2=loft_10, Data3=surface)

# ----
# GH solution
# VB
# C#
# Python with RhinoCommon Only
# Pythong with RhinoScriptSyntax
# GH solution
# VB
# C#
# Python
# VB
brep_join = BrepJoin(Breps=merge)  # -> Breps, Closed
