# Grasshopper definition SetsTree109b.gh (Grasshopper 1.0.7)
# Copyright: Wickerson Studios
# plug-ins: MeshEdit Components, Bifocals

image_sampler = ImageSampler(
    FilePath="C:\Users\Sculpture\Documents\2020Grasshopper\ScreenShots2019\Screenshots2020\SurfaceEditAlgorithm.PNG",
    Filter="Value",
    Interpolate=False,
    Umax=1,
    Umin=0,
    Vmax=1,
    Vmin=0,
    Wrap=1)

# ----
# VECTOR GRID 109/1001 NODE: Grid and Populate
# Wickerson Studio
# created by: Michael Wickerson
# Grasshopper for Rhino 3D Algorithmic Modeling
# www.wickersonstudios.com
# www.michaelwickerson.com
# https://www.youtube.com/channel/UC7J48Ppcsa6oncp6d29R0xw
# https://github.com/mwickerson
# https://www.facebook.com/michael.wickerson
# https://www.linkedin.com/in/michael-wickerson-696a80156/
# https://www.grasshopper3d.com/profile/MichaelWickerson
number_slider = Slider(6, range=0..10)
number_slider_2 = Slider(4, range=0..10)
number_slider_3 = Slider(10, range=0..10)
rectangular = Rectangular(
    Plane=PlaneXY(0, 0, 0),
    SizeX=number_slider,
    SizeY=Slider(4, range=0..10),
    ExtentX=number_slider_3,
    ExtentY=number_slider_2)  # -> Cells, Points
construct_domain = ConstructDomain(DomainStart=Slider(10, range=0..10), DomainEnd=Slider(0, range=0..1))
range = Range(Domain=construct_domain, Steps=Slider(10, range=0..10))
number_slider_4 = Slider(2.64, range=0..10)
unit_z = UnitZ(Factor=range)
negative = Negative(Value=number_slider_4)
construct_domain_2 = ConstructDomain(DomainStart=negative, DomainEnd=number_slider_4)
range_2 = Range(Domain=Domain(0, 1), Steps=10)
graph_mapper = GraphMapper(
    range_2,
    x0=0.1,
    x1=1,
    y0=0.1,
    y1=1,
    Ox=0.5740755796,
    Oy=0.06351459026,
    Px=0.8925193548,
    Py=0.1930966377,
    container_name="Parabola")

# ----
# 1001 GRASSHOPPER DEFINITIONS
# Wickerson Studio
# 
# created by: Michael Wickerson
# 
# Grasshopper for Rhino 3D Algorithmic Modeling
# 
# www.wickersonstudios.com
# www.michaelwickerson.com
# https://www.youtube.com/channel/UC7J48Ppcsa6oncp6d29R0xw
# https://github.com/mwickerson
# https://www.facebook.com/michael.wickerson
# https://www.linkedin.com/in/michael-wickerson-696a80156/
# https://www.grasshopper3d.com/profile/MichaelWickerson
radial = Radial(Plane=PlaneXY(0, 0, 0), Size=number_slider, ExtentR=number_slider_3, ExtentP=number_slider_2)  # -> Cells, Points
hexagonal = Hexagonal(Plane=PlaneXY(0, 0, 0), Size=number_slider, ExtentX=number_slider_3, ExtentY=number_slider_2)  # -> Cells, Points

point = Point(simplify(radial.Points))
flip_matrix = FlipMatrix(Data=point)
point_2 = Point(flip_matrix)
path_mapper = PathMapper(point_2, source="{A}", target="{A}")
param_viewer = ParamViewer(point)
param_viewer_2 = ParamViewer(point_2)
path_mapper_2 = PathMapper(point, source="{A}", target="{A}")
move = Move(Geometry=graft(point), Motion=unit_z)  # -> Geometry, Transform
move_2 = Move(Geometry=path_mapper, Motion=reverse(unit_z))  # -> Geometry, Transform
move_3 = Move(Geometry=point, Motion=unit_z)  # -> Geometry, Transform
interpolate = Interpolate(Vertices=move_2.Geometry, Degree=3, Periodic=False, KnotStyle=1)  # -> Curve, Length, Domain
interpolate_2 = Interpolate(Vertices=move_3.Geometry, Degree=3, Periodic=False, KnotStyle=1)  # -> flatten(Curve), Length, Domain
interpolate_3 = Interpolate(Vertices=move.Geometry, Degree=3, Periodic=False, KnotStyle=1)  # -> Curve, Length, Domain
list_length = ListLength(List=interpolate_2.Curve)
range_3 = Range(Domain=construct_domain_2, Steps=expr("x-1", list_length))
path_mapper_3 = PathMapper(interpolate_3.Curve, source="{A;B}(i)", target="{A;i}(B)")
unit_z_2 = UnitZ(Factor=range_3)
split_tree = SplitTree(Data=path_mapper_3, Masks=flatten("{0,5,...;?}[?]"))  # -> Positive, Negative
jitter = Jitter(List=unit_z_2, Jitter=Slider(0.32, range=0..1), Seed=2)  # -> Values, Indices
geometry = Geometry(split_tree.Negative)
geometry_2 = Geometry(split_tree.Positive)
move_4 = Move(Geometry=interpolate_2.Curve, Motion=jitter.Values)  # -> Geometry, Transform
merge = Merge(Data1=geometry, Data2=interpolate_2.Curve, Data3=interpolate.Curve)
loft = Loft(Curves=move_4.Geometry, Options={Adjust=False, Closed=False, LoftEnds=0, LoftSimp=0, LoftType=0, Rebuild=10, Refit=0.01})
pipe_variable = PipeVariable(Curve=reparameterize(geometry_2), Parameters=range_2, Radii=graph_mapper, Caps=0)
# GH solution
# VB
# C#
# Python with RhinoCommon Only
# Pythong with RhinoScriptSyntax
# GH solution
# VB
# C#
# Python
# VB
pipe = Pipe(Curve=merge, Radius=Slider(0.305, range=0..1), Caps=2)

param_viewer_3 = ParamViewer(interpolate_3.Curve)

number_slider_5 = Slider(42, range=0..100)
surface = Surface(loft)
divide_surface = DivideSurface(Surface=surface, UCount=number_slider_5, VCount=number_slider_5)  # -> Points, Normals, Parameters
amplitude = Amplitude(Vector=divide_surface.Normals, Amplitude=Slider(0.698, range=0.001..2))
vector_display = VectorDisplay(Anchor=divide_surface.Points, Vector=divide_surface.Normals)
move_5 = Move(Geometry=divide_surface.Points, Motion=amplitude)  # -> flatten(Geometry), Transform
expression = Expression(x=number_slider_5, Expression="x+1")
surface_from_points = SurfaceFromPoints(Points=move_5.Geometry, UCount=expression, Interpolate=False)
mesh_frompoints = MeshFromPoints(Points=move_5.Geometry, UDirection=expression, VDirection=expression)
deconstruct_brep = DeconstructBrep(Brep=surface_from_points)  # -> Faces, graft(Edges), Vertices
deconstruct_brep_2 = DeconstructBrep(Brep=surface)  # -> Faces, graft(Edges), Vertices
loft_2 = Loft(
    Curves=[deconstruct_brep.Edges, deconstruct_brep_2.Edges],
    Options={Adjust=False, Closed=False, LoftEnds=0, LoftSimp=0, LoftType=0, Rebuild=10, Refit=0.01})  # -> flatten(Loft)

merge_2 = Merge(Data1=surface_from_points, Data2=loft_2, Data3=surface)

brep_join = BrepJoin(Breps=merge_2)  # -> flatten(Breps), Closed

dispatch = Dispatch(List=brep_join.Breps, DispatchPattern=[True, False])  # -> ListA, ListB
deconstruct_brep_3 = DeconstructBrep(Brep=dispatch.ListA)  # -> Faces, graft(Edges), Vertices
deconstruct_brep_4 = DeconstructBrep(Brep=dispatch.ListB)  # -> Faces, graft(Edges), Vertices
loft_3 = Loft(
    Curves=[deconstruct_brep_3.Edges, deconstruct_brep_4.Edges],
    Options={Adjust=False, Closed=False, LoftEnds=0, LoftSimp=0, LoftType=0, Rebuild=10, Refit=0.01})
# rc
# rs
# Full multiplicity knots at start
# Simple knots
# Full multiplicity knots at end
# P1
# A=0.2*P1+ 0.8*P2
# D=0.2*A + 0.8*B
# P2
# B=0.47*P2 + 0.53*P3
# Full multiplicity knots at start
# E=0.7*B + 0.3*C
# P3
# Full multiplicity knots in the middle
# C=0.8*P3 + 0.2*P4
# P4
# Full multiplicity knots at end
# Compare knot spacing
merge_3 = Merge(Data1=pipe_variable, Data2=brep_join.Breps, Data3=loft_3, Data4=pipe)
