# Grasshopper definition SetsTree110b.gh (Grasshopper 1.0.7)
# Copyright: Wickerson Studios
# plug-ins: MeshEdit Components, Bifocals

# Wickerson Studio
# 
# created by: Michael Wickerson
# 
# Grasshopper for Rhino 3D Algorithmic Modeling
# 
# www.wickersonstudios.com
# www.michaelwickerson.com
# https://www.youtube.com/channel/UC7J48Ppcsa6oncp6d29R0xw
# https://github.com/mwickerson
# https://www.facebook.com/michael.wickerson
# https://www.linkedin.com/in/michael-wickerson-696a80156/
# https://www.grasshopper3d.com/profile/MichaelWickerson
image_sampler = ImageSampler(
    FilePath="C:\Users\Sculpture\Documents\2020Grasshopper\ScreenShots2019\Screenshots2020\SurfaceEditAlgorithm.PNG",
    Filter="Value",
    Interpolate=False,
    Umax=1,
    Umin=0,
    Vmax=1,
    Vmin=0,
    Wrap=1)
# VECTOR GRID 110/1001 NODE: Grid and Populate
# Wickerson Studio
# created by: Michael Wickerson
# Grasshopper for Rhino 3D Algorithmic Modeling
# www.wickersonstudios.com
# www.michaelwickerson.com
# https://www.youtube.com/channel/UC7J48Ppcsa6oncp6d29R0xw
# https://github.com/mwickerson
# https://www.facebook.com/michael.wickerson
# https://www.linkedin.com/in/michael-wickerson-696a80156/
# https://www.grasshopper3d.com/profile/MichaelWickerson
number_slider = Slider(59, range=0..120)
number_slider_2 = Slider(0, range=0..100)
polygon = Polygon(Plane=PlaneXY(0, 0, 0), Radius=Slider(80, range=0..80), Segments=Slider(4, range=0..10), FilletRadius=0)  # -> Polygon, Length
# 1001 GRASSHOPPER DEFINITIONS
populate_2d = Populate2D(Region=polygon.Polygon, Count=number_slider, Seed=number_slider_2)  # -> simplify(Population)
boundary_surfaces = BoundarySurfaces(Edges=polygon.Polygon)
flip_matrix = FlipMatrix(Data=populate_2d)
series = Series(Start=0, Step=1, Count=number_slider)
point = Point(simplify(populate_2d))
point_2 = Point(flip_matrix)
populate_geometry = PopulateGeometry(Geometry=boundary_surfaces, Count=number_slider, Seed=number_slider_2)
param_viewer = ParamViewer(point_2)
param_viewer_2 = ParamViewer(point)
number_slider_3 = Slider(3, range=1..5)
path_mapper = PathMapper(point_2, source="{A;B}(i)", target="{A;i}(B)")
path_mapper_2 = PathMapper(point, source="{A;B}(i)", target="{A;B}(i)")
unit_z = UnitZ(Factor=series)
panel = Panel("{0,2,...;0,2,...}[1,3,5,7,9]")
panel_2 = Panel("{0,4,...;0,4,...}[1,3,5,7,9]")
split_tree = SplitTree(Data=path_mapper_2, Masks=flatten("{0;0,2,...}[0,2,...]"))  # -> Positive, Negative
split_tree_2 = SplitTree(Data=path_mapper, Masks=flatten("{0;0,3,...}[0,3,...]"))  # -> Positive, Negative
geometry = Geometry(split_tree_2.Positive)
geometry_2 = Geometry(split_tree_2.Negative)
geometry_3 = Geometry(split_tree.Positive)
geometry_4 = Geometry(split_tree.Negative)
move = Move(Geometry=geometry_3, Motion=unit_z)  # -> Geometry, Transform
move_2 = Move(Geometry=geometry, Motion=unit_z)  # -> Geometry, Transform
move_3 = Move(Geometry=geometry_2, Motion=unit_z)  # -> Geometry, Transform
sort_list = SortList(Keys=move.Geometry, ValuesA=move.Geometry)  # -> Keys, ValuesA
nurbs_curve = NurbsCurve(Vertices=sort_list.ValuesA, Degree=number_slider_3, Periodic=False)  # -> Curve, Length, Domain
nurbs_curve_2 = NurbsCurve(Vertices=move_2.Geometry, Degree=number_slider_3, Periodic=False)  # -> Curve, Length, Domain
nurbs_curve_3 = NurbsCurve(Vertices=move_3.Geometry, Degree=number_slider_3, Periodic=False)  # -> Curve, Length, Domain
merge = Merge(Data1=nurbs_curve.Curve, Data2=nurbs_curve_2.Curve, Data3=nurbs_curve_3.Curve)
range = Range(Domain=Domain(0, 1), Steps=10)
graph_mapper = GraphMapper(
    range,
    x0=0,
    x1=1,
    y0=0,
    y1=1,
    container_name="Sine",
    Equation_px=[0.02637743205, 0.2648532987],
    Equation_py=[0.5683245063, 0.8610776663])
pipe_variable = PipeVariable(Curve=reparameterize(merge), Parameters=range, Radii=graph_mapper, Caps=2)
loft = Loft(
    Curves=[nurbs_curve.Curve, nurbs_curve_2.Curve],
    Options={Adjust=True, Closed=False, LoftEnds=0, LoftSimp=0, LoftType=0, Rebuild=10, Refit=0.01})
loft_2 = Loft(
    Curves=[nurbs_curve_2.Curve, nurbs_curve_3.Curve],
    Options={Adjust=True, Closed=False, LoftEnds=0, LoftSimp=0, LoftType=0, Rebuild=10, Refit=0.01})
loft_3 = Loft(
    Curves=[nurbs_curve.Curve, nurbs_curve_3.Curve],
    Options={Adjust=True, Closed=False, LoftEnds=0, LoftSimp=0, LoftType=0, Rebuild=10, Refit=0.01})

number_slider_4 = Slider(4, range=0..10)  # disabled
number_slider_5 = Slider(3, range=0..10)  # disabled
number_slider_6 = Slider(7, range=0..10)  # disabled
number_slider_7 = Slider(4, range=0..10)  # disabled
number_slider_8 = Slider(0, range=0..1)  # disabled
number_slider_9 = Slider(10, range=0..10)  # disabled
radial = Radial(Plane=PlaneXY(0, 0, 0), Size=number_slider_5, ExtentR=number_slider_7, ExtentP=number_slider_6)  # -> Cells, Points; disabled
rectangular = Rectangular(Plane=PlaneXY(0, 0, 0), SizeX=number_slider_5, SizeY=number_slider_4, ExtentX=number_slider_7, ExtentY=number_slider_6)  # -> Cells, Points; disabled
number_slider_10 = Slider(10, range=0..10)  # disabled
hexagonal = Hexagonal(Plane=PlaneXY(0, 0, 0), Size=number_slider_5, ExtentX=number_slider_7, ExtentY=number_slider_6)  # -> Cells, Points; disabled
point_3 = Point(simplify(hexagonal.Points))  # disabled
construct_domain = ConstructDomain(DomainStart=number_slider_9, DomainEnd=number_slider_8)  # disabled
flip_matrix_2 = FlipMatrix(Data=point_3)  # disabled
point_4 = Point(flip_matrix_2)  # disabled
path_mapper_3 = PathMapper(point_4, source="{A}", target="{A}")  # disabled
param_viewer_3 = ParamViewer(point_3)  # disabled
param_viewer_4 = ParamViewer(point_4)  # disabled
range_2 = Range(Domain=construct_domain, Steps=number_slider_10)  # disabled
number_slider_11 = Slider(3.32, range=0..10)  # disabled
unit_z_2 = UnitZ(Factor=range_2)  # disabled
path_mapper_4 = PathMapper(point_3, source="{A}", target="{A}")  # disabled
move_4 = Move(Geometry=graft(point_3), Motion=unit_z_2)  # -> Geometry, Transform; disabled
move_5 = Move(Geometry=path_mapper_3, Motion=reverse(unit_z_2))  # -> Geometry, Transform; disabled
move_6 = Move(Geometry=point_3, Motion=unit_z_2)  # -> Geometry, Transform; disabled
negative = Negative(Value=number_slider_11)  # disabled
interpolate = Interpolate(Vertices=move_5.Geometry, Degree=3, Periodic=False, KnotStyle=1)  # -> Curve, Length, Domain; disabled
interpolate_2 = Interpolate(Vertices=move_6.Geometry, Degree=3, Periodic=False, KnotStyle=1)  # -> flatten(Curve), Length, Domain; disabled
construct_domain_2 = ConstructDomain(DomainStart=negative, DomainEnd=number_slider_11)  # disabled
interpolate_3 = Interpolate(Vertices=move_4.Geometry, Degree=3, Periodic=False, KnotStyle=1)  # -> Curve, Length, Domain; disabled
list_length = ListLength(List=interpolate_2.Curve)  # disabled
panel_3 = Panel("{0,2,...;?}[?]")  # disabled
range_3 = Range(Domain=construct_domain_2, Steps=expr("x-1", list_length))  # disabled
param_viewer_5 = ParamViewer(interpolate_3.Curve)  # disabled
path_mapper_5 = PathMapper(interpolate_3.Curve, source="{A;B}(i)", target="{A;i}(B)")  # disabled
number_slider_12 = Slider(0.88, range=0..1)  # disabled
unit_z_3 = UnitZ(Factor=range_3)  # disabled
split_tree_3 = SplitTree(Data=path_mapper_5, Masks=flatten(panel_3))  # -> Positive, Negative; disabled
jitter = Jitter(List=unit_z_3, Jitter=number_slider_12, Seed=2)  # -> Values, Indices; disabled
geometry_5 = Geometry(split_tree_3.Negative)  # disabled
geometry_6 = Geometry(split_tree_3.Positive)  # disabled
number_slider_13 = Slider(0.305, range=0..1)  # disabled
move_7 = Move(Geometry=interpolate_2.Curve, Motion=jitter.Values)  # -> Geometry, Transform; disabled
merge_2 = Merge(Data1=geometry_5, Data2=interpolate_2.Curve, Data3=interpolate.Curve)  # disabled
range_4 = Range(Domain=Domain(0, 1), Steps=10)  # disabled
graph_mapper_2 = GraphMapper(
    range_4,
    x0=0.1,
    x1=1,
    y0=0.1,
    y1=1,
    Ox=0.5740755796,
    Oy=0.06351459026,
    Px=0.8925193548,
    Py=0.1930966377,
    container_name="Parabola")  # disabled
loft_4 = Loft(Curves=move_7.Geometry, Options={Adjust=False, Closed=False, LoftEnds=0, LoftSimp=0, LoftType=0, Rebuild=10, Refit=0.01})  # disabled
pipe_variable_2 = PipeVariable(Curve=reparameterize(geometry_6), Parameters=range_4, Radii=graph_mapper_2, Caps=0)  # disabled
# GH solution
# VB
# C#
# Python with RhinoCommon Only
# Pythong with RhinoScriptSyntax
# GH solution
# VB
# C#
# Python
# VB
pipe = Pipe(Curve=merge_2, Radius=number_slider_13, Caps=2)  # disabled

number_slider_14 = Slider(42, range=0..100)  # disabled
surface = Surface(loft_4)  # disabled
number_slider_15 = Slider(0.698, range=0.001..2)  # disabled
divide_surface = DivideSurface(Surface=surface, UCount=number_slider_14, VCount=number_slider_14)  # -> Points, Normals, Parameters; disabled
amplitude = Amplitude(Vector=divide_surface.Normals, Amplitude=number_slider_15)  # disabled
vector_display = VectorDisplay(Anchor=divide_surface.Points, Vector=divide_surface.Normals)  # disabled
move_8 = Move(Geometry=divide_surface.Points, Motion=amplitude)  # -> flatten(Geometry), Transform; disabled
expression = Expression(x=number_slider_14, Expression="x+1")  # disabled
surface_from_points = SurfaceFromPoints(Points=move_8.Geometry, UCount=expression, Interpolate=False)  # disabled
mesh_frompoints = MeshFromPoints(Points=move_8.Geometry, UDirection=expression, VDirection=expression)  # disabled
deconstruct_brep = DeconstructBrep(Brep=surface_from_points)  # -> Faces, graft(Edges), Vertices; disabled
deconstruct_brep_2 = DeconstructBrep(Brep=surface)  # -> Faces, graft(Edges), Vertices; disabled
loft_5 = Loft(
    Curves=[deconstruct_brep.Edges, deconstruct_brep_2.Edges],
    Options={Adjust=False, Closed=False, LoftEnds=0, LoftSimp=0, LoftType=0, Rebuild=10, Refit=0.01})  # -> flatten(Loft); disabled

merge_3 = Merge(Data1=surface_from_points, Data2=loft_5, Data3=surface)  # disabled

brep_join = BrepJoin(Breps=merge_3)  # -> flatten(Breps), Closed; disabled

dispatch = Dispatch(List=brep_join.Breps, DispatchPattern=[True, False])  # -> ListA, ListB; disabled
deconstruct_brep_3 = DeconstructBrep(Brep=dispatch.ListA)  # -> Faces, graft(Edges), Vertices; disabled
deconstruct_brep_4 = DeconstructBrep(Brep=dispatch.ListB)  # -> Faces, graft(Edges), Vertices; disabled
loft_6 = Loft(
    Curves=[deconstruct_brep_3.Edges, deconstruct_brep_4.Edges],
    Options={Adjust=False, Closed=False, LoftEnds=0, LoftSimp=0, LoftType=0, Rebuild=10, Refit=0.01})  # disabled
# rc
# rs
# Full multiplicity knots at start
# Simple knots
# Full multiplicity knots at end
# P1
# A=0.2*P1+ 0.8*P2
# D=0.2*A + 0.8*B
# P2
# B=0.47*P2 + 0.53*P3
# Full multiplicity knots at start
# E=0.7*B + 0.3*C
# P3
# Full multiplicity knots in the middle
# C=0.8*P3 + 0.2*P4
# P4
# Full multiplicity knots at end
# Compare knot spacing
merge_4 = Merge(Data1=pipe_variable_2, Data2=brep_join.Breps, Data3=loft_6, Data4=pipe)  # disabled
