# Grasshopper definition SetsTree110c.gh (Grasshopper 1.0.7)
# Copyright: Wickerson Studios

# Wickerson Studio
# 
# created by: Michael Wickerson
# 
# Grasshopper for Rhino 3D Algorithmic Modeling
# 
# www.wickersonstudios.com
# www.michaelwickerson.com
# https://www.youtube.com/channel/UC7J48Ppcsa6oncp6d29R0xw
# https://github.com/mwickerson
# https://www.facebook.com/michael.wickerson
# https://www.linkedin.com/in/michael-wickerson-696a80156/
# https://www.grasshopper3d.com/profile/MichaelWickerson
image_sampler = ImageSampler(
    FilePath="C:\Users\Sculpture\Documents\2020Grasshopper\ScreenShots2019\Screenshots2020\SurfaceEditAlgorithm.PNG",
    Filter="Value",
    Interpolate=False,
    Umax=1,
    Umin=0,
    Vmax=1,
    Vmin=0,
    Wrap=1)
# VECTOR GRID 110/1001 NODE: Grid and Populate
# Wickerson Studio
# created by: Michael Wickerson
# Grasshopper for Rhino 3D Algorithmic Modeling
# www.wickersonstudios.com
# www.michaelwickerson.com
# https://www.youtube.com/channel/UC7J48Ppcsa6oncp6d29R0xw
# https://github.com/mwickerson
# https://www.facebook.com/michael.wickerson
# https://www.linkedin.com/in/michael-wickerson-696a80156/
# https://www.grasshopper3d.com/profile/MichaelWickerson
square = Square(Plane=PlaneXY(0, 0, 0), Size=1, ExtentX=5, ExtentY=5)  # -> simplify(Cells), simplify(Points)
point = Point(graft(square.Points))
panel = Panel("{0;1}")
panel_2 = Panel("{1;1}")
# 1001 GRASSHOPPER DEFINITIONS
param_viewer = ParamViewer(point)
path_mapper = PathMapper(point, source="{A;B}(i)", target="{A;B}(i)")
panel_3 = Panel("{0;-1}")
panel_4 = Panel("{1;-1}")
panel_5 = Panel("""{0;1}
{1;1}""")
point_list = PointList(Points=point, Size=Slider(0.688, range=0..1))
relative_item = RelativeItem(Tree=point, Offset=["{1;-2}", "{1;2}"], WrapPaths=False, WrapItems=False)  # -> ItemA, ItemB
relative_item_2 = RelativeItem(Tree=point, Offset=panel_5, WrapPaths=False, WrapItems=False)  # -> ItemA, ItemB
split_tree = SplitTree(Data=path_mapper, Masks=flatten("{0,2,...;0,2,...}[?]"))  # -> Positive, Negative
point_2 = Point(graft(split_tree.Positive))
point_3 = Point(flatten(split_tree.Positive))
point_4 = Point(relative_item.ItemB)
point_5 = Point(relative_item.ItemA)
point_6 = Point(relative_item_2.ItemB)
point_7 = Point(relative_item_2.ItemA)
number_slider = Slider(0.08, range=0..1)
line = Line(StartPoint=point_5, EndPoint=point_4)
line_2 = Line(StartPoint=point_2, EndPoint=point_3)
line_3 = Line(StartPoint=point_7, EndPoint=point_6)
# rs
# Full multiplicity knots at start
# Simple knots
# Full multiplicity knots at end
# P1
# A=0.2*P1+ 0.8*P2
# D=0.2*A + 0.8*B
# P2
# B=0.47*P2 + 0.53*P3
# Full multiplicity knots at start
# E=0.7*B + 0.3*C
# P3
# Full multiplicity knots in the middle
# C=0.8*P3 + 0.2*P4
# P4
# Full multiplicity knots at end
# Compare knot spacing
# GH solution
# VB
# C#
# Python with RhinoCommon Only
# Pythong with RhinoScriptSyntax
# GH solution
# VB
# C#
# Python
# VB
pipe = Pipe(Curve=line, Radius=Slider(0.08, range=0..1), Caps=2)
pipe_2 = Pipe(Curve=line_2, Radius=number_slider, Caps=2)
# rc
pipe_3 = Pipe(Curve=line_3, Radius=number_slider, Caps=2)
