# Grasshopper definition SetsTree111.gh (Grasshopper 1.0.7)
# Copyright: Wickerson Studios
# plug-ins: Bifocals

# 1001 GRASSHOPPER DEFINITIONS
# Wickerson Studio
# 
# created by: Michael Wickerson
# 
# Grasshopper for Rhino 3D Algorithmic Modeling
# 
# www.wickersonstudios.com
# www.michaelwickerson.com
# https://www.youtube.com/channel/UC7J48Ppcsa6oncp6d29R0xw
# https://github.com/mwickerson
# https://www.facebook.com/michael.wickerson
# https://www.linkedin.com/in/michael-wickerson-696a80156/
# https://www.grasshopper3d.com/profile/MichaelWickerson
image_sampler = ImageSampler(
    FilePath="C:\Users\Sculpture\Documents\2020Grasshopper\ScreenShots2019\Screenshots2020\SurfaceEditAlgorithm.PNG",
    Filter="Value",
    Interpolate=False,
    Umax=1,
    Umin=0,
    Vmax=1,
    Vmin=0,
    Wrap=1)
# Wickerson Studio
# created by: Michael Wickerson
# Grasshopper for Rhino 3D Algorithmic Modeling
# www.wickersonstudios.com
# www.michaelwickerson.com
# https://www.youtube.com/channel/UC7J48Ppcsa6oncp6d29R0xw
# https://github.com/mwickerson
# https://www.facebook.com/michael.wickerson
# https://www.linkedin.com/in/michael-wickerson-696a80156/
# https://www.grasshopper3d.com/profile/MichaelWickerson
square = Square(Plane=PlaneXY(0, 0, 0), Size=1, ExtentX=5, ExtentY=5)  # -> Cells, simplify(Points)
radial = Radial(Plane=PlaneXY(0, 0, 0), Size=1, ExtentR=5, ExtentP=20)  # -> Cells, simplify(Points)
triangular = Triangular(Plane=PlaneXY(0, 0, 0), Size=1, ExtentX=5, ExtentY=5)  # -> Cells, simplify(Points)
hexagonal = Hexagonal(Plane=PlaneXY(0, 0, 0), Size=1, ExtentX=5, ExtentY=5)  # -> Cells, simplify(Points)
# VECTOR GRID 111/1001
# NODE: Relative Item(s)
point = Point(graft(radial.Points))

panel = Panel("{-1;2}")
panel_2 = Panel("{0;1}")
panel_3 = Panel("{1;1}")
panel_4 = Panel("{-1;-2}")
panel_5 = Panel("{0;-1}")
panel_6 = Panel("{1;-1}")
relative_item = RelativeItem(Tree=point, Offset=["{1;-2}", "{1;2}"], WrapPaths=False, WrapItems=False)  # -> ItemA, ItemB
point_2 = Point(relative_item.ItemB)
point_3 = Point(relative_item.ItemA)
line = Line(StartPoint=point_3, EndPoint=point_2)
pipe = Pipe(Curve=line, Radius=Slider(0.08, range=0..1), Caps=2)

panel_7 = Panel("""{0;1}
{1;1}""")
relative_item_2 = RelativeItem(Tree=point, Offset=panel_7, WrapPaths=False, WrapItems=False)  # -> ItemA, ItemB
point_4 = Point(relative_item_2.ItemA)
point_5 = Point(relative_item_2.ItemB)
number_slider = Slider(0.08, range=0..1)
line_2 = Line(StartPoint=point_4, EndPoint=point_5)
pipe_2 = Pipe(Curve=line_2, Radius=number_slider, Caps=2)

construct_domain = ConstructDomain(DomainStart=Slider(0, range=0..10), DomainEnd=Slider(10, range=0..10))
range = Range(Domain=construct_domain, Steps=Slider(20, range=0..20))
unit_z = UnitZ(Factor=range)
move = Move(Geometry=radial.Points, Motion=unit_z)  # -> simplify(graft(Geometry)), Transform
param_viewer = ParamViewer(move.Geometry)
relative_items = RelativeItems(TreeA=point, TreeB=move.Geometry, Offset=["{1;-2}", "{-1;-2}", "{1;2}", "{-1;2}"], WrapPaths=False, WrapItems=False)  # -> ItemA, ItemB
point_6 = Point(relative_items.ItemB)
point_7 = Point(relative_items.ItemA)
line_3 = Line(StartPoint=point_7, EndPoint=point_6)
# rc
# rs
# Full multiplicity knots at start
# Simple knots
# Full multiplicity knots at end
# P1
# A=0.2*P1+ 0.8*P2
# D=0.2*A + 0.8*B
# P2
# B=0.47*P2 + 0.53*P3
# Full multiplicity knots at start
# E=0.7*B + 0.3*C
# P3
# Full multiplicity knots in the middle
# C=0.8*P3 + 0.2*P4
# P4
# Full multiplicity knots at end
# Compare knot spacing
# GH solution
# VB
# C#
# Python with RhinoCommon Only
# Pythong with RhinoScriptSyntax
# GH solution
# VB
# C#
# Python
# VB
pipe_3 = Pipe(Curve=line_3, Radius=Slider(0.135, range=0..1), Caps=2)

relative_item_3 = RelativeItem(Tree=point, Offset=["{0;-1}", "{1;1}", "{1;-1}", "{1;2}", "{1;-2}", "{0;1}"], WrapPaths=False, WrapItems=False)  # -> ItemA, ItemB
point_8 = Point(relative_item_3.ItemA)
point_9 = Point(relative_item_3.ItemB)
line_4 = Line(StartPoint=point_8, EndPoint=point_9)
pipe_4 = Pipe(Curve=line_4, Radius=Slider(0.08, range=0..1), Caps=2)

path_mapper = PathMapper(point, source="{A;B}(i)", target="{A;i}(B)")
path_mapper_2 = PathMapper(point, source="{A;B}(i)", target="{A;B}(i)")
param_viewer_2 = ParamViewer(point)
number_slider_2 = Slider(0.688, range=0..1)
split_tree = SplitTree(Data=path_mapper, Masks=flatten("{0,2,...;0,2,...}[?]"))  # -> Positive, Negative
point_10 = Point(simplify(graft(split_tree.Positive)))
point_11 = Point(flatten(split_tree.Positive))
param_viewer_3 = ParamViewer(point_11)
param_viewer_4 = ParamViewer(point_10)
line_5 = Line(StartPoint=point_10, EndPoint=point_11)
pipe_5 = Pipe(Curve=line_5, Radius=number_slider, Caps=2)
