# Grasshopper definition SetsTree112E.gh (Grasshopper 1.0.7)
# Copyright: Wickerson Studios
# plug-ins: Bifocals

# 1001 GRASSHOPPER DEFINITIONS
# Wickerson Studio
# 
# created by: Michael Wickerson
# 
# Grasshopper for Rhino 3D Algorithmic Modeling
# 
# www.wickersonstudios.com
# www.michaelwickerson.com
# https://www.youtube.com/channel/UC7J48Ppcsa6oncp6d29R0xw
# https://github.com/mwickerson
# https://www.facebook.com/michael.wickerson
# https://www.linkedin.com/in/michael-wickerson-696a80156/
# https://www.grasshopper3d.com/profile/MichaelWickerson
image_sampler = ImageSampler(
    FilePath="C:\Users\Sculpture\Documents\2020Grasshopper\ScreenShots2019\Screenshots2020\SurfaceEditAlgorithm.PNG",
    Filter="Value",
    Interpolate=False,
    Umax=1,
    Umin=0,
    Vmax=1,
    Vmin=0,
    Wrap=1)
# Wickerson Studio
# created by: Michael Wickerson
# Grasshopper for Rhino 3D Algorithmic Modeling
# www.wickersonstudios.com
# www.michaelwickerson.com
# https://www.youtube.com/channel/UC7J48Ppcsa6oncp6d29R0xw
# https://github.com/mwickerson
# https://www.facebook.com/michael.wickerson
# https://www.linkedin.com/in/michael-wickerson-696a80156/
# https://www.grasshopper3d.com/profile/MichaelWickerson
number_slider = Slider(6, range=0..10)
# DIVIDE SURFACE 112/1001 NODE: Relative Item(s)
sphere = Sphere(Base=PlaneXY(0, 0, 0), Radius=1)
divide_surface = DivideSurface(Surface=sphere, UCount=number_slider, VCount=number_slider)  # -> simplify(graft(Points)), Normals, Parameters
point = Point(divide_surface.Points)
flip_matrix = FlipMatrix(Data=divide_surface.Normals)
path_mapper = PathMapper(point, source="{A;B}", target="{A;B}")
path_mapper_2 = PathMapper(divide_surface.Points, source="{A;B}(i)", target="{A;B+3}(i)")
path_mapper_3 = PathMapper(point, source="{A;B}(i)", target="{A;B*3}(i)")
param_viewer = ParamViewer(flip_matrix)
construct_domain = ConstructDomain(DomainStart=Slider(0, range=0..10), DomainEnd=Slider(10, range=0..10))
range = Range(Domain=construct_domain, Steps=expr("x-1", Slider(5, range=0..20)))
vector = Vector(flip_matrix)
amplitude = Amplitude(Vector=vector, Amplitude=range)
point_2 = Point(path_mapper_2)
panel = Panel("{1;-2}")
panel_2 = Panel("{0;-1}")
panel_3 = Panel("{1;-1}")
panel_4 = Panel("{1;2}")
move = Move(Geometry=divide_surface.Points, Motion=amplitude)  # -> simplify(graft(Geometry)), Transform
panel_5 = Panel("{2;3}")
panel_6 = Panel("{4;5}")
panel_7 = Panel("{5;6}")
panel_8 = Panel("{2;-3}")
relative_items = RelativeItems(TreeA=path_mapper, TreeB=move.Geometry, Offset=["{0;1}", "{1;1}"], WrapPaths=False, WrapItems=False)  # -> ItemA, ItemB
point_3 = Point(relative_items.ItemB)
point_4 = Point(relative_items.ItemA)
line = Line(StartPoint=point_4, EndPoint=point_3)
pipe = Pipe(Curve=line, Radius=Slider(0.135, range=0..1), Caps=2)
loft = Loft(Curves=line, Options={Adjust=False, Closed=False, LoftEnds=0, LoftSimp=0, LoftType=0, Rebuild=10, Refit=0.01})
surface = Surface(loft)
panel_9 = Panel(loft)
md_slider = MDSlider(
    SliderMode=0,
    slider_value=Point(0.5647732804, 0.5101281143, 0.5),
    x_domain=Domain(0, 1),
    y_domain=Domain(0, 1),
    z_domain=Domain(0, 1))
construct_domain_2 = ConstructDomain(DomainU=md_slider, DomainV=md_slider)
isotrim = Isotrim(Surface=reparameterize(surface), Domain=construct_domain_2)
deconstruct_brep = DeconstructBrep(Brep=isotrim)  # -> Faces, Edges, Vertices
list_item = ListItem(List=deconstruct_brep.Vertices, Index="2", Wrap=True)

surface_closest_point = SurfaceClosestPoint(Point=list_item, Surface=surface)  # -> Point, UVPoint, Distance
evaluate_surface = EvaluateSurface(Surface=surface, Point=surface_closest_point.UVPoint)  # -> Point, Normal, UDirection, VDirection, Frame

number_slider_2 = Slider(1, range=0..1)
amplitude_2 = Amplitude(Vector=evaluate_surface.Normal, Amplitude=number_slider_2)
# rs
multiplication = Multiplication(A=evaluate_surface.Normal, B=number_slider_2)
extrude = Extrude(Base=surface, Direction=multiplication)
# rc
# Full multiplicity knots at start
# Simple knots
# Full multiplicity knots at end
# P1
# A=0.2*P1+ 0.8*P2
# D=0.2*A + 0.8*B
# P2
# B=0.47*P2 + 0.53*P3
# Full multiplicity knots at start
# E=0.7*B + 0.3*C
# P3
# Full multiplicity knots in the middle
# C=0.8*P3 + 0.2*P4
# P4
# Full multiplicity knots at end
# Compare knot spacing
# GH solution
# VB
# C#
# Python with RhinoCommon Only
# Pythong with RhinoScriptSyntax
# GH solution
# VB
# C#
# Python
# VB
vector_display = VectorDisplay(Anchor=evaluate_surface.Point, Vector=amplitude_2)
