# Grasshopper definition SetsTree112b.gh (Grasshopper 1.0.7)
# Copyright: Wickerson Studios
# plug-ins: Bifocals

# Wickerson Studio
# 
# created by: Michael Wickerson
# 
# Grasshopper for Rhino 3D Algorithmic Modeling
# 
# www.wickersonstudios.com
# www.michaelwickerson.com
# https://www.youtube.com/channel/UC7J48Ppcsa6oncp6d29R0xw
# https://github.com/mwickerson
# https://www.facebook.com/michael.wickerson
# https://www.linkedin.com/in/michael-wickerson-696a80156/
# https://www.grasshopper3d.com/profile/MichaelWickerson
image_sampler = ImageSampler(
    FilePath="C:\Users\Sculpture\Documents\2020Grasshopper\ScreenShots2019\Screenshots2020\SurfaceEditAlgorithm.PNG",
    Filter="Value",
    Interpolate=False,
    Umax=1,
    Umin=0,
    Vmax=1,
    Vmin=0,
    Wrap=1)
# Wickerson Studio
# created by: Michael Wickerson
# Grasshopper for Rhino 3D Algorithmic Modeling
# www.wickersonstudios.com
# www.michaelwickerson.com
# https://www.youtube.com/channel/UC7J48Ppcsa6oncp6d29R0xw
# https://github.com/mwickerson
# https://www.facebook.com/michael.wickerson
# https://www.linkedin.com/in/michael-wickerson-696a80156/
# https://www.grasshopper3d.com/profile/MichaelWickerson
square = Square(Plane=PlaneXY(0, 0, 0), Size=1, ExtentX=5, ExtentY=5)  # -> Cells, simplify(Points)
radial = Radial(Plane=PlaneXY(0, 0, 0), Size=1, ExtentR=5, ExtentP=20)  # -> Cells, simplify(Points)
triangular = Triangular(Plane=PlaneXY(0, 0, 0), Size=1, ExtentX=5, ExtentY=5)  # -> Cells, simplify(Points)
hexagonal = Hexagonal(Plane=PlaneXY(0, 0, 0), Size=1, ExtentX=5, ExtentY=5)  # -> Cells, simplify(Points)
point = Point(graft(radial.Points))
panel = Panel("{0;1}")
panel_2 = Panel("{1;1}")
panel_3 = Panel("{1;2}")
# 1001 GRASSHOPPER DEFINITIONS
# VECTOR GRID 112/1001 NODE: Relative Item(s)
param_viewer = ParamViewer(point)
panel_4 = Panel("{1;-2}")
panel_5 = Panel("{0;-1}")
panel_6 = Panel("{1;-1}")
path_mapper = PathMapper(point, source="{A;B}(i)", target="{A;B+1}(i)")
path_mapper_2 = PathMapper(point, source="{A;B}(i)", target="{A;B+3}(i)")
path_mapper_3 = PathMapper(point, source="{A;B}(i)", target="{A;B*3}(i)")
construct_domain = ConstructDomain(DomainStart=Slider(2.77, range=0..10), DomainEnd=Slider(10, range=0..10))
range = Range(Domain=construct_domain, Steps=Slider(20, range=0..20))
unit_z = UnitZ(Factor=range)
move = Move(Geometry=radial.Points, Motion=unit_z)  # -> simplify(graft(Geometry)), Transform
param_viewer_2 = ParamViewer(move.Geometry)
relative_items = RelativeItems(
    TreeA=path_mapper_3,
    TreeB=move.Geometry,
    Offset=["{0;1}", "{1;2}", "{2;3}", "{3;4}", "{4;5}", "{5;6}"],
    WrapPaths=False,
    WrapItems=False)  # -> ItemA, ItemB
point_2 = Point(relative_items.ItemB)
point_3 = Point(relative_items.ItemA)
line = Line(StartPoint=point_3, EndPoint=point_2)
# rc
# rs
# Full multiplicity knots at start
# Simple knots
# Full multiplicity knots at end
# P1
# A=0.2*P1+ 0.8*P2
# D=0.2*A + 0.8*B
# P2
# B=0.47*P2 + 0.53*P3
# Full multiplicity knots at start
# E=0.7*B + 0.3*C
# P3
# Full multiplicity knots in the middle
# C=0.8*P3 + 0.2*P4
# P4
# Full multiplicity knots at end
# Compare knot spacing
# GH solution
# VB
# C#
# Python with RhinoCommon Only
# Pythong with RhinoScriptSyntax
# GH solution
# VB
# C#
# Python
# VB
pipe = Pipe(Curve=line, Radius=Slider(0.135, range=0..1), Caps=2)
