# Grasshopper definition SetsTree112d.gh (Grasshopper 1.0.7)
# Copyright: Wickerson Studios
# plug-ins: Bifocals

# Wickerson Studio
# 
# created by: Michael Wickerson
# 
# Grasshopper for Rhino 3D Algorithmic Modeling
# 
# www.wickersonstudios.com
# www.michaelwickerson.com
# https://www.youtube.com/channel/UC7J48Ppcsa6oncp6d29R0xw
# https://github.com/mwickerson
# https://www.facebook.com/michael.wickerson
# https://www.linkedin.com/in/michael-wickerson-696a80156/
# https://www.grasshopper3d.com/profile/MichaelWickerson
image_sampler = ImageSampler(
    FilePath="C:\Users\Sculpture\Documents\2020Grasshopper\ScreenShots2019\Screenshots2020\SurfaceEditAlgorithm.PNG",
    Filter="Value",
    Interpolate=False,
    Umax=1,
    Umin=0,
    Vmax=1,
    Vmin=0,
    Wrap=1)

number_slider = Slider(8, range=0..20)
sphere = Sphere(Base=PlaneXY(0, 0, 0), Radius=1)
# Wickerson Studio
# created by: Michael Wickerson
# Grasshopper for Rhino 3D Algorithmic Modeling
# www.wickersonstudios.com
# www.michaelwickerson.com
# https://www.youtube.com/channel/UC7J48Ppcsa6oncp6d29R0xw
# https://github.com/mwickerson
# https://www.facebook.com/michael.wickerson
# https://www.linkedin.com/in/michael-wickerson-696a80156/
# https://www.grasshopper3d.com/profile/MichaelWickerson
square = Square(Plane=PlaneXY(0, 0, 0), Size=1, ExtentX=5, ExtentY=5)  # -> Cells, simplify(Points)
radial = Radial(Plane=PlaneXY(0, 0, 0), Size=1, ExtentR=5, ExtentP=20)  # -> Cells, simplify(Points)
rectangular = Rectangular(Plane=PlaneXY(0, 0, 0), SizeX=1, SizeY=2, ExtentX=10, ExtentY=5)  # -> Cells, simplify(Points)
divide_surface = DivideSurface(Surface=sphere, UCount=number_slider, VCount=number_slider)  # -> simplify(graft(Points)), Normals, Parameters
populate_geometry = PopulateGeometry(Geometry=sphere, Count=number_slider, Seed=1)  # -> simplify(graft(Population))
# VECTOR GRID 112/1001 NODE: Relative Item(s)
point = Point(graft(populate_geometry))
# 1001 GRASSHOPPER DEFINITIONS
param_viewer = ParamViewer(point)
path_mapper = PathMapper(divide_surface.Points, source="{A;B}(i)", target="{A;B+3}(i)")
path_mapper_2 = PathMapper(point, source="{A;B}(i)", target="{A;B*3}(i)")
path_mapper_3 = PathMapper(point, source="{A;B}", target="{A;B}")
construct_domain = ConstructDomain(DomainStart=Slider(2.77, range=0..10), DomainEnd=Slider(10, range=0..10))
range = Range(Domain=construct_domain, Steps=expr("x-1", Slider(20, range=0..20)))
unit_z = UnitZ(Factor=range)
panel = Panel("{1;-2}")
point_2 = Point(path_mapper_3)
panel_2 = Panel("{0;-1}")
panel_3 = Panel("{1;-1}")
panel_4 = Panel("{1;2}")
panel_5 = Panel("{1;1}")
panel_6 = Panel("{5;6}")
panel_7 = Panel("{2;-3}")
number_slider_2 = Slider(0, range=0..1)

param_viewer_2 = ParamViewer(populate_geometry)
vector = Vector(divide_surface.Normals)
amplitude = Amplitude(Vector=vector, Amplitude=range)

move = Move(Geometry=populate_geometry, Motion=amplitude)  # -> simplify(graft(Geometry)), Transform
relative_items = RelativeItems(
    TreeA=path_mapper_3,
    TreeB=move.Geometry,
    Offset=["{0;1}", "{2;3}", "{4;5}"],
    WrapPaths=number_slider_2,
    WrapItems=number_slider_2)  # -> ItemA, ItemB
param_viewer_3 = ParamViewer(relative_items.ItemA)
point_3 = Point(relative_items.ItemB)
point_4 = Point(relative_items.ItemA)
line = Line(StartPoint=point_4, EndPoint=point_3)
loft = Loft(Curves=line, Options={Adjust=False, Closed=False, LoftEnds=0, LoftSimp=0, LoftType=0, Rebuild=10, Refit=0.01})
# rc
# rs
# Full multiplicity knots at start
# Simple knots
# Full multiplicity knots at end
# P1
# A=0.2*P1+ 0.8*P2
# D=0.2*A + 0.8*B
# P2
# B=0.47*P2 + 0.53*P3
# Full multiplicity knots at start
# E=0.7*B + 0.3*C
# P3
# Full multiplicity knots in the middle
# C=0.8*P3 + 0.2*P4
# P4
# Full multiplicity knots at end
# Compare knot spacing
# GH solution
# VB
# C#
# Python with RhinoCommon Only
# Pythong with RhinoScriptSyntax
# GH solution
# VB
# C#
# Python
# VB
pipe = Pipe(Curve=line, Radius=Slider(0.135, range=0..1), Caps=2)
