# Grasshopper definition SetsTree112f.gh (Grasshopper 1.0.7)
# Copyright: Wickerson Studios
# plug-ins: Bifocals

# 1001 GRASSHOPPER DEFINITIONS
# Wickerson Studio
# 
# created by: Michael Wickerson
# 
# Grasshopper for Rhino 3D Algorithmic Modeling
# 
# www.wickersonstudios.com
# www.michaelwickerson.com
# https://www.youtube.com/channel/UC7J48Ppcsa6oncp6d29R0xw
# https://github.com/mwickerson
# https://www.facebook.com/michael.wickerson
# https://www.linkedin.com/in/michael-wickerson-696a80156/
# https://www.grasshopper3d.com/profile/MichaelWickerson
image_sampler = ImageSampler(
    FilePath="C:\Users\Sculpture\Documents\2020Grasshopper\ScreenShots2019\Screenshots2020\SurfaceEditAlgorithm.PNG",
    Filter="Value",
    Interpolate=False,
    Umax=1,
    Umin=0,
    Vmax=1,
    Vmin=0,
    Wrap=1)
# Wickerson Studio
# created by: Michael Wickerson
# Grasshopper for Rhino 3D Algorithmic Modeling
# www.wickersonstudios.com
# www.michaelwickerson.com
# https://www.youtube.com/channel/UC7J48Ppcsa6oncp6d29R0xw
# https://github.com/mwickerson
# https://www.facebook.com/michael.wickerson
# https://www.linkedin.com/in/michael-wickerson-696a80156/
# https://www.grasshopper3d.com/profile/MichaelWickerson
number_slider = Slider(11, range=0..100)
number_slider_2 = Slider(27, range=0..30)
# DIVIDE SURFACE 112/1001 NODE: Relative Item(s)
sphere = Sphere(Base=PlaneXY(0, 0, 0), Radius=number_slider)
divide_surface = DivideSurface(Surface=sphere, UCount=number_slider_2, VCount=number_slider_2)  # -> simplify(graft(Points)), Normals, Parameters
point = Point(divide_surface.Points)
param_viewer = ParamViewer(divide_surface.Points)
list_length = ListLength(List=divide_surface.Normals)
path_mapper = PathMapper(point, source="{A;B}(i)", target="{A;B;i}")
path_mapper_2 = PathMapper(divide_surface.Points, source="{A;B}(i)", target="{A;B+12}(0)")
path_mapper_3 = PathMapper(point, source="{A;B}(i)", target="{A;B/3}(i)")
path_mapper_4 = PathMapper(divide_surface.Points, source="{A;B}(i)", target="{A/2;B/2}(i/3)")
construct_domain = ConstructDomain(DomainStart=Slider(0, range=0..10), DomainEnd=Slider(30, range=0..30))
range = Range(Domain=construct_domain, Steps=expr("x-1", list_length))
vector = Vector(divide_surface.Normals)
point_2 = Point(path_mapper)
point_3 = Point(path_mapper_2)
amplitude = Amplitude(Vector=vector, Amplitude=range)
panel = Panel("{1;-2}")
sphere_2 = Sphere(Base=point_3, Radius=Slider(0.45, range=0..1))
panel_2 = Panel("{1;-1}")
panel_3 = Panel("{1;2}")
point_list = PointList(Points=point_2)
point_list_2 = PointList(Points=point_3)
panel_4 = Panel("{0;-1}")
panel_5 = Panel("{0;1}")
panel_6 = Panel("{2;3}")
panel_7 = Panel("{4;5}")
panel_8 = Panel("{2;-3}")
move = Move(Geometry=point_2, Motion=amplitude)  # -> simplify(Geometry), Transform
panel_9 = Panel("{1;1}")
relative_items = RelativeItems(TreeA=point_3, TreeB=move.Geometry, Offset="{5;6}", WrapPaths=False, WrapItems=False)  # -> ItemA, ItemB
point_4 = Point(relative_items.ItemA)
point_5 = Point(relative_items.ItemB)
line = Line(StartPoint=point_4, EndPoint=point_5)
loft = Loft(Curves=line, Options={Adjust=False, Closed=False, LoftEnds=0, LoftSimp=0, LoftType=0, Rebuild=10, Refit=0.01})
pipe = Pipe(Curve=line, Radius=Slider(0.1, range=0..1), Caps=2)
number_slider_3 = Slider(48, range=0..100)
surface = Surface(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)
divide_surface_2 = DivideSurface(Surface=surface, UCount=number_slider_3, VCount=number_slider_3)  # -> Points, Normals, Parameters
amplitude_2 = Amplitude(Vector=divide_surface_2.Normals, Amplitude=Slider(0.981, range=0.001..2))
vector_display = VectorDisplay(Anchor=divide_surface_2.Points, Vector=divide_surface_2.Normals)
move_2 = Move(Geometry=divide_surface_2.Points, Motion=amplitude_2)  # -> flatten(Geometry), Transform
expression = Expression(x=number_slider_3, Expression="x+1")
surface_from_points = SurfaceFromPoints(Points=move_2.Geometry, UCount=expression, Interpolate=False)
deconstruct_brep = DeconstructBrep(Brep=surface_from_points)  # -> Faces, graft(Edges), Vertices
deconstruct_brep_2 = DeconstructBrep(Brep=surface)  # -> Faces, graft(Edges), Vertices
loft_2 = Loft(
    Curves=[deconstruct_brep.Edges, deconstruct_brep_2.Edges],
    Options={Adjust=False, Closed=False, LoftEnds=0, LoftSimp=0, LoftType=0, Rebuild=10, Refit=0.01})  # -> flatten(Loft)
merge = Merge(Data1=surface_from_points, Data2=loft_2, Data3=surface)
clean_tree = CleanTree(RemoveNulls=True, RemoveInvalid=True, RemoveEmpty=False, Tree=merge)
# GH solution
# VB
# C#
# Python with RhinoCommon Only
# Pythong with RhinoScriptSyntax
# GH solution
# VB
# C#
# Python
# VB
brep_join = BrepJoin(Breps=clean_tree)  # -> Breps, Closed
panel_10 = Panel(brep_join.Breps)

surface_2 = Surface(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)  # disabled
md_slider = MDSlider(
    SliderMode=0,
    slider_value=Point(0.5647732804, 0.5101281143, 0.5),
    x_domain=Domain(0, 1),
    y_domain=Domain(0, 1),
    z_domain=Domain(0, 1))  # disabled
construct_domain_2 = ConstructDomain(DomainU=md_slider, DomainV=md_slider)  # disabled
panel_11 = Panel("2")  # disabled
number_slider_4 = Slider(1, range=0..1)  # disabled
number_slider_5 = Slider(0.503, range=0..1)  # disabled
# rc
# Full multiplicity knots at start
# Simple knots
# Full multiplicity knots at end
# P1
# A=0.2*P1+ 0.8*P2
# D=0.2*A + 0.8*B
# P2
# B=0.47*P2 + 0.53*P3
# Full multiplicity knots at start
# E=0.7*B + 0.3*C
# P3
# Full multiplicity knots in the middle
# C=0.8*P3 + 0.2*P4
# P4
# Full multiplicity knots at end
# Compare knot spacing
pipe_2 = Pipe(Curve=line, Radius=number_slider_5, Caps=2)  # disabled

isotrim = Isotrim(Surface=reparameterize(surface_2), Domain=construct_domain_2)  # disabled

deconstruct_brep_3 = DeconstructBrep(Brep=isotrim)  # -> Faces, Edges, Vertices; disabled
list_item = ListItem(List=deconstruct_brep_3.Vertices, Index=panel_11, Wrap=True)  # disabled

surface_closest_point = SurfaceClosestPoint(Point=list_item, Surface=surface_2)  # -> Point, UVPoint, Distance; disabled
evaluate_surface = EvaluateSurface(Surface=surface_2, Point=surface_closest_point.UVPoint)  # -> Point, Normal, UDirection, VDirection, Frame; disabled

amplitude_3 = Amplitude(Vector=evaluate_surface.Normal, Amplitude=number_slider_4)  # disabled
vector_display_2 = VectorDisplay(Anchor=evaluate_surface.Point, Vector=amplitude_3)  # disabled
multiplication = Multiplication(A=evaluate_surface.Normal, B=number_slider_4)  # disabled
# rs
extrude = Extrude(Base=surface_2, Direction=multiplication)  # disabled
