# Grasshopper definition SetsTree93.gh (Grasshopper 1.0.7)
# Copyright: Wickerson Studios
# plug-ins: Bifocals

image_sampler = ImageSampler(
    FilePath="C:\Users\Sculpture\Documents\2020Grasshopper\ScreenShots2019\Screenshots2020\SurfaceEditAlgorithm.PNG",
    Filter="Value",
    Interpolate=False,
    Umax=1,
    Umin=0,
    Vmax=1,
    Vmin=0,
    Wrap=1)
# Wickerson Studio
# created by: Michael Wickerson
# Grasshopper for Rhino 3D Algorithmic Modeling
# www.wickersonstudios.com
# www.michaelwickerson.com
# https://www.youtube.com/channel/UC7J48Ppcsa6oncp6d29R0xw
# https://github.com/mwickerson
# https://www.facebook.com/michael.wickerson
# https://www.linkedin.com/in/michael-wickerson-696a80156/
# https://www.grasshopper3d.com/profile/MichaelWickerson
geometry = Geometry(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)

# ----
# 1001 GRASSHOPPER DEFINITIONS
# Wickerson Studio
# 
# created by: Michael Wickerson
# 
# Grasshopper for Rhino 3D Algorithmic Modeling
# 
# www.wickersonstudios.com
# www.michaelwickerson.com
# https://www.youtube.com/channel/UC7J48Ppcsa6oncp6d29R0xw
# https://github.com/mwickerson
# https://www.facebook.com/michael.wickerson
# https://www.linkedin.com/in/michael-wickerson-696a80156/
# https://www.grasshopper3d.com/profile/MichaelWickerson
# SETS TREE 093 NODE: Data Trees
tree_branch = TreeBranch(MaintainPaths=True)

number_slider = Slider(5, range=0..10)
number_slider_2 = Slider(20, range=0..20)
number_slider_3 = Slider(5, range=0..10)
series = Series(Start=0, Step=number_slider_2, Count=number_slider)
construct_point = ConstructPoint(XCoordinate=0, YCoordinate=0, ZCoordinate=series)
series_2 = Series(Start=0, Step=number_slider_2, Count=number_slider)
unit_x = UnitX(Factor=series_2)
series_3 = Series(Start=0, Step=number_slider_2, Count=Slider(6, range=0..10))
data = Data(graft(construct_point))
move = Move(Geometry=data, Motion=unit_x)  # -> Geometry, Transform
unit_y = UnitY(Factor=series_3)
data_2 = Data(graft(move.Geometry))
move_2 = Move(Geometry=data_2, Motion=unit_y)  # -> Geometry, Transform

range = Range(Domain=Slider(100, range=0..100), Steps=number_slider)
ghpython_script = GhPythonScript(range=range)  # -> out, a; inputs range: list
# ---------- ghpython_script: Python ----------
import rhinoscriptsyntax as rs
import Rhino.Geometry as rg

#Create a list
points = []

#Create Nested Loops
for x in range:
    for y in range:
        for z in range:
            point = rg.Point3d(x,y,z)
            points.append(point)
            
#Output values
a = points
# ---------- end ghpython_script ----------

point_list = PointList(Points=move_2.Geometry, Size=Slider(6, range=0..10))
param_viewer = ParamViewer(ghpython_script.a)

param_viewer_2 = ParamViewer(move_2.Geometry)
series_4 = Series(Start=0, Step=Slider(2, range=0..10), Count=Slider(7, range=0..10))
cull_index = CullIndex(List=param_viewer_2, Indices=series_4, Wrap=True)
tree_branch_2 = TreeBranch(Tree=move_2.Geometry, Path=cull_index, MaintainPaths=True)
param_viewer_3 = ParamViewer(tree_branch_2)
cull_index_2 = CullIndex(List=tree_branch_2, Indices=[Slider(5, range=0..10), Slider(1, range=0..10)], Wrap=True)
series_5 = Series(Start=0, Step=Slider(9, range=0..10), Count=Slider(9, range=0..10))
param_viewer_4 = ParamViewer(cull_index_2)
xz_plane = XZPlane(Origin=cull_index_2)
cull_index_3 = CullIndex(List=param_viewer_4, Indices=series_5, Wrap=True)
tree_branch_3 = TreeBranch(Tree=xz_plane, Path=cull_index_3, MaintainPaths=True)
param_viewer_5 = ParamViewer(tree_branch_3)
dispatch = Dispatch(List=tree_branch_3, DispatchPattern=[True, False])  # -> ListA, flatten(ListB)
line = Line(StartPoint=dispatch.ListA, EndPoint=dispatch.ListB)
number_slider_4 = Slider(5, range=0..10)
end_points = EndPoints(Curve=line)  # -> Start, End
nurbs_curve = NurbsCurve(Vertices=end_points.End, Degree=3, Periodic=False)  # -> Curve, Length, Domain
end_points_2 = EndPoints(Curve=nurbs_curve.Curve)  # -> Start, End
# Full multiplicity knots at start
# Simple knots
# Full multiplicity knots at end
# P1
# A=0.2*P1+ 0.8*P2
# D=0.2*A + 0.8*B
# P2
# B=0.47*P2 + 0.53*P3
# Full multiplicity knots at start
# E=0.7*B + 0.3*C
# P3
# Full multiplicity knots in the middle
# C=0.8*P3 + 0.2*P4
# P4
# Full multiplicity knots at end
# Compare knot spacing
# GH solution
# VB
# C#
# Python with RhinoCommon Only
# Pythong with RhinoScriptSyntax
# GH solution
# VB
# C#
# Python
# VB
mesh_sphere = MeshSphere(Base=[end_points_2.Start, end_points_2.End], Radius=number_slider_4, UCount=10, VCount=20)
point_list_2 = PointList(Points=end_points.End, Size=number_slider_4)
# rc
# rs
pipe = Pipe(Curve=nurbs_curve.Curve, Radius=1, Caps=2)

param_viewer_6 = ParamViewer(param_viewer_2)
param_viewer_7 = ParamViewer(param_viewer_3)
param_viewer_8 = ParamViewer(xz_plane)
