# Grasshopper definition SetsTree94.gh (Grasshopper 1.0.7)
# Copyright: Wickerson Studios
# plug-ins: Bifocals

image_sampler = ImageSampler(
    FilePath="C:\Users\Sculpture\Documents\2020Grasshopper\ScreenShots2019\Screenshots2020\SurfaceEditAlgorithm.PNG",
    Filter="Value",
    Interpolate=False,
    Umax=1,
    Umin=0,
    Vmax=1,
    Vmin=0,
    Wrap=1)
# Wickerson Studio
# created by: Michael Wickerson
# Grasshopper for Rhino 3D Algorithmic Modeling
# www.wickersonstudios.com
# www.michaelwickerson.com
# https://www.youtube.com/channel/UC7J48Ppcsa6oncp6d29R0xw
# https://github.com/mwickerson
# https://www.facebook.com/michael.wickerson
# https://www.linkedin.com/in/michael-wickerson-696a80156/
# https://www.grasshopper3d.com/profile/MichaelWickerson
geometry = Geometry(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)

# ----
# 1001 GRASSHOPPER DEFINITIONS
# Wickerson Studio
# 
# created by: Michael Wickerson
# 
# Grasshopper for Rhino 3D Algorithmic Modeling
# 
# www.wickersonstudios.com
# www.michaelwickerson.com
# https://www.youtube.com/channel/UC7J48Ppcsa6oncp6d29R0xw
# https://github.com/mwickerson
# https://www.facebook.com/michael.wickerson
# https://www.linkedin.com/in/michael-wickerson-696a80156/
# https://www.grasshopper3d.com/profile/MichaelWickerson
# SETS TREE 094 NODE: Data Trees
tree_branch = TreeBranch(MaintainPaths=True)

number_slider = Slider(6, range=0..6)
number_slider_2 = Slider(12, range=0..12)
series = Series(Start=0, Step=number_slider_2, Count=number_slider)
construct_point = ConstructPoint(XCoordinate=0, YCoordinate=0, ZCoordinate=series)
series_2 = Series(Start=0, Step=number_slider_2, Count=number_slider)
unit_x = UnitX(Factor=series_2)
series_3 = Series(Start=0, Step=number_slider_2, Count=number_slider)
data = Data(graft(construct_point))
move = Move(Geometry=data, Motion=unit_x)  # -> Geometry, Transform
unit_y = UnitY(Factor=series_3)
data_2 = Data(graft(move.Geometry))
move_2 = Move(Geometry=data_2, Motion=unit_y)  # -> Geometry, Transform

range = Range(Domain=Slider(100, range=0..100), Steps=number_slider)
ghpython_script = GhPythonScript(range=range)  # -> out, a; inputs range: list
# ---------- ghpython_script: Python ----------
import rhinoscriptsyntax as rs
import Rhino.Geometry as rg

#Create a list
points = []

#Create Nested Loops
for x in range:
    for y in range:
        for z in range:
            point = rg.Point3d(x,y,z)
            points.append(point)
            
#Output values
a = points
# ---------- end ghpython_script ----------

number_slider_3 = Slider(3, range=0..6)
number_slider_4 = Slider(24, range=0..24)
series_4 = Series(Start=0, Step=number_slider_4, Count=number_slider_3)
construct_point_2 = ConstructPoint(XCoordinate=0, YCoordinate=0, ZCoordinate=series_4)
series_5 = Series(Start=0, Step=number_slider_4, Count=number_slider_3)
unit_x_2 = UnitX(Factor=series_5)
series_6 = Series(Start=0, Step=number_slider_4, Count=number_slider_3)
data_3 = Data(graft(construct_point_2))
move_3 = Move(Geometry=data_3, Motion=unit_x_2)  # -> Geometry, Transform
unit_y_2 = UnitY(Factor=series_6)
data_4 = Data(graft(move_3.Geometry))
move_4 = Move(Geometry=data_4, Motion=unit_y_2)  # -> Geometry, Transform

panel = Panel("3")
panel_2 = Panel("4")
panel_3 = Panel("-1")
panel_4 = Panel("-3")
panel_5 = Panel("-4")
panel_6 = Panel("-5")
panel_7 = Panel("0")
panel_8 = Panel("2")
point_list = PointList(Points=move_2.Geometry, Size=Slider(6, range=0..10))

number_slider_5 = Slider(2, range=0..10)
number_slider_6 = Slider(36, range=0..36)
param_viewer = ParamViewer(move_2.Geometry)
series_7 = Series(Start=0, Step=number_slider_5, Count=number_slider_6)
cull_index = CullIndex(List=param_viewer, Indices=series_7, Wrap=True)
tree_branch_2 = TreeBranch(Tree=move_2.Geometry, Path=cull_index, MaintainPaths=True)
param_viewer_2 = ParamViewer(tree_branch_2)
cull_index_2 = CullIndex(List=tree_branch_2, Indices=series_7, Wrap=True)
series_8 = Series(Start=0, Step=number_slider_5, Count=number_slider_6)
param_viewer_3 = ParamViewer(cull_index_2)
xz_plane = XZPlane(Origin=cull_index_2)
cull_index_3 = CullIndex(List=param_viewer_3, Indices=series_8, Wrap=True)
tree_branch_3 = TreeBranch(Tree=xz_plane, Path=cull_index_3, MaintainPaths=True)
param_viewer_4 = ParamViewer(tree_branch_3)
line = Line(StartPoint=tree_branch_3, EndPoint=tree_branch_3)
end_points = EndPoints(Curve=line)  # -> Start, flatten(End)
nurbs_curve = NurbsCurve(Vertices=end_points.End, Degree=3, Periodic=False)  # -> Curve, Length, Domain
number_slider_7 = Slider(5, range=0..10)
end_points_2 = EndPoints(Curve=nurbs_curve.Curve)  # -> Start, End
mesh_sphere = MeshSphere(Base=[end_points_2.Start, end_points_2.End], Radius=number_slider_7, UCount=10, VCount=20)
pipe = Pipe(Curve=nurbs_curve.Curve, Radius=1, Caps=2)
point_list_2 = PointList(Points=end_points.Start, Size=number_slider_7)

param_viewer_5 = ParamViewer(ghpython_script.a)
number_slider_8 = Slider(7, range=0..10)

path_mapper = PathMapper(move_4.Geometry, source="{A;B;C;D}(i)", target="{A;B;i;D}(C)")
list_item = ListItem(List=path_mapper, Index="-2", Wrap=True)
list_item_2 = ListItem(List=move_4.Geometry, Index="-2", Wrap=True)
line_2 = Line(StartPoint=list_item_2, EndPoint=list_item)
point_list_3 = PointList(Points=list_item, Size=number_slider_8)
point_list_4 = PointList(Points=list_item_2, Size=number_slider_8)

path_mapper_2 = PathMapper(move_4.Geometry, source="{A;B;C;D}(i)", target="{A;B;C;i}(D)")
list_item_3 = ListItem(List=path_mapper_2, Index="-2", Wrap=True)
list_item_4 = ListItem(List=move_4.Geometry, Index="-2", Wrap=True)
line_3 = Line(StartPoint=list_item_4, EndPoint=list_item_3)
point_list_5 = PointList(Points=list_item_4, Size=number_slider_8)
point_list_6 = PointList(Points=list_item_3, Size=number_slider_8)

path_mapper_3 = PathMapper(move_4.Geometry, source="{A;B;C;D}(i)", target="{A;B;i;D}(C)")
number_slider_9 = Slider(0, range=0..10)
list_item_5 = ListItem(List=path_mapper_3, Index="1", Wrap=True)
list_item_6 = ListItem(List=move_4.Geometry, Index="1", Wrap=True)
line_4 = Line(StartPoint=list_item_6, EndPoint=list_item_5)
point_list_7 = PointList(Points=list_item_6, Size=number_slider_8)
point_list_8 = PointList(Points=list_item_5, Size=number_slider_8)

path_mapper_4 = PathMapper(move_4.Geometry, source="{A;B;C;D}(i)", target="{A;B;C;i}(D)")
list_item_7 = ListItem(List=path_mapper_4, Index="1", Wrap=True)
list_item_8 = ListItem(List=move_4.Geometry, Index="1", Wrap=True)
line_5 = Line(StartPoint=list_item_8, EndPoint=list_item_7)
point_list_9 = PointList(Points=list_item_8, Size=number_slider_8)
point_list_10 = PointList(Points=list_item_7, Size=number_slider_8)

param_viewer_6 = ParamViewer(move_2.Geometry)
series_9 = Series(Start=0, Step=Slider(2, range=0..10), Count=Slider(7, range=0..10))
cull_index_4 = CullIndex(List=param_viewer_6, Indices=series_9, Wrap=True)
tree_branch_4 = TreeBranch(Tree=move_2.Geometry, Path=cull_index_4, MaintainPaths=True)
param_viewer_7 = ParamViewer(tree_branch_4)
cull_index_5 = CullIndex(List=tree_branch_4, Indices=[Slider(5, range=0..10), Slider(1, range=0..10)], Wrap=True)
series_10 = Series(Start=0, Step=Slider(9, range=0..10), Count=Slider(9, range=0..10))
param_viewer_8 = ParamViewer(cull_index_5)
xz_plane_2 = XZPlane(Origin=cull_index_5)
cull_index_6 = CullIndex(List=param_viewer_8, Indices=series_10, Wrap=True)
tree_branch_5 = TreeBranch(Tree=xz_plane_2, Path=cull_index_6, MaintainPaths=True)
param_viewer_9 = ParamViewer(tree_branch_5)
dispatch = Dispatch(List=tree_branch_5, DispatchPattern=[True, False])  # -> ListA, flatten(ListB)
line_6 = Line(StartPoint=dispatch.ListA, EndPoint=dispatch.ListB)
number_slider_10 = Slider(5, range=0..10)
end_points_3 = EndPoints(Curve=line_6)  # -> Start, End
nurbs_curve_2 = NurbsCurve(Vertices=end_points_3.End, Degree=3, Periodic=False)  # -> Curve, Length, Domain
end_points_4 = EndPoints(Curve=nurbs_curve_2.Curve)  # -> Start, End
mesh_sphere_2 = MeshSphere(Base=[end_points_4.Start, end_points_4.End], Radius=number_slider_10, UCount=10, VCount=20)
point_list_11 = PointList(Points=end_points_3.End, Size=number_slider_10)
# rc
# rs
pipe_2 = Pipe(Curve=nurbs_curve_2.Curve, Radius=1, Caps=2)

length = Length(Curve=line_3)
length_2 = Length(Curve=line_2)
length_3 = Length(Curve=line_5)
length_4 = Length(Curve=line_4)
cull_pattern = CullPattern(List=line_3, CullPattern=length)
cull_pattern_2 = CullPattern(List=line_2, CullPattern=length_2)
cull_pattern_3 = CullPattern(List=line_4, CullPattern=length_4)
cull_pattern_4 = CullPattern(List=line_5, CullPattern=length_3)
clean_tree = CleanTree(RemoveNulls=True, RemoveInvalid=True, RemoveEmpty=True, Tree=cull_pattern)
clean_tree_2 = CleanTree(RemoveNulls=True, RemoveInvalid=True, RemoveEmpty=True, Tree=cull_pattern_2)
clean_tree_3 = CleanTree(RemoveNulls=True, RemoveInvalid=True, RemoveEmpty=True, Tree=cull_pattern_3)
clean_tree_4 = CleanTree(RemoveNulls=True, RemoveInvalid=True, RemoveEmpty=True, Tree=cull_pattern_4)
range_2 = Range(Domain=Domain(0, 1), Steps=10)
merge = Merge(Data1=clean_tree_4, Data2=clean_tree_3, Data4=clean_tree_2)
end_points_5 = EndPoints(Curve=[clean_tree_4, clean_tree_3, clean_tree_2])  # -> Start, End
graph_mapper = GraphMapper(
    range_2,
    x0=0,
    x1=1,
    y0=0,
    y1=1,
    Ox=0.5327325463,
    Oy=0.4447591901,
    Px=0.6912702322,
    Py=0.8459127545,
    container_name="Parabola")
point = Point(flatten([end_points_5.End, end_points_5.Start]))
number_slider_11 = Slider(6, range=0..10)
sphere = Sphere(Base=PlaneXY(0, 0, 0), Radius=Slider(100, range=0..100))
average = Average(Input=point)
pipe_variable = PipeVariable(Curve=reparameterize(merge), Parameters=range_2, Radii=graph_mapper, Caps=2)
divide_surface = DivideSurface(Surface=sphere, UCount=number_slider_11, VCount=number_slider_11)  # -> flatten(Points), Normals, Parameters
# GH solution
# VB
# C#
# Python with RhinoCommon Only
# Pythong with RhinoScriptSyntax
# GH solution
# VB
# C#
# Python
# VB
plane_normal = PlaneNormal(Origin=divide_surface.Points, ZAxis=Vector(0, 0, 1))
# Full multiplicity knots at start
# Simple knots
# Full multiplicity knots at end
# P1
# A=0.2*P1+ 0.8*P2
# D=0.2*A + 0.8*B
# P2
# B=0.47*P2 + 0.53*P3
# Full multiplicity knots at start
# E=0.7*B + 0.3*C
# P3
# Full multiplicity knots in the middle
# C=0.8*P3 + 0.2*P4
# P4
# Full multiplicity knots at end
# Compare knot spacing
orient = Orient(Geometry=pipe_variable, Source=average, Target=plane_normal)  # -> Geometry, Transform
