# Grasshopper definition SetsTree94b.gh (Grasshopper 1.0.7)
# Copyright: Wickerson Studios
# plug-ins: Bifocals

image_sampler = ImageSampler(
    FilePath="C:\Users\Sculpture\Documents\2020Grasshopper\ScreenShots2019\Screenshots2020\SurfaceEditAlgorithm.PNG",
    Filter="Value",
    Interpolate=False,
    Umax=1,
    Umin=0,
    Vmax=1,
    Vmin=0,
    Wrap=1)
# Wickerson Studio
# created by: Michael Wickerson
# Grasshopper for Rhino 3D Algorithmic Modeling
# www.wickersonstudios.com
# www.michaelwickerson.com
# https://www.youtube.com/channel/UC7J48Ppcsa6oncp6d29R0xw
# https://github.com/mwickerson
# https://www.facebook.com/michael.wickerson
# https://www.linkedin.com/in/michael-wickerson-696a80156/
# https://www.grasshopper3d.com/profile/MichaelWickerson
geometry = Geometry(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)

path_mapper = PathMapper()

# ----
# Wickerson Studio
# 
# created by: Michael Wickerson
# 
# Grasshopper for Rhino 3D Algorithmic Modeling
# 
# www.wickersonstudios.com
# www.michaelwickerson.com
# https://www.youtube.com/channel/UC7J48Ppcsa6oncp6d29R0xw
# https://github.com/mwickerson
# https://www.facebook.com/michael.wickerson
# https://www.linkedin.com/in/michael-wickerson-696a80156/
# https://www.grasshopper3d.com/profile/MichaelWickerson
# SETS TREE 094b NODE: Data Trees
tree_branch = TreeBranch(MaintainPaths=True)

number_slider = Slider(24, range=0..24)
# 1001 GRASSHOPPER DEFINITIONS
number_slider_2 = Slider(3, range=0..6)
series = Series(Start=0, Step=number_slider, Count=number_slider_2)
construct_point = ConstructPoint(XCoordinate=0, YCoordinate=0, ZCoordinate=series)
series_2 = Series(Start=0, Step=number_slider, Count=number_slider_2)
unit_x = UnitX(Factor=series_2)
series_3 = Series(Start=0, Step=number_slider, Count=number_slider_2)
data = Data(graft(construct_point))
move = Move(Geometry=data, Motion=unit_x)  # -> Geometry, Transform
unit_y = UnitY(Factor=series_3)
data_2 = Data(graft(move.Geometry))
move_2 = Move(Geometry=data_2, Motion=unit_y)  # -> Geometry, Transform

panel = Panel("1")
panel_2 = Panel("4")
panel_3 = Panel("-1")
panel_4 = Panel("-4")
panel_5 = Panel("-5")
panel_6 = Panel("3")
panel_7 = Panel("-2")
panel_8 = Panel("0")
number_slider_3 = Slider(7, range=0..10)
range = Range(Domain=Domain(0, 1), Steps=10)
graph_mapper = GraphMapper(
    range,
    x0=0,
    x1=1,
    y0=0,
    y1=1,
    Ox=0.5327325463,
    Oy=0.4447591901,
    Px=0.6912702322,
    Py=0.8459127545,
    container_name="Parabola")
number_slider_4 = Slider(4, range=0..10)
sphere = Sphere(Base=PlaneXY(0, 0, 0), Radius=Slider(100, range=0..100))
divide_surface = DivideSurface(Surface=sphere, UCount=number_slider_4, VCount=number_slider_4)  # -> flatten(Points), Normals, Parameters
# Full multiplicity knots at start
# Simple knots
# Full multiplicity knots at end
# P1
# A=0.2*P1+ 0.8*P2
# D=0.2*A + 0.8*B
# P2
# B=0.47*P2 + 0.53*P3
# Full multiplicity knots at start
# E=0.7*B + 0.3*C
# P3
# Full multiplicity knots in the middle
# C=0.8*P3 + 0.2*P4
# P4
# Full multiplicity knots at end
# Compare knot spacing
# GH solution
# VB
# C#
# Python with RhinoCommon Only
# Pythong with RhinoScriptSyntax
# GH solution
# VB
# C#
# Python
# VB
plane_normal = PlaneNormal(Origin=divide_surface.Points, ZAxis=Vector(0, 0, 1))

path_mapper_2 = PathMapper(move_2.Geometry, source="{A;B;C;D}(i)", target="{A;B;C;i}(D)")
list_item = ListItem(List=path_mapper_2, Index="-3", Wrap=True)
list_item_2 = ListItem(List=move_2.Geometry, Index="-3", Wrap=True)
line = Line(StartPoint=list_item_2, EndPoint=list_item)
point_list = PointList(Points=list_item_2, Size=number_slider_3)
point_list_2 = PointList(Points=list_item, Size=number_slider_3)

path_mapper_3 = PathMapper(move_2.Geometry, source="{A;B;C;D}(i)", target="{A;B;i;D}(C)")
list_item_3 = ListItem(List=path_mapper_3, Index="-3", Wrap=True)
list_item_4 = ListItem(List=move_2.Geometry, Index="-3", Wrap=True)
line_2 = Line(StartPoint=list_item_4, EndPoint=list_item_3)
point_list_3 = PointList(Points=list_item_3, Size=number_slider_3)
point_list_4 = PointList(Points=list_item_4, Size=number_slider_3)

path_mapper_4 = PathMapper(move_2.Geometry, source="{A;B;C;D}(i)", target="{A;B;i;D}(C)")
number_slider_5 = Slider(0, range=0..10)
list_item_5 = ListItem(List=path_mapper_4, Index="2", Wrap=True)
list_item_6 = ListItem(List=move_2.Geometry, Index="2", Wrap=True)
line_3 = Line(StartPoint=list_item_6, EndPoint=list_item_5)
point_list_5 = PointList(Points=list_item_6, Size=number_slider_3)
point_list_6 = PointList(Points=list_item_5, Size=number_slider_3)

path_mapper_5 = PathMapper(move_2.Geometry, source="{A;B;C;D}(i)", target="{A;B;C;i}(D)")
list_item_7 = ListItem(List=path_mapper_5, Index="2", Wrap=True)
list_item_8 = ListItem(List=move_2.Geometry, Index="2", Wrap=True)
line_4 = Line(StartPoint=list_item_8, EndPoint=list_item_7)
point_list_7 = PointList(Points=list_item_8, Size=number_slider_3)
point_list_8 = PointList(Points=list_item_7, Size=number_slider_3)

length = Length(Curve=line)
length_2 = Length(Curve=line_2)
length_3 = Length(Curve=line_4)
length_4 = Length(Curve=line_3)
cull_pattern = CullPattern(List=line, CullPattern=length)
cull_pattern_2 = CullPattern(List=line_2, CullPattern=length_2)
panel_9 = Panel(length_3)
cull_pattern_3 = CullPattern(List=line_3, CullPattern=length_4)
cull_pattern_4 = CullPattern(List=line_4, CullPattern=length_3)
clean_tree = CleanTree(RemoveNulls=True, RemoveInvalid=True, RemoveEmpty=True, Tree=cull_pattern)
clean_tree_2 = CleanTree(RemoveNulls=True, RemoveInvalid=True, RemoveEmpty=True, Tree=cull_pattern_2)
clean_tree_3 = CleanTree(RemoveNulls=True, RemoveInvalid=True, RemoveEmpty=True, Tree=cull_pattern_3)
clean_tree_4 = CleanTree(RemoveNulls=True, RemoveInvalid=True, RemoveEmpty=True, Tree=cull_pattern_4)
merge = Merge(Data1=clean_tree_4, Data2=clean_tree_3, Data4=clean_tree_2)
end_points = EndPoints(Curve=[clean_tree_4, clean_tree_3, clean_tree_2])  # -> Start, End
point = Point(flatten([end_points.End, end_points.Start]))
average = Average(Input=point)
pipe_variable = PipeVariable(Curve=reparameterize(merge), Parameters=range, Radii=graph_mapper, Caps=2)
# rc
# rs
orient = Orient(Geometry=pipe_variable, Source=average, Target=plane_normal)  # -> Geometry, Transform
