# Grasshopper definition SetsTree95.gh (Grasshopper 1.0.7)
# Copyright: Wickerson Studios
# plug-ins: Bifocals

# Wickerson Studio
# 
# created by: Michael Wickerson
# 
# Grasshopper for Rhino 3D Algorithmic Modeling
# 
# www.wickersonstudios.com
# www.michaelwickerson.com
# https://www.youtube.com/channel/UC7J48Ppcsa6oncp6d29R0xw
# https://github.com/mwickerson
# https://www.facebook.com/michael.wickerson
# https://www.linkedin.com/in/michael-wickerson-696a80156/
# https://www.grasshopper3d.com/profile/MichaelWickerson
image_sampler = ImageSampler(
    FilePath="C:\Users\Sculpture\Documents\2020Grasshopper\ScreenShots2019\Screenshots2020\SurfaceEditAlgorithm.PNG",
    Filter="Value",
    Interpolate=False,
    Umax=1,
    Umin=0,
    Vmax=1,
    Vmin=0,
    Wrap=1)
# Wickerson Studio
# created by: Michael Wickerson
# Grasshopper for Rhino 3D Algorithmic Modeling
# www.wickersonstudios.com
# www.michaelwickerson.com
# https://www.youtube.com/channel/UC7J48Ppcsa6oncp6d29R0xw
# https://github.com/mwickerson
# https://www.facebook.com/michael.wickerson
# https://www.linkedin.com/in/michael-wickerson-696a80156/
# https://www.grasshopper3d.com/profile/MichaelWickerson
geometry = Geometry(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)
number_slider = Slider(3, range=0..10)

# ----
# SETS TREE 095 NODE: Data Trees
number_slider_2 = Slider(3, range=0..10)
# 1001 GRASSHOPPER DEFINITIONS
series = Series(Start=0, Step=1, Count=number_slider_2)
series_2 = Series(Start=0, Step=1, Count=number_slider_2)
construct_point = ConstructPoint(XCoordinate=series, YCoordinate=0, ZCoordinate=graft(series_2))
unit_y = UnitY(Factor=series_2)
number_slider_3 = Slider(0.42, range=0..1)
move = Move(Geometry=graft(construct_point), Motion=unit_y)  # -> Geometry, Transform
xz_plane = XZPlane(Origin=move.Geometry)
polygon = Polygon(Plane=xz_plane, Radius=number_slider_3, Segments=Slider(4, range=0..10), FilletRadius=0)  # -> Polygon, Length
point_list = PointList(Points=construct_point, Size=number_slider_3)
list_length = ListLength(List=polygon.Polygon)
param_viewer = ParamViewer(polygon.Polygon)
range = Range(Domain=Slider(0.58, range=0..1), Steps=expr("x-1", list_length))
range_2 = Range(Domain=Slider(0.12, range=0..1), Steps=expr("x-1", list_length))
area = Area(Geometry=polygon.Polygon)  # -> Area, Centroid
pi = Pi(Factor=range)
pi_2 = Pi(Factor=range_2)
negative = Negative(Value=pi_2)
rotate_3d = Rotate3D(Geometry=polygon.Polygon, Angle=pi, Center=area.Centroid, Axis=xz_plane)  # -> Geometry, Transform
param_viewer_2 = ParamViewer(rotate_3d.Geometry)
xy_plane = XYPlane(Origin=Point(0, 0, 0))
control_polygon = ControlPolygon(Curve=rotate_3d.Geometry)  # -> Polygon, Points
param_viewer_3 = ParamViewer(control_polygon.Polygon)
rotate_3d_2 = Rotate3D(Geometry=control_polygon.Polygon, Angle=negative, Center=area.Centroid, Axis=xy_plane)  # -> Geometry, Transform
loft_options = LoftOptions(Closed=Slider(1, range=0..1), Adjust=False, Rebuild=0, Refit=0, Type=Slider(3, range=0..5))
param_viewer_4 = ParamViewer(rotate_3d_2.Geometry)
loft = Loft(Curves=rotate_3d_2.Geometry, Options=loft_options)

series_3 = Series(Start=0, Step=1, Count=number_slider)
series_4 = Series(Start=0, Step=1, Count=number_slider)
construct_point_2 = ConstructPoint(XCoordinate=series_4, YCoordinate=0, ZCoordinate=graft(series_3))
unit_y_2 = UnitY(Factor=series_3)
number_slider_4 = Slider(0.42, range=0..1)
move_2 = Move(Geometry=graft(construct_point_2), Motion=unit_y_2)  # -> Geometry, Transform
xz_plane_2 = XZPlane(Origin=move_2.Geometry)
point_list_2 = PointList(Points=move_2.Geometry, Size=number_slider_4)
polygon_2 = Polygon(Plane=xz_plane_2, Radius=number_slider_4, Segments=Slider(4, range=0..10), FilletRadius=0)  # -> simplify(Polygon), Length
list_length_2 = ListLength(List=polygon_2.Polygon)
area_2 = Area(Geometry=polygon_2.Polygon)  # -> Area, Centroid
param_viewer_5 = ParamViewer(polygon.Polygon)
range_3 = Range(Domain=Slider(0.25, range=0..1), Steps=expr("x-1", list_length_2))
pi_3 = Pi(Factor=range_3)
range_4 = Range(Domain=Slider(0.24, range=0..1), Steps=expr("x-1", list_length_2))
pi_4 = Pi(Factor=range_4)
negative_2 = Negative(Value=pi_4)
xy_plane_2 = XYPlane(Origin=Point(0, 0, 0))
loft_options_2 = LoftOptions(Closed=Slider(1, range=0..1), Adjust=False, Rebuild=0, Refit=0, Type=Slider(3, range=0..5))

path_mapper = PathMapper(polygon_2.Polygon, source="{A;B}", target="{A;B}")

param_viewer_6 = ParamViewer(path_mapper)
rotate_3d_3 = Rotate3D(Geometry=path_mapper, Angle=pi_3, Center=area_2.Centroid, Axis=xz_plane_2)  # -> simplify(Geometry), Transform
path_mapper_2 = PathMapper(rotate_3d_3.Geometry, source="{A;B}(i)", target="{A;i}(B)")
path_mapper_3 = PathMapper(rotate_3d_3.Geometry, source="{A;B}(i)", target="{i;A}(B)")
path_mapper_4 = PathMapper(rotate_3d_3.Geometry, source="{A;B}(i)", target="{B;i}(A)")
path_mapper_5 = PathMapper(rotate_3d_3.Geometry, source="{A;B}(i)", target="{i;B}(A)")
param_viewer_7 = ParamViewer(rotate_3d_3.Geometry)
param_viewer_8 = ParamViewer(rotate_3d_3.Geometry)
param_viewer_9 = ParamViewer(path_mapper_2)

path_mapper_6 = PathMapper(rotate_3d_3.Geometry, source="{A;B}", target="{A;B}")

control_polygon_2 = ControlPolygon(Curve=path_mapper_6)  # -> simplify(Polygon), Points
path_mapper_7 = PathMapper(control_polygon_2.Polygon, source="{A;B}(i)", target="{i;A}(B)")
path_mapper_8 = PathMapper(control_polygon_2.Polygon, source="{A;B}(i)", target="{B;i}(A)")
path_mapper_9 = PathMapper(control_polygon_2.Polygon, source="{A;B}(i)", target="{A;i}(B)")
path_mapper_10 = PathMapper(control_polygon_2.Polygon, source="{A;B}(i)", target="{i;B}(A)")
param_viewer_10 = ParamViewer(control_polygon_2.Polygon)
rotate_3d_4 = Rotate3D(Geometry=path_mapper_8, Angle=negative_2, Center=area_2.Centroid, Axis=xy_plane_2)  # -> simplify(Geometry), Transform

path_mapper_11 = PathMapper(control_polygon_2.Polygon, source="{A;B}", target="{A;B}")
path_mapper_12 = PathMapper(rotate_3d_4.Geometry, source="{A;B}", target="{A;B}")

path_mapper_13 = PathMapper(rotate_3d_4.Geometry, source="{A;B}(i)", target="{i;A}(B)")
path_mapper_14 = PathMapper(rotate_3d_4.Geometry, source="{A;B}(i)", target="{B;i}(A)")
path_mapper_15 = PathMapper(rotate_3d_4.Geometry, source="{A;B}(i)", target="{A;i}(B)")
path_mapper_16 = PathMapper(rotate_3d_4.Geometry, source="{A;B}(i)", target="{i;B}(A)")
param_viewer_11 = ParamViewer(rotate_3d_4.Geometry)
param_viewer_12 = ParamViewer(rotate_3d_4.Geometry)
shift_paths = ShiftPaths(Data=path_mapper_13, Offset=-1)
loft_2 = Loft(Curves=path_mapper_13, Options=loft_options_2)
# rc
# rs
# Full multiplicity knots at start
# Simple knots
# Full multiplicity knots at end
# P1
# A=0.2*P1+ 0.8*P2
# D=0.2*A + 0.8*B
# P2
# B=0.47*P2 + 0.53*P3
# Full multiplicity knots at start
# E=0.7*B + 0.3*C
# P3
# Full multiplicity knots in the middle
# C=0.8*P3 + 0.2*P4
# P4
# Full multiplicity knots at end
# Compare knot spacing
# GH solution
# VB
# C#
# Python with RhinoCommon Only
# Pythong with RhinoScriptSyntax
# GH solution
# VB
# C#
# Python
# VB
panel = Panel(loft_2)
