# Grasshopper definition SetsTree96.gh (Grasshopper 1.0.7)
# Copyright: Wickerson Studios
# plug-ins: Bifocals

image_sampler = ImageSampler(
    FilePath="C:\Users\Sculpture\Documents\2020Grasshopper\ScreenShots2019\Screenshots2020\SurfaceEditAlgorithm.PNG",
    Filter="Value",
    Interpolate=False,
    Umax=1,
    Umin=0,
    Vmax=1,
    Vmin=0,
    Wrap=1)
# Wickerson Studio
# created by: Michael Wickerson
# Grasshopper for Rhino 3D Algorithmic Modeling
# www.wickersonstudios.com
# www.michaelwickerson.com
# https://www.youtube.com/channel/UC7J48Ppcsa6oncp6d29R0xw
# https://github.com/mwickerson
# https://www.facebook.com/michael.wickerson
# https://www.linkedin.com/in/michael-wickerson-696a80156/
# https://www.grasshopper3d.com/profile/MichaelWickerson
geometry = Geometry(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)
series = Series(Start=Slider(2, range=0..20), Step=Slider(1, range=0..10), Count=Slider(5, range=0..20))
multiplication = Multiplication(A=series, B=Slider(1, range=0..10))
circle = Circle(Plane=PlaneXY(0, 0, 0), Radius=multiplication)
cull_index = CullIndex(List=circle, Indices="0", Wrap=True)
curve = Curve(cull_index)
divide_curve = DivideCurve(Curve=curve, Count=Slider(6, range=0..10), Kinks=False)  # -> Points, Tangents, Parameters
series_2 = Series(Start=Slider(0, range=0..20), Step=Slider(3, range=0..10), Count=Slider(12, range=0..20))
param_viewer = ParamViewer(curve)
flip_matrix = FlipMatrix(Data=divide_curve.Points)
unit_z = UnitZ(Factor=series_2)
param_viewer_2 = ParamViewer(divide_curve.Points)
data = Data(graft(flip_matrix))
param_viewer_3 = ParamViewer(flip_matrix)
move = Move(Geometry=data, Motion=unit_z)  # -> Geometry, Transform
param_viewer_4 = ParamViewer(curve)
param_viewer_5 = ParamViewer(data)
interpolate = Interpolate(Vertices=move.Geometry, Degree=3, Periodic=False, KnotStyle=1)  # -> Curve, Length, Domain
param_viewer_6 = ParamViewer(divide_curve.Points)
param_viewer_7 = ParamViewer(move.Geometry)
param_viewer_8 = ParamViewer(move.Geometry)
path_mapper = PathMapper(move.Geometry, source="{A;B;C;D;E}(i)", target="{floor(i/100);i%10}")
param_viewer_9 = ParamViewer(flip_matrix)
path_mapper_2 = PathMapper(move.Geometry, source="{A;B;C;D;E}(i)", target="{E;i}")
param_viewer_10 = ParamViewer(data)
number_slider = Slider(0.39, range=0..4)
point_list = PointList(Points=cull_index, Size=number_slider)
point_list_2 = PointList(Points=divide_curve.Points, Size=number_slider)
point_list_3 = PointList(Points=flip_matrix, Size=number_slider)
point_list_4 = PointList(Points=data, Size=number_slider)
point_list_5 = PointList(Points=move.Geometry, Size=number_slider)
param_viewer_11 = ParamViewer(move.Geometry)

path_mapper_3 = PathMapper(move.Geometry, source="{A;B;C;D;E}(i)", target="{floor(i/(item_count^(1/3)))}")
path_mapper_4 = PathMapper(move.Geometry, source="{A;B;C;D;E}(i)", target="{floor(i/(path_count^(1/3)))}")
path_mapper_5 = PathMapper(move.Geometry, source="{A;B;C;D;E}(i)", target="{floor(i/(path_index^(1/3)))}")
point_list_6 = PointList(Points=path_mapper_3, Size=number_slider)
nurbs_curve = NurbsCurve(Vertices=path_mapper, Degree=Slider(2, range=0..3), Periodic=Slider(1, range=0..1))  # -> flatten(Curve), Length, Domain

flip_matrix_2 = FlipMatrix(Data=path_mapper_3)
param_viewer_12 = ParamViewer(path_mapper_3)
point_list_7 = PointList(Points=path_mapper, Size=number_slider)
point_list_8 = PointList(Points=path_mapper_2, Size=number_slider)
point_list_9 = PointList(Points=path_mapper_5, Size=number_slider)
point_list_10 = PointList(Points=flip_matrix_2, Size=number_slider)
point_list_11 = PointList(Points=path_mapper_4, Size=number_slider)
param_viewer_13 = ParamViewer(path_mapper_4)
param_viewer_14 = ParamViewer(path_mapper_5)
param_viewer_15 = ParamViewer(param_viewer_12)
param_viewer_16 = ParamViewer(path_mapper)
param_viewer_17 = ParamViewer(param_viewer_13)
param_viewer_18 = ParamViewer(path_mapper_2)
param_viewer_19 = ParamViewer(param_viewer_14)
pipe = Pipe(Curve=nurbs_curve.Curve, Radius=Slider(0.34, range=0..1), Caps=2)
param_viewer_20 = ParamViewer(param_viewer_16)
# GH solution
# VB
# C#
# Python with RhinoCommon Only
# Pythong with RhinoScriptSyntax
# GH solution
# VB
# C#
# Python
# VB
param_viewer_21 = ParamViewer(param_viewer_18)

# ----
# 1001 GRASSHOPPER DEFINITIONS
# Wickerson Studio
# 
# created by: Michael Wickerson
# 
# Grasshopper for Rhino 3D Algorithmic Modeling
# 
# www.wickersonstudios.com
# www.michaelwickerson.com
# https://www.youtube.com/channel/UC7J48Ppcsa6oncp6d29R0xw
# https://github.com/mwickerson
# https://www.facebook.com/michael.wickerson
# https://www.linkedin.com/in/michael-wickerson-696a80156/
# https://www.grasshopper3d.com/profile/MichaelWickerson
# SETS TREE 096 NODE: Data Trees
series_3 = Series(Start=0, Step=1, Count=Slider(4, range=0..10))
multiplication_2 = Multiplication(A=series_3, B=Slider(1.761, range=0..10))
circle_2 = Circle(Plane=PlaneXY(0, 0, 0), Radius=multiplication_2)
series_4 = Series(Start=0, Step=1, Count=Slider(10, range=0..10))
cull_index_2 = CullIndex(List=circle_2, Indices="0", Wrap=True)
curve_2 = Curve(cull_index_2)
construct_point = ConstructPoint(XCoordinate=graft(series_3), YCoordinate=series_3, ZCoordinate=0)
divide_curve_2 = DivideCurve(Curve=curve_2, Count=Slider(4, range=0..10), Kinks=False)  # -> Points, Tangents, Parameters
number_slider_2 = Slider(0.47, range=0..1)
flip_matrix_3 = FlipMatrix(Data=divide_curve_2.Points)
flip_matrix_4 = FlipMatrix(Data=construct_point)
unit_z_2 = UnitZ(Factor=series_4)
data_2 = Data(graft(flip_matrix_3))
point_list_12 = PointList(Points=flip_matrix_4, Size=number_slider_2)
point_list_13 = PointList(Points=construct_point, Size=number_slider_2)
move_2 = Move(Geometry=data_2, Motion=unit_z_2)  # -> Geometry, Transform
point_list_14 = PointList(Points=divide_curve_2.Points, Size=number_slider_2)
point_list_15 = PointList(Points=flip_matrix_3, Size=number_slider_2)
point_list_16 = PointList(Points=data_2, Size=number_slider_2)
point_list_17 = PointList(Points=move_2.Geometry, Size=number_slider_2)
number_slider_3 = Slider(2, range=0..3)
number_slider_4 = Slider(0.33, range=0..1)
path_mapper_6 = PathMapper(move_2.Geometry, source="{A;B;C;D;E}(i)", target="{floor(i/(item_count^(1/3)))}")
path_mapper_7 = PathMapper(move_2.Geometry, source="{A;B;C;D;E}(i)", target="{floor(i/100);i%10}")
path_mapper_8 = PathMapper(move_2.Geometry, source="{A;B;C;D;E}(i)", target="{i}")
path_mapper_9 = PathMapper(move_2.Geometry, source="{A;B;C;D;E}(i)", target="{i%100}")
path_mapper_10 = PathMapper(move_2.Geometry, source="{A;B;C;D;E}(i)", target="{A;B;C;D;i}(E)")
path_mapper_11 = PathMapper(move_2.Geometry, source="{A;B;C;D;E}(i)", target="{A;B;C;i;E}(D)")
path_mapper_12 = PathMapper(move_2.Geometry, source="{A;B;C;D;E}", target="{A;B;C;D;E}")
path_mapper_13 = PathMapper(move_2.Geometry, source="{A;B;C;D;E}(i)", target="{i;B}")
path_mapper_14 = PathMapper(move_2.Geometry, source="{A;B;C;D;E}(i)", target="{i}")
path_mapper_15 = PathMapper(move_2.Geometry, source="{A;B;C;D;E}", target="{B}")
path_mapper_16 = PathMapper(move_2.Geometry, source="{A;B;C;D;E}(i)", target="{E;i}")
flip_matrix_5 = FlipMatrix(Data=path_mapper_9)
flip_matrix_6 = FlipMatrix(Data=path_mapper_6)
number_slider_5 = Slider(2, range=0..3)
point_list_18 = PointList(Points=path_mapper_7, Size=number_slider_2)
point_list_19 = PointList(Points=path_mapper_10, Size=number_slider_2)
point_list_20 = PointList(Points=path_mapper_8, Size=number_slider_2)
point_list_21 = PointList(Points=flip_matrix_5, Size=number_slider_2)
point_list_22 = PointList(Points=flip_matrix_6, Size=number_slider_2)
flip_matrix_7 = FlipMatrix(Data=path_mapper_13)
point_list_23 = PointList(Points=path_mapper_16, Size=number_slider_2)
flip_matrix_8 = FlipMatrix(Data=path_mapper_13)
point_list_24 = PointList(Points=path_mapper_13, Size=number_slider_2)
point_list_25 = PointList(Points=path_mapper_13, Size=number_slider_2)
point_list_26 = PointList(Points=flip_matrix_7, Size=number_slider_2)
point_list_27 = PointList(Points=path_mapper_15, Size=number_slider_2)
point_list_28 = PointList(Points=flip_matrix_8, Size=number_slider_2)
param_viewer_22 = ParamViewer(path_mapper_7)
nurbs_curve_2 = NurbsCurve(Vertices=flip_matrix_7, Degree=number_slider_5, Periodic=False)  # -> flatten(Curve), Length, Domain
nurbs_curve_3 = NurbsCurve(Vertices=path_mapper_16, Degree=number_slider_5, Periodic=False)  # -> flatten(Curve), Length, Domain
nurbs_curve_4 = NurbsCurve(Vertices=path_mapper_6, Degree=number_slider_5, Periodic=Slider(1, range=0..1))  # -> flatten(Curve), Length, Domain
nurbs_curve_5 = NurbsCurve(Vertices=path_mapper_10, Degree=number_slider_5, Periodic=False)  # -> flatten(Curve), Length, Domain
nurbs_curve_6 = NurbsCurve(Vertices=path_mapper_15, Degree=number_slider_5, Periodic=False)  # -> flatten(Curve), Length, Domain
nurbs_curve_7 = NurbsCurve(Vertices=path_mapper_12, Degree=number_slider_5, Periodic=False)  # -> flatten(Curve), Length, Domain
nurbs_curve_8 = NurbsCurve(Vertices=path_mapper_11, Degree=number_slider_5, Periodic=False)  # -> flatten(Curve), Length, Domain
nurbs_curve_9 = NurbsCurve(Vertices=path_mapper_9, Degree=number_slider_5, Periodic=False)  # -> flatten(Curve), Length, Domain
nurbs_curve_10 = NurbsCurve(Vertices=path_mapper_7, Degree=number_slider_5, Periodic=False)  # -> flatten(Curve), Length, Domain
nurbs_curve_11 = NurbsCurve(Vertices=flip_matrix_8, Degree=number_slider_5, Periodic=False)  # -> flatten(Curve), Length, Domain
nurbs_curve_12 = NurbsCurve(Vertices=path_mapper_8, Degree=3, Periodic=False)  # -> flatten(Curve), Length, Domain
loft = Loft(
    Curves=nurbs_curve_12.Curve,
    Options={Adjust=False, Closed=False, LoftEnds=0, LoftSimp=0, LoftType=0, Rebuild=10, Refit=0.01})
loft_2 = Loft(
    Curves=nurbs_curve_5.Curve,
    Options={Adjust=False, Closed=False, LoftEnds=0, LoftSimp=0, LoftType=0, Rebuild=10, Refit=0.01})
loft_3 = Loft(
    Curves=nurbs_curve_7.Curve,
    Options={Adjust=False, Closed=False, LoftEnds=0, LoftSimp=0, LoftType=0, Rebuild=10, Refit=0.01})
loft_4 = Loft(
    Curves=nurbs_curve_4.Curve,
    Options={Adjust=False, Closed=False, LoftEnds=0, LoftSimp=0, LoftType=0, Rebuild=10, Refit=0.01})
# rc
# rs
# Full multiplicity knots at start
# Simple knots
# Full multiplicity knots at end
# P1
# A=0.2*P1+ 0.8*P2
# D=0.2*A + 0.8*B
# P2
# B=0.47*P2 + 0.53*P3
# Full multiplicity knots at start
# E=0.7*B + 0.3*C
# P3
# Full multiplicity knots in the middle
# C=0.8*P3 + 0.2*P4
# P4
# Full multiplicity knots at end
# Compare knot spacing
pipe_2 = Pipe(Curve=nurbs_curve_4.Curve, Radius=number_slider_4, Caps=2)

path_mapper_17 = PathMapper(move_2.Geometry, source="{A;B;C;D;E}(i)", target="{A;B;C;D;E}(item_count - 1 - i)")
path_mapper_18 = PathMapper(move_2.Geometry, source="{A;B;C;D;E}", target="{path_index}")
path_mapper_19 = PathMapper(move_2.Geometry, source="{A;B;C;D;E}", target="{A;B;C;D;E}")
path_mapper_20 = PathMapper(move_2.Geometry, source="{A;B;C;D;E}", target="{0}")
path_mapper_21 = PathMapper(move_2.Geometry, source="{A;B;C;D;E}(i)", target="{A;B;C;D;E;i}")
path_mapper_22 = PathMapper(move_2.Geometry, source="{A;B;C;D;E}", target="{A;B;C;D}")
point_list_29 = PointList(Points=path_mapper_21, Size=number_slider_2)
point_list_30 = PointList(Points=path_mapper_18, Size=number_slider_2)
number_slider_6 = Slider(3, range=0..3)
nurbs_curve_13 = NurbsCurve(Vertices=path_mapper_21, Degree=3, Periodic=False)  # -> Curve, Length, Domain
nurbs_curve_14 = NurbsCurve(Vertices=path_mapper_20, Degree=number_slider_6, Periodic=False)  # -> flatten(Curve), Length, Domain
nurbs_curve_15 = NurbsCurve(Vertices=path_mapper_22, Degree=number_slider_6, Periodic=False)  # -> flatten(Curve), Length, Domain
nurbs_curve_16 = NurbsCurve(Vertices=path_mapper_17, Degree=number_slider_6, Periodic=False)  # -> flatten(Curve), Length, Domain
nurbs_curve_17 = NurbsCurve(Vertices=path_mapper_19, Degree=number_slider_6, Periodic=False)  # -> flatten(Curve), Length, Domain
nurbs_curve_18 = NurbsCurve(Vertices=path_mapper_18, Degree=number_slider_6, Periodic=False)  # -> flatten(Curve), Length, Domain
loft_5 = Loft(
    Curves=nurbs_curve_15.Curve,
    Options={Adjust=False, Closed=False, LoftEnds=0, LoftSimp=0, LoftType=0, Rebuild=10, Refit=0.01})
loft_6 = Loft(
    Curves=nurbs_curve_17.Curve,
    Options={Adjust=False, Closed=False, LoftEnds=0, LoftSimp=0, LoftType=0, Rebuild=10, Refit=0.01})
loft_7 = Loft(
    Curves=nurbs_curve_16.Curve,
    Options={Adjust=False, Closed=False, LoftEnds=0, LoftSimp=0, LoftType=0, Rebuild=10, Refit=0.01})

path_mapper_23 = PathMapper(move_2.Geometry, source="{A;B;C;D;E}(i)", target="{A;B;C;D;E}(item_count - 1 - i)")
path_mapper_24 = PathMapper(move_2.Geometry, source="{A;B;C;D;E}", target="{path_index}")
path_mapper_25 = PathMapper(move_2.Geometry, source="{A;B;C;D;E}(i)", target="{A;B;C;D;i}(E)")
path_mapper_26 = PathMapper(move_2.Geometry, source="{A;B;C;D;E}(i)", target="{A;B;C+i;D}")
path_mapper_27 = PathMapper(move_2.Geometry, source="{A;B;C;D;E}", target="{A;B;C;D;0}")
path_mapper_28 = PathMapper(move_2.Geometry, source="{A;B;C;D;E}(i)", target="{A;B;C;D;E;i}")
path_mapper_29 = PathMapper(move_2.Geometry, source="{A;B;C;D;E}(i)", target="{A;B;C;D+i}")
point_list_31 = PointList(Points=path_mapper_28, Size=number_slider_2)
point_list_32 = PointList(Points=path_mapper_25, Size=number_slider_2)
point_list_33 = PointList(Points=path_mapper_26, Size=number_slider_2)
point_list_34 = PointList(Points=path_mapper_24, Size=number_slider_2)
point_list_35 = PointList(Points=path_mapper_23, Size=number_slider_2)
nurbs_curve_19 = NurbsCurve(Vertices=path_mapper_28, Degree=3, Periodic=False)  # -> Curve, Length, Domain
nurbs_curve_20 = NurbsCurve(Vertices=path_mapper_29, Degree=number_slider_3, Periodic=False)  # -> flatten(Curve), Length, Domain
nurbs_curve_21 = NurbsCurve(Vertices=path_mapper_26, Degree=number_slider_3, Periodic=False)  # -> flatten(Curve), Length, Domain
nurbs_curve_22 = NurbsCurve(Vertices=path_mapper_27, Degree=3, Periodic=False)  # -> flatten(Curve), Length, Domain
nurbs_curve_23 = NurbsCurve(Vertices=path_mapper_25, Degree=number_slider_3, Periodic=False)  # -> flatten(Curve), Length, Domain
nurbs_curve_24 = NurbsCurve(Vertices=path_mapper_23, Degree=3, Periodic=False)  # -> flatten(Curve), Length, Domain
nurbs_curve_25 = NurbsCurve(Vertices=path_mapper_24, Degree=3, Periodic=False)  # -> flatten(Curve), Length, Domain
loft_8 = Loft(
    Curves=nurbs_curve_22.Curve,
    Options={Adjust=False, Closed=False, LoftEnds=0, LoftSimp=0, LoftType=0, Rebuild=10, Refit=0.01})
loft_9 = Loft(
    Curves=nurbs_curve_20.Curve,
    Options={Adjust=False, Closed=False, LoftEnds=0, LoftSimp=0, LoftType=0, Rebuild=10, Refit=0.01})
loft_10 = Loft(
    Curves=nurbs_curve_23.Curve,
    Options={Adjust=False, Closed=False, LoftEnds=0, LoftSimp=0, LoftType=0, Rebuild=10, Refit=0.01})
loft_11 = Loft(
    Curves=nurbs_curve_21.Curve,
    Options={Adjust=False, Closed=False, LoftEnds=0, LoftSimp=0, LoftType=0, Rebuild=10, Refit=0.01})

point_list_36 = PointList(Points=path_mapper_22, Size=number_slider_2)
point_list_37 = PointList(Points=path_mapper_20, Size=number_slider_2)

point_list_38 = PointList(Points=path_mapper_29, Size=number_slider_2)
point_list_39 = PointList(Points=path_mapper_27, Size=number_slider_2)

point_list_40 = PointList(Points=path_mapper_17, Size=number_slider_2)
point_list_41 = PointList(Points=path_mapper_19, Size=number_slider_2)

point_list_42 = PointList(Points=path_mapper_11, Size=number_slider_2)
point_list_43 = PointList(Points=path_mapper_9, Size=number_slider_2)

point_list_44 = PointList(Points=path_mapper_6, Size=number_slider_2)
point_list_45 = PointList(Points=path_mapper_12, Size=number_slider_2)

shift_paths = ShiftPaths(Data=path_mapper_7, Offset=-1)
point_list_46 = PointList(Points=shift_paths, Size=number_slider_2)
nurbs_curve_26 = NurbsCurve(Vertices=shift_paths, Degree=number_slider_5, Periodic=False)  # -> flatten(Curve), Length, Domain

pipe_3 = Pipe(Curve=nurbs_curve_21.Curve, Radius=number_slider_4, Caps=2)
pipe_4 = Pipe(Curve=nurbs_curve_26.Curve, Radius=number_slider_4, Caps=2)
