# Grasshopper definition SetsTree97.gh (Grasshopper 1.0.7)
# Copyright: Wickerson Studios
# plug-ins: Bifocals

# 1001 GRASSHOPPER DEFINITIONS
# Wickerson Studio
# 
# created by: Michael Wickerson
# 
# Grasshopper for Rhino 3D Algorithmic Modeling
# 
# www.wickersonstudios.com
# www.michaelwickerson.com
# https://www.youtube.com/channel/UC7J48Ppcsa6oncp6d29R0xw
# https://github.com/mwickerson
# https://www.facebook.com/michael.wickerson
# https://www.linkedin.com/in/michael-wickerson-696a80156/
# https://www.grasshopper3d.com/profile/MichaelWickerson
image_sampler = ImageSampler(
    FilePath="C:\Users\Sculpture\Documents\2020Grasshopper\ScreenShots2019\Screenshots2020\SurfaceEditAlgorithm.PNG",
    Filter="Value",
    Interpolate=False,
    Umax=1,
    Umin=0,
    Vmax=1,
    Vmin=0,
    Wrap=1)
# Wickerson Studio
# created by: Michael Wickerson
# Grasshopper for Rhino 3D Algorithmic Modeling
# www.wickersonstudios.com
# www.michaelwickerson.com
# https://www.youtube.com/channel/UC7J48Ppcsa6oncp6d29R0xw
# https://github.com/mwickerson
# https://www.facebook.com/michael.wickerson
# https://www.linkedin.com/in/michael-wickerson-696a80156/
# https://www.grasshopper3d.com/profile/MichaelWickerson
geometry = Geometry(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)
# SETS TREE 097 NODE: Data Trees
number_slider = Slider(7, range=0..10)

series = Series(Start=0, Step=number_slider, Count=Slider(6, range=0..10))
unit_z = UnitZ(Factor=series)
construct_point = ConstructPoint(XCoordinate=series, YCoordinate=graft(series), ZCoordinate=0)
move = Move(Geometry=graft(construct_point), Motion=unit_z)  # -> Geometry, Transform
number_slider_2 = Slider(4.46, range=0..6)
point_list = PointList(Points=move.Geometry, Size=number_slider_2)
path_mapper = PathMapper(move.Geometry, source="{A;B;C;D}(i)", target="{floor(i/100);i%10}")
path_mapper_2 = PathMapper(move.Geometry, source="{A;B;C;D}(i)", target="{floor(i/(item_count^(1/3)))}")
path_mapper_3 = PathMapper(move.Geometry, source="{A;B;C;D}(i)", target="{i%100}")
path_mapper_4 = PathMapper(move.Geometry, source="{A;B;C;D}(i)", target="{A;B;C;D}(item_count - 1 - i)")
path_mapper_5 = PathMapper(move.Geometry, source="{A;B;C;D}(i)", target="{A;B;C;D}(item_count - 2 - i)")
path_mapper_6 = PathMapper(move.Geometry, source="{A;B;C;D}(i)", target="{i}")
path_mapper_7 = PathMapper(move.Geometry, source="{A;B;C;D}(i)", target="{C;i}")
path_mapper_8 = PathMapper(move.Geometry, source="{A;B;C;D}(i)", target="{A;i}")
path_mapper_9 = PathMapper(move.Geometry, source="{A;B;C;D}(i)", target="{B;i}")
path_mapper_10 = PathMapper(move.Geometry, source="{A;B;C;D}", target="{item_count}")
path_mapper_11 = PathMapper(move.Geometry, source="{A;B;C;D}", target="{path_count}")
path_mapper_12 = PathMapper(move.Geometry, source="{A;B;C;D}", target="{path_index}")
path_mapper_13 = PathMapper(move.Geometry, source="{A;B;C;D}(i)", target="{D;i}")
path_mapper_14 = PathMapper(move.Geometry, source="{A;B;C;D}(i)", target="{A;B+i}")
path_mapper_15 = PathMapper(move.Geometry, source="{A;B;C;D}(i)", target="{A;B;C;D+i}")
path_mapper_16 = PathMapper(move.Geometry, source="{A;B;C;D}(i)", target="{A;B;C+i}")
path_mapper_17 = PathMapper(move.Geometry, source="{A;B;C;D}", target="{0}")
path_mapper_18 = PathMapper(move.Geometry, source="{A;B;C;D}", target="{A;B;C;D;0}")
path_mapper_19 = PathMapper(move.Geometry, source="{A;B;C;D}", target="{A;B;C;D}")
path_mapper_20 = PathMapper(move.Geometry, source="{A;B;C;D}(i)", target="{A;B;C;i}(D)")
path_mapper_21 = PathMapper(move.Geometry, source="{A;B;C;D}(i)", target="{A;B;C;D;i}")
path_mapper_22 = PathMapper(move.Geometry, source="{A;B;C;D}", target="{A;B;C}")
path_mapper_23 = PathMapper(move.Geometry, source="{A;B;C;D}(i)", target="{A;B;i}(C)")
number_slider_3 = Slider(2, range=0..3)
point_list_2 = PointList(Points=path_mapper_19, Size=number_slider_2)
point_list_3 = PointList(Points=path_mapper_20, Size=number_slider_2)
point_list_4 = PointList(Points=path_mapper_21, Size=number_slider_2)
point_list_5 = PointList(Points=path_mapper_23, Size=number_slider_2)
point_list_6 = PointList(Points=path_mapper_4, Size=number_slider_2)
point_list_7 = PointList(Points=path_mapper_5, Size=number_slider_2)
point_list_8 = PointList(Points=path_mapper_10, Size=number_slider_2)
point_list_9 = PointList(Points=path_mapper_12, Size=number_slider_2)
point_list_10 = PointList(Points=path_mapper_18, Size=number_slider_2)
point_list_11 = PointList(Points=path_mapper_15, Size=number_slider_2)
point_list_12 = PointList(Points=path_mapper_16, Size=number_slider_2)
point_list_13 = PointList(Points=path_mapper_14, Size=number_slider_2)
point_list_14 = PointList(Points=path_mapper_6, Size=number_slider_2)
point_list_15 = PointList(Points=path_mapper_11, Size=number_slider_2)
point_list_16 = PointList(Points=path_mapper_3, Size=number_slider_2)
point_list_17 = PointList(Points=path_mapper_8, Size=number_slider_2)
point_list_18 = PointList(Points=path_mapper_7, Size=number_slider_2)
point_list_19 = PointList(Points=path_mapper_9, Size=number_slider_2)
point_list_20 = PointList(Points=path_mapper, Size=number_slider_2)
point_list_21 = PointList(Points=path_mapper_13, Size=number_slider_2)
point_list_22 = PointList(Points=path_mapper_2, Size=number_slider_2)
param_viewer = ParamViewer(path_mapper_19)
param_viewer_2 = ParamViewer(path_mapper_20)
param_viewer_3 = ParamViewer(path_mapper_17)
param_viewer_4 = ParamViewer(path_mapper_21)
param_viewer_5 = ParamViewer(path_mapper_22)
param_viewer_6 = ParamViewer(path_mapper_23)
param_viewer_7 = ParamViewer(path_mapper_4)
param_viewer_8 = ParamViewer(path_mapper_5)
param_viewer_9 = ParamViewer(path_mapper_10)
param_viewer_10 = ParamViewer(path_mapper_11)
param_viewer_11 = ParamViewer(path_mapper_15)
param_viewer_12 = ParamViewer(path_mapper_16)
param_viewer_13 = ParamViewer(path_mapper_14)
param_viewer_14 = ParamViewer(path_mapper_6)
param_viewer_15 = ParamViewer(path_mapper_12)
param_viewer_16 = ParamViewer(path_mapper_18)
param_viewer_17 = ParamViewer(path_mapper_3)
param_viewer_18 = ParamViewer(path_mapper_2)
param_viewer_19 = ParamViewer(path_mapper_13)
param_viewer_20 = ParamViewer(path_mapper)
param_viewer_21 = ParamViewer(path_mapper_7)
param_viewer_22 = ParamViewer(path_mapper_9)
param_viewer_23 = ParamViewer(path_mapper_8)
number_slider_4 = Slider(0.9, range=0..1)
nurbs_curve = NurbsCurve(Vertices=path_mapper_19, Degree=number_slider_3, Periodic=False)  # -> Curve, Length, Domain
nurbs_curve_2 = NurbsCurve(Vertices=path_mapper_20, Degree=number_slider_3, Periodic=False)  # -> Curve, Length, Domain
nurbs_curve_3 = NurbsCurve(Vertices=path_mapper_22, Degree=number_slider_3, Periodic=False)  # -> Curve, Length, Domain
nurbs_curve_4 = NurbsCurve(Vertices=path_mapper_23, Degree=number_slider_3, Periodic=False)  # -> Curve, Length, Domain
nurbs_curve_5 = NurbsCurve(Vertices=path_mapper_5, Degree=Slider(1, range=0..3), Periodic=False)  # -> Curve, Length, Domain
nurbs_curve_6 = NurbsCurve(Vertices=path_mapper_10, Degree=number_slider_3, Periodic=False)  # -> Curve, Length, Domain
nurbs_curve_7 = NurbsCurve(Vertices=path_mapper_11, Degree=number_slider_3, Periodic=False)  # -> Curve, Length, Domain
nurbs_curve_8 = NurbsCurve(Vertices=path_mapper_12, Degree=number_slider_3, Periodic=False)  # -> Curve, Length, Domain
nurbs_curve_9 = NurbsCurve(Vertices=path_mapper_18, Degree=number_slider_3, Periodic=False)  # -> Curve, Length, Domain
nurbs_curve_10 = NurbsCurve(Vertices=path_mapper_15, Degree=number_slider_3, Periodic=False)  # -> Curve, Length, Domain
nurbs_curve_11 = NurbsCurve(Vertices=path_mapper_16, Degree=number_slider_3, Periodic=False)  # -> Curve, Length, Domain
nurbs_curve_12 = NurbsCurve(Vertices=path_mapper_14, Degree=number_slider_3, Periodic=False)  # -> Curve, Length, Domain
nurbs_curve_13 = NurbsCurve(Vertices=path_mapper_6, Degree=number_slider_3, Periodic=False)  # -> Curve, Length, Domain
nurbs_curve_14 = NurbsCurve(Vertices=path_mapper_4, Degree=number_slider_3, Periodic=False)  # -> Curve, Length, Domain
nurbs_curve_15 = NurbsCurve(Vertices=path_mapper_17, Degree=3, Periodic=False)  # -> Curve, Length, Domain
nurbs_curve_16 = NurbsCurve(Vertices=path_mapper_21, Degree=3, Periodic=False)  # -> Curve, Length, Domain
nurbs_curve_17 = NurbsCurve(Vertices=path_mapper_3, Degree=number_slider_3, Periodic=False)  # -> Curve, Length, Domain
nurbs_curve_18 = NurbsCurve(Vertices=path_mapper, Degree=number_slider_3, Periodic=False)  # -> Curve, Length, Domain
nurbs_curve_19 = NurbsCurve(Vertices=path_mapper_2, Degree=number_slider_3, Periodic=False)  # -> Curve, Length, Domain
nurbs_curve_20 = NurbsCurve(Vertices=path_mapper_13, Degree=number_slider_3, Periodic=False)  # -> Curve, Length, Domain
nurbs_curve_21 = NurbsCurve(Vertices=path_mapper_7, Degree=number_slider_3, Periodic=False)  # -> Curve, Length, Domain
nurbs_curve_22 = NurbsCurve(Vertices=path_mapper_9, Degree=number_slider_3, Periodic=False)  # -> Curve, Length, Domain
nurbs_curve_23 = NurbsCurve(Vertices=path_mapper_8, Degree=number_slider_3, Periodic=False)  # -> Curve, Length, Domain
pipe = Pipe(Curve=nurbs_curve_14.Curve, Radius=number_slider_4, Caps=2)
pipe_2 = Pipe(Curve=nurbs_curve_15.Curve, Radius=number_slider_4, Caps=2)
pipe_3 = Pipe(Curve=nurbs_curve_16.Curve, Radius=number_slider_4, Caps=2)
pipe_4 = Pipe(Curve=nurbs_curve_3.Curve, Radius=number_slider_4, Caps=2)
pipe_5 = Pipe(Curve=nurbs_curve_5.Curve, Radius=number_slider_4, Caps=2)
pipe_6 = Pipe(Curve=nurbs_curve_6.Curve, Radius=number_slider_4, Caps=2)
pipe_7 = Pipe(Curve=nurbs_curve_7.Curve, Radius=number_slider_4, Caps=2)
pipe_8 = Pipe(Curve=nurbs_curve_8.Curve, Radius=number_slider_4, Caps=2)
pipe_9 = Pipe(Curve=nurbs_curve_9.Curve, Radius=number_slider_4, Caps=2)
pipe_10 = Pipe(Curve=nurbs_curve_10.Curve, Radius=number_slider_4, Caps=2)
pipe_11 = Pipe(Curve=nurbs_curve_11.Curve, Radius=number_slider_4, Caps=2)
pipe_12 = Pipe(Curve=nurbs_curve_13.Curve, Radius=number_slider_4, Caps=2)
pipe_13 = Pipe(Curve=nurbs_curve_17.Curve, Radius=number_slider_4, Caps=2)
pipe_14 = Pipe(Curve=nurbs_curve_12.Curve, Radius=number_slider_4, Caps=2)
pipe_15 = Pipe(Curve=nurbs_curve_19.Curve, Radius=number_slider_4, Caps=2)
pipe_16 = Pipe(Curve=nurbs_curve_18.Curve, Radius=number_slider_4, Caps=2)
pipe_17 = Pipe(Curve=nurbs_curve_21.Curve, Radius=number_slider_4, Caps=2)
pipe_18 = Pipe(Curve=nurbs_curve_22.Curve, Radius=number_slider_4, Caps=2)
pipe_19 = Pipe(Curve=nurbs_curve_23.Curve, Radius=number_slider_4, Caps=2)
pipe_20 = Pipe(Curve=nurbs_curve_20.Curve, Radius=number_slider_4, Caps=2)
pipe_21 = Pipe(Curve=nurbs_curve.Curve, Radius=number_slider_4, Caps=2)
pipe_22 = Pipe(Curve=nurbs_curve_2.Curve, Radius=number_slider_4, Caps=2)
# rc
# rs
pipe_23 = Pipe(Curve=nurbs_curve_4.Curve, Radius=number_slider_4, Caps=2)

point_list_23 = PointList(Points=move.Geometry, Size=Slider(6, range=0..10))

path_mapper_24 = PathMapper(move.Geometry, source="{A;B;C;D}(i)", target="{floor(i/(item_count^(1/3)))}")
path_mapper_25 = PathMapper(move.Geometry, source="{A;B;C;D}(i)", target="{floor(i/(path_count^(1/3)))}")
path_mapper_26 = PathMapper(move.Geometry, source="{A;B;C;D}(i)", target="{floor(i/(path_index^(1/3)))}")
point_list_24 = PointList(Points=path_mapper_24, Size=number_slider_2)
point_list_25 = PointList(Points=path_mapper_25, Size=number_slider_2)
point_list_26 = PointList(Points=path_mapper_26, Size=number_slider_2)
param_viewer_24 = ParamViewer(path_mapper_24)
param_viewer_25 = ParamViewer(path_mapper_25)
param_viewer_26 = ParamViewer(path_mapper_26)
nurbs_curve_24 = NurbsCurve(Vertices=path_mapper_24, Degree=number_slider_3, Periodic=False)  # -> Curve, Length, Domain
nurbs_curve_25 = NurbsCurve(Vertices=path_mapper_25, Degree=number_slider_3, Periodic=False)  # -> Curve, Length, Domain
nurbs_curve_26 = NurbsCurve(Vertices=path_mapper_26, Degree=3, Periodic=False)  # -> Curve, Length, Domain

point_list_27 = PointList(Points=path_mapper_17, Size=number_slider_2)
point_list_28 = PointList(Points=path_mapper_22, Size=number_slider_2)

pipe_24 = Pipe(Curve=nurbs_curve_25.Curve, Radius=number_slider_4, Caps=2)
pipe_25 = Pipe(Curve=nurbs_curve_24.Curve, Radius=number_slider_4, Caps=2)
# Full multiplicity knots at start
# Simple knots
# Full multiplicity knots at end
# P1
# A=0.2*P1+ 0.8*P2
# D=0.2*A + 0.8*B
# P2
# B=0.47*P2 + 0.53*P3
# Full multiplicity knots at start
# E=0.7*B + 0.3*C
# P3
# Full multiplicity knots in the middle
# C=0.8*P3 + 0.2*P4
# P4
# Full multiplicity knots at end
# Compare knot spacing
# GH solution
# VB
# C#
# Python with RhinoCommon Only
# Pythong with RhinoScriptSyntax
# GH solution
# VB
# C#
# Python
# VB
pipe_26 = Pipe(Curve=nurbs_curve_26.Curve, Radius=number_slider_4, Caps=2)
