# Grasshopper definition SetsTree99.gh (Grasshopper 1.0.7)
# Copyright: Wickerson Studios
# plug-ins: Bifocals

image_sampler = ImageSampler(
    FilePath="C:\Users\Sculpture\Documents\2020Grasshopper\ScreenShots2019\Screenshots2020\SurfaceEditAlgorithm.PNG",
    Filter="Value",
    Interpolate=False,
    Umax=1,
    Umin=0,
    Vmax=1,
    Vmin=0,
    Wrap=1)
# Wickerson Studio
# created by: Michael Wickerson
# Grasshopper for Rhino 3D Algorithmic Modeling
# www.wickersonstudios.com
# www.michaelwickerson.com
# https://www.youtube.com/channel/UC7J48Ppcsa6oncp6d29R0xw
# https://github.com/mwickerson
# https://www.facebook.com/michael.wickerson
# https://www.linkedin.com/in/michael-wickerson-696a80156/
# https://www.grasshopper3d.com/profile/MichaelWickerson
geometry = Geometry(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)
range = Range(Domain=Domain(0, 1), Steps=10)
graph_mapper = GraphMapper(
    range,
    x0=0,
    x1=1,
    y0=0,
    y1=1,
    Ox=0.524638772,
    Oy=0.2855074406,
    Px=0.710144937,
    Py=0.702898562,
    container_name="Parabola")

# ----
# 1001 GRASSHOPPER DEFINITIONS
# Wickerson Studio
# 
# created by: Michael Wickerson
# 
# Grasshopper for Rhino 3D Algorithmic Modeling
# 
# www.wickersonstudios.com
# www.michaelwickerson.com
# https://www.youtube.com/channel/UC7J48Ppcsa6oncp6d29R0xw
# https://github.com/mwickerson
# https://www.facebook.com/michael.wickerson
# https://www.linkedin.com/in/michael-wickerson-696a80156/
# https://www.grasshopper3d.com/profile/MichaelWickerson
# SETS TREE 098 NODE: Data Trees
number_slider = Slider(2.98, range=0..6)
series = Series(Start=0, Step=Slider(10, range=0..10), Count=Slider(3, range=0..10))
series_2 = Series(Start=0, Step=Slider(4, range=0..10), Count=Slider(40, range=0..40))
construct_point = ConstructPoint(XCoordinate=series, YCoordinate=graft(series), ZCoordinate=0)
unit_z = UnitZ(Factor=series_2)
point_list = PointList(Points=construct_point, Size=number_slider)
move = Move(Geometry=graft(construct_point), Motion=unit_z)  # -> Geometry, Transform
path_mapper = PathMapper(move.Geometry, source="{A;B;C;D}(i)", target="{floor(i/(path_index^(1/3)))}")
point_list_2 = PointList(Points=move.Geometry, Size=number_slider)
param_viewer = ParamViewer(path_mapper)
nurbs_curve = NurbsCurve(Vertices=path_mapper, Degree=Slider(3, range=1..3), Periodic=False)  # -> Curve, Length, Domain
point_list_3 = PointList(Points=path_mapper, Size=number_slider)
pipe = Pipe(Curve=nurbs_curve.Curve, Radius=Slider(1.81, range=0..6), Caps=2)  # -> flatten(Pipe)

pipe_variable = PipeVariable(Curve=reparameterize(nurbs_curve.Curve), Parameters=range, Radii=graph_mapper, Caps=1)  # -> flatten(Pipe)

list_length = ListLength(List=pipe_variable)
range_2 = Range(Domain=Slider(4, range=0..4), Steps=expr("x-1", list_length))
pi = Pi(Factor=range_2)
rotate_3d = Rotate3D(Geometry=pipe_variable, Angle=pi, Center=Point(0, 0, 0), Axis=Vector(0, 0, 1))  # -> Geometry, Transform
# rc
# rs
# Full multiplicity knots at start
# Simple knots
# Full multiplicity knots at end
# P1
# A=0.2*P1+ 0.8*P2
# D=0.2*A + 0.8*B
# P2
# B=0.47*P2 + 0.53*P3
# Full multiplicity knots at start
# E=0.7*B + 0.3*C
# P3
# Full multiplicity knots in the middle
# C=0.8*P3 + 0.2*P4
# P4
# Full multiplicity knots at end
# Compare knot spacing
# GH solution
# VB
# C#
# Python with RhinoCommon Only
# Pythong with RhinoScriptSyntax
# GH solution
# VB
# C#
# Python
# VB
list_item = ListItem(List=rotate_3d.Geometry, Index=Slider(38, range=0..100), Wrap=True)
