# Grasshopper definition Vectors113b.gh (Grasshopper 1.0.7)
# Copyright: Wickerson Studios
# plug-ins: Bifocals

image_sampler = ImageSampler(
    FilePath="C:\Users\Sculpture\Documents\2020Grasshopper\ScreenShots2019\Screenshots2020\SurfaceEditAlgorithm.PNG",
    Filter="Value",
    Interpolate=False,
    Umax=1,
    Umin=0,
    Vmax=1,
    Vmin=0,
    Wrap=1)

# ----
# Wickerson Studio
# created by: Michael Wickerson
# Grasshopper for Rhino 3D Algorithmic Modeling
# www.wickersonstudios.com
# www.michaelwickerson.com
# https://www.youtube.com/channel/UC7J48Ppcsa6oncp6d29R0xw
# https://github.com/mwickerson
# https://www.facebook.com/michael.wickerson
# https://www.linkedin.com/in/michael-wickerson-696a80156/
# https://www.grasshopper3d.com/profile/MichaelWickerson
number_slider = Slider(10, range=0..10)
# 1001 GRASSHOPPER DEFINITIONS
# Wickerson Studio
# 
# created by: Michael Wickerson
# 
# Grasshopper for Rhino 3D Algorithmic Modeling
# 
# www.wickersonstudios.com
# www.michaelwickerson.com
# https://www.youtube.com/channel/UC7J48Ppcsa6oncp6d29R0xw
# https://github.com/mwickerson
# https://www.facebook.com/michael.wickerson
# https://www.linkedin.com/in/michael-wickerson-696a80156/
# https://www.grasshopper3d.com/profile/MichaelWickerson
# VECTOR PLANE 113/1001 NODE: Planes
sphere = Sphere(Base=PlaneXY(0, 0, 0), Radius=1)
divide_surface = DivideSurface(Surface=sphere, UCount=number_slider, VCount=number_slider)  # -> Points, Normals, Parameters
construct_plane = ConstructPlane(Origin=divide_surface.Points, XAxis=Vector(1, 0, 0), YAxis=Vector(0, 1, 0))
adjust_plane = AdjustPlane(Plane=construct_plane, Normal=divide_surface.Normals)
list_length = ListLength(List=adjust_plane)
range = Range(Domain=Slider(1.21, range=0..2), Steps=expr("x-1", list_length))
pi = Pi(Factor=range)
number_slider_2 = Slider(0.37, range=0..1)
rotate_plane = RotatePlane(Plane=adjust_plane, Angle=pi)
number_slider_3 = Slider(10, range=0..10)
deconstruct_plane = DeconstructPlane(Plane=rotate_plane)  # -> Origin, XAxis, YAxis, ZAxis
cylinder = Cylinder(Base=rotate_plane, Radius=number_slider_2, Length=number_slider_2)
plane_coordinates = PlaneCoordinates(Point=deconstruct_plane.Origin, System=PlaneXY(0, 0, 0))  # -> XCoordinate, YCoordinate, ZCoordinate
divide_surface_2 = DivideSurface(Surface=cylinder, UCount=number_slider_3, VCount=number_slider_3)  # -> simplify(Points), Normals, Parameters
vector_display = VectorDisplay(Anchor=deconstruct_plane.ZAxis, Vector=deconstruct_plane.ZAxis)
panel = Panel(plane_coordinates.XCoordinate)
path_mapper = PathMapper(divide_surface_2.Points, source="{A;B;C}(i)", target="{A;B;C}(i-1)")
panel_2 = Panel(plane_coordinates.YCoordinate)
param_viewer = ParamViewer(divide_surface_2.Points)
panel_3 = Panel(plane_coordinates.ZCoordinate)
path_mapper_2 = PathMapper(path_mapper, source="{A;B;C}(i)", target="{A;B;C}(i/(path_count/(1/1)))")
point = Point(path_mapper)
param_viewer_2 = ParamViewer(path_mapper)
point_2 = Point(path_mapper_2)
split_tree = SplitTree(Data=path_mapper_2, Masks=flatten("{0;?;0,2,...}[?]"))  # -> Positive, Negative
split_tree_2 = SplitTree(Data=path_mapper_2, Masks=flatten("{0;?;1,3,...}[?]"))  # -> Positive, Negative
number_slider_4 = Slider(1, range=0..1)
param_viewer_3 = ParamViewer(path_mapper_2)
point_3 = Point(split_tree.Negative)
point_4 = Point(split_tree.Positive)
point_5 = Point(split_tree_2.Positive)
clean_tree = CleanTree(RemoveNulls=True, RemoveInvalid=True, RemoveEmpty=number_slider_4, Tree=point_4)
clean_tree_2 = CleanTree(RemoveNulls=True, RemoveInvalid=True, RemoveEmpty=number_slider_4, Tree=point_5)
line = Line(StartPoint=clean_tree, EndPoint=clean_tree_2)
# rc
# Full multiplicity knots at start
# Simple knots
# Full multiplicity knots at end
# P1
# A=0.2*P1+ 0.8*P2
# D=0.2*A + 0.8*B
# P2
# B=0.47*P2 + 0.53*P3
# Full multiplicity knots at start
# E=0.7*B + 0.3*C
# P3
# Full multiplicity knots in the middle
# C=0.8*P3 + 0.2*P4
# P4
# Full multiplicity knots at end
# Compare knot spacing
# GH solution
# VB
# C#
# Python with RhinoCommon Only
# Pythong with RhinoScriptSyntax
# GH solution
# VB
# C#
# Python
# VB
mesh_sphere = MeshSphere(Base=point_3, Radius=Slider(0.046, range=0..1), UCount=10, VCount=20)
# rs
pipe = Pipe(Curve=line, Radius=Slider(0.09, range=0..1), Caps=2)
